# Grasshopper definition BIMage_0.1.gh (Grasshopper 1.0.7)
# plug-ins: TextToNumbers, ViewportExporterRotMat, XMPparser, ReOrderToElementBasedTree, EleFront, Rhino.Inside for Autodesk Revit, visibleElements, ElementDisplacementImgCoordSyst, ImportExternalTree, ElementDisplacementBimCoordSyst, FindOptimalImages, ViewportExporterElmtGrid, CreateSearchGrid, FindOptimalImagesZ, GetNumberOfVisibleElements, ViewportExporterVectorBased, findOptimalDisplacedElement, FindOptimalZdisplacement

# ----
# Actions
# Actions
run = BooleanToggle(False)
run_2 = BooleanToggle(False)
run_3 = BooleanToggle(False)
run_4 = BooleanToggle(True)

# ----
# Inputs
# Inputs
method_gradient = ValueList({"2_Dir", "hor_Dir", "ver_Dir"}, selected="2_Dir")
method_similarity = ValueList({"immse", "corr2D", "mult", "MI"}, selected="corr2D")
export_comparison_imgs = BooleanToggle(False)
rendering_type = ValueList({"Wireframe", "Shaded", "Rendered", "X-ray"}, selected="Shaded")
rendering_type_2 = ValueList({"Wireframe", "Shaded", "Rendered", "X-ray"}, selected="Shaded")
intermediate_images_export_path = FilePath("D:\Data\Work data\Phd\11_analyses\BIMage\Democo leopoldskazerne\Complete_img&BIMduplicates\BIM-based approach\05_similarities\")
brute_force_bimages_directory_z = FilePath("D:\Data\Work data\Phd\11_analyses\BIMage\Democo leopoldskazerne\Complete_img&BIMduplicates\BIM-based approach\04_BIMagesBruteForcingDisplacement Z\")
distance_between_images = Slider(13, range=0..20)
number_of_images = Slider(10, range=0..20)
view_type = ValueList({"Perspective", "Top", "Front", "Right"}, selected="Perspective")
view_type_2 = ValueList({"Perspective", "Top", "Front", "Right"}, selected="Perspective")
enable_mask = BooleanToggle(False)
priority_axis = ValueList({"X", "Y", "Z"}, selected="Z")
max_movement_mm = Number(90)
xmp_files_directory = FilePath("D:\Data\Work data\Phd\11_analyses\BIMage\Democo leopoldskazerne\Complete_img&BIMduplicates\BIM-based approach\01_RealImagesXMP\")
cam_directory = FilePath("D:\Data\Work data\Phd\11_analyses\BIMage\Democo leopoldskazerne\Complete_img&BIMduplicates\BIM-based approach\00_RealImages\")
stride_mm = Number(3)
columns = Geometry([<brep referenced from the Rhino model> x33])

panel = Panel(cam_directory)

# ----
# Revit to Rhino
text = Text(["Walls", "Floors", "Structural Columns"])
# Geometry
query_categories = QueryCategories(Type=1, Parent=null, Name=text)
category_filter = CategoryFilter(Categories=query_categories, Inverted=False)
query_elements = QueryElements(Filter=category_filter, Limit=100)  # -> Elements, Count
element_geometry = ElementGeometry(Elements=flatten(query_elements.Elements))  # -> flatten(Geometry)
brep = Brep()

# ----
# Data preparation
# 1. Revit to Rhino - color encoding in elements
# Settings to set in Rhino Display options
# for the Perspective viewport:
# 
# Shaded tab:
# - background = black
# - shade vertex color in object's color
# - backface settings: cull backfaces
# - lighting method = no lighting
# 
# Shaded < Grid tab:
# - grid usage: use mode specific setting
# --> disable all
# 
# Shaded < Objects < Surfaces tab:
# - surface edge settings:
#           edge thickness =1px
# 
# OpenGL tab:
# - Anti-aliasing = none
# If elements in the GH canvas
# are missing that's because Rhino
# is not fired up from inside Revit
# (using the Revit addin 'Rhino.Inside').
# Select the geometries present in the
# Rhino file as input geometries instead.
# 2. Read in the recorded imagery parameters
# Output (2)
xmpparser = XMPparser(ImagesLocation=cam_directory, XMPFilesLocation=xmp_files_directory, Run=run_4)  # -> flatten(Names), flatten(Locations), flatten(Rotations), flatten(ImageWidth), flatten(ImageHeight), flatten(FocalLength)

# ----
# Update camera locations to
# BIM coordinate system
# Error catching &
# conversion
vector_xyz = VectorXYZ(XComponent=104659.911, YComponent=192394.387, ZComponent=24.4)  # -> Vector, Length
ignore_z_component = VectorXYZ(XComponent=13.3367, YComponent=-5.853, ZComponent=0)  # -> Vector, Length
subtraction = Subtraction(A=xmpparser.Locations, B=vector_xyz.Vector)
addition = Addition(A=ignore_z_component.Vector, B=subtraction)

# ----
# Rhino geometries
original_bim_elements = Geometry([<brep referenced from the Rhino model> x40])
reverse_list = ReverseList(List=original_bim_elements)

area = Area(Geometry=reverse_list)  # -> Area, Centroid
area_2 = Area(Geometry=columns)  # -> Area, Centroid
set_difference = SetDifference(SetA=area.Centroid, SetB=area_2.Centroid)
item_index = ItemIndex(List=area.Centroid, Item=set_difference)
list_item = ListItem(List=reverse_list, Index=item_index, Wrap=True)
geometry = Geometry(list_item)

# ----
# BIM elements
list_length = ListLength(List=reverse_list)

# ----
# erroneous determination of focal lengths for DJI-images in RC
# --> update to correct value
duplicate_data = DuplicateData(Data=23.905, Number=242, Order=True)  # -> flatten(Data)
split_list = SplitList(List=xmpparser.FocalLength, Index=242)  # -> flatten(ListA), flatten(ListB)
merge = Merge(Data1=duplicate_data, Data2=split_list.ListB)

# ----
# Experiments
nrofvisibleelements = Number([3, 3, 3, 3, 3, 3, 3, 3, 2, 2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])

# ----
# Convert to matrices
texttonumbers = TextToNumbers(Text=xmpparser.Rotations)  # -> simplify(NrS)
construct_matrix = ConstructMatrix(Rows=3, Columns=3, Values=texttonumbers)  # -> flatten(Matrix)

# ----
# Determine number of visible elements (of the selected subset)
# that are visible for each image stand point
getnumberofvisibleelements = GetNumberOfVisibleElements(
    Elmts_geometry=columns,
    Cam_names=xmpparser.Names,
    Cam_Locations=addition,
    Cam_RotationMatrices=construct_matrix,
    Cam_Widths=xmpparser.ImageWidth,
    Cam_Height=xmpparser.ImageHeight,
    Cam_FocalLength35mm=merge,
    ViewType=view_type,
    RenderingType=rendering_type,
    Run=run)

# ----
# Representation
series = Series(Start=0, Step=1, Count=list_length)
addition_2 = Addition(A=series, B=1)

# ----
# Select the geometries of the new dataset
correct_z_bim_elements = Geometry([<brep referenced from the Rhino model> x40])

# ----
# Experiments: these are the input parameters
# (otherwise different set every time I reopen R+GH because
# some entries are equally ranked and thus picked on random basis)
optimal_camera_names_z = Text(["IMG_8858", "IMG_8844", "IMG_8942", "IMG_8923", "IMG_8796", "IMG_8806", "IMG_8825", "IMG_8978", "IMG_9045", "IMG_8885"])
optimal_camera_locations_z = Vector([Vector(84.510666, 171.727962, -0.735436), Vector(82.602965, 187.176454, -0.750258), Vector(37.866589, 164.811739, -0.741346), Vector(37.704706, 178.765825, -0.760008), Vector(36.998533, 192.007659, -0.736462), Vector(50.759456, 193.541228, -0.737923), Vector(71.721255, 196.472033, -0.720676), Vector(60.203584, 178.773077, -0.75447), Vector(69.474753, 169.651567, -0.755566), Vector(51.696601, 164.461235, -0.805664)])
optimal_camera_ids_z = Number([310, 296, 394, 375, 248, 258, 277, 430, 497, 337])

# ----
# Colouring
construct_domain = ConstructDomain(DomainStart=0, DomainEnd=expr("x-1", list_length))
domain = Domain(Domain(0, 255))
colour_rgb = ColourRGB(Alpha=255, Red=addition_2, Green=0, Blue=0)
remap_numbers = RemapNumbers(Value=series, Source=construct_domain, Target=domain)  # -> Mapped, Clipped

# ----
# Bake Elements
panel_2 = Panel("BIM_original")
define_layer = DefineLayer(Name=panel_2)
define_object_attributes = DefineObjectAttributes(Name=addition_2, Layer=define_layer, Color=colour_rgb)
bake_objects = BakeObjects(Geometry=reverse_list, Attributes=define_object_attributes, BakeName=panel_2, Bake=False)

# ----
# Stored on disk
# Experiments:
# best results:
# - corr2D method
# - 2Dir gradient
# - Disabled mask
vector = Vector([Vector(0, 0, 0.057), Vector(0, 0, 0.052), Vector(0, 0, 0.052), Vector(0, 0, 0.044), Vector(0, 0, 0.047), Vector(0, 0, 0.037), Vector(0, 0, -0.013), Vector(0, 0, 0.03), Vector(0, 0, 0.06), Vector(0, 0, 0.057)])
vector_2 = Vector(Vector(0, 0, 0.047))

# ----
# 3. Determine ideal images to determine correct Z coordinates
# Output (3)
# 4. Create duplicate BIMages of displaced dataset in Z  (Brute-force)
# 5. Determine optimal displacement in Z
# Output (5)
# 6. Bake correctly placed (in Z) dataset
# Determination Z
createsearchgrid = CreateSearchGrid(Movement=expr("x/1000", max_movement_mm), Stride=expr("x/1000", stride_mm), PriorityAxis=priority_axis)
list_item_2 = ListItem(List=xmpparser.ImageWidth, Index=optimal_camera_ids_z, Wrap=True)
list_item_3 = ListItem(List=construct_matrix, Index=optimal_camera_ids_z, Wrap=True)
move = Move(Geometry=reverse_list, Motion=vector_2)  # -> Geometry, Transform
list_item_4 = ListItem(List=merge, Index=optimal_camera_ids_z, Wrap=True)
list_item_5 = ListItem(List=xmpparser.ImageHeight, Index=optimal_camera_ids_z, Wrap=True)
findoptimalimagesz = FindOptimalImagesZ(
    Cameras=number_of_images,
    MinimalDistance=distance_between_images,
    ImageLocations=addition,
    ImageNames=xmpparser.Names,
    NrOfVisibleElements=nrofvisibleelements)  # -> Opt_img_z, Opt_img_z_location, Opt_img_z_ID
viewportexportervectorbased = ViewportExporterVectorBased(
    Geometries_setInvisible=geometry,
    MoveVectors=createsearchgrid,
    Cam_opt_names=optimal_camera_names_z,
    Cam_opt_Locations=optimal_camera_locations_z,
    Cam_opt_RotationMatrices=list_item_3,
    Cam_opt_Widths=list_item_2,
    Cam_opt_Height=list_item_5,
    Cam_opt_FocalLength35mm=list_item_4,
    FilePath=brute_force_bimages_directory_z,
    ViewType=view_type_2,
    RenderingType=rendering_type_2,
    Run=run_2)

# ----
# Bake Elements
panel_3 = Panel("BIM_FinalExprmts_Zcorrect")
# After Z determination completion
# --> update visibilities in Rhino:
# 
# - BIM_Original    --> hidden
# - BIM_Zcorrect   --> show
define_layer_2 = DefineLayer(Name=panel_3)
define_object_attributes_2 = DefineObjectAttributes(Name=addition_2, Layer=define_layer_2, Color=colour_rgb)
# Output (6)
# Stored in Rhino-file
bake_objects_2 = BakeObjects(Geometry=move.Geometry, Attributes=define_object_attributes_2, BakeName=panel_3, Bake=False)

# ----
# Output (4)
list_item_6 = ListItem(List=nrofvisibleelements, Index=findoptimalimagesz.Opt_img_z_ID, Wrap=True)
findoptimalzdisplacement = FindOptimalZdisplacement(
    RealImgPath=cam_directory,
    BIMagePath=brute_force_bimages_directory_z,
    ImgNames=optimal_camera_names_z,
    ImgOptimalities=list_item_6,
    AppliedDisplacements=createsearchgrid,
    GradientMethod=method_gradient,
    SimilarityMethod=method_similarity,
    EnableMask=enable_mask,
    EnableExport=export_comparison_imgs,
    ExportPath=intermediate_images_export_path,
    Run=run_3)  # -> OptimalDisplacements, OptimalDisplacement

# ----
# Preview selected optimal
# camera locations?
# 
# 
# 
# Enable - disable
custom_preview = CustomPreview(
    Geometry=optimal_camera_locations_z,
    Material={diffuse=RGB(255, 128, 0), emission=RGB(127, 255, 0), shine=0.5, specular=RGB(255, 255, 255), transparency=0})

# ----
# Actions
# Actions
restrict_to_ground_level = BooleanToggle(True)
prefer_ground_level = BooleanToggle(True)
run_5 = BooleanToggle(False)
run_6 = BooleanToggle(False)
run_7 = BooleanToggle(True)
run_8 = BooleanToggle(False)
run_9 = BooleanToggle(False)

# ----
# Inputs
# Inputs
method_gradient_2 = ValueList({"2_Dir", "hor_Dir", "ver_Dir"}, selected="2_Dir")
method_similarity_2 = ValueList({"immse", "corr2D", "mult", "MI"}, selected="corr2D")
export_comparison_imgs_2 = BooleanToggle(False)
rendering_type_3 = ValueList({"Wireframe", "Shaded", "Rendered", "X-ray"}, selected="Shaded")
rendering_type_4 = ValueList({"Wireframe", "Shaded", "Rendered", "X-ray"}, selected="Shaded")
brute_force_bimages_directory_x = FilePath("D:\Data\Work data\Phd\11_analyses\BIMage\Democo leopoldskazerne\Complete_img&BIMduplicates\BIM-based approach\04_BIMagesBruteForcingDisplacement X\")
brute_force_bimages_directory_y = FilePath("D:\Data\Work data\Phd\11_analyses\BIMage\Democo leopoldskazerne\Complete_img&BIMduplicates\BIM-based approach\04_BIMagesBruteForcingDisplacement Y\")
bim_duplicate_images_location = FilePath("D:\Data\Work data\Phd\11_analyses\BIMage\Democo leopoldskazerne\Complete_img&BIMduplicates\BIM-based approach\02_BIMages\")
view_type_3 = ValueList({"Perspective", "Top", "Front", "Right"}, selected="Perspective")
view_type_4 = ValueList({"Perspective", "Top", "Front", "Right"}, selected="Perspective")
enable_mask_2 = BooleanToggle(True)
priority_axis_2 = ValueList({"X", "Y"}, selected="X")
priority_axis_3 = ValueList({"X", "Y"}, selected="Y")
exported_images_path = FilePath("D:\Data\Work data\Phd\11_analyses\BIMage\Democo leopoldskazerne\Complete_img&BIMduplicates\BIM-based approach\05_similarities\")
max_movement_mm_2 = Number(90)
nr_of_pixels_to_grow = Integer(70)
desired_element = Integer("30")
angle = Number(expr("x*pi/180", 15))
stride_mm_2 = Number(3)
cameras = Number(10)

# ----
# 8. Create list of visible elements per image
area_3 = Area(Geometry=correct_z_bim_elements)  # -> Area, Centroid

# ----
# Previously executed?
# --> Read from disk
file_path = FilePath("D:\Data\Work data\Phd\11_analyses\BIMage\Democo leopoldskazerne\Complete_img&BIMduplicates\BIM-based approach\03_Img&ElementBased_Lists\FinalExperiments_img_elementNames.txt")
file_path_2 = FilePath("D:\Data\Work data\Phd\11_analyses\BIMage\Democo leopoldskazerne\Complete_img&BIMduplicates\BIM-based approach\03_Img&ElementBased_Lists\FinalExperiments_img_coverage.txt")
file_path_3 = FilePath("D:\Data\Work data\Phd\11_analyses\BIMage\Democo leopoldskazerne\Complete_img&BIMduplicates\BIM-based approach\03_Img&ElementBased_Lists\FinalExperiments_img_elementBBs.txt")
# 9. Reorder data to create list of elements  and in which images they are visible
file_path_4 = FilePath("D:\Data\Work data\Phd\11_analyses\BIMage\Democo leopoldskazerne\Complete_img&BIMduplicates\BIM-based approach\03_Img&ElementBased_Lists\FinalExperiments_img_elementGrownBBs.txt")
importexternaltree = ImportExternalTree(TreeFile=file_path, Numeric=True)
importexternaltree_2 = ImportExternalTree(TreeFile=file_path_2, Numeric=True)
importexternaltree_3 = ImportExternalTree(TreeFile=file_path_3, Numeric=False)
importexternaltree_4 = ImportExternalTree(TreeFile=file_path_4, Numeric=False)

# ----
# 7. Create BIMages, equivalent to real images
# (necessary because BIM dataset shifted up/downwards)
viewportexporterrotmat = ViewportExporterRotMat(
    Names=xmpparser.Names,
    Locations=addition,
    RotationMatrix=construct_matrix,
    ImageWidth=xmpparser.ImageWidth,
    ImageHeight=xmpparser.ImageHeight,
    FocalLength35mm=merge,
    FilePath=bim_duplicate_images_location,
    ViewType=view_type_3,
    RenderingType=rendering_type_3,
    Run=run_5)
# 10. Determine images that best portray the desired element
area_4 = Area(Geometry=correct_z_bim_elements)  # -> Area, Centroid
createsearchgrid_2 = CreateSearchGrid(Movement=expr("x/1000", max_movement_mm_2), Stride=expr("x/1000", stride_mm_2), PriorityAxis=priority_axis_3)
# 11. Create duplicate BIMages of displaced desired element  (Brute-force)
createsearchgrid_3 = CreateSearchGrid(Movement=expr("x/1000", max_movement_mm_2), Stride=expr("x/1000", stride_mm_2), PriorityAxis=priority_axis_2)

# ----
# Previously executed?
# --> Read from disk
file_path_5 = FilePath("D:\Data\Work data\Phd\11_analyses\BIMage\Democo leopoldskazerne\Complete_img&BIMduplicates\BIM-based approach\03_Img&ElementBased_Lists\FinalExperiments_elmt_imgIDs.txt")
file_path_6 = FilePath("D:\Data\Work data\Phd\11_analyses\BIMage\Democo leopoldskazerne\Complete_img&BIMduplicates\BIM-based approach\03_Img&ElementBased_Lists\FinalExperiments_elmt_coverage.txt")
file_path_7 = FilePath("D:\Data\Work data\Phd\11_analyses\BIMage\Democo leopoldskazerne\Complete_img&BIMduplicates\BIM-based approach\03_Img&ElementBased_Lists\FinalExperiments_elmt_elementBBs.txt")
file_path_8 = FilePath("D:\Data\Work data\Phd\11_analyses\BIMage\Democo leopoldskazerne\Complete_img&BIMduplicates\BIM-based approach\03_Img&ElementBased_Lists\FinalExperiments_elmt_elementGrownBBs.txt")
importexternaltree_5 = ImportExternalTree(TreeFile=file_path_5, Numeric=True)
importexternaltree_6 = ImportExternalTree(TreeFile=file_path_6, Numeric=True)
importexternaltree_7 = ImportExternalTree(TreeFile=file_path_7, Numeric=False)
importexternaltree_8 = ImportExternalTree(TreeFile=file_path_8, Numeric=False)

tree_branch = TreeBranch(Tree=importexternaltree_5, Path=desired_element, MaintainPaths=True)
tree_branch_2 = TreeBranch(Tree=importexternaltree_6, Path=desired_element, MaintainPaths=True)
list_item_7 = ListItem(List=addition, Index=tree_branch, Wrap=True)
reordertoelementbasedtree = ReOrderToElementBasedTree(
    ImageBasedElementNames=importexternaltree,
    ImageBasedCoverage=importexternaltree_2,
    ImageBasedBB=importexternaltree_3,
    ImageBasedGrownBB=importexternaltree_4,
    Run=run_7)  # -> ElementBasedImageNames, ElementBasedCoverage, ElementBasedBB, ElementBasedGrownBB
list_item_8 = ListItem(List=correct_z_bim_elements, Index=expr("x-1", desired_element), Wrap=True)
list_item_9 = ListItem(List=area_4.Centroid, Index=expr("x-1", desired_element), Wrap=True)
# Output (7)
# Stored on disk
# Output (8)
visibleelements = VisibleElements(
    ImageFolder=bim_duplicate_images_location,
    ImageNames=xmpparser.Names,
    PxToGrow=nr_of_pixels_to_grow,
    ImageLocations=addition,
    ElementLocations=area_3.Centroid,
    Run=run_6)  # -> ElementNames, Coverage, BB, GrownBB

# ----
# Output (9)
# Experiments: these are the input parameters for X for elmt 31
opt_img_x = Number([430, 429, 431, 404, 403, 485, 483, 381, 402, 405])
# Output (10)
optimalityvalues_x = Number([74739462.39, 3961532.924, 3807570.166, 3475243.227, 3223091.18, 1774643.13, 1483552.767, 1287131.378, 1247870.678, 1210585.685])

# ----
# Read from disk
file_path_9 = FilePath("D:\Data\Work data\Phd\11_analyses\BIMage\Democo leopoldskazerne\Complete_img&BIMduplicates\05_Img&ElementBased_Lists\img_elementNames.txt")
file_path_10 = FilePath("D:\Data\Work data\Phd\11_analyses\BIMage\Democo leopoldskazerne\Complete_img&BIMduplicates\05_Img&ElementBased_Lists\img_coverage.txt")
file_path_11 = FilePath("D:\Data\Work data\Phd\11_analyses\BIMage\Democo leopoldskazerne\Complete_img&BIMduplicates\05_Img&ElementBased_Lists\img_elementBBs.txt")
file_path_12 = FilePath("D:\Data\Work data\Phd\11_analyses\BIMage\Democo leopoldskazerne\Complete_img&BIMduplicates\05_Img&ElementBased_Lists\img_elementGrownBBs.txt")
importexternaltree_9 = ImportExternalTree(TreeFile=file_path_9, Numeric=True)  # disabled
importexternaltree_10 = ImportExternalTree(TreeFile=file_path_10, Numeric=True)  # disabled
importexternaltree_11 = ImportExternalTree(TreeFile=file_path_11, Numeric=False)  # disabled
importexternaltree_12 = ImportExternalTree(TreeFile=file_path_12, Numeric=False)  # disabled

# ----
# 3. Create duplicate images of the BIM
run_10 = BooleanToggle(False)
xmp_files_location = FilePath("D:\Data\Work data\Phd\11_analyses\BIMage\Democo leopoldskazerne\Complete_img&BIMduplicates\Image-based approach\01_RealImagesXMP\")
# 2. Create a list of properties of the recorded images
images_location = FilePath("D:\Data\Work data\Phd\11_analyses\BIMage\Democo leopoldskazerne\Complete_img&BIMduplicates\Image-based approach\00_RealImages\")
xmpparser_2 = XMPparser(ImagesLocation=images_location, XMPFilesLocation=xmp_files_location, Run=run_10)  # -> flatten(Names), flatten(Locations), flatten(Rotations), flatten(ImageWidth), flatten(ImageHeight), flatten(FocalLength)
texttonumbers_2 = TextToNumbers(Text=xmpparser_2.Rotations)  # -> simplify(NrS)
construct_matrix_2 = ConstructMatrix(Rows=3, Columns=3, Values=texttonumbers_2)  # -> flatten(Matrix)

# ----
# Update camera locations to
# BIM coordinate system
vector_xyz_2 = VectorXYZ(XComponent=104659.911, YComponent=192394.387, ZComponent=24.4)  # -> Vector, Length
ignore_z_component_2 = VectorXYZ(XComponent=13.3367, YComponent=-5.853, ZComponent=0)  # -> Vector, Length
subtraction_2 = Subtraction(A=xmpparser_2.Locations, B=vector_xyz_2.Vector)
addition_3 = Addition(A=ignore_z_component_2.Vector, B=subtraction_2)

# ----
# Revit
# to Rhino
# Abandoned:
# Image-based approach
# Input geometries
text_2 = Text(["Walls", "Floors", "Structural Columns"])
# Geometry
query_categories_2 = QueryCategories(Type=1, Parent=null, Name=text_2)
category_filter_2 = CategoryFilter(Categories=query_categories_2, Inverted=False)
query_elements_2 = QueryElements(Filter=category_filter_2, Limit=100)  # -> Elements, Count
element_geometry_2 = ElementGeometry(Elements=flatten(query_elements_2.Elements))  # -> flatten(Geometry)
brep_2 = Brep()

# ----
# Rhino
# geometries
original_bim_elements_2 = Geometry([<brep referenced from the Rhino model> x40])
correct_z_bim_elements_2 = Geometry([<brep referenced from the Rhino model> x40])

# ----
# Setting BIM to correct height (Z displacement)
number = Number(0.042)
ground_truth_displacement = VectorXYZ(XComponent=0, YComponent=0, ZComponent=number)  # -> Vector, Length
move_2 = Move(Geometry=original_bim_elements_2, Motion=ground_truth_displacement.Vector)  # -> Geometry, Transform

# ----
# 5. Reorder data to create list of elements
#     and in which images they are visible
boolean_toggle = BooleanToggle(False)
reordertoelementbasedtree_2 = ReOrderToElementBasedTree(
    ImageBasedElementNames=importexternaltree_9,
    ImageBasedCoverage=importexternaltree_10,
    ImageBasedBB=importexternaltree_11,
    ImageBasedGrownBB=importexternaltree_12,
    Run=boolean_toggle)  # -> ElementBasedImageNames, ElementBasedCoverage, ElementBasedBB, ElementBasedGrownBB

# ----
# Read from disk
file_path_13 = FilePath("D:\Data\Work data\Phd\11_analyses\BIMage\Democo leopoldskazerne\Complete_img&BIMduplicates\05_Img&ElementBased_Lists\elmt_imgIDs.txt")
file_path_14 = FilePath("D:\Data\Work data\Phd\11_analyses\BIMage\Democo leopoldskazerne\Complete_img&BIMduplicates\05_Img&ElementBased_Lists\elmt_coverage.txt")
file_path_15 = FilePath("D:\Data\Work data\Phd\11_analyses\BIMage\Democo leopoldskazerne\Complete_img&BIMduplicates\05_Img&ElementBased_Lists\elmt_elementBBs.txt")
file_path_16 = FilePath("D:\Data\Work data\Phd\11_analyses\BIMage\Democo leopoldskazerne\Complete_img&BIMduplicates\05_Img&ElementBased_Lists\elmt_elementGrownBBs.txt")
importexternaltree_13 = ImportExternalTree(TreeFile=file_path_13, Numeric=True)
importexternaltree_14 = ImportExternalTree(TreeFile=file_path_14, Numeric=True)
importexternaltree_15 = ImportExternalTree(TreeFile=file_path_15, Numeric=False)
importexternaltree_16 = ImportExternalTree(TreeFile=file_path_16, Numeric=False)

area_5 = Area(Geometry=brep_2)  # -> Area, Centroid

# ----
# Element edges
deconstruct_brep = DeconstructBrep(Brep=brep_2)  # -> Faces, Edges, Vertices
list_length_2 = ListLength(List=deconstruct_brep.Edges)

# ----
# BIM elements
list_length_3 = ListLength(List=brep_2)

# ----
# erroneous determination of focal lengths for DJI-images in RC
# --> update to correct value
duplicate_data_2 = DuplicateData(Data=23.905, Number=242, Order=True)  # -> flatten(Data)
split_list_2 = SplitList(List=xmpparser_2.FocalLength, Index=242)  # -> flatten(ListA), flatten(ListB)
merge_2 = Merge(Data1=duplicate_data_2, Data2=split_list_2.ListB)

bim_duplicate_images_location_2 = FilePath("D:\Data\Work data\Phd\11_analyses\BIMage\Democo leopoldskazerne\Complete_img&BIMduplicates\Image-based approach\03_BIMages\")
run_11 = BooleanToggle(False)
viewportexporterrotmat_2 = ViewportExporterRotMat(
    Names=xmpparser_2.Names,
    Locations=addition_3,
    RotationMatrix=construct_matrix_2,
    ImageWidth=xmpparser_2.ImageWidth,
    ImageHeight=xmpparser_2.ImageHeight,
    FocalLength35mm=merge_2,
    FilePath=bim_duplicate_images_location_2,
    ViewType="Perspective",
    RenderingType="Shaded",
    Run=run_11)

# ----
# 4. Create list of visible elements per image
boolean_toggle_2 = BooleanToggle(False)
visibleelements_2 = VisibleElements(
    Image_folder=bim_duplicate_images_location_2,
    Image_names=xmpparser_2.Names,
    Px_to_grow=70,
    Run=boolean_toggle_2,
    run=False)  # -> ElementNames, Coverage, BB, GrownBB

bool = BooleanToggle(False)

# ---- group: colour method 2
# Colouring
colour_wheel = ColourWheel(
    list_length_3,
    ColourGrips_Style=10,
    ColourGrips_Grip=[0.9168214029, 3.141592654, 2.073498471, 4.71238898],
    ColourGrips_Lum=[0.5124033021, 0.465442761],
    ColourGrips_Range=[3.116477627, 3.116477627, 3.116477627, 3.116477627],
    ColourGrips_Sat=[0.7596254948, 1])
jitter = Jitter(List=colour_wheel, Jitter=1, Seed=2)  # -> Values, Indices
duplicate_data_3 = DuplicateData(Data=graft(jitter.Values), Number=list_length_2, Order=True)

# ----
# Representation
panel_4 = Panel("255")
colour_rgb_2 = ColourRGB(Alpha=255, Red=0, Green=0, Blue=panel_4)

# ----
# Bake Edges
series_2 = Series(Start=0, Step=1, Count=list_length_3)  # -> graft(Series)
duplicate_data_4 = DuplicateData(Data=series_2, Number=list_length_2, Order=True)
define_layer_3 = DefineLayer(Name="BIM edges")
define_object_attributes_3 = DefineObjectAttributes(Name=duplicate_data_4, Layer=define_layer_3, Color=colour_rgb_2)
bake_objects_3 = BakeObjects(Geometry=deconstruct_brep.Edges, Attributes=define_object_attributes_3, BakeName="BIM edges", Bake=False)

# ----
# 7. Calculate optimal BIM element displacement along the image plane per image per element
gaussmagnitude = Integer(8)
stride = Integer(6)
run_12 = BooleanToggle(False)

number_2 = Number([-7, -6, 10, 13, -9])
number_3 = Number([27, -51, 30, 11, -40])
number_4 = Number([-75, -112, -72, -75, -99])
# 8. Combine optimal BIM element displacements
# 9. Update BIM elements
# 10. Re-check point 7 & 8 (& 9)
# 11. List of final displacement (x,y,z) per element
# 12. Push final displacements back to BIM to update from As-Design BIM to As-Built BIM
number_5 = Number([-22, -22, -27, -28, -19])
run_13 = BooleanToggle(False)

# ----
# Element cardinal axes
list_item_10 = ListItem(List=correct_z_bim_elements, Index=expr("x-1", desired_element), Wrap=True)
deconstruct_brep_2 = DeconstructBrep(Brep=list_item_10)  # -> Faces, Edges, Vertices

# ---- group: Max surface area
area_6 = Area(Geometry=deconstruct_brep_2.Faces)  # -> Area, Centroid
sort_list = SortList(Keys=area_6.Area)  # -> Keys, ValuesValuesA
reverse_list_2 = ReverseList(List=sort_list.Keys)
list_item_11 = ListItem(List=reverse_list_2, Index=0, Wrap=True)
equality = Equality(FirstNumber=area_6.Area, SecondNumber=list_item_11)  # -> Equality, Inequality
member_index = MemberIndex(Set=equality.Equality, Member=True)  # -> Index, Count
list_item_12 = ListItem(List=deconstruct_brep_2.Faces, Index=member_index.Index, Wrap=True)

# ----
deconstruct_plane = DeconstructPlane(Plane=flatten(list_item_12))  # -> Origin, XAxis, YAxis, ZAxis
merge_3 = Merge(Data1=deconstruct_plane.XAxis, Data2=deconstruct_plane.YAxis, Data3=deconstruct_plane.ZAxis)

findoptimalimagesxy = FindOptimalImagesXY(
    ElementLocation=list_item_9,
    ImageLocations=addition,
    ElementImageLocations=list_item_7,
    ImageNames=tree_branch,
    Coverage=tree_branch_2,
    CardinalElementAxes=merge_3,
    Angle=angle,
    CamerasZone=cameras,
    GroundLevel=prefer_ground_level,
    GroundRestricted=restrict_to_ground_level)  # -> Opt_img_x, Opt_img_y, OptimalityValues_x, OptimalityValues_y

# ----
# Y
list_item_13 = ListItem(List=xmpparser.Names, Index=findoptimalimagesxy.Opt_img_y, Wrap=True)
list_item_14 = ListItem(List=addition, Index=findoptimalimagesxy.Opt_img_y, Wrap=True)
list_item_15 = ListItem(List=construct_matrix, Index=findoptimalimagesxy.Opt_img_y, Wrap=True)
list_item_16 = ListItem(List=xmpparser.ImageWidth, Index=findoptimalimagesxy.Opt_img_y, Wrap=True)
list_item_17 = ListItem(List=xmpparser.ImageHeight, Index=findoptimalimagesxy.Opt_img_y, Wrap=True)
# Output (11)
# Stored on disk
list_item_18 = ListItem(List=merge, Index=findoptimalimagesxy.Opt_img_y, Wrap=True)

# ----
# 12. Find overall optimal element displacement
# Retrieve correct
# element (grown)
# bounding box
# X
tree_branch_3 = TreeBranch(Tree=importexternaltree_5, Path=desired_element, MaintainPaths=True)
equality_2 = Equality(FirstNumber=tree_branch_3, SecondNumber=simplify(graft(findoptimalimagesxy.Opt_img_x)))  # -> Equality, Inequality
member_index_2 = MemberIndex(Set=equality_2.Equality, Member=True)  # -> simplify(Index), Count
tree_branch_4 = TreeBranch(Tree=importexternaltree_8, Path=desired_element, MaintainPaths=True)
tree_branch_5 = TreeBranch(Tree=importexternaltree_7, Path=desired_element, MaintainPaths=True)
list_item_19 = ListItem(List=tree_branch_4, Index=member_index_2.Index, Wrap=True)  # -> flatten(Item)
list_item_20 = ListItem(List=tree_branch_5, Index=member_index_2.Index, Wrap=True)  # -> flatten(Item)

# ----
# X
list_item_21 = ListItem(List=xmpparser.Names, Index=findoptimalimagesxy.Opt_img_x, Wrap=True)
list_item_22 = ListItem(List=addition, Index=findoptimalimagesxy.Opt_img_x, Wrap=True)
list_item_23 = ListItem(List=construct_matrix, Index=findoptimalimagesxy.Opt_img_x, Wrap=True)
list_item_24 = ListItem(List=xmpparser.ImageWidth, Index=findoptimalimagesxy.Opt_img_x, Wrap=True)
list_item_25 = ListItem(List=xmpparser.ImageHeight, Index=findoptimalimagesxy.Opt_img_x, Wrap=True)
list_item_26 = ListItem(List=merge, Index=findoptimalimagesxy.Opt_img_x, Wrap=True)

# ----
# X
viewportexporterelmtgrid = ViewportExporterElmtGrid(
    Elmt_geometry=list_item_8,
    Elmt_name=desired_element,
    GridDisplacements=createsearchgrid_3,
    Cam_opt_names=list_item_21,
    Cam_opt_Locations=list_item_22,
    Cam_opt_RotationMatrices=list_item_23,
    Cam_opt_Widths=list_item_24,
    Cam_opt_Height=list_item_25,
    Cam_opt_FocalLength35mm=list_item_26,
    FilePath=brute_force_bimages_directory_x,
    ViewType=view_type_4,
    RenderingType=rendering_type_4,
    Run=run_8)

# ----
# Y
tree_branch_6 = TreeBranch(Tree=importexternaltree_5, Path=desired_element, MaintainPaths=True)
equality_3 = Equality(FirstNumber=tree_branch_6, SecondNumber=simplify(graft(findoptimalimagesxy.Opt_img_y)))  # -> Equality, Inequality
member_index_3 = MemberIndex(Set=equality_3.Equality, Member=True)  # -> simplify(Index), Count
tree_branch_7 = TreeBranch(Tree=importexternaltree_7, Path=desired_element, MaintainPaths=True)
tree_branch_8 = TreeBranch(Tree=importexternaltree_8, Path=desired_element, MaintainPaths=True)
list_item_27 = ListItem(List=tree_branch_7, Index=member_index_3.Index, Wrap=True)  # -> flatten(Item)
list_item_28 = ListItem(List=tree_branch_8, Index=member_index_3.Index, Wrap=True)  # -> flatten(Item)

# ----
# Y
viewportexporterelmtgrid_2 = ViewportExporterElmtGrid(
    Elmt_geometry=list_item_8,
    Elmt_name=desired_element,
    GridDisplacements=createsearchgrid_2,
    Cam_opt_names=list_item_13,
    Cam_opt_Locations=list_item_14,
    Cam_opt_RotationMatrices=list_item_15,
    Cam_opt_Widths=list_item_16,
    Cam_opt_Height=list_item_17,
    Cam_opt_FocalLength35mm=list_item_18,
    FilePath=brute_force_bimages_directory_y,
    ViewType=view_type_4,
    RenderingType=rendering_type_4,
    Run=run_8)

# ----
# X
# Y
logarithm = Logarithm(Value=findoptimalimagesxy.OptimalityValues_x)
list_length_4 = ListLength(List=logarithm)
list_item_29 = ListItem(List=logarithm, Index=expr("x-1", list_length_4), Wrap=True)
subtraction_3 = Subtraction(A=logarithm, B=list_item_29)
addition_4 = Addition(A=subtraction_3, B=1)
logarithm_2 = Logarithm(Value=findoptimalimagesxy.OptimalityValues_y)
list_length_5 = ListLength(List=logarithm_2)
list_item_30 = ListItem(List=logarithm_2, Index=expr("x-1", list_length_5), Wrap=True)
subtraction_4 = Subtraction(A=logarithm_2, B=list_item_30)
addition_5 = Addition(A=subtraction_4, B=1)

# ----
# X
# Y
findoptimaldisplacedelement = FindOptimalDisplacedElement(
    RealImgPath=cam_directory,
    BIMagePath=brute_force_bimages_directory_y,
    ImgNames=list_item_13,
    ImgOptimalities=addition_5,
    ElmtBBs=list_item_27,
    ElmtGrownBBs=list_item_28,
    AppliedDisplacements=createsearchgrid_2,
    GradientMethod=method_gradient_2,
    SimilarityMethod=method_similarity_2,
    EnableMask=enable_mask_2,
    EnableExport=export_comparison_imgs_2,
    ExportPath=exported_images_path,
    Run=viewportexporterelmtgrid_2)  # -> OptimalDisplacements, OptimalDisplacement
findoptimaldisplacedelement_2 = FindOptimalDisplacedElement(
    RealImgPath=cam_directory,
    BIMagePath=brute_force_bimages_directory_x,
    ImgNames=list_item_21,
    ImgOptimalities=addition_4,
    ElmtBBs=list_item_20,
    ElmtGrownBBs=list_item_19,
    AppliedDisplacements=createsearchgrid_3,
    GradientMethod=method_gradient_2,
    SimilarityMethod=method_similarity_2,
    EnableMask=enable_mask_2,
    EnableExport=export_comparison_imgs_2,
    ExportPath=exported_images_path,
    Run=viewportexporterelmtgrid)  # -> OptimalDisplacements, OptimalDisplacement
# Output (12)
panel_5 = Panel(findoptimaldisplacedelement_2.OptimalDisplacement)
panel_6 = Panel(findoptimaldisplacedelement.OptimalDisplacement)
panel_7 = Panel(findoptimaldisplacedelement_2.OptimalDisplacements)
panel_8 = Panel(findoptimaldisplacedelement.OptimalDisplacements)

# ----
# Preview selected element &
# optimal camera locations?
# 
# 
# 
# 
# 
# 
# 
# Enable - disable
custom_preview_2 = CustomPreview(
    Geometry=list_item_8,
    Material={diffuse=RGB(255, 128, 0), emission=RGB(127, 255, 0), shine=0.5, specular=RGB(255, 255, 255), transparency=0})  # disabled
custom_preview_3 = CustomPreview(
    Geometry=list_item_22,
    Material={diffuse=RGB(255, 128, 0), emission=RGB(66, 48, 66), shine=0.5, specular=RGB(255, 255, 255), transparency=0})  # disabled
custom_preview_4 = CustomPreview(
    Geometry=list_item_14,
    Material={diffuse=RGB(192, 0, 192), emission=RGB(66, 48, 66), shine=0.5, specular=RGB(255, 255, 255), transparency=0})  # disabled

list_item_31 = ListItem(List=xmpparser.Names, Index=findoptimalimagesxy.Opt_img_y, Wrap=True)
list_item_32 = ListItem(List=xmpparser.Names, Index=findoptimalimagesxy.Opt_img_x, Wrap=True)
panel_9 = Panel(list_item_32)
panel_10 = Panel(list_item_31)

# ----
# Bake Elements
series_3 = Series(Start=0, Step=1, Count=list_length_3)
define_layer_4 = DefineLayer(Name="BIM_correctZ")
addition_6 = Addition(A=series_3, B=1)

# ---- group: colour method 1
construct_domain_2 = ConstructDomain(DomainStart=0, DomainEnd=expr("x-1", list_length_3))
colour_rgb_3 = ColourRGB(Alpha=255, Red=addition_6, Green=0, Blue=0)
domain_2 = Domain(Domain(0, 255))
duplicate_data_5 = DuplicateData(Data=graft(colour_rgb_3), Number=list_length_2, Order=True)
remap_numbers_2 = RemapNumbers(Value=series_3, Source=construct_domain_2, Target=domain_2)  # -> Mapped, Clipped

# ----
define_object_attributes_4 = DefineObjectAttributes(Name=addition_6, Layer=define_layer_4, Color=colour_rgb_3)
bake_objects_4 = BakeObjects(Geometry=brep_2, Attributes=define_object_attributes_4, BakeName="BIM_correctZ", Bake=False)

# ----
# 6. Per element select images that best portray them
desired_element_2 = Integer(31)
tree_branch_9 = TreeBranch(Tree=importexternaltree_13, Path=desired_element_2, MaintainPaths=True)
tree_branch_10 = TreeBranch(Tree=importexternaltree_14, Path=desired_element_2, MaintainPaths=True)
list_item_33 = ListItem(List=area_5.Centroid, Index=expr("x-1", desired_element_2), Wrap=True)
list_item_34 = ListItem(List=addition_3, Index=tree_branch_9, Wrap=True)
angle_2 = Number(expr("x*pi/180", 15))
cameras_2 = Number(7)

panel_11 = Panel(desired_element_2)

# ----
# Element cardinal axes
list_item_35 = ListItem(List=original_bim_elements_2, Index=expr("x-1", desired_element_2), Wrap=True)
deconstruct_brep_3 = DeconstructBrep(Brep=list_item_35)  # -> Faces, Edges, Vertices

# ---- group: Max surface area
area_7 = Area(Geometry=deconstruct_brep_3.Faces)  # -> Area, Centroid
sort_list_2 = SortList(Keys=area_7.Area)  # -> Keys, ValuesValuesA
reverse_list_3 = ReverseList(List=sort_list_2.Keys)
list_item_36 = ListItem(List=reverse_list_3, Index=0, Wrap=True)
equality_4 = Equality(FirstNumber=area_7.Area, SecondNumber=list_item_36)  # -> Equality, Inequality
member_index_4 = MemberIndex(Set=equality_4.Equality, Member=True)  # -> Index, Count
list_item_37 = ListItem(List=deconstruct_brep_3.Faces, Index=member_index_4.Index, Wrap=True)

# ----
deconstruct_plane_2 = DeconstructPlane(Plane=flatten(list_item_37))  # -> Origin, XAxis, YAxis, ZAxis
merge_4 = Merge(Data1=deconstruct_plane_2.XAxis, Data2=deconstruct_plane_2.YAxis, Data3=deconstruct_plane_2.ZAxis)

findoptimalimages = FindOptimalImages(
    ElementLocation=list_item_33,
    ImageLocations=list_item_34,
    ImageNames=tree_branch_9,
    Coverage=tree_branch_10,
    CardinalElementAxes=merge_4,
    Angle=angle_2,
    CamerasZone=cameras_2,
    GroundLevel=bool,
    GroundRestricted=False,
    GroundRestricted_2=False)  # -> Opt_img_x, Opt_img_y, OptimalityValues_x, OptimalityValues_y

tree_item = TreeItem(Tree=importexternaltree_15, Path=desired_element_2, Index=findoptimalimages.Opt_img_y, Wrap=True)
tree_item_2 = TreeItem(Tree=importexternaltree_16, Path=desired_element_2, Index=findoptimalimages.Opt_img_y, Wrap=True)
list_item_38 = ListItem(List=xmpparser_2.Names, Index=findoptimalimages.Opt_img_y, Wrap=True)
elementdisplacement_imgcoordsyst = ElementDisplacement_ImgCoordSyst(
    RealImgPath=images_location,
    BIMagePath=bim_duplicate_images_location_2,
    ImgNames=list_item_38,
    ElmtBBs=tree_item,
    ElmtGrownBBs=tree_item_2,
    Stride=stride,
    GaussMagnitude=gaussmagnitude,
    Run=run_12)  # -> Disp_X, Disp_Y

tree_item_3 = TreeItem(Tree=importexternaltree_15, Path=desired_element_2, Index=findoptimalimages.Opt_img_x, Wrap=True)
tree_item_4 = TreeItem(Tree=importexternaltree_16, Path=desired_element_2, Index=findoptimalimages.Opt_img_x, Wrap=True)
list_item_39 = ListItem(List=xmpparser_2.Names, Index=findoptimalimages.Opt_img_x, Wrap=True)
elementdisplacement_imgcoordsyst_2 = ElementDisplacement_ImgCoordSyst(
    RealImgPath=images_location,
    BIMagePath=bim_duplicate_images_location_2,
    ImgNames=list_item_39,
    ElmtBBs=tree_item_3,
    ElmtGrownBBs=tree_item_4,
    Stride=stride,
    GaussMagnitude=gaussmagnitude,
    Run=run_12)  # -> Disp_X, Disp_Y

panel_12 = Panel(list_item_38)
panel_13 = Panel(list_item_39)
panel_14 = Panel(elementdisplacement_imgcoordsyst.Disp_X)
panel_15 = Panel(elementdisplacement_imgcoordsyst_2.Disp_X)
panel_16 = Panel(elementdisplacement_imgcoordsyst.Disp_Y)
panel_17 = Panel(elementdisplacement_imgcoordsyst_2.Disp_Y)

list_item_40 = ListItem(List=addition_3, Index=findoptimalimages.Opt_img_y, Wrap=True)
list_item_41 = ListItem(List=merge_2, Index=findoptimalimages.Opt_img_y, Wrap=True)
list_item_42 = ListItem(List=construct_matrix_2, Index=findoptimalimages.Opt_img_y, Wrap=True)
list_item_43 = ListItem(List=xmpparser_2.ImageWidth, Index=findoptimalimages.Opt_img_y, Wrap=True)

list_item_44 = ListItem(List=addition_3, Index=findoptimalimages.Opt_img_x, Wrap=True)
list_item_45 = ListItem(List=merge_2, Index=findoptimalimages.Opt_img_x, Wrap=True)
list_item_46 = ListItem(List=construct_matrix_2, Index=findoptimalimages.Opt_img_x, Wrap=True)
list_item_47 = ListItem(List=xmpparser_2.ImageWidth, Index=findoptimalimages.Opt_img_x, Wrap=True)

elementdisplacement_bimcoordsyst = ElementDisplacement_BimCoordSyst(
    ElementLocation=list_item_33,
    ImageLocations=list_item_40,
    ImageRocations=list_item_42,
    ImageFocalLengths=list_item_41,
    ImageWidths=list_item_43,
    XDisplacement=number_2,
    YDisplacement=number_5,
    Run=run_13)
elementdisplacement_bimcoordsyst_2 = ElementDisplacement_BimCoordSyst(
    ElementLocation=list_item_33,
    ImageLocations=list_item_44,
    ImageRocations=list_item_46,
    ImageFocalLengths=list_item_45,
    ImageWidths=list_item_47,
    XDisplacement=number_3,
    YDisplacement=number_4,
    Run=run_13)

# ----
# 8. Convert optimal BIM element displacement from image to BIM coordinate system
run_14 = BooleanToggle(False)
elementdisplacement_bimcoordsyst_3 = ElementDisplacement_BimCoordSyst(
    ElementLocation=list_item_33,
    ImageLocations=list_item_40,
    ImageRocations=list_item_42,
    ImageFocalLengths=list_item_41,
    ImageWidths=list_item_43,
    XDisplacement=elementdisplacement_imgcoordsyst.Disp_X,
    YDisplacement=elementdisplacement_imgcoordsyst.Disp_Y,
    Run=run_14)  # disabled
elementdisplacement_bimcoordsyst_4 = ElementDisplacement_BimCoordSyst(
    ElementLocation=list_item_33,
    ImageLocations=list_item_44,
    ImageRocations=list_item_46,
    ImageFocalLengths=list_item_45,
    ImageWidths=list_item_47,
    XDisplacement=elementdisplacement_imgcoordsyst_2.Disp_X,
    YDisplacement=elementdisplacement_imgcoordsyst_2.Disp_Y,
    Run=run_14)  # disabled

panel_18 = Panel(elementdisplacement_bimcoordsyst)
panel_19 = Panel(elementdisplacement_bimcoordsyst_2)
