# Grasshopper definition M_classification_gui.gh (Grasshopper 0.9.76)
# plug-ins: MeshEdit Components, Human UI, Predictor, EleFront, WriteMatlabPredictors

# import data
geometry_pipeline = GeometryPipeline(
    GroupByLayer=False,
    GroupByType=False,
    IncludeHidden=True,
    IncludeLocked=True,
    LayerFilter="*",
    NameFilter="*",
    TypeFilter=32)
launch_window = LaunchWindow(Show=Toggle(True), Name="Classification Application", Width=400, Height=1000, ChildStatus=0, EnableHorizScroll=False)

area_filter = Slider(0.3, range=0..1)
create_slider = CreateSlider(AreaFilter=area_filter, ShowBounds=False, ShowTicks=False, ShowTooltip=False, ShowValLabel=True)
create_label = CreateLabel(AreaFilter="No Surfaces are filtered from the data set", LabelSize=8, Justification=1)
value_listener = ValueListener(Elements=create_slider, SomeProperty=True)  # -> Values, Indices

create_label_2 = CreateLabel(ComputationTime="Estimated Computation Time:", LabelSize=12, Justification=0)
create_checkbox = CreateCheckbox(ProcessData="Process Data", StartingValue=False)

normal_threshold = Slider(0.35, range=0..1)
create_slider_2 = CreateSlider(NormalThreshold=normal_threshold, ShowBounds=False, ShowTicks=False, ShowTooltip=False, ShowValLabel=True)
create_label_3 = CreateLabel(NormalThreshold="No Division was made", LabelSize=8, Justification=1)
value_listener_2 = ValueListener(Elements=create_slider_2, SomeProperty=True)  # -> Values, Indices

area_large_surface = Slider(4, range=0..10)
create_slider_3 = CreateSlider(AreaLargeSurface=area_large_surface, ShowBounds=False, ShowTicks=False, ShowTooltip=False, ShowValLabel=True)
create_label_4 = CreateLabel(AreaLargeSurface="No Large Surfaces Detected", LabelSize=8, Justification=1)
value_listener_3 = ValueListener(Elements=create_slider_3, SomeProperty=True)  # -> Values, Indices

create_label_5 = CreateLabel(GeneralSettings="General Settings", LabelSize=18, Justification=1)
create_checkbox_2 = CreateCheckbox(ImportData="Import data", StartingValue=False)
create_checklist = CreateChecklist(ChecklistItems=["Floors", "Ceilings", "Roofs", "Walls", "Beams", "Clutter"], Selected=True)
create_chart = CreateChart(
    Data=[0, 1, 2, 3, 4, 5],
    Names=["Floors", "Ceilings", "Roofs", "Walls", "Beams", "Clutter"],
    Title="Precision",
    ChartType=3)
create_chart_2 = CreateChart(Data=[0, 1, 2, 3, 4, 5], Names=["Floors", "Ceilings", "Roofs", "Walls", "Beams", "Clutter"], Title="Recall", ChartType=3)
# Results
value_listener_4 = ValueListener(Elements=create_checkbox, SomeProperty=True)  # -> Values, Indices
value_listener_5 = ValueListener(Elements=create_label_2, SomeProperty=True)  # -> Values, Indices
# GUI
# Settings
value_listener_6 = ValueListener(Elements=create_checkbox_2, SomeProperty=True)  # -> Values, Indices
stream_filter = StreamFilter(Gate=value_listener_6.Values, Stream1=geometry_pipeline)
mesh_area = MeshArea(Mesh=stream_filter)  # -> Area, Centroid
# General Settings
# Area Filter
larger_than = LargerThan(FirstNumber=mesh_area.Area, SecondNumber=value_listener.Values)  # -> LargerThan, OrEqualTo
dispatch = Dispatch(List=mesh_area.Centroid, DispatchPattern=larger_than.OrEqualTo)  # -> ListA, ListB
value_listener_7 = ValueListener(Elements=create_checklist, SomeProperty=True)  # -> Values, simplify(graft(Indices))
stream_filter_2 = StreamFilter(Gate=value_listener_4.Values, Stream0=False, Stream1=True)
construct_path = ConstructPath(Indices=value_listener_7.Indices)  # -> flatten(Branch)
# Recall
stream_filter_3 = StreamFilter(Gate=value_listener_4.Values, Stream1=create_chart_2)
stream_filter_4 = StreamFilter(Gate=value_listener_4.Values, Stream1=create_chart)
floors = ColourSwatch(SwatchColor=RGB(250, 0, 0))
ceilings = ColourSwatch(SwatchColor=RGB(170, 0, 255))
roofs = ColourSwatch(SwatchColor=RGB(3, 36, 255))
walls = ColourSwatch(SwatchColor=RGB(6, 181, 0))
beams = ColourSwatch(SwatchColor=RGB(244, 252, 0))
clutter = ColourSwatch(SwatchColor=RGB(102, 102, 102))
entwine = Entwine(Branch00=floors, Branch01=ceilings, Branch02=roofs, Branch03=walls, Branch04=beams, Branch05=clutter, FlattenInputs=True)  # -> simplify(Result)
text = Text(["'Walls'", "'Walls'", "'Clutter'", "'Clutter'", "'Clutter'", "'Clutter'"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])
reference = Text(graft(text))
# quick test validation in matlab
match_text = MatchText(Text=reference, Pattern="'Floors'", Case=True)
match_text_2 = MatchText(Text=reference, Pattern="'Roofs'", Case=True)
match_text_3 = MatchText(Text=reference, Pattern="'Ceilings'", Case=True)
match_text_4 = MatchText(Text=reference, Pattern="'Walls'", Case=True)
match_text_5 = MatchText(Text=reference, Pattern="'Beams'", Case=True)
match_text_6 = MatchText(Text=reference, Pattern="'Clutter'", Case=True)
panel = Panel(match_text_6)
number = Number(expr("x*2", match_text_3))
number_2 = Number(expr("x*3", match_text_2))
number_3 = Number(expr("x*4", match_text_4))
number_4 = Number(expr("x*5", match_text_5))
number_5 = Number(expr("x*6", match_text_6))
text_2 = Text("@\"C:\\Users\\maarten.bassier\\Google Drive\\Research\\2016-11 Build Grasshopper plug in\\Predictors\\test.csv\"")
number_6 = Number([1, 1, 1, 1, 1, 1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])

# ----
# MESH
# Area Filter
# Area
# CENTROID
# NORMAL
# LARGE HORI (Nz >=20°)
# LARGE
# LARGE VERTI
# Verti
# Hori
# Trash
geometry = Geometry(stream_filter)
area_threshold = Slider(0.3, range=0..1)
number_slider = Slider(4, range=0..5)
boolean_toggle = BooleanToggle(False)

stream_filter_5 = StreamFilter(Gate=value_listener_6.Values, Stream1=geometry)
dispatch_2 = Dispatch(List=stream_filter_5, DispatchPattern=larger_than.OrEqualTo)  # -> ListA, ListB
face_normals = FaceNormals(Mesh=dispatch_2.ListA)  # -> Centers, Normals
# Normal Division
average = Average(Input=face_normals.Normals)  # -> flatten(ArithmeticMean)
deconstruct_vector = DeconstructVector(Vector=average)  # -> expr("abs(round(x,2))", XComponent), expr("abs(round(x,2))", YComponent), expr("abs(round(x,2))", ZComponent)
smaller_than = SmallerThan(FirstNumber=deconstruct_vector.ZComponent, _03520GUI=value_listener_2.Values)  # -> SmallerThan, OrEqualTo
dispatch_3 = Dispatch(List=dispatch_2.ListA, DispatchPattern=smaller_than.OrEqualTo)  # -> ListA, ListB
verti = Geometry(dispatch_3.ListA)
hori = Geometry(dispatch_3.ListB)
surf = Geometry(dispatch_2.ListA)
noise = Geometry(dispatch_2.ListB)
list_length = ListLength(List=dispatch_3.ListB)
list_length_2 = ListLength(List=dispatch_2.ListB)
list_length_3 = ListLength(List=dispatch_3.ListA)
list_length_4 = ListLength(List=dispatch_2.ListA)

mesh_area_2 = MeshArea(Mesh=stream_filter_5)  # -> Area, Centroid
larger_than_2 = LargerThan(FirstNumber=mesh_area_2.Area, SecondNumber=value_listener.Values)  # -> LargerThan, OrEqualTo
dispatch_4 = Dispatch(List=stream_filter_5, DispatchPattern=larger_than_2.LargerThan)  # -> ListA, ListB
trash = Geometry(dispatch_4.ListB)
stream_filter_6 = StreamFilter(Gate=value_listener_4.Values, Stream1=dispatch_4.ListA)
mesh_area_3 = MeshArea(Mesh=stream_filter_6)  # -> expr("round(x,2)", Area), Centroid
larger_than_3 = LargerThan(FirstNumber=mesh_area_3.Area, SecondNumber=number_slider)  # -> LargerThan, OrEqualTo
larger_than_4 = LargerThan(FirstNumber=mesh_area_3.Area, SecondNumber=number_slider)  # -> LargerThan, OrEqualTo
mesh_closest_point = MeshClosestPoint(Point=mesh_area_3.Centroid, Mesh=stream_filter_6)  # -> Point, Index, Parameter
larger_than_5 = LargerThan(FirstNumber=mesh_area_3.Area, SecondNumber=number_slider)  # -> LargerThan, OrEqualTo
mesh_eval = MeshEval(Mesh=stream_filter_6, Parameter=mesh_closest_point.Parameter)  # -> Point, unitize(Normal), Colour
dispatch_5 = Dispatch(List=stream_filter_6, DispatchPattern=larger_than_5.OrEqualTo)  # -> ListA, ListB
deconstruct_vector_2 = DeconstructVector(Vector=mesh_eval.Normal)  # -> expr("abs(round(x,2))", XComponent), expr("abs(round(x,2))", YComponent), expr("abs(round(x,2))", ZComponent)
smaller_than_2 = SmallerThan(FirstNumber=deconstruct_vector_2.ZComponent, SecondNumber=0.35)  # -> SmallerThan, OrEqualTo
dispatch_6 = Dispatch(List=graft(stream_filter_6), DispatchPattern=graft(smaller_than_2.SmallerThan))  # -> ListA, ListB
larger_than_6 = LargerThan(FirstNumber=deconstruct_vector_2.ZComponent, SecondNumber=0.35)  # -> LargerThan, OrEqualTo
geometry_2 = Geometry(dispatch_6.ListB)
verti_2 = Geometry(dispatch_6.ListA)
gate_and = GateAnd(A=larger_than_6.OrEqualTo, B=larger_than_3.OrEqualTo)
gate_and_2 = GateAnd(A=smaller_than_2.SmallerThan, B=larger_than_4.OrEqualTo)
dispatch_7 = Dispatch(List=stream_filter_6, DispatchPattern=gate_and)  # -> ListA, ListB
dispatch_8 = Dispatch(List=stream_filter_6, DispatchPattern=gate_and_2)  # -> ListA, ListB
large_verti = Geometry(dispatch_8.ListA)
geometry_3 = Geometry(dispatch_5.ListA)
geometry_4 = Geometry(dispatch_7.ListA)

larger_than_7 = LargerThan(FirstNumber=mesh_area_2.Area, SecondNumber=1)  # -> LargerThan, OrEqualTo
dispatch_9 = Dispatch(List=stream_filter_5, DispatchPattern=larger_than_7.LargerThan)  # -> ListA, ListB
mesh = Mesh(dispatch_9.ListA)
create_3d_view = Create3DView(MeshToDisplay=mesh, MeshColors=RGB(255, 0, 0), ViewWidth=300, ViewHeight=300)
merge = Merge(Data2=create_label_2, Data3=create_checklist, Data4=create_3d_view)
# centralise
adjust_element_positioning = AdjustElementPositioning(ElementsToAdjust=merge, AbsolutePositioning=False, HorizontalAlignment=1)
merge_2 = Merge(Data1=create_chart_2, Data2=create_chart, Data3=create_3d_view, Data4=create_checklist)
hide_show_element = HideShowElement(ElementToHideShow=merge_2, Show=stream_filter_2, Collapse=True, Disable=False)
merge_3 = Merge(
    Data1=create_checkbox_2,
    Data2=create_label_5,
    Data3=create_slider,
    Data4=create_label,
    Data5=create_slider_2,
    Data6=create_label_3,
    Data7=create_slider_3,
    Data8=create_label_2,
    Data9=create_3d_view,
    Data10=create_checkbox,
    Data11=create_3d_view,
    Data12=create_checklist,
    Data13=create_chart_2)
save_element_states = SaveElementStates(Elements=merge_3, SaveState=False, StateName="save", ClearSavedStates=False)  # -> SavedStates, SavedStateNames
restore_element_states = RestoreElementStates(Restore=False, SavedStates=save_element_states.SavedStates, StateNameToRestore=save_element_states.SavedStateNames)
add_elements = AddElements(Window=launch_window, Elements=flatten(merge_3))  # -> AddedElements, ElementNames
stream_filter_7 = StreamFilter(Gate=value_listener_4.Values, Stream1=create_3d_view)

mesh_area_4 = MeshArea(Mesh=dispatch_4.ListA)  # -> Area, Centroid
mesh_closest_point_2 = MeshClosestPoint(Point=mesh_area_4.Centroid, Mesh=dispatch_4.ListA)  # -> Point, Index, Parameter
mesh_eval_2 = MeshEval(Mesh=dispatch_4.ListA, Parameter=mesh_closest_point_2.Parameter)  # -> Point, unitize(Normal), Colour
deconstruct_vector_3 = DeconstructVector(Vector=mesh_eval_2.Normal)  # -> expr("abs(round(x,2))", XComponent), expr("abs(round(x,2))", YComponent), expr("abs(round(x,2))", ZComponent)
larger_than_8 = LargerThan(FirstNumber=deconstruct_vector_3.ZComponent, SecondNumber=0.35)  # -> LargerThan, OrEqualTo
dispatch_10 = Dispatch(List=dispatch_4.ListA, DispatchPattern=larger_than_8.OrEqualTo)  # -> ListA, ListB
list_length_5 = ListLength(List=dispatch_10.ListA)
list_length_6 = ListLength(List=dispatch_4.ListA)
division = Division(A=list_length_5, B=list_length_6)
number_7 = Number(expr("round((100*x),0)", division))
format = Format(Format="{0}/{1} ({2}%) Vertical Surfaces", Culture=127, Data0=list_length_5, Data1=list_length_6, Data2=number_7)
set_label_contents = SetLabelContents(LabelToModify=create_label_3, NewLabelContents=format)

list_length_7 = ListLength(List=dispatch_4.ListA)
list_length_8 = ListLength(List=geometry)
division_2 = Division(A=list_length_7, B=list_length_8)
number_8 = Number(expr("round((100*x),0)", division_2))
format_2 = Format(Format="{0}/{1} ({2}%) Significant Surfaces", Culture=127, Data0=list_length_7, Data1=list_length_8, Data2=number_8)
set_label_contents_2 = SetLabelContents(LabelToModify=create_label, NewLabelContents=format_2)

list_length_9 = ListLength(List=dispatch_4.ListA)  # -> expr("x*0.015", Length)
format_3 = Format(Format="Estimated Computation Time: {0}s", Culture=127, Data0=list_length_9)
stream_filter_8 = StreamFilter(Gate=value_listener_6.Values, Stream0=value_listener_5.Values, Stream1=format_3)
set_label_contents_3 = SetLabelContents(LabelToModify=create_label_2, NewLabelContents=stream_filter_8)

larger_than_9 = LargerThan(FirstNumber=mesh_area_3.Area, SecondNumber=Slider(4, range=0..5))  # -> LargerThan, OrEqualTo
larger_than_10 = LargerThan(FirstNumber=mesh_area_3.Area, SecondNumber=number_slider)  # -> LargerThan, OrEqualTo

list_length_10 = ListLength(List=dispatch_4.ListA)
list_length_11 = ListLength(List=geometry)
division_3 = Division(A=list_length_10, B=list_length_11)
number_9 = Number(expr("round((100*x),0)", division_3))
format_4 = Format(Format="{0}/{1} ({2}%) Large Surfaces", Culture=127, Data0=list_length_10, Data1=list_length_11, Data2=number_9)
set_label_contents_4 = SetLabelContents(LabelToModify=create_label_4, NewLabelContents=format_4)

# ----
# Proximity Predictor Vbot. Vertical distance of hori to bottom of large vertical surfaces
# highest and lowest point
# highest and lowest point
hori_surface = Geometry(geometry_2)
# Proximity Predictor Vtop. Vertical distance of hori to top of large vertical surfaces
large_verti_surface = Geometry(large_verti)
deconstruct_mesh = DeconstructMesh(Mesh=hori_surface)  # -> Vertices, Faces, Colours, Normals
deconstruct_mesh_2 = DeconstructMesh(Mesh=large_verti_surface)  # -> Vertices, Faces, Colours, Normals
mesh_area_5 = MeshArea(Mesh=hori_surface)  # -> Area, Centroid
mesh_area_6 = MeshArea(Mesh=large_verti_surface)  # -> Area, Centroid
deconstruct_vector_4 = DeconstructVector(Vector=deconstruct_mesh.Vertices)  # -> XComponent, YComponent, ZComponent
deconstruct_vector_5 = DeconstructVector(Vector=deconstruct_mesh_2.Vertices)  # -> XComponent, YComponent, ZComponent
sort_list = SortList(Keys=deconstruct_vector_4.ZComponent, ValuesHighest=deconstruct_mesh.Vertices)  # -> Keys, reverse(ValuesHighest)
sort_list_2 = SortList(Keys=deconstruct_vector_5.ZComponent, ValuesHighest=deconstruct_mesh_2.Vertices)  # -> Keys, reverse(ValuesHighest)
sort_list_3 = SortList(Keys=deconstruct_vector_4.ZComponent, ValuesLowest=deconstruct_mesh.Vertices)  # -> Keys, ValuesLowest
sort_list_4 = SortList(Keys=deconstruct_vector_5.ZComponent, ValuesLowest=deconstruct_mesh_2.Vertices)  # -> Keys, ValuesLowest
closest_points = ClosestPoints(Point=mesh_area_5.Centroid, Cloud=mesh_area_6.Centroid, Count=20)  # -> ClosestPoint, CPIndex, Distance
smaller_than_3 = SmallerThan(FirstNumber=closest_points.Distance, SecondNumber=10)  # -> SmallerThan, OrEqualTo
dispatch_11 = Dispatch(List=closest_points.CPIndex, DispatchPattern=smaller_than_3.SmallerThan)  # -> ListA, ListB
list_item = ListItem(List=sort_list.ValuesHighest, Index=0, Wrap=True)
list_item_2 = ListItem(List=sort_list_3.ValuesLowest, Index=0, Wrap=True)
list_item_3 = ListItem(List=sort_list_2.ValuesHighest, Index=0, Wrap=True)  # -> flatten(Item)
list_item_4 = ListItem(List=sort_list_4.ValuesLowest, Index=0, Wrap=True)  # -> flatten(Item)
list_item_5 = ListItem(List=list_item_3, Index=closest_points.CPIndex, Wrap=True)
list_item_6 = ListItem(List=large_verti_surface, Index=closest_points.CPIndex, Wrap=True)
list_item_7 = ListItem(List=list_item_4, Index=dispatch_11.ListA, Wrap=True)
deconstruct = Deconstruct(Point=list_item_5)  # -> XComponent, YComponent, simplify(ZComponent)
deconstruct_2 = Deconstruct(Point=list_item)  # -> XComponent, YComponent, simplify(ZComponent)
deconstruct_3 = Deconstruct(Point=list_item_7)  # -> XComponent, YComponent, simplify(ZComponent)
deconstruct_4 = Deconstruct(Point=list_item_2)  # -> XComponent, YComponent, simplify(ZComponent)
subtraction = Subtraction(A=deconstruct_2.ZComponent, B=deconstruct.ZComponent)
subtraction_2 = Subtraction(A=deconstruct_3.ZComponent, B=deconstruct_4.ZComponent)
sort_list_5 = SortList(Keys=expr("round(abs(x),2)", subtraction))  # -> Keys, ValuesValuesA
sort_list_6 = SortList(Keys=expr("round(abs(x),2)", subtraction_2))  # -> Keys, ValuesValuesA
list_item_8 = ListItem(List=sort_list_5.Keys, Index=0, Wrap=True)
list_item_9 = ListItem(List=sort_list_6.Keys, Index=0, Wrap=True)
replace_nulls = ReplaceNulls(Items=list_item_8, Replacements=10)  # -> flatten(Items), Count
replace_nulls_2 = ReplaceNulls(Items=list_item_9, Replacements=10)  # -> flatten(Items), Count
panel_2 = Panel(replace_nulls.Items)
_16_vbot = Panel(replace_nulls_2.Items)

# ----
# General predictors
# Predictor Area %
bounds = Bounds(Numbers=mesh_area_3.Area)
deconstruct_domain = DeconstructDomain(Domain=bounds)  # -> Start, End
division_4 = Division(A=mesh_area_3.Area, B=deconstruct_domain.End)
number_10 = Number(expr("round(x,2)", division_4))
_2_area = Panel(number_10)

# ----
# Predictor Diagonaal XY
plane_normal = PlaneNormal(Origin=Point(0, 0, 0), ZAxis=Vector(0, 0, 1))  # -> graft(Plane)
bounding_box = BoundingBox(Content=graft(stream_filter_6), Plane=plane_normal, UnionBox=True)  # -> flatten(Box), Box_2
box_properties = BoxProperties(Box=bounding_box.Box)  # -> Center, Diagonal, Area, Volume, Degeneracy
deconstruct_vector_6 = DeconstructVector(Vector=box_properties.Diagonal)  # -> expr("abs(round(x,1))", XComponent), expr("abs(round(x,1))", YComponent), expr("abs(round(x,1))", ZComponent)
evaluate = Evaluate(Expression="round(sqrt(x*x+y*y),2)", x=deconstruct_vector_6.XComponent, y=deconstruct_vector_6.YComponent)
_5_diagonaal_xy = Panel(evaluate)

# ----
# Predictor Coplanarity. distance perpendicular to large plane with same normal (0= good). Coplanariteit
# Normal distance to 5 closest large surf
# deviating normals get bad score
larger_than_11 = LargerThan(FirstNumber=mesh_area_3.Area, SecondNumber=number_slider)  # -> LargerThan, OrEqualTo
normals = Geometry(mesh_eval.Normal)
centroids = Geometry(mesh_eval.Point)
dispatch_12 = Dispatch(Normals=normals, DispatchPattern=larger_than_11.LargerThan)  # -> LargeNormals, ListB
dispatch_13 = Dispatch(Centroids=centroids, DispatchPattern=larger_than_11.LargerThan)  # -> LargeCentroids, ListB
closest_points_2 = ClosestPoints(Point=centroids, Cloud=dispatch_13.LargeCentroids, Count=30)  # -> ClosestPoint, CPIndex, Distance
list_item_10 = ListItem(List=dispatch_12.LargeNormals, Index=closest_points_2.CPIndex, Wrap=True)
plane_normal_2 = PlaneNormal(Origin=dispatch_13.LargeCentroids, ZAxis=dispatch_12.LargeNormals)
dot_product = DotProduct(VectorA=graft(normals), VectorB=list_item_10, Unitize=True)  # -> expr("abs(x)", DotProduct)
list_item_11 = ListItem(List=plane_normal_2, Index=closest_points_2.CPIndex, Wrap=True)
plane_closest_point = PlaneClosestPoint(Point=graft(centroids), Plane=list_item_11)  # -> Point, UVPoint, expr("abs(x)", Distance)
larger_than_12 = LargerThan(FirstNumber=dot_product, SecondNumber=Slider(0.87, range=0..1))  # -> LargerThan, OrEqualTo
dispatch_14 = Dispatch(List=plane_closest_point.Distance, DispatchPattern=larger_than_12.LargerThan)  # -> ListA, ListB
number_11 = Number(expr("(x*0)+10", dispatch_14.ListB))
merge_4 = Merge(Data1=dispatch_14.ListA, Data2=number_11)
sort_list_7 = SortList(Keys=merge_4)  # -> expr("round(x,2)", Keys), ValuesValuesA
list_item_12 = ListItem(List=sort_list_7.Keys, Index=0, Wrap=True)  # -> flatten(Item)
_7_coplanariteit = Panel(list_item_12)

# ----
# Predictor Dv_bottom. Vertical Distance of lowest mesh point of verti to closest large horizontal Surface
# 0 tem .. if verti, 10 if hori
# lowest verti mesh point
verti_3 = Geometry(dispatch_6.ListA)
deconstruct_mesh_3 = DeconstructMesh(Mesh=verti_3)  # -> Vertices, Faces, Colours, Normals
# CLASS SPECIFIC PREDICTORS: VERTICAL
large_verti_2 = Geometry(dispatch_8.ListA)
deconstruct_vector_7 = DeconstructVector(Vector=deconstruct_mesh_3.Vertices)  # -> XComponent, YComponent, ZComponent
mesh_area_7 = MeshArea(Mesh=large_verti_2)  # -> Area, Centroid
sort_list_8 = SortList(Keys=deconstruct_vector_7.ZComponent, ValuesValuesA=deconstruct_mesh_3.Vertices)  # -> Keys, ValuesValuesA
list_item_13 = ListItem(List=sort_list_8.ValuesValuesA, Index=0, Wrap=True)  # -> simplify(Item)
closest_points_3 = ClosestPoints(Point=list_item_13, Cloud=mesh_area_7.Centroid, Count=10)  # -> ClosestPoint, CPIndex, Distance
list_item_14 = ListItem(List=mesh_area_7.Centroid, Index=closest_points_3.CPIndex, Wrap=True)
deconstruct_5 = Deconstruct(Point=list_item_13)  # -> XComponent, YComponent, expr("x", ZComponent)
deconstruct_6 = Deconstruct(Point=list_item_14)  # -> XComponent, YComponent, simplify(ZComponent)
subtraction_3 = Subtraction(A=deconstruct_6.ZComponent, B=deconstruct_5.ZComponent)
smaller_than_4 = SmallerThan(FirstNumber=subtraction_3, SecondNumber=0.03)  # -> SmallerThan, OrEqualTo
dispatch_15 = Dispatch(List=subtraction_3, DispatchPattern=smaller_than_4.SmallerThan)  # -> ListA, ListB
sort_list_9 = SortList(Keys=dispatch_15.ListA)  # -> expr("round(abs(x),2)", reverse(Keys)), ValuesValuesA
list_item_15 = ListItem(List=sort_list_9.Keys, Index=0, Wrap=True)
replace_nulls_3 = ReplaceNulls(Items=list_item_15, Replacements=10)  # -> flatten(Items), Count
_11_dbot = Panel(replace_nulls_3.Items)

# ----
# Predictor Normal Similarity. Distance from surf normal to dominant normal large surfaces (<7.5° is ok)
# dominant normals of large surf
mesh_closest_point_3 = MeshClosestPoint(Point=mesh_area_3.Centroid, Mesh=stream_filter_6)  # -> Point, Index, Parameter
larger_than_13 = LargerThan(FirstNumber=mesh_area_3.Area, SecondNumber=number_slider)  # -> LargerThan, OrEqualTo
mesh_eval_3 = MeshEval(Mesh=stream_filter_6, Parameter=mesh_closest_point_3.Parameter)  # -> Point, unitize(Normal), Colour
dispatch_16 = Dispatch(List=mesh_eval_3.Normal, DispatchPattern=larger_than_13.LargerThan)  # -> ListA, ListB
point_groups = PointGroups(Points=dispatch_16.ListA, Distance=0.13)  # -> simplify(Groups), Indices
average_2 = Average(Input=point_groups.Groups)  # -> flatten(ArithmeticMean)
closest_points_4 = ClosestPoints(Point=mesh_eval_3.Normal, Cloud=average_2, Count=1)  # -> ClosestPoint, CPIndex, expr("round(x,2)", flatten(Distance))
_3_normal_similarity = Panel(closest_points_4.Distance)

# ----
# Predictor inside/outside walls or floors. inliers of bounding boxes of possible walls/floors
# choose x closest other large verti surf
# select the surf with similar normal
# take thickest wall
# create bounding box around 2 surf
# adjust normal of bounding box to match surf
# test if centroid is within BB
# select surf within 0.6m XY
# seperate H surf and adjust their normals
#  to dominant horizontal normal
# algin plane
# select dominant hori normal
dispatch_17 = Dispatch(List=stream_filter_6, DispatchPattern=larger_than_5.LargerThan)  # -> ListA, ListB
dispatch_18 = Dispatch(List=mesh_area_3.Centroid, DispatchPattern=larger_than_5.LargerThan)  # -> ListA, ListB
dispatch_19 = Dispatch(List=mesh_eval.Normal, DispatchPattern=larger_than_5.LargerThan)  # -> ListA, ListB
large_surf_centroids = Geometry(dispatch_18.ListA)
large_surf_normals = Geometry(dispatch_19.ListA)
large_surf = Geometry(dispatch_17.ListA)
closest_points_5 = ClosestPoints(Point=large_surf_centroids, Cloud=large_surf_centroids, Count=10)  # -> ClosestPoint, CPIndex, Distance
list_item_16 = ListItem(List=large_surf_normals, Index=closest_points_5.CPIndex, Wrap=True)  # -> simplify(Item)
list_item_17 = ListItem(List=large_surf_centroids, Index=closest_points_5.CPIndex, Wrap=True)  # -> simplify(Item)
list_item_18 = ListItem(List=large_surf, Index=closest_points_5.CPIndex, Wrap=True)  # -> simplify(Item)
vector_2pt = Vector2Pt(PointA=simplify(graft(large_surf_centroids)), PointB=list_item_17, Unitize=False)  # -> Vector, Length
dot_product_2 = DotProduct(VectorA=simplify(graft(large_surf_normals)), VectorB=list_item_16, Unitize=False)  # -> expr("abs(x)", DotProduct)
dot_product_3 = DotProduct(VectorA=simplify(graft(large_surf_normals)), VectorB=vector_2pt.Vector, Unitize=False)  # -> expr("abs(x)", DotProduct)
larger_than_14 = LargerThan(FirstNumber=dot_product_2, SecondNumber=0.87)  # -> LargerThan, OrEqualTo
smaller_than_5 = SmallerThan(FirstNumber=dot_product_3, SecondNumber=Slider(0.6, range=0..1))  # -> SmallerThan, OrEqualTo
gate_and_3 = GateAnd(A=larger_than_14.LargerThan, B=smaller_than_5.SmallerThan)
dispatch_20 = Dispatch(List=list_item_18, DispatchPattern=gate_and_3)  # -> ListA, ListB
dispatch_21 = Dispatch(List=dot_product_3, DispatchPattern=gate_and_3)  # -> ListA, ListB
deconstruct_vector_8 = DeconstructVector(Vector=large_surf_normals)  # -> XComponent, YComponent, ZComponent
sort_list_10 = SortList(Keys=dispatch_21.ListA, ValuesValuesA=dispatch_20.ListA)  # -> reverse(Keys), reverse(ValuesValuesA)
larger_than_15 = LargerThan(FirstNumber=deconstruct_vector_8.ZComponent, SecondNumber=0.87)  # -> simplify(graft(LargerThan)), OrEqualTo
list_item_19 = ListItem(List=sort_list_10.ValuesValuesA, Index=1, Wrap=True)
merge_5 = Merge(Data1=simplify(graft(large_surf)), Data2=list_item_19)  # -> simplify(Result)
dispatch_22 = Dispatch(List=merge_5, DispatchPattern=larger_than_15.LargerThan)  # -> ListA, ListB
deconstruct_vector_9 = DeconstructVector(Vector=average_2)  # -> XComponent, YComponent, expr("abs(x)", ZComponent)
unit_x = UnitX(Factor=1)
xy_plane = XYPlane(Origin=Point(0, 0, 0))
smaller_than_6 = SmallerThan(FirstNumber=deconstruct_vector_9.ZComponent, SecondNumber=0.13)  # -> SmallerThan, OrEqualTo
tree_statistics = TreeStatistics(Tree=point_groups.Groups)  # -> Paths, Length, Count
angle = Angle(VectorA=unit_x, VectorB=large_surf_normals, Plane=xy_plane)  # -> simplify(graft(Angle)), Reflex
plane_origin = PlaneOrigin(Base=xy_plane, Origin=large_surf_centroids)  # -> graft(Plane)
dispatch_23 = Dispatch(List=average_2, DispatchPattern=smaller_than_6.SmallerThan)  # -> ListA, ListB
dispatch_24 = Dispatch(List=tree_statistics.Length, DispatchPattern=smaller_than_6.SmallerThan)  # -> ListA, ListB
rotate_plane = RotatePlane(Plane=plane_origin, Angle=angle.Angle)  # -> simplify(Plane)
sort_list_11 = SortList(Keys=dispatch_24.ListA, ValuesValuesA=dispatch_23.ListA)  # -> reverse(Keys), reverse(ValuesValuesA)
bounding_box_2 = BoundingBox(Content=simplify(dispatch_22.ListB), Plane=rotate_plane, UnionBox=True)  # -> Box, Box_2
unit_x_2 = UnitX(Factor=1)
list_item_20 = ListItem(List=sort_list_11.ValuesValuesA, Index=0, Wrap=True)
angle_2 = Angle(VectorA=unit_x_2, VectorB=list_item_20)  # -> Angle, Reflex
xy_plane_2 = XYPlane(Origin=Point(0, 0, 0))
rotate_axis = RotateAxis(Geometry=xy_plane_2, Angle=angle_2.Reflex, Axis=Line((0, 0, 0), (0, 0, 1)))  # -> Geometry, Transform
bounding_box_3 = BoundingBox(Content=dispatch_22.ListA, Plane=rotate_axis.Geometry, UnionBox=True)  # -> Box, Box_2
merge_6 = Merge(Data1=bounding_box_2.Box, Data2=bounding_box_3.Box)
clean_tree = CleanTree(RemoveNulls=True, RemoveInvalid=True, RemoveEmpty=True, Tree=merge_6)  # -> flatten(Tree)
point_in_breps = PointInBreps(Brep=clean_tree, Point=mesh_area_3.Centroid, Strict=False)  # -> flatten(Inside), Index
_10_bb_inliers = Panel(point_in_breps.Inside)

# ----
# Normal Z
deconstruct_vector_10 = DeconstructVector(Vector=mesh_eval_3.Normal)  # -> expr("abs(round(x,1))", XComponent), expr("abs(round(x,1))", YComponent), expr("abs((round(x,2)))", ZComponent)
_4_normal_z = Panel(deconstruct_vector_10.ZComponent)

# ----
# Predictor Proximity.  Distance edge-edge to  closest large surface
# edge curves of meshes
mesh_edges = MeshEdges(Mesh=stream_filter_6)  # -> NakedEdges, InteriorEdges, NonManifoldEdges
centroids_2 = Geometry(mesh_eval.Point)
larger_than_16 = LargerThan(FirstNumber=mesh_area_3.Area, SecondNumber=number_slider)  # -> LargerThan, OrEqualTo
join_curves = JoinCurves(Curves=mesh_edges.NakedEdges, Preserve=False)  # -> simplify(Curves)
dispatch_25 = Dispatch(Centroids=centroids_2, DispatchPattern=larger_than_16.OrEqualTo)  # -> ListA, ListB
length = Length(Curve=join_curves)
sort_list_12 = SortList(Keys=length, ValuesValuesA=join_curves)  # -> reverse(Keys), reverse(ValuesValuesA)
closest_points_6 = ClosestPoints(Point=centroids_2, Cloud=dispatch_25.ListA, Count=10)  # -> ClosestPoint, CPIndex, Distance
list_item_21 = ListItem(List=sort_list_12.ValuesValuesA, Index=0, Wrap=True)  # -> flatten(Item)
dispatch_26 = Dispatch(List=list_item_21, DispatchPattern=larger_than_16.OrEqualTo)  # -> ListA, ListB
list_item_22 = ListItem(List=dispatch_26.ListA, Index=closest_points_6.CPIndex, Wrap=True)
curve_proximity = CurveProximity(CurveA=graft(list_item_21), CurveB=list_item_22)  # -> PointA, PointB, Distance
sort_list_13 = SortList(Keys=curve_proximity.Distance)  # -> expr("round(x,2)", Keys), ValuesValuesA
list_item_23 = ListItem(List=sort_list_13.Keys, Index=0, Wrap=True)  # -> flatten(Item)
_8_proximity = Panel(list_item_23)

# ----
# Predictor Connections.  # connections with neighbours
# 9 neighbours omdat je als muur met max 9 dichte buren kan zitten
# 20cm omdat je dan parrallelle muren als connectie kan hebben. en om een treshold in te bouwen
# or if your are large => +4 (since box hypothesis)
centroids_3 = Geometry(mesh_eval.Point)
closest_points_7 = ClosestPoints(Point=centroids_3, Cloud=centroids_3, Count=10)  # -> ClosestPoint, CPIndex, Distance
edges = Geometry(list_item_21)
list_item_24 = ListItem(List=edges, Index=closest_points_7.CPIndex, Wrap=True)
curve_proximity_2 = CurveProximity(CurveA=graft(edges), CurveB=list_item_24)  # -> PointA, PointB, Distance
smaller_than_7 = SmallerThan(FirstNumber=curve_proximity_2.Distance, SecondNumber=Slider(0.1, range=0..1))  # -> SmallerThan, OrEqualTo
mass_addition = MassAddition(Input=smaller_than_7.SmallerThan)  # -> Result, PartialResults
number_12 = Number(expr("x-1", mass_addition.Result))
larger_than_17 = LargerThan(FirstNumber=mesh_area_3.Area, SecondNumber=number_slider)  # -> LargerThan, OrEqualTo
number_13 = Number(expr("x*4", graft(larger_than_17.OrEqualTo)))
merge_7 = Merge(Data1=number_12, Data2=number_13)
mass_addition_2 = MassAddition(Input=merge_7)  # -> flatten(Result), PartialResults
_9_connections = Panel(mass_addition_2.Result)

# ----
# Predictor Dv_top. Vertical Distance of highest mesh point of verti to closest large horizontal Surface above
# 0 tem .. if verti, 10 if hori
# highest and lowest point
sort_list_14 = SortList(Keys=deconstruct_vector_7.ZComponent, ValuesValuesA=deconstruct_mesh_3.Vertices)  # -> Keys, reverse(ValuesValuesA)
list_item_25 = ListItem(List=sort_list_14.ValuesValuesA, Index=0, Wrap=True)  # -> simplify(Item)
closest_points_8 = ClosestPoints(Point=list_item_25, Cloud=mesh_area_7.Centroid, Count=10)  # -> ClosestPoint, CPIndex, Distance
list_item_26 = ListItem(List=mesh_area_7.Centroid, Index=closest_points_8.CPIndex, Wrap=True)
deconstruct_7 = Deconstruct(Point=list_item_25)  # -> XComponent, YComponent, expr("x-0.05", ZComponent)
deconstruct_8 = Deconstruct(Point=list_item_26)  # -> XComponent, YComponent, ZComponent
subtraction_4 = Subtraction(A=deconstruct_8.ZComponent, B=deconstruct_7.ZComponent)
larger_than_18 = LargerThan(FirstNumber=subtraction_4, SecondNumber=-0.03)  # -> LargerThan, OrEqualTo
dispatch_27 = Dispatch(List=subtraction_4, DispatchPattern=larger_than_18.LargerThan)  # -> ListA, ListB
sort_list_15 = SortList(Keys=dispatch_27.ListA)  # -> expr("abs(round(x,2))", Keys), ValuesValuesA
list_item_27 = ListItem(List=sort_list_15.Keys, Index=0, Wrap=True)
replace_nulls_4 = ReplaceNulls(Items=list_item_27, Replacements=10)  # -> flatten(Items), Count
_12_dtop = Panel(replace_nulls_4.Items)

# ----
# Predictor hoogte
_6_height = Panel(deconstruct_vector_6.ZComponent)

geometry_5 = Geometry(graft(stream_filter_6))
get_rhino_attributes = GetRhinoAttributes(Geometry=stream_filter_6)  # -> Name, Layer, Colour
reference_2 = Text(graft(get_rhino_attributes.Layer))
# Validation component
match_text_7 = MatchText(Text=reference_2, Pattern="Walls", Case=True)
match_text_8 = MatchText(Text=reference_2, Pattern="Beams", Case=True)
match_text_9 = MatchText(Text=reference_2, Pattern="Clutter", Case=True)
match_text_10 = MatchText(Text=reference_2, Pattern="Roofs", Case=True)
match_text_11 = MatchText(Text=reference_2, Pattern="Ceilings", Case=True)
match_text_12 = MatchText(Text=reference_2, Pattern="Floors", Case=True)
dispatch_28 = Dispatch(List=geometry_5, DispatchPattern=match_text)  # -> ListA, ListB
dispatch_29 = Dispatch(List=geometry_5, DispatchPattern=match_text_3)  # -> ListA, ListB
dispatch_30 = Dispatch(List=geometry_5, DispatchPattern=match_text_4)  # -> ListA, ListB
dispatch_31 = Dispatch(List=geometry_5, DispatchPattern=match_text_2)  # -> ListA, ListB
dispatch_32 = Dispatch(List=geometry_5, DispatchPattern=match_text_5)  # -> ListA, ListB
dispatch_33 = Dispatch(List=geometry_5, DispatchPattern=match_text_6)  # -> ListA, ListB
number_14 = Number(expr("x*2", match_text_11))
number_15 = Number(expr("x*3", match_text_10))
number_16 = Number(expr("x*4", match_text_7))
number_17 = Number(expr("x*5", match_text_8))
number_18 = Number(expr("x*6", match_text_9))
# Reference
number_19 = Number(match_text_12)
merge_8 = Merge(Data1=number_19, Data2=number_14, Data3=number_15, Data4=number_16, Data5=number_17, Data6=number_18)
geometry_6 = Geometry(dispatch_28.ListA)
geometry_7 = Geometry(dispatch_29.ListA)
geometry_8 = Geometry(dispatch_30.ListA)
geometry_9 = Geometry(dispatch_31.ListA)
geometry_10 = Geometry(dispatch_32.ListA)
geometry_11 = Geometry(dispatch_33.ListA)
mass_addition_3 = MassAddition(Input=merge_8)  # -> flatten(Reference), PartialResults
list_length_12 = ListLength(List=get_rhino_attributes.Layer)
merge_9 = Merge(Data1=number_19, Data2=number, Data3=number_2, Data4=number_3, Data5=number_4, Data6=number_5)
# give indices of each class for y and reference
series = Series(Start=0, Step=1, Count=list_length_12)
equality = Equality(FirstNumber=mass_addition_3.Reference, SecondNumber=6)  # -> Equality, Inequality
equality_2 = Equality(FirstNumber=mass_addition_3.Reference, SecondNumber=4)  # -> Equality, Inequality
equality_3 = Equality(FirstNumber=mass_addition_3.Reference, SecondNumber=3)  # -> Equality, Inequality
equality_4 = Equality(FirstNumber=mass_addition_3.Reference, SecondNumber=1)  # -> Equality, Inequality
equality_5 = Equality(FirstNumber=mass_addition_3.Reference, SecondNumber=5)  # -> Equality, Inequality
equality_6 = Equality(FirstNumber=mass_addition_3.Reference, SecondNumber=2)  # -> Equality, Inequality
mass_addition_4 = MassAddition(Input=merge_9)  # -> flatten(Reference), PartialResults
duplicate_data = DuplicateData(Data=series, Number=6, Order=True)
equality_7 = Equality(FirstNumber=mass_addition_4.Reference, SecondNumber=6)  # -> Equality, Inequality
equality_8 = Equality(FirstNumber=mass_addition_4.Reference, SecondNumber=4)  # -> Equality, Inequality
equality_9 = Equality(FirstNumber=mass_addition_4.Reference, SecondNumber=3)  # -> Equality, Inequality
equality_10 = Equality(FirstNumber=mass_addition_4.Reference, SecondNumber=1)  # -> Equality, Inequality
equality_11 = Equality(FirstNumber=mass_addition_4.Reference, SecondNumber=5)  # -> Equality, Inequality
equality_12 = Equality(FirstNumber=mass_addition_4.Reference, SecondNumber=2)  # -> Equality, Inequality
entwine_2 = Entwine(
    Branch00=equality_4.Equality,
    Branch01=equality_6.Equality,
    Branch02=equality_3.Equality,
    Branch03=equality_2.Equality,
    Branch04=equality_5.Equality,
    Branch05=equality.Equality,
    FlattenInputs=True)  # -> simplify(Result)
partition_list = PartitionList(List=duplicate_data, Size=list_length_12)  # -> simplify(Chunks)
dispatch_34 = Dispatch(List=partition_list, DispatchPattern=entwine_2)  # -> IndicesRef, ListB
# Write CSV file (WriteMatlabPredictors.gha)
text_3 = Text(get_rhino_attributes.Layer)
geometry_12 = Geometry(stream_filter_6)
entwine_3 = Entwine(
    Branch00=equality_10.Equality,
    Branch01=equality_12.Equality,
    Branch02=equality_9.Equality,
    Branch03=equality_8.Equality,
    Branch04=equality_11.Equality,
    Branch05=equality_7.Equality,
    FlattenInputs=True)  # -> simplify(Result)
list_length_13 = ListLength(List=dispatch_34.IndicesRef)
panel_3 = Panel(list_length_13)

# ----
# Predictor Raytrace trash.
hori_surface_2 = Geometry(simplify(graft(geometry_2)))
clean_tree_2 = CleanTree(RemoveNulls=True, RemoveInvalid=True, RemoveEmpty=True, Tree=hori_surface_2)
trash_2 = Geometry(trash)
mesh_area_8 = MeshArea(Mesh=trash_2)  # -> Area, Centroid
mesh_area_9 = MeshArea(Mesh=clean_tree_2)  # -> Area, Centroid
deconstruct_mesh_4 = DeconstructMesh(Mesh=clean_tree_2)  # -> Vertices, Faces, Colours, Normals
closest_points_9 = ClosestPoints(Point=mesh_area_9.Centroid, Cloud=flatten(mesh_area_9.Centroid), Count=20)  # -> ClosestPoint, CPIndex, Distance
deconstruct_9 = Deconstruct(Point=mesh_area_9.Centroid)  # -> XComponent, YComponent, ZComponent
closest_points_10 = ClosestPoints(Point=mesh_area_9.Centroid, Cloud=mesh_area_8.Centroid, Count=200)  # -> ClosestPoint, CPIndex, Distance
deconstruct_10 = Deconstruct(Point=mesh_area_8.Centroid)  # -> XComponent, YComponent, ZComponent
convex_hull = ConvexHull(Points=deconstruct_mesh_4.Vertices, Plane=PlaneXY(0, 0, 0))  # -> Hull, HullZ, Indices
list_item_28 = ListItem(List=flatten(hori_surface_2), Index=closest_points_9.CPIndex, Wrap=True)
list_item_29 = ListItem(List=deconstruct_10.ZComponent, Index=closest_points_10.CPIndex, Wrap=True)
list_item_30 = ListItem(List=mesh_area_8.Centroid, Index=closest_points_10.CPIndex, Wrap=True)
larger_than_19 = LargerThan(FirstNumber=list_item_29, SecondNumber=expr("x-4", deconstruct_9.ZComponent))  # -> LargerThan, OrEqualTo
smaller_than_8 = SmallerThan(FirstNumber=list_item_29, SecondNumber=deconstruct_9.ZComponent)  # -> SmallerThan, OrEqualTo
gate_and_4 = GateAnd(A=larger_than_19.LargerThan, B=smaller_than_8.SmallerThan)
dispatch_35 = Dispatch(List=list_item_30, DispatchPattern=gate_and_4)  # -> ListA, ListB
point_in_curve = PointInCurve(Point=dispatch_35.ListA, Curve=convex_hull.Hull)  # -> Relationship, Point
equality_13 = Equality(FirstNumber=point_in_curve.Relationship, SecondNumber=0)  # -> Equality, Inequality
dispatch_36 = Dispatch(List=dispatch_35.ListA, DispatchPattern=equality_13.Inequality)  # -> ListA, ListB
geometry_13 = Geometry(dispatch_36.ListA)
deconstruct_11 = Deconstruct(Point=geometry_13)  # -> XComponent, YComponent, ZComponent
construct_point = ConstructPoint(
    XCoordinate=deconstruct_11.XComponent,
    YCoordinate=deconstruct_11.YComponent,
    ZCoordinate=expr("x-0.05", deconstruct_9.ZComponent))
line = Line(StartPoint=geometry_13, EndPoint=construct_point)
collision_one_many = CollisionOneMany(Collider=line, Obstacles=list_item_28)  # -> Collision, Index
number_20 = Number(expr("-(x-1)", collision_one_many.Collision))
mass_addition_5 = MassAddition(Input=number_20)  # -> Result, PartialResults
list_length_14 = ListLength(List=collision_one_many.Collision)
division_5 = Division(A=mass_addition_5.Result, B=list_length_14)
geometry_14 = Geometry(dispatch_6.ListA)
replace_nulls_5 = ReplaceNulls(Items=division_5, Replacements=0)  # -> Items, Count
number_21 = Number(expr("0*x+10", geometry_14))
merge_10 = Merge(Data1=simplify(replace_nulls_5.Items), Data2=simplify(number_21))  # -> flatten(Result)

number_22 = Number(expr("round(x,2)", merge_10))

panel_4 = Panel(number_22)

# ----
# Predictor Z to reference
geometry_15 = Geometry(dispatch_7.ListA)  # disabled
mesh_area_10 = MeshArea(Mesh=geometry_15)  # -> Area, Centroid; disabled
deconstruct_12 = Deconstruct(Point=mesh_area_10.Centroid)  # -> XComponent, YComponent, ZComponent; disabled
construct_point_2 = ConstructPoint(XCoordinate=0, YCoordinate=0, ZCoordinate=deconstruct_12.ZComponent)  # disabled
point_groups_2 = PointGroups(Points=construct_point_2, Distance=2)  # -> Groups, Indices; disabled
list_item_31 = ListItem(List=deconstruct_12.ZComponent, Index=point_groups_2.Indices, Wrap=True)  # -> simplify(Item); disabled
average_3 = Average(Input=list_item_31)  # -> flatten(ArithmeticMean); disabled
sort_list_16 = SortList(Keys=average_3)  # -> Keys, ValuesValuesA; disabled
list_item_32 = ListItem(List=sort_list_16.Keys, Index=0, Wrap=True)  # disabled
geometry_16 = Geometry(mesh_area_3.Centroid)  # disabled
deconstruct_13 = Deconstruct(Point=geometry_16)  # -> XComponent, YComponent, ZComponent; disabled
subtraction_5 = Subtraction(A=deconstruct_13.ZComponent, B=list_item_32)  # disabled

number_23 = Number(expr("round(x,2)", subtraction_5))  # disabled

panel_5 = Panel(number_23)  # disabled

# ----
# Predictor large Hori surf proximity in XY. distance in XY to floor/ceiling curve at projected height. Curve should also allign with direction of floor edge
# or if your are large => 100%
# % of points within 0.4m of hori large
edges_2 = Geometry(list_item_21)  # disabled
dispatch_37 = Dispatch(List=edges_2, DispatchPattern=gate_and)  # -> ListA, SmallEdges; disabled
dispatch_38 = Dispatch(List=mesh_area_3.Centroid, DispatchPattern=gate_and)  # -> ListA, ListB; disabled
centroids_4 = Geometry(mesh_eval.Point)  # disabled
centroid_l_h_surf = Geometry(dispatch_38.ListA)  # disabled
edges_large_hori = Geometry(dispatch_37.ListA)  # disabled
closest_points_11 = ClosestPoints(Point=centroids_4, Cloud=centroid_l_h_surf, Count=5)  # -> ClosestPoint, CPIndex, Distance; disabled
list_item_33 = ListItem(List=centroid_l_h_surf, Index=closest_points_11.CPIndex, Wrap=True)  # disabled
project = Project(Geometry=graft(edges_2), Plane=list_item_33)  # -> simplify(Geometry), Transform; disabled
list_item_34 = ListItem(List=edges_large_hori, Index=closest_points_11.CPIndex, Wrap=True)  # -> simplify(graft(Item)); disabled
number_slider_2 = Slider(0.4, range=0..1)  # disabled

length_2 = Length(Curve=project.Geometry)  # -> expr("round(x,0)+5", Length); disabled

divide_curve = DivideCurve(Curve=project.Geometry, Count=length_2, Kinks=False)  # -> Points, Tangents, Parameters; disabled
curve_closest_point = CurveClosestPoint(Point=divide_curve.Points, Curve=list_item_34)  # -> Point, Parameter, expr("round(x,2)", Distance); disabled
smaller_than_9 = SmallerThan(FirstNumber=curve_closest_point.Distance, SecondNumber=number_slider_2)  # -> SmallerThan, OrEqualTo; disabled
mass_addition_6 = MassAddition(Input=smaller_than_9.SmallerThan)  # -> Result, PartialResults; disabled
shift_paths = ShiftPaths(Data=mass_addition_6.Result, Offset=-1)  # disabled
sort_list_17 = SortList(Keys=shift_paths)  # -> reverse(Keys), ValuesValuesA; disabled
list_item_35 = ListItem(List=sort_list_17.Keys, Index=0, Wrap=True)  # disabled
dispatch_39 = Dispatch(List=list_item_35, DispatchPattern=graft(larger_than_5.LargerThan))  # -> ListA, ListB; disabled
multiplication = Multiplication(A=0, B=dispatch_39.ListA)  # disabled
number_24 = Number(expr("x+100", multiplication))  # disabled
merge_11 = Merge(Data1=number_24, Data2=dispatch_39.ListB)  # -> flatten(Result); disabled
_13_prox_xy = Panel(merge_11)  # disabled

# ----
# Collision Predictor Colabove. Number (0<1 = % of hit )or( 2=vertical ) hit with large hori obstacle 1.5m above (0 for floors and roofs,1 for ceilings)
# raytrace lines (+0.03 - +1.5m)
larger_than_20 = LargerThan(FirstNumber=deconstruct_vector_2.ZComponent, SecondNumber=0.5)  # -> graft(LargerThan), OrEqualTo
larger_than_21 = LargerThan(FirstNumber=mesh_area_3.Area, SecondNumber=number_slider)  # -> graft(LargerThan), OrEqualTo
# CLASS SPECIFIC PREDICTORS: HORIZONTAL
larger_than_22 = LargerThan(FirstNumber=deconstruct_vector_2.ZComponent, SecondNumber=0.5)  # -> graft(LargerThan), OrEqualTo
gate_and_5 = GateAnd(A=larger_than_21.LargerThan, B=larger_than_20.LargerThan)
dispatch_40 = Dispatch(List=graft(mesh_area_3.Area), DispatchPattern=larger_than_22.LargerThan)  # -> ListA, simplify(ListB)
dispatch_41 = Dispatch(List=graft(stream_filter_6), DispatchPattern=larger_than_22.LargerThan)  # -> ListA, ListB
dispatch_42 = Dispatch(List=graft(stream_filter_6), DispatchPattern=gate_and_5)  # -> ListA, ListB
clean_tree_3 = CleanTree(RemoveNulls=True, RemoveInvalid=True, RemoveEmpty=True, Tree=dispatch_41.ListA)  # -> reverse(Tree)
number_25 = Number(expr("(x*0)+2.0", dispatch_40.ListB))
large_hori_surf = Geometry(dispatch_42.ListA)
mesh_area_11 = MeshArea(Mesh=large_hori_surf)  # -> expr("round(x,2)", Area), Centroid
hori_surf = Geometry(clean_tree_3)
mesh_area_12 = MeshArea(Mesh=hori_surf)  # -> expr("round(x,2)", Area), Centroid
deconstruct_14 = Deconstruct(Point=mesh_area_11.Centroid)  # -> XComponent, YComponent, ZComponent
populate_geometry = PopulateGeometry(Geometry=hori_surf, Count=expr("(x+1)", mesh_area_12.Area), Seed=1)  # -> simplify(Population)
sort_list_18 = SortList(Keys=deconstruct_14.ZComponent, ValuesValuesA=large_hori_surf, ValuesA=mesh_area_11.Centroid)  # -> Keys, reverse(flatten(ValuesValuesA)), reverse(flatten(ValuesA))
move = Move(Geometry=populate_geometry, Motion=Vector(0, 0, 1.5))  # -> Geometry, Transform
move_2 = Move(Geometry=populate_geometry, Motion=Vector(0, 0, 0.03))  # -> Geometry, Transform
line_2 = Line(StartPoint=move_2.Geometry, EndPoint=move.Geometry)
list_length_15 = ListLength(List=line_2)

closest_points_12 = ClosestPoints(Point=mesh_area_12.Centroid, Cloud=sort_list_18.ValuesA, Count=10)  # -> ClosestPoint, CPIndex, Distance
list_item_36 = ListItem(List=sort_list_18.ValuesValuesA, Index=closest_points_12.CPIndex, Wrap=True)  # -> simplify(Item)

# ----
# Collision Predictor ColBelow. Number (0<1 = % of hit )or( 2=vertical ) hit with large hori obstacle -1.5m (0 for ceilings)
# large surf should be sorted from low to high. Else raytrace makes mistake
move_3 = Move(Geometry=populate_geometry, Motion=Vector(0, 0, -1.5))  # -> Geometry, Transform
move_4 = Move(Geometry=populate_geometry, Motion=Vector(0, 0, -0.03))  # -> Geometry, Transform
line_3 = Line(StartPoint=move_4.Geometry, EndPoint=move_3.Geometry)
collision_one_many_2 = CollisionOneMany(Collider=line_3, Obstacles=list_item_36)  # -> Collision, Index
mass_addition_7 = MassAddition(Input=collision_one_many_2.Collision)  # -> Result, PartialResults
list_length_16 = ListLength(List=line_2)
division_6 = Division(A=mass_addition_7.Result, B=list_length_16)
merge_12 = Merge(Data1=division_6, Data2=number_25)  # -> flatten(Result)
number_26 = Number(expr("round(x,2)", merge_12))
_15_raytrace_bot = Panel(number_26)

# ----
# Collision Predictor ColFarBelow. Number (0<1 = % of hit )or( 2=vertical ) if hit with large hori obstacle +15m (0 for roofs and outside)
move_5 = Move(Geometry=populate_geometry, Motion=Vector(0, 0, 15))  # -> Geometry, Transform
move_6 = Move(Geometry=populate_geometry, Motion=Vector(0, 0, 0.03))  # -> Geometry, Transform
line_4 = Line(StartPoint=move_6.Geometry, EndPoint=move_5.Geometry)
collision_one_many_3 = CollisionOneMany(Collider=line_4, Obstacles=list_item_36)  # -> Collision, Index
mass_addition_8 = MassAddition(Input=collision_one_many_3.Collision)  # -> Result, PartialResults
list_length_17 = ListLength(List=line_4)
division_7 = Division(A=mass_addition_8.Result, B=list_length_17)
merge_13 = Merge(Data1=division_7, Data2=number_25)  # -> flatten(Result)
number_27 = Number(expr("round(x,2)", merge_13))
_15_raytrace_bot_2 = Panel(number_27)

collision_one_many_4 = CollisionOneMany(Collider=line_2, Obstacles=list_item_36)  # -> Collision, Index
mass_addition_9 = MassAddition(Input=collision_one_many_4.Collision)  # -> Result, PartialResults
division_8 = Division(A=mass_addition_9.Result, B=list_length_15)
merge_14 = Merge(Data1=division_8, Data2=number_25)  # -> flatten(Result)
number_28 = Number(expr("round(x,2)", merge_14))
_14_raytrace_top = Panel(number_28)

number_29 = Number(_2_area)
number_30 = Number(_3_normal_similarity)
number_31 = Number(_4_normal_z)
number_32 = Number(_5_diagonaal_xy)
number_33 = Number(_7_coplanariteit)
number_34 = Number(_6_height)
number_35 = Number(_8_proximity)
number_36 = Number(_9_connections)
number_37 = Number(_10_bb_inliers)
number_38 = Number(_11_dbot)
number_39 = Number(panel_4)
number_40 = Number(_12_dtop)
number_41 = Number(_16_vbot)
number_42 = Number(panel_2)
number_43 = Number(_13_prox_xy)  # disabled
number_44 = Number(_14_raytrace_top)
number_45 = Number(_15_raytrace_bot)
number_46 = Number(_15_raytrace_bot_2)

writematlabpredictors = WriteMatlabPredictors(
    Write=Button(),
    Label=text_3,
    Area=number_29,
    NormalSimilarity=number_30,
    NormalZ=number_31,
    DiagonalXY=number_32,
    Height=number_34,
    Coplanarity=number_33,
    Proximity=number_35,
    Connections=number_36,
    Wallinlier=number_37,
    DvBottom=number_38,
    DvTop=number_40,
    ColAbove=number_44,
    ColBelow=number_45,
    ColFarAbove=number_46,
    Vbot=number_41,
    Vtop=number_42,
    Raytrace=number_39)
bagged_trees_classification = BaggedTreesClassification(
    Geometry=geometry_12,
    Area=number_29,
    NormalSimilarity=number_30,
    NormalZ=number_31,
    DiagonalXY=number_32,
    Height=number_34,
    Coplanarity=number_33,
    Proximity=number_35,
    Connections=number_36,
    Wallinlier=number_37,
    DvBottom=number_38,
    DvTop=number_40,
    ColAbove=number_44,
    ColBelow=number_45,
    ColFarAbove=number_46,
    Vbot=number_41,
    Vtop=number_42,
    Raytrace=number_39)  # -> Geometry, Labels
y = Number(expr("x+1", bagged_trees_classification.Labels))
equality_14 = Equality(FirstNumber=y, SecondNumber=4)  # -> Equality, Inequality
equality_15 = Equality(FirstNumber=y, SecondNumber=1)  # -> Equality, Inequality
dispatch_43 = Dispatch(List=flatten(geometry_5), DispatchPattern=equality_15.Equality)  # -> ListA, ListB
# application
geometry_17 = Geometry(dispatch_43.ListA)
equality_16 = Equality(FirstNumber=y, SecondNumber=2)  # -> Equality, Inequality
equality_17 = Equality(FirstNumber=y, SecondNumber=3)  # -> Equality, Inequality
equality_18 = Equality(FirstNumber=y, SecondNumber=6)  # -> Equality, Inequality
equality_19 = Equality(FirstNumber=y, SecondNumber=5)  # -> Equality, Inequality
entwine_4 = Entwine(
    Branch00=equality_15.Equality,
    Branch01=equality_16.Equality,
    Branch02=equality_17.Equality,
    Branch03=equality_14.Equality,
    Branch04=equality_19.Equality,
    Branch05=equality_18.Equality,
    FlattenInputs=True)  # -> simplify(Result)
dispatch_44 = Dispatch(List=partition_list, DispatchPattern=entwine_4)  # -> IndicesY, ListB
# see how many indices overlap
merge_15 = Merge(Data1=dispatch_44.IndicesY, Data2=dispatch_34.IndicesRef)
sort_list_19 = SortList(Keys=merge_15)  # -> Keys, ValuesValuesA
delete_consecutive = DeleteConsecutive(Set=sort_list_19.Keys, Wrap=False)  # -> Set, Count
list_length_18 = ListLength(List=dispatch_44.IndicesY)
sift_pattern = SiftPattern(List=bagged_trees_classification.Geometry, SiftPattern=bagged_trees_classification.Labels)  # -> Output0, Output1, Output2, Output3, Output4, Output5
# Precision
division_9 = Division(A=delete_consecutive.Count, B=list_length_18)
panel_6 = Panel(division_9)
number_47 = Number(expr("round((100*x),0)", panel_6))
replace_nulls_6 = ReplaceNulls(Items=number_47, Replacements=100)  # -> flatten(Items), Count
set_chart_contents = SetChartContents(ChartToModify=stream_filter_4, NewChartValues=replace_nulls_6.Items)
# Recall
division_10 = Division(A=delete_consecutive.Count, B=list_length_13)
panel_7 = Panel(division_10)
number_48 = Number(expr("round((100*x),0)", panel_7))
replace_nulls_7 = ReplaceNulls(Items=number_48, Replacements=100)  # -> flatten(Items), Count
set_chart_contents_2 = SetChartContents(ChartToModify=stream_filter_3, NewChartValues=replace_nulls_7.Items)
clean_tree_4 = CleanTree(RemoveNulls=True, RemoveInvalid=True, RemoveEmpty=True, Tree=sift_pattern.Output0)
floors_2 = Geometry(clean_tree_4)
clean_tree_5 = CleanTree(RemoveNulls=True, RemoveInvalid=True, RemoveEmpty=True, Tree=sift_pattern.Output2)
roofs_2 = Geometry(clean_tree_5)
clean_tree_6 = CleanTree(RemoveNulls=True, RemoveInvalid=True, RemoveEmpty=True, Tree=sift_pattern.Output3)
walls_2 = Geometry(clean_tree_6)
clean_tree_7 = CleanTree(RemoveNulls=True, RemoveInvalid=True, RemoveEmpty=True, Tree=sift_pattern.Output1)
ceilings_2 = Geometry(clean_tree_7)
clean_tree_8 = CleanTree(RemoveNulls=True, RemoveInvalid=True, RemoveEmpty=True, Tree=sift_pattern.Output4)
beams_2 = Geometry(clean_tree_8)
clean_tree_9 = CleanTree(RemoveNulls=True, RemoveInvalid=True, RemoveEmpty=True, Tree=sift_pattern.Output5)
clutter_2 = Geometry(clean_tree_9)
entwine_5 = Entwine(
    Branch00=floors_2,
    Branch01=ceilings_2,
    Branch02=roofs_2,
    Branch03=walls_2,
    Branch04=beams_2,
    Branch05=clutter_2,
    FlattenInputs=True)  # -> simplify(Result)
tree_branch = TreeBranch(Tree=entwine_5, Path=construct_path, MaintainPaths=True)
set_3d_view = Set3DView(_3DView=stream_filter_7, MeshToDisplay=flatten(tree_branch))
panel_8 = Panel(division_9)
panel_9 = Panel(division_10)
ceilings_3 = Geometry(clean_tree_7)
clutter_3 = Geometry(clean_tree_9)
beams_3 = Geometry(clean_tree_8)
floors_3 = Geometry(clean_tree_4)
roofs_3 = Geometry(clean_tree_5)
walls_3 = Geometry(clean_tree_6)
weighted_average = WeightedAverage(Input=flatten(division_9), Weights=flatten(list_length_13))
weighted_average_2 = WeightedAverage(Input=flatten(division_10), Weights=flatten(list_length_13))
panel_10 = Panel(weighted_average)
panel_11 = Panel(weighted_average_2)
