# Grasshopper definition M_classification_machinelearning.gh (Grasshopper 1.0.7)
# plug-ins: MeshEdit Components, Volvox, EleFront, Scan2BIM

# Classification
geometry = Geometry([<mesh referenced from the Rhino model> x85])
mesh = Mesh(geometry)
clean_tree = CleanTree(RemoveNulls=True, RemoveInvalid=True, RemoveEmpty=True, Tree=mesh)
mesh_area = MeshArea(Mesh=clean_tree)  # -> Area, Centroid
# Area Filter
larger_than = LargerThan(FirstNumber=mesh_area.Area, SecondNumber=Slider(0.4, range=0..1))  # -> LargerThan, OrEqualTo
number_slider = Slider(4, range=0..5)
dispatch = Dispatch(List=mesh, DispatchPattern=larger_than.LargerThan)  # -> ListA, ListB
trash = Geometry(dispatch.ListB)
# MESH
stream_filter = StreamFilter(Gate=Toggle(True), Stream1=dispatch.ListA)
# NORMAL
face_normals = FaceNormals(Mesh=stream_filter)  # -> Centers, Normals
# Area
# CENTROID
mesh_area_2 = MeshArea(Mesh=stream_filter)  # -> expr("round(x,2)", Area), Centroid
larger_than_2 = LargerThan(FirstNumber=mesh_area_2.Area, SecondNumber=number_slider)  # -> LargerThan, OrEqualTo
larger_than_3 = LargerThan(FirstNumber=mesh_area_2.Area, SecondNumber=number_slider)  # -> LargerThan, OrEqualTo
# LARGE
larger_than_4 = LargerThan(FirstNumber=mesh_area_2.Area, SecondNumber=number_slider)  # -> LargerThan, OrEqualTo
average = Average(Input=face_normals.Normals)  # -> flatten(ArithmeticMean)
deconstruct_vector = DeconstructVector(Vector=unitize(average))  # -> expr("abs(round(x,2))", XComponent), expr("abs(round(x,2))", YComponent), expr("abs(round(x,2))", ZComponent)
# LARGE VERTI
smaller_than = SmallerThan(FirstNumber=deconstruct_vector.ZComponent, SecondNumber=0.35)  # -> SmallerThan, OrEqualTo
dispatch_2 = Dispatch(List=graft(stream_filter), DispatchPattern=graft(smaller_than.SmallerThan))  # -> ListA, ListB
# LARGE HORI (Nz >=20°)
larger_than_5 = LargerThan(FirstNumber=deconstruct_vector.ZComponent, SecondNumber=0.35)  # -> LargerThan, OrEqualTo
# Hori
# Trash
geometry_2 = Geometry(dispatch_2.ListB)
# Verti
verti = Geometry(dispatch_2.ListA)
gate_and = GateAnd(A=larger_than_5.OrEqualTo, B=larger_than_2.OrEqualTo)
gate_and_2 = GateAnd(A=smaller_than.SmallerThan, B=larger_than_3.OrEqualTo)
dispatch_3 = Dispatch(List=stream_filter, DispatchPattern=larger_than_4.OrEqualTo)  # -> ListA, ListB
dispatch_4 = Dispatch(List=stream_filter, DispatchPattern=gate_and)  # -> ListA, ListB
dispatch_5 = Dispatch(List=stream_filter, DispatchPattern=gate_and_2)  # -> ListA, ListB
large_verti = Geometry(dispatch_5.ListA)
geometry_3 = Geometry(dispatch_3.ListA)
geometry_4 = Geometry(dispatch_4.ListA)

# ----
# Predictor Coplanarity. distance perpendicular to large plane with same normal (0= good). Coplanariteit
# Normal distance to 5 closest large surf
# deviating normals get bad score
larger_than_6 = LargerThan(FirstNumber=mesh_area_2.Area, SecondNumber=number_slider)  # -> LargerThan, OrEqualTo
normals = Geometry(average)
centroids = Geometry(mesh_area_2.Centroid)
dispatch_6 = Dispatch(Normals=normals, DispatchPattern=larger_than_6.LargerThan)  # -> LargeNormals, ListB
dispatch_7 = Dispatch(Centroids=centroids, DispatchPattern=larger_than_6.LargerThan)  # -> LargeCentroids, ListB
closest_points = ClosestPoints(Point=centroids, Cloud=dispatch_7.LargeCentroids, Count=30)  # -> ClosestPoint, CPIndex, Distance
list_item = ListItem(List=dispatch_6.LargeNormals, Index=closest_points.CPIndex, Wrap=True)
plane_normal = PlaneNormal(Origin=dispatch_7.LargeCentroids, ZAxis=dispatch_6.LargeNormals)
dot_product = DotProduct(VectorA=graft(normals), VectorB=list_item, Unitize=True)  # -> expr("abs(x)", DotProduct)
list_item_2 = ListItem(List=plane_normal, Index=closest_points.CPIndex, Wrap=True)
plane_closest_point = PlaneClosestPoint(Point=graft(centroids), Plane=list_item_2)  # -> Point, UVPoint, expr("abs(x)", Distance)
larger_than_7 = LargerThan(FirstNumber=dot_product, SecondNumber=Slider(0.87, range=0..1))  # -> LargerThan, OrEqualTo
dispatch_8 = Dispatch(List=plane_closest_point.Distance, DispatchPattern=larger_than_7.LargerThan)  # -> ListA, ListB
number = Number(expr("(x*0)+10", dispatch_8.ListB))
merge = Merge(Data1=dispatch_8.ListA, Data2=number)
sort_list = SortList(Keys=merge)  # -> expr("round(x,2)", Keys), ValuesValuesA
list_item_3 = ListItem(List=sort_list.Keys, Index=0, Wrap=True)  # -> flatten(Item)
_7_coplanariteit = Panel(list_item_3)

# ----
# Proximity Predictor Vbot. Vertical distance of hori to bottom of large vertical surfaces
# highest and lowest point
# highest and lowest point
hori_surface = Geometry(geometry_2)
# Proximity Predictor Vtop. Vertical distance of hori to top of large vertical surfaces
large_verti_surface = Geometry(large_verti)
deconstruct_mesh = DeconstructMesh(Mesh=hori_surface)  # -> Vertices, Faces, Colours, Normals
deconstruct_mesh_2 = DeconstructMesh(Mesh=large_verti_surface)  # -> Vertices, Faces, Colours, Normals
mesh_area_3 = MeshArea(Mesh=hori_surface)  # -> Area, Centroid
mesh_area_4 = MeshArea(Mesh=large_verti_surface)  # -> Area, Centroid
deconstruct_vector_2 = DeconstructVector(Vector=deconstruct_mesh.Vertices)  # -> XComponent, YComponent, ZComponent
deconstruct_vector_3 = DeconstructVector(Vector=deconstruct_mesh_2.Vertices)  # -> XComponent, YComponent, ZComponent
sort_list_2 = SortList(Keys=deconstruct_vector_2.ZComponent, ValuesHighest=deconstruct_mesh.Vertices)  # -> Keys, reverse(ValuesHighest)
sort_list_3 = SortList(Keys=deconstruct_vector_3.ZComponent, ValuesHighest=deconstruct_mesh_2.Vertices)  # -> Keys, reverse(ValuesHighest)
sort_list_4 = SortList(Keys=deconstruct_vector_2.ZComponent, ValuesLowest=deconstruct_mesh.Vertices)  # -> Keys, ValuesLowest
sort_list_5 = SortList(Keys=deconstruct_vector_3.ZComponent, ValuesLowest=deconstruct_mesh_2.Vertices)  # -> Keys, ValuesLowest
closest_points_2 = ClosestPoints(Point=mesh_area_3.Centroid, Cloud=mesh_area_4.Centroid, Count=20)  # -> ClosestPoint, CPIndex, Distance
smaller_than_2 = SmallerThan(FirstNumber=closest_points_2.Distance, SecondNumber=10)  # -> SmallerThan, OrEqualTo
dispatch_9 = Dispatch(List=closest_points_2.CPIndex, DispatchPattern=smaller_than_2.SmallerThan)  # -> ListA, ListB
list_item_4 = ListItem(List=sort_list_2.ValuesHighest, Index=0, Wrap=True)
list_item_5 = ListItem(List=sort_list_4.ValuesLowest, Index=0, Wrap=True)
list_item_6 = ListItem(List=sort_list_3.ValuesHighest, Index=0, Wrap=True)  # -> flatten(Item)
list_item_7 = ListItem(List=sort_list_5.ValuesLowest, Index=0, Wrap=True)  # -> flatten(Item)
list_item_8 = ListItem(List=list_item_6, Index=closest_points_2.CPIndex, Wrap=True)
list_item_9 = ListItem(List=large_verti_surface, Index=closest_points_2.CPIndex, Wrap=True)
list_item_10 = ListItem(List=list_item_7, Index=dispatch_9.ListA, Wrap=True)
deconstruct = Deconstruct(Point=list_item_8)  # -> XComponent, YComponent, simplify(ZComponent)
deconstruct_2 = Deconstruct(Point=list_item_4)  # -> XComponent, YComponent, simplify(ZComponent)
deconstruct_3 = Deconstruct(Point=list_item_10)  # -> XComponent, YComponent, simplify(ZComponent)
deconstruct_4 = Deconstruct(Point=list_item_5)  # -> XComponent, YComponent, simplify(ZComponent)
subtraction = Subtraction(A=deconstruct_2.ZComponent, B=deconstruct.ZComponent)
subtraction_2 = Subtraction(A=deconstruct_3.ZComponent, B=deconstruct_4.ZComponent)
sort_list_6 = SortList(Keys=expr("round(abs(x),2)", subtraction))  # -> Keys, ValuesValuesA
sort_list_7 = SortList(Keys=expr("round(abs(x),2)", subtraction_2))  # -> Keys, ValuesValuesA
list_item_11 = ListItem(List=sort_list_6.Keys, Index=0, Wrap=True)
list_item_12 = ListItem(List=sort_list_7.Keys, Index=0, Wrap=True)
replace_nulls = ReplaceNulls(Items=list_item_11, Replacements=10)  # -> flatten(Items), Count
replace_nulls_2 = ReplaceNulls(Items=list_item_12, Replacements=10)  # -> flatten(Items), Count
panel = Panel(replace_nulls.Items)
_16_vbot = Panel(replace_nulls_2.Items)

# ----
# General predictors
# Predictor Area %
bounds = Bounds(Numbers=mesh_area_2.Area)
deconstruct_domain = DeconstructDomain(Domain=bounds)  # -> Start, End
division = Division(A=mesh_area_2.Area, B=deconstruct_domain.End)
number_2 = Number(expr("round(x,2)", division))
_2_area = Panel(number_2)

# ----
# Predictor Dv_bottom. Vertical Distance of lowest mesh point of verti to closest large horizontal Surface
# 0 tem .. if verti, 10 if hori
# lowest verti mesh point
verti_2 = Geometry(dispatch_2.ListA)
deconstruct_mesh_3 = DeconstructMesh(Mesh=verti_2)  # -> Vertices, Faces, Colours, Normals
# CLASS SPECIFIC PREDICTORS: VERTICAL
large_verti_2 = Geometry(dispatch_5.ListA)
deconstruct_vector_4 = DeconstructVector(Vector=deconstruct_mesh_3.Vertices)  # -> XComponent, YComponent, ZComponent
mesh_area_5 = MeshArea(Mesh=large_verti_2)  # -> Area, Centroid
sort_list_8 = SortList(Keys=deconstruct_vector_4.ZComponent, ValuesValuesA=deconstruct_mesh_3.Vertices)  # -> Keys, ValuesValuesA
list_item_13 = ListItem(List=sort_list_8.ValuesValuesA, Index=0, Wrap=True)  # -> simplify(Item)
closest_points_3 = ClosestPoints(Point=list_item_13, Cloud=mesh_area_5.Centroid, Count=10)  # -> ClosestPoint, CPIndex, Distance
list_item_14 = ListItem(List=mesh_area_5.Centroid, Index=closest_points_3.CPIndex, Wrap=True)
deconstruct_5 = Deconstruct(Point=list_item_13)  # -> XComponent, YComponent, expr("x", ZComponent)
deconstruct_6 = Deconstruct(Point=list_item_14)  # -> XComponent, YComponent, simplify(ZComponent)
subtraction_3 = Subtraction(A=deconstruct_6.ZComponent, B=deconstruct_5.ZComponent)
smaller_than_3 = SmallerThan(FirstNumber=subtraction_3, SecondNumber=0.03)  # -> SmallerThan, OrEqualTo
dispatch_10 = Dispatch(List=subtraction_3, DispatchPattern=smaller_than_3.SmallerThan)  # -> ListA, ListB
sort_list_9 = SortList(Keys=dispatch_10.ListA)  # -> expr("round(abs(x),2)", reverse(Keys)), ValuesValuesA
list_item_15 = ListItem(List=sort_list_9.Keys, Index=0, Wrap=True)
replace_nulls_3 = ReplaceNulls(Items=list_item_15, Replacements=10)  # -> flatten(Items), Count
_11_dbot = Panel(replace_nulls_3.Items)

# ----
# Predictor Proximity.  Distance edge-edge to  closest large surface
# edge curves of meshes
mesh_edges = MeshEdges(Mesh=stream_filter)  # -> NakedEdges, InteriorEdges, NonManifoldEdges
centroids_2 = Geometry(mesh_area_2.Centroid)
larger_than_8 = LargerThan(FirstNumber=mesh_area_2.Area, SecondNumber=number_slider)  # -> LargerThan, OrEqualTo
join_curves = JoinCurves(Curves=mesh_edges.NakedEdges, Preserve=False)  # -> simplify(Curves)
dispatch_11 = Dispatch(Centroids=centroids_2, DispatchPattern=larger_than_8.OrEqualTo)  # -> ListA, ListB
length = Length(Curve=join_curves)
sort_list_10 = SortList(Keys=length, ValuesValuesA=join_curves)  # -> reverse(Keys), reverse(ValuesValuesA)
closest_points_4 = ClosestPoints(Point=centroids_2, Cloud=dispatch_11.ListA, Count=10)  # -> ClosestPoint, CPIndex, Distance
list_item_16 = ListItem(List=sort_list_10.ValuesValuesA, Index=0, Wrap=True)  # -> flatten(Item)
dispatch_12 = Dispatch(List=list_item_16, DispatchPattern=larger_than_8.OrEqualTo)  # -> ListA, ListB
list_item_17 = ListItem(List=dispatch_12.ListA, Index=closest_points_4.CPIndex, Wrap=True)
curve_proximity = CurveProximity(CurveA=graft(list_item_16), CurveB=list_item_17)  # -> PointA, PointB, Distance
sort_list_11 = SortList(Keys=curve_proximity.Distance)  # -> expr("round(x,2)", Keys), ValuesValuesA
list_item_18 = ListItem(List=sort_list_11.Keys, Index=0, Wrap=True)  # -> flatten(Item)
_8_proximity = Panel(list_item_18)

# ----
# Predictor Connections.  # connections with neighbours
# 9 neighbours omdat je als muur met max 9 dichte buren kan zitten
# 20cm omdat je dan parrallelle muren als connectie kan hebben. en om een treshold in te bouwen
# or if your are large => +4 (since box hypothesis)
centroids_3 = Geometry(mesh_area_2.Centroid)
closest_points_5 = ClosestPoints(Point=centroids_3, Cloud=centroids_3, Count=10)  # -> ClosestPoint, CPIndex, Distance
edges = Geometry(list_item_16)
list_item_19 = ListItem(List=edges, Index=closest_points_5.CPIndex, Wrap=True)
curve_proximity_2 = CurveProximity(CurveA=graft(edges), CurveB=list_item_19)  # -> PointA, PointB, Distance
smaller_than_4 = SmallerThan(FirstNumber=curve_proximity_2.Distance, SecondNumber=Slider(0.1, range=0..1))  # -> SmallerThan, OrEqualTo
mass_addition = MassAddition(Input=smaller_than_4.SmallerThan)  # -> Result, PartialResults
number_3 = Number(expr("x-1", mass_addition.Result))
larger_than_9 = LargerThan(FirstNumber=mesh_area_2.Area, SecondNumber=number_slider)  # -> LargerThan, OrEqualTo
number_4 = Number(expr("x*4", graft(larger_than_9.OrEqualTo)))
merge_2 = Merge(Data1=number_3, Data2=number_4)
mass_addition_2 = MassAddition(Input=merge_2)  # -> flatten(Result), PartialResults
_9_connections = Panel(mass_addition_2.Result)

# ----
# Predictor Diagonaal XY
plane_normal_2 = PlaneNormal(Origin=Point(0, 0, 0), ZAxis=Vector(0, 0, 1))  # -> graft(Plane)
bounding_box = BoundingBox(Content=graft(stream_filter), Plane=plane_normal_2, UnionBox=True)  # -> flatten(Box), Box_2
box_properties = BoxProperties(Box=bounding_box.Box)  # -> Center, Diagonal, Area, Volume, Degeneracy
deconstruct_vector_5 = DeconstructVector(Vector=box_properties.Diagonal)  # -> expr("abs(round(x,1))", XComponent), expr("abs(round(x,1))", YComponent), expr("abs(round(x,1))", ZComponent)
evaluate = Evaluate(Expression="round(sqrt(x*x+y*y),2)", x=deconstruct_vector_5.XComponent, y=deconstruct_vector_5.YComponent)
_5_diagonaal_xy = Panel(evaluate)

list_item_20 = ListItem(List=bounding_box.Box, Index=0, Wrap=True)
vector = Vector(average)

# ----
# Predictor Dv_top. Vertical Distance of highest mesh point of verti to closest large horizontal Surface above
# 0 tem .. if verti, 10 if hori
# highest and lowest point
sort_list_12 = SortList(Keys=deconstruct_vector_4.ZComponent, ValuesValuesA=deconstruct_mesh_3.Vertices)  # -> Keys, reverse(ValuesValuesA)
list_item_21 = ListItem(List=sort_list_12.ValuesValuesA, Index=0, Wrap=True)  # -> simplify(Item)
closest_points_6 = ClosestPoints(Point=list_item_21, Cloud=mesh_area_5.Centroid, Count=10)  # -> ClosestPoint, CPIndex, Distance
list_item_22 = ListItem(List=mesh_area_5.Centroid, Index=closest_points_6.CPIndex, Wrap=True)
deconstruct_7 = Deconstruct(Point=list_item_21)  # -> XComponent, YComponent, expr("x-0.05", ZComponent)
deconstruct_8 = Deconstruct(Point=list_item_22)  # -> XComponent, YComponent, ZComponent
subtraction_4 = Subtraction(A=deconstruct_8.ZComponent, B=deconstruct_7.ZComponent)
larger_than_10 = LargerThan(FirstNumber=subtraction_4, SecondNumber=-0.03)  # -> LargerThan, OrEqualTo
dispatch_13 = Dispatch(List=subtraction_4, DispatchPattern=larger_than_10.LargerThan)  # -> ListA, ListB
sort_list_13 = SortList(Keys=dispatch_13.ListA)  # -> expr("abs(round(x,2))", Keys), ValuesValuesA
list_item_23 = ListItem(List=sort_list_13.Keys, Index=0, Wrap=True)
replace_nulls_4 = ReplaceNulls(Items=list_item_23, Replacements=10)  # -> flatten(Items), Count
_12_dtop = Panel(replace_nulls_4.Items)

list_length = ListLength(List=stream_filter)
list_length_2 = ListLength(List=stream_filter)
series = Series(Start=0, Step=0, Count=list_length)  # -> simplify(graft(Series))

# ----
# Normal Z
_4_normal_z = Panel(deconstruct_vector.ZComponent)

# ----
# Predictor hoogte
_6_height = Panel(deconstruct_vector_5.ZComponent)

series_2 = Series(Start=0, Step=0, Count=list_length_2)  # -> simplify(graft(Series))
list_length_3 = ListLength(List=stream_filter)
series_3 = Series(Start=0, Step=0, Count=list_length_3)  # -> simplify(graft(Series))
geometry_5 = Geometry(graft(stream_filter))
get_rhino_attributes = GetRhinoAttributes(Geometry=stream_filter)  # -> Name, Layer, Colour
text = Text(["'Walls'", "'Walls'", "'Clutter'", "'Clutter'", "'Clutter'", "'Clutter'"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])
reference = Text(graft(text))
# Validation component
reference_2 = Text(graft(get_rhino_attributes.Layer))
# quick test validation in matlab
match_text = MatchText(Text=reference, Pattern="'Floors'", Case=True)
match_text_2 = MatchText(Text=reference, Pattern="'Roofs'", Case=True)
match_text_3 = MatchText(Text=reference, Pattern="'Ceilings'", Case=True)
match_text_4 = MatchText(Text=reference, Pattern="'Walls'", Case=True)
match_text_5 = MatchText(Text=reference, Pattern="'Beams'", Case=True)
match_text_6 = MatchText(Text=reference, Pattern="'Clutter'", Case=True)
panel_2 = Panel(match_text_6)
match_text_7 = MatchText(Text=reference_2, Pattern="Walls", Case=True)
match_text_8 = MatchText(Text=reference_2, Pattern="Beams", Case=True)
match_text_9 = MatchText(Text=reference_2, Pattern="Clutter", Case=True)
match_text_10 = MatchText(Text=reference_2, Pattern="Roofs", Case=True)
match_text_11 = MatchText(Text=reference_2, Pattern="Ceilings", Case=True)
match_text_12 = MatchText(Text=reference_2, Pattern="Floors", Case=True)
dispatch_14 = Dispatch(List=geometry_5, DispatchPattern=match_text)  # -> ListA, ListB
dispatch_15 = Dispatch(List=geometry_5, DispatchPattern=match_text_3)  # -> ListA, ListB
dispatch_16 = Dispatch(List=geometry_5, DispatchPattern=match_text_4)  # -> ListA, ListB
dispatch_17 = Dispatch(List=geometry_5, DispatchPattern=match_text_2)  # -> ListA, ListB
dispatch_18 = Dispatch(List=geometry_5, DispatchPattern=match_text_5)  # -> ListA, ListB
dispatch_19 = Dispatch(List=geometry_5, DispatchPattern=match_text_6)  # -> ListA, ListB
number_5 = Number(expr("x*2", match_text_11))
number_6 = Number(expr("x*3", match_text_10))
number_7 = Number(expr("x*4", match_text_7))
number_8 = Number(expr("x*5", match_text_8))
# application
number_9 = Number(expr("x*6", match_text_9))
# Reference
number_10 = Number(match_text_12)
merge_3 = Merge(Data1=number_10, Data2=number_5, Data3=number_6, Data4=number_7, Data5=number_8, Data6=number_9)
geometry_6 = Geometry(dispatch_14.ListA)
geometry_7 = Geometry(dispatch_15.ListA)
geometry_8 = Geometry(dispatch_16.ListA)
geometry_9 = Geometry(dispatch_17.ListA)
geometry_10 = Geometry(dispatch_18.ListA)
geometry_11 = Geometry(dispatch_19.ListA)
number_11 = Number(expr("x*2", match_text_3))
number_12 = Number(expr("x*3", match_text_2))
number_13 = Number(expr("x*4", match_text_4))
number_14 = Number(expr("x*5", match_text_5))
number_15 = Number(expr("x*6", match_text_6))
mass_addition_3 = MassAddition(Input=merge_3)  # -> flatten(Reference), PartialResults
list_length_4 = ListLength(List=get_rhino_attributes.Layer)
merge_4 = Merge(Data1=number_10, Data2=number_11, Data3=number_12, Data4=number_13, Data5=number_14, Data6=number_15)
# give indices of each class for y and reference
series_4 = Series(Start=0, Step=1, Count=list_length_4)
mass_addition_4 = MassAddition(Input=merge_4)  # -> flatten(Reference), PartialResults
equality = Equality(FirstNumber=mass_addition_3.Reference, SecondNumber=6)  # -> Equality, Inequality
equality_2 = Equality(FirstNumber=mass_addition_3.Reference, SecondNumber=4)  # -> Equality, Inequality
equality_3 = Equality(FirstNumber=mass_addition_3.Reference, SecondNumber=3)  # -> Equality, Inequality
equality_4 = Equality(FirstNumber=mass_addition_3.Reference, SecondNumber=1)  # -> Equality, Inequality
equality_5 = Equality(FirstNumber=mass_addition_3.Reference, SecondNumber=5)  # -> Equality, Inequality
equality_6 = Equality(FirstNumber=mass_addition_3.Reference, SecondNumber=2)  # -> Equality, Inequality
duplicate_data = DuplicateData(Data=series_4, Number=6, Order=True)
equality_7 = Equality(FirstNumber=mass_addition_4.Reference, SecondNumber=6)  # -> Equality, Inequality
equality_8 = Equality(FirstNumber=mass_addition_4.Reference, SecondNumber=4)  # -> Equality, Inequality
equality_9 = Equality(FirstNumber=mass_addition_4.Reference, SecondNumber=3)  # -> Equality, Inequality
equality_10 = Equality(FirstNumber=mass_addition_4.Reference, SecondNumber=1)  # -> Equality, Inequality
equality_11 = Equality(FirstNumber=mass_addition_4.Reference, SecondNumber=5)  # -> Equality, Inequality
equality_12 = Equality(FirstNumber=mass_addition_4.Reference, SecondNumber=2)  # -> Equality, Inequality
entwine = Entwine(
    Branch00=equality_4.Equality,
    Branch01=equality_6.Equality,
    Branch02=equality_3.Equality,
    Branch03=equality_2.Equality,
    Branch04=equality_5.Equality,
    Branch05=equality.Equality,
    FlattenInputs=True)  # -> simplify(Result)
partition_list = PartitionList(List=duplicate_data, Size=list_length_4)  # -> simplify(Chunks)
dispatch_20 = Dispatch(List=partition_list, DispatchPattern=entwine)  # -> IndicesRef, ListB
# Write CSV file (WriteMatlabPredictors.gha)
text_2 = Text(get_rhino_attributes.Layer)
text_3 = Text("@\"C:\\Users\\maarten.bassier\\Google Drive\\Research\\2016-11 Build Grasshopper plug in\\Predictors\\test.csv\"")
geometry_12 = Geometry(stream_filter)
entwine_2 = Entwine(
    Branch00=equality_10.Equality,
    Branch01=equality_12.Equality,
    Branch02=equality_9.Equality,
    Branch03=equality_8.Equality,
    Branch04=equality_11.Equality,
    Branch05=equality_7.Equality,
    FlattenInputs=True)  # -> simplify(Result)
button = Button()
list_length_5 = ListLength(List=dispatch_20.IndicesRef)
panel_3 = Panel(list_length_5)

# ----
# Predictor Z to reference
geometry_13 = Geometry(dispatch_4.ListA)  # disabled
mesh_area_6 = MeshArea(Mesh=geometry_13)  # -> Area, Centroid; disabled
deconstruct_9 = Deconstruct(Point=mesh_area_6.Centroid)  # -> XComponent, YComponent, ZComponent; disabled
construct_point = ConstructPoint(XCoordinate=0, YCoordinate=0, ZCoordinate=deconstruct_9.ZComponent)  # disabled
point_groups = PointGroups(Points=construct_point, Distance=2)  # -> Groups, Indices; disabled
list_item_24 = ListItem(List=deconstruct_9.ZComponent, Index=point_groups.Indices, Wrap=True)  # -> simplify(Item); disabled
average_2 = Average(Input=list_item_24)  # -> flatten(ArithmeticMean); disabled
sort_list_14 = SortList(Keys=average_2)  # -> Keys, ValuesValuesA; disabled
list_item_25 = ListItem(List=sort_list_14.Keys, Index=0, Wrap=True)  # disabled
geometry_14 = Geometry(mesh_area_2.Centroid)  # disabled
deconstruct_10 = Deconstruct(Point=geometry_14)  # -> XComponent, YComponent, ZComponent; disabled
subtraction_5 = Subtraction(A=deconstruct_10.ZComponent, B=list_item_25)  # disabled

number_16 = Number(expr("round(x,2)", subtraction_5))  # disabled

panel_4 = Panel(number_16)  # disabled

# ----
# Predictor Raytrace trash.
hori_surface_2 = Geometry(simplify(graft(geometry_2)))
clean_tree_2 = CleanTree(RemoveNulls=True, RemoveInvalid=True, RemoveEmpty=True, Tree=hori_surface_2)
trash_2 = Geometry(trash)
mesh_area_7 = MeshArea(Mesh=trash_2)  # -> Area, Centroid
mesh_area_8 = MeshArea(Mesh=clean_tree_2)  # -> Area, Centroid
deconstruct_mesh_4 = DeconstructMesh(Mesh=clean_tree_2)  # -> Vertices, Faces, Colours, Normals
closest_points_7 = ClosestPoints(Point=mesh_area_8.Centroid, Cloud=flatten(mesh_area_8.Centroid), Count=20)  # -> ClosestPoint, CPIndex, Distance
deconstruct_11 = Deconstruct(Point=mesh_area_8.Centroid)  # -> XComponent, YComponent, ZComponent
closest_points_8 = ClosestPoints(Point=mesh_area_8.Centroid, Cloud=mesh_area_7.Centroid, Count=200)  # -> ClosestPoint, CPIndex, Distance
deconstruct_12 = Deconstruct(Point=mesh_area_7.Centroid)  # -> XComponent, YComponent, ZComponent
convex_hull = ConvexHull(Points=deconstruct_mesh_4.Vertices, Plane=PlaneXY(0, 0, 0))  # -> Hull, HullZ, Indices
list_item_26 = ListItem(List=flatten(hori_surface_2), Index=closest_points_7.CPIndex, Wrap=True)
list_item_27 = ListItem(List=deconstruct_12.ZComponent, Index=closest_points_8.CPIndex, Wrap=True)
list_item_28 = ListItem(List=mesh_area_7.Centroid, Index=closest_points_8.CPIndex, Wrap=True)
larger_than_11 = LargerThan(FirstNumber=list_item_27, SecondNumber=expr("x-4", deconstruct_11.ZComponent))  # -> LargerThan, OrEqualTo
smaller_than_5 = SmallerThan(FirstNumber=list_item_27, SecondNumber=deconstruct_11.ZComponent)  # -> SmallerThan, OrEqualTo
gate_and_3 = GateAnd(A=larger_than_11.LargerThan, B=smaller_than_5.SmallerThan)
dispatch_21 = Dispatch(List=list_item_28, DispatchPattern=gate_and_3)  # -> ListA, ListB
point_in_curve = PointInCurve(Point=dispatch_21.ListA, Curve=convex_hull.Hull)  # -> Relationship, Point
equality_13 = Equality(FirstNumber=point_in_curve.Relationship, SecondNumber=0)  # -> Equality, Inequality
dispatch_22 = Dispatch(List=dispatch_21.ListA, DispatchPattern=equality_13.Inequality)  # -> ListA, ListB
geometry_15 = Geometry(dispatch_22.ListA)
deconstruct_13 = Deconstruct(Point=geometry_15)  # -> XComponent, YComponent, ZComponent
construct_point_2 = ConstructPoint(
    XCoordinate=deconstruct_13.XComponent,
    YCoordinate=deconstruct_13.YComponent,
    ZCoordinate=expr("x-0.05", deconstruct_11.ZComponent))
line = Line(StartPoint=geometry_15, EndPoint=construct_point_2)
collision_one_many = CollisionOneMany(Collider=line, Obstacles=list_item_26)  # -> Collision, Index
number_17 = Number(expr("-(x-1)", collision_one_many.Collision))
mass_addition_5 = MassAddition(Input=number_17)  # -> Result, PartialResults
list_length_6 = ListLength(List=collision_one_many.Collision)
division_2 = Division(A=mass_addition_5.Result, B=list_length_6)
geometry_16 = Geometry(simplify(dispatch_2.ListA))
replace_nulls_5 = ReplaceNulls(Items=division_2, Replacements=0)  # -> Items, Count
number_18 = Number(expr("0*x+10", geometry_16))

tree_statistics = TreeStatistics(Tree=geometry_16)  # -> Paths, Length, Count
series_5 = Series(Start=0, Step=0, Count=tree_statistics.Count)  # -> simplify(graft(Series))

# ----
# Predictor large Hori surf proximity in XY. distance in XY to floor/ceiling curve at projected height. Curve should also allign with direction of floor edge
# or if your are large => 100%
# % of points within 0.4m of hori large
edges_2 = Geometry(list_item_16)  # disabled
dispatch_23 = Dispatch(List=edges_2, DispatchPattern=gate_and)  # -> ListA, SmallEdges; disabled
dispatch_24 = Dispatch(List=mesh_area_2.Centroid, DispatchPattern=gate_and)  # -> ListA, ListB; disabled
centroids_4 = Geometry(mesh_area_2.Centroid)  # disabled
centroid_l_h_surf = Geometry(dispatch_24.ListA)  # disabled
edges_large_hori = Geometry(dispatch_23.ListA)  # disabled
closest_points_9 = ClosestPoints(Point=centroids_4, Cloud=centroid_l_h_surf, Count=5)  # -> ClosestPoint, CPIndex, Distance; disabled
list_item_29 = ListItem(List=centroid_l_h_surf, Index=closest_points_9.CPIndex, Wrap=True)  # disabled
project = Project(Geometry=graft(edges_2), Plane=list_item_29)  # -> simplify(Geometry), Transform; disabled
list_item_30 = ListItem(List=edges_large_hori, Index=closest_points_9.CPIndex, Wrap=True)  # -> simplify(graft(Item)); disabled
number_slider_2 = Slider(0.4, range=0..1)  # disabled

length_2 = Length(Curve=project.Geometry)  # -> expr("round(x,0)+5", Length); disabled

divide_curve = DivideCurve(Curve=project.Geometry, Count=length_2, Kinks=False)  # -> Points, Tangents, Parameters; disabled
curve_closest_point = CurveClosestPoint(Point=divide_curve.Points, Curve=list_item_30)  # -> Point, Parameter, expr("round(x,2)", Distance); disabled
smaller_than_6 = SmallerThan(FirstNumber=curve_closest_point.Distance, SecondNumber=number_slider_2)  # -> SmallerThan, OrEqualTo; disabled
mass_addition_6 = MassAddition(Input=smaller_than_6.SmallerThan)  # -> Result, PartialResults; disabled
shift_paths = ShiftPaths(Data=mass_addition_6.Result, Offset=-1)  # disabled
sort_list_15 = SortList(Keys=shift_paths)  # -> reverse(Keys), ValuesValuesA; disabled
list_item_31 = ListItem(List=sort_list_15.Keys, Index=0, Wrap=True)  # disabled
dispatch_25 = Dispatch(List=list_item_31, DispatchPattern=graft(larger_than_4.LargerThan))  # -> ListA, ListB; disabled
multiplication = Multiplication(A=0, B=dispatch_25.ListA)  # disabled
number_19 = Number(expr("x+100", multiplication))  # disabled
merge_5 = Merge(Data1=number_19, Data2=dispatch_25.ListB)  # -> flatten(Result); disabled
_13_prox_xy = Panel(merge_5)  # disabled

# ----
# Predictor inside/outside walls or floors. inliers of bounding boxes of possible walls/floors
# choose x closest other large verti surf
# select the surf with similar normal
# take thickest wall
# create bounding box around 2 surf
# adjust normal of bounding box to match surf
# test if centroid is within BB
# select surf within 0.6m XY
# seperate H surf and adjust their normals
#  to dominant horizontal normal
# algin plane
# select dominant hori normal
dispatch_26 = Dispatch(List=stream_filter, DispatchPattern=larger_than_4.LargerThan)  # -> ListA, ListB
dispatch_27 = Dispatch(List=mesh_area_2.Centroid, DispatchPattern=larger_than_4.LargerThan)  # -> ListA, ListB
dispatch_28 = Dispatch(Normal=average, DispatchPattern=larger_than_4.LargerThan)  # -> ListA, ListB
large_surf_centroids = Geometry(dispatch_27.ListA)
large_surf = Geometry(dispatch_26.ListA)
large_surf_normals = Geometry(dispatch_28.ListA)
closest_points_10 = ClosestPoints(Point=large_surf_centroids, Cloud=large_surf_centroids, Count=10)  # -> ClosestPoint, CPIndex, Distance
list_item_32 = ListItem(List=large_surf_normals, Index=closest_points_10.CPIndex, Wrap=True)  # -> simplify(Item)
list_item_33 = ListItem(List=large_surf_centroids, Index=closest_points_10.CPIndex, Wrap=True)  # -> simplify(Item)
list_item_34 = ListItem(List=large_surf, Index=closest_points_10.CPIndex, Wrap=True)  # -> simplify(Item)
vector_2pt = Vector2Pt(PointA=simplify(graft(large_surf_centroids)), PointB=list_item_33, Unitize=False)  # -> Vector, Length
dot_product_2 = DotProduct(VectorA=simplify(graft(large_surf_normals)), VectorB=list_item_32, Unitize=False)  # -> expr("abs(x)", DotProduct)
dot_product_3 = DotProduct(VectorA=simplify(graft(large_surf_normals)), VectorB=vector_2pt.Vector, Unitize=False)  # -> expr("abs(x)", DotProduct)
larger_than_12 = LargerThan(FirstNumber=dot_product_2, SecondNumber=0.87)  # -> LargerThan, OrEqualTo
smaller_than_7 = SmallerThan(FirstNumber=dot_product_3, SecondNumber=Slider(0.6, range=0..1))  # -> SmallerThan, OrEqualTo
gate_and_4 = GateAnd(A=larger_than_12.LargerThan, B=smaller_than_7.SmallerThan)
dispatch_29 = Dispatch(List=list_item_34, DispatchPattern=gate_and_4)  # -> ListA, ListB
dispatch_30 = Dispatch(List=dot_product_3, DispatchPattern=gate_and_4)  # -> ListA, ListB
deconstruct_vector_6 = DeconstructVector(Vector=large_surf_normals)  # -> XComponent, YComponent, ZComponent
sort_list_16 = SortList(Keys=dispatch_30.ListA, ValuesValuesA=dispatch_29.ListA)  # -> reverse(Keys), reverse(ValuesValuesA)
larger_than_13 = LargerThan(FirstNumber=deconstruct_vector_6.ZComponent, SecondNumber=0.87)  # -> simplify(graft(LargerThan)), OrEqualTo
list_item_35 = ListItem(List=sort_list_16.ValuesValuesA, Index=1, Wrap=True)
merge_6 = Merge(Data1=simplify(graft(large_surf)), Data2=list_item_35)  # -> simplify(Result)
dispatch_31 = Dispatch(List=merge_6, DispatchPattern=larger_than_13.LargerThan)  # -> ListA, ListB
unit_x = UnitX(Factor=1)
xy_plane = XYPlane(Origin=Point(0, 0, 0))
angle = Angle(VectorA=unit_x, VectorB=large_surf_normals, Plane=xy_plane)  # -> simplify(graft(Angle)), Reflex
plane_origin = PlaneOrigin(Base=xy_plane, Origin=large_surf_centroids)  # -> graft(Plane)
rotate_plane = RotatePlane(Plane=plane_origin, Angle=angle.Angle)  # -> simplify(Plane)
bounding_box_2 = BoundingBox(Content=simplify(dispatch_31.ListB), Plane=rotate_plane, UnionBox=True)  # -> Box, Box_2
unit_x_2 = UnitX(Factor=1)
xy_plane_2 = XYPlane(Origin=Point(0, 0, 0))

# ----
# Collision Predictor Colabove. Number (0<1 = % of hit )or( 2=vertical ) hit with large hori obstacle 1.5m above (0 for floors and roofs,1 for ceilings)
# raytrace lines (+0.03 - +1.5m)
larger_than_14 = LargerThan(FirstNumber=deconstruct_vector.ZComponent, SecondNumber=0.5)  # -> graft(LargerThan), OrEqualTo
larger_than_15 = LargerThan(FirstNumber=mesh_area_2.Area, SecondNumber=number_slider)  # -> graft(LargerThan), OrEqualTo
# CLASS SPECIFIC PREDICTORS: HORIZONTAL
larger_than_16 = LargerThan(FirstNumber=deconstruct_vector.ZComponent, SecondNumber=0.5)  # -> graft(LargerThan), OrEqualTo
gate_and_5 = GateAnd(A=larger_than_15.LargerThan, B=larger_than_14.LargerThan)
dispatch_32 = Dispatch(List=graft(mesh_area_2.Area), DispatchPattern=larger_than_16.LargerThan)  # -> ListA, simplify(ListB)
dispatch_33 = Dispatch(List=graft(stream_filter), DispatchPattern=larger_than_16.LargerThan)  # -> ListA, ListB
dispatch_34 = Dispatch(List=graft(stream_filter), DispatchPattern=gate_and_5)  # -> ListA, ListB
clean_tree_3 = CleanTree(RemoveNulls=True, RemoveInvalid=True, RemoveEmpty=True, Tree=dispatch_33.ListA)  # -> reverse(Tree)
number_20 = Number(expr("(x*0)+2.0", dispatch_32.ListB))
large_hori_surf = Geometry(dispatch_34.ListA)
mesh_area_9 = MeshArea(Mesh=large_hori_surf)  # -> expr("round(x,2)", Area), Centroid
hori_surf = Geometry(clean_tree_3)
mesh_area_10 = MeshArea(Mesh=hori_surf)  # -> expr("round(x,2)", Area), Centroid
deconstruct_14 = Deconstruct(Point=mesh_area_9.Centroid)  # -> XComponent, YComponent, ZComponent
populate_geometry = PopulateGeometry(Geometry=hori_surf, Count=expr("(x+1)", mesh_area_10.Area), Seed=1)  # -> simplify(Population)
sort_list_17 = SortList(Keys=deconstruct_14.ZComponent, ValuesValuesA=large_hori_surf, ValuesA=mesh_area_9.Centroid)  # -> Keys, reverse(flatten(ValuesValuesA)), reverse(flatten(ValuesA))
move = Move(Geometry=populate_geometry, Motion=Vector(0, 0, 1.5))  # -> Geometry, Transform
move_2 = Move(Geometry=populate_geometry, Motion=Vector(0, 0, 0.03))  # -> Geometry, Transform
line_2 = Line(StartPoint=move_2.Geometry, EndPoint=move.Geometry)
list_length_7 = ListLength(List=line_2)

closest_points_11 = ClosestPoints(Point=mesh_area_10.Centroid, Cloud=sort_list_17.ValuesA, Count=10)  # -> ClosestPoint, CPIndex, Distance
list_item_36 = ListItem(List=sort_list_17.ValuesValuesA, Index=closest_points_11.CPIndex, Wrap=True)  # -> simplify(Item)

# ----
# Predictor Normal Similarity. Distance from surf normal to dominant normal large surfaces (<7.5° is ok)
# dominant normals of large surf
larger_than_17 = LargerThan(FirstNumber=mesh_area_2.Area, SecondNumber=number_slider)  # -> LargerThan, OrEqualTo
dispatch_35 = Dispatch(List=vector, DispatchPattern=larger_than_17.LargerThan)  # -> ListA, ListB
point_groups_2 = PointGroups(Points=dispatch_35.ListA, Distance=0.13)  # -> simplify(Groups), Indices
average_3 = Average(Input=point_groups_2.Groups)  # -> flatten(ArithmeticMean)

construct_cloud = ConstructCloud(Points=average_3)
closest_point = ClosestPoint(Cloud=construct_cloud, Point=vector)  # -> Point, Normal, Color, expr("round(x,2)", flatten(Distance)), Index

_3_normal_similarity = Panel(closest_point.Distance)

deconstruct_vector_7 = DeconstructVector(Vector=average_3)  # -> XComponent, YComponent, expr("abs(x)", ZComponent)
smaller_than_8 = SmallerThan(FirstNumber=deconstruct_vector_7.ZComponent, SecondNumber=0.13)  # -> SmallerThan, OrEqualTo
tree_statistics_2 = TreeStatistics(Tree=point_groups_2.Groups)  # -> Paths, Length, Count
dispatch_36 = Dispatch(List=average_3, DispatchPattern=smaller_than_8.SmallerThan)  # -> ListA, ListB
dispatch_37 = Dispatch(List=tree_statistics_2.Length, DispatchPattern=smaller_than_8.SmallerThan)  # -> ListA, ListB
sort_list_18 = SortList(Keys=dispatch_37.ListA, ValuesValuesA=dispatch_36.ListA)  # -> reverse(Keys), reverse(ValuesValuesA)
list_item_37 = ListItem(List=sort_list_18.ValuesValuesA, Index=0, Wrap=True)
angle_2 = Angle(VectorA=unit_x_2, VectorB=list_item_37)  # -> Angle, Reflex
rotate_axis = RotateAxis(Geometry=xy_plane_2, Angle=angle_2.Reflex, Axis=Line((0, 0, 0), (0, 0, 1)))  # -> Geometry, Transform
bounding_box_3 = BoundingBox(Content=dispatch_31.ListA, Plane=rotate_axis.Geometry, UnionBox=True)  # -> Box, Box_2
merge_7 = Merge(Data1=bounding_box_2.Box, Data2=bounding_box_3.Box)
clean_tree_4 = CleanTree(RemoveNulls=True, RemoveInvalid=True, RemoveEmpty=True, Tree=merge_7)  # -> flatten(Tree)
point_in_breps = PointInBreps(Brep=clean_tree_4, Point=mesh_area_2.Centroid, Strict=False)  # -> flatten(Inside), Index
_10_bb_inliers = Panel(point_in_breps.Inside)

# ----
# Collision Predictor ColBelow. Number (0<1 = % of hit )or( 2=vertical ) hit with large hori obstacle -1.5m (0 for ceilings)
# large surf should be sorted from low to high. Else raytrace makes mistake
move_3 = Move(Geometry=populate_geometry, Motion=Vector(0, 0, -1.5))  # -> Geometry, Transform
move_4 = Move(Geometry=populate_geometry, Motion=Vector(0, 0, -0.03))  # -> Geometry, Transform
line_3 = Line(StartPoint=move_4.Geometry, EndPoint=move_3.Geometry)
collision_one_many_2 = CollisionOneMany(Collider=line_3, Obstacles=list_item_36)  # -> Collision, Index
mass_addition_7 = MassAddition(Input=collision_one_many_2.Collision)  # -> Result, PartialResults
list_length_8 = ListLength(List=line_2)
division_3 = Division(A=mass_addition_7.Result, B=list_length_8)
merge_8 = Merge(Data1=division_3, Data2=number_20, Data3=series_2)

list_item_38 = ListItem(List=merge_8, Index=0, Wrap=True)  # -> flatten(Item)

number_21 = Number(expr("round(x,2)", list_item_38))
_15_raytrace_bot = Panel(number_21)

# ----
# Collision Predictor ColFarBelow. Number (0<1 = % of hit )or( 2=vertical ) if hit with large hori obstacle +15m (0 for roofs and outside)
move_5 = Move(Geometry=populate_geometry, Motion=Vector(0, 0, 15))  # -> Geometry, Transform
move_6 = Move(Geometry=populate_geometry, Motion=Vector(0, 0, 0.03))  # -> Geometry, Transform
line_4 = Line(StartPoint=move_6.Geometry, EndPoint=move_5.Geometry)
collision_one_many_3 = CollisionOneMany(Collider=line_4, Obstacles=list_item_36)  # -> Collision, Index
mass_addition_8 = MassAddition(Input=collision_one_many_3.Collision)  # -> Result, PartialResults
list_length_9 = ListLength(List=line_4)
division_4 = Division(A=mass_addition_8.Result, B=list_length_9)
merge_9 = Merge(Data1=simplify(division_4), Data2=simplify(number_20), Data3=series)

list_item_39 = ListItem(List=merge_9, Index=0, Wrap=True)  # -> flatten(Item)

number_22 = Number(expr("round(x,2)", list_item_39))
_15_raytrace_bot_2 = Panel(number_22)

collision_one_many_4 = CollisionOneMany(Collider=line_2, Obstacles=list_item_36)  # -> Collision, Index
mass_addition_9 = MassAddition(Input=collision_one_many_4.Collision)  # -> Result, PartialResults
division_5 = Division(A=mass_addition_9.Result, B=list_length_7)
merge_10 = Merge(Data1=division_5, Data2=number_20, Data3=series_3)

list_item_40 = ListItem(List=merge_10, Index=0, Wrap=True)  # -> flatten(Item)

number_23 = Number(expr("round(x,2)", list_item_40))
_14_raytrace_top = Panel(number_23)

merge_11 = Merge(Data1=simplify(replace_nulls_5.Items), Data2=simplify(number_18), Data3=series_5)

list_item_41 = ListItem(List=merge_11, Index=0, Wrap=True)  # -> flatten(Item)
number_24 = Number(expr("round(x,2)", list_item_41))

panel_5 = Panel(number_24)

number_25 = Number(_2_area)
number_26 = Number(_3_normal_similarity)
number_27 = Number(_4_normal_z)
number_28 = Number(_5_diagonaal_xy)
number_29 = Number(_7_coplanariteit)
number_30 = Number(_6_height)
number_31 = Number(_8_proximity)
number_32 = Number(_9_connections)
number_33 = Number(_10_bb_inliers)
number_34 = Number(_11_dbot)
number_35 = Number(panel_5)
number_36 = Number(_12_dtop)
number_37 = Number(_16_vbot)
number_38 = Number(panel)
number_39 = Number(_13_prox_xy)  # disabled
number_40 = Number(_14_raytrace_top)
number_41 = Number(_15_raytrace_bot)
number_42 = Number(_15_raytrace_bot_2)

predict_bagged_trees3 = Predict_Bagged_Trees3(
    Area=number_25,
    NormalSimilarity=number_26,
    NormalZ=number_27,
    DiagonalXY=number_28,
    Height=number_30,
    Coplanarity=number_29,
    Proximity=number_31,
    Connections=number_32,
    Wallinlier=number_33,
    DvBottom=number_34,
    DvTop=number_36,
    ColAbove=number_40,
    ColBelow=number_41,
    ColFarAbove=number_42,
    Vbot=number_37,
    Vtop=number_38,
    Raytrace=number_35)
y = Number(expr("x+1", predict_bagged_trees3))
equality_14 = Equality(FirstNumber=y, SecondNumber=4)  # -> Equality, Inequality
equality_15 = Equality(FirstNumber=y, SecondNumber=1)  # -> Equality, Inequality
dispatch_38 = Dispatch(List=flatten(geometry_5), DispatchPattern=equality_15.Equality)  # -> ListA, ListB
geometry_17 = Geometry(dispatch_38.ListA)
equality_16 = Equality(FirstNumber=y, SecondNumber=2)  # -> Equality, Inequality
equality_17 = Equality(FirstNumber=y, SecondNumber=3)  # -> Equality, Inequality
equality_18 = Equality(FirstNumber=y, SecondNumber=6)  # -> Equality, Inequality
equality_19 = Equality(FirstNumber=y, SecondNumber=5)  # -> Equality, Inequality
entwine_3 = Entwine(
    Branch00=equality_15.Equality,
    Branch01=equality_16.Equality,
    Branch02=equality_17.Equality,
    Branch03=equality_14.Equality,
    Branch04=equality_19.Equality,
    Branch05=equality_18.Equality,
    FlattenInputs=True)  # -> simplify(Result)
dispatch_39 = Dispatch(List=partition_list, DispatchPattern=entwine_3)  # -> IndicesY, ListB
# see how many indices overlap
merge_12 = Merge(Data1=dispatch_39.IndicesY, Data2=dispatch_20.IndicesRef)
sort_list_19 = SortList(Keys=merge_12)  # -> Keys, ValuesValuesA
delete_consecutive = DeleteConsecutive(Set=sort_list_19.Keys, Wrap=False)  # -> Set, Count
list_length_10 = ListLength(List=dispatch_39.IndicesY)
sift_pattern = SiftPattern(List=geometry_12, SiftPattern=predict_bagged_trees3)  # -> Output0, Output1, Output2, Output3, Output4, Output5
# Precision
division_6 = Division(A=delete_consecutive.Count, B=list_length_10)
# Recall
division_7 = Division(A=delete_consecutive.Count, B=list_length_5)
clean_tree_5 = CleanTree(RemoveNulls=True, RemoveInvalid=True, RemoveEmpty=True, Tree=sift_pattern.Output0)
clean_tree_6 = CleanTree(RemoveNulls=True, RemoveInvalid=True, RemoveEmpty=True, Tree=sift_pattern.Output2)
clean_tree_7 = CleanTree(RemoveNulls=True, RemoveInvalid=True, RemoveEmpty=True, Tree=sift_pattern.Output3)
clean_tree_8 = CleanTree(RemoveNulls=True, RemoveInvalid=True, RemoveEmpty=True, Tree=sift_pattern.Output1)
clean_tree_9 = CleanTree(RemoveNulls=True, RemoveInvalid=True, RemoveEmpty=True, Tree=sift_pattern.Output4)
clean_tree_10 = CleanTree(RemoveNulls=True, RemoveInvalid=True, RemoveEmpty=True, Tree=sift_pattern.Output5)
panel_6 = Panel(division_6)
panel_7 = Panel(division_7)
beams = Geometry(clean_tree_9)
clutter = Geometry(clean_tree_10)
floors = Geometry(clean_tree_5)
ceilings = Geometry(clean_tree_8)
roofs = Geometry(clean_tree_6)
walls = Geometry(clean_tree_7)
entwine_4 = Entwine(Branch00=floors, Branch01=ceilings, Branch02=roofs, Branch03=walls, Branch04=beams, Branch05=clutter, FlattenInputs=True)  # -> simplify(Result)

# ----
# colorize meshes
tree_statistics_3 = TreeStatistics(Tree=simplify(entwine_4))  # -> Paths, Length, Count
random = Random(Range=Domain(0, 255), Number=tree_statistics_3.Count, Seed=2)  # -> graft(Random)
random_2 = Random(Range=Domain(0, 255), Number=tree_statistics_3.Count, Seed=50)  # -> graft(Random)
random_3 = Random(Range=Domain(0, 255), Number=tree_statistics_3.Count, Seed=78)  # -> graft(Random)
colour_rgb = ColourRGB(Alpha=255, Red=random, Green=random_2, Blue=random_3)  # -> simplify(Colour)
tree_statistics_4 = TreeStatistics(Tree=colour_rgb)  # -> Paths, Length, Count
replace_paths = ReplacePaths(Data=colour_rgb, Search=tree_statistics_4.Paths, Replace=tree_statistics_3.Paths)

weighted_average = WeightedAverage(Input=flatten(division_6), Weights=flatten(list_length_5))
weighted_average_2 = WeightedAverage(Input=flatten(division_7), Weights=flatten(list_length_5))
walls_2 = Geometry(clean_tree_7)
beams_2 = Geometry(clean_tree_9)
clutter_2 = Geometry(clean_tree_10)
floors_2 = Geometry(clean_tree_5)
ceilings_2 = Geometry(clean_tree_8)
roofs_2 = Geometry(clean_tree_6)
panel_8 = Panel(weighted_average)
panel_9 = Panel(weighted_average_2)
get_rhino_attributes_2 = GetRhinoAttributes(Geometry=entwine_4)  # -> Name, Layer, Color
mesh_colours = MeshColours(
    Mesh=entwine_4,
    Colours=simplify(graft([RGB(255, 0, 0), RGB(128, 0, 128), RGB(0, 0, 255), RGB(0, 128, 0), RGB(255, 255, 0), RGB(255, 255, 255)])))  # -> simplify(Mesh)

# ----
# bake geometry
define_layer = DefineLayer(Name=["Floors", "Ceilings", "Roofs", "Walls", "Beams", "Clutter"])  # -> simplify(graft(Layer))
define_object_attributes = DefineObjectAttributes(Name=get_rhino_attributes_2.Name, Layer=define_layer, Color=replace_paths)
bake_objects = BakeObjects(Geometry=mesh_colours, Attributes=define_object_attributes, BakeName="56", Bake=False)
