# Grasshopper definition M_evalIFC_1.gh (Grasshopper 1.0.7)
# plug-ins: Volvox, GhVa20

# ----
# INPUT
vis2_object = Object(simplify(graft([<object referenced from the Rhino model> x3])))
# TRAINING DATA GENERATION
# this script extracts traiing data from visualARQ and point cloud inputs.
cloud = Cloud([<cloud referenced from the Rhino model> x2])

visualarq_explode = VisualARQExplode(Object=vis2_object, Recursive=True)  # -> Products, Blocks, Breps, Meshes, Curves

# ----
# window specific
deconstruct_window = DeconstructWindow(Window=vis2_object)  # -> Host, Position, Options
deconstruct_window_options = DeconstructWindowOptions(Options=deconstruct_window.Options)  # -> Style, Profile, VerticalAlignment, HorizontalAlignment, InsertionAlignment, AlignmentOffset, OpeningSide, Aperture, Elevation
deconstruct_window_style = DeconstructWindowStyle(Style=deconstruct_window_options.Style)  # -> Name, Components, Type, Profile, Sizes, ModelBlock, PlanBlock
deconstruct_window_leaf = DeconstructWindowLeaf(Leaf=deconstruct_window_style.Components)  # -> Name, Components, Width, Thickness, Invert, Fixed

merge_clouds = MergeClouds(Cloud=cloud)
cloud_2 = Cloud(merge_clouds)
voxel_subsampling = VoxelSubsampling(Size=0.05)

# ----
# mesh IFC
brep = Brep(simplify(visualarq_explode.Breps))
mesh = Mesh(visualarq_explode.Meshes)
mesh_brep = MeshBrep(
    Brep=brep,
    Settings={GridMaxCount=0, GridMinCount=16, JaggedSeams=False, MaxEdgeLength=0, MinEdgeLength=0.0001, MinTolerance=0, Refine=True, RefineAngle=0, RelativeTolerance=0.65, SimplePlanes=True, Tolerance=0})  # -> simplify(Mesh)
path_mapper = PathMapper(mesh_brep, source=["{A}", "{A;B}"], target=["{path_index}", "{path_index}"])
path_mapper_2 = PathMapper(mesh, source=["{A}", "{A;B}"], target=["{path_index}", "{path_index}"])
merge = Merge(Data1=path_mapper, Data2=path_mapper_2)
mesh_join = MeshJoin(Meshes=merge)

# ----
# compute bounding box in the plane
path_mapper_3 = PathMapper(visualarq_explode.Meshes, source=["{A}", "{A;B}"], target=["{path_index}", "{path_index}"])
path_mapper_4 = PathMapper(visualarq_explode.Breps, source=["{A}", "{A;B}"], target=["{path_index}", "{path_index}"])
merge_2 = Merge(Data1=path_mapper_4, Data2=path_mapper_3)
clean_tree = CleanTree(RemoveNulls=True, RemoveInvalid=True, RemoveEmpty=True, Tree=merge_2)
populate_geometry = PopulateGeometry(Geometry=clean_tree, Count=20, Seed=1)
shift_paths = ShiftPaths(Data=populate_geometry, Offset=-1)  # -> simplify(Data)
plane_fit = PlaneFit(Points=shift_paths)  # -> Plane, Deviation
bounding_box = BoundingBox(Content=clean_tree, Plane=plane_fit.Plane, UnionBox=True)  # -> Box, Box_2

cloud_engine = CloudEngine(Cloud=cloud_2, Instruction0=voxel_subsampling)

# ----
# expand BBox
number_slider = Slider(0.1, range=0..1)
z = Slider(0.1, range=0..1)
construct_point = ConstructPoint(XCoordinate=number_slider, YCoordinate=number_slider, ZCoordinate=z)
move = Move(Geometry=bounding_box.Box, Motion=expr("-x", construct_point))  # -> Geometry, Transform
move_2 = Move(Geometry=bounding_box.Box, Motion=construct_point)  # -> Geometry, Transform
merge_3 = Merge(Data1=move.Geometry, Data2=move_2.Geometry)
bounding_box_2 = BoundingBox(Content=merge_3, Plane=plane_fit.Plane, UnionBox=True)  # -> Box, Box_2

mesh_2 = Mesh(mesh_join)

# ----
# select PCD
cloud_3 = Cloud(merge_clouds)
mesh_include = MeshInclude(Cloud=cloud_3, Mesh=bounding_box_2.Box, Leave=False)

# ----
# eval PCD
key = Key("D")
cloud_4 = Cloud(mesh_include)
mesh_compare = MeshCompare(Cloud=cloud_4, Mesh=mesh_2, Key=key)
cull_cloud = CullCloud(Cloud=mesh_compare, Key=key, Domain=[Domain(0, 0.015), Domain(0.015, 0.03), Domain(0.03, 0.05), Domain(0.05, 0.1)])
cloud_statistics = CloudStatistics(Cloud=cull_cloud)  # -> Count, Colors, Colors_2
clean_tree_2 = CleanTree(RemoveNulls=True, RemoveInvalid=True, RemoveEmpty=False, Tree=cloud_statistics.Count)
sort_list = SortList(Keys=clean_tree_2, ValuesA=[0, 1, 2, 3])  # -> reverse(Keys), reverse(ValuesA)
colours = Colours([RGB(0, 255, 0), RGB(255, 255, 0), RGB(255, 128, 0), RGB(255, 0, 0)])
list_item = ListItem(List=sort_list.ValuesA, Index=0, Wrap=True)
list_item_2 = ListItem(List=colours, Index=list_item, Wrap=True)
list_item_3 = ListItem(List=colours, Index=-1, Wrap=True)
replace_nulls = ReplaceNulls(Items=list_item_2, Replacements=list_item_3)  # -> Items, Count
mesh_colours = MeshColours(Mesh=mesh_brep, Colours=replace_nulls.Items)

panel = Panel(cloud_statistics.Count)
number_slider_2 = Slider(2, range=0..10)
list_item_4 = ListItem(List=flatten(mesh_include), Index=number_slider_2, Wrap=True)
list_item_5 = ListItem(List=flatten(bounding_box_2.Box), Index=number_slider_2, Wrap=True)
