# Grasshopper definition M_trainingdata_1.gh (Grasshopper 1.0.7)
# plug-ins: Volvox, GhVa20, TbGh20

# ----
# INPUT
vis2_object = Object(simplify(graft([<object referenced from the Rhino model> x3])))
cloud = Cloud(<cloud referenced from the Rhino model>)

# ----
# TRAINING DATA GENERATION
# this script extracts traiing data from visualARQ and point cloud inputs.
deconstruct_block_instance = DeconstructBlockInstance(BlockInstance=vis2_object)  # -> Block, Point, Normal, Rotation, Scale
visualarq_explode = VisualARQExplode(Object=vis2_object, Recursive=True)  # -> Products, Blocks, Breps, Meshes, Curves

# ----
# window specific
deconstruct_window = DeconstructWindow(Window=vis2_object)  # -> Host, Position, Options
deconstruct_window_options = DeconstructWindowOptions(Options=deconstruct_window.Options)  # -> Style, Profile, VerticalAlignment, HorizontalAlignment, InsertionAlignment, AlignmentOffset, OpeningSide, Aperture, Elevation
deconstruct_window_style = DeconstructWindowStyle(Style=deconstruct_window_options.Style)  # -> Name, Components, Type, Profile, Sizes, ModelBlock, PlanBlock
deconstruct_window_leaf = DeconstructWindowLeaf(Leaf=deconstruct_window_style.Components)  # -> Name, Components, Width, Thickness, Invert, Fixed

# ----
# compute bounding box in the plane
merge = Merge(Data1=visualarq_explode.Breps, Data2=visualarq_explode.Meshes)
clean_tree = CleanTree(RemoveNulls=True, RemoveInvalid=True, RemoveEmpty=True, Tree=merge)
populate_geometry = PopulateGeometry(Geometry=clean_tree, Count=20, Seed=1)
shift_paths = ShiftPaths(Data=populate_geometry, Offset=-1)  # -> simplify(Data)
plane_fit = PlaneFit(Points=shift_paths)  # -> Plane, Deviation
bounding_box = BoundingBox(Content=clean_tree, Plane=plane_fit.Plane, UnionBox=True)  # -> Box, Box_2

list_item = ListItem(List=visualarq_explode.Breps, Index=Slider(0, range=0..10), Wrap=True)

# ----
# expand BBox
number_slider = Slider(0.4, range=0..1)
z = Slider(0.4, range=0..1)
construct_point = ConstructPoint(XCoordinate=number_slider, YCoordinate=number_slider, ZCoordinate=z)
move = Move(Geometry=bounding_box.Box, Motion=expr("-x", construct_point))  # -> Geometry, Transform
move_2 = Move(Geometry=bounding_box.Box, Motion=construct_point)  # -> Geometry, Transform
merge_2 = Merge(Data1=move.Geometry, Data2=move_2.Geometry)
bounding_box_2 = BoundingBox(Content=merge_2, Plane=plane_fit.Plane, UnionBox=True)  # -> Box, Box_2

# ----
# select PCD
cloud_2 = Cloud(cloud)
mesh_include = MeshInclude(Cloud=cloud_2, Mesh=bounding_box_2.Box, Leave=True)

panel = Panel(mesh_include)
