# Grasshopper definition thesis_volumeberekening_10.gh (Grasshopper 1.0.7)
# plug-ins: EleFront, Pancake, Pufferfish, Volvox, Human

reference_by_layer_r6 = ReferenceByLayerR6(LayerName="BT1_Onderbouw_Fundering")

# ----
# start script
boolean_toggle = BooleanToggle(True)
file_path = FilePath("C:\\Users\\r0713363\\Documents\\thesis_jonas\\temp_files\\Volumeberekening")
ghpython_script = GhPythonScript(exportlocatie=file_path, run=boolean_toggle)  # -> out, map
# ---------- ghpython_script: Python ----------
__author__ = "r0713363"
__version__ = "2022.04.21"

import rhinoscriptsyntax as rs
import os
from datetime import datetime
from fileinput import filename
import os.path

map=[]
if run == True:
    today = datetime.now()
    nieuwe_map=exportlocatie + today.strftime('%Y-%m-%d(%H-%M-%S)')
    os.mkdir(nieuwe_map)
    map.append(nieuwe_map)
# ---------- end ghpython_script ----------
file_path_2 = FilePath("C:\Users\r0713363\Documents\thesis_jonas\temp_files")
opkuisen_map = GhPythonScript(search_dir=file_path_2, run=boolean_toggle)  # -> out, a
# ---------- opkuisen_map: Python ----------
__author__ = "r0713363"
__version__ = "2022.04.23"

import rhinoscriptsyntax as rs
import os, shutil

if run==True:
    os.chdir(search_dir)
    files = filter(os.path.isdir, os.listdir(search_dir))
    gesorteerd = [os.path.join(search_dir, f) for f in files] # add path to each file
    gesorteerd.sort(key=lambda x: os.path.getmtime(x))
    
    lengte=len(gesorteerd)
    
    print(gesorteerd)
    print(lengte)
    
    aantal=lengte-10
    verwijderen=[]
    for i in range(aantal):
        shutil.rmtree(gesorteerd[i])
# ---------- end opkuisen_map ----------

# ----
# As-design ifc
list_item = ListItem(List=reference_by_layer_r6, Index=1, Wrap=True)
angle_split_mesh = AngleSplitMesh(Mesh=list_item, Angle=80, Opposite=False)  # -> Split, ResultBoolean
volume = Volume(Geometry=list_item)  # -> Volume, Centroid
deconstruct = Deconstruct(Point=volume.Centroid)  # -> XComponent, YComponent, ZComponent
area = Area(Geometry=angle_split_mesh.Split)  # -> Area, Centroid
deconstruct_2 = Deconstruct(Point=area.Centroid)  # -> XComponent, YComponent, ZComponent
larger_than = LargerThan(FirstNumber=deconstruct_2.ZComponent, SecondNumber=deconstruct.ZComponent)  # -> LargerThan, OrEqualTo
cull_pattern = CullPattern(List=angle_split_mesh.Split, CullPattern=larger_than.OrEqualTo)
mesh_join = MeshJoin(Meshes=cull_pattern)

deleteonlayer = DeleteOnLayer(Run=boolean_toggle, Layer="PancakeDefault", enableFullPath=False)

# ----
# rioleringsbuizen
reference_by_layer_r6_2 = ReferenceByLayerR6(LayerName=["BT5_Rioolpijp_Aansluiting_WRP2", "BT5_Rioolpijp_Hoofdriolering_WRP1"])
mesh_split = MeshSplit(Mesh=reference_by_layer_r6_2, Splitters=list_item)  # -> flatten(Result)
volume_2 = Volume(Geometry=reference_by_layer_r6_2)  # -> Volume, Centroid
list_item_2 = ListItem(List=mesh_split, Index=5, Wrap=True)

# ----
# Bounding box ifc
bounding_box = BoundingBox(Content=mesh_join, Plane=PlaneXY(0, 0, 0))  # -> Box, Box_2
box_corners = BoxCorners(Box=bounding_box.Box)  # -> CornerA, CornerB, CornerC, CornerD, CornerE, CornerF, CornerG, CornerH
move = Move(Geometry=box_corners.CornerA, Motion=Vector(0, 0, -10))  # -> Geometry, Transform
move_2 = Move(Geometry=box_corners.CornerG, Motion=Vector(0, 0, 10))  # -> Geometry, Transform
box_2pt = Box2Pt(PointA=move.Geometry, PointB=move_2.Geometry, Plane=PlaneXY(0, 0, 0))

file_path_3 = FilePath("V:\\Studenten\\Thesis\\Jonas Slagmolen\\Data\\Gregorius\\Vluchten\\20200511 Grego\\MeshLAMBERT08_ELLIPS.obj")

# ----
# As-design 2.5D
reference_by_layer_r6_3 = ReferenceByLayerR6(LayerName="OPHOGING")
curve = Curve(reference_by_layer_r6_3)

# ----
# Selecteren curves
polygon_center = PolygonCenter(Polyline=curve)  # -> CenterV, CenterE, CenterA
point_groups = PointGroups(Points=polygon_center.CenterV, Distance=5)  # -> Groups, Indices
list_item_3 = ListItem(List=curve, Index=point_groups.Indices, Wrap=True)
curve_2 = Curve(list_item_3)

# ----
# evaluate component
series = Series(Start=2, Step=1, Count=2)
tree_statistics = TreeStatistics(Tree=curve_2)  # -> Paths, Length, Count
number_slider = Slider(41, range=0..100)
list_item_4 = ListItem(List=tree_statistics.Paths, Index=series, Wrap=True)
tree_branch = TreeBranch(Tree=curve_2, Path=list_item_4, MaintainPaths=True)

# ----
# 2.5D to 3D mesh
number_slider_2 = Slider(0.2, range=0..1)
divide_distance = DivideDistance(Curve=tree_branch, Distance=number_slider_2)  # -> Points, Tangents, Parameters
trim_tree = TrimTree(Tree=divide_distance.Points, Depth=1)
delaunay_mesh = DelaunayMesh(Points=trim_tree, Plane=PlaneXY(0, 0, 0))

control_points = ControlPoints(Curve=tree_branch)  # -> Points, Weights, Knots
weave = Weave(Pattern=[0, 1], Stream0=divide_distance.Points, Stream1=control_points.Points, NullGaps=False)

# ----
# Bounding box
move_3 = Move(Geometry=tree_branch, Motion=Vector(0, 0, 0))  # -> Geometry, Transform

# ----
# bbox 2.5D
list_length = ListLength(List=tree_branch)
deconstruct_domain = DeconstructDomain(Domain=list_length)  # -> Start, End
subtraction = Subtraction(A=deconstruct_domain.End, B=1)
list_item_5 = ListItem(List=tree_branch, Index=subtraction, Wrap=True)
list_item_6 = ListItem(List=tree_branch, Index=deconstruct_domain.Start, Wrap=True)
move_4 = Move(Geometry=list_item_5, Motion=Vector(0, 0, 10))  # -> Geometry, Transform
move_5 = Move(Geometry=list_item_6, Motion=Vector(0, 0, -10))  # -> Geometry, Transform
insert_items = InsertItems(List=move_5.Geometry, Item=move_4.Geometry, Indices=0, Wrap=True)
weave_2 = Weave(Pattern=[0, 1], Stream0=move_3.Geometry, Stream1=insert_items, NullGaps=False)
bounding_box_2 = BoundingBox(Content=weave_2, Plane=PlaneXY(0, 0, 0), UnionBox=True)  # -> Box, flatten(Box_2)

# ----
# Mesh to split with
close_curve = CloseCurve(Curve=tree_branch, CloseType=0, Bulge=0.5, Tolerance=0)  # -> Closed, ResultBoolean
length = Length(Curve=close_curve.Closed)
sort_list = SortList(Keys=length, ValuesValuesA=close_curve.Closed)  # -> Keys, reverse(ValuesValuesA)
list_item_7 = ListItem(List=sort_list.ValuesValuesA, Index=0, Wrap=True)
move_6 = Move(Geometry=list_item_7, Motion=Vector(0, 0, -20))  # -> Geometry, Transform
move_7 = Move(Geometry=list_item_7, Motion=Vector(0, 0, 10))  # -> Geometry, Transform
weave_3 = Weave(Pattern=[0, 1], Stream0=move_6.Geometry, Stream1=move_7.Geometry, NullGaps=False)
loft = Loft(Curves=weave_3, Options={Adjust=False, Closed=False, LoftEnds=0, LoftSimp=0, LoftType=0, Rebuild=10, Refit=0.01})

weave_4 = Weave(Pattern=[0, 1], Stream0=bounding_box_2.Box_2, Stream1=box_2pt, NullGaps=False)
match_text = MatchText(Text=weave_4, Pattern="Box", Case=True)
cull_pattern_2 = CullPattern(List=weave_4, CullPattern=match_text)
list_length_2 = ListLength(List=cull_pattern_2)

area_2 = Area(Geometry=list_item_7)  # -> Area, Centroid
panel = Panel(area_2.Area)

# ----
# Boundingbox grenzen
deconstruct_box = DeconstructBox(Box=cull_pattern_2)  # -> Plane, X, Y, Z
deconstruct_domain_2 = DeconstructDomain(Domain=deconstruct_box.X)  # -> flatten(Start), flatten(End)
deconstruct_domain_3 = DeconstructDomain(Domain=deconstruct_box.Y)  # -> flatten(Start), flatten(End)
deconstruct_domain_4 = DeconstructDomain(Domain=deconstruct_box.Z)  # -> flatten(Start), flatten(End)
text = Text(deconstruct_domain_2.End)
text_2 = Text(deconstruct_domain_3.Start)
text_3 = Text(deconstruct_domain_3.End)
text_4 = Text(deconstruct_domain_2.Start)
text_5 = Text(deconstruct_domain_4.Start)
text_6 = Text(deconstruct_domain_4.End)

# ----
# Referentie as-built
file_path_4 = FilePath("V:\\Studenten\\Thesis\\Jonas Slagmolen\\Data\\Gregorius\\Vluchten\\20200511 Grego\\MeshLAMBERT08_ELLIPS.obj")
text_7 = Text("referentie_puntenwolk_bbox")
bbox = GhPythonScript(
    map=ghpython_script.map,
    naam=text_7,
    run=boolean_toggle,
    aantal=list_length_2,
    xmin=text_4,
    xmax=text,
    ymin=text_2,
    ymax=text_3,
    zmin=text_5,
    zmax=text_6)  # -> out, export1; inputs aantal: Int32, xmin: list, xmax: list, ymin: list, ymax: list, zmin: list, zmax: list
# ---------- bbox: Python ----------
__author__ = "r0713363"
__version__ = "2022.04.12"

" Opletten dat de input zoals xmin ... telkens op List Acces staat"
import rhinoscriptsyntax as rs
import os
import subprocess
from datetime import datetime
fileformat=".bin"

today = datetime.now()
bestand='%s\\%s' % (map,naam) + today.strftime('%Y-%m-%d_%H-%M-%S')

export1=[]
if run == True:
    for i in range(aantal):
        export='%s_%d%s' % (bestand,i,fileformat)
        string= '%s : %s : %s: %s : %s : %s' % (xmin[i], ymin[i], zmin[i], xmax[i], ymax[i], zmax[i])
        subprocess.Popen(["C:\Program Files\CloudCompare\CloudCompare.exe","-O",mesh,"-AUTO_SAVE","OFF","-CROP",string,"-Save_MESHES","FILE",export])
        export1.append(export)
else:
    export1=("C:\\nietuitgevoerd")
# ---------- end bbox ----------
import_obj = ImportOBJ(File=bbox.export1, MapYtoZ=False, LastSaveLocalization="neutral,N")

# ----
# Split mesh
merge = Merge(Data1=delaunay_mesh, Data2=import_obj)
prune_tree = PruneTree(Tree=merge, Minimum=1, Maximum=0)
mesh_split_2 = MeshSplit(Mesh=prune_tree, Splitters=loft)
list_item_8 = ListItem(List=mesh_split_2, Index=0, Wrap=True)

# ----
# bounding box
text_8 = Text("referentie_puntenwolk_bbox")
file_path_5 = FilePath("V:\\Studenten\\Thesis\\Jonas Slagmolen\\Data\\Gregorius\\Vluchten\\20210419 Gregorius\\TINLAMBERT08_ELLIPS.obj")
bbox_2 = GhPythonScript(
    mesh=file_path_3,
    map=ghpython_script.map,
    naam=text_8,
    run=boolean_toggle,
    aantal=list_length_2,
    xmin=text_4,
    xmax=text,
    ymin=text_2,
    ymax=text_3,
    zmin=text_5,
    zmax=text_6)  # -> out, export1; inputs aantal: Int32, xmin: list, xmax: list, ymin: list, ymax: list, zmin: list, zmax: list
# ---------- bbox_2: Python ----------
__author__ = "r0713363"
__version__ = "2022.04.12"

" Opletten dat de input zoals xmin ... telkens op List Acces staat"
import rhinoscriptsyntax as rs
import os
import subprocess
from datetime import datetime
fileformat=".obj"

today = datetime.now()
bestand='%s\\%s' % (map,naam) + today.strftime('%Y-%m-%d_%H-%M-%S')

export1=[]
if run == True:
    for i in range(aantal):
        export='%s_%d%s' % (bestand,i,fileformat)
        string= '%s : %s : %s: %s : %s : %s' % (xmin[i], ymin[i], zmin[i], xmax[i], ymax[i], zmax[i])
        subprocess.Popen(["C:\Program Files\CloudCompare\CloudCompare.exe","-O",mesh,"-AUTO_SAVE","OFF","-M_EXPORT_FMT","OBJ","-CROP",string,"-Save_MESHES","FILE",export])
        export1.append(export)
else:
    export1=("C:\\nietuitgevoerd")
# ---------- end bbox_2 ----------
import_obj_2 = ImportOBJ(File=bbox_2.export1, MapYtoZ=False, LastSaveLocalization="neutral,N")

# ----
# Save mesh
trim_tree_2 = TrimTree(Tree=list_item_8, Depth=1)
ghpython_script_2 = GhPythonScript(exportlocatie=ghpython_script.map)  # -> out, file_path
# ---------- ghpython_script_2: Python ----------
__author__ = "r0713363"
__version__ = "2022.04.21"

import rhinoscriptsyntax as rs
naam="mesh_as_design"
file_path= '%s\\\%s{0}.stl' % (exportlocatie,naam)
# ---------- end ghpython_script_2 ----------
# Referentie puntenwolk
list_length_3 = ListLength(List=flatten(trim_tree_2))
filepath_series = FilepathSeries(
    PatternOfFilepath=ghpython_script_2.file_path,
    StartingIndex=1,
    QuantityOfFilenames=list_length_3,
    GenerateNext=False,
    Reset=boolean_toggle,
    LastSaveLocalization="neutral,N")  # -> Filepath, ListOfFilepath, CounterOfFirstFile
export_as = ExportAs(
    Geometry=trim_tree_2,
    FileLocation=graft(filepath_series.ListOfFilepath),
    Overwrite=True,
    Export=boolean_toggle,
    CompMode=False,
    LastSaveLocalization="neutral,N")  # -> OK, ExportCommand
trim_tree_3 = TrimTree(Tree=export_as.OK, Depth=1)
sort_list_2 = SortList(Keys=trim_tree_3, ValuesA=trim_tree_3)  # -> Keys, ValuesA
list_item_9 = ListItem(List=sort_list_2.ValuesA, Index=0, Wrap=True)

# ----
# Split mesh
mesh_split_3 = MeshSplit(Mesh=import_obj_2, Splitters=loft)
area_3 = Area(Geometry=mesh_split_3)  # -> Area, Centroid
sort_list_3 = SortList(Keys=area_3.Area, ValuesValuesA=mesh_split_3)  # -> Keys, reverse(ValuesValuesA)
list_item_10 = ListItem(List=sort_list_3.ValuesValuesA, Index=0, Wrap=True)

# ----
# mesh to point cloud
number_slider_3 = Slider(100000, range=0..100000)
list_length_4 = ListLength(List=filepath_series.ListOfFilepath)
text_9 = Text("as_design_puntenwolk")
text_10 = Text(number_slider_3)
mesh_to_pointcloud = GhPythonScript(
    run=list_item_9,
    aantal=list_length_4,
    mesh=filepath_series.ListOfFilepath,
    densiteit=text_10,
    map=ghpython_script.map,
    naam=text_9)  # -> out, map, export1; inputs mesh: list
# ---------- mesh_to_pointcloud: Python ----------
"""Omvormen van mesh naar puntenwolk.
    Inputs:
        run: Boolean True= aan
        aantal= de hoeveelheid verschillende meshes
        mesh: De om te vormen mesh
        densiteit: De densiteit van de te sampelen punten
        export: De locatie waar puntenwolk opgeslagen moet worden
    Output:
        export: Het pad waar de puntenwolk is opgeslagen"""

__author__ = "r0713363"
__version__ = "2022.03.15"

import rhinoscriptsyntax as rs
import os, shutil
import subprocess
from datetime import datetime


fileformat=".e57"

today = datetime.now()
exportlocatie='%s\\\%s_' % (map,naam)
nieuwe_map=exportlocatie + today.strftime('%Y-%m-%d_%H-%M-%S')

export1=[]
map=[]
if run == True:
    for i in range(aantal):
        mesh1=mesh[i]
        Exportmap='%s_%d' % (nieuwe_map,i)
        os.mkdir(Exportmap)
        export= '%s\\%s%s' % (Exportmap,naam,fileformat)
        subprocess.Popen(["C:\Program Files\CloudCompare\CloudCompare.exe","-O",mesh1,"-AUTO_SAVE","OFF","-C_EXPORT_FMT","E57","-SAMPLE_MESH","DENSITY",densiteit,"-SAVE_CLOUDS","FILE",export])
        export1.append(export)
        map.append(Exportmap)
else:
    export1="c:/niet_uitgevoerd"
# ---------- end mesh_to_pointcloud ----------

# ----
# Save mesh
ghpython_script_3 = GhPythonScript(exportlocatie=ghpython_script.map)  # -> out, file_path
# ---------- ghpython_script_3: Python ----------
__author__ = "r0713363"
__version__ = "2022.04.21"

import rhinoscriptsyntax as rs
naam="mesh_as_build"
file_path= '%s\\\%s{0}.stl' % (exportlocatie,naam)
# ---------- end ghpython_script_3 ----------
# As-built
trim_tree_4 = TrimTree(Tree=list_item_10, Depth=1)
list_length_5 = ListLength(List=bbox_2.export1)
filepath_series_2 = FilepathSeries(
    PatternOfFilepath=ghpython_script_3.file_path,
    StartingIndex=1,
    QuantityOfFilenames=list_length_5,
    GenerateNext=False,
    Reset=boolean_toggle,
    LastSaveLocalization="neutral,N")  # -> Filepath, ListOfFilepath, CounterOfFirstFile
export_as_2 = ExportAs(
    Geometry=trim_tree_4,
    FileLocation=graft(filepath_series_2.ListOfFilepath),
    Overwrite=True,
    Export=boolean_toggle,
    CompMode=False,
    LastSaveLocalization="neutral,N")  # -> OK, ExportCommand
trim_tree_5 = TrimTree(Tree=export_as_2.OK, Depth=1)

sort_list_4 = SortList(Keys=trim_tree_5, ValuesA=trim_tree_5)  # -> Keys, ValuesA

list_item_11 = ListItem(List=sort_list_4.ValuesA, Index=0, Wrap=True)

# ----
# Mesh to point cloud
number_slider_4 = Slider(100000, range=0..100000)
text_11 = Text(number_slider_4)
text_12 = Text("mesh_as_build_to_pointcloud")
mesh_to_pointcloud_2 = GhPythonScript(
    run=list_item_11,
    aantal=list_length_5,
    mesh=filepath_series_2.ListOfFilepath,
    densiteit=text_11,
    map=ghpython_script.map,
    naam=text_12)  # -> out, export1; inputs mesh: list
# ---------- mesh_to_pointcloud_2: Python ----------
"""Omvormen van mesh naar puntenwolk.
    Inputs:
        run: Boolean True= aan
        aantal= de hoeveelheid verschillende meshes
        mesh: De om te vormen mesh
        densiteit: De densiteit van de te sampelen punten
        export: De locatie waar puntenwolk opgeslagen moet worden
    Output:
        export: Het pad waar de puntenwolk is opgeslagen"""

__author__ = "r0713363"
__version__ = "2022.03.15"

import rhinoscriptsyntax as rs
import os, shutil
import subprocess
from datetime import datetime


fileformat=".e57"

today = datetime.now()
exportlocatie='%s\\%s_' % (map,naam)
nieuwe_map=exportlocatie + today.strftime('%Y-%m-%d_%H-%M-%S')

export1=[]
if run == True:
    for i in range(aantal):
        mesh1=mesh[i]
        Exportmap='%s_%d' % (nieuwe_map,i)
        os.mkdir(Exportmap)
        export= '%s\\%s%s' % (Exportmap,naam,fileformat)
        subprocess.Popen(["C:\Program Files\CloudCompare\CloudCompare.exe","-O",mesh1,"-AUTO_SAVE","OFF","-C_EXPORT_FMT","E57","-SAMPLE_MESH","DENSITY",densiteit,"-SAVE_CLOUDS","FILE",export])
        export1.append(export)
else:
    for i in range(aantal):
        export="c:\\niet_uitgevoerd"
        export1.append(export)
# ---------- end mesh_to_pointcloud_2 ----------

list_length_6 = ListLength(List=mesh_to_pointcloud_2.export1)
merge_2 = Merge(Data1=mesh_to_pointcloud.export1, Data2=mesh_to_pointcloud_2.export1)
list_length_7 = ListLength(List=merge_2)
file_path_6 = FilePath(merge_2)
ghpython_script_4 = GhPythonScript(file=file_path_6, aantal=list_length_7)  # -> out, run; inputs file: list
# ---------- ghpython_script_4: Python ----------
__author__ = "r0713363"
__version__ = "2022.04.24"

import rhinoscriptsyntax as rs
import os

start=[]
for i in range(aantal):
    if os.path.isfile(file[i]):
        start1=True
        start.append(start1)
    else:
        start2=False
        start.append(start2)
gesorteerd=sorted(start)
run=gesorteerd[0]
# ---------- end ghpython_script_4 ----------

# ----
# Volumeberekening
text_13 = Text("0.1")
file_path_7 = FilePath("C:\\Users\\r0713363\\Documents\\thesis_jonas\\volumeberekening_puntenwolk1")
file_path_8 = FilePath("C:\\Users\\r0713363\\Documents\\thesis_jonas\\volumeberekening_puntenwolk2_")
file_path_9 = FilePath("C:\\Users\\r0713363\\Documents\\thesis_jonas\\volumeberekening_resultaat_")
volume_3 = GhPythonScript(
    run=Toggle(True),
    aantal=list_length_6,
    rapportlocatie=mesh_to_pointcloud.map,
    cloud1=mesh_to_pointcloud.export1,
    cloud2=mesh_to_pointcloud_2.export1,
    grid_step=text_13,
    exportlocatie1=file_path_7,
    exportlocatie2=file_path_8,
    exportlocatie3=file_path_9)  # -> out, volumerapport, model; inputs rapportlocatie: list, cloud1: list, cloud2: list
# ---------- volume_3: Python ----------
__author__ = "Jonas"
__version__ = "2022.02.11"



import rhinoscriptsyntax as rs
import os
import subprocess

fileformat=".e57"

volumerapport=[]
model=[]
if run == True:
    for i in range(aantal):
        Cloud1=cloud1[i]
        Cloud2=cloud2[i]
        Export1= '%s%d%s' % (exportlocatie1,i,fileformat)
        Export2= '%s%d%s' % (exportlocatie2,i,fileformat)
        Export3= '%s%d%s' % (exportlocatie3,i,fileformat)
        rapportlocatie1=rapportlocatie[i]
        rapportmap= '%s\VolumeCalculationReport.txt' %(rapportlocatie1)
        subprocess.Popen(["C:\Program Files\CloudCompare\CloudCompare.exe","-O",Cloud1,"-O",Cloud2,"-AUTO_SAVE","OFF","-C_EXPORT_FMT","E57","-NO_TIMESTAMP","-VOLUME","-GRID_STEP",grid_step,"-SAVE_CLOUDS","FILE",Export1,"FILE",Export2,"FILE",Export3])
        volumerapport.append(rapportmap)
        model.append(Export3)
# ---------- end volume_3 ----------
list_length_8 = ListLength(List=volume_3.model)
read_file = ReadFile(File=volume_3.volumerapport, PerLineParse=True)
ghpython_script_5 = GhPythonScript(file=volume_3.model, aantal=list_length_8)  # -> out, run; inputs file: list; same code as ghpython_script_4
list_item_12 = ListItem(List=read_file, Index=[0, 3, 4], Wrap=True)
text_14 = Text(ghpython_script_5.run)
panel_2 = Panel(list_item_12)

import_to_document = ImportToDocument(File=volume_3.model, OK=text_14, LastSaveLocalization="neutral,N")  # -> graft(Guid), Layer, ObjectAttributes
cloud = Cloud(import_to_document.Guid)
list_item_13 = ListItem(List=read_file, Index=1, Wrap=True)
panel_3 = Panel(list_item_13)
