# Grasshopper definition Stanford2D3D_CRF_Decoding.gh (Grasshopper 1.0.7)
# plug-ins: EleFront, Scan2BIM

# This script extracts relevant spatial features from each wall segment
# and each connection between them
# for the purpose of clustering.
# Input Wall/floors/ceiling segments
# Sort by largest first
wall_segments = Mesh([<mesh referenced from the Rhino model> x235])
ceilings = Geometry([<mesh referenced from the Rhino model> x55])
floors = Geometry([<mesh referenced from the Rhino model> x44])
sort_list = SortList(Keys=wall_segments, ValuesValuesA=wall_segments)  # -> Keys, reverse(ValuesValuesA)

# ----
# A. Graph creation G(N,E), culling of unreliable edges and parameter extraction
# 0. Fully adjancency matrix (k=20). Paths = indices
area = Area(Geometry=sort_list.ValuesValuesA)  # -> Area, Centroid
list_length = ListLength(List=sort_list.ValuesValuesA)
closest_points = ClosestPoints(Point=area.Centroid, Cloud=area.Centroid, Count=Slider(20, range=0..100))  # -> simplify(FullAdjenccyMatrix), simplify(CPIndex), simplify(Distance)
series = Series(Start=0, Step=1, Count=list_length)  # -> simplify(graft(Series))
cull_index = CullIndex(Index=closest_points.CPIndex, Indices=0, Wrap=True)  # -> simplify(List)
list_item = ListItem(List=sort_list.ValuesValuesA, Index=cull_index, Wrap=True)  # -> simplify(Item)
list_length_2 = ListLength(List=list_item)
duplicate_data = DuplicateData(Data=series, Number=list_length_2, Order=True)  # -> simplify(Data)
integer = Integer(duplicate_data)
integer_2 = Integer(cull_index)
merge = Merge(Data1=graft(integer), Data2=graft(integer_2))  # -> simplify(Result)
construct_path = ConstructPath(Indices=merge)  # -> flatten(Branch)
tree_statistics = TreeStatistics(Tree=merge)  # -> Paths, Length, Count
replace_paths = ReplacePaths(Data=merge, Search=tree_statistics.Paths, Replace=construct_path)
list_item_2 = ListItem(Centroid=area.Centroid, Index=replace_paths, Wrap=True)
list_item_3 = ListItem(List=sort_list.ValuesValuesA, Index=replace_paths, Wrap=True)
list_item_4 = ListItem(List=area.Area, Index=replace_paths, Wrap=True)

# ----
# 1. cull edges |boundary|>2m
list_item_5 = ListItem(List=list_item_2, Index=0, Wrap=True)
list_item_6 = ListItem(List=list_item_3, Index=0, Wrap=True)
list_item_7 = ListItem(List=list_item_3, Index=1, Wrap=True)
list_item_8 = ListItem(List=list_item_2, Index=1, Wrap=True)
mesh_closest_point = MeshClosestPoint(Point=list_item_8, Mesh=list_item_6)  # -> Point, Index, Parameter
mesh_closest_point_2 = MeshClosestPoint(Point=list_item_5, Mesh=list_item_7)  # -> Point, Index, Parameter
mesh_eval = MeshEval(Mesh=list_item_6, Parameter=mesh_closest_point.Parameter)  # -> Point, Normal, Colour
mesh_eval_2 = MeshEval(Mesh=list_item_7, Parameter=mesh_closest_point_2.Parameter)  # -> Point, Normal, Colour
line = Line(StartPoint=mesh_eval.Point, EndPoint=mesh_eval_2.Point)
length = Length(Curve=line)
smaller_than = SmallerThan(FirstNumber=length, SecondNumber=Slider(2, range=0..10))  # -> SmallerThan, OrEqualTo
dispatch = Dispatch(List=list_item_3, DispatchPattern=smaller_than.SmallerThan)  # -> simplify(ListA), ListB
dispatch_2 = Dispatch(Centroid=list_item_2, DispatchPattern=smaller_than.SmallerThan)  # -> simplify(ListA), ListB
dispatch_3 = Dispatch(List=line, DispatchPattern=smaller_than.SmallerThan)  # -> simplify(ListA), ListB
dispatch_4 = Dispatch(List=list_item_4, DispatchPattern=smaller_than.SmallerThan)  # -> simplify(ListA), ListB
clean_tree = CleanTree(RemoveNulls=True, RemoveInvalid=True, RemoveEmpty=True, Tree=dispatch_2.ListA)
clean_tree_2 = CleanTree(RemoveNulls=True, RemoveInvalid=True, RemoveEmpty=True, Tree=dispatch.ListA)
clean_tree_3 = CleanTree(RemoveNulls=True, RemoveInvalid=True, RemoveEmpty=True, Tree=dispatch_3.ListA)
clean_tree_4 = CleanTree(RemoveNulls=True, RemoveInvalid=True, RemoveEmpty=True, Tree=dispatch_4.ListA)

# ----
# 2. cull edges BoundingBox>0.8m
list_item_9 = ListItem(List=clean_tree, Index=1, Wrap=True)
list_item_10 = ListItem(List=clean_tree, Index=0, Wrap=True)
area_2 = Area(Geometry=clean_tree_2)  # -> Area, Centroid
line_2 = Line(StartPoint=list_item_10, EndPoint=list_item_9)
mesh_closest_point_3 = MeshClosestPoint(Point=area_2.Centroid, Mesh=clean_tree_2)  # -> Point, Index, Parameter
mesh_eval_3 = MeshEval(Mesh=clean_tree_2, Parameter=mesh_closest_point_3.Parameter)  # -> Point, Normal, Colour
sort_list_2 = SortList(Keys=clean_tree_4, ValuesMesh=clean_tree_2, ValuesCentroid=clean_tree, ValuesNormal=mesh_eval_3.Normal)  # -> reverse(Keys), reverse(ValuesMesh), reverse(ValuesCentroid), reverse(ValuesNormal)
list_item_11 = ListItem(List=sort_list_2.ValuesNormal, Index=0, Wrap=True)
list_item_12 = ListItem(List=sort_list_2.ValuesCentroid, Index=1, Wrap=True)
list_item_13 = ListItem(List=sort_list_2.ValuesCentroid, Index=0, Wrap=True)
vector_2pt = Vector2Pt(PointA=list_item_13, PointB=list_item_12, Unitize=False)  # -> Vector, Length
dot_product = DotProduct(VectorA=list_item_11, VectorB=vector_2pt.Vector, Unitize=False)
smaller_than_2 = SmallerThan(FirstNumber=dot_product, SecondNumber=Slider(0.8, range=0..1))  # -> SmallerThan, OrEqualTo
dispatch_5 = Dispatch(List=sort_list_2.Keys, DispatchPattern=smaller_than_2.SmallerThan)  # -> ListA, ListB
dispatch_6 = Dispatch(List=sort_list_2.ValuesMesh, DispatchPattern=smaller_than_2.SmallerThan)  # -> ListA, ListB
dispatch_7 = Dispatch(Normal=sort_list_2.ValuesNormal, DispatchPattern=smaller_than_2.SmallerThan)  # -> ListA, ListB
dispatch_8 = Dispatch(Centroid=sort_list_2.ValuesCentroid, DispatchPattern=smaller_than_2.SmallerThan)  # -> ListA, ListB
dispatch_9 = Dispatch(List=clean_tree_3, DispatchPattern=smaller_than_2.SmallerThan)  # -> ListA, ListB
clean_tree_5 = CleanTree(RemoveNulls=True, RemoveInvalid=True, RemoveEmpty=True, Tree=dispatch_5.ListA)
clean_tree_6 = CleanTree(RemoveNulls=True, RemoveInvalid=True, RemoveEmpty=True, Tree=dispatch_6.ListA)
clean_tree_7 = CleanTree(RemoveNulls=True, RemoveInvalid=True, RemoveEmpty=True, Tree=dispatch_7.ListA)
clean_tree_8 = CleanTree(RemoveNulls=True, RemoveInvalid=True, RemoveEmpty=True, Tree=dispatch_8.ListA)
clean_tree_9 = CleanTree(RemoveNulls=True, RemoveInvalid=True, RemoveEmpty=True, Tree=dispatch_9.ListA)

panel = Panel(dot_product)

# ----
# 3. Remove duplicates
list_item_14 = ListItem(List=clean_tree_8, Index=0, Wrap=True)
list_item_15 = ListItem(List=clean_tree_8, Index=1, Wrap=True)
line_3 = Line(StartPoint=list_item_14, EndPoint=list_item_15)
evaluate_length = EvaluateLength(Curve=line_3, Length=0.5, Normalized=True)  # -> flatten(Point), Tangent, Parameter
tree_statistics_2 = TreeStatistics(Tree=line_3)  # -> Paths, Length, Count
point_groups = PointGroups(Points=evaluate_length.Point, Distance=expr("0.01", 1))  # -> simplify(Groups), simplify(Indices)
list_item_16 = ListItem(List=point_groups.Indices, Index=0, Wrap=True)
list_item_17 = ListItem(List=tree_statistics_2.Paths, Index=list_item_16, Wrap=True)
tree_branch = TreeBranch(Tree=clean_tree_8, Path=list_item_17, MaintainPaths=True)
tree_branch_2 = TreeBranch(Tree=clean_tree_7, Path=list_item_17, MaintainPaths=True)
tree_branch_3 = TreeBranch(Tree=clean_tree_6, Path=list_item_17, MaintainPaths=True)
tree_branch_4 = TreeBranch(Tree=clean_tree_9, Path=list_item_17, MaintainPaths=True)
tree_branch_5 = TreeBranch(Tree=clean_tree_5, Path=list_item_17, MaintainPaths=True)

number_slider = Slider(1, range=0..10)
number_slider_2 = Slider(1, range=0..100)

# ----
# Show Potential Edges
list_item_18 = ListItem(List=tree_branch, Index=1, Wrap=True)
list_item_19 = ListItem(List=tree_branch, Index=0, Wrap=True)
line_4 = Line(StartPoint=list_item_19, EndPoint=list_item_18)

# ----
# 4. cull edges intersecting with other surfaces
initial_wall_segments = Geometry(sort_list.ValuesValuesA)
edges = Geometry(tree_branch_4)
evaluate_length_2 = EvaluateLength(Curve=edges, Length=0.5, Normalized=True)  # -> Point, Tangent, Parameter
length_2 = Length(Curve=edges)
number = Number(expr("x+0.03", length_2))
division = Division(A=length_2, B=number)
scale = Scale(Geometry=edges, Center=evaluate_length_2.Point, Factor=division)  # -> Geometry, Transform
mesh_curve = MeshCurve(Mesh=initial_wall_segments, Curve=scale.Geometry)  # -> Points, Faces
shift_paths = ShiftPaths(Data=mesh_curve.Points, Offset=-1)
list_length_3 = ListLength(List=shift_paths)
equality = Equality(FirstNumber=list_length_3, SecondNumber=0)  # -> Equality, Inequality
dispatch_10 = Dispatch(Centroid=tree_branch, DispatchPattern=equality.Equality)  # -> ListA, ListB
dispatch_11 = Dispatch(List=tree_branch_5, DispatchPattern=equality.Equality)  # -> ListA, ListB
dispatch_12 = Dispatch(Normal=tree_branch_2, DispatchPattern=equality.Equality)  # -> ListA, ListB
dispatch_13 = Dispatch(List=tree_branch_3, DispatchPattern=equality.Equality)  # -> ListA, ListB
dispatch_14 = Dispatch(List=tree_branch_4, DispatchPattern=equality.Equality)  # -> ListA, ListB
clean_tree_10 = CleanTree(RemoveNulls=True, RemoveInvalid=True, RemoveEmpty=True, Tree=dispatch_10.ListA)
clean_tree_11 = CleanTree(RemoveNulls=True, RemoveInvalid=True, RemoveEmpty=True, Tree=dispatch_11.ListA)
clean_tree_12 = CleanTree(RemoveNulls=True, RemoveInvalid=True, RemoveEmpty=True, Tree=dispatch_12.ListA)
clean_tree_13 = CleanTree(RemoveNulls=True, RemoveInvalid=True, RemoveEmpty=True, Tree=dispatch_13.ListA)
clean_tree_14 = CleanTree(RemoveNulls=True, RemoveInvalid=True, RemoveEmpty=True, Tree=dispatch_14.ListA)

# ----
# Show Potential Edges
list_item_20 = ListItem(List=clean_tree_10, Index=1, Wrap=True)
list_item_21 = ListItem(List=clean_tree_10, Index=0, Wrap=True)
line_5 = Line(StartPoint=list_item_21, EndPoint=list_item_20)

# ----
# 5. absolute distance: cull edges that dot fulfill 5.1,5.2,5.3
# 5.1. dot (ni,nj) > cos(t) & dot(ni & nj,sisj) & || si,sj || < 2m
# 5.2. || si,sj || < 0.5m
list_item_22 = ListItem(List=clean_tree_10, Index=0, Wrap=True)
list_item_23 = ListItem(List=clean_tree_10, Index=1, Wrap=True)
list_item_24 = ListItem(List=clean_tree_12, Index=1, Wrap=True)
list_item_25 = ListItem(List=clean_tree_12, Index=0, Wrap=True)
vector_length = VectorLength(Vector=clean_tree_14)
vector_2pt_2 = Vector2Pt(PointA=list_item_22, PointB=list_item_23, Unitize=True)  # -> Vector, Length
dot_product_2 = DotProduct(VectorA=list_item_25, VectorB=list_item_24, Unitize=False)  # -> expr("abs(x)", DotProduct)
vector_length_2 = VectorLength(Vector=clean_tree_14)
smaller_than_3 = SmallerThan(FirstNumber=vector_length, SecondNumber=Slider(0.5, range=0..1))  # -> SmallerThan, OrEqualTo
dot_product_3 = DotProduct(VectorA=list_item_25, VectorB=vector_2pt_2.Vector, Unitize=False)  # -> expr("abs(x)", DotProduct)
smaller_than_4 = SmallerThan(FirstNumber=vector_length_2, SecondNumber=Slider(2, range=0..10))  # -> SmallerThan, OrEqualTo
cos_theta_30 = Number(0.866)
larger_than = LargerThan(FirstNumber=dot_product_2, SecondNumber=cos_theta_30)  # -> LargerThan, OrEqualTo
smaller_than_5 = SmallerThan(FirstNumber=dot_product_3, SecondNumber=Slider(0.8, range=0..1))  # -> SmallerThan, OrEqualTo
gate_and = GateAnd(A=larger_than.LargerThan, B=smaller_than_5.SmallerThan, C=smaller_than_4.SmallerThan)
gate_or = GateOr(A=gate_and, B=smaller_than_3.SmallerThan)
dispatch_15 = Dispatch(List=clean_tree_11, DispatchPattern=gate_or)  # -> ListA, ListB
dispatch_16 = Dispatch(List=clean_tree_13, DispatchPattern=gate_or)  # -> ListA, ListB
dispatch_17 = Dispatch(Centroid=clean_tree_10, DispatchPattern=gate_or)  # -> ListA, ListB
dispatch_18 = Dispatch(Normal=clean_tree_12, DispatchPattern=gate_or)  # -> ListA, ListB
dispatch_19 = Dispatch(List=clean_tree_14, DispatchPattern=gate_or)  # -> ListA, ListB
clean_tree_15 = CleanTree(RemoveNulls=True, RemoveInvalid=True, RemoveEmpty=True, Tree=dispatch_15.ListA)
clean_tree_16 = CleanTree(RemoveNulls=True, RemoveInvalid=True, RemoveEmpty=True, Tree=dispatch_16.ListA)
clean_tree_17 = CleanTree(RemoveNulls=True, RemoveInvalid=True, RemoveEmpty=True, Tree=dispatch_17.ListA)
clean_tree_18 = CleanTree(RemoveNulls=True, RemoveInvalid=True, RemoveEmpty=True, Tree=dispatch_18.ListA)
clean_tree_19 = CleanTree(RemoveNulls=True, RemoveInvalid=True, RemoveEmpty=True, Tree=dispatch_19.ListA)

# ----
# B. Create a set of connected components
# 1.Region grow connected components
centroid_segments = Geometry(clean_tree_17)
normal_segments = Vector(clean_tree_18)
potential_edges = Geometry(clean_tree_19)
initial_wall_segments_2 = Geometry(sort_list.ValuesValuesA)
wall_segments_2 = Geometry(clean_tree_16)
tree_statistics_3 = TreeStatistics(Tree=potential_edges)  # -> Paths, Length, Count
text_split = TextSplit(Text=graft(tree_statistics_3.Paths), Separators=";")
replace_text = ReplaceText(Text=text_split, Find=["{", "}"], RecursiveReplace=False)
list_item_26 = ListItem(List=replace_text, Index=1, Wrap=True)  # -> flatten(Item)
list_item_27 = ListItem(List=replace_text, Index=0, Wrap=True)  # -> flatten(Item)
ghpython_script = GhPythonScript(S=initial_wall_segments_2, si=list_item_27, sj=list_item_26)  # -> out, branch, records; inputs S: list of Mesh, si: list of Int32, sj: list of Int32
# ---------- ghpython_script: Python ----------
__author__ = "u0094523"
__version__ = "2018.11.13"

import rhinoscriptsyntax as rs
from Grasshopper.Kernel.Data import GH_Path
from Grasshopper import DataTree
import clr
clr.AddReference("Grasshopper")
import System


branch=DataTree[System.Object](); """ branches"""
records=DataTree[System.Object]();
queue=range(len(S)); """ list with records"""
i=0; """ branch counter"""
j=0;

while any(queue):
    """ create list a with all the indices belonging together"""
    a=[queue[0]]; """list with indices of the cluster"""
    j=0;
    del queue[0];
    while j<len(a):
        indices_si=[k for k, x in enumerate(si) if x == a[j]]; """record indices si"""
        indices_sj=[k for k, x in enumerate(sj) if x == a[j]]; """record indices sj"""
        b=[]; """ records"""
        for k in range(len(indices_si)):
            b.append(indices_si[k]);
            a.append(sj[indices_si[k]]);
            if a[-1] in queue:
                queue.remove(a[-1]);"""delete last added value in a from queue"""
        for l in range(len(indices_sj)):
            b.append(indices_sj[l]);
            a.append(si[indices_sj[l]]);
            if a[-1] in queue:
                queue.remove(a[-1]);
        for m in range(len(b)):
            si[b[m]]=-1;
            sj[b[m]]=-1;
        j=j+1;
        records.AddRange(b,GH_Path(i));
    branch.AddRange(a,GH_Path(i));
    i=i+1;"""
    a.append(indices_si);
    a.append(indices_sj);
    append list a to a new branch in b
    Add(b,c); b.append([1, 2, 3 ]);
    c=c+1;
       a[i]=len(S);(si[1]);
a=b in si;
a=si.index(b);
a= [0]*len(S);"""
# ---------- end ghpython_script ----------
create_set = CreateSet(List=ghpython_script.branch)  # -> Index, Map
list_item_28 = ListItem(List=initial_wall_segments_2, Index=create_set.Index, Wrap=True)
list_item_29 = ListItem(List=list_item_27, Index=ghpython_script.records, Wrap=True)
list_item_30 = ListItem(List=list_item_26, Index=ghpython_script.records, Wrap=True)
connected_components = Geometry(list_item_28)
sj = Integer(list_item_30)
si = Integer(list_item_29)

# ----
# Show Potential Edges
list_item_31 = ListItem(List=clean_tree_17, Index=1, Wrap=True)
list_item_32 = ListItem(List=clean_tree_17, Index=0, Wrap=True)
line_6 = Line(StartPoint=list_item_32, EndPoint=list_item_31)

# ----
# D1.  wall clustering inside each connected component using region growing
# Area >tArea
initial_wall_segments_3 = Geometry(sort_list.ValuesValuesA)

# ----
# C. Validate connected components
# Area >tArea
# 1. Area components with singular surface
# 2. test BB (S) <0.8m
connected_components_2 = Geometry(connected_components)
list_length_4 = ListLength(List=connected_components_2)
equality_2 = Equality(FirstNumber=list_length_4, SecondNumber=1)  # -> Equality, Inequality
dispatch_20 = Dispatch(List=connected_components_2, DispatchPattern=equality_2.Equality)  # -> ListA, ListB
dispatch_21 = Dispatch(List=create_set.Index, DispatchPattern=equality_2.Equality)  # -> ListA, ListB
dispatch_22 = Dispatch(List=si, DispatchPattern=equality_2.Equality)  # -> ListA, ListB
dispatch_23 = Dispatch(List=sj, DispatchPattern=equality_2.Equality)  # -> ListA, ListB
clean_tree_20 = CleanTree(RemoveNulls=True, RemoveInvalid=True, RemoveEmpty=True, Tree=dispatch_20.ListB)
mesh_edges = MeshEdges(Mesh=clean_tree_20)  # -> NakedEdges, InteriorEdges, NonManifoldEdges
list_item_33 = ListItem(List=clean_tree_20, Index=0, Wrap=True)
evaluate_curve = EvaluateCurve(Curve=mesh_edges.NakedEdges, Parameter=0.5)  # -> Point, Tangent, Angle
area_3 = Area(Geometry=list_item_33)  # -> Area, Centroid
shift_paths_2 = ShiftPaths(Data=evaluate_curve.Point, Offset=-1)
mesh_closest_point_4 = MeshClosestPoint(Point=area_3.Centroid, Mesh=list_item_33)  # -> Point, Index, Parameter
mesh_eval_4 = MeshEval(Mesh=list_item_33, Parameter=mesh_closest_point_4.Parameter)  # -> Point, Normal, Colour
clean_tree_21 = CleanTree(RemoveNulls=True, RemoveInvalid=True, RemoveEmpty=True, Tree=dispatch_21.ListB)
clean_tree_22 = CleanTree(RemoveNulls=True, RemoveInvalid=True, RemoveEmpty=True, Tree=dispatch_22.ListB)
clean_tree_23 = CleanTree(RemoveNulls=True, RemoveInvalid=True, RemoveEmpty=True, Tree=dispatch_23.ListB)
larger_than_2 = LargerThan(FirstNumber=dispatch_20.ListA, SecondNumber=Slider(1, range=0..1))  # -> LargerThan, OrEqualTo
dispatch_24 = Dispatch(List=dispatch_20.ListA, DispatchPattern=larger_than_2.OrEqualTo)  # -> ListA, ListB
clean_tree_24 = CleanTree(RemoveNulls=True, RemoveInvalid=True, RemoveEmpty=True, Tree=dispatch_24.ListB)
clean_tree_25 = CleanTree(RemoveNulls=True, RemoveInvalid=True, RemoveEmpty=True, Tree=dispatch_24.ListA)

area_4 = Area(Geometry=clean_tree_20)  # -> Area, Centroid

vector_2pt_3 = Vector2Pt(PointA=area_3.Centroid, PointB=area_4.Centroid, Unitize=False)  # -> Vector, Length
dot_product_4 = DotProduct(VectorA=mesh_eval_4.Normal, VectorB=vector_2pt_3.Vector, Unitize=False)
bounds = Bounds(Numbers=dot_product_4)
deconstruct_domain = DeconstructDomain(Domain=bounds)  # -> Start, End
subtraction = Subtraction(A=deconstruct_domain.End, B=deconstruct_domain.Start)
smaller_than_6 = SmallerThan(FirstNumber=expr("abs(x)", subtraction), SecondNumber=Slider(0.8, range=0..1))  # -> SmallerThan, OrEqualTo
dispatch_25 = Dispatch(List=clean_tree_21, DispatchPattern=smaller_than_6.OrEqualTo)  # -> ListA, ListB
dispatch_26 = Dispatch(List=clean_tree_22, DispatchPattern=smaller_than_6.OrEqualTo)  # -> ListA, ListB
dispatch_27 = Dispatch(List=clean_tree_20, DispatchPattern=smaller_than_6.OrEqualTo)  # -> ListA, ListB
dispatch_28 = Dispatch(List=clean_tree_23, DispatchPattern=smaller_than_6.OrEqualTo)  # -> ListA, ListB
clean_tree_26 = CleanTree(RemoveNulls=True, RemoveInvalid=True, RemoveEmpty=True, Tree=dispatch_27.ListB)
clean_tree_27 = CleanTree(RemoveNulls=True, RemoveInvalid=True, RemoveEmpty=True, Tree=dispatch_25.ListB)
clean_tree_28 = CleanTree(RemoveNulls=True, RemoveInvalid=True, RemoveEmpty=True, Tree=dispatch_28.ListB)
clean_tree_29 = CleanTree(RemoveNulls=True, RemoveInvalid=True, RemoveEmpty=True, Tree=dispatch_26.ListB)
clean_tree_30 = CleanTree(RemoveNulls=True, RemoveInvalid=True, RemoveEmpty=True, Tree=dispatch_27.ListA)
merge_2 = Merge(Data1=clean_tree_25, Data2=clean_tree_24, Data3=clean_tree_30)

region_growing_walls = Region_Growing_Walls(Mesh=initial_wall_segments_3, Mesh_si=clean_tree_28, Mesh_sj=clean_tree_29, Threshold_Thickness=0.8)

shift_paths_3 = ShiftPaths(Data=region_growing_walls, Offset=-1)
list_length_5 = ListLength(List=region_growing_walls)
tree_statistics_4 = TreeStatistics(Tree=clean_tree_28)  # -> Paths, Length, Count
tree_statistics_5 = TreeStatistics(Tree=shift_paths_3)  # -> Paths, Length, Count
shift_paths_4 = ShiftPaths(Data=list_length_5, Offset=-1)
replace_paths_2 = ReplacePaths(Data=shift_paths_3, Search=tree_statistics_5.Paths, Replace=tree_statistics_4.Paths)
replace_paths_3 = ReplacePaths(Data=shift_paths_4, Search=tree_statistics_5.Paths, Replace=tree_statistics_4.Paths)
partition_list = PartitionList(List=replace_paths_2, Size=replace_paths_3)
list_item_34 = ListItem(List=initial_wall_segments_3, Index=partition_list, Wrap=True)
list_length_6 = ListLength(List=partition_list)
equality_3 = Equality(FirstNumber=list_length_6, SecondNumber=1)  # -> Equality, Inequality
dispatch_29 = Dispatch(List=list_item_34, DispatchPattern=equality_3.Equality)  # -> ListA, ListB
dispatch_30 = Dispatch(List=partition_list, DispatchPattern=equality_3.Equality)  # -> ListA, ListB
larger_than_3 = LargerThan(FirstNumber=dispatch_29.ListA, SecondNumber=Slider(1, range=0..1))  # -> LargerThan, OrEqualTo
dispatch_31 = Dispatch(List=dispatch_30.ListA, DispatchPattern=larger_than_3.OrEqualTo)  # -> ListA, ListB
dispatch_32 = Dispatch(List=dispatch_29.ListA, DispatchPattern=larger_than_3.OrEqualTo)  # -> ListA, ListB
clean_tree_31 = CleanTree(RemoveNulls=True, RemoveInvalid=True, RemoveEmpty=True, Tree=dispatch_32.ListB)
clean_tree_32 = CleanTree(RemoveNulls=True, RemoveInvalid=True, RemoveEmpty=True, Tree=dispatch_29.ListB)
clean_tree_33 = CleanTree(RemoveNulls=True, RemoveInvalid=True, RemoveEmpty=True, Tree=dispatch_31.ListA)
clean_tree_34 = CleanTree(RemoveNulls=True, RemoveInvalid=True, RemoveEmpty=True, Tree=dispatch_32.ListA)
merge_3 = Merge(Data1=clean_tree_34, Data2=clean_tree_32)  # -> simplify(WallsRG)

# ----
# clean si==sj => it causes errors in clustering
subtraction_2 = Subtraction(A=clean_tree_28, B=clean_tree_29)
equality_4 = Equality(FirstNumber=subtraction_2, SecondNumber=0)  # -> Equality, Inequality
dispatch_33 = Dispatch(List=clean_tree_28, DispatchPattern=equality_4.Inequality)  # -> ListA, ListB
dispatch_34 = Dispatch(List=clean_tree_29, DispatchPattern=equality_4.Inequality)  # -> ListA, ListB

# ----
# D2. Bake region growing
# adopt name of largest wall surface
merge_4 = Merge(Data1=merge_2, Data2=merge_3)
sort_list_3 = SortList(Keys=merge_4, ValuesValuesA=merge_4)  # -> Keys, reverse(ValuesValuesA)
get_rhino_attributes = GetRhinoAttributes(Geometry=sort_list_3.ValuesValuesA)  # -> Name, Layer, Color
define_layer = DefineLayer(Name="wallregiongrowing", Color=RGB(255, 3, 3))  # -> simplify(graft(Layer))
list_item_35 = ListItem(List=get_rhino_attributes.Color, Index=0, Wrap=True)
list_item_36 = ListItem(List=get_rhino_attributes.Name, Index=0, Wrap=True)
define_object_attributes = DefineObjectAttributes(Name=list_item_36, Layer=define_layer, Color=list_item_35)
bake_objects = BakeObjects(Geometry=sort_list_3.ValuesValuesA, Attributes=define_object_attributes, BakeName="2", Bake=False)

# ----
# F1. Validatie RG/ground truth
# Precision ( % correct of selected)
get_rhino_attributes_2 = GetRhinoAttributes(Geometry=merge_3)  # -> Name, Layer, Color
name_ground_truth = Text(get_rhino_attributes_2.Name)
create_set_2 = CreateSet(List=name_ground_truth)  # -> Set, Map
list_length_7 = ListLength(List=get_rhino_attributes_2.Name)
member_index = MemberIndex(Set=name_ground_truth, Member=create_set_2.Set)  # -> Index, Count
sort_list_4 = SortList(Keys=member_index.Count)  # -> reverse(Keys), ValuesValuesA
list_item_37 = ListItem(List=sort_list_4.Keys, Index=0, Wrap=True)
division_2 = Division(A=list_item_37, B=list_length_7)
weighted_average = WeightedAverage(Input=flatten(division_2), Weights=flatten(list_length_7))
panel_2 = Panel(weighted_average)

panel_3 = Panel(get_rhino_attributes_2.Name)

# ----
# local remapping of si & sj required (Matlab +1)
initial_wall_segments_4 = Geometry(sort_list.ValuesValuesA)

# ----
# 1.1 length edge si/sj
# normalise
initial_wall_segments_5 = Geometry(sort_list.ValuesValuesA)

# ----
# 2.1 BB thickness si/sj
# [nodes*1]
initial_wall_segments_6 = Geometry(sort_list.ValuesValuesA)

# ----
# E1. Extract features CRF (associativity! (1= good/ 0= bad))
# 0. Extract seeds
# 2. Unary feature extraction (unary/seeds)
region_growing_wall_segments = Geometry(merge_3)
sort_list_5 = SortList(Keys=region_growing_wall_segments, ValuesValuesA=region_growing_wall_segments)  # -> Keys, reverse(ValuesValuesA), reverse(ValuesA)
list_item_38 = ListItem(List=sort_list_5.ValuesValuesA, Index=0, Wrap=True)
seeds = Geometry(list_item_38)
shift_paths_5 = ShiftPaths(Data=seeds, Offset=-1)

seeds_2 = Geometry(shift_paths_5)
tree_statistics_6 = TreeStatistics(Tree=seeds_2)  # -> Paths, Length, Count
tree_statistics_7 = TreeStatistics(Tree=seeds_2)  # -> Paths, Length, Count
tree_statistics_8 = TreeStatistics(Tree=seeds_2)  # -> Paths, Length, Count
tree_branch_6 = TreeBranch(Tree=clean_tree_26, Path=tree_statistics_6.Paths, MaintainPaths=True)
tree_branch_7 = TreeBranch(Tree=dispatch_34.ListA, Path=tree_statistics_7.Paths, MaintainPaths=True)
tree_branch_8 = TreeBranch(Tree=dispatch_33.ListA, Path=tree_statistics_8.Paths, MaintainPaths=True)
clean_tree_35 = CleanTree(RemoveNulls=True, RemoveInvalid=True, RemoveEmpty=True, Tree=tree_branch_6)
clean_tree_36 = CleanTree(RemoveNulls=True, RemoveInvalid=True, RemoveEmpty=True, Tree=tree_branch_7)
clean_tree_37 = CleanTree(RemoveNulls=True, RemoveInvalid=True, RemoveEmpty=True, Tree=tree_branch_8)

# ----
# 1.1 length edge si/seed
# normalise by imposing sigmoidal funtion
seed = Geometry(shift_paths_5)
unclustered_connected_components = Geometry(clean_tree_35)
unclustered_connected_components_2 = Geometry(graft(unclustered_connected_components))
list_length_8 = ListLength(List=seed)
list_length_9 = ListLength(List=unclustered_connected_components)
duplicate_data_2 = DuplicateData(Data=seed, Number=list_length_9, Order=True)  # -> simplify(Data)
partition_list_2 = PartitionList(List=duplicate_data_2, Size=list_length_8)
area_5 = Area(Geometry=partition_list_2)  # -> Area, Centroid
area_6 = Area(Geometry=unclustered_connected_components_2)  # -> Area, Centroid
list_item_39 = ListItem(List=area_5.Centroid, Index=1, Wrap=True)
list_item_40 = ListItem(List=area_6.Centroid, Index=0, Wrap=True)
mesh_closest_point_5 = MeshClosestPoint(Point=area_5.Centroid, Mesh=unclustered_connected_components_2)  # -> Point, Index, Parameter
mesh_closest_point_6 = MeshClosestPoint(Point=area_6.Centroid, Mesh=partition_list_2)  # -> Point, Index, Parameter
mesh_eval_5 = MeshEval(Mesh=unclustered_connected_components_2, Parameter=mesh_closest_point_5.Parameter)  # -> Point, Normal, Colour
mesh_eval_6 = MeshEval(Mesh=partition_list_2, Parameter=mesh_closest_point_6.Parameter)  # -> Point, Normal, Colour
line_7 = Line(StartPoint=mesh_eval_5.Point, EndPoint=mesh_eval_6.Point)
length_3 = Length(Curve=line_7)  # -> expr("abs(x)", Length)
shift_paths_6 = ShiftPaths(Data=length_3, Offset=-1)

si_2 = Integer(clean_tree_37)
sj_2 = Integer(clean_tree_36)
list_item_41 = ListItem(List=initial_wall_segments_5, Index=si_2, Wrap=True)  # -> graft(Item)
list_item_42 = ListItem(List=initial_wall_segments_5, Index=sj_2, Wrap=True)  # -> graft(Item)
area_7 = Area(Geometry=list_item_41)  # -> Area, Centroid
area_8 = Area(Geometry=list_item_42)  # -> Area, Centroid
list_item_43 = ListItem(List=area_7.Centroid, Index=1, Wrap=True)
list_item_44 = ListItem(List=area_8.Centroid, Index=0, Wrap=True)
mesh_closest_point_7 = MeshClosestPoint(Point=list_item_43, Mesh=list_item_42)  # -> Point, Index, Parameter
mesh_closest_point_8 = MeshClosestPoint(Point=area_8.Centroid, Mesh=list_item_41)  # -> Point, Index, Parameter
mesh_eval_7 = MeshEval(Mesh=list_item_42, Parameter=mesh_closest_point_7.Parameter)  # -> Point, Normal, Colour
mesh_eval_8 = MeshEval(Mesh=list_item_41, Parameter=mesh_closest_point_8.Parameter)  # -> Point, Normal, Colour
line_8 = Line(StartPoint=mesh_eval_7.Point, EndPoint=mesh_eval_8.Point)
length_4 = Length(Curve=line_8)  # -> expr("abs(x)", Length)
shift_paths_7 = ShiftPaths(Data=length_4, Offset=-1)

# ----
# 1.1 BB thickness si/seed
# [nodes*seeds]
unclustered_connected_components_3 = Geometry(clean_tree_35)
seed_2 = Geometry(shift_paths_5)
_52_cluster_nodefeature_wallthickness = _52_Cluster_Nodefeature_Wallthickness(Nodes=unclustered_connected_components_3, Seeds=seed_2)
list_length_10 = ListLength(List=seed_2)
partition_list_3 = PartitionList(List=_52_cluster_nodefeature_wallthickness, Size=list_length_10)
shift_paths_8 = ShiftPaths(Data=partition_list_3, Offset=-1)

sj_3 = Integer(clean_tree_36)
si_3 = Integer(clean_tree_37)
list_item_45 = ListItem(List=initial_wall_segments_6, Index=si_3, Wrap=True)  # -> graft(Item)
list_item_46 = ListItem(List=initial_wall_segments_6, Index=sj_3, Wrap=True)  # -> graft(Item)
_52_cluster_nodefeature_wallthickness_2 = _52_Cluster_Nodefeature_Wallthickness(Nodes=list_item_46, Seeds=list_item_45)
shift_paths_9 = ShiftPaths(Data=_52_cluster_nodefeature_wallthickness_2, Offset=-1)

list_item_47 = ListItem(List=initial_wall_segments_4, Index=clean_tree_37, Wrap=True)
list_item_48 = ListItem(List=initial_wall_segments_4, Index=clean_tree_36, Wrap=True)
guid = Guid(list_item_48)
guid_2 = Guid(clean_tree_35)
guid_3 = Guid(list_item_47)
c_script = CSharpScript(list=guid_2, si=guid_3, sj=guid)  # -> out, si_new, sj_new; inputs list: list of String, si: list of String, sj: list of String
# ---------- c_script: C# usings ----------
using System.Linq;
# ---------- c_script: C# ----------
    List<int> indices = new List<int>();
    List<int> indices2 = new List<int>();
    for (int i = 0;i < si.Count;i++)
    {

      indices.Add(list.FindIndex(k => k == si[i]));
      indices2.Add(list.FindIndex(k => k == sj[i]));

    }
    si_new = indices;
    sj_new = indices2;
# ---------- end c_script ----------

clean_tree_38 = CleanTree(RemoveNulls=True, RemoveInvalid=True, RemoveEmpty=True, Tree=seeds)

fe2 = Number(expr("round(1/(e^(x²)),2)", shift_paths_7))
fe1 = Number(expr("round(1/(e^(x²)),2)", shift_paths_9))
fn2 = Number(expr("round(1/(e^(x²)),2)", shift_paths_6))
fn1 = Number(expr("round(1/(e^(x²)),2)", shift_paths_8))

# ----
# E2. CRF decoding
list_length_11 = ListLength(List=seeds_2)
connected_components_3 = Geometry(clean_tree_35)
seeds_3 = Geometry(seeds_2)
si_4 = Integer(expr("x+1", c_script.si_new))
sj_4 = Integer(expr("x+1", c_script.sj_new))
parameters = Integer([6, 4, 1, 1])
nfeature_2 = Number(fn2)
efeature_2 = Number(fe2)
nfeature_1 = Number(fn1)
efeature_1 = Number(fe1)
states = Integer(list_length_11)
crf_walls_decode = CRF_walls_decode(
    NodeFeature1=nfeature_1,
    NodeFeature2=nfeature_2,
    EdgeFeature1=efeature_1,
    EdgeFeature2=efeature_2,
    Mesh_si=si_4,
    Mesh_sj=sj_4,
    Parameters=parameters,
    Nstates=states)
create_set_3 = CreateSet(List=crf_walls_decode)  # -> Set, Map
member_index_2 = MemberIndex(Set=crf_walls_decode, Member=create_set_3.Set)  # -> Index, Count
list_length_12 = ListLength(List=member_index_2.Index)
shift_paths_10 = ShiftPaths(Data=member_index_2.Index, Offset=-1)
shift_paths_11 = ShiftPaths(Data=list_length_12, Offset=-1)
list_item_49 = ListItem(List=connected_components_3, Index=shift_paths_10, Wrap=True)  # -> simplify(Item)
partition_list_4 = PartitionList(List=list_item_49, Size=shift_paths_11)

get_rhino_attributes_3 = GetRhinoAttributes(Geometry=seeds_3)  # -> Name, Layer, Color

# ----
# E3. Bake CRF
# adopt name of largest wall surface
merge_5 = Merge(Data1=merge_2, Data2=partition_list_4)
sort_list_6 = SortList(Keys=merge_5, ValuesValuesA=merge_5)  # -> Keys, reverse(ValuesValuesA)
get_rhino_attributes_4 = GetRhinoAttributes(Geometry=sort_list_6.ValuesValuesA)  # -> Name, Layer, Color
define_layer_2 = DefineLayer(Name="wallCRF", Color=RGB(255, 3, 3))  # -> simplify(graft(Layer))
list_item_50 = ListItem(List=get_rhino_attributes_4.Name, Index=0, Wrap=True)
list_item_51 = ListItem(List=get_rhino_attributes_4.Color, Index=0, Wrap=True)
define_object_attributes_2 = DefineObjectAttributes(Name=list_item_50, Layer=define_layer_2, Color=list_item_51)
bake_objects_2 = BakeObjects(Geometry=sort_list_6.ValuesValuesA, Attributes=define_object_attributes_2, BakeName="3", Bake=False)

list_item_52 = ListItem(List=shift_paths_8, Index=number_slider, Wrap=True)
list_item_53 = ListItem(Segemnts=unclustered_connected_components_3, Index=Slider(4, range=0..10), Wrap=True)
list_item_54 = ListItem(Seeds=shift_paths_5, Index=number_slider, Wrap=True)
list_item_55 = ListItem(Segemnts=si_3, Index=number_slider_2, Wrap=True)
tree_branch_9 = TreeBranch(Tree=line_7, Path="{1;1}", MaintainPaths=True)
list_item_56 = ListItem(Seeds=sj_3, Index=number_slider_2, Wrap=True)
list_item_57 = ListItem(Seeds=initial_wall_segments_6, Index=list_item_56, Wrap=True)
list_item_58 = ListItem(Segemnts=initial_wall_segments_6, Index=list_item_55, Wrap=True)
panel_4 = Panel(partition_list_3)
panel_5 = Panel(length_3)

# ----
# F2. Validatie CRF/ground truth
# Precision ( % correct of selected)
get_rhino_attributes_5 = GetRhinoAttributes(Geometry=partition_list_4)  # -> Name, Layer, Color
name_ground_truth_2 = Text(get_rhino_attributes_5.Name)
create_set_4 = CreateSet(List=name_ground_truth_2)  # -> Set, Map

panel_6 = Panel(get_rhino_attributes_5.Name)
list_length_13 = ListLength(List=get_rhino_attributes_5.Name)
member_index_3 = MemberIndex(Set=name_ground_truth_2, Member=create_set_4.Set)  # -> Index, Count
sort_list_7 = SortList(Keys=member_index_3.Count)  # -> reverse(Keys), ValuesA
list_item_59 = ListItem(List=sort_list_7.Keys, Index=0, Wrap=True)
division_3 = Division(A=list_item_59, B=list_length_13)
weighted_average_2 = WeightedAverage(Input=flatten(division_3), Weights=flatten(list_length_13))

panel_7 = Panel(weighted_average_2)
