# Grasshopper definition Stanford2D3D_trainingdatacreation1.gh (Grasshopper 1.0.7)
# plug-ins: EleFront, Scan2BIM

# Input Mesh Segments with materials
geometry = Geometry([<mesh referenced from the Rhino model> x783])
_42_convert_meshmaterials_to_names = _42_Convert_MeshMaterials_to_Names(Run=geometry)
# Input Classified Mesh Segments
# & Labels to search
names_mesh_segments = Geometry([<mesh referenced from the Rhino model> x783])
label_colors = Colour([RGB(255, 255, 0), RGB(128, 128, 255), RGB(192, 64, 0), RGB(0, 128, 128), RGB(255, 128, 128), RGB(0, 255, 0), RGB(128, 128, 0), RGB(64, 64, 64), RGB(0, 0, 192), RGB(255, 0, 0), RGB(64, 0, 64), RGB(0, 64, 64), RGB(224, 224, 224)])
labels = Text(["ceiling", "floor", "wall", "column", "beam", "window", "door", "table", "chair", "bookcase", "sofa", "board", "clutter"])
get_rhino_attributes = GetRhinoAttributes(Geometry=names_mesh_segments)  # -> Name, Layer, Color
text_split = TextSplit(Text=get_rhino_attributes.Name, Separators=" ")
mesh_nameextraction = Mesh_NameExtraction(Text=get_rhino_attributes.Name, String=labels)
list_item = ListItem(List=text_split, Index=1, Wrap=True)  # -> simplify(flatten(Item))
define_layer = DefineLayer(Name=labels, Color=label_colors)  # -> simplify(graft(Layer))
list_item_2 = ListItem(List=names_mesh_segments, Index=mesh_nameextraction, Wrap=True)
list_item_3 = ListItem(List=list_item, Index=mesh_nameextraction, Wrap=True)
define_object_attributes = DefineObjectAttributes(Name=list_item_3, Layer=define_layer, Color=simplify(graft(label_colors)))
bake_objects = BakeObjects(Geometry=list_item_2, Attributes=define_object_attributes, BakeName="0", Bake=False)
