# Grasshopper definition Stanford2D3D_trainingdatacreationwalls.gh (Grasshopper 1.0.7)
# plug-ins: EleFront

# Input Clustered Mesh Segments with names
wall_mesh_segments = Geometry([<mesh referenced from the Rhino model> x239])
get_rhino_attributes = GetRhinoAttributes(Geometry=wall_mesh_segments)  # -> simplify(graft(Name)), Layer, Color
list_length = ListLength(List=get_rhino_attributes.Name)
random = Random(Range=Domain(0, 255), Number=list_length, Seed=expr("0.5*x", get_rhino_attributes.Name))  # -> simplify(Random)
random_2 = Random(Range=Domain(0, 255), Number=list_length, Seed=expr("2*x", get_rhino_attributes.Name))  # -> simplify(Random)
random_3 = Random(Range=Domain(0, 255), Number=list_length, Seed=get_rhino_attributes.Name)  # -> simplify(Random)
colour_rgb = ColourRGB(Alpha=255, Red=random, Green=random_3, Blue=random_2)
define_color = DefineColor(Color=colour_rgb, Source="object")
define_object_attributes = DefineObjectAttributes(Name=get_rhino_attributes.Name, Color=define_color)
# bake seperate walls
bake_objects = BakeObjects(Geometry=simplify(graft(wall_mesh_segments)), Attributes=define_object_attributes, BakeName="1", Bake=False)
