# Grasshopper definition clustering.gh (Grasshopper 0.9.76)
# plug-ins: MeshEdit Components, EleFront

number_slider = Slider(2, range=0..10)
geometry = Geometry([<mesh referenced from the Rhino model> x127])
geometry_2 = Geometry([<mesh referenced from the Rhino model> x32])
geometry_3 = Geometry([<mesh referenced from the Rhino model> x2])
geometry_4 = Geometry([<mesh referenced from the Rhino model> x43])
mesh_area = MeshArea(Mesh=geometry_2)  # -> Area, Centroid
number_slider_2 = Slider(0, range=0..10)
deconstruct_mesh = DeconstructMesh(Mesh=geometry)  # -> flatten(Vertices), Faces, Colours, Normals
average = Average(Input=flatten(deconstruct_mesh.Vertices))
deconstruct_mesh_2 = DeconstructMesh(Mesh=geometry_2)  # -> Vertices, Faces, Colours, Normals
average_2 = Average(Input=deconstruct_mesh_2.Normals)
number = Number(geometry_4)
number_2 = Number(geometry_3)
geometry_5 = Geometry([<mesh referenced from the Rhino model> x244])
sort_list = SortList(Keys=number, ValuesA=geometry_4)  # -> Keys, reverse(ValuesA)
filter_by_layer = FilterByLayer(Geometry=geometry_5, Layer=["wall1", "wall2", "wall3", "wall4", "wall5", "wall6", "wall7", "wall8", "wall9", "wall10"])  # -> simplify(Geometry)
sort_list_2 = SortList(Keys=number_2, ValuesValuesA=geometry_3)  # -> Keys, reverse(ValuesValuesA)
cross_reference = CrossReference(ListListA=mesh_area.Centroid, ListListB=mesh_area.Centroid, CrossMode=3)  # -> ListListA, ListListB
mesh_area_2 = MeshArea(Mesh=geometry_2)  # -> Area, Centroid
xy_plane = XYPlane(Origin=average_2)
convex_hull = ConvexHull(Points=deconstruct_mesh_2.Vertices, Plane=xy_plane)  # -> Hull, flatten(HullZ), Indices
move = Move(Geometry=convex_hull.Hull, Motion=Vector(0, 0, 3))  # -> Geometry, Transform
explode = Explode(Curve=move.Geometry, Recursive=True)  # -> Segments, Vertices
xy_plane_2 = XYPlane(Origin=average)
convex_hull_2 = ConvexHull(Points=deconstruct_mesh.Vertices, Plane=xy_plane_2)  # -> Hull, HullZ, Indices
number_slider_3 = Slider(10, range=0..10)
list_item = ListItem(List=sort_list.ValuesA, Index=Slider(30, range=0..100), Wrap=True)
line = Line(StartPoint=cross_reference.ListListA, EndPoint=cross_reference.ListListB)
geometry_6 = Geometry(line)
fit_line = FitLine(Points=explode.Vertices)  # -> simplify(Line)
list_item_2 = ListItem(List=sort_list_2.ValuesValuesA, Index=0, Wrap=True)
cross_reference_2 = CrossReference(ListListA=flatten(mesh_area_2.Centroid), ListListB=flatten(mesh_area_2.Centroid), CrossMode=3)  # -> graft(ListListA), graft(ListListB)
tree_branch = TreeBranch(Tree=simplify(cross_reference_2.ListListA), Path=number_slider_2, MaintainPaths=True)
cross_reference_3 = CrossReference(ListListA=flatten(average_2), ListListB=flatten(average_2), CrossMode=3)  # -> graft(ListListA), graft(ListListB)
tree_branch_2 = TreeBranch(Tree=simplify(cross_reference_3.ListListA), Path=number_slider_2, MaintainPaths=True)
cross_reference_4 = CrossReference(ListListA=convex_hull.HullZ, ListListB=convex_hull.HullZ, CrossMode=3)  # -> graft(ListListA), graft(ListListB)
tree_branch_3 = TreeBranch(Tree=simplify(cross_reference_4.ListListB), Path=number_slider, MaintainPaths=True)
tree_branch_4 = TreeBranch(Tree=simplify(cross_reference_4.ListListA), Path=number_slider, MaintainPaths=True)
# Or Overlap. boundary between surfaces within the same plane <0.1m
explode_2 = Explode(Curve=cross_reference_4.ListListA, Recursive=True)  # -> Segments, Vertices
extend_curve = ExtendCurve(Curve=geometry_6, Type=0, Start=-0.03, End=-0.03)
cross_reference_5 = CrossReference(ListListA=geometry_2, ListListB=geometry_2, CrossMode=3)  # -> graft(ListListA), graft(ListListB)
scale = Scale(Geometry=convex_hull_2.Hull, Center=average, Factor=0.95)  # -> Geometry, Transform
boundary_surfaces = BoundarySurfaces(Edges=scale.Geometry)
extrude = Extrude(Base=fit_line, Direction=Vector(0, 0, 10))  # -> flatten(Extrusion)
mesh_area_3 = MeshArea(Mesh=extrude)  # -> Area, Centroid
cross_reference_6 = CrossReference(ListListA=mesh_area_3.Centroid, ListListB=mesh_area_3.Centroid, CrossMode=3)  # -> ListListA, ListListB
vector_display = VectorDisplay(Anchor=tree_branch, Vector=tree_branch_2)
deconstruct_mesh_3 = DeconstructMesh(Mesh=list_item_2)  # -> Vertices, Faces, Colours, Normals
line_2 = Line(StartPoint=cross_reference_6.ListListA, EndPoint=cross_reference_6.ListListB)
mesh_curve = MeshCurve(Mesh=geometry_2, Curve=simplify(graft(extend_curve)))  # -> Points, Faces
# orthogonal (within 0.6m) distance
plane_fit = PlaneFit(Points=explode_2.Vertices)  # -> Plane, Deviation
project = Project(Geometry=cross_reference_4.ListListB, Plane=plane_fit.Plane)  # -> Geometry, Transform
# coplanar (within 1m) distance
vector_2pt = Vector2Pt(PointA=cross_reference_2.ListListA, PointB=cross_reference_2.ListListB, Unitize=False)  # -> Vector, Length
tree_branch_5 = TreeBranch(Tree=simplify(vector_2pt.Vector), Path=number_slider_2, MaintainPaths=True)
vector_display_2 = VectorDisplay(Anchor=tree_branch, Vector=tree_branch_5)
# Boundingsbox thickness < 60cm
merge = Merge(Data1=cross_reference_5.ListListA, Data2=cross_reference_5.ListListB)  # -> simplify(Result)
number_3 = Number(merge)
sort_list_3 = SortList(Keys=number_3, ValuesValuesA=merge)  # -> Keys, reverse(ValuesValuesA)
list_item_3 = ListItem(List=merge, Index=0, Wrap=True)
face_normals = FaceNormals(Mesh=list_item_3)  # -> Centers, Normals
# No intersection with ceiling
average_3 = Average(Input=face_normals.Normals)
# boundary between surfaces <0.1m
curve_proximity = CurveProximity(CurveA=cross_reference_4.ListListA, CurveB=cross_reference_4.ListListB)  # -> PointA, PointB, Distance
extrude_2 = Extrude(Base=boundary_surfaces, Direction=Vector(0, 0, -4))
collision_one_many = CollisionOneMany(Collider=line, Obstacles=extrude_2)  # -> Collision, Index
plane_fit_2 = PlaneFit(Points=deconstruct_mesh_3.Vertices)  # -> Plane, Deviation
extend_curve_2 = ExtendCurve(Curve=line_2, Type=0, Start=-0.03, End=-0.03)
# No intersection with surfaces
mesh_curve_2 = MeshCurve(Mesh=extrude, Curve=extend_curve_2)  # -> Points, Faces
shift_paths = ShiftPaths(Data=mesh_curve.Points, Offset=-1)
dot_product = DotProduct(VectorA=cross_reference_3.ListListA, VectorB=vector_2pt.Vector, Unitize=False)  # -> expr("abs(x)", DotProduct)
curve_proximity_2 = CurveProximity(CurveA=cross_reference_4.ListListA, CurveB=project.Geometry)  # -> PointA, PointB, expr("round(x,2)", Distance)
dot_product_2 = DotProduct(VectorA=cross_reference_3.ListListA, VectorB=cross_reference_3.ListListB, Unitize=False)  # -> expr("abs(x)", DotProduct)
plane_normal = PlaneNormal(Origin=Point(0, 0, 0), ZAxis=average_3)  # -> simplify(Plane)
bounding_box = BoundingBox(Content=merge, Plane=plane_normal, UnionBox=True)  # -> flatten(Box), Box_2
bounding_box_2 = BoundingBox(Content=geometry_3, Plane=plane_fit_2.Plane, UnionBox=True)  # -> Box, Box_2
list_length = ListLength(List=mesh_curve_2.Points)  # -> flatten(Length)
boolean = Boolean(invert(collision_one_many.Collision))
smaller_than = SmallerThan(FirstNumber=curve_proximity.Distance, SecondNumber=Slider(0.1, range=0..0.1))  # -> flatten(SmallerThan), OrEqualTo
list_length_2 = ListLength(List=shift_paths)  # -> flatten(Length)
smaller_than_2 = SmallerThan(FirstNumber=curve_proximity.Distance, SecondNumber=Slider(1, range=0..1))  # -> flatten(SmallerThan), OrEqualTo
deconstruct_brep = DeconstructBrep(Brep=bounding_box.Box)  # -> Faces, Edges, Vertices
smaller_than_3 = SmallerThan(FirstNumber=curve_proximity_2.Distance, SecondNumber=Slider(0.1, range=0..0.1))  # -> flatten(SmallerThan), OrEqualTo
deconstruct_box = DeconstructBox(Box=bounding_box_2.Box)  # -> Plane, X, Y, Z
smaller_than_4 = SmallerThan(FirstNumber=dot_product, SecondNumber=Slider(0.6, range=0..1))  # -> flatten(SmallerThan), OrEqualTo
equality = Equality(FirstNumber=list_length, SecondNumber=0)  # -> Equality, Inequality
equality_2 = Equality(FirstNumber=list_length_2, SecondNumber=0)  # -> Equality, Inequality
smaller_than_5 = SmallerThan(FirstNumber=dot_product_2, SecondNumber=Slider(0.15, range=0..1))  # -> flatten(SmallerThan), OrEqualTo
smaller_than_6 = SmallerThan(FirstNumber=curve_proximity.Distance, SecondNumber=Slider(1, range=0..1))  # -> flatten(SmallerThan), OrEqualTo
number_4 = Number(deconstruct_brep.Faces)
deconstruct_domain = DeconstructDomain(Domain=deconstruct_box.Z)  # -> Start, End
sort_list_4 = SortList(Keys=number_4, ValuesValuesA=deconstruct_brep.Faces)  # -> reverse(Keys), reverse(ValuesValuesA)
gate_and = GateAnd(A=equality.Equality, B=equality_2.Equality)
panel = Panel(boolean)
subtraction = Subtraction(A=deconstruct_domain.Start, B=deconstruct_domain.End)
panel_2 = Panel(subtraction)
gate_and_2 = GateAnd(A=smaller_than_6.SmallerThan, B=smaller_than_5.SmallerThan)
list_item_4 = ListItem(List=sort_list_4.ValuesValuesA, Index=0, Wrap=True)
list_item_5 = ListItem(List=sort_list_4.ValuesValuesA, Index=1, Wrap=True)
dispatch = Dispatch(List=line, DispatchPattern=smaller_than.OrEqualTo)  # -> ListA, ListB
gate_or = GateOr(A=smaller_than.SmallerThan, B=smaller_than_3.SmallerThan, C=smaller_than_4.SmallerThan, D=gate_and_2)
mesh_area_4 = MeshArea(Mesh=list_item_5)  # -> Area, Centroid
plane_closest_point = PlaneClosestPoint(Point=mesh_area_4.Centroid, Plane=list_item_4)  # -> Point, UVPoint, expr("abs(x)", Distance)
geometry_7 = Geometry(dispatch.ListA)
average_4 = Average(Input=flatten(plane_closest_point.Distance))
smaller_than_7 = SmallerThan(FirstNumber=plane_closest_point.Distance, SecondNumber=Slider(0.6, range=0..1))  # -> flatten(SmallerThan), OrEqualTo
panel_3 = Panel(smaller_than.SmallerThan)
panel_4 = Panel(smaller_than_3.SmallerThan)
panel_5 = Panel(gate_and_2)
panel_6 = Panel(gate_and)
gate_and_3 = GateAnd(A=smaller_than_7.SmallerThan, B=boolean, C=gate_or, D=gate_and, E=smaller_than_2.SmallerThan)
dispatch_2 = Dispatch(List=line, DispatchPattern=gate_and_3)  # -> ListA, ListB
geometry_8 = Geometry(dispatch_2.ListA)
dispatch_3 = Dispatch(List=bounding_box.Box, DispatchPattern=smaller_than_7.SmallerThan)  # -> ListA, ListB
panel_7 = Panel(smaller_than_7.SmallerThan)
geometry_9 = Geometry(dispatch_3.ListA)
