# Grasshopper definition old_Clustering_1.gh (Grasshopper 1.0.7)
# plug-ins: EleFront, WriteMatlabPredictors

layers = Text(["wall0", "wall1", "wall2", "wall3", "wall4", "wall5", "wall7"])  # disabled
reference_by_layer = ReferenceByLayer(LayerName=layers)  # -> simplify(Geometry); disabled
geometry = Geometry([<mesh referenced from the Rhino model> x260])
number_slider = Slider(5, range=0..10)  # disabled
tree_branch = TreeBranch(Path="{129;1}", MaintainPaths=True)
list_item = ListItem(Index=0, Wrap=True)  # disabled
number_slider_2 = Slider(3, range=0..10)  # disabled
tree_branch_2 = TreeBranch(Path="{3;3}", MaintainPaths=True)  # disabled
# 3. Write predictors for training
boolean_toggle = BooleanToggle(True)  # disabled
domain = Domain(Domain(0, 30))  # disabled
number_slider_3 = Slider(1, range=0..1)  # disabled

# ----
# ground truth walls
walls_ground_truth = Geometry(reference_by_layer)
tree_statistics = TreeStatistics(Tree=walls_ground_truth)  # -> simplify(graft(Paths)), Length, Count
series = Series(Start=0, Step=1, Count=tree_statistics.Count)  # -> simplify(graft(Series))
list_length = ListLength(List=walls_ground_truth)
duplicate_data = DuplicateData(Data=series, Number=list_length, Order=False)  # -> simplify(flatten(Data))

# ----
# Inputs: walls, floors, ceilings
walls = Geometry(flatten(geometry))
# A. Create a set of connected potential edges
sort_list = SortList(Keys=walls, ValuesValuesA=walls, ValuesLabelsGroundTruth=duplicate_data)  # -> reverse(Keys), reverse(ValuesValuesA), reverse(ValuesLabelsGroundTruth)
floors = Geometry([<mesh referenced from the Rhino model> x113])
# Grasshopper Plug in: Clustering
walls_2 = Geometry(sort_list.ValuesValuesA)
ceilings = Geometry([<mesh referenced from the Rhino model> x127])

integer = Integer(sort_list.ValuesLabelsGroundTruth)

geometry_2 = Geometry(simplify(flatten(walls_2)))  # disabled
list_length_2 = ListLength(List=flatten(geometry_2))  # disabled
series_2 = Series(Start=0, Step=1, Count=list_length_2)  # disabled
# 0. Fully adjancency matrix (uppertriangle)
area = Area(Geometry=geometry_2)  # -> Area, Centroid; disabled
cross_reference = CrossReference(ListListA=flatten(series_2), ListListB=flatten(series_2), CrossMode=7)  # -> simplify(graft(ListListA)), simplify(graft(ListListB)); disabled

# ----
# 0. Fully adjancency matrix (k=20). Paths = indices
area_2 = Area(Geometry=walls_2)  # -> Area, Centroid
list_length_3 = ListLength(List=walls_2)
closest_points = ClosestPoints(Point=area_2.Centroid, Cloud=area_2.Centroid, Count=Slider(20, range=0..100))  # -> simplify(FullAdjenccyMatrix), simplify(CPIndex), simplify(Distance)
series_3 = Series(Start=0, Step=1, Count=list_length_3)  # -> simplify(graft(Series))
cull_index = CullIndex(Index=closest_points.CPIndex, Indices=0, Wrap=True)  # -> simplify(List)
list_item_2 = ListItem(List=walls_2, Index=cull_index, Wrap=True)  # -> simplify(Item)
list_length_4 = ListLength(List=list_item_2)
duplicate_data_2 = DuplicateData(Data=series_3, Number=list_length_4, Order=True)  # -> simplify(Data)
integer_2 = Integer(duplicate_data_2)
integer_3 = Integer(cull_index)
merge = Merge(Data1=graft(integer_2), Data2=graft(integer_3))  # -> simplify(Result)
construct_path = ConstructPath(Indices=merge)  # -> flatten(Branch)
tree_statistics_2 = TreeStatistics(Tree=merge)  # -> Paths, Length, Count
replace_paths = ReplacePaths(Data=merge, Search=tree_statistics_2.Paths, Replace=construct_path)
list_item_3 = ListItem(Centroid=area_2.Centroid, Index=replace_paths, Wrap=True)
list_item_4 = ListItem(List=walls_2, Index=replace_paths, Wrap=True)
list_item_5 = ListItem(List=area_2.Area, Index=replace_paths, Wrap=True)

merge_2 = Merge(Data1=cross_reference.ListListA, Data2=cross_reference.ListListB)  # disabled
list_item_6 = ListItem(Centroid=area.Centroid, Index=merge_2, Wrap=True)  # disabled
list_item_7 = ListItem(List=geometry_2, Index=merge_2, Wrap=True)  # disabled
list_item_8 = ListItem(List=area.Area, Index=merge_2, Wrap=True)  # disabled
sort_list_2 = SortList(Keys=list_item_8, ValuesGeo=list_item_7, ValuesCentroid=list_item_6)  # -> reverse(Keys), reverse(ValuesGeo), reverse(ValuesCentroid); disabled
mass_addition = MassAddition(Input=merge)  # -> flatten(Result), PartialResults; disabled
tree_statistics_3 = TreeStatistics(Tree=merge)  # -> Paths, Length, Count; disabled
# duplicaten vermijden
sort_list_3 = SortList(Keys=mass_addition.Result, ValuesValuesA=tree_statistics_3.Paths)  # -> Keys, ValuesValuesA; disabled
delete_consecutive = DeleteConsecutive(Set=sort_list_3.Keys, Wrap=False)  # -> Set, Count; disabled
find_similar_member = FindSimilarMember(Data=mass_addition.Result, Set=simplify(delete_consecutive.Set))  # -> Hit, Index; disabled
sort_list_4 = SortList(Keys=find_similar_member.Index, ValuesValuesA=tree_statistics_3.Paths)  # -> Keys, ValuesValuesA; disabled
delete_consecutive_2 = DeleteConsecutive(Set=sort_list_4.Keys, Wrap=False)  # -> Set, Count; disabled
list_item_9 = ListItem(List=tree_statistics_3.Paths, Index=delete_consecutive_2.Set, Wrap=True)  # disabled
# 1. cull edges length>3m
smaller_than = SmallerThan(FirstNumber=closest_points.Distance, SecondNumber=number_slider)  # -> SmallerThan, OrEqualTo; disabled
tree_branch_3 = TreeBranch(Tree=merge, MaintainPaths=True)  # disabled

# ----
# 1. cull edges |boundary|>2m
list_item_10 = ListItem(List=list_item_3, Index=1, Wrap=True)
list_item_11 = ListItem(List=list_item_3, Index=0, Wrap=True)
list_item_12 = ListItem(List=list_item_4, Index=0, Wrap=True)
list_item_13 = ListItem(List=list_item_4, Index=1, Wrap=True)
mesh_closest_point = MeshClosestPoint(Point=list_item_10, Mesh=list_item_12)  # -> Point, Index, Parameter
mesh_closest_point_2 = MeshClosestPoint(Point=list_item_11, Mesh=list_item_13)  # -> Point, Index, Parameter
mesh_eval = MeshEval(Mesh=list_item_12, Parameter=mesh_closest_point.Parameter)  # -> Point, Normal, Colour
mesh_eval_2 = MeshEval(Mesh=list_item_13, Parameter=mesh_closest_point_2.Parameter)  # -> Point, Normal, Colour
line = Line(StartPoint=mesh_eval.Point, EndPoint=mesh_eval_2.Point)
length = Length(Curve=line)
smaller_than_2 = SmallerThan(FirstNumber=length, SecondNumber=Slider(2, range=0..10))  # -> SmallerThan, OrEqualTo
dispatch = Dispatch(List=list_item_4, DispatchPattern=smaller_than_2.SmallerThan)  # -> simplify(ListA), ListB
dispatch_2 = Dispatch(Centroid=list_item_3, DispatchPattern=smaller_than_2.SmallerThan)  # -> simplify(ListA), ListB
dispatch_3 = Dispatch(List=line, DispatchPattern=smaller_than_2.SmallerThan)  # -> simplify(ListA), ListB
dispatch_4 = Dispatch(List=list_item_5, DispatchPattern=smaller_than_2.SmallerThan)  # -> simplify(ListA), ListB
clean_tree = CleanTree(RemoveNulls=True, RemoveInvalid=True, RemoveEmpty=True, Tree=dispatch.ListA)
clean_tree_2 = CleanTree(RemoveNulls=True, RemoveInvalid=True, RemoveEmpty=True, Tree=dispatch_2.ListA)
clean_tree_3 = CleanTree(RemoveNulls=True, RemoveInvalid=True, RemoveEmpty=True, Tree=dispatch_3.ListA)
clean_tree_4 = CleanTree(RemoveNulls=True, RemoveInvalid=True, RemoveEmpty=True, Tree=dispatch_4.ListA)

list_item_14 = ListItem(List=walls_2, Index=tree_branch_3, Wrap=True)  # disabled
cull_index_2 = CullIndex(List=smaller_than.SmallerThan, Indices=0, Wrap=True)  # disabled
dispatch_5 = Dispatch(List=list_item_2, DispatchPattern=cull_index_2)  # -> simplify(graft(ListA)), ListB; disabled
geometry_3 = Geometry(walls_2)
dispatch_6 = Dispatch(List=list_item_2, DispatchPattern=cull_index_2)  # -> simplify(ListA), ListB; disabled
list_item_15 = ListItem(List=walls_2, Index=129, Wrap=True)
list_length_5 = ListLength(List=walls_2)
list_item_16 = ListItem(List=walls_2, Index=cull_index, Wrap=True)
list_item_17 = ListItem(List=geometry_3, Index=Slider(38, range=0..100), Wrap=True)
list_item_18 = ListItem(List=geometry_3, Index=Slider(33, range=0..100), Wrap=True)
tree_branch_4 = TreeBranch(Tree=list_item_16, Path="{129}", MaintainPaths=True)
labels = Integer(integer)  # disabled
list_item_19 = ListItem(List=clean_tree_2, Index=1, Wrap=True)
list_item_20 = ListItem(List=clean_tree_2, Index=0, Wrap=True)
# D2. Cluster a set of walls inside each connected component using CRF
initial_meshes = Geometry(walls_2)  # disabled

# ----
# 2. cull edges BoundingBox>0.8m
area_3 = Area(Geometry=clean_tree)  # -> Area, Centroid
mesh_closest_point_3 = MeshClosestPoint(Point=area_3.Centroid, Mesh=clean_tree)  # -> Point, Index, Parameter
mesh_eval_3 = MeshEval(Mesh=clean_tree, Parameter=mesh_closest_point_3.Parameter)  # -> Point, Normal, Colour
sort_list_5 = SortList(Keys=clean_tree_4, ValuesMesh=clean_tree, ValuesCentroid=clean_tree_2, ValuesNormal=mesh_eval_3.Normal)  # -> reverse(Keys), reverse(ValuesMesh), reverse(ValuesCentroid), reverse(ValuesNormal)
list_item_21 = ListItem(List=sort_list_5.ValuesNormal, Index=0, Wrap=True)
list_item_22 = ListItem(List=sort_list_5.ValuesCentroid, Index=1, Wrap=True)
list_item_23 = ListItem(List=sort_list_5.ValuesCentroid, Index=0, Wrap=True)
vector_2pt = Vector2Pt(PointA=list_item_23, PointB=list_item_22, Unitize=False)  # -> Vector, Length
dot_product = DotProduct(VectorA=list_item_21, VectorB=vector_2pt.Vector, Unitize=False)
smaller_than_3 = SmallerThan(FirstNumber=dot_product, SecondNumber=Slider(0.8, range=0..1))  # -> SmallerThan, OrEqualTo
dispatch_7 = Dispatch(List=sort_list_5.Keys, DispatchPattern=smaller_than_3.SmallerThan)  # -> ListA, ListB
dispatch_8 = Dispatch(List=sort_list_5.ValuesMesh, DispatchPattern=smaller_than_3.SmallerThan)  # -> ListA, ListB
dispatch_9 = Dispatch(Centroid=sort_list_5.ValuesCentroid, DispatchPattern=smaller_than_3.SmallerThan)  # -> ListA, ListB
dispatch_10 = Dispatch(Normal=sort_list_5.ValuesNormal, DispatchPattern=smaller_than_3.SmallerThan)  # -> ListA, ListB
dispatch_11 = Dispatch(List=clean_tree_3, DispatchPattern=smaller_than_3.SmallerThan)  # -> ListA, ListB
clean_tree_5 = CleanTree(RemoveNulls=True, RemoveInvalid=True, RemoveEmpty=True, Tree=dispatch_7.ListA)
clean_tree_6 = CleanTree(RemoveNulls=True, RemoveInvalid=True, RemoveEmpty=True, Tree=dispatch_8.ListA)
clean_tree_7 = CleanTree(RemoveNulls=True, RemoveInvalid=True, RemoveEmpty=True, Tree=dispatch_9.ListA)
clean_tree_8 = CleanTree(RemoveNulls=True, RemoveInvalid=True, RemoveEmpty=True, Tree=dispatch_10.ListA)
clean_tree_9 = CleanTree(RemoveNulls=True, RemoveInvalid=True, RemoveEmpty=True, Tree=dispatch_11.ListA)

line_2 = Line(StartPoint=list_item_20, EndPoint=list_item_19)
panel = Panel(dot_product)
list_item_24 = ListItem(List=clean_tree_7, Index=1, Wrap=True)
list_item_25 = ListItem(List=clean_tree_7, Index=0, Wrap=True)

# ----
# 3. Remove duplicates
list_item_26 = ListItem(List=clean_tree_7, Index=0, Wrap=True)
list_item_27 = ListItem(List=clean_tree_7, Index=1, Wrap=True)
line_3 = Line(StartPoint=list_item_26, EndPoint=list_item_27)
evaluate_length = EvaluateLength(Curve=line_3, Length=0.5, Normalized=True)  # -> Point, Tangent, Parameter
tree_statistics_4 = TreeStatistics(Tree=line_3)  # -> Paths, Length, Count
point_groups = PointGroups(Points=flatten(evaluate_length.Point), Distance=0.01)  # -> simplify(Groups), simplify(Indices)
list_item_28 = ListItem(List=point_groups.Indices, Index=0, Wrap=True)
list_item_29 = ListItem(List=tree_statistics_4.Paths, Index=list_item_28, Wrap=True)
tree_branch_5 = TreeBranch(Tree=clean_tree_5, Path=list_item_29, MaintainPaths=True)
tree_branch_6 = TreeBranch(Tree=clean_tree_6, Path=list_item_29, MaintainPaths=True)
tree_branch_7 = TreeBranch(Tree=clean_tree_7, Path=list_item_29, MaintainPaths=True)
tree_branch_8 = TreeBranch(Tree=clean_tree_8, Path=list_item_29, MaintainPaths=True)
tree_branch_9 = TreeBranch(Tree=clean_tree_9, Path=list_item_29, MaintainPaths=True)

# ----
# 4. cull edges intersecting with other surfaces
geometry_4 = Geometry(walls_2)
edges = Geometry(tree_branch_9)
evaluate_length_2 = EvaluateLength(Curve=edges, Length=0.5, Normalized=True)  # -> Point, Tangent, Parameter
length_2 = Length(Curve=edges)
number = Number(expr("x+0.03", length_2))
division = Division(A=length_2, B=number)
scale = Scale(Geometry=edges, Center=evaluate_length_2.Point, Factor=division)  # -> Geometry, Transform
mesh_curve = MeshCurve(Mesh=geometry_4, Curve=scale.Geometry)  # -> Points, Faces
shift_paths = ShiftPaths(Data=mesh_curve.Points, Offset=-1)
list_length_6 = ListLength(List=shift_paths)
equality = Equality(FirstNumber=list_length_6, SecondNumber=0)  # -> Equality, Inequality
dispatch_12 = Dispatch(List=tree_branch_5, DispatchPattern=equality.Equality)  # -> ListA, ListB
dispatch_13 = Dispatch(List=tree_branch_6, DispatchPattern=equality.Equality)  # -> ListA, ListB
dispatch_14 = Dispatch(Centroid=tree_branch_7, DispatchPattern=equality.Equality)  # -> ListA, ListB
dispatch_15 = Dispatch(Normal=tree_branch_8, DispatchPattern=equality.Equality)  # -> ListA, ListB
dispatch_16 = Dispatch(List=tree_branch_9, DispatchPattern=equality.Equality)  # -> ListA, ListB
clean_tree_10 = CleanTree(RemoveNulls=True, RemoveInvalid=True, RemoveEmpty=True, Tree=dispatch_12.ListA)
clean_tree_11 = CleanTree(RemoveNulls=True, RemoveInvalid=True, RemoveEmpty=True, Tree=dispatch_13.ListA)
clean_tree_12 = CleanTree(RemoveNulls=True, RemoveInvalid=True, RemoveEmpty=True, Tree=dispatch_14.ListA)
clean_tree_13 = CleanTree(RemoveNulls=True, RemoveInvalid=True, RemoveEmpty=True, Tree=dispatch_15.ListA)
clean_tree_14 = CleanTree(RemoveNulls=True, RemoveInvalid=True, RemoveEmpty=True, Tree=dispatch_16.ListA)

tree_branch_10 = TreeBranch(Tree=shift_paths, Path="{129}", MaintainPaths=True)  # -> graft(Branch)
panel_2 = Panel(division)
line_4 = Line(StartPoint=list_item_25, EndPoint=list_item_24)
list_item_30 = ListItem(List=clean_tree_12, Index=1, Wrap=True)
list_item_31 = ListItem(List=clean_tree_12, Index=0, Wrap=True)
list_item_32 = ListItem(List=tree_branch_7, Index=1, Wrap=True)
list_item_33 = ListItem(List=tree_branch_7, Index=0, Wrap=True)
line_5 = Line(StartPoint=list_item_31, EndPoint=list_item_30)
line_6 = Line(StartPoint=list_item_33, EndPoint=list_item_32)

# ----
# 5. absolute distance: cull edges that dot fulfill 5.1,5.2,5.3
# 5.1 dot(ni,nj) > cos(t) & || si,sj || < 1m
# 5.2. dot (ni,nj) > cos(t) & dot(ni & nj,sisj) & || si,sj || < 2m
# 5.3. || si,sj || < 0.5m
list_item_34 = ListItem(List=clean_tree_12, Index=0, Wrap=True)
list_item_35 = ListItem(List=clean_tree_12, Index=1, Wrap=True)
list_item_36 = ListItem(List=clean_tree_13, Index=0, Wrap=True)
list_item_37 = ListItem(List=clean_tree_13, Index=1, Wrap=True)
vector_length = VectorLength(Vector=clean_tree_14)
vector_2pt_2 = Vector2Pt(PointA=list_item_34, PointB=list_item_35, Unitize=True)  # -> Vector, Length
dot_product_2 = DotProduct(VectorA=list_item_36, VectorB=list_item_37, Unitize=False)
vector_length_2 = VectorLength(Vector=clean_tree_14)
smaller_than_4 = SmallerThan(FirstNumber=vector_length, SecondNumber=Slider(0.5, range=0..1))  # -> SmallerThan, OrEqualTo
smaller_than_5 = SmallerThan(FirstNumber=vector_length_2, SecondNumber=Slider(1, range=0..1))  # -> SmallerThan, OrEqualTo
dot_product_3 = DotProduct(VectorA=list_item_36, VectorB=vector_2pt_2.Vector, Unitize=False)  # -> expr("abs(x)", DotProduct)
dot_product_4 = DotProduct(VectorA=list_item_37, VectorB=vector_2pt_2.Vector, Unitize=False)  # -> expr("abs(x)", DotProduct)
cos_theta_30 = Number(0.866)
larger_than = LargerThan(FirstNumber=dot_product_2, SecondNumber=cos_theta_30)  # -> LargerThan, OrEqualTo
number_slider_4 = Slider(0.1, range=0..0.1)
smaller_than_6 = SmallerThan(FirstNumber=dot_product_4, SecondNumber=number_slider_4)  # -> SmallerThan, OrEqualTo
smaller_than_7 = SmallerThan(FirstNumber=dot_product_3, SecondNumber=number_slider_4)  # -> SmallerThan, OrEqualTo
gate_and = GateAnd(A=larger_than.LargerThan, B=smaller_than_5.SmallerThan)
gate_and_2 = GateAnd(A=smaller_than_7.SmallerThan, B=smaller_than_6.SmallerThan)
gate_and_3 = GateAnd(A=larger_than.LargerThan, B=gate_and_2)
gate_or = GateOr(C=gate_and, A=gate_and_3, B=smaller_than_4.SmallerThan)
dispatch_17 = Dispatch(List=clean_tree_10, DispatchPattern=gate_or)  # -> ListA, ListB
dispatch_18 = Dispatch(List=clean_tree_11, DispatchPattern=gate_or)  # -> ListA, ListB
dispatch_19 = Dispatch(Centroid=clean_tree_12, DispatchPattern=gate_or)  # -> ListA, ListB
dispatch_20 = Dispatch(Normal=clean_tree_13, DispatchPattern=gate_or)  # -> ListA, ListB
dispatch_21 = Dispatch(List=clean_tree_14, DispatchPattern=gate_or)  # -> ListA, ListB
clean_tree_15 = CleanTree(RemoveNulls=True, RemoveInvalid=True, RemoveEmpty=True, Tree=dispatch_17.ListA)
clean_tree_16 = CleanTree(RemoveNulls=True, RemoveInvalid=True, RemoveEmpty=True, Tree=dispatch_18.ListA)
clean_tree_17 = CleanTree(RemoveNulls=True, RemoveInvalid=True, RemoveEmpty=True, Tree=dispatch_19.ListA)
clean_tree_18 = CleanTree(RemoveNulls=True, RemoveInvalid=True, RemoveEmpty=True, Tree=dispatch_20.ListA)
clean_tree_19 = CleanTree(RemoveNulls=True, RemoveInvalid=True, RemoveEmpty=True, Tree=dispatch_21.ListA)

# ----
# B. Create a set of connected components
# 1.Region grow connected components
meshes_at_edges = Geometry(clean_tree_16)
initial_meshes_2 = Geometry(walls_2)
area_4 = Number(clean_tree_15)
normal = Vector(clean_tree_18)
centroid = Geometry(clean_tree_17)
edge = Geometry(clean_tree_19)
tree_statistics_5 = TreeStatistics(Tree=edge)  # -> Paths, Length, Count
list_item_38 = ListItem(List=centroid, Index=1, Wrap=True)
list_item_39 = ListItem(List=centroid, Index=0, Wrap=True)
line_7 = Line(StartPoint=list_item_39, EndPoint=list_item_38)
text_split = TextSplit(Text=graft(tree_statistics_5.Paths), Separators=";")
replace_text = ReplaceText(Text=text_split, Find=["{", "}"], RecursiveReplace=False)
list_item_40 = ListItem(List=replace_text, Index=1, Wrap=True)  # -> flatten(Item)
list_item_41 = ListItem(List=replace_text, Index=0, Wrap=True)  # -> flatten(Item)
ghpython_script = GhPythonScript(S=initial_meshes_2, si=list_item_41, sj=list_item_40)  # -> out, branch, records; inputs S: list of Mesh, si: list of Int32, sj: list of Int32
# ---------- ghpython_script: Python ----------
__author__ = "u0094523"
__version__ = "2018.11.13"

import rhinoscriptsyntax as rs
from Grasshopper.Kernel.Data import GH_Path
from Grasshopper import DataTree
import clr
clr.AddReference("Grasshopper")
import System


branch=DataTree[System.Object](); """ branches"""
records=DataTree[System.Object]();
queue=range(len(S)); """ list with records"""
i=0; """ branch counter"""
j=0;

while any(queue):
    """ create list a with all the indices belonging together"""
    a=[queue[0]]; """list with indices of the cluster"""
    j=0;
    del queue[0];
    while j<len(a):
        indices_si=[k for k, x in enumerate(si) if x == a[j]]; """record indices si"""
        indices_sj=[k for k, x in enumerate(sj) if x == a[j]]; """record indices sj"""
        b=[]; """ records"""
        for k in range(len(indices_si)):
            b.append(indices_si[k]);
            a.append(sj[indices_si[k]]);
            if a[-1] in queue:
                queue.remove(a[-1]);"""delete last added value in a from queue"""
        for l in range(len(indices_sj)):
            b.append(indices_sj[l]);
            a.append(si[indices_sj[l]]);
            if a[-1] in queue:
                queue.remove(a[-1]);
        for m in range(len(b)):
            si[b[m]]=-1;
            sj[b[m]]=-1;
        j=j+1;
        records.AddRange(b,GH_Path(i));
    branch.AddRange(a,GH_Path(i));
    i=i+1;"""
    a.append(indices_si);
    a.append(indices_sj);
    append list a to a new branch in b
    Add(b,c); b.append([1, 2, 3 ]);
    c=c+1;
       a[i]=len(S);(si[1]);
a=b in si;
a=si.index(b);
a= [0]*len(S);"""
# ---------- end ghpython_script ----------
create_set = CreateSet(List=ghpython_script.branch)  # -> Index, Map
list_item_42 = ListItem(List=initial_meshes_2, Index=create_set.Index, Wrap=True)
list_item_43 = ListItem(List=list_item_41, Index=ghpython_script.records, Wrap=True)
list_item_44 = ListItem(List=list_item_40, Index=ghpython_script.records, Wrap=True)
connected_components = Geometry(list_item_42)
sj = Integer(list_item_44)
si = Integer(list_item_43)

tree_branch_11 = TreeBranch(Tree=list_item_42, Path=Slider(5, range=0..100), MaintainPaths=True)
panel_3 = Panel(gate_or)  # disabled
list_item_45 = ListItem(List=clean_tree_17, Index=1, Wrap=True)  # disabled
list_item_46 = ListItem(List=clean_tree_17, Index=0, Wrap=True)  # disabled
# problem: floor and ceiling geometry is subideal! its to close to walls and computationally challenging for little to no reduction rate.
line_8 = Line(StartPoint=list_item_46, EndPoint=list_item_45)  # disabled
ceilings_2 = Geometry(ceilings)  # disabled
# 6. cull edges that intersect with room geometry
floors_2 = Geometry(floors)  # disabled
deconstruct_mesh = DeconstructMesh(Mesh=floors_2)  # -> Vertices, Faces, Colours, Normals; disabled
deconstruct_mesh_2 = DeconstructMesh(Mesh=ceilings_2)  # -> Vertices, Faces, Colours, Normals; disabled
mesh_edges = MeshEdges(Mesh=floors_2)  # -> NakedEdges, InteriorEdges, NonManifoldEdges; disabled
mesh_edges_2 = MeshEdges(Mesh=ceilings_2)  # -> NakedEdges, InteriorEdges, NonManifoldEdges; disabled
convex_hull = ConvexHull(Points=deconstruct_mesh.Vertices, Plane=PlaneXY(0, 0, 0))  # -> Hull, HullZ, Indices; disabled
convex_hull_2 = ConvexHull(Points=deconstruct_mesh_2.Vertices, Plane=PlaneXY(0, 0, 0))  # -> Hull, HullZ, Indices; disabled
join_curves = JoinCurves(Curves=mesh_edges.NakedEdges, Preserve=False)  # -> flatten(Curves); disabled
join_curves_2 = JoinCurves(Curves=mesh_edges_2.NakedEdges, Preserve=False)  # -> flatten(Curves); disabled
offset_curve = OffsetCurve(Curve=convex_hull.HullZ, Distance=-0.15, Plane=PlaneXY(0, 0, 0), Corners=1)  # disabled
offset_curve_2 = OffsetCurve(Curve=convex_hull_2.HullZ, Distance=-0.15, Plane=PlaneXY(0, 0, 0), Corners=1)  # disabled
length_3 = Length(Curve=join_curves)  # -> flatten(Length); disabled
length_4 = Length(Curve=join_curves_2)  # -> flatten(Length); disabled
extrude = Extrude(Base=offset_curve, Direction=Vector(0, 0, 2))  # disabled
extrude_2 = Extrude(Base=offset_curve_2, Direction=Vector(0, 0, -2))  # disabled
larger_than_2 = LargerThan(FirstNumber=length_4, SecondNumber=number_slider_3)  # -> LargerThan, OrEqualTo; disabled
larger_than_3 = LargerThan(FirstNumber=length_3, SecondNumber=number_slider_3)  # -> LargerThan, OrEqualTo; disabled
merge_3 = Merge(Data1=extrude, Data2=extrude_2)  # -> flatten(Result); disabled
dispatch_22 = Dispatch(List=join_curves_2, DispatchPattern=larger_than_2.LargerThan)  # -> ListA, ListB; disabled
dispatch_23 = Dispatch(List=join_curves, DispatchPattern=larger_than_3.LargerThan)  # -> ListA, ListB; disabled
extrude_3 = Extrude(Base=dispatch_22.ListA, Direction=Vector(0, 0, -2))  # disabled
extrude_4 = Extrude(Base=dispatch_23.ListA, Direction=Vector(0, 0, 2))  # disabled
merge_4 = Merge(Data1=extrude_4, Data2=extrude_3)  # disabled
mesh_curve_2 = MeshCurve(Mesh=merge_4, Curve=clean_tree_19)  # -> Points, Faces; disabled
shift_paths_2 = ShiftPaths(Data=mesh_curve_2.Points, Offset=-1)  # disabled
list_length_7 = ListLength(List=shift_paths_2)  # disabled
equality_2 = Equality(FirstNumber=list_length_7, SecondNumber=0)  # -> Equality, Inequality; disabled
dispatch_24 = Dispatch(List=clean_tree_15, DispatchPattern=equality_2.Equality)  # -> ListA, ListB; disabled
dispatch_25 = Dispatch(List=clean_tree_16, DispatchPattern=equality_2.Equality)  # -> ListA, ListB; disabled
dispatch_26 = Dispatch(Centroid=clean_tree_17, DispatchPattern=equality_2.Equality)  # -> ListA, ListB; disabled
dispatch_27 = Dispatch(Normal=clean_tree_18, DispatchPattern=equality_2.Equality)  # -> ListA, ListB; disabled
dispatch_28 = Dispatch(List=clean_tree_19, DispatchPattern=equality_2.Equality)  # -> ListA, ListB; disabled
clean_tree_20 = CleanTree(RemoveNulls=True, RemoveInvalid=True, RemoveEmpty=True, Tree=dispatch_24.ListA)  # disabled
clean_tree_21 = CleanTree(RemoveNulls=True, RemoveInvalid=True, RemoveEmpty=True, Tree=dispatch_25.ListA)  # disabled
clean_tree_22 = CleanTree(RemoveNulls=True, RemoveInvalid=True, RemoveEmpty=True, Tree=dispatch_26.ListA)  # disabled
clean_tree_23 = CleanTree(RemoveNulls=True, RemoveInvalid=True, RemoveEmpty=True, Tree=dispatch_27.ListA)  # disabled
clean_tree_24 = CleanTree(RemoveNulls=True, RemoveInvalid=True, RemoveEmpty=True, Tree=dispatch_28.ListA)  # disabled
list_item_47 = ListItem(List=clean_tree_22, Index=1, Wrap=True)  # disabled
list_item_48 = ListItem(List=clean_tree_22, Index=0, Wrap=True)  # disabled
line_9 = Line(StartPoint=list_item_48, EndPoint=list_item_47)  # disabled

# ----
# D1. Cluster a set of walls inside each connected component using region growing
# 2. Grow clusters within component
# Area >tArea
walls_3 = Geometry(sort_list.ValuesValuesA)

# ----
# C. Validate connected components
# Area >tArea
# 1. Area components with singular surface
# 2. test BB (S) <0.8m
connected_components_2 = Geometry(list_item_42)
list_length_8 = ListLength(List=connected_components_2)
equality_3 = Equality(FirstNumber=list_length_8, SecondNumber=1)  # -> Equality, Inequality
dispatch_29 = Dispatch(List=connected_components_2, DispatchPattern=equality_3.Equality)  # -> ListA, ListB
dispatch_30 = Dispatch(List=create_set.Index, DispatchPattern=equality_3.Equality)  # -> ListA, ListB
dispatch_31 = Dispatch(List=si, DispatchPattern=equality_3.Equality)  # -> ListA, ListB
dispatch_32 = Dispatch(List=sj, DispatchPattern=equality_3.Equality)  # -> ListA, ListB
clean_tree_25 = CleanTree(RemoveNulls=True, RemoveInvalid=True, RemoveEmpty=True, Tree=dispatch_29.ListB)
list_item_49 = ListItem(List=clean_tree_25, Index=0, Wrap=True)
area_5 = Area(Geometry=list_item_49)  # -> Area, Centroid
mesh_closest_point_4 = MeshClosestPoint(Point=area_5.Centroid, Mesh=list_item_49)  # -> Point, Index, Parameter
mesh_eval_4 = MeshEval(Mesh=list_item_49, Parameter=mesh_closest_point_4.Parameter)  # -> Point, Normal, Colour
clean_tree_26 = CleanTree(RemoveNulls=True, RemoveInvalid=True, RemoveEmpty=True, Tree=dispatch_30.ListB)
clean_tree_27 = CleanTree(RemoveNulls=True, RemoveInvalid=True, RemoveEmpty=True, Tree=dispatch_31.ListB)
clean_tree_28 = CleanTree(RemoveNulls=True, RemoveInvalid=True, RemoveEmpty=True, Tree=dispatch_32.ListB)
larger_than_4 = LargerThan(FirstNumber=dispatch_29.ListA, SecondNumber=Slider(1, range=0..1))  # -> LargerThan, OrEqualTo
dispatch_33 = Dispatch(List=dispatch_29.ListA, DispatchPattern=larger_than_4.OrEqualTo)  # -> ListA, ListB
clean_tree_29 = CleanTree(RemoveNulls=True, RemoveInvalid=True, RemoveEmpty=True, Tree=dispatch_33.ListB)
clean_tree_30 = CleanTree(RemoveNulls=True, RemoveInvalid=True, RemoveEmpty=True, Tree=dispatch_33.ListA)

area_6 = Area(Geometry=clean_tree_25)  # -> Area, Centroid
vector_2pt_3 = Vector2Pt(PointA=area_5.Centroid, PointB=area_6.Centroid, Unitize=False)  # -> Vector, Length
dot_product_5 = DotProduct(VectorA=mesh_eval_4.Normal, VectorB=vector_2pt_3.Vector, Unitize=False)
bounds = Bounds(Numbers=dot_product_5)
deconstruct_domain = DeconstructDomain(Domain=bounds)  # -> Start, End
addition = Addition(A=deconstruct_domain.Start, B=deconstruct_domain.End)

smaller_than_8 = SmallerThan(FirstNumber=expr("abs(x)", addition), SecondNumber=Slider(0.8, range=0..1))  # -> SmallerThan, OrEqualTo
dispatch_34 = Dispatch(List=clean_tree_26, DispatchPattern=smaller_than_8.OrEqualTo)  # -> ListA, ListB
dispatch_35 = Dispatch(List=clean_tree_27, DispatchPattern=smaller_than_8.OrEqualTo)  # -> ListA, ListB
dispatch_36 = Dispatch(List=clean_tree_25, DispatchPattern=smaller_than_8.OrEqualTo)  # -> ListA, ListB
dispatch_37 = Dispatch(List=clean_tree_28, DispatchPattern=smaller_than_8.OrEqualTo)  # -> ListA, ListB
clean_tree_31 = CleanTree(RemoveNulls=True, RemoveInvalid=True, RemoveEmpty=True, Tree=dispatch_36.ListB)
clean_tree_32 = CleanTree(RemoveNulls=True, RemoveInvalid=True, RemoveEmpty=True, Tree=dispatch_34.ListB)
clean_tree_33 = CleanTree(RemoveNulls=True, RemoveInvalid=True, RemoveEmpty=True, Tree=dispatch_36.ListA)
clean_tree_34 = CleanTree(RemoveNulls=True, RemoveInvalid=True, RemoveEmpty=True, Tree=dispatch_35.ListB)
clean_tree_35 = CleanTree(RemoveNulls=True, RemoveInvalid=True, RemoveEmpty=True, Tree=dispatch_37.ListB)
merge_5 = Merge(Data1=clean_tree_30, Data2=clean_tree_29, Data3=clean_tree_33, Data4=clean_tree_31)

sort_list_6 = SortList(Keys=clean_tree_31, ValuesIndex=clean_tree_32, ValuesMesh=clean_tree_31)  # -> reverse(Keys), reverse(ValuesIndex), reverse(ValuesMesh)
area_7 = Area(Geometry=sort_list_6.ValuesMesh)  # -> Area, Centroid
mesh_closest_point_5 = MeshClosestPoint(Point=area_7.Centroid, Mesh=sort_list_6.ValuesMesh)  # -> Point, Index, Parameter
# probleem! de bevraging van dikte is potentieel verkeerd! de punten die opgeroepen worden zijn mogelijks niet altijd de juiste
mesh_eval_5 = MeshEval(Mesh=sort_list_6.ValuesMesh, Parameter=mesh_closest_point_5.Parameter)  # -> Point, Normal, Colour
plane_normal = PlaneNormal(Origin=area_7.Centroid, ZAxis=mesh_eval_5.Normal)
ghpython_script_2 = GhPythonScript(S=sort_list_6.ValuesMesh, S_index=sort_list_6.ValuesIndex, S_plane=plane_normal)  # -> out, size, clusters; inputs S: list, S_index: list of Int32, S_plane: list
# ---------- ghpython_script_2: Python ----------
__author__ = "u0094523"
__version__ = "2018.11.13"
import math
import Rhino
import Rhino.Geometry

import rhinoscriptsyntax as rs
import scriptcontext as sc
from Grasshopper.Kernel.Data import GH_Path
from Grasshopper import DataTree
import clr
clr.AddReference("Grasshopper")
import System

clusters=[];""" branches are processed simultaneously"""
a=[]; """ indices clusters"""
N=[]; """meshes of growing cluster"""
size=[]; """length of each cluster"""
j=[]; """indices within list """

while any(S):
    """any(S):"""
    n=0;
    a=[];
    N=[];
    j=[];
    while n < (len(S)):
        """ n= indices of growing cluster"""
        a.append(S_index[n]);
        N.append(S[n]);
        j.append(n);
        box=rs.BoundingBox(N,S_plane[0]); """ point 0 and 4 represent the thickness"""
        edges=rs.VectorCreate(box[0], box[4]);
        length= rs.VectorLength(edges);
        if length >0.8:
            del N[-1];
            del a[-1];
            del j[-1];
            n=n+1;
        else :
            n=n+1;
    for i in range(len(a)):
        del S[j[len(a)-i-1]];
        del S_index[j[len(a)-i-1]];
        del S_plane[j[len(a)-i-1]];
    clusters.append(a); """new tree with nested lists for each cluster """
    size.append(len(a));

"""list with indices of the cluster"""
""" 0.start growing with largest surface in S_index = 0  (because of sorted)"""
""" 1.eval edge largest neighbor S_index = 1->n """
""" eval criterium: BB(s0 -> sj) < 0.8 """
""" add valid edges to clusters, path """

"""run loop for every branch"""



""" remove valid indices from S """
""" restart loop """
# ---------- end ghpython_script_2 ----------
list_to_tree = ListToTree(PythonList=graft(ghpython_script_2.clusters))  # -> simplify(DataTree); inputs PythonList: list, BasePath: list of Int32
# ---------- list_to_tree: Python ----------
from Grasshopper import DataTree as Tree
from Grasshopper.Kernel.Data import GH_Path as Path
from System import Array

def list_to_tree(input, none_and_holes=False, base_path=[0]):
    """Transforms nestings of lists or tuples to a Grasshopper DataTree"""
    
    def process_one_item(input,tree,track):
        path = Path(Array[int](track))
        if len(input) == 0 and none_and_holes: tree.EnsurePath(path); return
        for i,item in enumerate(input):
            if hasattr(item, '__iter__'): #if list or tuple
                track.append(i); process_one_item(item,tree,track); track.pop()
            else:
                if none_and_holes: tree.Insert(item,path,i)
                elif item is not None: tree.Add(item,path)
    tree = Tree[object]()
    if input is not None: process_one_item(input,tree,base_path[:]); return tree
    

pythonList = PythonList or []
None_and_holes = False
Base_path = BasePath or [0]


DataTree = list_to_tree(pythonList,none_and_holes = None_and_holes, base_path= Base_path)
# ---------- end list_to_tree ----------
partition_list = PartitionList(List=list_to_tree, Size=ghpython_script_2.size)  # -> simplify(Chunks)
list_item_50 = ListItem(List=walls_3, Index=partition_list, Wrap=True)
list_length_9 = ListLength(List=list_item_50)
equality_4 = Equality(FirstNumber=list_length_9, SecondNumber=1)  # -> Equality, Inequality
dispatch_38 = Dispatch(List=list_item_50, DispatchPattern=equality_4.Equality)  # -> ListA, ListB
dispatch_39 = Dispatch(List=partition_list, DispatchPattern=equality_4.Equality)  # -> ListA, ListB
larger_than_5 = LargerThan(FirstNumber=dispatch_38.ListA, SecondNumber=Slider(1, range=0..1))  # -> LargerThan, OrEqualTo
dispatch_40 = Dispatch(List=dispatch_39.ListA, DispatchPattern=larger_than_5.OrEqualTo)  # -> ListA, ListB
dispatch_41 = Dispatch(List=dispatch_38.ListA, DispatchPattern=larger_than_5.OrEqualTo)  # -> ListA, ListB
clean_tree_36 = CleanTree(RemoveNulls=True, RemoveInvalid=True, RemoveEmpty=True, Tree=dispatch_41.ListB)
clean_tree_37 = CleanTree(RemoveNulls=True, RemoveInvalid=True, RemoveEmpty=True, Tree=dispatch_38.ListB)
clean_tree_38 = CleanTree(RemoveNulls=True, RemoveInvalid=True, RemoveEmpty=True, Tree=dispatch_39.ListB)
clean_tree_39 = CleanTree(RemoveNulls=True, RemoveInvalid=True, RemoveEmpty=True, Tree=dispatch_40.ListA)
clean_tree_40 = CleanTree(RemoveNulls=True, RemoveInvalid=True, RemoveEmpty=True, Tree=dispatch_41.ListA)
merge_6 = Merge(Data1=clean_tree_40, Data2=clean_tree_37)
merge_7 = Merge(Data1=clean_tree_39, Data2=clean_tree_38)

panel_4 = Panel(clean_tree_33)
explode_tree = ExplodeTree(Data=list_item_50)  # -> Branch0, Branch1, Branch2, Branch3, Branch4, Branch5, Branch6, Branch7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; disabled
geometry_5 = Geometry(explode_tree.Branch0)  # disabled
geometry_6 = Geometry(explode_tree.Branch1)  # disabled
geometry_7 = Geometry(explode_tree.Branch2)  # disabled
geometry_8 = Geometry(explode_tree.Branch3)  # disabled
geometry_9 = Geometry(explode_tree.Branch4)
geometry_10 = Geometry(explode_tree.Branch5)
large_connected_components_index = Integer(clean_tree_32)  # disabled
unclustered_connected_components = Geometry(clean_tree_31)  # disabled
sort_list_7 = SortList(Keys=large_connected_components_index, ValuesValuesA=unclustered_connected_components)  # -> Keys, ValuesValuesA, ValuesLabe; disabled
# connected components
unclustered_connected_components_2 = Geometry(sort_list_7.ValuesValuesA)  # disabled
large_connected_components_index_2 = Integer(sort_list_7.Keys)  # disabled
large_connected_components_index_3 = Integer(large_connected_components_index_2)  # disabled
list_item_51 = ListItem(List=labels, Index=large_connected_components_index_3, Wrap=True)  # disabled
sj_large_connected_components = Integer(clean_tree_35)  # disabled
si_large_connected_components = Integer(clean_tree_34)  # disabled
# seeds from region growing
list_item_52 = ListItem(List=merge_6, Index=0, Wrap=True)  # disabled
list_item_53 = ListItem(List=merge_7, Index=0, Wrap=True)  # disabled
seed_index = Integer(list_item_53)  # disabled
seed = Geometry(list_item_52)  # disabled
tree_branch_12 = TreeBranch(Tree=seed, Path=number_slider_2, MaintainPaths=True)  # disabled
panel_5 = Panel(seed_index)
list_length_10 = ListLength(List=list_item_51)  # disabled
# map indices for matlab from 1 to end
series_4 = Series(Start=1, Step=1, Count=list_length_10)  # disabled

# ----
# 1.1 BB thickness si/seed
unclustered_connected_components_3 = Geometry(unclustered_connected_components_2)  # disabled
seed_2 = Geometry(seed)  # disabled
area_8 = Area(Geometry=unclustered_connected_components_3)  # -> Area, Centroid; disabled
area_9 = Area(Geometry=seed_2)  # -> Area, Centroid; disabled
mesh_closest_point_6 = MeshClosestPoint(Point=area_8.Centroid, Mesh=unclustered_connected_components_3)  # -> Point, Index, Parameter; disabled
mesh_closest_point_7 = MeshClosestPoint(Point=area_9.Centroid, Mesh=seed_2)  # -> Point, Index, Parameter; disabled
mesh_eval_6 = MeshEval(Mesh=unclustered_connected_components_3, Parameter=mesh_closest_point_6.Parameter)  # -> Point, Normal, Colour; disabled
mesh_eval_7 = MeshEval(Mesh=seed_2, Parameter=mesh_closest_point_7.Parameter)  # -> Point, Normal, Colour; disabled
vector_2pt_4 = Vector2Pt(PointA=mesh_eval_7.Point, PointB=mesh_eval_6.Point, Unitize=False)  # -> Vector, Length; disabled
dot_product_6 = DotProduct(VectorA=mesh_eval_7.Normal, VectorB=vector_2pt_4.Vector, Unitize=False)  # -> expr("abs(x)", DotProduct); disabled

panel_6 = Panel(merge_7)  # disabled

# ----
# 1.1 length edge si/seed
area_10 = Area(Geometry=unclustered_connected_components_2)  # -> Area, Centroid; disabled
area_11 = Area(Geometry=seed)  # -> Area, Centroid; disabled
unclustered_connected_components_4 = Geometry(unclustered_connected_components_2)  # disabled
seed_3 = Geometry(seed)  # disabled
list_item_54 = ListItem(List=area_11.Centroid, Index=1, Wrap=True)  # disabled
list_item_55 = ListItem(List=area_10.Centroid, Index=0, Wrap=True)  # disabled
mesh_closest_point_8 = MeshClosestPoint(Point=list_item_54, Mesh=unclustered_connected_components_4)  # -> Point, Index, Parameter; disabled
mesh_closest_point_9 = MeshClosestPoint(Point=area_10.Centroid, Mesh=seed_3)  # -> Point, Index, Parameter; disabled
mesh_eval_8 = MeshEval(Mesh=unclustered_connected_components_4, Parameter=mesh_closest_point_8.Parameter)  # -> Point, Normal, Colour; disabled
mesh_eval_9 = MeshEval(Mesh=seed_3, Parameter=mesh_closest_point_9.Parameter)  # -> Point, Normal, Colour; disabled
line_10 = Line(StartPoint=mesh_eval_8.Point, EndPoint=mesh_eval_9.Point)  # disabled

replace_members = ReplaceMembers(Set=si_large_connected_components, Find=large_connected_components_index_2, Replace=series_4)  # disabled
# 2. feature extraction (unary/seeds)
replace_members_2 = ReplaceMembers(Set=sj_large_connected_components, Find=large_connected_components_index_2, Replace=series_4)  # disabled

# ----
# 1.1 BB thickness edge si/sj
sj_large_connected_components_2 = Integer(sj_large_connected_components)  # disabled
si_large_connected_components_2 = Integer(si_large_connected_components)  # disabled
initial_meshes_3 = Geometry(initial_meshes)  # disabled
list_item_56 = ListItem(List=initial_meshes_3, Index=si_large_connected_components_2, Wrap=True)  # -> simplify(graft(Item)); disabled
list_item_57 = ListItem(List=initial_meshes_3, Index=sj_large_connected_components_2, Wrap=True)  # -> simplify(graft(Item)); disabled
area_12 = Area(Geometry=list_item_56)  # -> Area, Centroid; disabled
merge_8 = Merge(Data1=list_item_56, Data2=list_item_57)  # disabled
mesh_closest_point_10 = MeshClosestPoint(Point=area_12.Centroid, Mesh=list_item_56)  # -> Point, Index, Parameter; disabled
mesh_eval_10 = MeshEval(Mesh=list_item_56, Parameter=mesh_closest_point_10.Parameter)  # -> Point, Normal, Colour; disabled
plane_normal_2 = PlaneNormal(Origin=mesh_eval_10.Point, ZAxis=mesh_eval_10.Normal)  # disabled
bounding_box = BoundingBox(Content=merge_8, Plane=plane_normal_2, UnionBox=True)  # -> Box, flatten(Box_2); disabled
deconstruct_box = DeconstructBox(Box=bounding_box.Box_2)  # -> Plane, X, Y, Z; disabled
bb_thickness = Number(deconstruct_box.Z)  # disabled
number_2 = Number(expr("1/(e^(x²))", bb_thickness))  # disabled

# ----
# 1.1 length edge si/sj
sj_large_connected_components_3 = Integer(sj_large_connected_components)  # disabled
# 1. feature extraction (pairwise)
# 1.1 length projected edge si/sj
si_large_connected_components_3 = Integer(si_large_connected_components)  # disabled
initial_meshes_4 = Geometry(initial_meshes)  # disabled
list_item_58 = ListItem(List=initial_meshes_4, Index=si_large_connected_components_3, Wrap=True)  # disabled
list_item_59 = ListItem(List=initial_meshes_4, Index=sj_large_connected_components_3, Wrap=True)  # disabled
area_13 = Area(Geometry=list_item_59)  # -> Area, Centroid; disabled
# pairwise training data
area_14 = Area(Geometry=list_item_58)  # -> Area, Centroid; disabled
mesh_closest_point_11 = MeshClosestPoint(Point=area_13.Centroid, Mesh=list_item_58)  # -> Point, Index, Parameter; disabled
mesh_closest_point_12 = MeshClosestPoint(Point=area_14.Centroid, Mesh=list_item_59)  # -> Point, Index, Parameter; disabled
mesh_eval_11 = MeshEval(Mesh=list_item_58, Parameter=mesh_closest_point_11.Parameter)  # -> Point, Normal, Colour; disabled
mesh_eval_12 = MeshEval(Mesh=list_item_59, Parameter=mesh_closest_point_12.Parameter)  # -> Point, Normal, Colour; disabled
line_11 = Line(StartPoint=mesh_eval_11.Point, EndPoint=mesh_eval_12.Point)  # disabled
length_5 = Length(Curve=line_11)  # disabled
number_3 = Number(expr("1/(e^(x²))", length_5))  # disabled

si_mapped_matlab = Integer(replace_members)  # disabled
sj_mapped_matlab = Integer(replace_members_2)  # disabled

# ----
# labels
labels_2 = Integer(list_item_51)  # disabled
list_item_60 = ListItem(List=labels_2, Index=si_large_connected_components_3, Wrap=True)  # disabled
list_item_61 = ListItem(List=labels_2, Index=sj_large_connected_components_3, Wrap=True)  # disabled
equality_5 = Equality(FirstNumber=list_item_60, SecondNumber=list_item_61)  # -> Equality, Inequality; disabled
integer_4 = Integer(equality_5.Inequality)  # disabled

panel_7 = Panel(sj_mapped_matlab)  # disabled
length_6 = Length(Curve=line_10)  # -> expr("abs(x)", Length); disabled
number_4 = Number(expr("round(1/(e^(x²)),2)", length_6))  # disabled
number_5 = Number(expr("round(1/(e^(x²)),2)", dot_product_6))  # disabled
panel_8 = Panel(list_item_51)  # disabled
# equalize 0/1
sort_list_8 = SortList(Keys=integer_4, ValuesValuesA=number_3, ValuesA=number_2)  # -> Keys, ValuesValuesA, ValuesA; disabled
# BB
sub_list = SubList(List=sort_list_8.ValuesA, Domain=Domain(0, 299), Wrap=True)  # -> List, Index; disabled
# edge
sub_list_2 = SubList(List=sort_list_8.ValuesValuesA, Domain=Domain(0, 299), Wrap=True)  # -> List, Index; disabled
# labels
sub_list_3 = SubList(List=sort_list_8.Keys, Domain=Domain(0, 299), Wrap=True)  # -> List, Index; disabled
panel_9 = Panel(number_4)  # disabled
writematlabpredictors = WriteMatlabPredictors(Write=boolean_toggle, Label=list_item_51, NormalSimilarity=line_10)  # disabled
bb = Number(dot_product_6)  # disabled
edge_2 = Number(length_6)  # disabled
label = Integer(list_item_51)  # disabled
panel_10 = Panel(number_5)  # disabled
number_6 = Number(expr("round(1/(e^(x²)),2)", bb))  # disabled
number_7 = Number(expr("round(1/(e^(x²)),2)", edge_2))  # disabled
sort_list_9 = SortList(Keys=number_7, ValuesValuesA=number_6, ValuesA=label)  # -> reverse(Keys), reverse(ValuesValuesA), reverse(ValuesA); disabled
# unary training data + equalize 0/1: 81.2% recall/precision BoostedTrees
sort_list_10 = SortList(Keys=number_6, ValuesBB=number_7, ValuesLabel=label)  # -> reverse(Keys), reverse(ValuesBB), reverse(ValuesLabel); disabled
sub_list_4 = SubList(List=sort_list_9.ValuesA, Domain=domain, Wrap=True)  # -> List, Index; disabled
sub_list_5 = SubList(List=sort_list_10.ValuesLabel, Domain=domain, Wrap=True)  # -> List, Index; disabled
# edges
sub_list_6 = SubList(List=sort_list_9.Keys, Domain=domain, Wrap=True)  # -> List, Index; disabled
# Bounding Boxes
sub_list_7 = SubList(List=sort_list_9.ValuesValuesA, Domain=domain, Wrap=True)  # -> List, Index; disabled
sub_list_8 = SubList(List=sort_list_10.Keys, Domain=domain, Wrap=True)  # -> List, Index; disabled
# labels
merge_9 = Merge(Data1=sub_list_4.List, Data2=sub_list_5.List)  # -> simplify(Result); disabled
tree_statistics_6 = TreeStatistics(Tree=merge_9)  # -> Paths, Length, Count; disabled
series_5 = Series(Start=0, Step=1, Count=tree_statistics_6.Count)  # -> graft(Series); disabled
sub_list_9 = SubList(List=sort_list_10.ValuesBB, Domain=domain, Wrap=True)  # -> List, Index; disabled
merge_10 = Merge(Data1=sub_list_7.List, Data2=sub_list_8.List)  # -> simplify(Result); disabled
merge_11 = Merge(Data1=sub_list_6.List, Data2=sub_list_9.List)  # -> simplify(Result); disabled
equality_6 = Equality(FirstNumber=merge_9, SecondNumber=series_5)  # -> simplify(Equality), Inequality; disabled
multiplication = Multiplication(A=merge_10, B=merge_11)  # disabled
panel_11 = Panel(merge_11)  # disabled
panel_12 = Panel(merge_10)  # disabled
integer_5 = Integer(equality_6.Equality)  # disabled
panel_13 = Panel(integer_5)  # disabled

# ----
# RESULTS
computed_labels = Integer(expr("x-1", [1, 2, 3, 4, 5, 4, 7, 2, 6, 2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]))  # disabled
ground_thruth_labels = Integer([0, 1, 2, 3, 4, 3, 0, 1, 5, 1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])  # disabled
unclustered_connected_components_5 = Geometry([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])  # disabled
region_grow = Geometry(Tree({0}: [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], {1}: [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], {2}: [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], {3}: [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], {4}: [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], {5}: [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], {6}: [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], {7}: [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], {8}: [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]))  # disabled
region_growing_indices = Integer(merge_7)  # disabled
list_item_62 = ListItem(List=ground_thruth_labels, Index=region_growing_indices, Wrap=True)  # disabled
create_set_2 = CreateSet(List=ground_thruth_labels)  # -> Set, Map; disabled
item_index = ItemIndex()  # disabled
member_index = MemberIndex(Set=computed_labels, Member=create_set_2.Set)  # -> simplify(Index), Count; disabled
equality_7 = Equality(FirstNumber=list_item_62, SecondNumber=graft(create_set_2.Set))  # -> Equality, Inequality; disabled
list_item_63 = ListItem(List=unclustered_connected_components_5, Index=member_index.Index, Wrap=True)  # disabled
mass_addition_2 = MassAddition(Input=flatten(equality_7.Equality))  # -> Result, PartialResults; disabled
number_slider_5 = Slider(8, range=0..10)  # disabled
tree_branch_13 = TreeBranch(Tree=region_grow, Path=number_slider_5, MaintainPaths=True)  # disabled
tree_branch_14 = TreeBranch(Tree=list_item_63, Path=number_slider_5, MaintainPaths=True)  # disabled

panel_14 = Panel(list_item_62)  # disabled
