# Grasshopper definition LOA.gh (Grasshopper 0.9.76)
# plug-ins: Volvox

file_path = FilePath("F:\Data\Lidar_15.Sint Jacobs Kerk Leuven\PTG\volvox1.e57")
file_path_2 = FilePath("F:\Data\Lidar_7.N-block\Point clouds\piece1_3M.e57")
text = Text(["1", "1", "1", "1", "1", "1"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])
text_2 = Text(["1", "1", "1", "1", "1", "1"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])
load_e57 = LoadE57(FilePath=file_path_2, Percent=1, Check=True)
series = Series(Start=0, Step=1, Count=100000)
cloud_enginex = CloudEngineX(Cloud=load_e57, Run=Toggle(False), Abort=False, showinfo=True)
split_list = SplitList(List=series, Index=50000)  # -> ListA, ListB
sub_cloud = SubCloud()
bounding_box = BoundingBox(Content=cloud_enginex, Plane=PlaneXY(0, 0, 0))  # -> Box, Box_2; disabled
deconstruct_cloud = DeconstructCloud(Cloud=cloud_enginex)  # -> Points, Normals, Colors; disabled
entwine = Entwine(Branch00=split_list.ListA, Branch01=split_list.ListB, FlattenInputs=True)  # -> simplify(Result)
get_points = GetPoints(Cloud=cloud_enginex, Indices=entwine)  # -> Points, Normals, Colors
construct_cloud = ConstructCloud(Points=get_points.Points, Normals=get_points.Normals, Colors=get_points.Colors)
cloud_statistics = CloudStatistics(Cloud=cloud_enginex)  # -> Count, Colors, Colors_2; disabled
delaunay_mesh = DelaunayMesh(Points=deconstruct_cloud.Points)  # disabled
mesh_compare = MeshCompare(Cloud=cloud_enginex, Mesh=bounding_box.Box, Key="d")  # disabled
cull_cloud = CullCloud(Cloud=mesh_compare, Key="d", Domain=Domain(-0.05, 0.05))  # disabled
cloud_statistics_2 = CloudStatistics(Cloud=cull_cloud)  # -> Count, Colors, Colors_2; disabled
division = Division(A=cloud_statistics_2.Count, B=cloud_statistics.Count)  # disabled
