# Grasshopper definition Script_thesis_Jonas_Slagmolen.gh (Grasshopper 1.0.7)
# plug-ins: EleFront, Pancake, Pufferfish, Volvox, Section To XY, Human

referentie_mesh_as_built = FilePath("V:\Studenten\Thesis\Jonas Slagmolen\Data\Gregorius\Vluchten\20200511 Grego\MeshLAMBERT08_ELLIPS.ply")
mesh_as_built = FilePath("V:\Studenten\Thesis\Jonas Slagmolen\Data\Gregorius\Vluchten\20201215 Grego\MeshLAMBERT08_ELLIPS.ply")

# ----
# start script
as_design_vs_as_built = BooleanToggle(False)
as_built_vs_as_built = BooleanToggle(False)
curves_2_5d = ReferenceByLayerR6(LayerName="OPHOGING")
mesh_ifc = ReferenceByLayerR6(LayerName="BT1_Verhardingstype_WSV1")
referentie_mesh_as_built_2 = FilePath("V:\Studenten\Thesis\Jonas Slagmolen\Data\Mariakerke\Vluchten\101_0352\MeshLAMBERT72_TAW.obj")
mesh_as_built_2 = FilePath("V:\Studenten\Thesis\Jonas Slagmolen\Data\Mariakerke\Vluchten\101_0362\MeshLAMBERT72_TAW.obj")
merge = Merge(Data1=as_design_vs_as_built, Data2=as_built_vs_as_built)
sort_list = SortList(Keys=merge, ValuesValuesA=merge)  # -> Keys, reverse(ValuesValuesA)
list_item = ListItem(List=sort_list.ValuesValuesA, Index=0, Wrap=True)
file_path = FilePath("C:\\Users\\r0713363\\Documents\\thesis_jonas\\temp_files\\Volumeberekening")
file_path_2 = FilePath("C:\Users\r0713363\\Documents\\thesis_jonas\\temp_files")
map_aanmaken = GhPythonScript(exportlocatie=file_path, run=list_item)  # -> out, map
# ---------- map_aanmaken: Python ----------
__author__ = "r0713363"
__version__ = "2022.04.21"

import rhinoscriptsyntax as rs
import os
from datetime import datetime
from fileinput import filename
import os.path

map=[]
if run == True:
    today = datetime.now()
    nieuwe_map=exportlocatie + today.strftime('%Y-%m-%d(%H-%M-%S)')
    os.mkdir(nieuwe_map)
    map.append(nieuwe_map)
# ---------- end map_aanmaken ----------
opkuisen_map = GhPythonScript(search_dir=file_path_2, run=list_item)  # -> out, a
# ---------- opkuisen_map: Python ----------
__author__ = "r0713363"
__version__ = "2022.04.23"

import rhinoscriptsyntax as rs
import os, shutil

if run==True:
    os.chdir(search_dir)
    files = filter(os.path.isdir, os.listdir(search_dir))
    gesorteerd = [os.path.join(search_dir, f) for f in files] # add path to each file
    gesorteerd.sort(key=lambda x: os.path.getmtime(x))
    
    lengte=len(gesorteerd)
    
    print(gesorteerd)
    print(lengte)
    
    aantal=lengte-10
    verwijderen=[]
    for i in range(aantal):
        shutil.rmtree(gesorteerd[i])
# ---------- end opkuisen_map ----------

# ----
# kiezen element
series = Series(Start=0, Step=1, Count=3)
roi_2_5d_tekenen = Curve(<curve referenced from the Rhino model>)  # disabled
number = Number([0, 1, 2])

# ----
# As-design ifc
mesh = Mesh(mesh_ifc)
angle_split_mesh = AngleSplitMesh(Mesh=mesh, Angle=80, Opposite=False)  # -> Split, ResultBoolean
volume = Volume(Geometry=mesh)  # -> Volume, Centroid
deconstruct = Deconstruct(Point=volume.Centroid)  # -> XComponent, YComponent, ZComponent
area = Area(Geometry=angle_split_mesh.Split)  # -> Area, Centroid
deconstruct_2 = Deconstruct(Point=area.Centroid)  # -> XComponent, YComponent, ZComponent
larger_than = LargerThan(FirstNumber=deconstruct_2.ZComponent, SecondNumber=deconstruct.ZComponent)  # -> LargerThan, OrEqualTo
cull_pattern = CullPattern(List=angle_split_mesh.Split, CullPattern=larger_than.OrEqualTo)
area_2 = Area(Geometry=cull_pattern)  # -> Area, Centroid
sort_list_2 = SortList(Keys=area_2.Area, ValuesValuesA=cull_pattern)  # -> Keys, reverse(ValuesValuesA)
list_item_2 = ListItem(List=sort_list_2.ValuesValuesA, Index=1, Wrap=True)
list_item_3 = ListItem(List=sort_list_2.ValuesValuesA, Index=0, Wrap=True)
merge_2 = Merge(Data1=list_item_3, Data2=list_item_2)
equality_within_tolerance = EqualityWithinTolerance(FirstNumber=list_item_3, SecondNumber=list_item_2, Tolerance=1)  # -> Equality, Inequality
cull_pattern_2 = CullPattern(List=list_item_3, CullPattern=equality_within_tolerance.Inequality)
cull_pattern_3 = CullPattern(List=merge_2, CullPattern=equality_within_tolerance.Equality)
area_3 = Area(Geometry=cull_pattern_3)  # -> Area, Centroid
deconstruct_3 = Deconstruct(Point=area_3.Centroid)  # -> XComponent, YComponent, ZComponent
sort_list_3 = SortList(Keys=deconstruct_3.ZComponent, ValuesValuesA=merge_2)  # -> Keys, reverse(ValuesValuesA)
list_item_4 = ListItem(List=sort_list_3.ValuesValuesA, Index=0, Wrap=True)
merge_3 = Merge(Data1=list_item_4, Data2=cull_pattern_2)
clean_tree = CleanTree(RemoveNulls=True, RemoveInvalid=True, RemoveEmpty=True, Tree=merge_3)  # -> simplify(Tree)

merge_4 = Merge(Data1=as_design_vs_as_built, Data2=as_built_vs_as_built)
sort_list_4 = SortList(Keys=merge_4, ValuesValuesA=merge_4)  # -> Keys, reverse(ValuesValuesA)
abort = Abort(Condition=invert(sort_list_4.ValuesValuesA), Passthrough=referentie_mesh_as_built_2, LastSaveLocalization="neutral,N")  # disabled
abort_2 = Abort(Condition=invert(sort_list_4.ValuesValuesA), Passthrough=mesh_as_built_2, LastSaveLocalization="neutral,N")  # disabled

# ----
# Groeperen curves
curve = Curve(curves_2_5d)
polygon_center = PolygonCenter(Polyline=curve)  # -> CenterV, CenterE, CenterA
point_groups = PointGroups(Points=polygon_center.CenterV, Distance=5)  # -> Groups, Indices
list_item_5 = ListItem(List=curve, Index=point_groups.Indices, Wrap=True)
curve_2 = Curve(list_item_5)

# ----
# Roi tekenen
curve_3 = Curve(curves_2_5d)
offset_surface = OffsetSurface(Surface=roi_2_5d_tekenen, Distance=-100, BothSides=-1, CreateSolid=True)
shape_in_brep = ShapeInBrep(Brep=offset_surface, Shape=curve_3)
equality = Equality(FirstNumber=shape_in_brep, SecondNumber=2)  # -> Equality, Inequality
cull_pattern_4 = CullPattern(List=curve_3, CullPattern=invert(equality.Equality))
roi_toevoegen = RoiToevoegen(geometry=cull_pattern_4, geometry_2=roi_2_5d_tekenen)

# ----
# evaluate component
tree_statistics = TreeStatistics(Tree=curve_2)  # -> Paths, Length, Count
number_slider = Slider(41, range=0..100)
list_item_6 = ListItem(List=tree_statistics.Paths, Index=number, Wrap=True)
tree_branch = TreeBranch(Tree=curve_2, Path=list_item_6, MaintainPaths=True)

# ----
# Roi tekenen
patch = Patch(Curves=roi_2_5d_tekenen, Spans=20, Flexibility=1, Trim=True)
offset_surface_2 = OffsetSurface(Surface=roi_2_5d_tekenen, Distance=-100, BothSides=-1, CreateSolid=True)
mesh_split = MeshSplit(Mesh=clean_tree, Splitters=offset_surface_2)
populate_geometry = PopulateGeometry(Geometry=mesh_split, Count=1, Seed=1)
trim_tree = TrimTree(Tree=populate_geometry, Depth=1)
point_in_brep = PointInBrep(Brep=offset_surface_2, Point=trim_tree, Strict=False)
cull_pattern_5 = CullPattern(List=mesh_split, CullPattern=point_in_brep)
trim_tree_2 = TrimTree(Tree=cull_pattern_5, Depth=1)
merge_5 = Merge(Data1=trim_tree_2, Data2=patch)
dispatch = Dispatch(List=merge_5, DispatchPattern=[True, False])  # -> ListA, ListB

# ----
# Mesh to split with
merge_6 = Merge(Data1=tree_branch, Data2=roi_toevoegen)
clean_tree_2 = CleanTree(RemoveNulls=True, RemoveInvalid=False, RemoveEmpty=True, Tree=merge_6)
close_curve = CloseCurve(Curve=clean_tree_2, CloseType=0, Bulge=0.5, Tolerance=0)  # -> Closed, ResultBoolean
length = Length(Curve=close_curve.Closed)
sort_list_5 = SortList(Keys=length, ValuesValuesA=close_curve.Closed)  # -> Keys, reverse(ValuesValuesA)
list_item_7 = ListItem(List=sort_list_5.ValuesValuesA, Index=0, Wrap=True)
extrude = Extrude(Base=list_item_7, Direction=[Vector(0, 0, 10), Vector(0, 0, -10)])

number_2 = Number(1)

# ----
# 2.5D to 3D mesh
merge_7 = Merge(Data1=tree_branch, Data2=cull_pattern_4)
number_slider_2 = Slider(0.1, range=0..1)
clean_tree_3 = CleanTree(RemoveNulls=True, RemoveInvalid=False, RemoveEmpty=True, Tree=merge_7)
divide_distance = DivideDistance(Curve=clean_tree_3, Distance=number_2)  # -> Points, Tangents, Parameters
control_points = ControlPoints(Curve=clean_tree_3)  # -> Points, Weights, Knots
merge_8 = Merge(Data1=control_points.Points, Data2=divide_distance.Points)
trim_tree_3 = TrimTree(Tree=merge_8, Depth=1)
delaunay_mesh = DelaunayMesh(Points=trim_tree_3, Plane=PlaneXY(0, 0, 0))

# ----
# Mesh to split with
merge_9 = Merge(Data1=dispatch.ListA, Data2=clean_tree)
clean_tree_4 = CleanTree(RemoveNulls=True, RemoveInvalid=True, RemoveEmpty=True, Tree=merge_9)
dispatch_2 = Dispatch(List=clean_tree_4, DispatchPattern=[True, False])  # -> ListA, ListB
tree_statistics_2 = TreeStatistics(Tree=dispatch_2.ListA)  # -> Paths, Length, Count
list_item_8 = ListItem(List=tree_statistics_2.Paths, Index=series, Wrap=True)
tree_branch_2 = TreeBranch(Tree=dispatch_2.ListA, Path=list_item_8, MaintainPaths=True)
mesh_edges = MeshEdges(Mesh=tree_branch_2)  # -> NakedEdges, InteriorEdges, NonManifoldEdges
join_curves = JoinCurves(Curves=mesh_edges.NakedEdges, Preserve=False)
clean_tree_5 = CleanTree(RemoveNulls=True, RemoveInvalid=False, RemoveEmpty=True, Tree=join_curves)
length_2 = Length(Curve=clean_tree_5)
sort_list_6 = SortList(Keys=length_2, ValuesValuesA=clean_tree_5)  # -> Keys, reverse(ValuesValuesA)
list_item_9 = ListItem(List=sort_list_6.ValuesValuesA, Index=0, Wrap=True)
patch_2 = Patch(Curves=list_item_9, Spans=20, Flexibility=1, Trim=True)
move = Move(Geometry=patch_2, Motion=[Vector(0, 0, 10), Vector(0, 0, -10)])  # -> Geometry, Transform
loft = Loft(Curves=move.Geometry, Options={Adjust=False, Closed=False, LoftEnds=0, LoftSimp=0, LoftType=0, Rebuild=10, Refit=0.01})
merge_10 = Merge(Data1=move.Geometry, Data2=loft)
mesh_join = MeshJoin(Meshes=merge_10)

# ----
# As-design 2.5D
mesh_join_2 = MeshJoin(Meshes=extrude)

# ----
# Split mesh
mesh_split_2 = MeshSplit(Mesh=delaunay_mesh, Splitters=mesh_join_2)
populate_geometry_2 = PopulateGeometry(Geometry=mesh_split_2, Count=1, Seed=1)
trim_tree_4 = TrimTree(Tree=populate_geometry_2, Depth=1)
point_in_curve = PointInCurve(Point=trim_tree_4, Curve=list_item_7)  # -> Relationship, Point
cull_pattern_6 = CullPattern(List=mesh_split_2, CullPattern=point_in_curve.Relationship)
mesh_join_3 = MeshJoin(Meshes=cull_pattern_6)

# ----
# bbox 2.5D
bounding_box = BoundingBox(Content=mesh_join_2, Plane=PlaneXY(0, 0, 0), UnionBox=True)  # -> Box, flatten(Box_2)

# ----
# Bounding box ifc
bounding_box_2 = BoundingBox(Content=mesh_join, Plane=PlaneXY(0, 0, 0), UnionBox=True)  # -> Box, flatten(Box_2)

# ----
# Plane
merge_11 = Merge(Data1=mesh_join_2, Data2=list_item_9)
clean_tree_6 = CleanTree(RemoveNulls=True, RemoveInvalid=False, RemoveEmpty=True, Tree=merge_11)
minbb_py = PythonScript(input=clean_tree_6)  # -> out, box
# ---------- minbb_py: Python ----------
#Quick and rough Min Bounding Box Calculation 
#Author Ilja Asanovic

import rhinoscriptsyntax as rs
import math


def volume(bb):
    length = rs.Distance(bb[0], bb[1])
    width = rs.Distance(bb[0], bb[3])
    height = rs.Distance(bb[0], bb[4])
    volume = length * width * height
    return volume


obj = input
init_plane = rs.WorldXYPlane()
#init_bb = rs.BoundingBox(obj, init_plane)
#init_vol = volume(init_bb)

#print init_vol

new_vol_x = [] #ROT X /0 to 180 degrees
for i in range(0,180+1):
    new_plane = rs.RotatePlane(init_plane, i, [1,0,0])
    new_bb = rs.BoundingBox(obj, new_plane)
    new_vol_x.append(int(volume(new_bb)))


rot_x = new_vol_x.index(min(new_vol_x))+1 #degrees
plane_x = rs.RotatePlane(init_plane, rot_x, [1,0,0])
#addpoints = rs.AddPoints(rs.BoundingBox(obj, plane_x))

new_vol_y = [] #ROT Y  /0 to 180 degrees
for i in range(0,180+1):
    new_plane = rs.RotatePlane(plane_x, i, [0,1,0])
    new_bb = rs.BoundingBox(obj, new_plane)
    new_vol_y.append(int(volume(new_bb)))

rot_y = new_vol_y.index(min(new_vol_y))+1 #degrees
plane_y = rs.RotatePlane(plane_x, rot_y, [0,1,0])
#addpoints = rs.AddPoints(rs.BoundingBox(obj, plane_y))

new_vol_z = [] #ROT Z  /0 to 180 degrees
for i in range(0,180+1):
    new_plane = rs.RotatePlane(plane_y, i, [0,0,1])
    new_bb = rs.BoundingBox(obj, new_plane)
    new_vol_z.append(int(volume(new_bb)))

rot_z = new_vol_z.index(min(new_vol_z))+1 #degrees
plane_z = rs.RotatePlane(plane_y, rot_z, [0,0,1])
#addpoints = rs.AddPoints(rs.BoundingBox(obj, plane_z))

pts = rs.BoundingBox(obj, plane_z)
#local axes
ref_axis1 = rs.VectorCreate(pts[0], pts[1])
ref_axis2 = rs.VectorCreate(pts[0], pts[3])
ref_axis3 = rs.VectorCreate(pts[0], pts[4])

new_vol_ref_axis1 = []
for i in range(0,180+1):  
    new_plane = rs.RotatePlane(plane_z, i, ref_axis1)
    new_bb = rs.BoundingBox(obj, new_plane)
    new_vol_ref_axis1.append(int(volume(new_bb)))

rot_ref_axis1 = new_vol_ref_axis1.index(min(new_vol_ref_axis1))+1
plane_ref_axis1 = rs.RotatePlane(plane_z, rot_ref_axis1, ref_axis1)
#addpoints = rs.AddPoints(rs.BoundingBox(obj, plane_ref_axis1))

new_vol_ref_axis2 = []
for i in range(0,180+1):
    new_plane = rs.RotatePlane(plane_ref_axis1, i, ref_axis2)
    new_bb = rs.BoundingBox(obj, new_plane)
    new_vol_ref_axis2.append(int(volume(new_bb)))

rot_ref_axis2 = new_vol_ref_axis2.index(min(new_vol_ref_axis2))+1
plane_ref_axis2 = rs.RotatePlane(plane_ref_axis1, rot_ref_axis2, ref_axis2)
#addpoints = rs.AddPoints(rs.BoundingBox(obj, plane_ref_axis2))

new_vol_ref_axis3 = []
for i in range(0,180+1):
    new_plane = rs.RotatePlane(plane_ref_axis2, i, ref_axis3)
    new_bb = rs.BoundingBox(obj, new_plane)
    new_vol_ref_axis3.append(int(volume(new_bb)))

rot_ref_axis3 = new_vol_ref_axis3.index(min(new_vol_ref_axis3))+1
plane_ref_axis3 = rs.RotatePlane(plane_ref_axis2, rot_ref_axis3, ref_axis3)
box = rs.AddBox(rs.AddPoints(rs.BoundingBox(obj, plane_ref_axis3)))
# ---------- end minbb_py ----------
deconstruct_brep = DeconstructBrep(Brep=minbb_py.box)  # -> Faces, Edges, Vertices
surface = Surface(deconstruct_brep.Faces)
area_4 = Area(Geometry=surface)  # -> Area, Centroid
evaluate_surface = EvaluateSurface(Surface=surface, Point=area_4.Centroid)  # -> Point, Normal, UDirection, VDirection, Frame
deconstruct_vector = DeconstructVector(Vector=evaluate_surface.Normal)  # -> XComponent, YComponent, ZComponent
equality_within_tolerance_2 = EqualityWithinTolerance(FirstNumber=deconstruct_vector.ZComponent, SecondNumber=-1, Tolerance=0.1)  # -> Equality, Inequality
cull_pattern_7 = CullPattern(List=surface, CullPattern=equality_within_tolerance_2.Equality)
deconstruct_brep_2 = DeconstructBrep(Brep=cull_pattern_7)  # -> Faces, Edges, Vertices
closest_point = ClosestPoint(Point=Point(0, 0, 0), Cloud=deconstruct_brep_2.Vertices)  # -> ClosestPoint, CPIndex, Distance
cull_index = CullIndex(List=deconstruct_brep_2.Vertices, Indices=closest_point.CPIndex, Wrap=True)
closest_point_2 = ClosestPoint(Point=closest_point.ClosestPoint, Cloud=cull_index)  # -> ClosestPoint, CPIndex, Distance
cull_index_2 = CullIndex(List=cull_index, Indices=closest_point_2.CPIndex, Wrap=True)
size = Number(0.04)
closest_point_3 = ClosestPoint(Point=closest_point.ClosestPoint, Cloud=cull_index_2)  # -> ClosestPoint, CPIndex, Distance
plane_3pt = Plane3Pt(PointA=closest_point.ClosestPoint, PointB=closest_point_3.ClosestPoint, PointC=closest_point_2.ClosestPoint)
distance = Distance(PointA=closest_point.ClosestPoint, PointB=closest_point_2.ClosestPoint)
distance_2 = Distance(PointA=closest_point.ClosestPoint, PointB=closest_point_3.ClosestPoint)
move_2 = Move(Geometry=plane_3pt, Motion=Vector(0, 0, -10))  # -> Geometry, Transform
division = Division(A=distance_2, B=size)
division_2 = Division(A=distance, B=size)

merge_12 = Merge(Data1=bounding_box.Box_2, Data2=bounding_box_2.Box_2)
clean_tree_7 = CleanTree(RemoveNulls=True, RemoveInvalid=True, RemoveEmpty=True, Tree=merge_12)
list_length = ListLength(List=clean_tree_7)

# ----
# bounding box
naam = Text("puntenwolk_bbox")
bbox = GhPythonScript(mesh=mesh_as_built_2, map=map_aanmaken.map, naam=naam, run=list_item, aantal=list_length, bbox=clean_tree_7)  # -> string, export1, X; inputs aantal: Int32, bbox: list of Box
# ---------- bbox: Python ----------
__author__ = "r0713363"
__version__ = "2022.04.12"

" Opletten dat de input zoals xmin ... telkens op List Acces staat"
import rhinoscriptsyntax as rs
import os
import subprocess
from datetime import datetime
import ghpythonlib.components as lib
import Rhino
import random

fileformat=".obj"

today = datetime.now()
bestand='%s\\%s' % (map,naam) + today.strftime('%Y-%m-%d_%H-%M-%S')

#min en max van x,y en z van bbox bepalen.#
test=lib.DeconstructBox(bbox)
if run == True and aantal==1:
    X=test.x
    Y=test.y
    Z=test.z
    xmin=X[0]
    xmax=X[1]
    ymin=Y[0]
    ymax=Y[1]
    zmin=Z[0]
    zmax=Z[1]
    export1='%s_%d%s' % (bestand,0,fileformat)
    string= '%s : %s : %s: %s : %s : %s' % (xmin, ymin, zmin, xmax, ymax, zmax)
    subprocess.Popen(["C:\Program Files\CloudCompare\CloudCompare.exe","-SILENT","-O",mesh,"-AUTO_SAVE","OFF","-M_EXPORT_FMT","OBJ","-CROP",string,"-Save_MESHES","FILE",export1])
elif run==True:
    export1=[]
    for i in range(aantal):
        X=test.x[i]
        Y=test.y[i]
        Z=test.z[i]
        
        xmin=X[0]
        xmax=X[1]
        
        ymin=Y[0]
        ymax=Y[1]
        
        zmin=Z[0]
        zmax=Z[1]
        export='%s_%d%s' % (bestand,i,fileformat)
        string= '%s : %s : %s: %s : %s : %s' % (xmin, ymin, zmin, xmax, ymax, zmax)
        subprocess.Popen(["C:\Program Files\CloudCompare\CloudCompare.exe","-SILENT","-O",mesh,"-AUTO_SAVE","OFF","-M_EXPORT_FMT","OBJ","-CROP",string,"-Save_MESHES","FILE",export])
        export1.append(export)
# ---------- end bbox ----------
import_obj = ImportOBJ(File=bbox.export1, MapYtoZ=False, LastSaveLocalization="neutral,N")

# ----
# Referentie as-built
text = Text("referentie_puntenwolk_bbox")
bbox_2 = GhPythonScript(
    mesh=referentie_mesh_as_built_2,
    map=map_aanmaken.map,
    naam=text,
    run=as_built_vs_as_built,
    aantal=list_length,
    bbox=clean_tree_7)  # -> string, export1, X; inputs aantal: Int32, bbox: list of Box; same code as bbox
import_obj_2 = ImportOBJ(File=bbox_2.export1, MapYtoZ=False, LastSaveLocalization="neutral,N")

# ----
# rioleringsbuizen
reference_by_layer_r6 = ReferenceByLayerR6(LayerName="BIM")
reference_by_layer_r6_2 = ReferenceByLayerR6(LayerName=["BT5_Rioolpijp_Aansluiting_WRP2", "BT5_Rioolpijp_Hoofdriolering_WRP1"])
move_3 = Move(Geometry=reference_by_layer_r6_2, Motion=Vector(0, 0, 0.3))  # -> Geometry, Transform
mesh_split_3 = MeshSplit(Mesh=reference_by_layer_r6, Splitters=dispatch_2.ListA)
mesh_join_4 = MeshJoin(Meshes=mesh_split_3)
volume_2 = Volume(Geometry=reference_by_layer_r6_2)  # -> Volume, Centroid
bounding_box_3 = BoundingBox(Content=dispatch_2.ListA, Plane=PlaneXY(0, 0, 0), UnionBox=True)  # -> Box, Box_2
mesh_split_4 = MeshSplit(Mesh=move_3.Geometry, Splitters=bounding_box_3.Box_2)
mesh_split_5 = MeshSplit(Mesh=reference_by_layer_r6_2, Splitters=bounding_box_3.Box_2)  # -> flatten(Result)
trim_tree_5 = TrimTree(Tree=mesh_split_4, Depth=1)
populate_geometry_3 = PopulateGeometry(Geometry=trim_tree_5, Count=1, Seed=1)
list_item_10 = ListItem(List=mesh_split_5, Index=5, Wrap=True)
trim_tree_6 = TrimTree(Tree=populate_geometry_3, Depth=1)
mesh_inclusion = MeshInclusion(Mesh=bounding_box_3.Box_2, Point=trim_tree_6, Strict=False)
cull_pattern_8 = CullPattern(List=move_3.Geometry, CullPattern=mesh_inclusion)
mesh_join_5 = MeshJoin(Meshes=cull_pattern_8)
mesh_split_6 = MeshSplit(Mesh=mesh_join_5, Splitters=mesh_join)
populate_geometry_4 = PopulateGeometry(Geometry=mesh_split_6, Count=1, Seed=1)
trim_tree_7 = TrimTree(Tree=populate_geometry_4, Depth=1)
trim_tree_8 = TrimTree(Tree=list_item_9, Depth=2)
point_in_curve_2 = PointInCurve(Point=trim_tree_7, Curve=trim_tree_8)  # -> Relationship, Point
trim_tree_9 = TrimTree(Tree=point_in_curve_2.Relationship, Depth=1)
cull_pattern_9 = CullPattern(List=mesh_split_6, CullPattern=trim_tree_9)
clean_tree_8 = CleanTree(RemoveNulls=True, RemoveInvalid=False, RemoveEmpty=True, Tree=cull_pattern_9)
null_item = NullItem(Item=cull_pattern_9)  # -> NullFlags, InvalidFlags, Description
close_mesh = CloseMesh(Mesh=clean_tree_8, Quadrangulate=True)  # -> Closed, Amount, Openings, ResultBoolean
equality_2 = Equality(FirstNumber=null_item.NullFlags, SecondNumber=1)  # -> Equality, Inequality
volume_3 = Volume(Geometry=close_mesh.Closed)  # -> Volume, Centroid
cull_pattern_10 = CullPattern(List=cull_pattern_9, CullPattern=equality_2.Equality)
merge_13 = Merge(Data1=volume_3.Volume, Data2=cull_pattern_10)
mass_addition = MassAddition(Input=merge_13)  # -> Result, PartialResults
panel = Panel(mass_addition.Result)

# ----
# bake geometry
pcd = Relay()  # disabled
list_length_2 = ListLength(List=flatten(pcd))  # disabled
define_layer = DefineLayer(Name="pointcloud")
series_2 = Series(Start=0, Step=1, Count=list_length_2)  # -> simplify(graft(Series))
define_object_attributes = DefineObjectAttributes(Name=series_2, Layer=define_layer)
bake_objects = BakeObjects(Geometry=simplify(graft(pcd)), Attributes=define_object_attributes, Bake=False)  # disabled

merge_14 = Merge()
clean_tree_9 = CleanTree(RemoveNulls=True, RemoveInvalid=False, RemoveEmpty=True, Tree=merge_14)
merge_15 = Merge(Data1=clean_tree_9)

# ----
# Controle data
layer_table = LayerTable(Update=True, AutoUpdate=False)  # -> Layers, FullLayerPaths, LayerColors, Linetypes, MaterialNames, Visible, PrintWidth, PrintColor
import_obj_3 = ImportOBJ(File=abort, MapYtoZ=False, LastSaveLocalization="neutral,N")
import_obj_4 = ImportOBJ(File=abort_2, MapYtoZ=False, LastSaveLocalization="neutral,N")
reference_by_layer_r6_3 = ReferenceByLayerR6(LayerName=layer_table.Layers)
text_2 = Text("Curve")
text_3 = Text(["Mesh", "Brep"])
filter_by_type_r6 = FilterByTypeR6(Geometry=reference_by_layer_r6_3, ObjectType=text_2)
filter_by_type_r6_2 = FilterByTypeR6(Geometry=reference_by_layer_r6_3, ObjectType=text_3)
mesh_edges_2 = MeshEdges(Mesh=filter_by_type_r6_2)  # -> NakedEdges, InteriorEdges, NonManifoldEdges
merge_16 = Merge(Data1=mesh_edges_2.NakedEdges, Data2=filter_by_type_r6)
control_points_2 = ControlPoints(Curve=merge_16)  # -> flatten(Points), Weights, Knots
convex_hull = ConvexHull(Points=control_points_2.Points, Plane=PlaneXY(0, 0, 0))  # -> Hull, HullZ, Indices
extrude_2 = Extrude(Base=convex_hull.HullZ, Direction=[Vector(0, 0, 10), Vector(0, 0, -10)])

# ----
# Split mesh
mesh_split_7 = MeshSplit(Mesh=import_obj_4, Splitters=extrude_2)
populate_geometry_5 = PopulateGeometry(Geometry=mesh_split_7, Count=1, Seed=1)
trim_tree_10 = TrimTree(Tree=populate_geometry_5, Depth=1)
point_in_curve_3 = PointInCurve(Point=trim_tree_10, Curve=convex_hull.Hull)  # -> Relationship, Point
cull_pattern_11 = CullPattern(List=mesh_split_7, CullPattern=invert(point_in_curve_3.Relationship))
mesh_join_6 = MeshJoin(Meshes=cull_pattern_11)

# ----
# Split mesh
mesh_split_8 = MeshSplit(Mesh=import_obj_3, Splitters=extrude_2)
populate_geometry_6 = PopulateGeometry(Geometry=mesh_split_8, Count=1, Seed=1)
trim_tree_11 = TrimTree(Tree=populate_geometry_6, Depth=1)
point_in_curve_4 = PointInCurve(Point=trim_tree_11, Curve=convex_hull.Hull)  # -> Relationship, Point
cull_pattern_12 = CullPattern(List=mesh_split_8, CullPattern=invert(point_in_curve_4.Relationship))
mesh_join_7 = MeshJoin(Meshes=cull_pattern_12)

populate_geometry_7 = PopulateGeometry(Geometry=mesh_join_7, Count=10000, Seed=1)
mesh_ray = MeshRay(Mesh=mesh_join_6, Point=populate_geometry_7, Direction=Vector(0, 0, 10))  # -> Point, Hit
mesh_ray_2 = MeshRay(Mesh=mesh_join_6, Point=populate_geometry_7, Direction=Vector(0, 0, -10))  # -> Point, Hit
cull_pattern_13 = CullPattern(List=mesh_ray.Point, CullPattern=mesh_ray.Hit)
cull_pattern_14 = CullPattern(List=populate_geometry_7, CullPattern=mesh_ray_2.Hit)
cull_pattern_15 = CullPattern(List=populate_geometry_7, CullPattern=mesh_ray.Hit)
cull_pattern_16 = CullPattern(List=mesh_ray_2.Point, CullPattern=mesh_ray_2.Hit)
distance_3 = Distance(PointA=cull_pattern_14, PointB=cull_pattern_16)
distance_4 = Distance(PointA=cull_pattern_15, PointB=cull_pattern_13)
negative = Negative(Value=distance_3)
merge_17 = Merge(Data1=distance_4, Data2=negative)
round_to_decimal_place = RoundToDecimalPlace(NumberX=merge_17, DecimalPlace=3, RoundType=0)  # -> Rounded, Difference
create_set = CreateSet(List=round_to_decimal_place.Rounded)  # -> Set, Map
member_index = MemberIndex(Set=round_to_decimal_place.Rounded, Member=create_set.Set)  # -> simplify(Index), Count
sort_list_7 = SortList(Keys=member_index.Count)  # -> reverse(Keys), ValuesValuesA
list_item_11 = ListItem(List=sort_list_7.Keys, Index=0, Wrap=True)
find_similar_member = FindSimilarMember(Data=list_item_11, Set=member_index.Count)  # -> Hit, Index
tree_branch_3 = TreeBranch(Tree=member_index.Index, Path=find_similar_member.Index, MaintainPaths=True)
list_item_12 = ListItem(List=round_to_decimal_place.Rounded, Index=tree_branch_3, Wrap=True)
list_item_13 = ListItem(List=list_item_12, Index=0, Wrap=True)
panel_2 = Panel(list_item_13)

# ----
# As-built
merge_18 = Merge(Data1=extrude, Data2=mesh_join)
clean_tree_10 = CleanTree(RemoveNulls=True, RemoveInvalid=False, RemoveEmpty=True, Tree=merge_18)
abort_3 = Abort(Condition=invert(as_built_vs_as_built), Passthrough=import_obj_3, LastSaveLocalization="neutral,N")
merge_19 = Merge(Data1=list_item_7, Data2=list_item_9)
clean_tree_11 = CleanTree(RemoveNulls=True, RemoveInvalid=False, RemoveEmpty=True, Tree=merge_19)

panel_3 = Panel(merge_18)

# ----
# Split mesh
mesh_split_9 = MeshSplit(Mesh=import_obj_2, Splitters=clean_tree_10)
populate_geometry_8 = PopulateGeometry(Geometry=mesh_split_9, Count=1, Seed=1)
trim_tree_12 = TrimTree(Tree=populate_geometry_8, Depth=1)
point_in_curve_5 = PointInCurve(Point=trim_tree_12, Curve=clean_tree_11)  # -> Relationship, Point
cull_pattern_17 = CullPattern(List=mesh_split_9, CullPattern=point_in_curve_5.Relationship)
mesh_join_8 = MeshJoin(Meshes=cull_pattern_17)
trim_tree_13 = TrimTree(Tree=mesh_join_8, Depth=3)

# ----
# Split mesh
mesh_split_10 = MeshSplit(Mesh=import_obj, Splitters=clean_tree_10)
populate_geometry_9 = PopulateGeometry(Geometry=mesh_split_10, Count=1, Seed=1)
trim_tree_14 = TrimTree(Tree=populate_geometry_9, Depth=1)
point_in_curve_6 = PointInCurve(Point=trim_tree_14, Curve=clean_tree_11)  # -> Relationship, Point
cull_pattern_18 = CullPattern(List=mesh_split_10, CullPattern=point_in_curve_6.Relationship)
mesh_join_9 = MeshJoin(Meshes=cull_pattern_18)

# ----
# Volumeberekening
merge_20 = Merge(Data1=mesh_join_3, Data2=tree_branch_2)
square = Square(Plane=move_2.Geometry, Size=size, ExtentX=division, ExtentY=division_2)  # -> Cells, Points
clean_tree_12 = CleanTree(RemoveNulls=True, RemoveInvalid=False, RemoveEmpty=True, Tree=merge_20)
trim_tree_15 = TrimTree(Tree=square.Points, Depth=1)
abort_4 = Abort(Condition=invert(as_design_vs_as_built), Passthrough=clean_tree_12, LastSaveLocalization="neutral,N")
simplify_tree = SimplifyTree(Tree=trim_tree_15, Front=False)
simplify_tree_2 = SimplifyTree(Tree=mesh_join_9, Front=False)
mesh_ray_3 = MeshRay(Mesh=simplify_tree_2, Point=simplify_tree, Direction=Vector(0, 0, 100))  # -> Point, Hit
merge_21 = Merge(Data1=abort_4, Data2=mesh_join_8)
trim_tree_16 = TrimTree(Tree=square.Cells, Depth=1)
clean_tree_13 = CleanTree(RemoveNulls=True, RemoveInvalid=False, RemoveEmpty=True, Tree=merge_21)
cull_pattern_19 = CullPattern(List=trim_tree_16, CullPattern=mesh_ray_3.Hit)
cull_pattern_20 = CullPattern(List=mesh_ray_3.Point, CullPattern=mesh_ray_3.Hit)
opp_cell = Multiplication(A=size, B=size)

# ----
# Fill
mesh_ray_4 = MeshRay(Mesh=clean_tree_13, Point=cull_pattern_20, Direction=Vector(0, 0, 1))  # -> Point, Hit
distance_5 = Distance(PointA=mesh_ray_4.Point, PointB=cull_pattern_20)
cull_pattern_21 = CullPattern(List=cull_pattern_19, CullPattern=mesh_ray_4.Hit)
clean_tree_14 = CleanTree(RemoveNulls=True, RemoveInvalid=True, RemoveEmpty=True, Tree=distance_5)
list_length_3 = ListLength(List=cull_pattern_21)
average = Average(Input=clean_tree_14)
multiplication = Multiplication(A=list_length_3, B=opp_cell)
multiplication_2 = Multiplication(A=multiplication, B=average)
volume_4 = Panel(multiplication_2)

# ----
# Cut
mesh_ray_5 = MeshRay(Mesh=clean_tree_13, Point=cull_pattern_20, Direction=Vector(0, 0, -1))  # -> Point, Hit
distance_6 = Distance(PointA=mesh_ray_5.Point, PointB=cull_pattern_20)
cull_pattern_22 = CullPattern(List=cull_pattern_19, CullPattern=mesh_ray_5.Hit)
negative_2 = Negative(Value=distance_6)
clean_tree_15 = CleanTree(RemoveNulls=True, RemoveInvalid=True, RemoveEmpty=True, Tree=distance_6)
list_length_4 = ListLength(List=cull_pattern_22)
average_2 = Average(Input=clean_tree_15)
multiplication_3 = Multiplication(A=list_length_4, B=opp_cell)
multiplication_4 = Multiplication(A=multiplication_3, B=average_2)
volume_5 = Panel(multiplication_4)

subtraction = Subtraction(A=multiplication_2, B=multiplication_4)
volume_6 = Panel(subtraction)
merge_22 = Merge(Data1=subtraction, Data2=multiplication_2, Data3=multiplication_4)
resultaat = Panel(merge_22)

clean_tree_16 = CleanTree(RemoveNulls=True, RemoveInvalid=True, RemoveEmpty=False, Tree=mesh_ray_4.Point)
clean_tree_17 = CleanTree(RemoveNulls=True, RemoveInvalid=True, RemoveEmpty=False, Tree=mesh_ray_5.Point)
merge_23 = Merge(Data1=distance_5, Data2=negative_2)
merge_24 = Merge(Data1=clean_tree_16, Data2=clean_tree_17)
clean_tree_18 = CleanTree(RemoveNulls=True, RemoveInvalid=True, RemoveEmpty=True, Tree=merge_23)
construct_cloud = ConstructCloud(Points=merge_24)
text_4 = Text("D")
add_data = AddData(Cloud=construct_cloud, Key=text_4, Data=clean_tree_18)
bounds = Bounds(Cloud=add_data, Key=text_4)
deconstruct_domain = DeconstructDomain(Domain=bounds)  # -> Start, End
merge_25 = Merge(Data1=deconstruct_domain.Start, Data2=deconstruct_domain.End)
sort_list_8 = SortList(Keys=merge_25, ValuesValuesA=merge_25)  # -> Keys, reverse(ValuesValuesA)
list_item_14 = ListItem(List=sort_list_8.ValuesValuesA, Index=0, Wrap=True)
negative_3 = Negative(Value=list_item_14)
range = Range(Domain=Domain(-1, 1), Steps=10)
div = DivideDomain(Domain=bounds, Count=10)
gradient = Gradient(LowerLimit=negative_3, UpperLimit=list_item_14, Parameter=range, stops=[0: RGB(255, 0, 0), 1: RGB(0, 181, 66)])
dedomain = DeconstructDomain(Domain=div)  # -> Start, End
item = ListItem(List=dedomain.End, Index=-1, Wrap=True)
merge_26 = Merge(Data1=dedomain.Start, Data2=item)
prevdata = PreviewData(Cloud=add_data, Key=text_4, Values=merge_26, Colors=gradient)

# ----
# Exporteren voor civil3d
boolean_toggle = BooleanToggle(True)
list_length_5 = ListLength(List=flatten(clean_tree_13))
list_length_6 = ListLength(List=flatten(mesh_join_9))
text_5 = Text("mesh_referentie_pt")
file_path_3 = FilePath("C:\Users\r0713363\Documents\thesis_jonas\as_design\mesh_point\")
text_6 = Text("mesh_bestaand_pt")
file_path_4 = FilePath("C:\Users\r0713363\Documents\thesis_jonas\as_design\mesh_point\")
save_mesh = GhPythonScript(run=boolean_toggle, map=file_path_3, naam=text_5, aantal=list_length_5, mesh=flatten(clean_tree_13))  # -> out, meshes, export; inputs mesh: list of Mesh
# ---------- save_mesh: Python ----------
__author__ = "r0713363"
__version__ = "2022.05.03"

import Rhino
import System
import ghpythonlib.component as ghcomp
import Rhino
import Rhino.Commands
import Rhino.Geometry
import Rhino.DocObjects
import os
from datetime import datetime


def test_write_obj(filename,mesh):

    split=Rhino.Geometry.Mesh.Append(mesh,mesh)
    arr = System.Array[Rhino.Geometry.Mesh]([mesh])

    path = System.Environment.GetFolderPath(System.Environment.SpecialFolder.Desktop)

    fwo = Rhino.FileIO.FileWriteOptions()
    options = Rhino.FileIO.FileObjWriteOptions(fwo)
    
    rc = Rhino.FileIO.FileObj.Write(filename, arr, options)


filename='%s\\%s_' % (map,naam)
meshes=[]
export=[]
fileformat=".obj"

if run==True:
    for i in range(aantal):
        filename1='%s%d%s' % (filename,i,fileformat)
        mesh1=mesh[i]
        meshes.append(mesh1)
        export.append(filename1)
        test_write_obj(filename1, mesh1)
else:
    export="Niet uitgevoerd"
# ---------- end save_mesh ----------
save_mesh_2 = GhPythonScript(run=Toggle(True), map=file_path_4, naam=text_6, aantal=list_length_6, mesh=flatten(mesh_join_9))  # -> out, meshes, export; inputs mesh: list of Mesh; same code as save_mesh
panel_4 = Panel(save_mesh.export)

# ----
# Bison
cutfill = CutFill(Boundary=clean_tree_11, Proposed=clean_tree_13, Existing=mesh_join_9, Grid=1)  # -> Mesh, Total, Cut, Fill, Units
panel_5 = Panel(cutfill.Total)

# ----
# Experimenten
mesh_2 = Mesh(cutfill.Mesh)

relay = Relay()
merge_27 = Merge(Data1=mesh_join_3, Data2=trim_tree_13, Data3=tree_branch_2)

list_length_7 = ListLength(List=merge_27)

ghpython_script = GhPythonScript(as_design=as_design_vs_as_built, aantal=list_length_7)  # -> out, index1, index2
# ---------- ghpython_script: Python ----------
__author__ = "r0713363"
__version__ = "2022.05.08"

import rhinoscriptsyntax as rs
if as_design==True:
    index1=0
    index2=aantal-1
else:
    index1=aantal
    index2=aantal+aantal-1
# ---------- end ghpython_script ----------
series_3 = Series(Start=ghpython_script.index1, Step=1, Count=list_length_7)
list_item_15 = ListItem(List=merge_27, Index=series_3, Wrap=True)
clean_tree_19 = CleanTree(RemoveNulls=True, RemoveInvalid=False, RemoveEmpty=True, Tree=list_item_15)

# ----
# Afwijkingsanalyse
deconstruct_mesh = DeconstructMesh(Mesh=clean_tree_19)  # -> Vertices, Faces, Colours, Normals
mesh_closest_point = MeshClosestPoint(Point=deconstruct_mesh.Vertices, Mesh=mesh_join_9)  # -> Point, Index, Parameter
vector_2pt = Vector2Pt(PointA=deconstruct_mesh.Vertices, PointB=mesh_closest_point.Point, Unitize=False)  # -> Vector, Length
deconstruct_vector_2 = DeconstructVector(Vector=vector_2pt.Vector)  # -> XComponent, YComponent, ZComponent
average_3 = Average(Input=deconstruct_vector_2.XComponent)
average_4 = Average(Input=deconstruct_vector_2.YComponent)
panel_6 = Panel(average_4)
panel_7 = Panel(average_3)

# ----
# Helling
deconstruct_mesh_2 = DeconstructMesh(Mesh=mesh_join_9)  # -> Vertices, Faces, Colours, Normals
average_5 = Average(Input=deconstruct_mesh.Normals)
average_6 = Average(Input=deconstruct_mesh_2.Normals)
angle = Angle(VectorA=average_5, VectorB=average_6)  # -> Angle, Reflex
degrees = Degrees(Radians=angle.Angle)
panel_8 = Panel(angle.Angle)
panel_9 = Panel(degrees)

# ----
# Methode met CC
guid = Guid()
file_path_5 = FilePath("C:\\Users\\r0713363\\Documents\\thesis_jonas\\temp_files\\volvox.e57")
guid_2 = Guid(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)
ghpython_script_2 = GhPythonScript(x=guid_2, y=file_path_5)  # -> out, a; inputs x: Guid; disabled
# ---------- ghpython_script_2: Python ----------
__author__ = "r0713363"
__version__ = "2022.05.27"

import rhinoscriptsyntax as rs
import Rhino
import scriptcontext
import ghpythonlib.components as ghcomp
import Rhino.Geometry


a=ghcomp.Volvox.SaveE57(y,x,False,True,False)
# ---------- end ghpython_script_2 ----------
merge_28 = Merge()
trim_tree_17 = TrimTree(Tree=merge_15, Depth=2)
ghpython_script_3 = GhPythonScript(file_path=trim_tree_17)  # -> out, a
# ---------- ghpython_script_3: Python ----------
__author__ = "r0713363"
__version__ = "2022.05.24"

import rhinoscriptsyntax as rs
import os
import time

time_to_wait = 20
time_counter = 0
while not os.path.exists(file_path):
    time.sleep(1)
    time_counter += 1
    a="bestaat_niet"
    if time_counter > time_to_wait:break
if os.path.isfile(file_path):
    a=file_path
# ---------- end ghpython_script_3 ----------
clean_tree_20 = CleanTree(RemoveNulls=True, RemoveInvalid=False, RemoveEmpty=True, Tree=merge_28)
list_item_16 = ListItem(List=clean_tree_20, Index=0, Wrap=True)
text_7 = Text("10000")

# ----
# Run command
file_path_6 = FilePath(trim_tree_17)
ghpython_script_4 = GhPythonScript(filepath=ghpython_script_3.a)  # -> out, a
# ---------- ghpython_script_4: Python ----------
__author__ = "r0713363"
__version__ = "2022.05.06"

import rhinoscriptsyntax as rs
import os

if os.path.isfile(filepath):
    a=True
else:
    a=False
# ---------- end ghpython_script_4 ----------
sort_list_9 = SortList(Keys=ghpython_script_4.a, ValuesValuesA=ghpython_script_4.a)  # -> Keys, ValuesValuesA
list_item_17 = ListItem(List=sort_list_9.ValuesValuesA, Index=0, Wrap=True)

# ----
# Volumeberekening
file_path_7 = FilePath("C:\\Users\\r0713363\\Documents\\thesis_jonas\\volumeberekening_puntenwolk1")
file_path_8 = FilePath("C:\\Users\\r0713363\\Documents\\thesis_jonas\\volumeberekening_puntenwolk2_")
file_path_9 = FilePath("C:\\Users\\r0713363\\Documents\\thesis_jonas\\volumeberekening_resultaat_")
grid_step = Text("0.1")
volume_7 = GhPythonScript(
    run=list_item_17,
    aantal=1,
    rapportlocatie=clean_tree_20,
    grid_step=grid_step,
    exportlocatie1=list_item_16,
    exportlocatie2=list_item_16,
    exportlocatie3=file_path_9)  # -> out, volumerapport, model; inputs rapportlocatie: list, cloud1: list, cloud2: list
# ---------- volume_7: Python ----------
__author__ = "Jonas"
__version__ = "2022.02.11"



import rhinoscriptsyntax as rs
import os
import subprocess

fileformat=".e57"

volumerapport=[]
model=[]

if run == True:
    for i in range(aantal):
        Cloud1=cloud1[i]
        Cloud2=cloud2[i]
        rapportlocatie1=rapportlocatie[i]
        Export1= '%s%d%s' % (exportlocatie1,i,fileformat)
        Export2= '%s%d%s' % (exportlocatie2,i,fileformat)
        Export3= '%s%d%s' % (exportlocatie3,i,fileformat)
        rapportmap= '%s\VolumeCalculationReport.txt' %(rapportlocatie1)
        subprocess.Popen(["C:\Program Files\CloudCompare\CloudCompare.exe","-O","-GLOBAL_SHIFT","AUTO",Cloud1,"-O","-GLOBAL_SHIFT","FIRST",Cloud2,"-AUTO_SAVE","OFF","-C_EXPORT_FMT","E57","-NO_TIMESTAMP","-VOLUME","-GRID_STEP",grid_step,"-SAVE_CLOUDS","FILE",Export1,"FILE",Export2,"FILE",Export3])
        volumerapport.append(rapportmap)
        model.append(Export3)
# ---------- end volume_7 ----------
list_length_8 = ListLength(List=volume_7.model)
read_file = ReadFile(File=volume_7.volumerapport, PerLineParse=True)
ghpython_script_5 = GhPythonScript(file=volume_7.model, aantal=list_length_8)  # -> out, run; inputs file: list
# ---------- ghpython_script_5: Python ----------
__author__ = "r0713363"
__version__ = "2022.04.24"

import rhinoscriptsyntax as rs
import os

start=[]
for i in range(aantal):
    if os.path.isfile(file[i]):
        start1=True
        start.append(start1)
    else:
        start2=False
        start.append(start2)
gesorteerd=sorted(start)
run=gesorteerd[0]
# ---------- end ghpython_script_5 ----------
text_8 = Text(ghpython_script_5.run)
list_item_18 = ListItem(List=read_file, Index=[0, 3, 4, 6], Wrap=True)
import_to_document = ImportToDocument(File=volume_7.model, OK=text_8, LastSaveLocalization="neutral,N")  # -> Guid, Layer, ObjectAttributes
list_item_19 = ListItem(List=read_file, Index=1, Wrap=True)
cloud = Cloud(import_to_document.Guid)
panel_10 = Panel(list_item_18)
panel_11 = Panel(list_item_19)

panel_12 = Panel(text_8)

# ==== cluster RoiToevoegen
geometry = ClusterInput()
area = Area(Geometry=geometry)  # -> Area, Centroid
sort_list = SortList(Keys=area.Area, ValuesValuesA=area.Centroid)  # -> reverse(Keys), reverse(ValuesValuesA)
list_item = ListItem(List=sort_list.ValuesValuesA, Index=0, Wrap=True)
deconstruct = Deconstruct(Point=list_item)  # -> XComponent, YComponent, ZComponent
unit_z = UnitZ(Factor=deconstruct.ZComponent)
geometry_2 = ClusterInput()
move = Move(Geometry=geometry_2, Motion=unit_z)  # -> Geometry, Transform
geometry_3 = ClusterOutput(move.Geometry)
