# Grasshopper definition BakingAndExportingToFileTEMP.gh (Grasshopper 0.9.76)
# plug-ins: Python Interpreter

directorypath_with_backslashes_no_spaces = Panel("C:\FileName")  # "DirectoryPath with Backslashes NO SPACES and FileName Minus Extension"
brep = Brep([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])
python_nik_s_obj_file_saver = PythonScript(FileNameToSave=directorypath_with_backslashes_no_spaces, Brep=brep)  # -> out; inputs Brep: list of Brep
# ---------- python_nik_s_obj_file_saver: Python ----------
import rhinoscriptsyntax
import Rhino

FILE_NAME = FileNameToSave

for q in range (0,len(Brep)):
  Rhino.RhinoDoc.ActiveDoc.Objects.AddBrep(Brep[q], Rhino.DocObjects.ObjectAttributes())

rhinoscriptsyntax.Command("SelAll")
rhinoscriptsyntax.Command("-Export " + FILE_NAME + ".obj y=n Enter Enter") #y=n turns off silly Y/Z axis swap! Use no spaces in the file path.
rhinoscriptsyntax.Command("Delete Enter")
# ---------- end python_nik_s_obj_file_saver ----------
