# Grasshopper definition ExportPointsWithNames.gh (Grasshopper 1.0.7)
# plug-ins: EleFront

# Export points
geometry = Geometry([<point referenced from the Rhino model> x525, <curve referenced from the Rhino model> x3, <point referenced from the Rhino model> x140, <curve referenced from the Rhino model>, <point referenced from the Rhino model> x133, <curve referenced from the Rhino model> x2, <point referenced from the Rhino model> x151, <curve referenced from the Rhino model>])
point = Point(geometry)
deconstruct = Deconstruct(Point=point)  # -> XComponent, YComponent, ZComponent
get_rhino_attributes = GetRhinoAttributes(Geometry=point)  # -> Name, Layer, Color
concatenate = Concatenate(
    Fragment_A=get_rhino_attributes.Name,
    Fragment_B=deconstruct.XComponent,
    A=deconstruct.YComponent,
    B=deconstruct.ZComponent,
    JoinSeparator=",")
panel = Panel(concatenate)
