# Grasshopper definition bakeAndExport_v0.1.gh (Grasshopper 1.0.7)

panel = Panel("""first bake
then export""")
mesh = Mesh(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)
py_exportobj = GhPythonScript(path_out="C:\Test\", file_out="TestExport1.obj", run=Toggle(False))  # -> out, a; inputs run: Boolean
# ---------- py_exportobj: Python ----------
import Rhino
import os

if(run):
    ExportAsObj(path_out, file_out)

#----------------functions----------------
def ExportAsObj(filePath, fileName):
    #filepath = "C:\Test\TestExport.obj"
    if not os.path.isdir(filePath):
        os.mkdir(filePath)
    fileFullPath = filePath + fileName
    
    write_options = Rhino.FileIO.FileWriteOptions()
    write_options.WriteSelectedObjectsOnly = False
    
    obj_options = Rhino.FileIO.FileObjWriteOptions(write_options)
    #obj_options.UseSimpleDialog = True
    obj_options.CreateNgons = False
    obj_options.MapZtoY = False
    obj_options.ExportNormals = True
    obj_options.ExportTcs = True
    obj_options.ExportVcs = True

    #obj_options.ObjGroupNames = 1


    rc = Rhino.FileIO.FileObj.Write(fileFullPath, Rhino.RhinoDoc.ActiveDoc, obj_options)
    if rc == Rhino.PlugIns.WriteFileResult.Success:
        print "Success, file saved:", fileFullPath
    else:
        print "Error saving file:", fileFullPath
# ---------- end py_exportobj ----------
py_bake = PythonScript(geo=mesh, active=Toggle(False))  # -> out, a
# ---------- py_bake: Python ----------
import rhinoscriptsyntax as rs
import scriptcontext
import Rhino

if active:
    
    #we create or use some geometry
    geo_id = geo # or rs.AddLine((0,1,2), (9,8,7))
    #(we could do all operations here...
    
    scriptcontext.doc = ghdoc
    #we obtain the reference in the Rhino doc
    doc_object = rs.coercerhinoobject(geo_id)
    print(type(doc_object))
    
    attributes = doc_object.Attributes
    print('the type of attributes is: ' + str(type(attributes)))
    geometry = doc_object.Geometry
    print('the type of geometry is: ' + str(type(geometry)))
    
    #we change the scriptcontext
    scriptcontext.doc = Rhino.RhinoDoc.ActiveDoc
    
    #we add both the geometry and the attributes to the Rhino doc
    rhino_geo = scriptcontext.doc.Objects.Add(geometry, attributes)
    print('the Rhino doc ID is: ' + str(rhino_geo))
    
    #we put back the original Grasshopper document as default
    scriptcontext.doc = ghdoc
# ---------- end py_bake ----------
panel_2 = Panel(py_bake.out)
panel_3 = Panel(py_exportobj.out)
