# Grasshopper definition bakeAndExport_v0.2.gh (Grasshopper 1.0.7)
# plug-ins: LocalCode

activate = BooleanToggle(False)

# ----
# JD: input
activate_2 = Boolean(activate)
file_path = FilePath("D:\Data\2019-07 Klosterstift\Obj\Initial_1.obj")

# ----
# JD: output (file path
# + name)
file_path_2 = FilePath("D:\Data\2019-07 Klosterstift\Obj\")
guid = Guid()

# ----
# Import data
text = Text("Default")
geometry_pipeline = GeometryPipeline(
    GroupByLayer=False,
    GroupByType=False,
    IncludeHidden=True,
    IncludeLocked=True,
    LayerFilter="Default",
    NameFilter="*",
    SublayerFiltering=True,
    TypeFilter=32)
local_code_import = LocalCodeImport(FilePathsForImport=file_path, LayersToImport=text, OnOffSwitch=activate_2, DeleteExistingGeometry=invert(False))
mesh = Mesh(geometry_pipeline)

# ----
# mesh input
# mesh output
# Process
mesh_2 = Mesh(geometry_pipeline)
mesh_3 = Mesh(mesh_2)

# ----
# export data
text_2 = Text(".obj")
merge = Merge(Data1=file_path_2, Data2=guid, Data3=text_2)
text_join = TextJoin(Text=merge)
local_code_export = LocalCodeExport(DestinationFilePath=text_join, Export=activate_2, LayerNames=text, GeometryTree=mesh_3)
