# Grasshopper definition issue_button.gh (Grasshopper 1.0.7)

box = CenterBox(Base=PlaneXY(0, 0, 0), X=1, Y=1, Z=1)
python = GhPythonScript(y=Button(), x=box)  # -> out, a; inputs y: Boolean, x: Brep
# ---------- python: Python ----------
import rhinoscriptsyntax as rs
import scriptcontext as sc
import Rhino
sc.doc = Rhino.RhinoDoc.ActiveDoc

obj = sc.doc.Objects.Add(x)
if (rs.SelectObject(obj)):
    rs.Command("_-hydrostatics _Enter _HistoryWindow")
    history = rs.CommandHistory()
    last_index = history.rfind("Hydrostatics")
    a = history[last_index:]
    sc.doc.Objects.Delete(rs.coercerhinoobject(obj))
# ---------- end python ----------
panel = Panel(python.a)
