# Grasshopper definition clean_mesh.gh (Grasshopper 1.0.7)

geometry = Geometry([<mesh referenced from the Rhino model> x237])
sort_list = SortList(Keys=geometry, ValuesA=geometry)  # -> Keys, ValuesA
area = Area(Geometry=sort_list.ValuesA)  # -> Area, Centroid
average = Average(Input=area.Centroid)
larger_than = LargerThan(FirstNumber=area.Area, SecondNumber=Slider(10, range=0..10))  # -> LargerThan, OrEqualTo
dispatch = Dispatch(List=sort_list.ValuesA, DispatchPattern=larger_than.LargerThan)  # -> ListA, ListB
dispatch_2 = Dispatch(List=area.Centroid, DispatchPattern=larger_than.LargerThan)  # -> ListA, ListB
vector_2pt = Vector2Pt(PointA=average, PointB=dispatch_2.ListA, Unitize=True)  # -> Vector, Length
move = Move(Geometry=dispatch.ListA, Motion=expr("10*x", vector_2pt.Vector))  # -> Geometry, Transform
area_2 = Area(Geometry=move.Geometry)  # -> Area, Centroid
series = Series(Start=0, Step=1, Count=30)
list_item = ListItem(List=reverse(area_2.Centroid), Index=series, Wrap=True)
sphere = Sphere(Base=list_item, Radius=1)
