# Grasshopper definition figure_rdf1.gh (Grasshopper 1.0.7)

mesh = Mesh([<mesh referenced from the Rhino model> x114])
area = Area(Geometry=mesh)  # -> Area, Centroid
larger_than = LargerThan(FirstNumber=area.Area, SecondNumber=Slider(10, range=0..10))  # -> LargerThan, OrEqualTo
dispatch = Dispatch(List=mesh, DispatchPattern=larger_than.LargerThan)  # -> ListA, ListB
dispatch_2 = Dispatch(List=area.Centroid, DispatchPattern=larger_than.LargerThan)  # -> ListA, ListB
cross_reference = CrossReference(ListA=dispatch_2.ListA, ListB=dispatch_2.ListA, CrossMode=7)  # -> ListA, ListB
line = Line(StartPoint=cross_reference.ListA, EndPoint=cross_reference.ListB)
list_length = ListLength(List=line)
multiplication = Multiplication(A=list_length, B=Slider(0.9, range=0..1))
random_reduce = RandomReduce(List=line, Reduction=multiplication, Seed=1)
