# Grasshopper definition publish_json1.gh (Grasshopper 1.0.7)
# plug-ins: EleFront, LunchBox

input_meshes = Mesh([<mesh referenced from the Rhino model> x74])
bounding_box = BoundingBox(Content=input_meshes, Plane=PlaneXY(0, 0, 0))  # -> simplify(Box), Box_2
get_rhino_attributes = GetRhinoAttributes(Geometry=input_meshes)  # -> Name, Layer, Color
guid = Guid(input_meshes)
deconstruct_mesh = DeconstructMesh(Mesh=input_meshes)  # -> Vertices, Faces, Colours, Normals
element = Text(["GUID", "name", "bot:Element", "rdfs:label", "rdf:type", "product:Wall", "faceCount", "vertexCount", "centroid", "Dim.X", "Dim.Y", "Dim.Z"])
building = Text(["rdfs:label", "inst", "product:Building", "Fog:asObj", "rdf:type", "bot:Building", "bot:containsElement"])
site = Text(["rdf:about", "rdfs:label", "Fog:asObj", "foaf:name", "bot:Site", "bot:hasBuilding"])
box_properties = BoxProperties(Box=bounding_box.Box)  # -> simplify(Center), Diagonal, Area, Volume, Degeneracy
list_length = ListLength(List=deconstruct_mesh.Faces)  # -> simplify(Length)
list_length_2 = ListLength(List=deconstruct_mesh.Vertices)  # -> simplify(Length)
deconstruct_box = DeconstructBox(Box=bounding_box.Box)  # -> Plane, simplify(X), simplify(Y), simplify(Z)
panel = Panel(building)
panel_2 = Panel(element)
# URI GUID =
# URI NAme =
# URI rdf:type = Wall
# URI fog:asObj =
# URI
panel_3 = Panel(site)
bot_containselement = Text("25")
product_building = Text("building13")
bot_basbuilding = Text("building13")
list_length_3 = ListLength(List=flatten(input_meshes))
# Create JSON files from 3D meshes
# Data: Site
rdf_about = Text("Gendarmenmarkt reconstruction1")
fog_asobj = Text("\Projects\V4Design\Data\PUC4sc1 Gendarmenmarkt\Mesh\market1\building1.obj")
rdfs_label = Text("Gendarmenmarkt")
foaf_name = Text("Gendarmenmarkt")
bot_building = Text("Konzerthaus Berlin")
bot_element = Text(get_rhino_attributes.Name)
product_wall = Text(get_rhino_attributes.Layer)
fog_asobj_2 = Text(":\Projects\V4Design\Data\PUC4sc1 Gendarmenmarkt\Mesh\market1\building13.obj")
# Data: Building
rdfs_label_2 = Text("Konzerthaus Berlin")
bot_site = Text("Gendarmenmarkt")
vertexcount = Text(list_length_2)
inst = Text("building13")
rdfs_label_3 = Text(get_rhino_attributes.Layer)
rdf_type = Text("http://www.productontology.org/id/Building")
facecount = Text(list_length)
# Data: Elements
guid_2 = Text(guid)
name = Text(get_rhino_attributes.Name)
rdf_type_2 = Text("http://www.productontology.org/id/Wall")
centroid = Text(box_properties.Center)
dim_y = Text(deconstruct_box.Y)
dim_x = Text(deconstruct_box.X)
dim_z = Text(deconstruct_box.Z)
merge = Merge(
    Data1=rdfs_label_2,
    Data2=inst,
    Data3=product_building,
    Data4=fog_asobj_2,
    Data5=rdf_type,
    Data6=bot_building,
    Data7=bot_containselement)
duplicate_data = DuplicateData(Data=rdf_type_2, Number=list_length_3, Order=True)
merge_2 = Merge(Data1=rdf_about, Data2=rdfs_label, Data3=fog_asobj, Data4=foaf_name, Data5=bot_site, Data6=bot_basbuilding)
entwine = Entwine(
    Branch00=guid_2,
    Branch01=name,
    Branch02=bot_element,
    Branch03=rdfs_label_3,
    Branch04=duplicate_data,
    Branch05=product_wall,
    Branch06=facecount,
    Branch07=vertexcount,
    Branch08=centroid,
    Branch09=dim_x,
    Branch010=dim_y,
    Branch011=dim_z,
    FlattenInputs=True)  # -> simplify(Result)
panel_4 = Panel(merge_2)
panel_5 = Panel(merge)
c_script = CSharpScript(Guids=guid_2, Meshes=input_meshes)  # -> out, A; inputs Guids: list of Guid, Meshes: list of Mesh
# ---------- c_script: C# usings ----------
using System.IO;


using System.Linq;

using Rhino.DocObjects;
# ---------- c_script: C# ----------
    List<RhinoObject> Rhino_meshes = new List<RhinoObject>();
    foreach (Guid Guid in Guids)
    {
      Rhino_meshes.Add(Rhino.RhinoDoc.ActiveDoc.Objects.FindId(Guid));
    }
    foreach (Mesh mesh in Meshes)
    {
      var Centroid = mesh.GetBoundingBox(false).Center.ToString();
      var Min = mesh.GetBoundingBox(false).Min.ToString();
      var Max = mesh.GetBoundingBox(false).Max.ToString();
    }
    foreach (RhinoObject mesh in Rhino_meshes)
    {
      var ID = mesh.Attributes.Name;
      var Rdfs333Label = mesh.Document.Layers[mesh.Attributes.LayerIndex].Name;
      var GUID = mesh.Id.ToString();
      var Bot333Element = mesh.Attributes.Name;
      var Rdf333Type = "http://www.productontology.org/id/Wall";
    }
    A = Rhino_meshes;
# ---------- end c_script ----------
text = Text("Site")
text_2 = Text("Building")
elements = Text("Elements")
create_datatable = CreateDataTable(TableName=simplify(text), TableHeaders=site, ValueTree=simplify(graft(merge_2)))
create_datatable_2 = CreateDataTable(TableName=simplify(text_2), TableHeaders=building, ValueTree=simplify(graft(merge)))
create_datatable_3 = CreateDataTable(TableName=elements, TableHeaders=element, ValueTree=entwine)
button = Button()
file_path = FilePath("K:\Projects\V4Design\Data\PUC4sc1 Gendarmenmarkt\JSON\Site1.json")
file_path_2 = FilePath("K:\Projects\V4Design\Data\PUC4sc1 Gendarmenmarkt\JSON\Building1.json")
file_path_3 = FilePath("K:\Projects\V4Design\Data\PUC4sc1 Gendarmenmarkt\JSON\Elements1.json")
create_dataset = CreateDataSet(DataSetName="Gendarmenmarkt", DataTables=create_datatable)
create_json = CreateJSON(WriteJSON=button, FilePath=file_path, DataSet=create_dataset)
create_dataset_2 = CreateDataSet(DataSetName="Gendarmenmarkt", DataTables=create_datatable_2)
create_json_2 = CreateJSON(WriteJSON=button, FilePath=file_path_2, DataSet=create_dataset_2)
create_dataset_3 = CreateDataSet(DataSetName="Gendarmenmarkt", DataTables=create_datatable_3)
create_json_3 = CreateJSON(WriteJSON=button, FilePath=file_path_3, DataSet=create_dataset_3)
panel_6 = Panel(create_json_3)
