# Grasshopper definition mesh_vs_model.gh (Grasshopper 1.0.7)
# plug-ins: MeshEdit Components

# ----
# INPUT
mesh = Mesh(<mesh referenced from the Rhino model>)
curve = Curve(<curve referenced from the Rhino model>)

boundary_surfaces = BoundarySurfaces(Edges=curve)

# ----
# |mesh-surface|
extrude = Extrude(Base=boundary_surfaces, Direction=Vector(0, 0, 5))
move = Move(Geometry=extrude, Motion=Vector(0, 0, -2))  # -> Geometry, Transform
mesh_split = MeshSplit(Mesh=mesh, Splitters=move.Geometry)
list_item = ListItem(List=mesh_split, Index=1, Wrap=True)
deconstruct_mesh = DeconstructMesh(Mesh=list_item)  # -> Vertices, Faces, Colours, Normals
surface_closest_point = SurfaceClosestPoint(Point=deconstruct_mesh.Vertices, Surface=boundary_surfaces)  # -> Point, UVPoint, Distance
surface_closest_point_2 = SurfaceClosestPoint(Point=deconstruct_mesh.Vertices, Surface=boundary_surfaces)  # -> Point, UVPoint, Distance
average = Average(Input=surface_closest_point_2.Distance)
mesh_area = MeshArea(Mesh=boundary_surfaces)  # -> Area, Centroid
multiplication = Multiplication(A=mesh_area.Area, B=average)
panel = Panel(multiplication)

_3d_convexhull = _3DConvexHull(Points=deconstruct_mesh.Vertices)

# ----
# raytracing
untrim = Untrim(Surface=boundary_surfaces)
dimensions = Dimensions(Surface=untrim)  # -> UDimension, VDimension
divide_surface = DivideSurface(Surface=untrim, UCount=expr("10*x", dimensions.UDimension), VCount=expr("10*x", dimensions.VDimension))  # -> flatten(Points), Normals, Parameters
point_in_curve = PointInCurve(Point=divide_surface.Points, Curve=curve)  # -> Relationship, Point
cull_pattern = CullPattern(List=divide_surface.Points, CullPattern=point_in_curve.Relationship)  # -> simplify(graft(List))
deconstruct = Deconstruct(Point=cull_pattern)  # -> XComponent, YComponent, ZComponent
construct_point = ConstructPoint(XCoordinate=deconstruct.XComponent, YCoordinate=deconstruct.YComponent, ZCoordinate=expr("x+5", deconstruct.ZComponent))
line = Line(StartPoint=cull_pattern, EndPoint=construct_point)
mesh_curve = MeshCurve(Mesh=list_item, Curve=line)  # -> Points, Faces
line_2 = Line(StartPoint=cull_pattern, EndPoint=mesh_curve.Points)
length = Length(Curve=line_2)
average_2 = Average(Input=flatten(length))
mesh_area_2 = MeshArea(Mesh=boundary_surfaces)  # -> Area, Centroid
multiplication_2 = Multiplication(A=mesh_area_2.Area, B=average_2)
panel_2 = Panel(multiplication_2)

# ----
# CONVEX HULL
mesh_volume = MeshVolume(Mesh=_3d_convexhull)  # -> Volume, Centroid
panel_3 = Panel(mesh_volume.Volume)
