# Grasshopper definition mesh_vs_model2.gh (Grasshopper 1.0.7)

# ----
# INPUT
mesh = Mesh(<mesh referenced from the Rhino model>)
curve = Curve(<curve referenced from the Rhino model>)

boundary_surfaces = BoundarySurfaces(Edges=curve)
extrude = Extrude(Base=boundary_surfaces, Direction=Vector(0, 0, 10))
move = Move(Geometry=extrude, Motion=Vector(0, 0, -5))  # -> Geometry, Transform
mesh_split = MeshSplit(Mesh=mesh, Splitters=move.Geometry)
list_item = ListItem(List=mesh_split, Index=Slider(1, range=0..10), Wrap=True)

# ----
# CONVEX HULL
divide_curve = DivideCurve(Curve=curve, Count=10, Kinks=False)  # -> Points, Tangents, Parameters
deconstruct_mesh = DeconstructMesh(Mesh=list_item)  # -> Vertices, Faces, Colours, Normals
merge = Merge(Data1=deconstruct_mesh.Vertices, Data2=divide_curve.Points)
convex_hull = ConvexHull(Points=merge, Plane=PlaneXY(0, 0, 0))  # -> Hull, HullZ, Indices

# ----
# |mesh-surface|
face_normals = FaceNormals(Mesh=list_item)  # -> Centers, Normals
surface_closest_point = SurfaceClosestPoint(Point=face_normals.Centers, Surface=boundary_surfaces)  # -> Point, UVPoint, Distance
deconstruct_mesh_2 = DeconstructMesh(Mesh=list_item)  # -> Vertices, Faces, Colours, Normals
deconstruct_face = DeconstructFace(Face=simplify(graft(deconstruct_mesh_2.Faces)))  # -> CornerA, CornerB, CornerC, CornerD
list_item_2 = ListItem(List=deconstruct_mesh_2.Vertices, Index=deconstruct_face.CornerA, Wrap=True)
list_item_3 = ListItem(List=deconstruct_mesh_2.Vertices, Index=deconstruct_face.CornerB, Wrap=True)
list_item_4 = ListItem(List=deconstruct_mesh_2.Vertices, Index=deconstruct_face.CornerC, Wrap=True)
merge_2 = Merge(Data1=list_item_2, Data2=list_item_3, Data3=list_item_4)
average = Average(Input=merge_2)

# ----
# Average height
surface_closest_point_2 = SurfaceClosestPoint(Point=deconstruct_mesh.Vertices, Surface=boundary_surfaces)  # -> Point, UVPoint, Distance
average_2 = Average(Input=surface_closest_point_2.Distance)

# ----
# |surface-mesh|
untrim = Untrim(Surface=boundary_surfaces)
number_slider = Slider(0.05, range=0..0.1)
dimensions = Dimensions(Surface=untrim)  # -> UDimension, VDimension
division = Division(A=dimensions.UDimension, B=number_slider)
division_2 = Division(A=dimensions.VDimension, B=number_slider)
divide_surface = DivideSurface(Surface=boundary_surfaces, UCount=division, VCount=division_2)  # -> Points, Normals, Parameters
mesh_ray = MeshRay(Mesh=list_item, Point=divide_surface.Points, Direction=Vector(0, 0, 1))  # -> Point, Hit
distance = Distance(PointA=divide_surface.Points, PointB=mesh_ray.Point)  # -> flatten(Distance)
average_3 = Average(Input=distance)
panel = Panel(average_3)

move_2 = Move(Geometry=divide_surface.Points, Motion=Vector(0, 0, 10))  # -> Geometry, Transform; disabled
line = Line(StartPoint=divide_surface.Points, EndPoint=move_2.Geometry)  # disabled
move_3 = Move(Geometry=line, Motion=Vector(0, 0, -5))  # -> flatten(Geometry), Transform; disabled
mesh_curve = MeshCurve(Mesh=list_item, Curve=move_3.Geometry)  # -> Points, Faces; disabled
clean_tree = CleanTree(RemoveNulls=True, RemoveInvalid=True, RemoveEmpty=False, Tree=move_3.Geometry)  # disabled
panel_2 = Panel(average)
