# Grasshopper definition point_cloud_vs_mesh.gh (Grasshopper 1.0.7)
# plug-ins: Volvox

# ----
# INPUT
mesh = Mesh(<mesh referenced from the Rhino model>)
cloud = Cloud(<cloud referenced from the Rhino model>)

# ----
# COMPUTE DISTANCE TO MESH
number_slider = Slider(0.5, range=0..1)
key = Key("d")
construct_domain = ConstructDomain(DomainStart=0, DomainEnd=number_slider)
mesh_compare = MeshCompare(Cloud=cloud, Mesh=mesh, Key=key)
cull_cloud = CullCloud(Cloud=mesh_compare, Key=key, Domain=construct_domain)

# ----
# INLIER DETECTION
mesh_include = MeshInclude(Cloud=cloud, Mesh=mesh, Leave=False)

# ----
# BOUNDING BOX SELECTION
bounding_box = BoundingBox(Content=mesh, Plane=PlaneXY(0, 0, 0))  # -> Box, Box_2
box = Box(bounding_box.Box)
box_crop = BoxCrop(Box=box)
cloud_engine = CloudEngine(Cloud=cloud, Instruction0=box_crop)
