# Grasshopper definition test0.1.gh (Grasshopper 1.0.7)
# plug-ins: Saiga, Volvox, Scan2BIM, Scan2BIM2

populate_2d = Populate2D(
    Region={Plane=PlaneXY(0.483729179, 0.473355395, 0), Size=Domain2(u=-0.4648218708..0.4648218708, v=-0.4616381593..0.4616381593)},
    Count=100,
    Seed=12)
populate_3d = Populate3D(Region={Plane=PlaneXY(0, 0, 0), X=Domain(0, 10), Y=Domain(0, 10), Z=Domain(0, 2)}, Count=10000, Seed=1)
populate_2d_2 = Populate2D(Region={Plane=PlaneXY(0, 0, 0), Size=Domain2(u=0..20, v=0..10)}, Count=100, Seed=1)
populate_3d_2 = Populate3D(Region={Plane=PlaneXY(0, 0, 0), X=Domain(0, 10), Y=Domain(0, 10), Z=Domain(0, 2)}, Count=100, Seed=2)
populate_2d_3 = Populate2D(Region={Plane=PlaneXY(0, 0, 0), Size=Domain2(u=0..20, v=0..10)}, Count=100, Seed=12)
populate_3d_3 = Populate3D(Region={Plane=PlaneXY(0, 0, 0), X=Domain(0, 10), Y=Domain(0, 10), Z=Domain(0, 2)}, Count=100, Seed=1)
populate_geometry = PopulateGeometry(Geometry=[<brep referenced from the Rhino model> x2], Count=1000, Seed=1)
text = Text("sqdf")
delaunay_mesh = DelaunayMesh(Points=populate_3d_3, Plane=PlaneXY(0, 0, 0))
delaunay_mesh_2 = DelaunayMesh(Points=populate_2d_3, Plane=PlaneXY(0, 0, 0))
bounding_box = BoundingBox(Content=delaunay_mesh_2, Plane=PlaneXY(0, 0, 0))  # -> Box, Box_2
construct_cloud = ConstructCloud(Points=populate_2d_2)
construct_cloud_2 = ConstructCloud(Points=populate_2d_3)
construct_cloud_3 = ConstructCloud(Points=populate_3d_3)
construct_cloud_4 = ConstructCloud(Points=populate_3d)
bounding_box_2 = BoundingBox(Content=populate_3d_3, Plane=PlaneXY(0, 0, 0), UnionBox=True)  # -> Box, Box_2
construct_cloud_5 = ConstructCloud(Points=flatten(populate_geometry))
test = Test(Number=<missing>, Text=text, Point=populate_2d_2)  # -> Text, Number, Points
number_slider = Slider(0.8, range=0..1)
move = Move(Geometry=bounding_box_2.Box, Motion=Vector(0, 0, 0.5))  # -> Geometry, Transform
brep = Brep(bounding_box.Box)
move_2 = Move(Geometry=construct_cloud, Motion=Vector(0, 0, 0.1))  # -> Geometry, Transform
test2 = Test2(Point=populate_2d_2)  # -> Out, Cos
point_cloud = PointCloud(construct_cloud_4)
brep_2 = Brep(move.Geometry)
mesh = Mesh(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)
domain = Domain(Domain(0, 0.05))
fit_plane_to_mesh = FitPlaneToMesh(Downsampling=1, Resolution=0.05)  # -> Surface, Rmse
vector = Vector([Vector(0, 0, 1.570796327), Vector(0, 0, 3.141592654)])
vector_2 = Vector(Vector(0, 0, 0))
convexhull_3d = Convexhull3D(PointCloud=construct_cloud_3)
allign_two_point_clouds = AllignTwoPointClouds(
    PointCloudA=construct_cloud,
    PointCloudB=move_2.Geometry,
    Metric=0,
    InlierRatio=0.6,
    MaxIterations=100,
    DownsampleA=number_slider,
    DownsampleB=number_slider)  # -> Tform, Rmse
sample_point_cloud = SamplePointCloud(PointCloud=construct_cloud_4, Resolution=0.05)
crop_point_cloud = CropPointCloud(PointCloud=construct_cloud_3, Brep=brep_2)
sample_mesh = SampleMesh(Mesh=delaunay_mesh, Resolution=0.05)
fit_planes_to_geometry = FitPlanesToGeometry(Geometry=construct_cloud_5, NrPlanes=2, Tolerance=0.05)  # -> Surface, Rmse
compute_normals = ComputeNormals(PointCloud=[construct_cloud, construct_cloud_2], K=6)
compute_resolution = ComputeResolution(PointCloud=[construct_cloud, construct_cloud_2], K=0.5)
distance_to_mesh_brep = DistanceToMeshBrep(PointCloud=construct_cloud_3, Geometry=point_cloud, Interval=domain)
fit_plane_to_mesh_2 = FitPlaneToMesh(Mesh=delaunay_mesh, Tolerance=2, Resolution=0.05)  # -> Surface, Rmse, Rmse_2
create_transformation_matrix = CreateTransformationMatrix(R=vector, T=vector_2)
point_cloud_2 = PointCloud(construct_cloud)
split_vectors = SplitVectors(Vectors=graft(vector), Strict=False)  # -> simplify(X)
transform = Transform(Geometry=construct_cloud, Transform=allign_two_point_clouds.Tform)
decompose_transformation_matrix = DecomposeTransformationMatrix(Tform=create_transformation_matrix)  # -> R, T
# you still need to get the distances out
point_cloud_3 = PointCloud(distance_to_mesh_brep)
cloud = Cloud(point_cloud_3)
panel = Panel(create_transformation_matrix)
