# Grasshopper definition text_to_points.gh (Grasshopper 1.0.7)
# plug-ins: EleFront

# ----
# INPUT TEXT
text = Text(["S6122,89.6160,102.5840,8.3630,", "S6123,89.8290,97.6220,16.2620,", "S6124,89.7840,96.9550,16.2520,", "S6125,89.8610,97.6660,13.4130,", "S6126,89.8110,96.8900,13.4280,", "S6127,89.4060,97.6720,12.5400,", "S6128,89.3620,96.9960,12.5240,", "S6129,89.4540,97.6930,8.9380,", "S6130,89.3830,97.7750,8.8530,", "S6131,89.3620,97.9930,8.3260,", "S6132,89.4030,96.9980,8.9320,", "S6133,89.3180,96.9110,8.8400,", "S6134,89.3080,97.1580,8.3110,", "S6135,90.6660,101.0010,26.6590,", "S6136,90.7250,102.1720,21.3310,", "S6137,90.4680,97.7450,21.3370,", "S6138,90.4560,97.7790,17.7180,", "S6139,90.7250,102.0820,17.7980,", "S6140,116.2890,102.6940,21.1070,", "P6000,115.6700,107.9000,12.8770,", "P6001,115.6830,108.0690,12.8700,", "P6002,111.5560,109.6720,12.9470,", "P6003,111.5760,109.8640,12.9390,", "P6004,106.8670,108.2710,12.9680,", "P6005,106.8860,108.4650,12.9450,", "P6006,102.2070,108.5020,12.9700,", "P6007,102.2210,108.6760,12.9590,", "P6008,108.4080,108.4420,15.6230,", "P6009,108.3200,108.3810,15.6250,", "O1TEST,79.4920,100.6230,8.1250,"])

text_split = TextSplit(Text=text, Separators=" ,")
list_item = ListItem(List=text_split, Index=0, Wrap=True)
list_item_2 = ListItem(List=text_split, Index=1, Wrap=True)
list_item_3 = ListItem(List=text_split, Index=2, Wrap=True)
list_item_4 = ListItem(List=text_split, Index=3, Wrap=True)
panel = Panel(text_split)
construct_point = ConstructPoint(XCoordinate=list_item_2, YCoordinate=list_item_3, ZCoordinate=list_item_4)
polyline = PolyLine(Vertices=flatten(construct_point), Closed=False)
define_object_attributes = DefineObjectAttributes(Name=list_item)
bake_objects = BakeObjects(Geometry=construct_point, Attributes=define_object_attributes, BakeName="TS3", Bake=False)
