# Grasshopper definition ICP1.gh (Grasshopper 1.0.7)
# plug-ins: Volvox, LunchBox

# ----
# Save PCD
# werkt niet
list_length = ListLength()
construct_domain = ConstructDomain(DomainStart=1, DomainEnd=list_length)
subtraction = Subtraction(A=list_length, B=1)
range = Range(Domain=construct_domain, Steps=subtraction)  # -> simplify(graft(Range))
integer = Integer(range)
text = Text(integer)
text_2 = Text("PCDApart")
concatenate = Concatenate(FragmentA=text_2, FragmentB=text)
text_3 = Text(".ply")
concatenate_2 = Concatenate(FragmentA=concatenate, FragmentB=text_3)
text_4 = Text("E:\Documenten\Heinder\School\2019-2020\Thesis\Data\Testdata\Alle-muren\CloudCompare\PCD")
object_save = ObjectSave(
    BakeToggle=Toggle(False),
    FileDirectory=text_4,
    FileName=concatenate_2,
    Layer=text_2,
    ObjectName=concatenate,
    ObjectColor=RGB(255, 255, 255),
    LayerColor=RGB(255, 255, 255))

# ----
# tussenweg voor opslaan van PCD
number_slider = Slider(16, range=0..16)
tree_branch = TreeBranch(Path=number_slider, MaintainPaths=True)
save_e57 = SaveE57(FilePath=text_4, Scans=tree_branch, Spherical=False, Run=Toggle(False), Abort=False)

# ----
# Save Meshes
list_length_2 = ListLength()
construct_domain_2 = ConstructDomain(DomainStart=1, DomainEnd=list_length_2)
subtraction_2 = Subtraction(A=list_length_2, B=1)
range_2 = Range(Domain=construct_domain_2, Steps=subtraction_2)  # -> simplify(graft(Range))
integer_2 = Integer(range_2)
text_5 = Text(integer_2)
text_6 = Text("MeshApart")
concatenate_3 = Concatenate(FragmentA=text_6, FragmentB=text_5)
text_7 = Text(".ply")
concatenate_4 = Concatenate(FragmentA=concatenate_3, FragmentB=text_7)
text_8 = Text("E:\Documenten\Heinder\School\2019-2020\Thesis\Data\Testdata\Alle-muren\CloudCompare\Mesh")
object_save_2 = ObjectSave(
    BakeToggle=Toggle(False),
    FileDirectory=text_8,
    FileName=concatenate_4,
    Layer=text_6,
    ObjectName=concatenate_3,
    ObjectColor=RGB(255, 255, 255),
    LayerColor=RGB(255, 255, 255))

# ----
# -ROT is niet in te stellen
text_9 = Text("-o -GLOBAL_SHIFT -61200 -37700 0 E:\Documenten\Heinder\School\2019-2020\Thesis\Data\Testdata\Alle-muren\CloudCompare\Mesh\MeshApart")
concatenate_5 = Concatenate(FragmentA=text_9, FragmentB=text_5)
text_10 = Text(".ply -o -GLOBAL_SHIFT -61200 -37700 0 E:\Documenten\Heinder\School\2019-2020\Thesis\Data\Testdata\Alle-muren\CloudCompare\PCD\PCDApart")
concatenate_6 = Concatenate(FragmentA=concatenate_5, FragmentB=text_10)
concatenate_7 = Concatenate(FragmentA=concatenate_6, FragmentB=text_5)
text_11 = Text(".e57 -ICP -AUTO_SAVE OFF ")
concatenate_8 = Concatenate(FragmentA=concatenate_7, FragmentB=text_11)

# ----
# Totale ICP
boolean_toggle = BooleanToggle(False)
text_12 = Text("-o -GLOBAL_SHIFT -61200 -37700 0 E:\Documenten\Heinder\School\2019-2020\Thesis\Data\Testdata\Alle-muren\CloudCompare\Reserve\CC.ply -o -GLOBAL_SHIFT -61200 -37700 0  E:\Documenten\Heinder\School\2019-2020\Thesis\Data\Testdata\Alle-muren\CloudCompare\Reserve\CCPCD.ply -ICP -AUTO_SAVE OFF -ROT Z")
command_line = CommandLine(Commands=text_12, Run=boolean_toggle)

panel = Panel(text_12)
tree_branch_2 = TreeBranch(Tree=concatenate_8, Path=Slider(1, range=0..16), MaintainPaths=True)
command_line_2 = CommandLine(Commands=tree_branch_2, Run=Toggle(False))

# ----
# Totale ICP
boolean_toggle_2 = BooleanToggle(False)
text_13 = Text("-o -GLOBAL_SHIFT -61200 -37700 0 E:\Documenten\Heinder\School\2019-2020\Thesis\Data\Testdata\Alle-muren\CloudCompare\Reserve\CC.ply -o -GLOBAL_SHIFT -61200 -37700 0  E:\Documenten\Heinder\School\2019-2020\Thesis\Data\Testdata\Alle-muren\CloudCompare\Reserve\CCPCD.ply -ICP -AUTO_SAVE OFF -ROT Z")
command_line_3 = CommandLine(Commands=text_13, Run=boolean_toggle_2)
