# Grasshopper definition PCD_segmentation_coarse.gh (Grasshopper 1.0.7)
# plug-ins: Volvox

# ---- group: INPUTS
# PCD
# BIM
# %Subsampling
# Offset BB in m
number_slider = Slider(1, range=0..1)
number_slider_2 = Slider(0.2, range=0..1)
activate = Button()

# ----
geometry = Geometry([<brep referenced from the Rhino model> x3])
directory_pcd = FilePath("D:\Data\2020-08 Sample PM\PCD\")

# ---- group: Data I/O
# segment a PCD with a set of Geometries.
# This is a coarse initial segmentation using the Bounding box of the geometries
load_e57 = LoadE57(FilePath=directory_pcd, Index=-1, Percent=number_slider, Run=activate, Abort=False, Check=False)  # -> Cloud, Pose
merge_clouds = MergeClouds(Cloud=load_e57.Cloud)

# ---- group: Coarse Segmentation
bounding_box = BoundingBox(Content=geometry, Plane=PlaneXY(0, 0, 0))  # -> Box, Box_2
box_properties = BoxProperties(Box=bounding_box.Box)  # -> Center, Diagonal, Area, Volume, Degeneracy
scale = Scale(Geometry=bounding_box.Box, Center=box_properties.Center, Factor=1.2)  # -> Geometry, Transform
mesh_join = MeshJoin(Meshes=flatten(scale.Geometry))
mesh_include = MeshInclude(Cloud=merge_clouds, Mesh=mesh_join, Leave=False)

# ---- group: Data I/O out
text = Text("PCD_Segmented")
concatenate = Concatenate(FragmentA=directory_pcd, FragmentB=text)
save_e57 = SaveE57(FilePath=concatenate, Scans=mesh_include, Spherical=False, Run=True, Abort=False)
