# Grasshopper definition PCD_segmentation_fine3.gh (Grasshopper 1.0.7)
# plug-ins: Volvox, Scan2BIM, MeshEdit Components, EleFront, Rhino.Inside for Autodesk Revit

define_object_attributes = DefineObjectAttributes()
bake_objects = BakeObjects(Attributes=define_object_attributes, Bake=False)
graphical_element = GraphicalElement(<graphical element referenced from the Revit model>)
element_geometry = ElementGeometry(Element=graphical_element)

# ---- group: INPUTS
# PCD
# BIM
# %Subsampling
# Offset Bufferzone D in m
# % surface area for detection
# 3D point accuracy (m)
# Influence zone
# transformation
# Threshold accuracy
# transformation
k_neighbors = Slider(6, range=0..10)
neighbor_distance = Slider(20, range=0..30)
number_slider = Slider(0.01, range=0..0.01)
number_slider_2 = Slider(0, range=0..1)
number_slider_3 = Slider(0.01, range=0..1)
number_slider_4 = Slider(0.2, range=0..1)
activate = Button()
multiplication = Multiplication(A=Slider(0, range=0..0.1), _195Sigma3D=1.3)

# ---- group: use cloud in rhino
random_subsampling = RandomSubsampling(Percent=number_slider_3, Seed=123)
cloud = Cloud(<cloud referenced from the Rhino model>)
cloud_enginex = CloudEngineX(Cloud=cloud, Run=activate, Abort=False, Instruction0=random_subsampling, showinfo=True)

# ----
geometry = Geometry(simplify(graft([<brep referenced from the Rhino model> x4])))
directory_pcd = FilePath("D:\Data\2020-08 Sample PM\PCD\")
directory_pcd_2 = FilePath("D:\Data\2020-08 Sample PM\Week34\week34_photogrammetry_terrestrial.e57")

# ---- group: Data I/O
# 0. Import Point cloud
text = Text("PCD_Segmented.e57")
concatenate = Concatenate(FragmentA=directory_pcd, FragmentB=text)
load_e57 = LoadE57(FilePath=directory_pcd_2, Index=-1, Percent=number_slider_3, Run=activate, Abort=False, Check=False)  # -> Cloud, Pose
merge_clouds = MergeClouds(Cloud=load_e57.Cloud)

# ---- group: Compute distance and retain points within bufferzone
# 1. Segment Point cloud
key = Key("D")
construct_domain = ConstructDomain(DomainStart=expr("-x", number_slider_4), DomainEnd=number_slider_4)
mesh_compare = MeshCompare(Cloud=merge_clouds, Mesh=geometry, Key=key)
cullc = CullCloud(Cloud=mesh_compare, Key=key, Domain=construct_domain)  # -> simplify(graft(Cloud))

# ----
move = Move(Geometry=merge_clouds, Motion=Vector(0, 0, 0.1))  # -> Geometry, Transform
number_slider_5 = Slider(0.1, range=0..0.1)
cloud_2 = Cloud(flatten(cullc))
icp_pointclouds2 = ICP_pointclouds2(
    Pc_moving=move.Geometry,
    Pc_fixed=merge_clouds,
    Metric=0,
    InlierRatio=1,
    MaxIterations=100,
    DownsamplePc_moving=number_slider_5,
    DownsamplePc_fixed=number_slider_5)  # -> Tform, Rmse

# ---- group: Colorize point cloud
# Visualise D
bounds = Bounds(Cloud=cullc, Key=key)
range = Range(Domain=Domain(0, 0.7), Steps=4)
div = DivideDomain(Domain=bounds, Count=4)
gradient = Gradient(LowerLimit=0, UpperLimit=1, Parameter=range, stops=[0.246: RGB(0, 128, 0), 0.5: RGB(255, 255, 0), 0.695: RGB(255, 0, 0)])
dedomain = DeconstructDomain(Domain=div)  # -> Start, End
item = ListItem(List=dedomain.End, Index=-1, Wrap=True)
merge = Merge(Data1=dedomain.Start, Data2=item)
prevdata = PreviewData(Cloud=cullc, Key=key, Values=merge, Colors=gradient)

# ---- group: Data I/O out
text_2 = Text("PCD_Segmented")  # disabled
concatenate_2 = Concatenate(FragmentA=directory_pcd, FragmentB=text_2)  # disabled
relay = Relay()  # disabled
save_e57 = SaveE57(FilePath=concatenate_2, Scans=relay, Spherical=False, Run=True, Abort=False)  # disabled

# ----
panel = Panel(icp_pointclouds2.Tform)
# Normals
add_data = AddData()

# ----
# 2. PREPROCESS
t_observed = Number(number_slider_2)
bim = Geometry(geometry)
pcd = Cloud(cullc)

# ---- group: Evaluate % observed in XYZ
mesh_area = MeshArea(Mesh=bim)  # -> Area, Centroid

# ----
panel_2 = Panel(mesh_area.Area)

# ---- group: Sample data and distribute it among XYZ axis
populate_geometry = PopulateGeometry(Geometry=bim, Count=mesh_area.Area, Seed=1)  # -> simplify(Population)
mesh_closest_point = MeshClosestPoint(Point=populate_geometry, Mesh=bim)  # -> Point, Index, Parameter
mesh_eval = MeshEval(Mesh=bim, Parameter=mesh_closest_point.Parameter)  # -> Point, Normal, Colour
distribute_vectors = DistributeVectors(Vectors=unitize(mesh_eval.Normal), Strict=False)
list_length = ListLength(List=distribute_vectors)
shift_paths = ShiftPaths(Data=distribute_vectors, Offset=-1)
list_item = ListItem(List=populate_geometry, Index=shift_paths, Wrap=True)
shift_paths_2 = ShiftPaths(Data=list_length, Offset=-1)
list_item_2 = ListItem(List=mesh_eval.Normal, Index=shift_paths, Wrap=True)
partition_list = PartitionList(List=list_item, Size=shift_paths_2)
vector_display = VectorDisplay(Anchor=list_item, Vector=list_item_2)

# ---- group: moment of inertia in X,Y,Z
list_length_2 = ListLength(List=populate_geometry)
integer = Integer(list_length)
integer_2 = Integer(list_length_2)
division = Division(A=integer, B=integer_2)
shift_paths_3 = ShiftPaths(Data=division, Offset=-1)
moment_of_inertia_ix_iy_iz = Panel(shift_paths_3)

# ---- group: Romove objects/PCD that doesn't meet t% observed
inertia_moment = Number(shift_paths_3)
surface_area = Number(integer)
bim_2 = Geometry(simplify(bim))
shift_paths_4 = ShiftPaths(Data=surface_area, Offset=-1)

# ---- group: Evaluate % observed in XYZ (continued)
closest_point = ClosestPoint(Cloud=pcd, Point=list_item)  # -> Point, Normal, Color, Distance, Index
smaller_than = SmallerThan(FirstNumber=closest_point.Distance, SecondNumber=number_slider_4)  # -> SmallerThan, OrEqualTo

# ----
tree_statistics = TreeStatistics(Tree=closest_point.Distance)  # -> Paths, Length, Count
tree_branch = TreeBranch(Tree=shift_paths_2, Path=tree_statistics.Paths, MaintainPaths=True)

# ---- group: Evaluate % observed in XYZ (continued)
partition_list_2 = PartitionList(List=smaller_than.SmallerThan, Size=tree_branch)
mass_addition = MassAddition(Input=partition_list_2)  # -> Result, PartialResults
division_2 = Division(A=mass_addition.Result, B=simplify(graft(tree_branch)))
observed_surface = Panel(division_2)

# ---- group: Romove objects/PCD that doesn't meet t% observed (continued)
observed = Number(division_2)
shift_paths_5 = ShiftPaths(Data=observed, Offset=-1)
tree_branch_2 = TreeBranch(Tree=bim_2, Path=tree_statistics.Paths, MaintainPaths=True)
tree_branch_3 = TreeBranch(Tree=pcd, Path=tree_statistics.Paths, MaintainPaths=True)
tree_branch_4 = TreeBranch(Tree=inertia_moment, Path=tree_statistics.Paths, MaintainPaths=True)
sort_list = SortList(Keys=shift_paths_5)  # -> reverse(Keys), ValuesValuesA
tree_branch_5 = TreeBranch(Tree=shift_paths_4, Path=tree_statistics.Paths, MaintainPaths=True)
list_item_3 = ListItem(List=sort_list.Keys, Index=0, Wrap=True)
larger_than = LargerThan(FirstNumber=list_item_3, SecondNumber=t_observed)  # -> LargerThan, OrEqualTo
dispatch = Dispatch(List=tree_branch_3, DispatchPattern=larger_than.LargerThan)  # -> ListA, ListB
dispatch_2 = Dispatch(List=shift_paths_5, DispatchPattern=larger_than.LargerThan)  # -> ListA, ListB
dispatch_3 = Dispatch(List=tree_branch_4, DispatchPattern=larger_than.LargerThan)  # -> ListA, ListB
dispatch_4 = Dispatch(List=tree_branch_2, DispatchPattern=larger_than.LargerThan)  # -> ListA, ListB
dispatch_5 = Dispatch(List=tree_branch_5, DispatchPattern=larger_than.LargerThan)  # -> ListA, ListB
clean_parallel = CleanParallel(
    PrimaryData=dispatch.ListA,
    SecondaryDataSecondaryData1=dispatch_2.ListA,
    SecondaryData1=dispatch_4.ListA,
    SecondaryData2=dispatch_3.ListA,
    SecondaryData3=dispatch_5.ListA,
    removeEmpty=True)  # -> PrimaryData, SecondaryDataSecondaryData1, SecondaryData1, SecondaryData2, SecondaryData3

# ----
expression = Expression(x=tree_branch, Expression="if(x=0, 1, x)")  # disabled

# ---- group: Romove objects/PCD that doesn't meet t% observed
moment_of_inertia_ix_iy_iz_2 = Number(clean_parallel.SecondaryData2)
surface_area_ax_ay_az = Number(clean_parallel.SecondaryData3)
observed_2 = Number(clean_parallel.SecondaryDataSecondaryData1)  # disabled
bim_3 = Geometry(simplify(clean_parallel.SecondaryData1))  # disabled
pcd_2 = Cloud(clean_parallel.PrimaryData)  # disabled

# ---- group: BIM pcd sampling
# 3.SAMPLE BIM
bim_4 = Geometry(bim_3)
mesh_explode = MeshExplode(Mesh=bim_4, Interpolate=False)  # -> simplify(Faces)
mesh_edges = MeshEdges(Mesh=mesh_explode)  # -> NakedEdges, InteriorEdges, NonManifoldEdges
length = Length(Curve=mesh_edges.NakedEdges)  # -> expr("10*x", Length)
divide_curve = DivideCurve(Curve=mesh_edges.NakedEdges, Count=length, Kinks=False)  # -> Points, Tangents, Parameters
shift_paths_6 = ShiftPaths(Data=divide_curve.Points, Offset=-1)
cross_reference = CrossReference(ListListA=shift_paths_6, ListListB=shift_paths_6, CrossMode=7)  # -> graft(ListListA), graft(ListListB)
c_script = CSharpScript(P1=cross_reference.ListListA, P2=cross_reference.ListListB)  # -> out, A; inputs P1: list of Point3d, P2: list of Point3d; disabled
# ---------- c_script: C# ----------
    Point3d[] P = new Point3d[P1.Count];

    for (int i = 0; i < P1.Count; i++)
    {
      var point = new Point3d((((P2[i].X - P1[i].X) / 2) + P1[i].X), (((P2[i].Y - P1[i].Y) / 2) + P1[i].Y), (((P2[i].Z - P1[i].Z) / 2) + P1[i].Z));
      P[i] = point;
    }
    A = P;
# ---------- end c_script ----------
merge_2 = Merge(Data1=cross_reference.ListListA, Data2=cross_reference.ListListB)
average = Average(Input=merge_2)
shift_paths_7 = ShiftPaths(Data=average, Offset=-2)
construct_cloud = ConstructCloud(Points=shift_paths_7)  # -> simplify(Cloud)
bim_cloud = Cloud(simplify(construct_cloud))

# ----
move_2 = Move(Geometry=bim_cloud, Motion=Vector(0.05, 0, 0))  # -> Geometry, Transform

# ---- group: Compute ICP T*R
# 4. ICP doesn't do a good job
bim_cloud_2 = Cloud(bim_cloud)
pcd_3 = Cloud(pcd_2)
random_subsampling_2 = RandomSubsampling(Percent=Slider(0.2, range=0..1), Seed=123)
average_2 = Average(Cloud=bim_cloud_2, Percent=1)
cloud_engine = CloudEngine(Cloud=pcd_3, Instruction0=random_subsampling_2)
vector = Vector(expr("-x", simplify(graft(average_2))))
move_3 = Move(Geometry=pcd_3, Motion=vector)  # -> Geometry, Transform
move_4 = Move(Geometry=bim_cloud_2, Motion=vector)  # -> Geometry, Transform
icp_pointclouds = ICP_pointclouds(Pc_moving=move_3.Geometry, Pc_fixed=move_4.Geometry, Metric=0, InlierRatio=1, MaxIterations=60)  # -> simplify(Tform)
decompose_transformation_matrix = DecomposeTransformationMatrix(Tform=icp_pointclouds)  # -> R, T
translation = Panel(decompose_transformation_matrix.T)
rotation = Panel(decompose_transformation_matrix.R)

# ----
average_3 = Average(Cloud=move_2.Geometry, Percent=1)
rotate_3d = Rotate3D(Geometry=move_2.Geometry, Angle=0.02, Center=average_3, Axis=Vector(0, 0, 1))  # -> Geometry, Transform

# ---- group: Select influence zone
# Construct Adjacency matrix
bim_5 = Geometry(simplify(bim_3))
# include frequency and a measure for the aerodynamics of the object.
mesh_area_2 = MeshArea(Mesh=bim_5)  # -> Area, Centroid
closest_points = ClosestPoints(Point=mesh_area_2.Centroid, Cloud=flatten(mesh_area_2.Centroid), Count=k_neighbors)  # -> ClosestPoint, simplify(CPIndex), Distance
smaller_than_2 = SmallerThan(FirstNumber=closest_points.Distance, SecondNumber=neighbor_distance)  # -> SmallerThan, OrEqualTo
dispatch_6 = Dispatch(List=closest_points.CPIndex, DispatchPattern=smaller_than_2.SmallerThan)  # -> simplify(ListA), ListB
panel_3 = Panel(dispatch_6.ListA)

# ---- group: tx,ty,tz
T = Vector(simplify(decompose_transformation_matrix.T))
deconstruct = Deconstruct(Point=T)  # -> XComponent, YComponent, ZComponent
merge_3 = Merge(Data1=deconstruct.XComponent, Data2=deconstruct.YComponent, Data3=deconstruct.ZComponent)
list_length_3 = ListLength(List=dispatch_6.ListA)  # -> expr("3*x", flatten(Length))
tree_statistics_2 = TreeStatistics(Tree=merge_3)  # -> Paths, Length, Count
tree_branch_6 = TreeBranch(Tree=merge_3, Path=dispatch_6.ListA, MaintainPaths=False)
partition_list_3 = PartitionList(List=flatten(tree_branch_6), Size=list_length_3)  # -> simplify(Chunks)
tree_statistics_3 = TreeStatistics(Tree=partition_list_3)  # -> Paths, Length, Count
replace_paths = ReplacePaths(Data=partition_list_3, Search=tree_statistics_3.Paths, Replace=tree_statistics_2.Paths)
partition_list_4 = PartitionList(List=replace_paths, Size=3)  # -> simplify(graft(Chunks))
path_mapper = PathMapper(partition_list_4, source="{A;B;C}", target="{A;C;B}")
shift_paths_8 = ShiftPaths(Data=path_mapper, Offset=-1)
tx_ty_tz = Number(shift_paths_8)

# ---- group: rx,ry,rz
R = Vector(simplify(decompose_transformation_matrix.R))
deconstruct_2 = Deconstruct(Point=R)  # -> XComponent, YComponent, ZComponent
merge_4 = Merge(Data1=deconstruct_2.XComponent, Data2=deconstruct_2.YComponent, Data3=deconstruct_2.ZComponent)
list_length_4 = ListLength(List=dispatch_6.ListA)  # -> expr("3*x", flatten(Length))
tree_statistics_4 = TreeStatistics(Tree=merge_4)  # -> Paths, Length, Count
tree_branch_7 = TreeBranch(Tree=merge_4, Path=dispatch_6.ListA, MaintainPaths=False)
partition_list_5 = PartitionList(List=flatten(tree_branch_7), Size=list_length_4)  # -> simplify(Chunks)
tree_statistics_5 = TreeStatistics(Tree=partition_list_5)  # -> Paths, Length, Count
replace_paths_2 = ReplacePaths(Data=partition_list_5, Search=tree_statistics_5.Paths, Replace=tree_statistics_4.Paths)
partition_list_6 = PartitionList(List=replace_paths_2, Size=3)  # -> simplify(graft(Chunks))
path_mapper_2 = PathMapper(partition_list_6, source="{A;B;C}", target="{A;C;B}")
shift_paths_9 = ShiftPaths(Data=path_mapper_2, Offset=-1)
rx_ry_rz = Number(shift_paths_9)

# ---- group: Ix,Iy,Iz
# TODO: fix inertia
moment_of_inertia_i_xyz_a = Number(moment_of_inertia_ix_iy_iz_2)
tree_branch_8 = TreeBranch(Tree=moment_of_inertia_i_xyz_a, Path=dispatch_6.ListA, MaintainPaths=False)
tree_statistics_6 = TreeStatistics(Tree=moment_of_inertia_i_xyz_a)  # -> Paths, Length, Count
list_length_5 = ListLength(List=dispatch_6.ListA)  # -> expr("3*x", flatten(Length))
partition_list_7 = PartitionList(List=flatten(tree_branch_8), Size=list_length_5)  # -> simplify(Chunks)
tree_statistics_7 = TreeStatistics(Tree=partition_list_7)  # -> Paths, Length, Count
replace_paths_3 = ReplacePaths(Data=partition_list_7, Search=tree_statistics_7.Paths, Replace=tree_statistics_6.Paths)
partition_list_8 = PartitionList(List=replace_paths_3, Size=3)  # -> simplify(graft(Chunks))
path_mapper_3 = PathMapper(partition_list_8, source="{A;B;C}", target="{A;C;B}")
shift_paths_10 = ShiftPaths(Data=path_mapper_3, Offset=-1)
ix_iy_iz = Number(shift_paths_10)

surface_area_in_xyz = Number(surface_area_ax_ay_az)
tree_branch_9 = TreeBranch(Tree=surface_area_in_xyz, Path=dispatch_6.ListA, MaintainPaths=False)
tree_statistics_8 = TreeStatistics(Tree=surface_area_in_xyz)  # -> Paths, Length, Count
list_length_6 = ListLength(List=dispatch_6.ListA)  # -> expr("3*x", flatten(Length))
partition_list_9 = PartitionList(List=flatten(tree_branch_9), Size=list_length_6)  # -> simplify(Chunks)
tree_statistics_9 = TreeStatistics(Tree=partition_list_9)  # -> Paths, Length, Count
replace_paths_4 = ReplacePaths(Data=partition_list_9, Search=tree_statistics_9.Paths, Replace=tree_statistics_8.Paths)
partition_list_10 = PartitionList(List=replace_paths_4, Size=3)  # -> simplify(graft(Chunks))
path_mapper_4 = PathMapper(partition_list_10, source="{A;B;C}", target="{A;C;B}")
shift_paths_11 = ShiftPaths(Data=path_mapper_4, Offset=-1)
ax_ay_az = Number(shift_paths_11)

# ---- group: ox,oy,oz
number = Number(observed_2)
tree_branch_10 = TreeBranch(Tree=number, Path=dispatch_6.ListA, MaintainPaths=False)
tree_statistics_10 = TreeStatistics(Tree=number)  # -> Paths, Length, Count
list_length_7 = ListLength(List=dispatch_6.ListA)  # -> expr("3*x", flatten(Length))
partition_list_11 = PartitionList(List=flatten(tree_branch_10), Size=list_length_7)  # -> simplify(Chunks)
tree_statistics_11 = TreeStatistics(Tree=partition_list_11)  # -> Paths, Length, Count
replace_paths_5 = ReplacePaths(Data=partition_list_11, Search=tree_statistics_11.Paths, Replace=tree_statistics_10.Paths)
partition_list_12 = PartitionList(List=replace_paths_5, Size=3)  # -> simplify(graft(Chunks))
path_mapper_5 = PathMapper(partition_list_12, source="{A;B;C}", target="{A;C;B}")
shift_paths_12 = ShiftPaths(Data=path_mapper_5, Offset=-1)
ox_oy_oz = Number(shift_paths_12)

# ---- group: Absolute error: Compute most frequent LOA based on D
get_data = GetData(Cloud=pcd_2, Key="D")  # -> expr("abs(x)", simplify(Values)); disabled
loa_domains = Domain([Domain(0, 0.001), Domain(0.001, 0.005), Domain(0.005, 0.015), Domain(0.015, 0.05), Domain(0.05, 999999999)])  # disabled
find_domain = FindDomain(Domains=loa_domains, Number=get_data, Strict=False)  # -> Index, Neighbour; disabled
member = Member([0, 1, 2, 3, 4])  # disabled
text_3 = Text(["LOA50", "LOA40", "LOA30", "LOA20", "LOA10"])  # disabled
member_index = MemberIndex(Set=find_domain.Index, Member=member)  # -> Index, Count; disabled
sort_list_2 = SortList(Keys=member_index.Count, ValuesValuesA=text_3)  # -> Keys, reverse(ValuesValuesA); disabled
list_item_4 = ListItem(List=sort_list_2.ValuesValuesA, Index=0, Wrap=True)  # disabled
absolute_loa = Panel(list_item_4)  # disabled

# ----
# find dominant transformation in vincinity of each object
# without relying on a single object's observations
# NOTE: the RMSE of ICP gives an indication of the local error/parametric fit of the object.
# Given the coverage and the expected accuracy, one should be able to derive the local LOA
T_2 = Vector()  # disabled
# NOTE: the difference in R and T gives an indication of the positioning error
# ERROR: in a falsely georeferenced dataset, each translation will be different (R remains the same)
R_2 = Vector()  # disabled
point_groups = PointGroups(Points=flatten(T_2), Distance=multiplication)  # -> simplify(Groups), Indices; disabled
point_groups_2 = PointGroups(Points=flatten(R_2), Distance=multiplication)  # -> Groups, Indices; disabled
list_item_5 = ListItem(List=observed_2, Index=point_groups_2.Indices, Wrap=True)  # disabled
list_item_6 = ListItem(List=observed_2, Index=point_groups.Indices, Wrap=True)  # disabled
mass_addition_2 = MassAddition(Input=list_item_6)  # -> Coverage, PartialResults; disabled
mass_addition_3 = MassAddition(Input=list_item_5)  # -> Coverage, PartialResults; disabled
list_length_8 = ListLength(List=point_groups_2.Groups)  # disabled
list_length_9 = ListLength(List=point_groups.Groups)  # disabled
invers_rmse = Number()  # disabled
multiplication_2 = Multiplication(A=list_item_5, B=invers_rmse)  # disabled
weighted_average = WeightedAverage(Input=point_groups_2.Groups, Weights=multiplication_2)  # disabled
invers_rmse_2 = Number()  # disabled
multiplication_3 = Multiplication(A=list_item_6, B=invers_rmse_2)  # disabled
weighted_average_2 = WeightedAverage(Input=point_groups.Groups, Weights=multiplication_3)  # disabled
multiplication_4 = Multiplication(A=list_length_9, B=mass_addition_2.Coverage, C=invers_rmse_2)  # disabled
multiplication_5 = Multiplication(A=list_length_8, B=mass_addition_3.Coverage, C=invers_rmse)  # disabled
sort_list_3 = SortList(Keys=flatten(multiplication_4), ValuesValuesA=flatten(weighted_average_2))  # -> Keys, reverse(ValuesValuesA); disabled
sort_list_4 = SortList(Keys=flatten(multiplication_5), ValuesValuesA=flatten(weighted_average))  # -> Keys, reverse(ValuesValuesA); disabled
list_item_7 = ListItem(List=sort_list_3.ValuesValuesA, Index=0, Wrap=True)  # disabled
list_item_8 = ListItem(List=sort_list_4.ValuesValuesA, Index=0, Wrap=True)  # disabled
vector_2 = Vector(simplify(list_item_8))  # disabled
rotation_2 = Panel(vector_2)  # disabled
vector_3 = Vector(simplify(list_item_7))  # disabled
translation_2 = Panel(vector_3)  # disabled

number_2 = Number(number_slider)
c_script_2 = CSharpScript(x=tx_ty_tz, t_h=number_2)  # -> out, simplify(frequency); inputs x: list of Double, t_h: Double
# ---------- c_script_2: C# usings ----------
    using System.Linq;
# ---------- c_script_2: C# ----------
    int test = 0; ;
    List<int> lijst = new List<int>();
    for (int k = 0;k < x.Count; k++)
    {
      test = x
        .Where(v => Math.Abs(v - x[k]) <= t_h)
        .Count();
      lijst.Add(test);
    }
    frequency = lijst;
# ---------- end c_script_2 ----------

panel_4 = Panel(rx_ry_rz)

# ----
# Evaluation box
observed_3 = Number(observed_2)
tree_statistics_12 = TreeStatistics(Tree=bim_3)  # -> Paths, Length, Count
list_item_9 = ListItem(List=tree_statistics_12.Paths, Index=Slider(1, range=0..10), Wrap=True)
tree_branch_11 = TreeBranch(Tree=observed_3, Path=list_item_9, MaintainPaths=True)
tree_branch_12 = TreeBranch(Tree=pcd_2, Path=list_item_9, MaintainPaths=True)
tree_branch_13 = TreeBranch(Tree=bim_3, Path=list_item_9, MaintainPaths=True)
obesrved = Panel(tree_branch_11)

# ---- group: RMSE
rmse = Number(expr("x/x", mesh_area_2.Area))
tree_branch_14 = TreeBranch(Tree=rmse, Path=dispatch_6.ListA, MaintainPaths=False)
tree_statistics_13 = TreeStatistics(Tree=rmse)  # -> Paths, Length, Count
list_length_10 = ListLength(List=dispatch_6.ListA)  # -> expr("1*x", flatten(Length))
partition_list_13 = PartitionList(List=flatten(tree_branch_14), Size=list_length_10)  # -> simplify(Chunks)
tree_statistics_14 = TreeStatistics(Tree=partition_list_13)  # -> Paths, Length, Count
replace_paths_6 = ReplacePaths(Data=partition_list_13, Search=tree_statistics_14.Paths, Replace=tree_statistics_13.Paths)
list_length_11 = ListLength(List=partition_list_13)

# ---- group: oyz,oxz,oxy
list_item_10 = ListItem(List=observed_2, Index=[1, 2], Wrap=True)
list_item_11 = ListItem(List=observed_2, Index=[0, 2], Wrap=True)
list_item_12 = ListItem(List=observed_2, Index=[0, 1], Wrap=True)
list_length_12 = ListLength(List=dispatch_6.ListA)  # -> expr("3*x", flatten(Length))

# ----
mass_addition_4 = MassAddition(Input=list_item_12)  # -> Result, PartialResults
mass_addition_5 = MassAddition(Input=list_item_10)  # -> Result, PartialResults
mass_addition_6 = MassAddition(Input=list_item_11)  # -> Result, PartialResults

# ---- group: oyz,oxz,oxy (continued)
merge_5 = Merge(Data1=mass_addition_5.Result, Data2=mass_addition_6.Result, Data3=mass_addition_4.Result)
tree_branch_15 = TreeBranch(Tree=merge_5, Path=dispatch_6.ListA, MaintainPaths=False)
tree_statistics_15 = TreeStatistics(Tree=merge_5)  # -> Paths, Length, Count
partition_list_14 = PartitionList(List=flatten(tree_branch_15), Size=list_length_12)  # -> simplify(Chunks)
tree_statistics_16 = TreeStatistics(Tree=partition_list_14)  # -> Paths, Length, Count
replace_paths_7 = ReplacePaths(Data=partition_list_14, Search=tree_statistics_16.Paths, Replace=tree_statistics_15.Paths)
partition_list_15 = PartitionList(List=replace_paths_7, Size=3)  # -> simplify(graft(Chunks))
path_mapper_6 = PathMapper(partition_list_15, source="{A;B;C}", target="{A;C;B}")
shift_paths_13 = ShiftPaths(Data=path_mapper_6, Offset=-1)
oyz_oxz_oxy = Number(shift_paths_13)

list_item_13 = ListItem(List=surface_area_in_xyz, Index=[1, 2], Wrap=True)
list_item_14 = ListItem(List=surface_area_in_xyz, Index=[0, 2], Wrap=True)
list_item_15 = ListItem(List=surface_area_in_xyz, Index=[0, 1], Wrap=True)
list_length_13 = ListLength(List=dispatch_6.ListA)  # -> expr("3*x", flatten(Length))

# ----
mass_addition_7 = MassAddition(Input=list_item_14)  # -> Result, PartialResults
mass_addition_8 = MassAddition(Input=list_item_15)  # -> Result, PartialResults
mass_addition_9 = MassAddition(Input=list_item_13)  # -> Result, PartialResults

# ---- group: oyz,oxz,oxy (continued)
merge_6 = Merge(Data1=mass_addition_9.Result, Data2=mass_addition_7.Result, Data3=mass_addition_8.Result)
tree_branch_16 = TreeBranch(Tree=merge_6, Path=dispatch_6.ListA, MaintainPaths=False)
tree_statistics_17 = TreeStatistics(Tree=merge_6)  # -> Paths, Length, Count
partition_list_16 = PartitionList(List=flatten(tree_branch_16), Size=list_length_13)  # -> simplify(Chunks)
tree_statistics_18 = TreeStatistics(Tree=partition_list_16)  # -> Paths, Length, Count
replace_paths_8 = ReplacePaths(Data=partition_list_16, Search=tree_statistics_18.Paths, Replace=tree_statistics_17.Paths)
partition_list_17 = PartitionList(List=replace_paths_8, Size=3)  # -> simplify(graft(Chunks))
path_mapper_7 = PathMapper(partition_list_17, source="{A;B;C}", target="{A;C;B}")
shift_paths_14 = ShiftPaths(Data=path_mapper_7, Offset=-1)
ayz_axz_axy = Number(shift_paths_14)

list_item_16 = ListItem(List=moment_of_inertia_i_xyz_a, Index=[1, 2], Wrap=True)
list_item_17 = ListItem(List=moment_of_inertia_i_xyz_a, Index=[0, 2], Wrap=True)
list_item_18 = ListItem(List=moment_of_inertia_i_xyz_a, Index=[0, 1], Wrap=True)
list_length_14 = ListLength(List=dispatch_6.ListA)  # -> expr("3*x", flatten(Length))

# ----
mass_addition_10 = MassAddition(Input=list_item_17)  # -> Result, PartialResults
mass_addition_11 = MassAddition(Input=list_item_18)  # -> Result, PartialResults
mass_addition_12 = MassAddition(Input=list_item_16)  # -> Result, PartialResults

# ---- group: oyz,oxz,oxy (continued)
merge_7 = Merge(Data1=mass_addition_12.Result, Data2=mass_addition_10.Result, Data3=mass_addition_11.Result)
tree_branch_17 = TreeBranch(Tree=merge_7, Path=dispatch_6.ListA, MaintainPaths=False)
tree_statistics_19 = TreeStatistics(Tree=merge_7)  # -> Paths, Length, Count
partition_list_18 = PartitionList(List=flatten(tree_branch_17), Size=list_length_14)  # -> simplify(Chunks)
tree_statistics_20 = TreeStatistics(Tree=partition_list_18)  # -> Paths, Length, Count
replace_paths_9 = ReplacePaths(Data=partition_list_18, Search=tree_statistics_20.Paths, Replace=tree_statistics_19.Paths)
partition_list_19 = PartitionList(List=replace_paths_9, Size=3)  # -> simplify(graft(Chunks))
path_mapper_8 = PathMapper(partition_list_19, source="{A;B;C}", target="{A;C;B}")
shift_paths_15 = ShiftPaths(Data=path_mapper_8, Offset=-1)
iyz_ixz_ixy = Number(shift_paths_15)

# ----
# 5. COMPUTE DOMINANT TRANSFORMATION
# organise T,RMSE,Area,O and I per clique {clique;Type; index value}
# RMSE
# % observation
# Surface Area
# Moment of inertia
duplicate_data = DuplicateData(Data=replace_paths_6, Number=3, Order=True)
partition_list_20 = PartitionList(List=duplicate_data, Size=list_length_11)  # -> simplify(Chunks)
c_script_3 = CSharpScript(x=rx_ry_rz, t_h=number_2)  # -> out, simplify(frequency); inputs x: list of Double, t_h: Double; same code as c_script_2
panel_5 = Panel(ix_iy_iz)

# ---- group: RMSE (continued)
rmse_2 = Number(expr("1/x", partition_list_20))

# ---- group: Compute dominant transformation
multiplication_6 = Multiplication(RMSE=rmse_2, B=c_script_3.frequency, C=ox_oy_oz, D=ix_iy_iz, E=ax_ay_az)
multiplication_7 = Multiplication(RMSE=rmse_2, B=c_script_2.frequency, C=oyz_oxz_oxy, D=iyz_ixz_ixy, E=ayz_axz_axy)
sort_list_5 = SortList(Keys=multiplication_7, ValuesValuesA=rx_ry_rz)  # -> reverse(Keys), reverse(ValuesValuesA)
sort_list_6 = SortList(Keys=multiplication_6, ValuesValuesA=tx_ty_tz)  # -> reverse(Keys), reverse(ValuesValuesA)
list_item_19 = ListItem(List=sort_list_6.ValuesValuesA, Index=0, Wrap=True)
list_item_20 = ListItem(List=sort_list_5.ValuesValuesA, Index=0, Wrap=True)
tx_ty_tz_dominant = Number(list_item_19)
rx_ry_rz_dominant = Number(list_item_20)
shift_paths_16 = ShiftPaths(Data=tx_ty_tz_dominant, Offset=-1)
shift_paths_17 = ShiftPaths(Data=rx_ry_rz_dominant, Offset=-1)
list_item_21 = ListItem(List=shift_paths_16, Index=1, Wrap=True)
list_item_22 = ListItem(List=shift_paths_16, Index=0, Wrap=True)
list_item_23 = ListItem(List=shift_paths_16, Index=2, Wrap=True)
list_item_24 = ListItem(List=shift_paths_17, Index=1, Wrap=True)
list_item_25 = ListItem(List=shift_paths_17, Index=0, Wrap=True)
list_item_26 = ListItem(List=shift_paths_17, Index=2, Wrap=True)
vector_xyz = VectorXYZ(XComponent=list_item_25, YComponent=list_item_24, ZComponent=list_item_26)  # -> Vector, Length
vector_xyz_2 = VectorXYZ(XComponent=list_item_22, YComponent=list_item_21, ZComponent=list_item_23)  # -> Vector, Length
translation_3 = Panel(vector_xyz_2.Vector)
# TODO: fix weights
rotation_3 = Panel(vector_xyz.Vector)

# ----
panel_6 = Panel(multiplication_7)
panel_7 = Panel(multiplication_6)

panel_8 = Panel(c_script_3.frequency)

# ---- group: Total error - theoretical accuacy (0 = no distinguishable error)
# 6.Compute error for 95% of dimensions
R_3 = Vector(simplify(decompose_transformation_matrix.R))
vector_4 = Vector(simplify(vector_xyz.Vector))
T_3 = Vector(simplify(decompose_transformation_matrix.T))
vector_5 = Vector(simplify(vector_xyz_2.Vector))
bim_6 = Geometry(simplify(graft(bim_3)))
subtraction = Subtraction(A=T_3, B=vector_5)
subtraction_2 = Subtraction(A=R_3, B=vector_4)
bounding_box = BoundingBox(Content=bim_6, Plane=PlaneXY(0, 0, 0))  # -> simplify(Box), Box_2
accuracy_xyz = Panel(multiplication)
box_properties = BoxProperties(Box=bounding_box.Box)  # -> Center, expr("0.95*0.5*x", Diagonal), Area, Volume, Degeneracy
c_script_4 = CSharpScript(XYZ=simplify(box_properties.Diagonal), R=subtraction_2, t=subtraction)  # -> out, error_vector; inputs XYZ: Vector3d, R: Vector3d, t: Vector3d
# ---------- c_script_4: C# ----------
    var a = R[2];
    var b = R[1];
    var c = R[0];
    var x = XYZ[0];
    var y = XYZ[1];
    var z = XYZ[2];

    var Ex = Math.Cos(a) * Math.Cos(b) * x + (Math.Cos(a) * Math.Sin(b) * Math.Sin(c) - Math.Sin(a) * Math.Cos(c)) * y + (Math.Cos(a) * Math.Sin(b) * Math.Cos(c) + Math.Sin(a) * Math.Sin(c)) * z + t[0] - x;
    var Ey = Math.Sin(a) * Math.Cos(b) * x + (Math.Sin(a) * Math.Sin(b) * Math.Sin(c) + Math.Cos(a) * Math.Cos(c)) * y + (Math.Sin(a) * Math.Sin(b) * Math.Cos(c) - Math.Cos(a) * Math.Sin(c)) * z + t[1] - y;
    var Ez = -Math.Sin(b) * x + Math.Cos(b) * Math.Sin(c) * y + Math.Cos(b) * Math.Cos(c) * z + t[2] - z;

    error_vector = new Vector3d(Ex, Ey, Ez);
# ---------- end c_script_4 ----------
c_script_5 = CSharpScript(E=c_script_4.error_vector, sigma=multiplication)  # -> out, error_vector; inputs E: Vector3d, sigma: Double
# ---------- c_script_5: C# ----------
    var Ex = E[0];
    var Ey = E[1];
    var Ez = E[2];

    if (Math.Abs(E[0]) <= sigma)
    {
      Ex = 0.0;
    }
    if (Math.Abs(E[1]) <= sigma)
    {
      Ey = 0.0;
    }
    if (Math.Abs(E[2]) <= sigma)
    {
      Ez = 0.0;
    }

    error_vector = new Vector3d(Ex, Ey, Ez);
# ---------- end c_script_5 ----------
_95_error_vector = Vector(expr("round(x,3)", c_script_5.error_vector))
panel_9 = Panel(c_script_4.error_vector)

# ----
# TODO: think about internal dimensions
# Transform point cloud with T'
pcd_4 = Cloud(pcd_2)
create_transformation_matrix = CreateTransformationMatrix(R=vector_4, T=vector_5)  # -> simplify(Tform)
move_5 = Move(Geometry=pcd_4, Motion=vector)  # -> Geometry, Transform
construct_matrix = ConstructMatrix(Rows=4, Columns=4, Values=create_transformation_matrix)
transform = Transform(Geometry=move_5.Geometry, Transform=construct_matrix)
move_6 = Move(Geometry=transform, Motion=expr("-x", vector))  # -> Geometry, Transform
pcd_5 = Cloud(move_6.Geometry)

T_4 = Vector(simplify(pcd_5))
R_4 = Vector(simplify(c_script_4.error_vector))
tree_branch_18 = TreeBranch(Tree=R_4, Path=list_item_9, MaintainPaths=True)
tree_branch_19 = TreeBranch(Tree=pcd_5, Path=list_item_9, MaintainPaths=True)
# IMPORTANT: inlierratio should be 1, iterations >20 (60) otherwise errorenous ICP. downsampling doesn't hurt
# The ICP isn't very robust. In poorly distributed datasets, a 5cm translation is the maximum correct T
obesrved_2 = Panel(tree_branch_19)
obesrved_3 = Panel(tree_branch_18)

# ---- group: Compute distance and retain points within bufferzone
# 1. Segment Point cloud
interval = Number([0.015, 0.03, 0.05])
key_2 = Key("D")
construct_domain_2 = ConstructDomain(DomainStart=expr("-x", interval), DomainEnd=interval)
mesh_compare_2 = MeshCompare(Cloud=pcd_5, Mesh=bim_3, Key=key_2)
cullc_2 = CullCloud(Cloud=mesh_compare_2, Key=key_2, Domain=construct_domain_2)  # -> simplify(graft(Cloud))

# ----
panel_10 = Panel(subtraction_2)
shift_paths_18 = ShiftPaths(Data=cullc_2, Offset=-1)
panel_11 = Panel(box_properties.Diagonal)
cloud_statistics = CloudStatistics(Cloud=mesh_compare_2)  # -> Count, Colors, Colors_2
get_data_2 = GetData(Cloud=shift_paths_18, Key=key_2)
duplicate_data_2 = DuplicateData(Data=cloud_statistics.Count, Number=3, Order=True)
# compute signed distance
list_length_15 = ListLength(List=get_data_2)
panel_12 = Panel(_95_error_vector)
shift_paths_19 = ShiftPaths(Data=list_length_15, Offset=-1)

# ---- group: Colorize point cloud
# Visualise D
bounds_2 = Bounds(Cloud=mesh_compare_2, Key=key_2)
range_2 = Range(Domain=Domain(0, 0.7), Steps=4)
div_2 = DivideDomain(Domain=bounds_2, Count=4)
gradient_2 = Gradient(
    LowerLimit=0,
    UpperLimit=1,
    Parameter=range_2,
    stops=[0.246: RGB(0, 128, 0), 0.5: RGB(255, 255, 0), 0.695: RGB(255, 0, 0)])
dedomain_2 = DeconstructDomain(Domain=div_2)  # -> Start, End
item_2 = ListItem(List=dedomain_2.End, Index=-1, Wrap=True)
merge_8 = Merge(Data1=dedomain_2.Start, Data2=item_2)
prevdata_2 = PreviewData(Cloud=mesh_compare_2, Key=key_2, Values=merge_8, Colors=gradient_2)

# ----
division_3 = Division(A=shift_paths_19, B=duplicate_data_2)
panel_13 = Panel(division_3)
