# Grasshopper definition PCD_segmentation_fine5.gh (Grasshopper 1.0.7)
# plug-ins: Volvox, EleFront, MeshEdit Components, Scan2BIM, Rhino.Inside for Autodesk Revit

# ----
# Exagerated drift parameters
number_slider = Slider(0.025, range=0..0.05)
number_slider_2 = Slider(0.03, range=0..0.05)
number_slider_3 = Slider(0.02, range=0..0.05)
angle = Slider(3.5, range=0..5)

# ----
# Exagerated displacement parameters
number_slider_4 = Slider(0.1, range=0..0.2)
angle_2 = Slider(7, range=0..10)

# ---- group: georeferencing error
vector_xyz = VectorXYZ(XComponent=Slider(0.03, range=0..0.05), YComponent=Slider(0.02, range=0..0.05), ZComponent=Slider(0.04, range=0..0.05))  # -> Vector, Length
# Translation
georefvector = Vector(vector_xyz.Vector)

# ---- group: Export *.e57 point cloud
geometry = Geometry()
# Why is value '1.95sigma3D' set to 1.3?
file_path = FilePath("D:\Data\2020-08 Sample PM\Week34\PCD_TLS_Segmented.e57")
save_e57 = SaveE57(FilePath=file_path, Scans=geometry, Spherical=False, Run=Button(), Abort=False)

# ----
tlspcd = Cloud()
graphical_element = GraphicalElement(<graphical element referenced from the Revit model>)
element_geometry = ElementGeometry(Element=graphical_element)

# ---- group: INPUTS
# PCD
# BIM
# %Subsampling
# Offset Bufferzone D in m
# % surface area for detection
# 3D point accuracy (m)
# Influence zone
# transformation
# Threshold accuracy
# transformation
k_neighbors = Slider(10, range=0..30)
neighbor_distance = Slider(10, range=0..30)
number_slider_5 = Slider(0.01, range=0..0.01)
# min number of points
number_slider_6 = Slider(0.1, range=0..1)
number_slider_7 = Slider(0.01, range=0..1)
number_slider_8 = Slider(0.2, range=0..1)
multiplication = Multiplication(A=Slider(0.014, range=0..0.1), _195Sigma3D=1.3)
activate = Button()

# ---- group: use cloud in rhino
random_subsampling = RandomSubsampling(Percent=number_slider_7, Seed=123)
cloud = Cloud(<cloud referenced from the Rhino model>)
cloud_enginex = CloudEngineX(Cloud=cloud, Run=False, Abort=False, Instruction0=random_subsampling, showinfo=True)

# ----
geometry_2 = Geometry(simplify(graft([<brep referenced from the Rhino model> x129])))
directory_pcd = FilePath("D:\Data\2020-08 Sample PM\PCD\")
r_t = Relay()
directory_pcd_phot = FilePath("D:\Data\2020-08 Sample PM\Week34\week34_photogrammetry_terrestrial.e57")
directory_bim_samples = FilePath("D:\Data\2020-08 Sample PM\Week34\Week34_BIM_sampled.e57")
directory_pcd_tls = FilePath("D:\Data\2020-08 Sample PM\Week34\week34_lidar_CCprocessed.e57")
activate_2 = Button()

# ---- group: Data I/O
# 0. Import Point cloud
text = Text("PCD_Segmented.e57")
concatenate = Concatenate(FragmentA=directory_pcd, FragmentB=text)
load_e57 = LoadE57(FilePath=directory_pcd_tls, Index=-1, Percent=number_slider_7, Run=activate, Abort=False, Check=False)  # -> Cloud, Pose
merge_clouds = MergeClouds(Cloud=load_e57.Cloud)

pcd_normals = PCD_normals(PointCloud=merge_clouds, K=6)

# ----
compute_normals = ComputeNormals(PointCloud=merge_clouds, K=6)

# ---- group: Data I/O
# 0. Import BIM sampled
load_e57_2 = LoadE57(FilePath=directory_bim_samples, Index=-1, Percent=1, Run=activate_2, Abort=False, Check=False)  # -> Cloud, Pose
merge_clouds_2 = MergeClouds(Cloud=load_e57_2.Cloud)

# ----
compute_normals_2 = ComputeNormals(PointCloud=merge_clouds_2, K=6)

# ---- group: Compute distance and retain points within bufferzone
# 1. Segment Point cloud
key = Key("D")
construct_domain = ConstructDomain(DomainStart=expr("-x", number_slider_8), DomainEnd=number_slider_8)
mesh_compare = MeshCompare(Cloud=compute_normals_2, Mesh=geometry_2, Key=key)
cullc = CullCloud(Cloud=mesh_compare, Key=key, Domain=construct_domain)  # -> simplify(graft(Cloud))

# ---- group: Colorize point cloud
# Visualise D
bounds = Bounds(Cloud=cullc, Key=key)
range = Range(Domain=Domain(0, 0.7), Steps=4)
div = DivideDomain(Domain=bounds, Count=4)
gradient = Gradient(LowerLimit=0, UpperLimit=1, Parameter=range, stops=[0.246: RGB(0, 128, 0), 0.5: RGB(255, 255, 0), 0.695: RGB(255, 0, 0)])
dedomain = DeconstructDomain(Domain=div)  # -> Start, End
item = ListItem(List=dedomain.End, Index=-1, Wrap=True)
merge = Merge(Data1=dedomain.Start, Data2=item)
prevdata = PreviewData(Cloud=cullc, Key=key, Values=merge, Colors=gradient)

# ----
# 1. Segment BIM samples
mesh_compare_2 = MeshCompare(Cloud=compute_normals_2, Mesh=geometry_2, Key=key)
construct_domain_2 = ConstructDomain(DomainStart=expr("-x", number_slider_8), DomainEnd=number_slider_8)
cullc_2 = CullCloud(Cloud=mesh_compare_2, Key=key, Domain=construct_domain_2)  # -> simplify(graft(Cloud))

# ---- group: Romove objects/PCD that doesn't meet t% observed
# D. Filter
bim = Geometry(simplify(geometry_2))
bimcloud = Geometry(simplify(cullc_2))
cloud_statistics = CloudStatistics(Cloud=cullc)  # -> Count, Colors, Colors_2
larger_than = LargerThan(FirstNumber=cloud_statistics.Count, SecondNumber=Slider(700, range=0..1000))  # -> LargerThan, OrEqualTo
dispatch = Dispatch(List=cullc, DispatchPattern=larger_than.LargerThan)  # -> ListA, ListB
clean_par = CleanParallel(PrimaryData=dispatch.ListA, SecondaryDataSecondaryData1=bim, SecondaryData1=bimcloud, removeEmpty=True)  # -> PrimaryData, SecondaryDataSecondaryData1, SecondaryData1

bimpcd = Geometry(simplify(clean_par.SecondaryData1))
bim_2 = Geometry(simplify(clean_par.SecondaryDataSecondaryData1))
pcd = Cloud(clean_par.PrimaryData)

# ----
cloud_2 = Cloud(pcd)
photpcd = Cloud(cloud_2)
bimpcd_2 = Cloud(bimpcd)

percentage_of_elements_to_move = Slider(10, range=0..100)
tree_statistics = TreeStatistics(Tree=bimpcd_2)  # -> Paths, Length, Count
multiplication_2 = Multiplication(A=percentage_of_elements_to_move, B=tree_statistics.Count)
number = Number(expr("round(x/100,0)", multiplication_2))
random = Random(Range=tree_statistics.Count, Number=number, Seed=2, Integers=True)  # -> flatten(Random)

# ----
# Apply T+R
sort_list = SortList(Keys=random)  # -> Keys, ValuesValuesA
delete_consecutive = DeleteConsecutive(Set=sort_list.Keys, Wrap=False)  # -> flatten(Set), Count
list_length = ListLength(List=delete_consecutive.Set)

max_displacement_individual_element = Slider(0.04, range=0..0.07)
random_2 = Random(Range=number_slider_4, Number=list_length, Seed=3)  # -> flatten(Random)
random_3 = Random(Range=number_slider_4, Number=list_length, Seed=2)  # -> flatten(Random)
random_4 = Random(Range=number_slider_4, Number=list_length, Seed=4)  # -> flatten(Random)
vector_xyz_2 = VectorXYZ(XComponent=random_3, YComponent=random_2, ZComponent=random_4)  # -> Vector, Length

# ----
# Translation + Rotation
# -> simulate wrongly place elements
max_rotation_individual_element = Slider(5, range=0..10)
number_2 = Number(expr("x/180*pi", angle_2))
random_5 = Random(Range=number_2, Number=list_length, Seed=4, Integers=False)  # -> flatten(Random)

vector = Vector(expr("round(x,3)", vector_xyz_2.Vector))
number_3 = Number(expr("x/pi*180", random_5))

bim_3 = Geometry(bim_2)

# ---- group: create 129 0-vectors
bim_4 = Geometry(bim_3)
mesh_area = MeshArea(Mesh=bim_4)  # -> Area, Centroid
curve = Curve(<curve referenced from the Rhino model>)
vector_xyz_3 = VectorXYZ(XComponent=0, YComponent=0, ZComponent=0)  # -> Vector, Length
curve_closest_point = CurveClosestPoint(Point=mesh_area.Centroid, Curve=curve)  # -> Point, expr("x*0", Parameter), Distance
multiplication_3 = Multiplication(A=curve_closest_point.Parameter, B=vector_xyz_3.Vector)

# ----
cloud_statistics_2 = CloudStatistics(Cloud=bimpcd)  # -> Count, Colors, Colors_2
mesh_area_2 = MeshArea(Mesh=bim_2)  # -> Area, Centroid

# ---- group: Data I/O
pcd_normals_2 = PCD_normals(PointCloud=merge_clouds_2, K=6)

# ----
division = Division(A=cloud_statistics_2.Count, B=mesh_area_2.Area)
panel = Panel(division)

# ---- group: Data I/O out
text_2 = Text("PCD_Segmented")  # disabled
concatenate_2 = Concatenate(FragmentB=text_2)  # disabled
relay = Relay()  # disabled
# IMPORTANT: inlierratio should be 1, iterations >20 (60) otherwise errorenous ICP. downsampling doesn't hurt
# The ICP isn't very robust. In poorly distributed datasets, a 5cm translation is the maximum correct T
save_e57_2 = SaveE57(FilePath=concatenate_2, Scans=relay, Spherical=False, Run=True, Abort=False)  # disabled

# ----
domain = Domain([Domain(0, 0.015), Domain(0.015, 0.05), Domain(0.05, 999)])
neighbour_distance = Slider(10, range=1..25)
k_neighbours = Slider(10, range=1..25)
colour = Colour([RGB(0, 255, 0), RGB(255, 185, 0), RGB(255, 0, 0)])

gt_loa10_elementsnr = Panel("""1
4
14
21
99
103""")
gt_nrelementsperloa = Panel("""6
5
118""")
gt_loa20_elementsnr = Panel("""29
40
52
57
127""")

define_layer = DefineLayer(Name="TLS_Rel")

# ---- group: Drift
geometry_3 = Geometry(<curve referenced from the Rhino model>)
vector_xyz_4 = VectorXYZ(XComponent=Slider(0.015, range=0..0.05), YComponent=Slider(0.02, range=0..0.05), ZComponent=Slider(0, range=0..0.05))  # -> Vector, Length
driftvector = Vector(vector_xyz_4.Vector)

# ----
# Rotation
# (only for drift, not for georeferencing)
# (only around z-axis)
angle_3 = Slider(1, range=0..2)

bim_5 = Geometry(bim_3)

# ---- group: Drift (continued)
# Dataset overview: BIM
# BIM dataset (converted to mesh geometry)
# 
# BIMPCD
# BIM dataset (converted to PCD)
# 
# BIMPCD_GT
# Ground truth BIM dataset (PCD) with only the additional errors (Tx) applied to represent a realistic dataset with incorrectly placed elements
# 
# BIMPCDd
# Deformed (Tlocal) BIM dataset (PCD) that represents a measured PCD dataset with drift
# 
# BIMPCDdt
# Deformed (Tlocal) ánd shifted (Tgeneral) BIM dataset (PCD) that represents an almost correctly georeferenced measured PCD dataset with drift
# 
# BIMPCDdtw
# Deformed (Tlocal) ánd shifted (Tgeneral) BIM dataset (PCD) that represents an almost correctly georeferenced measured PCD dataset with drift. Additional errors (Tw) are added at element level to represent a realistic dataset with incorrectly placed elements
# 
# PHOTTLSPCD
# Photogrammetric/TLS dataset to show that the algorithm can handle that data as well
mesh_area_3 = MeshArea(Mesh=bim_5)  # -> Area, Centroid
curve_closest_point_2 = CurveClosestPoint(Point=mesh_area_3.Centroid, Curve=reparameterize(geometry_3))  # -> Point, Parameter, Distance
multiplication_4 = Multiplication(A=curve_closest_point_2.Parameter, B=driftvector)

# ----
addition = Addition(A=multiplication_4, B=georefvector)
tlocal_tgeneral = Move(Geometry=bimpcd_2, Motion=addition)  # -> Geometry, Transform
tlocal = Move(Geometry=bimpcd_2, Motion=multiplication_4)  # -> Geometry, Transform
applied_translation = Panel(addition)

bim_6 = Geometry(bim_5)
R = Number(simplify(graft(number_3)))
tree_statistics_2 = TreeStatistics(Tree=R)  # -> Paths, Length, Count

mesh_area_4 = MeshArea(Mesh=bim_5)  # -> Area, Centroid
curve_closest_point_3 = CurveClosestPoint(Point=mesh_area_4.Centroid, Curve=reparameterize(geometry_3))  # -> Point, Parameter, Distance

tree_statistics_3 = TreeStatistics(Tree=curve_closest_point_3.Parameter)  # -> Paths, Length, Count
list_item = ListItem(List=tree_statistics_3.Paths, Index=59, Wrap=True)
split_tree = SplitTree(Data=curve_closest_point_3.Parameter, Masks=flatten(list_item))  # -> Positive, Negative
construct_path = ConstructPath(Indices=95)
create_tree = CreateTree(Data=0, Path=construct_path)
merge_2 = Merge(Data1=split_tree.Negative, Data2=create_tree)

multiplication_5 = Multiplication(A=merge_2, B=angle_3)

panel_2 = Panel(tree_statistics_3.Paths)

# ----
# Introduce local errors
tlocal_tgeneral_2 = Move(Geometry=bimpcd_2, Motion=georefvector)  # -> Geometry, Transform
vector_xyz_5 = VectorXYZ(XComponent=0, YComponent=0, ZComponent=multiplication_5)  # -> Vector, Length

average = Average(Cloud=tlocal_tgeneral.Geometry, Percent=1)
average_2 = Average(Cloud=tlocal.Geometry, Percent=1)
rotate_3d = Rotate3D(Geometry=tlocal.Geometry, Angle=degrees(multiplication_5), Center=average_2, Axis=Vector(0, 0, 1))  # -> Geometry, Transform
rotate_3d_2 = Rotate3D(Geometry=tlocal_tgeneral.Geometry, Angle=degrees(multiplication_5), Center=average, Axis=Vector(0, 0, 1))  # -> Geometry, Transform
applied_rotation_rx_ry_rz = Panel(vector_xyz_5.Vector)

bimpcddt = Cloud(rotate_3d_2.Geometry)

bimpcddt_2 = Cloud(bimpcddt)
tree_statistics_4 = TreeStatistics(Tree=bimpcddt_2)  # -> Paths, Length, Count
list_item_2 = ListItem(List=tree_statistics_4.Paths, Index=delete_consecutive.Set, Wrap=True)
replace_paths = ReplacePaths(Data=R, Search=tree_statistics_2.Paths, Replace=list_item_2)
replace_paths_2 = ReplacePaths(Data=simplify(graft(vector)), Search=tree_statistics_2.Paths, Replace=list_item_2)
split_tree_2 = SplitTree(Data=bimpcddt_2, Masks=flatten(list_item_2))  # -> Positive, Negative
move = Move(Geometry=split_tree_2.Positive, Motion=replace_paths_2)  # -> Geometry, Transform
split_tree_3 = SplitTree(Data=bim_6, Masks=flatten(list_item_2))  # -> Positive, Negative
mesh_area_5 = MeshArea(Mesh=split_tree_3.Positive)  # -> Area, Centroid
rotate_3d_3 = Rotate3D(Geometry=move.Geometry, Angle=degrees(replace_paths), Center=mesh_area_5.Centroid, Axis=Vector(0, 0, 1))  # -> Geometry, Transform

vector_xyz_6 = VectorXYZ(XComponent=0, YComponent=0, ZComponent=replace_paths)  # -> Vector, Length
split_tree_4 = SplitTree(Data=multiplication_3, Masks=flatten(list_item_2))  # -> Positive, Negative
addition_2 = Addition(A=split_tree_4.Positive, B=vector_xyz_6.Vector)
merge_3 = Merge(Data1=addition_2, Data2=split_tree_4.Negative)

split_tree_5 = SplitTree(Data=multiplication_3, Masks=flatten(list_item_2))  # -> Positive, Negative
addition_3 = Addition(A=split_tree_5.Positive, B=replace_paths_2)
merge_4 = Merge(Data1=addition_3, Data2=split_tree_5.Negative)

# ----
# Ground Truth
gt_rotation = Panel(merge_3)
gt_translation = Panel(merge_4)
mesh_area_6 = MeshArea(Mesh=bim_4)  # -> Area, Centroid
bimpcd_3 = Cloud(bimpcd_2)
move_2 = Move(Geometry=bimpcd_3, Motion=merge_4)  # -> Geometry, Transform
rotate_3d_4 = Rotate3D(Geometry=move_2.Geometry, Angle=degrees(merge_3), Center=mesh_area_6.Centroid, Axis=Vector(0, 0, 1))  # -> Geometry, Transform

# ---- group: Conversion to radians
vector_2 = Vector(expr("x/180*pi", merge_3))

# ----
vector_xyz_7 = VectorXYZ(XComponent=0, YComponent=0, ZComponent=replace_paths)  # -> Vector, Length
split_tree_6 = SplitTree(Data=vector_xyz_5.Vector, Masks=flatten(list_item_2))  # -> Positive, Negative
addition_4 = Addition(A=split_tree_6.Positive, B=vector_xyz_7.Vector)
merge_5 = Merge(Data1=addition_4, Data2=split_tree_6.Negative)

split_tree_7 = SplitTree(Data=addition, Masks=flatten(list_item_2))  # -> Positive, Negative
addition_5 = Addition(A=split_tree_7.Positive, B=replace_paths_2)
merge_6 = Merge(Data1=addition_5, Data2=split_tree_7.Negative)

bimpcd_gt = Geometry(rotate_3d_4.Geometry)
bimpcdd = Cloud(rotate_3d.Geometry)
bimpcdt = Cloud(tlocal_tgeneral_2.Geometry)

# ----
# Combined translation from drift +
# georeferencing + incorrect placement
# Combined rotation from drift +
# georeferencing + incorrect placement
selected_elements = Panel(delete_consecutive.Set)
bimpcddtw_translation = Panel(merge_6)
bimpcddtw_rotation_rx_ry_rz = Panel(merge_5)
applied_translation_2 = Panel(vector)
merge_7 = Merge(Data1=rotate_3d_3.Geometry, Data2=split_tree_2.Negative)
applied_rotation = Panel(number_3)

bimpcddtw = Cloud(merge_7)

# ----
# Element T + R
# GROUND TRUTH
panel_3 = Panel("selected elements.txt")
run = Button()
file_path_2 = FilePath("D:\Data\2020-08 Sample PM\Week34\")
c_script = CSharpScript(path=file_path_2, filename=panel_3, text=selected_elements, Run=run)  # inputs path: String, filename: String, text: list of String, Run: Boolean
# ---------- c_script: C# ----------
    if (Run == true)
    {
      for (int i = 0;i < text.Count;i++)
        System.IO.File.WriteAllLines(path + "/" + filename, text);

    }
# ---------- end c_script ----------
c_script_2 = CSharpScript(path=file_path_2, filename="Applied translation.txt", text=applied_translation_2, Run=run)  # inputs path: String, filename: String, text: list of String, Run: Boolean; same code as c_script
c_script_3 = CSharpScript(path=file_path_2, filename="Applied rotation.txt", text=applied_rotation, Run=run)  # inputs path: String, filename: String, text: list of String, Run: Boolean; same code as c_script

t_observed = Number(number_slider_6)
bimpcd_4 = Cloud(bimpcd_2)
bim_7 = Geometry(bim_3)
pcd_2 = Cloud(bimpcddtw)

# ---- group: Applied T and R
T = Vector(merge_6)
R_2 = Vector(merge_5)

# ----
run_2 = Button()
file_path_3 = FilePath("D:\Data\2020-08 Sample PM\Week34\")
vector_3 = Vector(flatten(R_2))
c_script_4 = CSharpScript(path=file_path_3, filename="R_appl.txt", text=vector_3, Run=run_2)  # inputs path: String, filename: String, text: list of String, Run: Boolean; same code as c_script

run_3 = Button()
# Export to TXT
file_path_4 = FilePath("D:\Data\2020-08 Sample PM\Week34\")
vector_4 = Vector(flatten(T))
c_script_5 = CSharpScript(path=file_path_4, filename="T_appl.txt", text=vector_4, Run=run_3)  # inputs path: String, filename: String, text: list of String, Run: Boolean; same code as c_script

vector_5 = Vector(expr("x/180*pi", R_2))
multiplication_6 = Multiplication(A=merge_4, B=0)

# ---- group: Romove objects/PCD that doesn't meet t% observed
# D. Filter
bim_8 = Geometry(simplify(bim_7))
bimcloud_2 = Geometry(simplify(bimpcd_4))

# ----
# C.% of object Observed in XYZ
bimpcd_5 = Cloud(bimpcd_4)
voxel_colored = VoxelColored(Cloud=pcd_2, VoxelSize=number_slider_8)
construct_domain_3 = ConstructDomain(DomainStart=expr("-x", number_slider_8), DomainEnd=number_slider_8)
mesh_compare_3 = MeshCompare(Cloud=bimpcd_5, Mesh=voxel_colored, Key="D")
cullc_3 = CullCloud(Cloud=mesh_compare_3, Key="D", Domain=construct_domain_3)  # -> simplify(graft(Cloud))
bimpcd_6 = Cloud(pcd_2)
deconstruct_cloud = DeconstructCloud(Cloud=cullc_3)  # -> Points, simplify(Normals), Colors
deconstruct_cloud_2 = DeconstructCloud(Cloud=bimpcd_5)  # -> Points, simplify(Normals), Colors
distribute_vectors = DistributeVectors(Vectors=deconstruct_cloud.Normals, Strict=False)
distribute_vectors_2 = DistributeVectors(Vectors=deconstruct_cloud_2.Normals, Strict=False)

split_vectors = SplitVectors(Vectors=deconstruct_cloud.Normals, Strict=False)
split_vectors_2 = SplitVectors(Vectors=deconstruct_cloud_2.Normals, Strict=False)

list_length_2 = ListLength(List=split_vectors)
list_length_3 = ListLength(List=split_vectors_2)
division_2 = Division(A=list_length_2, B=list_length_3)
observed_xyz = Number(division_2)
observed_xyz_2 = Panel(observed_xyz)

# ---- group: Romove objects/PCD that doesn't meet t% observed (continued)
observed = Number(observed_xyz)
shift_paths = ShiftPaths(Data=observed, Offset=-1)
sort_list_2 = SortList(Keys=shift_paths)  # -> reverse(Keys), ValuesValuesA
list_item_3 = ListItem(List=sort_list_2.Keys, Index=0, Wrap=True)
larger_than_2 = LargerThan(FirstNumber=list_item_3, SecondNumber=t_observed)  # -> LargerThan, OrEqualTo
dispatch_2 = Dispatch(List=pcd_2, DispatchPattern=larger_than_2.LargerThan)  # -> ListA, ListB

# ----
panel_4 = Panel(dispatch_2.ListA)

# ---- group: A(xyz)
# A. Surface Area (XYZ)
mesh_explode = MeshExplode(Mesh=bim_7, Interpolate=False)  # -> simplify(Faces)
face_normals = FaceNormals(Mesh=bim_7)  # -> Centers, simplify(Normals)
# 2. PREPROCESS
mesh_area_7 = MeshArea(Mesh=mesh_explode)  # -> Area, Centroid
distribute_vectors_3 = DistributeVectors(Vectors=face_normals.Normals, Strict=False)
duplicate_data = DuplicateData(Data=mesh_area_7.Area, Number=3, Order=True)  # -> simplify(Data)
list_length_4 = ListLength(List=mesh_explode)
partition_list = PartitionList(List=duplicate_data, Size=list_length_4)

# ----
split_vectors_3 = SplitVectors(Vectors=face_normals.Normals, Strict=False)

# ---- group: A(xyz) (continued)
list_item_4 = ListItem(List=partition_list, Index=split_vectors_3, Wrap=True)
mass_addition = MassAddition(Input=list_item_4)  # -> Result, PartialResults
a_x_y_z = Number(mass_addition.Result)
a_x_y_z_2 = Panel(a_x_y_z)

# ---- group: Romove objects/PCD that doesn't meet t% observed (continued)
inertia_moment = Number(a_x_y_z)
surface_area = Number(a_x_y_z)
shift_paths_2 = ShiftPaths(Data=surface_area, Offset=-1)
shift_paths_3 = ShiftPaths(Data=inertia_moment, Offset=-1)
clean_parallel = CleanParallel(
    PrimaryData=dispatch_2.ListA,
    SecondaryDataSecondaryData1=bim_8,
    SecondaryData1=bimcloud_2,
    SecondaryData2=shift_paths,
    SecondaryData3=shift_paths_3,
    SecondaryData4=shift_paths_2,
    removeEmpty=True)  # -> PrimaryData, SecondaryDataSecondaryData1, SecondaryData1, SecondaryData2, SecondaryData3, SecondaryData4, SecondaryData5
path_mapper = PathMapper(clean_parallel.PrimaryData, source="{A}", target="{path_index}")
match_tree = MatchTree(Tree=clean_parallel.SecondaryDataSecondaryData1, Guide=path_mapper)
match_tree_2 = MatchTree(Tree=clean_parallel.SecondaryData1, Guide=path_mapper)
match_tree_3 = MatchTree(Tree=clean_parallel.SecondaryData2, Guide=path_mapper)
match_tree_4 = MatchTree(Tree=clean_parallel.SecondaryData3, Guide=path_mapper)
match_tree_5 = MatchTree(Tree=clean_parallel.SecondaryData4, Guide=path_mapper)

moment_of_inertia_ix_iy_iz = Number(match_tree_4)
surface_area_ax_ay_az = Number(match_tree_5)
observed_ox_oy_oz = Number(match_tree_3)
bimcloud_3 = Geometry(simplify(match_tree_2))
bim_9 = Geometry(simplify(match_tree))
pcd_3 = Cloud(path_mapper)

# ---- group: BIM pcd sampling
# 3.SAMPLE BIM (slow)
bim_10 = Geometry(bim_9)  # disabled
mesh_explode_2 = MeshExplode(Mesh=bim_10, Interpolate=False)  # -> simplify(Faces); disabled
c_script_6 = CSharpScript()  # -> out, A; inputs P1: list of Point3d, P2: list of Point3d; disabled
# ---------- c_script_6: C# usings ----------
using System.Linq;
# ---------- c_script_6: C# ----------
    // Point3d[] P = new Point3d[P1.Count];
    List<Point3d> result = new List<Point3d>();

    //
    //    P = V
    //      .Select((v, index) => index)
    //      .Where(index => Math.Abs(V[index].Y) >= Math.Abs(V[index].X) && Math.Abs(V[index].Y) >= Math.Abs(V[index].Z))
    //      .ToList();
    //
    //    for (int i = 0; i < P1.Count; i++)
    //    {
    //      var point = new Point3d((((P2[i].X - P1[i].X) / 2) + P1[i].X), (((P2[i].Y - P1[i].Y) / 2) + P1[i].Y), (((P2[i].Z - P1[i].Z) / 2) + P1[i].Z));
    //      P[i] = point;
    //    }

    var x1 = P1.Select(v => v.X).ToList();
    var y1 = P1.Select(v => v.Y).ToList();
    var z1 = P1.Select(v => v.Z).ToList();
    var x2 = P2.Select(v => v.X).ToList();
    var y2 = P2.Select(v => v.Y).ToList();
    var z2 = P2.Select(v => v.Z).ToList();


    for (int k = 0; k < P1.Count; k++)
    {
      result.Add(new Point3d((((x2[k] - x1[k]) / 2) + x1[k]), (((y2[k] - y1[k]) / 2) + y1[k]), (((z2[k] - z1[k]) / 2) + z1[k])));
    }
    A = result;
# ---------- end c_script_6 ----------
mesh_edges = MeshEdges(Mesh=mesh_explode_2)  # -> NakedEdges, InteriorEdges, NonManifoldEdges; disabled
length = Length(Curve=mesh_edges.NakedEdges)  # -> expr("10*x", Length); disabled
divide_curve = DivideCurve(Curve=mesh_edges.NakedEdges, Count=length, Kinks=False)  # -> Points, Tangents, Parameters; disabled
shift_paths_4 = ShiftPaths(Data=divide_curve.Points, Offset=-1)  # disabled
cross_reference = CrossReference(ListListA=shift_paths_4, ListListB=shift_paths_4, CrossMode=7)  # -> graft(ListListA), graft(ListListB); disabled
merge_8 = Merge(Data1=cross_reference.ListListA, Data2=cross_reference.ListListB)  # disabled
average_3 = Average(Input=merge_8)  # disabled
shift_paths_5 = ShiftPaths(Data=average_3, Offset=-2)  # disabled
construct_cloud = ConstructCloud(Points=shift_paths_5)  # -> simplify(Cloud); disabled
bim_cloud = Cloud(simplify(construct_cloud))  # disabled

# ----
geometry_4 = Geometry(flatten(bimcloud_3))
geometry_5 = Geometry(flatten(pcd_3))
merge_clouds_3 = MergeClouds(Cloud=geometry_4)
average_4 = Average(Cloud=merge_clouds_3, Percent=1)
average_5 = Average(Cloud=merge_clouds_3, Percent=1)  # -> expr("-x", Point)
vector_6 = Vector(expr("-x", simplify(graft(average_4))))
merge_clouds_4 = MergeClouds(Cloud=geometry_5)
average_6 = Average(Cloud=merge_clouds_4, Percent=1)  # -> expr("-x", Point)
move_3 = Move(Geometry=merge_clouds_3, Motion=vector_6)  # -> Geometry, Transform
move_4 = Move(Geometry=merge_clouds_4, Motion=vector_6)  # -> Geometry, Transform
move_5 = Move(Geometry=merge_clouds_4, Motion=average_6)  # -> Geometry, Transform
move_6 = Move(Geometry=merge_clouds_3, Motion=average_6)  # -> Geometry, Transform
surface_area_ax_ay_az_2 = Number(surface_area_ax_ay_az)
bim_11 = Geometry(simplify(bim_9))
pcd_4 = Cloud(pcd_3)
allign_two_point_clouds = AllignTwoPointClouds(
    PointCloudA=move_5.Geometry,
    PointCloudB=move_6.Geometry,
    Metric=0,
    InlierRatio=0.6,
    MaxIterations=100,
    DownsampleA=0.1,
    DownsampleB=0.5)  # -> Transform, RMSE

# ----
# 4. ICP global - project
icp_pointclouds2 = ICP_pointclouds2(
    Pc_moving=move_5.Geometry,
    Pc_fixed=move_6.Geometry,
    Metric=0,
    InlierRatio=1,
    MaxIterations=100,
    DownsamplePc_moving=1,
    DownsamplePc_fixed=1)  # -> Tform, Rmse
decompose_transformation_matrix = DecomposeTransformationMatrix(Tform=icp_pointclouds2.Tform)  # -> flatten(R), flatten(T)

decompose_transformation_matrix_2 = DecomposeTransformationMatrix(Transform=allign_two_point_clouds.Transform)  # -> R, T
translation_global = Panel(decompose_transformation_matrix_2.R)
rotation_global = Panel(decompose_transformation_matrix_2.T)

run_4 = Button()
vector_7 = Vector(expr("x/pi*180", flatten(decompose_transformation_matrix_2.R)))
# Export to TXT
file_path_5 = FilePath("D:\Data\2020-08 Sample PM\Week34\")
c_script_7 = CSharpScript(path=file_path_5, filename="R_glob.txt", text=vector_7, Run=run_4)  # inputs path: String, filename: String, text: list of String, Run: Boolean; same code as c_script

run_5 = Button()
file_path_6 = FilePath("D:\Data\2020-08 Sample PM\Week34\")
vector_8 = Vector(flatten(decompose_transformation_matrix_2.T))
c_script_8 = CSharpScript(path=file_path_6, filename="T_glob.txt", text=vector_8, Run=run_5)  # inputs path: String, filename: String, text: list of String, Run: Boolean; same code as c_script

# ---- group: Select influence zone
# Construct Adjacency matrix
bim_12 = Geometry(simplify(bim_9))
mesh_area_8 = MeshArea(Mesh=bim_12)  # -> Area, Centroid
closest_points = ClosestPoints(Point=mesh_area_8.Centroid, Cloud=flatten(mesh_area_8.Centroid), Count=k_neighbours)  # -> ClosestPoint, simplify(CPIndex), Distance
smaller_than = SmallerThan(FirstNumber=closest_points.Distance, SecondNumber=neighbour_distance)  # -> SmallerThan, OrEqualTo
dispatch_3 = Dispatch(List=closest_points.CPIndex, DispatchPattern=smaller_than.SmallerThan)  # -> simplify(ListA), ListB
panel_5 = Panel(dispatch_3.ListA)

# ----
neighbors = Number(dispatch_3.ListA)
list_item_5 = ListItem(List=flatten(bim_11), Index=neighbors, Wrap=True)
obesrved = Panel(neighbors)

# ---- group: Ix,Iy,Iz
surface_area_in_xyz = Number(surface_area_ax_ay_az)
tree_branch = TreeBranch(Tree=surface_area_in_xyz, Path=dispatch_3.ListA, MaintainPaths=False)
tree_statistics_5 = TreeStatistics(Tree=surface_area_in_xyz)  # -> Paths, Length, Count
list_length_5 = ListLength(List=dispatch_3.ListA)  # -> expr("3*x", flatten(Length))
partition_list_2 = PartitionList(List=flatten(tree_branch), Size=list_length_5)  # -> simplify(Chunks)
tree_statistics_6 = TreeStatistics(Tree=partition_list_2)  # -> Paths, Length, Count
replace_paths_3 = ReplacePaths(Data=partition_list_2, Search=tree_statistics_6.Paths, Replace=tree_statistics_5.Paths)
partition_list_3 = PartitionList(List=replace_paths_3, Size=3)  # -> simplify(graft(Chunks))
path_mapper_2 = PathMapper(partition_list_3, source="{A;B;C}", target="{A;C;B}")
shift_paths_6 = ShiftPaths(Data=path_mapper_2, Offset=-1)
ax_ay_az = Number(shift_paths_6)

# ---- group: ox,oy,oz
number_4 = Number(observed_ox_oy_oz)
tree_branch_2 = TreeBranch(Tree=number_4, Path=dispatch_3.ListA, MaintainPaths=False)
tree_statistics_7 = TreeStatistics(Tree=number_4)  # -> Paths, Length, Count
list_length_6 = ListLength(List=dispatch_3.ListA)  # -> expr("3*x", flatten(Length))
partition_list_4 = PartitionList(List=flatten(tree_branch_2), Size=list_length_6)  # -> simplify(Chunks)
tree_statistics_8 = TreeStatistics(Tree=partition_list_4)  # -> Paths, Length, Count
replace_paths_4 = ReplacePaths(Data=partition_list_4, Search=tree_statistics_8.Paths, Replace=tree_statistics_7.Paths)
partition_list_5 = PartitionList(List=replace_paths_4, Size=3)  # -> simplify(graft(Chunks))
path_mapper_3 = PathMapper(partition_list_5, source="{A;B;C}", target="{A;C;B}")
shift_paths_7 = ShiftPaths(Data=path_mapper_3, Offset=-1)
ox_oy_oz = Number(shift_paths_7)

# ---- group: Find largest element: floor
mass_addition_2 = MassAddition(Input=mesh_area_7.Area)  # -> Result, PartialResults
dispatch_4 = Dispatch(List=mass_addition_2.Result, DispatchPattern=larger_than_2.LargerThan)  # -> ListA, ListB
clean = CleanParallel(PrimaryData=dispatch_4.ListA)  # -> PrimaryData, SecondaryDataSecondaryData1
bounds_2 = Bounds(Numbers=flatten(clean.PrimaryData))
deconstruct_domain = DeconstructDomain(Domain=bounds_2)  # -> Start, End
path_mapper_4 = PathMapper(mass_addition_2.Result, source="{A}", target="{path_index}")
member_index = MemberIndex(Set=flatten(path_mapper_4), Member=deconstruct_domain.End)  # -> flatten(Index), Count

# ----
list_length_7 = ListLength(List=flatten(bim_9))
number_5 = Number(member_index.Index)
# bake geometry
series = Series(Start=0, Step=1, Count=list_length_7)  # -> simplify(graft(Series))
deconstruct_cloud_3 = DeconstructCloud(Cloud=pcd_3)  # -> Points, simplify(Normals), Colors
split_vectors_4 = SplitVectors(Vectors=deconstruct_cloud_3.Normals, Strict=False)
distribute_vectors_4 = DistributeVectors(Vectors=deconstruct_cloud_3.Normals, Strict=False)
list_length_8 = ListLength(List=split_vectors_4)

# ----
# find dominant transformation in vincinity of each object
# without relying on a single object's observations
# ERROR: in a falsely georeferenced dataset, each translation will be different (R remains the same)
R_3 = Vector()  # disabled
# NOTE: the RMSE of ICP gives an indication of the local error/parametric fit of the object.
# Given the coverage and the expected accuracy, one should be able to derive the local LOA
# NOTE: the difference in R and T gives an indication of the positioning error
T_2 = Vector()  # disabled
point_groups = PointGroups(Points=flatten(T_2), Distance=multiplication)  # -> simplify(Groups), Indices; disabled
point_groups_2 = PointGroups(Points=flatten(R_3), Distance=multiplication)  # -> Groups, Indices; disabled
list_item_6 = ListItem(List=observed_ox_oy_oz, Index=point_groups_2.Indices, Wrap=True)  # disabled
list_item_7 = ListItem(List=observed_ox_oy_oz, Index=point_groups.Indices, Wrap=True)  # disabled
mass_addition_3 = MassAddition(Input=list_item_7)  # -> Coverage, PartialResults; disabled
mass_addition_4 = MassAddition(Input=list_item_6)  # -> Coverage, PartialResults; disabled
list_length_9 = ListLength(List=point_groups_2.Groups)  # disabled
list_length_10 = ListLength(List=point_groups.Groups)  # disabled
invers_rmse = Number()  # disabled
multiplication_7 = Multiplication(A=list_item_6, B=invers_rmse)  # disabled
weighted_average = WeightedAverage(Input=point_groups_2.Groups, Weights=multiplication_7)  # disabled
invers_rmse_2 = Number()  # disabled
multiplication_8 = Multiplication(A=list_item_7, B=invers_rmse_2)  # disabled
weighted_average_2 = WeightedAverage(Input=point_groups.Groups, Weights=multiplication_8)  # disabled
multiplication_9 = Multiplication(A=list_length_10, B=mass_addition_3.Coverage, C=invers_rmse_2)  # disabled
multiplication_10 = Multiplication(A=list_length_9, B=mass_addition_4.Coverage, C=invers_rmse)  # disabled
sort_list_3 = SortList(Keys=flatten(multiplication_9), ValuesValuesA=flatten(weighted_average_2))  # -> Keys, reverse(ValuesValuesA); disabled
sort_list_4 = SortList(Keys=flatten(multiplication_10), ValuesValuesA=flatten(weighted_average))  # -> Keys, reverse(ValuesValuesA); disabled
list_item_8 = ListItem(List=sort_list_3.ValuesValuesA, Index=0, Wrap=True)  # disabled
list_item_9 = ListItem(List=sort_list_4.ValuesValuesA, Index=0, Wrap=True)  # disabled
vector_9 = Vector(simplify(list_item_9))  # disabled
rotation = Panel(vector_9)  # disabled
vector_10 = Vector(simplify(list_item_8))  # disabled
translation = Panel(vector_10)  # disabled

# ----
# create a spherical search area
bim_13 = Geometry(simplify(bim_9))  # disabled
bounding_box = BoundingBox(Content=bim_13, Plane=PlaneXY(0, 0, 0))  # -> Box, Box_2; disabled
construct_domain_4 = ConstructDomain(DomainStart=expr("-x", neighbor_distance), DomainEnd=neighbor_distance)  # disabled
box_properties = BoxProperties(Box=bounding_box.Box)  # -> Center, expr("0.5*x", Diagonal), Area, Volume, Degeneracy; disabled
domain_box = DomainBox(Base=simplify(box_properties.Center), X=construct_domain_4, Y=construct_domain_4, Z=construct_domain_4)  # disabled
pcd_5 = Cloud(pcd_3)  # disabled
mesh_area_9 = MeshArea(Mesh=bim_13)  # -> Area, Centroid; disabled
bimcloud_4 = Geometry(simplify(compute_normals_2))  # disabled
pcd_6 = Cloud(compute_normals)  # disabled
mesh_include = MeshInclude(Leave=True)  # disabled
sub_cloud = SubCloud()  # disabled
deconstruct_cloud_4 = DeconstructCloud()  # -> Points, Normals, Colors; disabled
sphere = Sphere(Base=box_properties.Center, Radius=neighbor_distance)  # -> simplify(Sphere); disabled
mesh_include_2 = MeshInclude(Leave=True)  # disabled
mesh_mesh = MeshMesh(MeshA=sphere, MeshB=flatten(bim_13))  # disabled
deconstruct_mesh = DeconstructMesh(Mesh=bim_13)  # -> Vertices, Faces, Colours, Normals; disabled
clash = Clash(Distance=1, ResultLimit=100)  # -> ClashCount, ClashPoints, ClashRadii, FirstIndex, SecondIndex; disabled

# ----
# 1. Segment BIM samples
mesh_compare_4 = MeshCompare(Cloud=compute_normals_2, Mesh=domain_box, Key=key)  # disabled
construct_domain_5 = ConstructDomain(DomainStart=expr("-x", number_slider_8), DomainEnd=number_slider_8)  # disabled
cullc_4 = CullCloud(Cloud=mesh_compare_4, Key=key, Domain=construct_domain_5)  # -> simplify(graft(Cloud)); disabled

# ---- group: Compute ICP T*R
# 4. ICP local - individual elements
number_slider_9 = Slider(1, range=0..1)
bim_cloud_2 = Cloud(bimcloud_3)
pcd_7 = Cloud(pcd_3)
average_7 = Average(Cloud=bim_cloud_2, Percent=1)
vector_11 = Vector(expr("-x", simplify(graft(average_7))))
move_7 = Move(Geometry=pcd_7, Motion=vector_11)  # -> Geometry, Transform
move_8 = Move(Geometry=bim_cloud_2, Motion=vector_11)  # -> Geometry, Transform
icp_pointclouds2_2 = ICP_pointclouds2(
    Pc_moving=move_7.Geometry,
    Pc_fixed=move_8.Geometry,
    Metric=0,
    InlierRatio=1,
    MaxIterations=100,
    DownsamplePc_moving=number_slider_9,
    DownsamplePc_fixed=1)  # -> simplify(Tform), simplify(Rmse)
decompose_transformation_matrix_3 = DecomposeTransformationMatrix(Tform=icp_pointclouds2_2.Tform)  # -> R, T

# ----
allign_two_point_clouds_2 = AllignTwoPointClouds(
    PointCloudA=move_7.Geometry,
    PointCloudB=move_8.Geometry,
    Metric=0,
    InlierRatio=0.6,
    MaxIterations=100,
    DownsampleA=0.1,
    DownsampleB=0.5)  # -> Transform, RMSE
panel_6 = Panel(icp_pointclouds2_2.Rmse)
decompose_transformation_matrix_4 = DecomposeTransformationMatrix(Transform=allign_two_point_clouds_2.Transform)  # -> R, T

T_3 = Vector(simplify(decompose_transformation_matrix_4.T))  # disabled
R_4 = Vector(simplify(decompose_transformation_matrix_4.R))  # disabled
add_data = AddData(Cloud=pcd_5, Key="T", Data=T_3)  # disabled
merge_clouds_5 = MergeClouds(Cloud=flatten(add_data))  # disabled
get_data = GetData(Cloud=merge_clouds_5, Key="T")  # disabled

vector_12 = Vector(expr("-round(x,4)", decompose_transformation_matrix_4.T))
vector_13 = Vector(expr("-round(x,4)/pi*180", decompose_transformation_matrix_4.R))

# ---- group: Compute ICP T*R (continued)
translation_2 = Panel(vector_12)
rotation_2 = Panel(vector_13)

# ----
run_6 = Button()
vector_14 = Vector(expr("x/pi*180", flatten(decompose_transformation_matrix_4.R)))
# Export to TXT
file_path_7 = FilePath("D:\Data\2020-08 Sample PM\Week34\")
c_script_9 = CSharpScript(path=file_path_7, filename="R_loc.txt", text=vector_14, Run=run_6)  # inputs path: String, filename: String, text: list of String, Run: Boolean; same code as c_script

run_7 = Button()
file_path_8 = FilePath("D:\Data\2020-08 Sample PM\Week34\")
vector_15 = Vector(flatten(decompose_transformation_matrix_4.T))
c_script_10 = CSharpScript(path=file_path_8, filename="T_loc.txt", text=vector_15, Run=run_7)  # inputs path: String, filename: String, text: list of String, Run: Boolean; same code as c_script

# ---- group: tx,ty,tz
T_4 = Vector(simplify(decompose_transformation_matrix_4.T))
deconstruct = Deconstruct(Point=T_4)  # -> XComponent, YComponent, ZComponent
merge_9 = Merge(Data1=deconstruct.XComponent, Data2=deconstruct.YComponent, Data3=deconstruct.ZComponent)
list_length_11 = ListLength(List=dispatch_3.ListA)  # -> expr("3*x", flatten(Length))
tree_statistics_9 = TreeStatistics(Tree=merge_9)  # -> Paths, Length, Count
tree_branch_3 = TreeBranch(Tree=merge_9, Path=dispatch_3.ListA, MaintainPaths=False)
partition_list_6 = PartitionList(List=flatten(tree_branch_3), Size=list_length_11)  # -> simplify(Chunks)
tree_statistics_10 = TreeStatistics(Tree=partition_list_6)  # -> Paths, Length, Count
replace_paths_5 = ReplacePaths(Data=partition_list_6, Search=tree_statistics_10.Paths, Replace=tree_statistics_9.Paths)
partition_list_7 = PartitionList(List=replace_paths_5, Size=3)  # -> simplify(graft(Chunks))
path_mapper_5 = PathMapper(partition_list_7, source="{A;B;C}", target="{A;C;B}")
shift_paths_8 = ShiftPaths(Data=path_mapper_5, Offset=-1)
tx_ty_tz = Number(shift_paths_8)

# ---- group: rx,ry,rz
R_5 = Vector(simplify(decompose_transformation_matrix_4.R))
deconstruct_2 = Deconstruct(Point=R_5)  # -> XComponent, YComponent, ZComponent
merge_10 = Merge(Data1=deconstruct_2.XComponent, Data2=deconstruct_2.YComponent, Data3=deconstruct_2.ZComponent)
list_length_12 = ListLength(List=dispatch_3.ListA)  # -> expr("3*x", flatten(Length))
tree_statistics_11 = TreeStatistics(Tree=merge_10)  # -> Paths, Length, Count
tree_branch_4 = TreeBranch(Tree=merge_10, Path=dispatch_3.ListA, MaintainPaths=False)
partition_list_8 = PartitionList(List=flatten(tree_branch_4), Size=list_length_12)  # -> simplify(Chunks)
tree_statistics_12 = TreeStatistics(Tree=partition_list_8)  # -> Paths, Length, Count
replace_paths_6 = ReplacePaths(Data=partition_list_8, Search=tree_statistics_12.Paths, Replace=tree_statistics_11.Paths)
partition_list_9 = PartitionList(List=replace_paths_6, Size=3)  # -> simplify(graft(Chunks))
path_mapper_6 = PathMapper(partition_list_9, source="{A;B;C}", target="{A;C;B}")
shift_paths_9 = ShiftPaths(Data=path_mapper_6, Offset=-1)
rx_ry_rz = Number(shift_paths_9)

# ---- group: Absolute
subtraction = Subtraction(A=decompose_transformation_matrix_4.R, B=decompose_transformation_matrix_2.R)
subtraction_2 = Subtraction(A=decompose_transformation_matrix_4.T, B=decompose_transformation_matrix_2.T)

# ----
# Evaluation box
observed_2 = Number(observed_ox_oy_oz)
T_5 = Vector(simplify(decompose_transformation_matrix_4.T))
R_6 = Vector(simplify(decompose_transformation_matrix_4.R))
tree_statistics_13 = TreeStatistics(Tree=bim_11)  # -> Paths, Length, Count
list_item_10 = ListItem(List=tree_statistics_13.Paths, Index=Slider(59, range=0..129), Wrap=True)
tree_branch_5 = TreeBranch(Tree=observed_2, Path=list_item_10, MaintainPaths=True)
tree_branch_6 = TreeBranch(Tree=T_5, Path=list_item_10, MaintainPaths=True)
tree_branch_7 = TreeBranch(Tree=bim_11, Path=list_item_10, MaintainPaths=True)
tree_branch_8 = TreeBranch(Tree=pcd_4, Path=list_item_10, MaintainPaths=True)
obesrved_2 = Panel(tree_branch_5)

tree_branch_9 = TreeBranch(Tree=list_item_5, Path=list_item_10, MaintainPaths=True)
tree_branch_10 = TreeBranch(Tree=R_6, Path=list_item_10, MaintainPaths=True)
t = Panel(tree_branch_6)
tree_branch_11 = TreeBranch(Tree=surface_area_ax_ay_az_2, Path=list_item_10, MaintainPaths=True)
area = Panel(tree_branch_11)

R_7 = Panel(tree_branch_10)

# ---- group: Ix,Iy,Iz
moment_of_inertia_i_xyz_a = Number(moment_of_inertia_ix_iy_iz)
list_length_13 = ListLength(List=dispatch_3.ListA)  # -> expr("3*x", flatten(Length))

# ----
# 5. COMPUTE DOMINANT TRANSFORMATION
# organise T,RMSE,Area,O and I per clique {clique;Type; index value}
# RMSE
# STAN: fix weights
# % observation
# Surface Area
# Moment of inertia
# TODO: fix inertia
mass_addition_5 = MassAddition(Input=moment_of_inertia_i_xyz_a)  # -> Result, PartialResults
division_3 = Division(A=moment_of_inertia_i_xyz_a, B=mass_addition_5.Result)
c_script_11 = CSharpScript(x=ox_oy_oz, w=1)  # -> out, simplify(A); inputs x: list of Double, w: Double
# ---------- c_script_11: C# ----------
    
    var result = new List<double>();
    if (x.Count != 0)
    {
      var temp = x.Max();
      if (temp != 0)
      {      result = x.Select(k => k / temp * w).ToList();
      }
      else
      { result = x;
      }

      A = result;
    }
# ---------- end c_script_11 ----------
number_6 = Number(number_slider_5)
c_script_12 = CSharpScript(x=rx_ry_rz, t_h=number_6)  # -> out, simplify(frequency); inputs x: list of Double, t_h: Double
# ---------- c_script_12: C# usings ----------
    using System.Linq;
# ---------- c_script_12: C# ----------
    int test = 0; ;
    List<int> lijst = new List<int>();
    for (int k = 0;k < x.Count; k++)
    {
      test = x
        .Where(v => Math.Abs(v - x[k]) <= t_h)
        .Count();
      lijst.Add(test);
    }
    frequency = lijst;
# ---------- end c_script_12 ----------
c_script_13 = CSharpScript(x=tx_ty_tz, t_h=number_6)  # -> out, simplify(frequency); inputs x: list of Double, t_h: Double; same code as c_script_12
c_script_14 = CSharpScript(x=ax_ay_az, w=1)  # -> out, simplify(A); inputs x: list of Double, w: Double
# ---------- c_script_14: C# ----------
    var result = new List<double>();
    if (x.Count != 0)
    {
      var temp = x.Max();
      if (temp != 0)
      {      result = x.Select(k => k / temp * w).ToList();
      }
      else
      { result = x;
      }

      A = result;
    }
# ---------- end c_script_14 ----------
panel_8 = Panel(ax_ay_az)
c_script_15 = CSharpScript(x=c_script_12.frequency, w=1)  # -> out, simplify(A); inputs x: list of Double, w: Double; same code as c_script_11
c_script_16 = CSharpScript(x=c_script_13.frequency, w=1)  # -> out, simplify(A); inputs x: list of Double, w: Double; same code as c_script_11
panel_9 = Panel(c_script_13.frequency)
w_i = Slider(0.3, range=0..1)
w_rmse = Slider(0.7, range=0..1)
w_f = Slider(1, range=0..1)
w_o = Slider(0.5, range=0..1)
w_a = Slider(0.26, range=0..1)
w_rmse_2 = Slider(0.7, range=0..1)
w_f_2 = Slider(1, range=0..1)
w_i_2 = Slider(0.3, range=0..1)
w_a_2 = Slider(0.26, range=0..1)
w_o_2 = Slider(0.5, range=0..1)

# ---- group: Ix,Iy,Iz (continued)
tree_branch_12 = TreeBranch(Tree=division_3, Path=dispatch_3.ListA, MaintainPaths=False)
tree_statistics_14 = TreeStatistics(Tree=division_3)  # -> Paths, Length, Count
partition_list_10 = PartitionList(List=flatten(tree_branch_12), Size=list_length_13)  # -> simplify(Chunks)
tree_statistics_15 = TreeStatistics(Tree=partition_list_10)  # -> Paths, Length, Count
replace_paths_7 = ReplacePaths(Data=partition_list_10, Search=tree_statistics_15.Paths, Replace=tree_statistics_14.Paths)
partition_list_11 = PartitionList(List=replace_paths_7, Size=3)  # -> simplify(graft(Chunks))
path_mapper_7 = PathMapper(partition_list_11, source="{A;B;C}", target="{A;C;B}")
shift_paths_10 = ShiftPaths(Data=path_mapper_7, Offset=-1)
ix_iy_iz = Number(shift_paths_10)

# ----
multiplication_11 = Multiplication(A=c_script_14.A, B=w_a)
multiplication_12 = Multiplication(A=c_script_16.A, B=w_f)
multiplication_13 = Multiplication(A=c_script_11.A, B=w_o)
multiplication_14 = Multiplication(A=c_script_15.A, B=w_f_2)

# ---- group: RMSE
rmse = Number(expr("abs(x)", mesh_area_8.Area))
tree_branch_13 = TreeBranch(Tree=rmse, Path=dispatch_3.ListA, MaintainPaths=False)
tree_statistics_16 = TreeStatistics(Tree=rmse)  # -> Paths, Length, Count
list_length_14 = ListLength(List=dispatch_3.ListA)  # -> expr("1*x", flatten(Length))
partition_list_12 = PartitionList(List=flatten(tree_branch_13), Size=list_length_14)  # -> simplify(Chunks)
tree_statistics_17 = TreeStatistics(Tree=partition_list_12)  # -> Paths, Length, Count
replace_paths_8 = ReplacePaths(Data=partition_list_12, Search=tree_statistics_17.Paths, Replace=tree_statistics_16.Paths)
list_length_15 = ListLength(List=partition_list_12)

# ----
panel_10 = Panel(rmse)

# ---- group: oyz,oxz,oxy
list_item_11 = ListItem(List=observed_ox_oy_oz, Index=[1, 2], Wrap=True)
list_item_12 = ListItem(List=observed_ox_oy_oz, Index=[0, 2], Wrap=True)
list_item_13 = ListItem(List=observed_ox_oy_oz, Index=[0, 1], Wrap=True)
list_length_16 = ListLength(List=dispatch_3.ListA)  # -> expr("3*x", flatten(Length))

# ----
mass_addition_6 = MassAddition(Input=list_item_13)  # -> Result, PartialResults
mass_addition_7 = MassAddition(Input=list_item_11)  # -> Result, PartialResults
mass_addition_8 = MassAddition(Input=list_item_12)  # -> Result, PartialResults

# ---- group: oyz,oxz,oxy (continued)
merge_11 = Merge(Data1=mass_addition_7.Result, Data2=mass_addition_8.Result, Data3=mass_addition_6.Result)
tree_branch_14 = TreeBranch(Tree=merge_11, Path=dispatch_3.ListA, MaintainPaths=False)
tree_statistics_18 = TreeStatistics(Tree=merge_11)  # -> Paths, Length, Count
partition_list_13 = PartitionList(List=flatten(tree_branch_14), Size=list_length_16)  # -> simplify(Chunks)
tree_statistics_19 = TreeStatistics(Tree=partition_list_13)  # -> Paths, Length, Count
replace_paths_9 = ReplacePaths(Data=partition_list_13, Search=tree_statistics_19.Paths, Replace=tree_statistics_18.Paths)
partition_list_14 = PartitionList(List=replace_paths_9, Size=3)  # -> simplify(graft(Chunks))
path_mapper_8 = PathMapper(partition_list_14, source="{A;B;C}", target="{A;C;B}")
shift_paths_11 = ShiftPaths(Data=path_mapper_8, Offset=-1)
oyz_oxz_oxy = Number(shift_paths_11)

list_item_14 = ListItem(List=surface_area_in_xyz, Index=[1, 2], Wrap=True)
list_item_15 = ListItem(List=surface_area_in_xyz, Index=[0, 2], Wrap=True)
list_item_16 = ListItem(List=surface_area_in_xyz, Index=[0, 1], Wrap=True)
list_length_17 = ListLength(List=dispatch_3.ListA)  # -> expr("3*x", flatten(Length))

# ----
mass_addition_9 = MassAddition(Input=list_item_15)  # -> Result, PartialResults
mass_addition_10 = MassAddition(Input=list_item_16)  # -> Result, PartialResults
mass_addition_11 = MassAddition(Input=list_item_14)  # -> Result, PartialResults

# ---- group: oyz,oxz,oxy (continued)
merge_12 = Merge(Data1=mass_addition_11.Result, Data2=mass_addition_9.Result, Data3=mass_addition_10.Result)
tree_branch_15 = TreeBranch(Tree=merge_12, Path=dispatch_3.ListA, MaintainPaths=False)
tree_statistics_20 = TreeStatistics(Tree=merge_12)  # -> Paths, Length, Count
partition_list_15 = PartitionList(List=flatten(tree_branch_15), Size=list_length_17)  # -> simplify(Chunks)
tree_statistics_21 = TreeStatistics(Tree=partition_list_15)  # -> Paths, Length, Count
replace_paths_10 = ReplacePaths(Data=partition_list_15, Search=tree_statistics_21.Paths, Replace=tree_statistics_20.Paths)
partition_list_16 = PartitionList(List=replace_paths_10, Size=3)  # -> simplify(graft(Chunks))
path_mapper_9 = PathMapper(partition_list_16, source="{A;B;C}", target="{A;C;B}")
shift_paths_12 = ShiftPaths(Data=path_mapper_9, Offset=-1)
ayz_axz_axy = Number(shift_paths_12)

list_item_17 = ListItem(List=division_3, Index=[1, 2], Wrap=True)
list_item_18 = ListItem(List=division_3, Index=[0, 2], Wrap=True)
list_item_19 = ListItem(List=division_3, Index=[0, 1], Wrap=True)
list_length_18 = ListLength(List=dispatch_3.ListA)  # -> expr("3*x", flatten(Length))

# ----
mass_addition_12 = MassAddition(Input=list_item_18)  # -> Result, PartialResults
mass_addition_13 = MassAddition(Input=list_item_19)  # -> Result, PartialResults
mass_addition_14 = MassAddition(Input=list_item_17)  # -> Result, PartialResults

# ---- group: oyz,oxz,oxy (continued)
merge_13 = Merge(Data1=mass_addition_14.Result, Data2=mass_addition_12.Result, Data3=mass_addition_13.Result)
tree_branch_16 = TreeBranch(Tree=merge_13, Path=dispatch_3.ListA, MaintainPaths=False)
tree_statistics_22 = TreeStatistics(Tree=merge_13)  # -> Paths, Length, Count
partition_list_17 = PartitionList(List=flatten(tree_branch_16), Size=list_length_18)  # -> simplify(Chunks)
tree_statistics_23 = TreeStatistics(Tree=partition_list_17)  # -> Paths, Length, Count
replace_paths_11 = ReplacePaths(Data=partition_list_17, Search=tree_statistics_23.Paths, Replace=tree_statistics_22.Paths)
partition_list_18 = PartitionList(List=replace_paths_11, Size=3)  # -> simplify(graft(Chunks))
path_mapper_10 = PathMapper(partition_list_18, source="{A;B;C}", target="{A;C;B}")
shift_paths_13 = ShiftPaths(Data=path_mapper_10, Offset=-1)
iyz_ixz_ixy = Number(shift_paths_13)

# ---- group: Total error - theoretical accuacy (0 = no distinguishable error)
# 6.Compute error for 95% of dimensions
bim_14 = Geometry(simplify(graft(bim_9)))
bounding_box_2 = BoundingBox(Content=bim_14, Plane=PlaneXY(0, 0, 0))  # -> simplify(Box), Box_2
accuracy_xyz = Panel(multiplication)
box_properties_2 = BoxProperties(Box=bounding_box_2.Box)  # -> Center, expr("0.95*0.5*x", Diagonal), Area, Volume, Degeneracy

# ----
duplicate_data_2 = DuplicateData(Data=replace_paths_8, Number=3, Order=True)
partition_list_19 = PartitionList(List=duplicate_data_2, Size=list_length_15)  # -> simplify(Chunks)
c_script_17 = CSharpScript(x=oyz_oxz_oxy, w=1)  # -> out, simplify(A); inputs x: list of Double, w: Double; same code as c_script_11
c_script_18 = CSharpScript(x=ayz_axz_axy, w=1)  # -> out, simplify(A); inputs x: list of Double, w: Double; same code as c_script_11
c_script_19 = CSharpScript(x=ix_iy_iz, w=1)  # -> out, simplify(A); inputs x: list of Double, w: Double; same code as c_script_11
c_script_20 = CSharpScript(x=iyz_ixz_ixy, w=1)  # -> out, simplify(A); inputs x: list of Double, w: Double; same code as c_script_11
panel_11 = Panel(c_script_20.A)

# ---- group: RMSE (continued)
rmse_2 = Number(expr("1/x", partition_list_19))

# ----
multiplication_15 = Multiplication(A=c_script_19.A, B=w_i)
multiplication_16 = Multiplication(A=c_script_20.A, B=w_i_2)
multiplication_17 = Multiplication(A=c_script_18.A, B=w_a_2)
multiplication_18 = Multiplication(A=c_script_17.A, B=w_o_2)

run_8 = Button()
file_path_9 = FilePath("D:\Data\2020-08 Sample PM\Week34\Elements_LOA\")

c_script_21 = CSharpScript(x=rmse_2, w=1)  # -> out, simplify(A); inputs x: list of Double, w: Double; same code as c_script_11

multiplication_19 = Multiplication(A=c_script_21.A, B=w_rmse)
multiplication_20 = Multiplication(A=c_script_21.A, B=w_rmse_2)

# ---- group: Compute dominant transformation
addition_6 = Addition(RMSE=multiplication_20, B=multiplication_14, C=multiplication_18, D=multiplication_16, E=multiplication_17)
addition_7 = Addition(RMSE=multiplication_19, B=multiplication_12, C=multiplication_13, D=multiplication_15, E=multiplication_11)
sort_list_5 = SortList(Keys=addition_7, ValuesValuesA=tx_ty_tz)  # -> reverse(Keys), reverse(ValuesValuesA)
sort_list_6 = SortList(Keys=addition_6, ValuesValuesA=rx_ry_rz)  # -> reverse(Keys), reverse(ValuesValuesA)
list_item_20 = ListItem(List=sort_list_5.ValuesValuesA, Index=0, Wrap=True)
list_item_21 = ListItem(List=sort_list_6.ValuesValuesA, Index=0, Wrap=True)
tx_ty_tz_dominant = Number(list_item_20)
rx_ry_rz_dominant = Number(list_item_21)
shift_paths_14 = ShiftPaths(Data=tx_ty_tz_dominant, Offset=-1)
shift_paths_15 = ShiftPaths(Data=rx_ry_rz_dominant, Offset=-1)
list_item_22 = ListItem(List=shift_paths_14, Index=1, Wrap=True)
list_item_23 = ListItem(List=shift_paths_14, Index=0, Wrap=True)
list_item_24 = ListItem(List=shift_paths_14, Index=2, Wrap=True)
list_item_25 = ListItem(List=shift_paths_15, Index=1, Wrap=True)
list_item_26 = ListItem(List=shift_paths_15, Index=0, Wrap=True)
list_item_27 = ListItem(List=shift_paths_15, Index=2, Wrap=True)
vector_xyz_8 = VectorXYZ(XComponent=list_item_26, YComponent=list_item_25, ZComponent=list_item_27)  # -> Vector, Length
vector_xyz_9 = VectorXYZ(XComponent=list_item_23, YComponent=list_item_22, ZComponent=list_item_24)  # -> Vector, Length
translation_3 = Panel(vector_xyz_9.Vector)
rotation_3 = Panel(vector_xyz_8.Vector)

# ----
vector_16 = Vector(simplify(vector_xyz_8.Vector))
vector_17 = Vector(simplify(vector_xyz_9.Vector))

# ---- group: Relative
subtraction_3 = Subtraction(A=decompose_transformation_matrix_4.R, B=vector_16)
subtraction_4 = Subtraction(A=decompose_transformation_matrix_4.T, B=vector_17)

# ---- group: Total error - theoretical accuacy (0 = no distinguishable error) (continued)
R_8 = Vector(simplify(subtraction_3))
T_6 = Vector(simplify(subtraction_4))
c_script_22 = CSharpScript(XYZ=simplify(box_properties_2.Diagonal), R=R_8, t=T_6)  # -> error_vector; inputs XYZ: Vector3d, R: Vector3d, t: Vector3d
# ---------- c_script_22: C# ----------
    var a = R[2];
    var b = R[1];
    var c = R[0];
    var x = XYZ[0];
    var y = XYZ[1];
    var z = XYZ[2];

    var Ex = Math.Cos(a) * Math.Cos(b) * x + (Math.Cos(a) * Math.Sin(b) * Math.Sin(c) - Math.Sin(a) * Math.Cos(c)) * y + (Math.Cos(a) * Math.Sin(b) * Math.Cos(c) + Math.Sin(a) * Math.Sin(c)) * z + t[0] - x;
    var Ey = Math.Sin(a) * Math.Cos(b) * x + (Math.Sin(a) * Math.Sin(b) * Math.Sin(c) + Math.Cos(a) * Math.Cos(c)) * y + (Math.Sin(a) * Math.Sin(b) * Math.Cos(c) - Math.Cos(a) * Math.Sin(c)) * z + t[1] - y;
    var Ez = -Math.Sin(b) * x + Math.Cos(b) * Math.Sin(c) * y + Math.Cos(b) * Math.Cos(c) * z + t[2] - z;

    error_vector = new Vector3d(Ex, Ey, Ez);
# ---------- end c_script_22 ----------
c_script_23 = CSharpScript(E=c_script_22, sigma=multiplication)  # -> out, error_vector; inputs E: Vector3d, sigma: Double
# ---------- c_script_23: C# ----------
    var Ex = E[0];
    var Ey = E[1];
    var Ez = E[2];

    if (Math.Abs(E[0]) <= sigma)
    {
      Ex = 0.0;
    }
    else
    {
      Ex = Math.Abs(Ex) - sigma;
    }


    if (Math.Abs(E[1]) <= sigma)
    {
      Ey = 0.0;
    }
    else
    {
      Ey = Math.Abs(Ey) - sigma;;
    }


    if (Math.Abs(E[2]) <= sigma)
    {
      Ez = 0.0;
    }
    else
    {
      Ez = Math.Abs(Ez) - sigma;;
    }

    error_vector = new Vector3d(Ex, Ey, Ez);
# ---------- end c_script_23 ----------
_95_error_vector = Vector(expr("round(x,3)", c_script_23.error_vector))
panel_12 = Panel(c_script_23.error_vector)

# ----
c_script_24 = CSharpScript(path=file_path_9, filename="REL_error_vector.txt", text=flatten(_95_error_vector), Run=run_8)  # inputs path: String, filename: String, text: list of String, Run: Boolean; same code as c_script

run_9 = Button()
file_path_10 = FilePath("D:\Data\2020-08 Sample PM\Week34\Elements_LOA\")
c_script_25 = CSharpScript(path=file_path_10, filename="ABS_error_vector.txt", text=flatten(_95_error_vector), Run=run_9)  # inputs path: String, filename: String, text: list of String, Run: Boolean; same code as c_script

run_10 = Button()
file_path_11 = FilePath("D:\Data\2020-08 Sample PM\Week34\Elements_LOA\")
c_script_26 = CSharpScript(path=file_path_11, filename="GT_error_vector.txt", text=flatten(_95_error_vector), Run=run_10)  # inputs path: String, filename: String, text: list of String, Run: Boolean; same code as c_script

panel_13 = Panel(c_script_22)
_95_error_vector_2 = Vector(expr("round(x,3)", _95_error_vector))
_95_error_vector_3 = Vector(expr("round(abs(x),3)", _95_error_vector))

panel_14 = Panel(multiplication_20)

vector_length = VectorLength(Vector=_95_error_vector_2)
find_domain = FindDomain(Domains=domain, Number=vector_length, Strict=False)  # -> Index, Neighbour

c_script_27 = CSharpScript(inputList=flatten(find_domain.Index))  # -> elementsSum, nrElementsPerLOA, LOA10_elementsNr, LOA20_elementsNr, LOA30_elementsNr; inputs inputList: list of Int32
# ---------- c_script_27: C# ----------
    int sum = 0;
    int loa10 = 0;
    int loa20 = 0;
    int loa30 = 0;
    List <int> perLOA = new List<int>();
    List <int> loa10Elements = new List<int>();
    List <int> loa20Elements = new List<int>();
    List <int> loa30Elements = new List<int>();
    for (int i = 0; i < inputList.Count;i++)
    {
      sum += inputList[i];
      if (inputList[i] == 0) {loa30++; loa30Elements.Add(i);}
      if (inputList[i] == 1) {loa20++; loa20Elements.Add(i);}
      if (inputList[i] == 2) {loa10++; loa10Elements.Add(i);}
    }
    elementsSum = sum;
    perLOA.Add(loa10);
    perLOA.Add(loa20);
    perLOA.Add(loa30);

    nrElementsPerLOA = perLOA;
    LOA10_elementsNr = loa10Elements;
    LOA20_elementsNr = loa20Elements;
    LOA30_elementsNr = loa30Elements;
# ---------- end c_script_27 ----------
merge_14 = Merge(Data1=c_script_27.LOA10_elementsNr, Data2=c_script_27.LOA20_elementsNr)
sort_list_7 = SortList(Keys=merge_14)  # -> Keys, ValuesValuesA
loa10 = Panel(c_script_27.LOA10_elementsNr)
loa20 = Panel(c_script_27.LOA20_elementsNr)
panel_15 = Panel(c_script_27.nrElementsPerLOA)

list_item_28 = ListItem(List=colour, Index=find_domain.Index, Wrap=True)

# ---- group: For relative method only: colour floor element gray
tree_statistics_24 = TreeStatistics(Tree=list_item_28)  # -> Paths, Length, Count
list_item_29 = ListItem(List=tree_statistics_24.Paths, Index=number_5, Wrap=True)
colour_2 = Colour(RGB(196, 196, 196))
split_tree_8 = SplitTree(Data=list_item_28, Masks=flatten(list_item_29))  # -> Positive, Negative
construct_path_2 = ConstructPath(Indices=number_5)
create_tree_2 = CreateTree(Data=colour_2, Path=construct_path_2)
merge_15 = Merge(Data1=split_tree_8.Negative, Data2=create_tree_2)

# ----
define_object_attributes = DefineObjectAttributes(Name=series, Layer=define_layer, Color=merge_15, Material=merge_15)

# ----
# Relative
# BIMPCD_dtw
panel_16 = Panel("REL_LOA10_elementsNr.txt")
run_11 = Button()
file_path_12 = FilePath("D:\Data\2020-08 Sample PM\Week34\Elements_LOA\")
c_script_28 = CSharpScript(path=file_path_12, filename="REL_nrElementsPerLOA.txt", text=c_script_27.nrElementsPerLOA, Run=run_11)  # inputs path: String, filename: String, text: list of String, Run: Boolean; same code as c_script
c_script_29 = CSharpScript(path=file_path_12, filename=panel_16, text=c_script_27.LOA10_elementsNr, Run=run_11)  # inputs path: String, filename: String, text: list of String, Run: Boolean; same code as c_script
c_script_30 = CSharpScript(path=file_path_12, filename="REL_LOA20_elementsNr.txt", text=c_script_27.LOA20_elementsNr, Run=run_11)  # inputs path: String, filename: String, text: list of String, Run: Boolean; same code as c_script
c_script_31 = CSharpScript(path=file_path_12, filename="REL_LOA30_elementsNr.txt", text=c_script_27.LOA30_elementsNr, Run=run_11)  # inputs path: String, filename: String, text: list of String, Run: Boolean; same code as c_script

bake_objects = BakeObjects(Geometry=simplify(graft(bim_9)), Attributes=define_object_attributes, BakeName="TLS_Rel", Bake=False)

# ----
# Absolute
# BIMPCD_dtw
panel_17 = Panel("ABS_nrElementsPerLOA.txt")
run_12 = Button()
file_path_13 = FilePath("D:\Data\2020-08 Sample PM\Week34\Elements_LOA\")
c_script_32 = CSharpScript(path=file_path_13, filename=panel_17, text=c_script_27.nrElementsPerLOA, Run=run_12)  # inputs path: String, filename: String, text: list of String, Run: Boolean; same code as c_script
c_script_33 = CSharpScript(path=file_path_13, filename="ABS_LOA10_elementsNr.txt", text=c_script_27.LOA10_elementsNr, Run=run_12)  # inputs path: String, filename: String, text: list of String, Run: Boolean; same code as c_script
c_script_34 = CSharpScript(path=file_path_13, filename="ABS_LOA20_elementsNr.txt", text=c_script_27.LOA20_elementsNr, Run=run_12)  # inputs path: String, filename: String, text: list of String, Run: Boolean; same code as c_script
c_script_35 = CSharpScript(path=file_path_13, filename="ABS_LOA30_elementsNr.txt", text=c_script_27.LOA30_elementsNr, Run=run_12)  # inputs path: String, filename: String, text: list of String, Run: Boolean; same code as c_script

run_13 = Button()
# Export to TXT
file_path_14 = FilePath("D:\Data\2020-08 Sample PM\Week34\")
vector_18 = Vector(flatten(vector_xyz_9.Vector))
c_script_36 = CSharpScript(path=file_path_14, filename="T_loc_opt.txt", text=vector_18, Run=run_13)  # inputs path: String, filename: String, text: list of String, Run: Boolean; same code as c_script

run_14 = Button()
file_path_15 = FilePath("D:\Data\2020-08 Sample PM\Week34\")
vector_19 = Vector(flatten(vector_xyz_8.Vector))
c_script_37 = CSharpScript(path=file_path_15, filename="R_loc_opt.txt", text=vector_19, Run=run_14)  # inputs path: String, filename: String, text: list of String, Run: Boolean; same code as c_script

# ----
# GROUND_TRUTH
panel_18 = Panel("GT_nrElementsPerLOA.txt")
run_15 = Button()
file_path_16 = FilePath("D:\Data\2020-08 Sample PM\Week34\Elements_LOA\")
c_script_38 = CSharpScript(path=file_path_16, filename=panel_18, text=c_script_27.nrElementsPerLOA, Run=run_15)  # inputs path: String, filename: String, text: list of String, Run: Boolean; same code as c_script
c_script_39 = CSharpScript(path=file_path_16, filename="GT_LOA10_elementsNr.txt", text=c_script_27.LOA10_elementsNr, Run=run_15)  # inputs path: String, filename: String, text: list of String, Run: Boolean; same code as c_script
c_script_40 = CSharpScript(path=file_path_16, filename="GT_LOA20_elementsNr.txt", text=c_script_27.LOA20_elementsNr, Run=run_15)  # inputs path: String, filename: String, text: list of String, Run: Boolean; same code as c_script
c_script_41 = CSharpScript(path=file_path_16, filename="GT_LOA30_elementsNr.txt", text=c_script_27.LOA30_elementsNr, Run=run_15)  # inputs path: String, filename: String, text: list of String, Run: Boolean; same code as c_script

# ---- group: Total error - theoretical accuacy (0 = no distinguishable error)
# 6.Compute error for 95% of dimensions
R_9 = Vector(simplify(decompose_transformation_matrix_4.R))
vector_20 = Vector(simplify(vector_xyz_8.Vector))
T_7 = Vector(simplify(decompose_transformation_matrix_4.T))
vector_21 = Vector(simplify(vector_xyz_9.Vector))
bim_15 = Geometry(simplify(graft(bim_9)))
subtraction_5 = Subtraction(A=T_7, B=vector_21)
subtraction_6 = Subtraction(A=R_9, B=vector_20)
bounding_box_3 = BoundingBox(Content=bim_15, Plane=PlaneXY(0, 0, 0))  # -> simplify(Box), Box_2
box_properties_3 = BoxProperties(Box=bounding_box_3.Box)  # -> Center, expr("0.95*0.5*x", Diagonal), Area, Volume, Degeneracy
c_script_42 = CSharpScript(XYZ=simplify(box_properties_3.Diagonal), R=subtraction_6, t=subtraction_5)  # -> out, error_vector; inputs XYZ: Vector3d, R: Vector3d, t: Vector3d; same code as c_script_22
c_script_43 = CSharpScript(E=c_script_42.error_vector, sigma=multiplication)  # -> out, error_vector; inputs E: Vector3d, sigma: Double
# ---------- c_script_43: C# ----------
    var Ex = E[0];
    var Ey = E[1];
    var Ez = E[2];

    if (Math.Abs(E[0]) <= sigma)
    {
      Ex = 0.0;
    }
    if (Math.Abs(E[1]) <= sigma)
    {
      Ey = 0.0;
    }
    if (Math.Abs(E[2]) <= sigma)
    {
      Ez = 0.0;
    }

    error_vector = new Vector3d(Ex, Ey, Ez);
# ---------- end c_script_43 ----------
_95_error_vector_4 = Vector(expr("round(x,3)", c_script_43.error_vector))
panel_19 = Panel(_95_error_vector_4)

# ----
_95_error_vector_5 = Vector(expr("round(x,3)", _95_error_vector_4))

tree_branch_17 = TreeBranch(Tree=_95_error_vector_5, Path=list_item_10, MaintainPaths=True)
error = Panel(tree_branch_17)

panel_20 = Panel(T_7)
create_transformation_matrix = CreateTransformationMatrix(R=vector_20, T=vector_21)

# ----
# TODO: think about internal dimensions
# Transform point cloud with T'
pcd_8 = Cloud(pcd_3)
create_transformation_matrix_2 = CreateTransformationMatrix(R=vector_20, T=vector_21)  # -> simplify(Tform)
move_9 = Move(Geometry=pcd_8, Motion=vector_11)  # -> Geometry, Transform
construct_matrix = ConstructMatrix(Rows=4, Columns=4, Values=create_transformation_matrix_2)
transform = Transform(Geometry=move_9.Geometry, Transform=create_transformation_matrix)
move_10 = Move(Geometry=transform, Motion=expr("-x", vector_11))  # -> Geometry, Transform
pcd_9 = Cloud(move_10.Geometry)

pcd_10 = Cloud(move_10.Geometry)
tree_branch_18 = TreeBranch(Tree=pcd_10, Path=list_item_10, MaintainPaths=True)

# ----
# bake geometry
_95_error_vector_6 = Vector(expr("round(x,3)", _95_error_vector_4))
deconstruct_3 = Deconstruct(Point=_95_error_vector_6)  # -> expr("abs(x)", XComponent), expr("abs(x)", YComponent), expr("abs(x)", ZComponent)
list_length_19 = ListLength(List=flatten(bim_9))
vector_length_2 = VectorLength(Vector=_95_error_vector_6)
domain_2 = Domain([Domain(0, 0.0015), Domain(0.0015, 0.05), Domain(0.05, 999)])
find_domain_2 = FindDomain(Domains=domain_2, Number=deconstruct_3.XComponent, Strict=False)  # -> Index, Neighbour
find_domain_3 = FindDomain(Domains=domain_2, Number=deconstruct_3.YComponent, Strict=False)  # -> Index, Neighbour
find_domain_4 = FindDomain(Domains=domain_2, Number=deconstruct_3.ZComponent, Strict=False)  # -> Index, Neighbour
define_layer_2 = DefineLayer(Name="LOA_Z")
define_layer_3 = DefineLayer(Name="LOA_X")
define_layer_4 = DefineLayer(Name="LOA_Y")
series_2 = Series(Start=0, Step=1, Count=list_length_19)  # -> simplify(graft(Series))
find_domain_5 = FindDomain(Domains=domain_2, Number=vector_length_2, Strict=False)  # -> Index, Neighbour
define_layer_5 = DefineLayer(Name="LOA_total")
colour_3 = Colour([RGB(0, 255, 0), RGB(255, 128, 0), RGB(255, 0, 0)])
list_item_30 = ListItem(List=colour_3, Index=find_domain_2.Index, Wrap=True)
list_item_31 = ListItem(List=colour_3, Index=find_domain_3.Index, Wrap=True)
list_item_32 = ListItem(List=colour_3, Index=find_domain_4.Index, Wrap=True)
list_item_33 = ListItem(List=colour_3, Index=find_domain_5.Index, Wrap=True)
define_object_attributes_2 = DefineObjectAttributes(Name=series_2, Layer=define_layer_5, Color=list_item_33, Material=list_item_33)
define_object_attributes_3 = DefineObjectAttributes(Name=series_2, Layer=define_layer_3, Color=list_item_30, Material=list_item_30)
define_object_attributes_4 = DefineObjectAttributes(Name=series_2, Layer=define_layer_4, Color=list_item_31, Material=list_item_31)
define_object_attributes_5 = DefineObjectAttributes(Name=series_2, Layer=define_layer_2, Color=list_item_32, Material=list_item_32)
bake_objects_2 = BakeObjects(Geometry=simplify(graft(bim_9)), Attributes=define_object_attributes_2, BakeName="45", Bake=False)
bake_objects_3 = BakeObjects(Geometry=simplify(graft(bim_9)), Attributes=define_object_attributes_3, BakeName="46", Bake=False)
bake_objects_4 = BakeObjects(Geometry=simplify(graft(bim_9)), Attributes=define_object_attributes_4, BakeName="47", Bake=False)
bake_objects_5 = BakeObjects(Geometry=simplify(graft(bim_9)), Attributes=define_object_attributes_5, BakeName="48", Bake=False)

# ---- group: Absolute error: Compute most frequent LOA based on D
get_data_2 = GetData(Cloud=pcd_3, Key="D")  # -> expr("abs(x)", simplify(Values))
loa_domains = Domain([Domain(0.005, 0.015), Domain(0.015, 0.05), Domain(0.05, 1000000000)])
member = Member([0, 1, 2])
text_3 = Text(["LOA30", "LOA20", "LOA10"])

# ----
duplicate_data_3 = DuplicateData(Data=get_data_2, Number=3, Order=True)  # -> simplify(Data)
partition_list_20 = PartitionList(List=duplicate_data_3, Size=list_length_8)
list_item_34 = ListItem(List=partition_list_20, Index=distribute_vectors_4, Wrap=True)
sort_list_8 = SortList(Keys=list_item_34)  # -> Keys, reverse(ValuesValuesA)
# reporting 95% value is not correct due to noise
list_length_20 = ListLength(List=sort_list_8.Keys)  # -> expr("0.95*x", Length)
list_item_35 = ListItem(List=sort_list_8.Keys, Index=list_length_20, Wrap=True)

# ---- group: Absolute error: Compute most frequent LOA based on D (continued)
find_domain_6 = FindDomain(Domains=loa_domains, Number=list_item_34, Strict=False)  # -> Index, Neighbour
member_index_2 = MemberIndex(Set=find_domain_6.Index, Member=member)  # -> Index, Count
sort_list_9 = SortList(Keys=member_index_2.Count, ValuesValuesA=member)  # -> Keys, reverse(ValuesValuesA)
list_item_36 = ListItem(List=sort_list_9.ValuesValuesA, Index=0, Wrap=True)
absolute_loa = Panel(list_item_35)

# ----
# bake geometry
list_length_21 = ListLength(List=flatten(bim_9))
series_3 = Series(Start=0, Step=1, Count=list_length_21)  # -> simplify(graft(Series))
define_layer_6 = DefineLayer(Name="LOA_absolute")
colour_4 = Colour([RGB(0, 255, 0), RGB(255, 128, 0), RGB(255, 0, 0)])
list_item_37 = ListItem(List=colour_4, Index=list_item_36, Wrap=True)
define_object_attributes_6 = DefineObjectAttributes(Name=series_3, Layer=define_layer_6, Color=list_item_37, Material=list_item_37)
bake_objects_6 = BakeObjects(Geometry=simplify(graft(bim_9)), Attributes=define_object_attributes_6, BakeName="49", Bake=False)
