# Grasshopper definition PoC1.gh (Grasshopper 1.0.7)
# plug-ins: Volvox, EleFront

# ----
# inputs
wekk_22_pcd = Cloud(simplify(graft([<cloud referenced from the Rhino model> x33])))
wekk_26_pcd = Cloud(simplify(graft([<cloud referenced from the Rhino model> x33])))
wekk_32_pcd = Cloud(simplify(graft([<cloud referenced from the Rhino model> x33])))
buffer_walls = Mesh(simplify(graft([<mesh referenced from the Rhino model> x33])))
walls = Brep(simplify(graft([<brep referenced from the Rhino model> x33])))
number_slider = Slider(32, range=0..100)
list_item = ListItem(List=flatten(wekk_22_pcd), Index=number_slider, Wrap=True)
list_item_2 = ListItem(List=flatten(wekk_26_pcd), Index=number_slider, Wrap=True)
list_item_3 = ListItem(List=flatten(walls), Index=number_slider, Wrap=True)
list_item_4 = ListItem(List=flatten(buffer_walls), Index=number_slider, Wrap=True)
list_item_5 = ListItem(List=flatten(wekk_32_pcd), Index=number_slider, Wrap=True)

digit_scroller = DigitScroller(Scroller_Digits=12, Scroller_Prefix="Digit Scroller", Scroller_Radix=9, Scroller_Value=12)  # disabled
cloud_statistics = CloudStatistics(Cloud=wekk_32_pcd)  # -> Count, Colors, Colors_2

# ----
# 0. occlusion detection based on distance to cloud ( cloud = valid if 30% of observed geometry is within 10cm of point cloud (10pnt/m²)
# outputs
brep = Brep(simplify(graft(walls)))
cloud = Cloud(simplify(graft(wekk_32_pcd)))
box_properties = BoxProperties(Box=brep)  # -> Center, Diagonal, Area, Volume, Degeneracy
populate_geometry = PopulateGeometry(Geometry=brep, Count=expr("round(10*x,0)", box_properties.Area), Seed=1)  # -> simplify(Population)
construct_cloud = ConstructCloud(Points=populate_geometry)
closest_point = ClosestPoint(Cloud=cloud, Point=populate_geometry)  # -> Point, Normal, Color, Distance, Index
add_data = AddData(Cloud=construct_cloud, Key="Distance", Data=closest_point.Distance)
bounds = Bounds(Cloud=add_data, Key="Distance")
range = Range(Domain=bounds, Steps=5)
smaller_than = SmallerThan(FirstNumber=closest_point.Distance, SecondNumber=Slider(0.1, range=0..0.1))  # -> SmallerThan, OrEqualTo
gradient = Gradient(
    LowerLimit=0,
    UpperLimit=0.3,
    Parameter=range,
    stops=[0.16: RGB(0, 128, 0), 0.164: RGB(206, 152, 0), 0.175: RGB(255, 255, 0), 0.653: RGB(255, 255, 0), 0.871: RGB(255, 0, 0)])
mass_addition = MassAddition(Input=smaller_than.OrEqualTo)  # -> Result, PartialResults
list_length = ListLength(List=closest_point.Distance)
prevdata = PreviewData(Cloud=add_data, Key="Distance", Values=range, Colors=gradient)
division = Division(A=mass_addition.Result, B=list_length)
larger_than = LargerThan(FirstNumber=division, SecondNumber=Slider(0.2, range=0..1))  # -> LargerThan, OrEqualTo
observed = Panel(division)
dispatch = Dispatch(List=brep, DispatchPattern=larger_than.OrEqualTo)  # -> ListA, ListB
# cue for single faced walls is the location of the peaks. if they are not located around
# the bufferzones after ransac optimization or the difference between
# both peaks is to high=> single faced
dispatch_2 = Dispatch(List=closest_point.Point, DispatchPattern=larger_than.OrEqualTo)  # -> ListA, ListB
dispatch_3 = Dispatch(List=cloud, DispatchPattern=larger_than.OrEqualTo)  # -> ListA, ListB
occluded_walls = Brep(dispatch.ListB)
occluded_pcd = Cloud(dispatch_3.ListB)
point = Point(dispatch_2.ListB)
cloud_2 = Cloud(simplify(graft(dispatch_3.ListA)))
brep_2 = Brep(simplify(graft(dispatch.ListA)))
point_2 = Point(dispatch_2.ListA)

tree_branch = TreeBranch(Tree=populate_geometry, Path=digit_scroller, MaintainPaths=True)  # disabled
tree_branch_2 = TreeBranch(Tree=cloud_2, Path=digit_scroller, MaintainPaths=True)  # disabled

# ----
# 1. Anchor detection. histogram in vertical direction (10cm per fraction), 80%<1.5m
# outputs
deconstruct = Deconstruct(Point=populate_geometry)  # -> XComponent, YComponent, ZComponent; disabled
number_slider_2 = Slider(1.5, range=0..10)  # disabled
bounds_2 = Bounds(Numbers=deconstruct.ZComponent)  # disabled
deconstruct_2 = Deconstruct(Point=point_2)  # -> XComponent, YComponent, ZComponent; disabled
dedomain = DeconstructDomain(Domain=bounds_2)  # -> Start, End; disabled
subtraction = Subtraction(A=dedomain.End, B=dedomain.Start)  # disabled
series = Series(Start=0, Step=0.1, Count=expr("10*x", subtraction))  # disabled
subtraction_2 = Subtraction(A=deconstruct_2.ZComponent, B=dedomain.Start)  # disabled
smaller_than_2 = SmallerThan(FirstNumber=subtraction_2, SecondNumber=number_slider_2)  # -> SmallerThan, OrEqualTo; disabled
mass_addition_2 = MassAddition(Input=smaller_than_2.OrEqualTo)  # -> Result, PartialResults; disabled
list_length_2 = ListLength(List=subtraction_2)  # disabled
number = Number(expr("abs(round(10*x,0))", subtraction))  # disabled
division_2 = Division(A=mass_addition_2.Result, B=list_length_2)  # disabled
merge = Merge(Data1=subtraction_2, Data2=series)  # -> flatten(Result); disabled
histogram_maker = HistogramMaker(data=merge, divs=number)  # -> out, flatten(A); inputs data: list, divs: Int32; disabled
# ---------- histogram_maker: C# ----------
    //find min and max of each

    double minsofar = Convert.ToDouble(data[0]);
    double maxsofar = Convert.ToDouble(data[0]);

    foreach (object xx in data)
    {
      minsofar = Math.Min(minsofar, Convert.ToDouble(xx));
      maxsofar = Math.Max(maxsofar, Convert.ToDouble(xx));
    }

    //assign each value a category, 0 being the lowest group, 100 being the highest
    int[] cats = new int[divs + 1];
    for (int i = 0; i < cats.Length; i++) cats[i] = 0;

    for (int i = 0; i < data.Count; i++)
    {
      double cat = divs * ((Convert.ToDouble(data[i]) - minsofar) / (maxsofar - minsofar));
      cats[(int) cat]++;
    }

    A = cats;
# ---------- end histogram_maker ----------
number_slider_3 = Slider(0.8, range=0..1)  # disabled
larger_than_2 = LargerThan(FirstNumber=division_2, SecondNumber=number_slider_3)  # -> LargerThan, OrEqualTo; disabled
quick_graph = QuickGraph(histogram_maker.A, SortOrder=0)  # disabled
dispatch_4 = Dispatch(List=brep_2, DispatchPattern=larger_than_2.OrEqualTo)  # -> ListA, ListB; disabled
dispatch_5 = Dispatch(List=cloud_2, DispatchPattern=larger_than_2.OrEqualTo)  # -> ListA, ListB; disabled
anchor_walls = Brep(dispatch_4.ListA)  # disabled
anchor_pcd = Cloud(dispatch_5.ListA)  # disabled
brep_3 = Brep(dispatch_4.ListB)  # disabled
cloud_3 = Cloud(dispatch_5.ListB)  # disabled

tree_branch_3 = TreeBranch(Tree=cloud_3, Path=digit_scroller, MaintainPaths=True)  # disabled
tree_branch_4 = TreeBranch(Tree=brep_3, Path=digit_scroller, MaintainPaths=True)  # disabled

# ----
# 2. diffirentiate rebar. raster image evaluation
# project points on hearth plane => export and process in matlab
deconstruct_brep = DeconstructBrep(Brep=brep_3)  # -> Faces, Edges, Vertices; disabled
area = Area(Geometry=deconstruct_brep.Faces)  # -> Area, Centroid; disabled
sort_list = SortList(Keys=area.Area, ValuesValuesA=deconstruct_brep.Faces, ValuesA=area.Centroid)  # -> reverse(Keys), reverse(ValuesValuesA), reverse(ValuesA); disabled
list_item_6 = ListItem(List=sort_list.ValuesA, Index=0, Wrap=True)  # disabled
list_item_7 = ListItem(List=sort_list.ValuesValuesA, Index=0, Wrap=True)  # disabled
mesh_closest_point = MeshClosestPoint(Point=list_item_6, Mesh=list_item_7)  # -> Point, Index, Parameter; disabled
mesh_eval = MeshEval(Mesh=list_item_7, Parameter=mesh_closest_point.Parameter)  # -> Point, simplify(Normal), Colour; disabled
plane_normal = PlaneNormal(Origin=mesh_closest_point.Point, ZAxis=mesh_eval.Normal)  # disabled
project = Project(Geometry=cloud_3, Plane=plane_normal)  # -> simplify(Geometry), Transform; disabled
list_length_3 = ListLength(List=flatten(project.Geometry))  # disabled
series_2 = Series(Start=0, Step=1, Count=list_length_3)  # disabled
define_object_attributes = DefineObjectAttributes(Name=series_2)  # disabled
bake_objects = BakeObjects(Geometry=project.Geometry, Attributes=define_object_attributes, Bake=False)  # disabled

panel = Panel(cloud_statistics.Count)
number_slider_4 = Slider(26, range=0..32)
tree_branch_5 = TreeBranch(Tree=wekk_32_pcd, Path=number_slider_4, MaintainPaths=True)
tree_branch_6 = TreeBranch(Tree=walls, Path=number_slider_4, MaintainPaths=True)

# ----
# 2. diffirentiate rebar => eval density in normal direction => does not work
# points along normal
# thickness wall
pcd = Relay()  # disabled
walls_2 = Relay()  # disabled
deconstruct_brep_2 = DeconstructBrep(Brep=walls_2)  # -> Faces, Edges, Vertices; disabled
deconstruct_cloud = DeconstructCloud(Cloud=pcd)  # -> simplify(Points), Normals, Colors; disabled
area_2 = Area(Geometry=deconstruct_brep_2.Faces)  # -> Area, Centroid; disabled
sort_list_2 = SortList(Keys=area_2.Area, ValuesValuesA=deconstruct_brep_2.Faces, ValuesA=area_2.Centroid)  # -> reverse(Keys), reverse(ValuesValuesA), reverse(ValuesA); disabled
list_item_8 = ListItem(List=sort_list_2.ValuesA, Index=0, Wrap=True)  # disabled
vector_2pt = Vector2Pt(PointA=simplify(list_item_8), PointB=deconstruct_cloud.Points, Unitize=False)  # -> Vector, Length; disabled
list_item_9 = ListItem(List=sort_list_2.ValuesValuesA, Index=0, Wrap=True)  # disabled
list_item_10 = ListItem(List=sort_list_2.ValuesValuesA, Index=1, Wrap=True)  # disabled
mesh_closest_point_2 = MeshClosestPoint(Point=list_item_8, Mesh=list_item_9)  # -> Point, Index, Parameter; disabled
surface_closest_point = SurfaceClosestPoint(Point=list_item_8, Surface=list_item_10)  # -> Point, UVPoint, simplify(Distance); disabled
mesh_eval_2 = MeshEval(Mesh=list_item_9, Parameter=mesh_closest_point_2.Parameter)  # -> Point, simplify(Normal), Colour; disabled
dot_product = DotProduct(VectorA=vector_2pt.Vector, VectorB=mesh_eval_2.Normal, Unitize=False)  # disabled
bounds_3 = Bounds(Numbers=dot_product)  # disabled
dedomain_2 = DeconstructDomain(Domain=bounds_3)  # -> Start, End; disabled
subtraction_3 = Subtraction(A=dedomain_2.End, B=dedomain_2.Start)  # disabled
number_2 = Number(expr("abs(round(100*x,0))", subtraction_3))  # disabled
series_3 = Series(Start=0, Step=1, Count=expr("x+1", number_2))  # disabled
series_4 = Series(Start=0, Step=0.01, Count=number_2)  # disabled
merge_2 = Merge(Data1=dot_product, Data2=series_4)  # -> flatten(Result); disabled
histogram_maker_2 = HistogramMaker(data=dot_product, divs=number_2)  # -> out, flatten(A); inputs data: list, divs: Int32; disabled; same code as histogram_maker
sort_list_3 = SortList(Keys=histogram_maker_2.A, ValuesValuesA=series_3)  # -> reverse(Keys), reverse(ValuesValuesA); disabled
quick_graph_2 = QuickGraph(histogram_maker_2.A, SortOrder=0)  # disabled
panel_2 = Panel(sort_list_3.ValuesValuesA)  # disabled

deconstruct_cloud_2 = DeconstructCloud(Cloud=wekk_32_pcd)  # -> Points, Normals, Colors
# Avg point density above floor (30cm) (high means fully observed wall)
cloud_statistics_2 = CloudStatistics(Cloud=wekk_32_pcd)  # -> Count, Colors, Colors_2
bounding_box = BoundingBox(Content=wekk_32_pcd, Plane=PlaneXY(0, 0, 0))  # -> Box, Box_2
# Potential features Single Faced Walls
deconstruct_brep_3 = DeconstructBrep(Brep=walls)  # -> Faces, Edges, Vertices
deconstruct_box = DeconstructBox(Box=walls)  # -> Plane, X, Y, Z
area_3 = Area(Geometry=walls)  # -> Area, Centroid
# Potential features Double Faced Walls
# histogram in horizontal direction with respect to hearth plane
# compute hearthplane
sort_list_4 = SortList(Keys=deconstruct_brep_3.Faces, ValuesA=deconstruct_brep_3.Faces)  # -> reverse(Keys), reverse(ValuesA)
list_item_11 = ListItem(List=sort_list_4.ValuesA, Index=0, Wrap=True)
area_4 = Area(Geometry=list_item_11)  # -> Area, Centroid
line = Line(StartPoint=area_4.Centroid, EndPoint=area_3.Centroid)
list_item_12 = ListItem(List=sort_list_4.Keys, Index=0, Wrap=True)  # -> simplify(Item)
move = Move(Geometry=list_item_11, Motion=line)  # -> simplify(Geometry), Transform
# 1cm per bracket
plane_closest_point = PlaneClosestPoint(Point=deconstruct_cloud_2.Points, Plane=move.Geometry)  # -> Point, UVPoint, simplify(Distance)
jitter = Jitter(Jitter=1, Seed=2)  # -> Values, Indices

# ----
# Difference in wall thickness (+ = thicker than wall thickness)
# peak detection
# wall thickness
# + buffer
number_slider_5 = Slider(0.3, range=0..1)
list_item_13 = ListItem(List=sort_list_4.ValuesA, Index=1, Wrap=True)
area_5 = Area(Geometry=list_item_13)  # -> Area, Centroid
plane_closest_point_2 = PlaneClosestPoint(Point=area_5.Centroid, Plane=list_item_11)  # -> Point, UVPoint, expr("abs(x)", simplify(Distance))
number_3 = Number(expr("2*x", number_slider_5))
addition = Addition(A=plane_closest_point_2.Distance, B=number_3)
number_4 = Number(expr("round(100*x,0)", addition))
series_5 = Series(Start=0, Step=1, Count=expr("x+1", number_4))
theoretical_wall_thickness_d = Panel(plane_closest_point_2.Distance)

histogram_maker_3 = HistogramMaker(data=plane_closest_point.Distance, divs=number_4)  # -> out, simplify(histogram); inputs data: list, divs: Int32
# ---------- histogram_maker_3: C# usings ----------
using System.IO;
using System.Linq;
using System.Data;
using System.Drawing;
using System.Reflection;
using System.Windows.Forms;
using System.Xml;
using System.Xml.Linq;
using System.Runtime.InteropServices;

using Rhino.DocObjects;
using Rhino.Collections;
using GH_IO;
using GH_IO.Serialization;
# ---------- histogram_maker_3: C# ----------
    //find min and max of each

    double minsofar = Convert.ToDouble(data[0]);
    double maxsofar = Convert.ToDouble(data[0]);

    foreach (object xx in data)
    {
      minsofar = Math.Min(minsofar, Convert.ToDouble(xx));
      maxsofar = Math.Max(maxsofar, Convert.ToDouble(xx));
    }

    //assign each value a category, 0 being the lowest group, 100 being the highest
    int[] cats = new int[divs + 1];
    for (int i = 0; i < cats.Length; i++) cats[i] = 0;

    for (int i = 0; i < data.Count; i++)
    {
      double cat = divs * ((Convert.ToDouble(data[i]) - minsofar) / (maxsofar - minsofar));
      Math.Round(Convert.ToDouble(data[i]) + divs/2, 0);
      cats[(int) cat]++;
    }

    histogram = cats;
# ---------- end histogram_maker_3 ----------
c_script = CSharpScript(
    histogram=histogram_maker_3.histogram,
    d=plane_closest_point_2.Distance,
    buffer=number_slider_5,
    threshold=Slider(0.05, range=0..0.1))  # -> out, simplify(Single_faced_wall), Double_faced_wall, A; inputs histogram: list of Int32, d: Double, buffer: Double, threshold: Double; disabled
# ---------- c_script: C# usings ----------
using System.Linq;
# ---------- c_script: C# ----------
    List<int> sortedhistogram = new List<int>(histogram.OrderByDescending(x => x));

    int peak1 = sortedhistogram[0];
    int i_peak2 = 0;
    // highest peak

    int i_peak1 = histogram.FindIndex(x => x == peak1);

    //thickness
    int i = 0;
    int temp = 0;

    while (temp < 5 && i < sortedhistogram.Count)
    {
      i_peak2 = histogram.FindIndex(x => x == sortedhistogram[i]);
      if ( Math.Abs(i_peak1 - i_peak2) > 5)
      {
        temp = Math.Abs(i_peak1 - i_peak2);

      }
      i++;
    }

    if (i_peak1 > i_peak2)
    {
      int swap = 0;
      swap = i_peak1;
      i_peak1 = i_peak2;
      i_peak2 = swap;
    }

    // average #p trough
    //dal_points = histogram.GetRange(i_peak1 + 3, temp - 3).Average();

    // average #p front
    //ruis_points_front = histogram.GetRange(i_peak1 - 18, 15).Average();

    // average #p back
    //ruis_points_back = histogram.GetRange(i_peak2 + 3, 15).Average();

    //identify if peaks are in expected location
    double expected_peak1 = buffer;
    A = Math.Abs(i_peak1 * 0.01 - expected_peak1);
    double expected_peak2 = buffer + d;


    if (Math.Abs(i_peak1 * 0.01 - expected_peak1) < threshold)
    {
      Double_faced_wall = histogram;

    }
    else
    {

      Single_faced_wall = histogram;
    }
# ---------- end c_script ----------
clean_tree = CleanTree(RemoveNulls=True, RemoveInvalid=True, RemoveEmpty=True, Tree=c_script.Double_faced_wall)  # -> simplify(Tree); disabled
clean_tree_2 = CleanTree(RemoveNulls=True, RemoveInvalid=True, RemoveEmpty=True, Tree=c_script.Single_faced_wall)  # -> simplify(Tree); disabled
c_script_2 = CSharpScript(histogram=histogram_maker_3.histogram)  # -> out, computed_wall_thickness, peaki, peakj, rij, ri, rj; inputs histogram: list of Int32
# ---------- c_script_2: C# ----------
    List<int> sortedhistogram = new List<int>(histogram.OrderByDescending(x => x));

    int peak1 = sortedhistogram[0];
    int peak2 = 0;
    int i_p2 = 0;
    int i_p1 = histogram.FindIndex(x => x == peak1);

    //thickness
    int i = 0;
    int temp = 0;

    while (temp < 5 && i < sortedhistogram.Count)
    {
      peak2 = sortedhistogram[i];
      i_p2 = histogram.FindIndex(x => x == peak2);
      if ( Math.Abs(i_p1 - i_p2) > 5)
      {
        temp = Math.Abs(i_p1 - i_p2);

      }
      i++;
    }
    computed_wall_thickness = temp * 0.01;
    if (i_p1 > i_p2)
    {
      int swap = 0;
      swap = i_p1;
      i_p1 = i_p2;
      i_p2 = swap;

    }
    //    peaki = Math.Sqrt(histogram[i_p1]);
    //    peakj = Math.Sqrt(histogram[i_p2]);
    peaki = (double)(histogram[i_p1]) / peak1;
    peakj = (double)(histogram[i_p2]) / peak1;

    //    // average #p trough
    //    rij = Math.Sqrt(histogram.GetRange(i_p1 + 2, temp - 2).Average());
    //
    //    // average #p front
    //    ri = Math.Sqrt(histogram.GetRange(1, i_p1 - 2).Average());
    //
    //    // average #p back
    //    rj = Math.Sqrt(histogram.GetRange(i_p2 + 0, histogram.Count - i_p2).Average());
    // average #p trough
    rij = (double)histogram.GetRange(i_p1 + 2, temp - 2).Average() / peak1;

    // average #p front
    ri = (double)(histogram.GetRange(1, i_p1 - 2).Average()) / peak1;

    // average #p back
    rj = (double)(histogram.GetRange(i_p2 + 0, histogram.Count - i_p2).Average()) / peak1;
# ---------- end c_script_2 ----------

sort_list_5 = SortList(Keys=histogram_maker_3.histogram, ValuesA=series_5)  # -> reverse(Keys), reverse(ValuesA)
subtraction_4 = Subtraction(A=c_script_2.computed_wall_thickness, B=plane_closest_point_2.Distance)
c_script_3 = CSharpScript(x=sort_list_5.ValuesA)  # -> out, A, B, C; inputs x: list of Int32
# ---------- c_script_3: C# ----------
    int x1 = x[0];
    int i = 0;
    double temp = 0;

  while (temp < 5 && i <x.Count)
    {

      if ( Math.Abs(x1 - x[i]) > 5)
      {
        temp = Math.Abs(x1 - x[i]);
      }
    i++;
    }
    A = temp*0.01;
# ---------- end c_script_3 ----------
deltad = Number(expr("abs(x)", subtraction_4))
observed_wall_thickness_dp = Panel(c_script_3.A)
difference_in_wall_thickness_delta_d = Panel(deltad)

quick_graph_3 = QuickGraph(histogram_maker_3.histogram, SortOrder=0)  # disabled
merge_3 = Merge(Data1=c_script_2.ri, Data2=c_script_2.rj)
# eval histogram first
# only works with 2 sided walls
average = Average(Input=merge_3)
panel_3 = Panel(average)
# occluded:
# >low #p
# >random histogram
# >random thickness
# >random vertical histogram
# non-existing:
# >low #p
# >random histogram
# >random thickness
# >peak at bottom of vertical histogram
# anchors:
# >low #p
# >random histogram
# >random thickness
# >peak at bottom of vertical histogram
# rebar:
# >medium #p
# >noisy histogram
# >computed thickness < d
# > y=c vertical histogram
# molding:
# >high #p
# >noisy histogram
# >computed thickness > d
# > y=c vertical histogram
# finish:
# >high #p
# >clean histogram
# >computed thickness = d
# > y=c vertical histogram
panel_4 = Panel(c_script_2.peakj)

# ----
# histogram in vertical direction (10cm per fraction) (y=c means fully observed wall)
deconstruct_3 = Deconstruct(Point=deconstruct_cloud_2.Points)  # -> XComponent, YComponent, simplify(ZComponent)
dedomain_3 = DeconstructDomain(Domain=deconstruct_box.Z)  # -> Start, End
subtraction_5 = Subtraction(A=dedomain_3.End, B=dedomain_3.Start)
subtraction_6 = Subtraction(A=deconstruct_3.ZComponent, B=dedomain_3.Start)  # -> simplify(Result)
number_5 = Number(expr("abs(round(10*x+10,0))", simplify(subtraction_5)))

list_length_4 = ListLength(List=deconstruct_3.ZComponent)
number_6 = Number(expr("abs(x)", subtraction_6))
larger_than_3 = LargerThan(FirstNumber=number_6, SecondNumber=0.3)  # -> LargerThan, OrEqualTo
dispatch_6 = Dispatch(List=number_6, DispatchPattern=larger_than_3.LargerThan)  # -> ListA, ListB
smaller_than_3 = SmallerThan(FirstNumber=dispatch_6.ListA, SecondNumber=1.2)  # -> SmallerThan, OrEqualTo
list_length_5 = ListLength(List=dispatch_6.ListA)
division_3 = Division(A=list_length_5, B=list_item_12)  # -> simplify(Result)
number_7 = Number(expr("x/2500", division_3))
evaluate = Evaluate(Expression="1/(e^(1/(0.01*x))^3)", x=division_3)
avg_point_density_m² = Panel(number_7)
mass_addition_3 = MassAddition(Input=smaller_than_3.SmallerThan)  # -> Result, PartialResults

histogram_maker_4 = HistogramMaker(data=number_6, divs=number_5)  # -> out, simplify(A); inputs data: list, divs: Int32
# ---------- histogram_maker_4: C# ----------
    //find min and max of each

    double minsofar = Convert.ToDouble(data[0]);
    double maxsofar = Convert.ToDouble(data[0]);

    foreach (object xx in data)
    {
      minsofar = Math.Min(minsofar, Convert.ToDouble(xx));
      maxsofar = Math.Max(maxsofar, Convert.ToDouble(xx));
    }

    //assign each value a category, 0 being the lowest group, 100 being the highest
    int[] cats = new int[divs + 1];
    for (int i = 0; i < cats.Length; i++) cats[i] = 0;

    for (int i = 0; i < data.Count; i++)
    {
      //double cat = divs * ((Convert.ToDouble(data[i]) - minsofar) / (maxsofar - minsofar));
      double cat = Math.Round(Convert.ToDouble(data[i]) * 10, 0);
      cats[(int) cat]++;
    }

    A = cats;
# ---------- end histogram_maker_4 ----------
quick_graph_4 = QuickGraph(histogram_maker_4.A, SortOrder=0)

avg_point_density_m²_2 = Panel(division_3)
division_4 = Division(A=mass_addition_3.Result, B=list_length_5)
c_script_4 = CSharpScript(histogram=histogram_maker_4.A)  # -> out, ph1, ph2, ph3; inputs histogram: list of Int32
# ---------- c_script_4: C# ----------
    //List<int> sortedhistogram = new List<int>(histogram.OrderByDescending(x => x));
    List<double> ph=new List<double>();
    ph.Add(Math.Sqrt(histogram.GetRange(0, 2).Average()));
    ph.Add(Math.Sqrt(histogram.GetRange(3, 8).Average()));
    ph.Add(Math.Sqrt(histogram.GetRange(9, histogram.Count - 9).Average()));
    // #p [0-0.2m]
    ph1 = 0.0;
    //ph1 = (double)histogram.GetRange(0, 2).Sum()/histogram.Sum();
  
    ph1 = Math.Sqrt(histogram.GetRange(0, 2).Average())/ph.Max();
    
    // #p [0.2-1m]
    ph2 = 0;
    
    
    ph2 = Math.Sqrt(histogram.GetRange(3, 8).Average())/ph.Max();
    //ph2 = (double)histogram.GetRange(3, 8).Sum()/histogram.Sum();
    // average #p back
    ph3 = 0;
     
    ph3 = Math.Sqrt(histogram.GetRange(9, histogram.Count - 9).Average())/ph.Max();
   
    //ph3 = (double)histogram.GetRange(9, histogram.Count - 9).Sum()/histogram.Sum();
# ---------- end c_script_4 ----------
points_below_1_2m = Panel(division_4)
panel_5 = Panel(c_script_4.ph1)
panel_6 = Panel(c_script_4.ph2)
panel_7 = Panel(c_script_4.ph3)
