# Grasshopper definition Quality_control_1.gh (Grasshopper 1.0.7)
# plug-ins: Volvox, EleFront

series = Series(Start=0, Step=1, Count=3)  # -> simplify(graft(Series))
mesh = Mesh(simplify(graft([<mesh referenced from the Rhino model> x33])))
mesh_2 = Mesh([<mesh referenced from the Rhino model> x68])
tree_branch = TreeBranch(Tree=mesh, Path=series, MaintainPaths=True)
entwine = Entwine(Branch00=mesh, Branch01=mesh_2, FlattenInputs=True)  # -> simplify(graft(Result))

# ----
# Legende
colour_swatch = ColourSwatch(SwatchColor=RGB(0, 125, 0))
insert_items = InsertItems(
    List=[colour_swatch, ColourSwatch(SwatchColor=RGB(255, 163, 0)), ColourSwatch(SwatchColor=RGB(255, 0, 0))],
    Item=ColourSwatch(SwatchColor=RGB(220, 223, 225)),
    Indices=3,
    Wrap=True)
rectangle = Rectangle({Plane=PlaneXY(48060.81892, 39422.34334, 0), Size=Domain2(u=-4255.646382..4255.646382, v=-6599.858372..6599.858372)})
legend = Legend(Colour=insert_items, Tags=["LOA 10", "LOA 20", "LOA 30", "NVT"], Rectangle=rectangle, LegendType=1)

# ----
# Offset BB in m
number_slider = Slider(0.2, range=0..1)

# ----
# #min percentage van aantal punten voor een waarde
number_slider_2 = Slider(0.566, range=0..1)

# ----
# BIM
mesh_3 = Mesh(simplify(graft([<mesh referenced from the Rhino model> x17])))

# ----
# Inputs
# Fotogrammetrie
cloud = Cloud(<cloud referenced from the Rhino model>)

multiplication = Multiplication(A=number_slider, B=1000)

# ----
# Subsampling Foto
number_slider_3 = Slider(0.2, range=0..1)
random_subsampling = RandomSubsampling(Percent=number_slider_3, Seed=123)
cloud_engine = CloudEngine(Cloud=cloud, Instruction0=random_subsampling)

area = Area(Geometry=mesh_3)  # -> Area, Centroid
integer = Integer(10000000)
list_length = ListLength(List=flatten(mesh_3))
division = Division(A=area.Area, B=integer)
series_2 = Series(Start=0, Step=1, Count=6)  # -> simplify(graft(Series))
series_3 = Series(Start=0, Step=1, Count=list_length)
tree_branch_2 = TreeBranch(Tree=mesh_3, Path=series_2, MaintainPaths=True)
area_2 = Area(Geometry=mesh_3)  # -> Area, Centroid
integer_2 = Integer(10000000)
division_2 = Division(A=area_2.Area, B=integer_2)
number = Number(0.05)
integer_3 = Integer(5)
integer_4 = Integer(1)
multiplication_2 = Multiplication(A=integer_3, B=1000)
construct_path = ConstructPath(Indices=[Slider(20, range=0..100), Slider(5, range=0..10)])
integer_5 = Integer(1)

# ----
# #punten
cloud_statistics = CloudStatistics(Cloud=cloud_engine)  # -> Count, Colors, Colors_2
panel = Panel(cloud_statistics.Count)

# ----
# #walls
tree_statistics = TreeStatistics(Tree=mesh_3)  # -> Paths, Length, Count
panel_2 = Panel(tree_statistics.Count)

boolean_toggle = BooleanToggle(False)
desired_file_extension = Panel("txt")
file_name = Panel("Gemiddeld_#punten")
file_name_2 = Panel("Piekwaarde")
file_name_3 = Panel("#punten_per_wall")
integer_6 = Integer(1000)
file_name_4 = Panel("#punten_PCD")
file_name_5 = Panel("%LOA30_punten")
file_name_6 = Panel("#walls")
boolean = Boolean(True)
boolean_2 = Boolean(True)
file_name_7 = Panel("%LOA20_punten")
file_name_8 = Panel("Hoek vlakken")
number_slider_4 = Slider(100, range=0..100)
number_2 = Number(0.001)

# ----
# Oriented BB
face_normals = FaceNormals(Mesh=mesh_3)  # -> Centers, Normals
list_item = ListItem(List=face_normals.Centers, Index=0, Wrap=True)
list_item_2 = ListItem(List=face_normals.Normals, Index=0, Wrap=True)
plane_normal = PlaneNormal(Origin=list_item, ZAxis=list_item_2)  # -> simplify(Plane)
bounding_box = BoundingBox(Content=mesh_3, Plane=plane_normal)  # -> Box, Box_2
box = Box(simplify(bounding_box.Box))

# ----
# 6 Meshes per mesh
settings_custom = SettingsCustom(
    StitchSeams=True,
    SimplePlanes=True,
    Refine=False,
    MinCount=16,
    MaxCount=400,
    AspectRatio=100,
    MaxDistance=0,
    MaxAngle=20,
    MinEdge=0,
    MaxEdge=0)
mesh_brep = MeshBrep(Brep=box, Settings=settings_custom)
face_boundaries = FaceBoundaries(Mesh=mesh_brep)
mesh_4 = Mesh(simplify(face_boundaries))

offset_surface = OffsetSurface(Surface=face_boundaries, Distance=multiplication, Retrim=True)  # -> reparameterize(Surface)
bounding_box_2 = BoundingBox(Content=offset_surface, Plane=plane_normal, UnionBox=True)  # -> Box, Box_2
brep = Brep(simplify(bounding_box_2.Box))

# ----
# Zoek grootste vlakken
area_3 = Area(Geometry=mesh_4)  # -> Area, Centroid
sort_list = SortList(Keys=area_3.Area, ValuesValuesA=[0, 1, 2, 3, 4, 5])  # -> Keys, ValuesValuesA
integer_7 = Integer(1)
integer_8 = Integer(2)
list_length_2 = ListLength(List=sort_list.ValuesValuesA)
subtraction = Subtraction(A=list_length_2, B=integer_7)
subtraction_2 = Subtraction(A=list_length_2, B=integer_8)
list_item_3 = ListItem(List=sort_list.ValuesValuesA, Index=subtraction, Wrap=True)
list_item_4 = ListItem(List=sort_list.ValuesValuesA, Index=subtraction_2, Wrap=True)

# ----
# segment BB PCD
mesh_brep_2 = MeshBrep(
    Brep=brep,
    Settings={GridMaxCount=0, GridMinCount=16, JaggedSeams=False, MaxEdgeLength=0, MinEdgeLength=0.0001, MinTolerance=0, Refine=True, RefineAngle=0, RelativeTolerance=0.65, SimplePlanes=True, Tolerance=0})
mesh_include = MeshInclude(Cloud=cloud_engine, Mesh=mesh_brep_2, Leave=False)

# ----
# Parts PCD and BB (control)
number_slider_5 = Slider(1, range=0..100)
tree_branch_3 = TreeBranch(Tree=mesh_include, Path=number_slider_5, MaintainPaths=True)
tree_branch_4 = TreeBranch(Tree=mesh_3, Path=number_slider_5, MaintainPaths=True)

deconstruct_cloud = DeconstructCloud(Cloud=mesh_include)  # -> simplify(Points), Normals, Colors
list_item_5 = ListItem(List=flatten(mesh_include), Index=Slider(7, range=0..10), Wrap=True)
duplicate_data = DuplicateData(Data=deconstruct_cloud.Points, Number=6, Order=True)
list_length_3 = ListLength(List=deconstruct_cloud.Points)
partition_list = PartitionList(List=duplicate_data, Size=list_length_3)  # -> simplify(Chunks)

text = Text("Gesegmenteerde puntenwolk")
define_object_attributes = DefineObjectAttributes(Layer=text)
bake_objects = BakeObjects(Geometry=mesh_include, Attributes=define_object_attributes, BakeName="1", Bake=False)

# ----
# shortest |D| per wallface per wall
# Compute D=||mesh-pcd||
# splits D per vlak
# bij meerdere muren {A;C}
# pijnlijk! 6x data (ram issues)
distance = Text("distance")
mesh_compare = MeshCompare(Cloud=mesh_include, Mesh=mesh_4, Key=distance)
get_data = GetData(Cloud=mesh_compare, Key=distance)  # -> expr("abs(x)", graft(Values))
path_mapper = PathMapper(get_data, source="{A;B;C}", target="{A;C}")
sort_list_2 = SortList(Keys=path_mapper, ValuesValuesA=[0, 1, 2, 3, 4, 5])  # -> Keys, ValuesValuesA
list_item_6 = ListItem(List=sort_list_2.ValuesValuesA, Index=0, Wrap=True)
shift_paths = ShiftPaths(Data=list_item_6, Offset=-1)
list_item_7 = ListItem(List=sort_list_2.Keys, Index=0, Wrap=True)
shift_paths_2 = ShiftPaths(Data=list_item_7, Offset=-1)
integer_9 = Integer(shift_paths)
member_index = MemberIndex(Set=integer_9, Member=[0, 1, 2, 3, 4, 5])  # -> simplify(Index), Count

duplicate_data_2 = DuplicateData(Data=shift_paths_2, Number=6, Order=True)
list_length_4 = ListLength(List=shift_paths_2)
partition_list_2 = PartitionList(List=duplicate_data_2, Size=list_length_4)  # -> simplify(Chunks)

# ----
# Distances
list_item_8 = ListItem(List=partition_list_2, Index=member_index.Index, Wrap=True)

# ----
# Points
list_item_9 = ListItem(List=partition_list, Index=member_index.Index, Wrap=True)  # -> simplify(Item)
sort_list_3 = SortList(Keys=list_item_8)  # -> Keys, ValuesValuesA

# ----
# Breedte van de muur volgens puntenwolk
integer_10 = Integer(simplify(graft(series_3)))
construct_path_2 = ConstructPath(Indices=[integer_10, list_item_3])
tree_branch_5 = TreeBranch(Tree=list_item_9, Path=construct_path_2, MaintainPaths=True)
construct_path_3 = ConstructPath(Indices=[integer_10, list_item_4])
deconstruct = Deconstruct(Point=tree_branch_5)  # -> XComponent, YComponent, ZComponent
tree_branch_6 = TreeBranch(Tree=list_item_9, Path=construct_path_3, MaintainPaths=True)
deconstruct_2 = Deconstruct(Point=tree_branch_6)  # -> XComponent, YComponent, ZComponent
construct_point = ConstructPoint(XCoordinate=deconstruct.XComponent, YCoordinate=deconstruct.YComponent, ZCoordinate=0)
construct_point_2 = ConstructPoint(XCoordinate=deconstruct_2.XComponent, YCoordinate=deconstruct_2.YComponent, ZCoordinate=0)
fit_line = FitLine(Points=construct_point)
fit_line_2 = FitLine(Points=construct_point_2)
end_points = EndPoints(Curve=fit_line)  # -> Start, End; disabled
end_points_2 = EndPoints(Curve=fit_line_2)  # -> Start, End; disabled
deconstruct_3 = Deconstruct(Point=end_points_2.Start)  # -> XComponent, YComponent, ZComponent; disabled
deconstruct_4 = Deconstruct(Point=end_points_2.End)  # -> XComponent, YComponent, ZComponent; disabled
deconstruct_5 = Deconstruct(Point=end_points.Start)  # -> XComponent, YComponent, ZComponent; disabled
deconstruct_6 = Deconstruct(Point=end_points.End)  # -> XComponent, YComponent, ZComponent; disabled
construct_point_3 = ConstructPoint(XCoordinate=deconstruct_3.XComponent, YCoordinate=deconstruct_3.YComponent, ZCoordinate=1)  # disabled
construct_point_4 = ConstructPoint(XCoordinate=deconstruct_4.XComponent, YCoordinate=deconstruct_4.YComponent, ZCoordinate=1)  # disabled
construct_point_5 = ConstructPoint(XCoordinate=deconstruct_5.XComponent, YCoordinate=deconstruct_5.YComponent, ZCoordinate=1)  # disabled
construct_point_6 = ConstructPoint(XCoordinate=deconstruct_6.XComponent, YCoordinate=deconstruct_6.YComponent, ZCoordinate=1)  # disabled
_4point_surface = _4PointSurface(CornerA=end_points_2.Start, CornerB=end_points_2.End, CornerC=construct_point_4, CornerD=construct_point_3)  # -> simplify(Surface); disabled
_4point_surface_2 = _4PointSurface(CornerA=end_points.Start, CornerB=end_points.End, CornerC=construct_point_6, CornerD=construct_point_5)  # -> simplify(Surface); disabled
populate_2d = Populate2D(Region=_4point_surface, Count=100, Seed=100)  # disabled
plane_closest_point = PlaneClosestPoint(Point=populate_2d, Plane=_4point_surface_2)  # -> Point, UVPoint, simplify(Distance); disabled
absolute = Absolute(Value=plane_closest_point.Distance)  # disabled

# ----
# Voorstelling van de punten per muur
#  in een diagram
number_slider_6 = Slider(14, range=0..23)
shift_paths_3 = ShiftPaths(Data=sort_list_3.Keys, Offset=-1)
tree_branch_7 = TreeBranch(Tree=shift_paths_3, Path=number_slider_6, MaintainPaths=True)
bar_graph = BarGraph(tree_branch_7, BarColor=RGB(0, 164, 0))

bar_graph_2 = BarGraph(tree_branch_7, BarColor=RGB(0, 164, 0))
list_length_5 = ListLength(List=shift_paths_3)

# ----
# Voorstelling van de punten per vlak
number_slider_7 = Slider(46, range=0..143)
tree_statistics_2 = TreeStatistics(Tree=sort_list_3.Keys)  # -> Paths, Length, Count
list_item_10 = ListItem(List=tree_statistics_2.Paths, Index=number_slider_7, Wrap=True)
tree_branch_8 = TreeBranch(Tree=sort_list_3.Keys, Path=list_item_10, MaintainPaths=True)
bar_graph_3 = BarGraph(tree_branch_8, BarColor=RGB(0, 164, 0))

tree_branch_9 = TreeBranch(Tree=simplify(fit_line_2), Path=construct_path, MaintainPaths=True)
extend_curve = ExtendCurve(Curve=tree_branch_9, Type=0, Start=integer_5, End=integer_5)
end_points_3 = EndPoints(Curve=fit_line_2)  # -> Start, End
deconstruct_7 = Deconstruct(Point=end_points_3.Start)  # -> XComponent, YComponent, ZComponent
deconstruct_8 = Deconstruct(Point=end_points_3.End)  # -> XComponent, YComponent, ZComponent
construct_point_7 = ConstructPoint(XCoordinate=deconstruct_7.XComponent, YCoordinate=deconstruct_7.YComponent, ZCoordinate=1)
construct_point_8 = ConstructPoint(XCoordinate=deconstruct_8.XComponent, YCoordinate=deconstruct_8.YComponent, ZCoordinate=1)
divide_curve = DivideCurve(Curve=simplify(fit_line), Count=10, Kinks=False)  # -> simplify(Points), Tangents, Parameters
_4point_surface_3 = _4PointSurface(CornerA=end_points_3.Start, CornerB=end_points_3.End, CornerC=construct_point_8, CornerD=construct_point_7)  # -> simplify(Surface)
shift_paths_4 = ShiftPaths(Data=divide_curve.Points, Offset=-1)

# ----
# Piek van Histogram zoeken.
sort_list_4 = SortList(Keys=absolute)  # -> Keys, ValuesValuesA; disabled
number_slider_8 = Slider(50, range=0..100)  # disabled
shift_paths_5 = ShiftPaths(Data=sort_list_4.Keys, Offset=-1)  # disabled
histogram_maker = HistogramMaker(data=shift_paths_5, divs=number_slider_8)  # -> out, A; inputs data: list, divs: Int32; disabled
# ---------- histogram_maker: C# ----------
    //find min and max of each

    double minsofar = Convert.ToDouble(data[0]);
    double maxsofar = Convert.ToDouble(data[0]);

    foreach (object xx in data)
    {
      minsofar = Math.Min(minsofar, Convert.ToDouble(xx));
      maxsofar = Math.Max(maxsofar, Convert.ToDouble(xx));
    }

    //assign each value a category, 0 being the lowest group, 100 being the highest
    int[] cats = new int[divs + 1];
    for (int i = 0; i < cats.Length; i++) cats[i] = 0;

    for (int i = 0; i < data.Count; i++)
    {
      double cat = divs * ((Convert.ToDouble(data[i]) - minsofar) / (maxsofar - minsofar));
      cats[(int) cat]++;
    }

    A = cats;
# ---------- end histogram_maker ----------
c_script = CSharpScript(histogram=histogram_maker.A)  # -> out, simplify(i), height_peak; inputs histogram: list of Int32; disabled
# ---------- c_script: C# usings ----------
using System.Linq;
# ---------- c_script: C# ----------
    List<int> sortedhistogram = new List<int>(histogram.OrderByDescending(y => y));

    int peak1 = sortedhistogram[0];
    i = histogram.FindIndex(x => x == peak1);
    height_peak = peak1;
    // peaki = Math.Sqrt(histogram[i_p1]);
    // peakj = Math.Sqrt(histogram[i_p2]);
    // peaki = (double) (histogram[i_p1]) / peak1;
# ---------- end c_script ----------
addition = Addition(A=c_script.i, B=1)  # disabled
sort_list_5 = SortList(Keys=shift_paths_5)  # -> Keys, ValuesValuesA; disabled
series_4 = Series(Start=0, Step=1, Count=addition)  # disabled
list_item_11 = ListItem(List=histogram_maker.A, Index=series_4, Wrap=True)  # disabled
mass_addition = MassAddition(Input=list_item_11)  # -> Result, PartialResults; disabled
list_item_12 = ListItem(List=sort_list_5.Keys, Index=mass_addition.Result, Wrap=True)  # -> simplify(Item); disabled

plane_closest_point_2 = PlaneClosestPoint(Point=simplify(shift_paths_4), Plane=_4point_surface_3)  # -> Point, UVPoint, simplify(Distance)
average = Average(Input=plane_closest_point_2.Distance)
larger_than = LargerThan(FirstNumber=average, SecondNumber=number_slider_4)  # -> LargerThan, OrEqualTo
smaller_than = SmallerThan(FirstNumber=average, SecondNumber=number_slider_4)  # -> SmallerThan, OrEqualTo
expression = Expression(x=larger_than.LargerThan, Expression="If(x=true,false,true)")  # -> simplify(Result)
panel_3 = Panel(average)

shift_paths_6 = ShiftPaths(Data=list_item_8, Offset=-1)
number_3 = Number(0.015)
list_length_6 = ListLength(List=shift_paths_6)

multiplication_3 = Multiplication(A=number_3, B=1000)

smaller_than_2 = SmallerThan(FirstNumber=shift_paths_6, SecondNumber=multiplication_3)  # -> SmallerThan, OrEqualTo
cull_pattern = CullPattern(List=shift_paths_6, CullPattern=smaller_than_2.OrEqualTo)
list_length_7 = ListLength(List=cull_pattern)
division_3 = Division(A=list_length_7, B=list_length_6)
multiplication_4 = Multiplication(A=division_3, B=100)

# ----
# % van punten LOA30
panel_4 = Panel(multiplication_4)

# ----
# Relatief aantal nodige punten
list_length_8 = ListLength(List=shift_paths_2)

division_4 = Division(A=list_length_8, B=division)

# ----
# Mediaan berekenen
number_4 = Number(flatten(division_4))
sort = SortList(Keys=number_4)  # -> Keys, ValuesA
lng = ListLength(List=sort.Keys)
division_5 = Division(A=lng, B=2)
mod = Modulus(A=lng, B=2)
subtraction_3 = Subtraction(A=division_5, B=1)
item = ListItem(List=sort.Keys, Index=[subtraction_3, division_5], Wrap=True)
round = Round(Number=division_5)  # -> Nearest, Floor, Ceiling
average_2 = Average(Input=item)
item_2 = ListItem(List=sort.Keys, Index=round.Floor, Wrap=True)
filter = StreamFilter(Gate=mod, Stream0=item_2, Stream1=average_2)

average_3 = Average(Input=flatten(division_4))
multiplication_5 = Multiplication(A=filter, B=number_slider_2)

multiplication_6 = Multiplication(A=list_length_8, B=number)

# ----
# #punten per wall
cloud_statistics_2 = CloudStatistics(Cloud=mesh_include)  # -> Count, Colors, Colors_2
panel_5 = Panel(division_4)

# ----
# Gemiddeld #punten
panel_6 = Panel(average_3)

# ----
# Hoek tussen de as van de muren. (indien exact 0 is er te weinig data)
# Wanden met weinig punten weg
deconstruct_cloud_2 = DeconstructCloud(Cloud=mesh_include)  # -> Points, Normals, Colors
mesh_5 = Mesh(mesh_3)
deconstruct_mesh = DeconstructMesh(Mesh=mesh_5)  # -> Vertices, Faces, Colours, Normals
list_length_9 = ListLength(List=deconstruct_cloud_2.Points)  # -> flatten(Length); disabled
convex_hull = ConvexHull(Points=simplify(deconstruct_cloud_2.Points), Plane=PlaneXY(0, 0, 0))  # -> Hull, HullZ, simplify(Indices)
number_slider_9 = Slider(0.14, range=0..1)  # disabled
convex_hull_2 = ConvexHull(Points=simplify(deconstruct_mesh.Vertices), Plane=PlaneXY(0, 0, 0))  # -> Hull, HullZ, simplify(Indices)
average_4 = Average(Input=list_length_9)  # disabled
curve = Curve(convex_hull.Hull)
curve_2 = Curve(simplify(convex_hull_2.Hull))
multiplication_7 = Multiplication(A=average_4, B=number_slider_9)  # disabled
populate_2d_2 = Populate2D(Region=curve, Count=100, Seed=100)
expression_2 = Expression(x=list_length_9, y=multiplication_7, Expression="If(x>y,x,0)")  # -> simplify(graft(Result)); disabled
integer_11 = Integer(1)
fit_line_3 = FitLine(Points=populate_2d_2)  # -> simplify(Line)
divide_length = DivideLength(Curve=simplify(fit_line_3), Length=integer_11)  # -> Points, Tangents, Parameters; disabled
list_item_13 = ListItem(List=divide_length.Tangents, Index=0, Wrap=True)  # disabled

surface_points = SurfacePoints(Surface=curve_2)  # -> Points, Weights, Greville, UCount, VCount

fit_line_4 = FitLine(Points=surface_points.Points)  # -> simplify(Line)
divide_length_2 = DivideLength(Curve=fit_line_4, Length=integer_11)  # -> Points, Tangents, Parameters; disabled
list_item_14 = ListItem(List=divide_length_2.Tangents, Index=0, Wrap=True)  # disabled
dot_product = DotProduct(VectorA=list_item_13, VectorB=list_item_14, Unitize=False)  # -> simplify(DotProduct); disabled
absolute_2 = Absolute(Value=dot_product)  # disabled
arccosine = ArcCosine(Value=absolute_2)  # disabled
degrees = Degrees(Radians=arccosine)  # disabled
expression_3 = Expression(x=degrees, y=expression_2, Expression="If(y=0,0,x)")  # -> simplify(graft(Result)); disabled

# ----
# Hoek tussen de as van de wanden (globale controle)
# As van wanden met evenwijdige vlakken
# As van de wand BIM
integer_12 = Integer(simplify(graft(series_3)))
construct_path_4 = ConstructPath(Indices=integer_12)
tree_branch_10 = TreeBranch(Tree=simplify(fit_line_3), Path=construct_path_4, MaintainPaths=True)
tree_branch_11 = TreeBranch(Tree=simplify(fit_line_4), Path=construct_path_4, MaintainPaths=True)

# ----
# Breedte van de muur volgens BIM
mesh_6 = Mesh(mesh_3)  # disabled
deconstruct_mesh_2 = DeconstructMesh(Mesh=mesh_6)  # -> Vertices, Faces, Colours, Normals; disabled
convex_hull_3 = ConvexHull(Points=simplify(deconstruct_mesh_2.Vertices), Plane=PlaneXY(0, 0, 0))  # -> Hull, HullZ, simplify(Indices); disabled
curve_3 = Curve(simplify(convex_hull_3.Hull))  # disabled
populate_2d_3 = Populate2D(Region=curve_3, Count=100, Seed=100)  # disabled
end_points_4 = EndPoints(Curve=fit_line_4)  # -> Start, End; disabled
deconstruct_9 = Deconstruct(Point=end_points_4.End)  # -> XComponent, YComponent, ZComponent; disabled
deconstruct_10 = Deconstruct(Point=end_points_4.Start)  # -> XComponent, YComponent, ZComponent; disabled
construct_point_9 = ConstructPoint(XCoordinate=deconstruct_9.XComponent, YCoordinate=deconstruct_9.YComponent, ZCoordinate=1000)  # disabled
construct_point_10 = ConstructPoint(XCoordinate=deconstruct_10.XComponent, YCoordinate=deconstruct_10.YComponent, ZCoordinate=1000)  # disabled
_4point_surface_4 = _4PointSurface(CornerA=end_points_4.Start, CornerB=end_points_4.End, CornerC=construct_point_10, CornerD=construct_point_9)  # -> simplify(Surface); disabled
plane_closest_point_3 = PlaneClosestPoint(Point=populate_2d_3, Plane=_4point_surface_4)  # -> Point, UVPoint, Distance; disabled
sort_list_6 = SortList(Keys=plane_closest_point_3.Distance)  # -> Keys, ValuesValuesA; disabled
absolute_3 = Absolute(Value=sort_list_6.Keys)  # disabled
list_item_15 = ListItem(List=absolute_3, Index=0, Wrap=True)  # disabled
list_item_16 = ListItem(List=absolute_3, Index=99, Wrap=True)  # disabled
addition_2 = Addition(A=list_item_15, B=list_item_16)  # -> simplify(Result); disabled

tree_branch_12 = TreeBranch(Tree=fit_line_3, Path=Slider(20, range=0..100), MaintainPaths=True)
extend_curve_2 = ExtendCurve(Curve=tree_branch_12, Type=0, Start=integer_4, End=integer_4)

expression_4 = Expression(x=smaller_than_2.OrEqualTo, Expression="If(x=true,false,true)")  # -> simplify(Result)
cull_pattern_2 = CullPattern(List=shift_paths_6, CullPattern=expression_4)
number_5 = Number(0.05)
list_length_10 = ListLength(List=shift_paths_6)

multiplication_8 = Multiplication(A=number_5, B=1000)

smaller_than_3 = SmallerThan(FirstNumber=cull_pattern_2, SecondNumber=multiplication_8)  # -> SmallerThan, OrEqualTo
cull_pattern_3 = CullPattern(List=cull_pattern_2, CullPattern=smaller_than_3.OrEqualTo)
list_length_11 = ListLength(List=cull_pattern_3)
division_6 = Division(A=list_length_11, B=list_length_10)
multiplication_9 = Multiplication(A=division_6, B=100)

# ----
# % van punten LOA20
panel_7 = Panel(multiplication_9)

# ----
# % punten in LOA20 en LOA30
addition_3 = Addition(A=panel_7, B=panel_4)
panel_8 = Panel(addition_3)

# ----
# % punten LOA10
subtraction_4 = Subtraction(A=100, B=addition_3)
panel_9 = Panel(subtraction_4)

# ----
# Enkel ongeveer evenwijdige wanden worden gehouden.
divide_length_3 = DivideLength(Curve=simplify(fit_line), Length=integer_11)  # -> Points, Tangents, Parameters
divide_length_4 = DivideLength(Curve=fit_line_2, Length=integer_11)  # -> Points, Tangents, Parameters
list_item_17 = ListItem(List=divide_length_3.Tangents, Index=0, Wrap=True)
list_item_18 = ListItem(List=divide_length_4.Tangents, Index=0, Wrap=True)

angle = Angle(VectorA=list_item_17, VectorB=list_item_18)  # -> simplify(Angle), Reflex

# ----
# Piek van Histogram zoeken.
histogram_maker_2 = HistogramMaker(data=shift_paths_3, divs=Slider(50, range=0..100))  # -> out, A; inputs data: list, divs: Int32; same code as histogram_maker
c_script_2 = CSharpScript(histogram=histogram_maker_2.A)  # -> out, simplify(i), height_peak; inputs histogram: list of Int32; same code as c_script
list_length_12 = ListLength(List=shift_paths_3)
addition_4 = Addition(A=c_script_2.i, B=1)
sort_list_7 = SortList(Keys=shift_paths_3)  # -> Keys, ValuesValuesA
series_5 = Series(Start=0, Step=1, Count=addition_4)
list_item_19 = ListItem(List=histogram_maker_2.A, Index=series_5, Wrap=True)
mass_addition_2 = MassAddition(Input=list_item_19)  # -> Result, PartialResults
list_item_20 = ListItem(List=sort_list_7.Keys, Index=mass_addition_2.Result, Wrap=True)  # -> simplify(Item)

division_7 = Division(A=list_length_12, B=division_2)

expression_5 = Expression(x=division_7, y=multiplication_5, Expression="If(x>y,x,0)")
expression_6 = Expression(x=list_item_20, y=expression_5, Expression="If(y=0,0,x)")  # -> simplify(Result)

# ----
# punt nauwkeurigheid moeten we hier ergens meenemen
# Gewogen gemiddelde van de afwijkingen per wand
gradient = Gradient(
    LowerLimit=0,
    UpperLimit=100,
    Parameter=expression_6,
    stops=[0: RGB(224, 224, 224), 0.149: RGB(0, 128, 0), 0.15: RGB(255, 165, 0), 0.5: RGB(255, 165, 0)])
mesh_colours = MeshColours(Mesh=mesh_3, Colours=gradient)

# ----
# Tabel
# piekwaarde
panel_10 = Panel(list_item_20)

# ----
# Wanneer er meerdere pieken zijn wordt een latere piek gezien.
subtraction_5 = Subtraction(A=c_script_2.height_peak, B=multiplication_6)
larger_than_2 = LargerThan(FirstNumber=histogram_maker_2.A, SecondNumber=20)  # -> LargerThan, OrEqualTo
smaller_than_4 = SmallerThan(FirstNumber=subtraction_5, SecondNumber=histogram_maker_2.A)  # -> SmallerThan, OrEqualTo
gate_and = GateAnd(A=smaller_than_4.SmallerThan, B=larger_than_2.LargerThan)
cull_pattern_4 = CullPattern(List=histogram_maker_2.A, CullPattern=gate_and)
item_index = ItemIndex(List=histogram_maker_2.A, Item=cull_pattern_4)
list_length_13 = ListLength(List=item_index)
subtraction_6 = Subtraction(A=list_length_13, B=1)
list_item_21 = ListItem(List=item_index, Index=subtraction_6, Wrap=True)  # -> simplify(Item)
maximum = Maximum(A=c_script_2.i, B=list_item_21)
addition_5 = Addition(A=maximum, B=1)
series_6 = Series(Start=0, Step=1, Count=addition_5)
list_item_22 = ListItem(List=histogram_maker_2.A, Index=series_6, Wrap=True)
mass_addition_3 = MassAddition(Input=list_item_22)  # -> Result, PartialResults
list_item_23 = ListItem(List=sort_list_7.Keys, Index=mass_addition_3.Result, Wrap=True)  # -> simplify(Item)

text_2 = Text("Kleurencode absoluut")
define_object_attributes_2 = DefineObjectAttributes(Layer=text_2, Color=gradient)
bake_objects_2 = BakeObjects(Geometry=mesh_3, Attributes=define_object_attributes_2, BakeName="1", Bake=False)

panel_11 = Panel(addition_5)

absolute_4 = Absolute(Value=angle.Angle)
degrees_2 = Degrees(Radians=absolute_4)

shift_paths_7 = ShiftPaths(Data=degrees_2, Offset=-1)
larger_than_3 = LargerThan(FirstNumber=shift_paths_7, SecondNumber=175)  # -> LargerThan, OrEqualTo
cull_pattern_5 = CullPattern(List=shift_paths_7, CullPattern=larger_than_3.LargerThan)
subtraction_7 = Subtraction(A=cull_pattern_5, B=180)
absolute_5 = Absolute(Value=subtraction_7)
minimum = Minimum(A=absolute_5, B=degrees_2)
shift_paths_8 = ShiftPaths(Data=minimum, Offset=-1)

smaller_than_5 = SmallerThan(FirstNumber=shift_paths_8, SecondNumber=Slider(1.5, range=0..10))  # -> SmallerThan, OrEqualTo

expression_7 = Expression(x=smaller_than_5.SmallerThan, Expression="If(x=true,false,true)")  # -> simplify(Result)
gate_or = GateOr(A=expression_7, B=expression)
expression_8 = Expression(x=gate_or, Expression="If(x=true,false,true)")  # -> simplify(Result)
panel_12 = Panel(expression_8)
cull_pattern_6 = CullPattern(List=fit_line_2, CullPattern=expression_8)
cull_pattern_7 = CullPattern(List=tree_branch_11, CullPattern=expression_8)

# ----
# Onderlinge hoeken BIM-model
curve_4 = Curve(simplify(graft(cull_pattern_7)))
divide_curve_2 = DivideCurve(Curve=curve_4, Count=5, Kinks=False)  # -> simplify(Points), simplify(Tangents), Parameters
list_item_24 = ListItem(List=divide_curve_2.Tangents, Index=0, Wrap=True)  # -> flatten(Item)
list_item_25 = ListItem(List=divide_curve_2.Tangents, Index=0, Wrap=True)
angle_2 = Angle(VectorA=list_item_25, VectorB=list_item_24)  # -> Angle, Reflex

# ----
# Onderlinge hoeken puntenwolk
curve_5 = Curve(simplify(graft(cull_pattern_6)))
divide_curve_3 = DivideCurve(Curve=curve_5, Count=5, Kinks=False)  # -> simplify(Points), simplify(Tangents), Parameters
list_item_26 = ListItem(List=divide_curve_3.Tangents, Index=0, Wrap=True)
list_item_27 = ListItem(List=divide_curve_3.Tangents, Index=0, Wrap=True)  # -> flatten(Item)
angle_3 = Angle(VectorA=list_item_26, VectorB=list_item_27)  # -> Angle, Reflex

# ----
# Relatieve fout
null_item = NullItem(Item=angle_3.Angle)  # -> NullFlags, InvalidFlags, Description
null_item_2 = NullItem(Item=angle_2.Angle)  # -> NullFlags, InvalidFlags, Description
expression_9 = Expression(x=null_item.InvalidFlags, Expression="If(x=true,false,true)")  # -> simplify(Result)
expression_10 = Expression(x=null_item_2.InvalidFlags, Expression="If(x=true,false,true)")  # -> simplify(Result)
cull_pattern_8 = CullPattern(List=angle_3.Angle, CullPattern=expression_9)
cull_pattern_9 = CullPattern(List=angle_2.Angle, CullPattern=expression_10)
subtraction_8 = Subtraction(A=cull_pattern_8, B=cull_pattern_9)

extend_curve_3 = ExtendCurve(Curve=curve_4, Type=0, Start=multiplication_2, End=multiplication_2)
extend_curve_4 = ExtendCurve(Curve=curve_5, Type=0, Start=multiplication_2, End=multiplication_2)
curve_curve = CurveCurve(CurveA=extend_curve_4, CurveB=extend_curve_3)  # -> simplify(Points), ParamsA, ParamsB
point = Point(curve_curve.Points)
list_length_14 = ListLength(List=extend_curve_3)

# ----
# Alles die +- -Pi is +Pi doen
pi = Pi(Factor=-0.8)
smaller_than_6 = SmallerThan(FirstNumber=subtraction_8, SecondNumber=pi)  # -> SmallerThan, OrEqualTo
boolean_3 = Boolean(True)
member_index_2 = MemberIndex(Set=smaller_than_6.SmallerThan, Member=boolean_3)  # -> Index, Count
list_item_28 = ListItem(List=subtraction_8, Index=member_index_2.Index, Wrap=True)
pi_2 = Pi(Factor=1)
addition_6 = Addition(A=list_item_28, B=pi_2)
list_item_29 = ListItem(List=addition_6, Index=member_index_2.Index, Wrap=True)  # -> simplify(Item)

# ----
# Alles die +-Pi is - Pi doen
pi_3 = Pi(Factor=0.8)
smaller_than_7 = SmallerThan(FirstNumber=subtraction_8, SecondNumber=pi_3)  # -> SmallerThan, OrEqualTo
boolean_4 = Boolean(False)
member_index_3 = MemberIndex(Set=smaller_than_7.SmallerThan, Member=boolean_4)  # -> Index, Count
pi_4 = Pi(Factor=1)
list_item_30 = ListItem(List=subtraction_8, Index=member_index_3.Index, Wrap=True)
subtraction_9 = Subtraction(A=list_item_30, B=pi_4)
list_item_31 = ListItem(List=subtraction_9, Index=member_index_3.Index, Wrap=True)  # -> simplify(Item)

# ----
# Alles die +-0 is 0 laten
expression_11 = Expression(x=smaller_than_7.SmallerThan, Expression="If(x=true,false,true)")  # -> simplify(Result)
gate_or_2 = GateOr(A=smaller_than_6.SmallerThan, B=expression_11)
expression_12 = Expression(x=gate_or_2, Expression="If(x=true,false,true)")  # -> simplify(Result)
cull_pattern_10 = CullPattern(List=subtraction_8, CullPattern=expression_12)

smaller_than_8 = SmallerThan(FirstNumber=list_length_14, SecondNumber=1)  # -> SmallerThan, OrEqualTo
shift_paths_9 = ShiftPaths(Data=minimum, Offset=-1)

# ----
# Hoek vlakken
panel_13 = Panel(shift_paths_9)

expression_13 = Expression(x=smaller_than_8.SmallerThan, Expression="If(x=true,false,true)")  # -> simplify(Result)
list_length_15 = ListLength(List=curve_curve.Points)
smaller_than_9 = SmallerThan(FirstNumber=list_length_15, SecondNumber=1)  # -> SmallerThan, OrEqualTo
member_index_4 = MemberIndex(Set=smaller_than_9.SmallerThan, Member=boolean_2)  # -> simplify(Index), Count
cull_pattern_11 = CullPattern(List=member_index_4.Index, CullPattern=expression_13)

# ----
# Roteren van de as van de wand
deconstruct_11 = Deconstruct(Point=curve_curve.Points)  # -> XComponent, YComponent, ZComponent
construct_point_11 = ConstructPoint(XCoordinate=deconstruct_11.XComponent, YCoordinate=deconstruct_11.YComponent, ZCoordinate=1)
end_points_5 = EndPoints(Curve=curve_5)  # -> Start, End
line = Line(StartPoint=curve_curve.Points, EndPoint=construct_point_11)
deconstruct_12 = Deconstruct(Point=end_points_5.Start)  # -> XComponent, YComponent, ZComponent
deconstruct_13 = Deconstruct(Point=end_points_5.End)  # -> XComponent, YComponent, ZComponent
construct_point_12 = ConstructPoint(XCoordinate=deconstruct_12.XComponent, YCoordinate=deconstruct_12.YComponent, ZCoordinate=1)
construct_point_13 = ConstructPoint(XCoordinate=deconstruct_13.XComponent, YCoordinate=deconstruct_13.YComponent, ZCoordinate=1)
_4point_surface_5 = _4PointSurface(CornerA=end_points_5.Start, CornerB=end_points_5.End, CornerC=construct_point_13, CornerD=construct_point_12)  # -> simplify(Surface)

# ----
# Mediaan berekenen
number_6 = Number([list_item_31, cull_pattern_10, list_item_29])

null_item_3 = NullItem(Item=number_6)  # -> NullFlags, InvalidFlags, Description
expression_14 = Expression(x=number_6, Expression="If(x=0,\"false\",\"true\")")
average_5 = Average(Input=number_6)
cull_pattern_12 = CullPattern(List=number_6, CullPattern=expression_14)

sort_2 = SortList(Keys=cull_pattern_12)  # -> Keys, ValuesA
lng_2 = ListLength(List=sort_2.Keys)
division_8 = Division(A=lng_2, B=2)
mod_2 = Modulus(A=lng_2, B=2)
subtraction_10 = Subtraction(A=division_8, B=1)
item_3 = ListItem(List=sort_2.Keys, Index=[subtraction_10, division_8], Wrap=True)
round_2 = Round(Number=division_8)  # -> Nearest, Floor, Ceiling
average_6 = Average(Input=item_3)
item_4 = ListItem(List=sort_2.Keys, Index=round_2.Floor, Wrap=True)
filter_2 = StreamFilter(Gate=mod_2, Stream0=item_4, Stream1=average_6)

shift_paths_10 = ShiftPaths(Data=average_5, Offset=-1)

# ----
# Gemiddelde hoek
panel_14 = Panel(shift_paths_10)

panel_15 = Panel(cull_pattern_12)
panel_16 = Panel(null_item_3.NullFlags)
shift_paths_11 = ShiftPaths(Data=filter_2, Offset=-1)
multiplication_10 = Multiplication(A=shift_paths_11, B=integer_6)

# ----
# Mediaan
panel_17 = Panel(multiplication_10)

replace_nulls = ReplaceNulls(Items=panel_17, Replacements=Slider(0, range=0..100))  # -> Items, Count

rotate_axis = RotateAxis(Geometry=curve_5, Angle=filter_2, Axis=line)  # -> simplify(Geometry), Transform
divide_curve_4 = DivideCurve(Curve=simplify(rotate_axis.Geometry), Count=10, Kinks=False)  # -> simplify(Points), Tangents, Parameters

shift_paths_12 = ShiftPaths(Data=divide_curve_4.Points, Offset=-1)

plane_closest_point_4 = PlaneClosestPoint(Point=simplify(shift_paths_12), Plane=_4point_surface_5)  # -> Point, UVPoint, simplify(Distance)
absolute_6 = Absolute(Value=plane_closest_point_4.Distance)
average_7 = Average(Input=absolute_6)  # -> simplify(ArithmeticMean)
replace_nulls_2 = ReplaceNulls(Items=average_7, Replacements=0)  # -> simplify(Items), Count

replace_items = ReplaceItems(List=replace_nulls_2.Items, Item=number_2, Indices=cull_pattern_11, Wrap=False)  # -> simplify(List)
shift_paths_13 = ShiftPaths(Data=replace_items, Offset=-1)

# ----
# Gewogen gemiddelde van de afwijkingen per wand
gradient_2 = Gradient(
    LowerLimit=0,
    UpperLimit=100,
    Parameter=shift_paths_13,
    stops=[0: RGB(224, 224, 224), 0.15: RGB(0, 128, 0), 0.15: RGB(255, 165, 0), 0.5: RGB(255, 165, 0)])
mesh_colours_2 = MeshColours(Mesh=mesh_4, Colours=gradient_2)

panel_18 = Panel(shift_paths_13)

# ----
# Kleuren absoluut en relatief
colour_swatch_2 = ColourSwatch(SwatchColor=RGB(255, 165, 0))
integer_13 = Integer(1)
integer_14 = Integer(3)
integer_15 = Integer(2)
integer_16 = Integer(0)
replace_members = ReplaceMembers(Set=[gradient_2, gradient], Find=ColourSwatch(SwatchColor=RGB(0, 128, 0)), Replace=integer_16)
replace_members_2 = ReplaceMembers(Set=replace_members, Find=colour_swatch_2, Replace=integer_13)
replace_members_3 = ReplaceMembers(Set=replace_members_2, Find=ColourSwatch(SwatchColor=RGB(255, 0, 0)), Replace=integer_15)
replace_members_4 = ReplaceMembers(Set=replace_members_3, Find=ColourSwatch(SwatchColor=RGB(224, 224, 224)), Replace=integer_14)
sort_list_8 = SortList(Keys=replace_members_4)  # -> Keys, ValuesValuesA
list_item_32 = ListItem(List=sort_list_8.Keys, Index=0, Wrap=True)
gradient_3 = Gradient(
    LowerLimit=0,
    UpperLimit=3,
    Parameter=list_item_32,
    stops=[0.02: RGB(0, 128, 0), 0.34: RGB(255, 165, 0), 0.67: RGB(255, 0, 0), 0.85: RGB(224, 224, 224)])
mesh_colours_3 = MeshColours(Mesh=mesh_3, Colours=gradient_3)

integer_17 = Integer(3)
integer_18 = Integer(0)
text_3 = Text("NVT")
integer_19 = Integer(1)
text_4 = Text("LOA 30")
integer_20 = Integer(2)
text_5 = Text("LOA 10")
text_6 = Text("LOA 20")
integer_21 = Integer(list_item_32)
replace_members_5 = ReplaceMembers(Set=integer_21, Find=integer_18, Replace=text_4)
replace_members_6 = ReplaceMembers(Set=replace_members_5, Find=integer_19, Replace=text_6)
replace_members_7 = ReplaceMembers(Set=replace_members_6, Find=integer_20, Replace=text_5)
replace_members_8 = ReplaceMembers(Set=replace_members_7, Find=integer_17, Replace=text_3)
panel_19 = Panel(replace_members_8)

txt_writer = TextDocumentWriter(relative=boolean, file=desired_file_extension, lines=flatten(panel_19), write=Button())  # inputs relative: Boolean, lines: list, write: Boolean, overwrite: Boolean, append: Boolean
# ---------- txt_writer: Python ----------
"""
Writes to a TXT or CSV file.
    Inputs:
        relative: Set to 'True' to create a new Text File using relative path. This file will live in the same directory as the Grasshopper document.
        file: TXT or CSV file to write to.
        lines: Text to write.
        write: Set to True to write.
        overwrite: Set to True to overwrite the specified file.
        append: Set to True to append the specified file.
"""

# Stephen P. Maher /  2015

ghenv.Component.Name = "Text Document Writer"
ghenv.Component.NickName = 'TXT-Writer'

import Grasshopper as gh
import os

if not relative and not file:
    msg = "Set either 'relative' to True or connect a file path to input parameter 'file'."
    ghenv.Component.AddRuntimeMessage(gh.Kernel.GH_RuntimeMessageLevel.Warning, msg)
elif relative == True:
    if overwrite == True and append == True:
        msg = "Set either 'overwrite' or 'append' to True."
        ghenv.Component.AddRuntimeMessage(gh.Kernel.GH_RuntimeMessageLevel.Error, msg)
    elif write:
        gh_path = ghdoc.Path # Get GH document's file path
        name = gh_path.split(".")[0]
        new = name.split("\\")
        file_name = new[4] + "_text_file.txt" # Create text file name
        dir = os.path.dirname(os.path.realpath(gh_path))
        file = os.path.join(dir, file_name) # Create text file path
        filePath = open(file, "w") # Open text file to create it
        if os.stat(file).st_size == 0: # Check to see if file has any data and continue if it's empty
            filePath = open(file, "w") # Open the file
            for line in lines: # Iterate through lines
                filePath.write(line + "\n") # Write separate lines
            filePath.close() # Close the file
        elif os.stat(file).st_size >= 1 and overwrite == False and append == False: # Check if file has data; if it does and 'overwrite' is  set to False, warn the user
            msg = "This file has content. If you wish to overwrite or append the file, please set either input parameters 'overwrite' or 'append' to True."
            ghenv.Component.AddRuntimeMessage(gh.Kernel.GH_RuntimeMessageLevel.Error, msg)
        elif os.stat(file).st_size >= 1 and overwrite == True: # If file has data and 'overwrite' set to True continue
            filePath = open(file, "w") # Open the file
            for line in lines: # Iterate through lines
                filePath.write(line + "\n") # Write separate lines
            filePath.close() # Close the file
        elif os.stat(file).st_size >= 1 and append == True: # If file has data and 'append' set to True and 'overwrite set to False  continue
            filePath = open(file, "a") # Open the file and 'append' document
            for line in lines: # Iterate through lines
                filePath.write("\n" + line) # Write separate lines
            filePath.close() # Close the file
    else:
        msg = "Set 'write' to True."
        ghenv.Component.AddRuntimeMessage(gh.Kernel.GH_RuntimeMessageLevel.Warning, msg)
elif relative == False or not relative:
    open(file, "w")
    if file:
        if overwrite == True and append == True:
            msg = "Set either 'overwrite' or 'append' to True."
            ghenv.Component.AddRuntimeMessage(gh.Kernel.GH_RuntimeMessageLevel.Error, msg)
        elif write:
            if os.stat(file).st_size == 0: # Check to see if file has any data and continue if it's empty
                filePath = open(file, "w") # Open the file
                for line in lines: # Iterate through lines
                    filePath.write(line + "\n") # Write separate lines
                filePath.close() # Close the file
            elif os.stat(file).st_size >= 1 and overwrite == False and append == False: # Check if file has data; if it does and 'overwrite' is  set to False, warn the user
                msg = "This file has content. If you wish to overwrite or append the file, please set either input parameters 'overwrite' or 'append' to True."
                ghenv.Component.AddRuntimeMessage(gh.Kernel.GH_RuntimeMessageLevel.Error, msg)
            elif os.stat(file).st_size >= 1 and overwrite == True: # If file has data and 'overwrite' set to True continue
                filePath = open(file, "w") # Open the file
                for line in lines: # Iterate through lines
                    filePath.write(line + "\n") # Write separate lines
                filePath.close() # Close the file
            elif os.stat(file).st_size >= 1 and append == True: # If file has data and 'append' set to True and 'overwrite set to False  continue
                filePath = open(file, "a") # Open the file and 'append' document
                for line in lines: # Iterate through lines
                    filePath.write("\n" + line) # Write separate lines
                filePath.close() # Close the file
        else:
            msg = "Set 'write' to True."
            ghenv.Component.AddRuntimeMessage(gh.Kernel.GH_RuntimeMessageLevel.Warning, msg)
    else:
        msg = "Input parameter 'file' failed to collect data."
        ghenv.Component.AddRuntimeMessage(gh.Kernel.GH_RuntimeMessageLevel.Warning, msg)
# ---------- end txt_writer ----------

text_7 = Text("Kleurencode absoluut")
define_object_attributes_3 = DefineObjectAttributes(Layer=text_7, Color=gradient_2)
bake_objects_3 = BakeObjects(Geometry=mesh_4, Attributes=define_object_attributes_3, BakeName="1", Bake=False)

# ----
# Baken van kleuren
text_8 = Text("Kleurencode resultaat")
define_object_attributes_4 = DefineObjectAttributes(Layer=text_8, Color=gradient_3)
bake_objects_4 = BakeObjects(Geometry=mesh_colours_3, Attributes=define_object_attributes_4, BakeName="1", Bake=False)
