# Grasshopper definition progress_monitoring_revit_inside.gh (Grasshopper 1.0.7)
# plug-ins: RhinoInside.Revit

# Select point clouds
category = DocumentCategoriesPicker({"Air Terminals": -2008013, "Analysis Display Style": -2000304, "Analysis Results": -2000303, "Areas": -2003200, "Bridge Abutments": -2006130, "Bridge Arches": -2006134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}, selected="Point Clouds": -2010001)
# Select specific Geometry e.g. Walls
category_2 = DocumentCategoriesPicker({"Air Terminals": -2008013, "Analysis Display Style": -2000304, "Analysis Results": -2000303, "Areas": -2003200, "Bridge Abutments": -2006130, "Bridge Arches": -2006134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}, selected="Walls": -2000011)
# Select All geometry
document_categories = DocumentCategories(Type=1, AllowsParameters=True, HasMaterialQuantities=True)
# Analyze Built walls
run = Button()
# Analyze built walls accuracy (red[>LOA10], orange [LOA20], green [LOA30])
run_2 = Button()
stream_gate = StreamGate(Gate=run)  # -> Target0, Target1
category_3 = Category()
element_geometry = ElementGeometry(Element=<geometry referenced from the Revit model>)
category_decompose = CategoryDecompose()  # -> Name, Parent, LineColor, Material, AllowsParameters, HasMaterialQuantities
document_elements = DocumentElements(Category=category)  # -> simplify(Elements)
document_elements_2 = DocumentElements(Category=category_2)  # -> simplify(Elements)
element_geometry_2 = ElementGeometry(Element=document_elements)  # -> simplify(Geometry)
element_geometry_3 = ElementGeometry(Element=document_elements_2)  # -> simplify(Geometry)
panel = Panel(element_geometry_3)
