# Grasshopper definition 0_Partial_walls2.gh (Grasshopper 1.0.7)
# plug-ins: EleFront, Scan2BIM, MeshEdit Components, Volvox

# ----
# INPUT
walls_clusters = Mesh([<mesh referenced from the Rhino model> x363])
floors = Mesh([<mesh referenced from the Rhino model> x51])
ceilings = Mesh([<mesh referenced from the Rhino model> x79])
get_rhino_attributes = GetRhinoAttributes(Geometry=walls_clusters)  # -> Name, Layer, Color
merge = Merge(Data1=floors, Data2=ceilings)
create_set = CreateSet(List=get_rhino_attributes.Name)  # -> Set, Map
filter_by_name = FilterByName(Geometry=walls_clusters, Name=create_set.Set)  # -> simplify(Geometry)
wall_segment_clusters = Mesh(simplify(filter_by_name))

number_slider = Slider(3, range=0..10)  # disabled
number_slider_2 = Slider(0, range=0..100)  # disabled
tree_branch = TreeBranch(Tree=filter_by_name, Path=number_slider_2, MaintainPaths=True)  # disabled

# ----
# 0.determine opossing points  for multiple walls.
# |v(psi,psj)| <1
# EDGE valid
# v(nsi) . v(psi,psj) > 0.05
# edges
# dotproduct (abs)
# v(nsi) . v(nsj) > 0.75
# test whether majority dotproduct is +/-
# dotproduct (signed)
# v (nsi)
# (psi)
populate_geometry = PopulateGeometry(Geometry=wall_segment_clusters, Count=expr("10*x+2", wall_segment_clusters), Seed=1)  # -> simplify(Population); disabled
populate_geometry_2 = PopulateGeometry(Geometry=wall_segment_clusters, Count=expr("10*x+3", wall_segment_clusters), Seed=1)  # -> simplify(Population)
shift_paths = ShiftPaths(Data=populate_geometry, Offset=-1)  # disabled
shift_paths_2 = ShiftPaths(Data=populate_geometry_2, Offset=-1)
number_slider_3 = Slider(15, range=0..100)
list_length = ListLength(List=populate_geometry_2)
closest_points = ClosestPoints(Point=shift_paths_2, Cloud=shift_paths_2, Count=number_slider_3)  # -> ClosestPoint, CPIndex, Distance
shift_paths_3 = ShiftPaths(Data=list_length, Offset=-1)
line = Line(StartPoint=graft(shift_paths_2), EndPoint=closest_points.ClosestPoint)
consecutive_domains = ConsecutiveDomains(Numbers=shift_paths_3, Additive=True)  # -> simplify(Domains)
shift_paths_4 = ShiftPaths(Data=closest_points.CPIndex, Offset=-1)
find_domain = FindDomain(Domains=consecutive_domains, Number=shift_paths_4, Strict=False)  # -> expr("x+1", Index), Neighbour
list_length_2 = ListLength(List=populate_geometry_2)
duplicate_data = DuplicateData(Data=graft(wall_segment_clusters), Number=list_length_2, Order=True)  # -> simplify(graft(Data))
list_item = ListItem(List=wall_segment_clusters, Index=find_domain.Index, Wrap=True)  # -> graft(Item)
mesh_closest_point = MeshClosestPoint(Point=graft(populate_geometry_2), Mesh=duplicate_data)  # -> Point, Index, Parameter
shift_paths_5 = ShiftPaths(Data=list_item, Offset=-1)
shift_paths_6 = ShiftPaths(Data=list_length, Offset=-1)
multiplication = Multiplication(A=shift_paths_6, B=number_slider_3)
partition_list = PartitionList(List=shift_paths_5, Size=multiplication)  # -> simplify(graft(Chunks))
mesh_eval = MeshEval(Mesh=duplicate_data, Parameter=mesh_closest_point.Parameter)  # -> Point, Normal, Colour
mesh_closest_point_2 = MeshClosestPoint(Point=graft(closest_points.ClosestPoint), Mesh=list_item)  # -> Point, Index, Parameter
shift_paths_7 = ShiftPaths(Data=mesh_eval.Point, Offset=-2)  # -> graft(Data)
shift_paths_8 = ShiftPaths(Data=mesh_eval.Normal, Offset=-2)  # -> graft(Data)
mesh_eval_2 = MeshEval(Mesh=partition_list, Parameter=mesh_closest_point_2.Parameter)  # -> Point, Normal, Colour
duplicate_data_2 = DuplicateData(Data=shift_paths_7, Number=number_slider_3, Order=True)  # -> simplify(Data)
duplicate_data_3 = DuplicateData(Data=shift_paths_8, Number=number_slider_3, Order=True)  # -> simplify(Data)
shift_paths_9 = ShiftPaths(Data=duplicate_data_3, Offset=-1)
dot_product = DotProduct(VectorA=simplify(graft(duplicate_data_3)), VectorB=simplify(graft(line)), Unitize=False)
dot_product_2 = DotProduct(VectorA=simplify(graft(duplicate_data_3)), VectorB=simplify(graft(line)), Unitize=False)  # disabled
shift_paths_10 = ShiftPaths(Data=dot_product, Offset=-2)
shift_paths_11 = ShiftPaths(Data=dot_product_2, Offset=-2)  # disabled
shift_paths_12 = ShiftPaths(Data=mesh_eval_2.Normal, Offset=-2)
dot_product_3 = DotProduct(VectorA=simplify(graft(shift_paths_12)), VectorB=simplify(graft(shift_paths_9)), Unitize=True)
dot_product_4 = DotProduct(VectorA=simplify(graft(shift_paths_12)), VectorB=simplify(graft(shift_paths_9)), Unitize=True)  # disabled
shift_paths_13 = ShiftPaths(Data=dot_product_3, Offset=-1)
shift_paths_14 = ShiftPaths(Data=dot_product_4, Offset=-1)  # disabled
number = Number(expr("abs(x)", shift_paths_13))
number_2 = Number(expr("abs(x)", shift_paths_14))  # disabled
number_3 = Number(expr("abs(x)", shift_paths_10))
list_length_3 = ListLength(List=populate_geometry_2)
number_4 = Number(expr("abs(x)", shift_paths_11))  # disabled
shift_paths_15 = ShiftPaths(Data=line, Offset=-1)
shift_paths_16 = ShiftPaths(Data=list_length_3, Offset=-1)
larger_than = LargerThan(FirstNumber=number_3, SecondNumber=Slider(0.08, range=0..1))  # -> simplify(LargerThan), OrEqualTo
larger_than_2 = LargerThan(FirstNumber=number, SecondNumber=Slider(0.5, range=0..1))  # -> LargerThan, OrEqualTo
multiplication_2 = Multiplication(A=shift_paths_16, B=number_slider_3)
partition_list_2 = PartitionList(List=shift_paths_10, Size=multiplication_2)
shift_paths_17 = ShiftPaths(Data=duplicate_data_3, Offset=-1)
shift_paths_18 = ShiftPaths(Data=duplicate_data_2, Offset=-1)

tree_branch_2 = TreeBranch(Tree=shift_paths_2, Path=number_slider_2, MaintainPaths=True)  # disabled
shift_paths_19 = ShiftPaths(Data=closest_points.Distance, Offset=-1)

smaller_than = SmallerThan(FirstNumber=shift_paths_19, SecondNumber=Slider(1, range=0..1))  # -> SmallerThan, OrEqualTo
gate_and = GateAnd(C=smaller_than.SmallerThan, A=larger_than.LargerThan, B=larger_than_2.LargerThan)
partition_list_3 = PartitionList(List=gate_and, Size=multiplication_2)
dispatch = Dispatch(List=simplify(number_3), DispatchPattern=gate_and)  # -> ListA, ListB
dispatch_2 = Dispatch(List=simplify(partition_list_2), DispatchPattern=partition_list_3)  # -> ListA, ListB
dispatch_3 = Dispatch(List=simplify(shift_paths_15), DispatchPattern=gate_and)  # -> ListA, ListB
dispatch_4 = Dispatch(List=simplify(shift_paths_17), DispatchPattern=gate_and)  # -> ListA, ListB
dispatch_5 = Dispatch(List=simplify(shift_paths_18), DispatchPattern=gate_and)  # -> ListA, ListB
geometry = Geometry(dispatch_3.ListA)

# ----
# 1. compute Mode thickness Dr
interval = Slider(0.03, range=0..0.1)
bounds = Bounds(Numbers=dispatch.ListA)
deconstruct_domain = DeconstructDomain(Domain=bounds)  # -> Start, End
subtraction = Subtraction(A=deconstruct_domain.End, B=deconstruct_domain.Start)
evaluate = Evaluate(Expression="round(i/interval,0)", I=subtraction, interval=interval)
histogram_maker = HistogramMaker(data=dispatch.ListA, divs=evaluate)  # -> out, simplify(histogram); inputs data: list, divs: Int32
# ---------- histogram_maker: C# usings ----------
using System.IO;
using System.Linq;
using System.Data;
using System.Drawing;
using System.Reflection;
using System.Windows.Forms;
using System.Xml;
using System.Xml.Linq;
using System.Runtime.InteropServices;

using Rhino.DocObjects;
using Rhino.Collections;
using GH_IO;
using GH_IO.Serialization;
# ---------- histogram_maker: C# ----------
    //find min and max of each

    double minsofar = Convert.ToDouble(data[0]);
    double maxsofar = Convert.ToDouble(data[0]);

    foreach (object xx in data)
    {
      minsofar = Math.Min(minsofar, Convert.ToDouble(xx));
      maxsofar = Math.Max(maxsofar, Convert.ToDouble(xx));
    }

    //assign each value a category, 0 being the lowest group, 100 being the highest
    int[] cats = new int[divs + 1];
    for (int i = 0; i < cats.Length; i++) cats[i] = 0;

    for (int i = 0; i < data.Count; i++)
    {
      double cat = divs * ((Convert.ToDouble(data[i]) - minsofar) / (maxsofar - minsofar));
      Math.Round(Convert.ToDouble(data[i]) + divs/2, 0);
      cats[(int) cat]++;
    }

    histogram = cats;
# ---------- end histogram_maker ----------
cull_index = CullIndex(List=histogram_maker.histogram, Indices=[0, 1, 2], Wrap=True)  # -> simplify(List)
c_script = CSharpScript(histogram=cull_index)  # -> out, simplify(i), height_peak; inputs histogram: list of Int32
# ---------- c_script: C# usings ----------
using System.Linq;
# ---------- c_script: C# ----------
    List<int> sortedhistogram = new List<int>(histogram.OrderByDescending(x => x));

    int peak1 = sortedhistogram[0];
    i = histogram.FindIndex(x => x == peak1);
    height_peak = peak1;
    //    peaki = Math.Sqrt(histogram[i_p1]);
    //    peakj = Math.Sqrt(histogram[i_p2]);
    // peaki = (double) (histogram[i_p1]) / peak1;
# ---------- end c_script ----------
number_5 = Number(3)
evaluate_2 = Evaluate(
    Expression="(i+offset)*interval+startdomain+0.5*interval",
    i=c_script.i,
    offset=number_5,
    interval=interval,
    startdomain=deconstruct_domain.Start)  # -> simplify(Result)
path_mapper = PathMapper(evaluate_2, source=["{A;B}", "{A}"], target=["{path_index}", "{path_index}"])
number_6 = Number(expr("round(x,2)", simplify(path_mapper)))
replace_nulls = ReplaceNulls(Items=number_6, Replacements=0.1)  # -> Items, Count

construct_point = ConstructPoint(XCoordinate=replace_nulls.Items, YCoordinate=0, ZCoordinate=0)
point_groups = PointGroups(Points=flatten(construct_point), Distance=Slider(0.03, range=0..0.1))  # -> Groups, Indices
create_set_2 = CreateSet(List=flatten(replace_nulls.Items))  # -> Set, Map
list_item_2 = ListItem(List=flatten(replace_nulls.Items), Index=point_groups.Indices, Wrap=True)  # -> simplify(Item)
average = Average(Input=list_item_2)
panel = Panel(average)
average_2 = Average(Input=dispatch.ListA)
thickness_dw = Number(average_2)
panel_2 = Panel(thickness_dw)

# ----
# find neirest floor/ceiling to project C away from it
# compute dotproduct
# floor
populate_geometry_3 = PopulateGeometry(Geometry=merge, Count=expr("3*x", merge), Seed=1)  # -> simplify(Population)
list_length_4 = ListLength(List=populate_geometry_3)  # -> flatten(Length)
merge_2 = Merge(Data1=0, Data2=list_length_4)
consecutive_domains_2 = ConsecutiveDomains(Numbers=merge_2, Additive=True)

construct_cloud = ConstructCloud(Points=flatten(populate_geometry_3))

# ----
# filter points that are inside floor or ceiling
# 2. compute wall candidates C
# create P
# create C walls
# if dotproduct = -, project P away from normal
# create C floors/ceilings
# if dotproduct = +, project P away from floor
number_7 = Number(expr("abs(x)", dispatch_2.ListA))
division = Division(A=dispatch_2.ListA, B=number_7)
mass_addition = MassAddition(Input=division)  # -> Result, PartialResults
shift_paths_20 = ShiftPaths(Data=mass_addition.Result, Offset=-1)
shift_paths_21 = ShiftPaths(Data=mesh_eval.Point, Offset=-2)
shift_paths_22 = ShiftPaths(Data=mesh_eval.Normal, Offset=-2)
replace_nulls_2 = ReplaceNulls(Items=shift_paths_20, Replacements=1)  # -> Items, Count
evaluate_3 = Evaluate(
    Expression="n*0.5*d*dotproduct/abs(dotproduct)",
    n=shift_paths_22,
    d=simplify(replace_nulls.Items),
    dotproduct=replace_nulls_2.Items)
move = Move(Geometry=shift_paths_21, Motion=evaluate_3)  # -> Geometry, Transform
clean_tree = CleanTree(RemoveNulls=True, RemoveInvalid=True, RemoveEmpty=False, Tree=move.Geometry)
geometry_2 = Geometry(simplify(graft(ceilings)))
geometry_3 = Geometry(simplify(graft(floors)))
move_2 = Move(Geometry=clean_tree, Motion=Vector(0, 0, 1))  # -> Geometry, Transform
move_3 = Move(Geometry=clean_tree, Motion=Vector(0, 0, -1))  # -> Geometry, Transform
move_4 = Move(Geometry=geometry_2, Motion=Vector(0, 0, -1))  # -> Geometry, Transform
move_5 = Move(Geometry=geometry_3, Motion=Vector(0, 0, 1))  # -> Geometry, Transform
line_2 = Line(StartPoint=move_2.Geometry, EndPoint=move_3.Geometry)
merge_3 = Merge(Data1=move_4.Geometry, Data2=move_5.Geometry)

tree_branch_3 = TreeBranch(Tree=move.Geometry, Path=number_slider_2, MaintainPaths=True)  # disabled
closest_point = ClosestPoint(Cloud=construct_cloud, Point=shift_paths_21)  # -> Point, Normal, Color, Distance, Index

line_3 = Line(StartPoint=simplify(graft(shift_paths_21)), EndPoint=simplify(graft(closest_point.Point)))
find_domain_2 = FindDomain(Domains=consecutive_domains_2, Number=closest_point.Index, Strict=False)  # -> simplify(Index), Neighbour
create_set_3 = CreateSet(List=find_domain_2.Index)  # -> Set, Map
sort_list = SortList(Keys=create_set_3.Set, ValuesValuesA=create_set_3.Set)  # -> reverse(Keys), reverse(ValuesValuesA)
list_item_3 = ListItem(List=sort_list.ValuesValuesA, Index=0, Wrap=True)
list_item_4 = ListItem(List=merge, Index=list_item_3, Wrap=True)
dot_product_5 = DotProduct(VectorA=line_3, VectorB=mesh_eval.Normal, Unitize=True)
shift_paths_23 = ShiftPaths(Data=dot_product_5, Offset=-1)

tree_branch_4 = TreeBranch(Tree=list_item_4, Path=number_slider_2, MaintainPaths=True)  # disabled
mesh_join = MeshJoin(Meshes=flatten(merge_3))

number_8 = Number(expr("abs(x)", shift_paths_23))
division_2 = Division(A=shift_paths_23, B=number_8)
mass_addition_2 = MassAddition(Input=division_2)  # -> Result, PartialResults
shift_paths_24 = ShiftPaths(Data=mass_addition_2.Result, Offset=-1)
number_9 = Number(expr("-1*x", shift_paths_24))
evaluate_4 = Evaluate(Expression="n*0.5*d*dotproduct/abs(dotproduct)", n=shift_paths_22, d=simplify(replace_nulls.Items), dotproduct=number_9)
move_6 = Move(Geometry=shift_paths_21, Motion=evaluate_4)  # -> Geometry, Transform
clean_tree_2 = CleanTree(RemoveNulls=True, RemoveInvalid=True, RemoveEmpty=False, Tree=move_6.Geometry)
mesh_curve = MeshCurve(Mesh=flatten(mesh_join), Curve=graft(line_2))  # -> Points, Faces
shift_paths_25 = ShiftPaths(Data=mesh_curve.Points, Offset=-1)
list_length_5 = ListLength(List=shift_paths_25)
dispatch_6 = Dispatch(List=simplify(graft(clean_tree)), DispatchPattern=list_length_5)  # -> ListA, ListB
candidates_c = Geometry(dispatch_6.ListB)
shift_paths_26 = ShiftPaths(Data=candidates_c, Offset=-1)
merge_4 = Merge(Data1=shift_paths_26, Data2=clean_tree_2)

# ----
# 3. Compute wall axes
mesh_area = MeshArea(Mesh=wall_segment_clusters)  # -> Area, Centroid
mass_addition_3 = MassAddition(Input=mesh_area.Area)  # -> Result, PartialResults
t = Slider(0.4, range=0..1)
t_2 = Slider(0.03, range=0..1)
number_10 = Number(expr("round(0.1*x,0)+3", mass_addition_3.Result))
wallfit = Wallfit(C=merge_4, P=shift_paths_21, K=Slider(100, range=0..1000), T=t_2, Dw=replace_nulls.Items, W=t, N=number_10)  # -> Hearth_line, InlrNum
control_points = ControlPoints(Curve=wallfit.Hearth_line)  # -> simplify(Points), Weights, Knots
c_script_2 = CSharpScript(points=control_points.Points)  # -> out, lines; inputs points: list of Point3d
# ---------- c_script_2: C# ----------
    List<Line> lines_temp = new List<Line>();
    for (int i = 0;i < points.Count - 1;i++)
    {
      Line line = new Line(points[i], points[i + 1]);
      lines_temp.Add(line);
    }
    lines = lines_temp;
# ---------- end c_script_2 ----------
wall_axes = Geometry(c_script_2.lines)

panel_3 = Panel(dispatch_6.ListA)

# ----
# 4. Project walls on level
curve_middle = CurveMiddle(Curve=c_script_2.lines)
deconstruct = Deconstruct(Point=simplify(curve_middle))  # -> XComponent, YComponent, ZComponent
mesh_area_2 = MeshArea(Mesh=floors)  # -> Area, Centroid
deconstruct_2 = Deconstruct(Point=mesh_area_2.Centroid)  # -> XComponent, YComponent, ZComponent
construct_point_2 = ConstructPoint(XCoordinate=0, YCoordinate=0, ZCoordinate=deconstruct.ZComponent)
construct_point_3 = ConstructPoint(XCoordinate=0, YCoordinate=0, ZCoordinate=deconstruct_2.ZComponent)
point_groups_2 = PointGroups(Points=construct_point_3, Distance=Slider(0.5, range=0..2))  # -> Groups, Indices
list_item_5 = ListItem(List=mesh_area_2.Centroid, Index=point_groups_2.Indices, Wrap=True)
average_3 = Average(Input=list_item_5)
deconstruct_3 = Deconstruct(Point=simplify(average_3))  # -> XComponent, YComponent, ZComponent
construct_point_4 = ConstructPoint(XCoordinate=0, YCoordinate=0, ZCoordinate=deconstruct_3.ZComponent)
plane_normal = PlaneNormal(Origin=average_3, ZAxis=Vector(0, 0, 1))  # -> simplify(Plane)

closest_point_2 = ClosestPoint(Point=construct_point_2, Cloud=flatten(construct_point_4))  # -> ClosestPoint, CPIndex, Distance

project = Project(Geometry=c_script_2.lines, Plane=closest_point_2.ClosestPoint)  # -> Geometry, Transform
wall_axes_2 = Geometry(project.Geometry)

# ----
# Bake Partial Walls
concatenate = Concatenate(Fragment_A=simplify(graft(create_set.Set)), A="_", Fragment_B=replace_nulls.Items)
define_layer = DefineLayer(Name="walls_partial", Color=RGB(0, 0, 0))
define_object_attributes = DefineObjectAttributes(Name=concatenate, Layer=define_layer, Material=replace_nulls.Items)
bake_objects = BakeObjects(Geometry=wall_axes_2, Attributes=define_object_attributes, BakeName="65", Bake=False)

panel_4 = Panel(concatenate)
