# Grasshopper definition 1_Trim_wall_lines.gh (Grasshopper 1.0.7)
# plug-ins: EleFront

td = Slider(0.2, range=0..1)
# Input
wall_axes = Curve(simplify(graft([<curve referenced from the Rhino model> x155])))
multiple_curves = MultipleCurves(Curves=flatten(wall_axes))  # -> simplify(graft(Points)), simplify(graft(IndexA)), simplify(graft(IndexB)), simplify(graft(ParamA)), simplify(graft(ParamB))
merge = Merge(Data1=multiple_curves.ParamA, Data2=multiple_curves.ParamB)  # -> simplify(graft(Result))
merge_2 = Merge(Data1=multiple_curves.IndexA, Data2=multiple_curves.IndexB)  # -> simplify(graft(Result))
create_tree = CreateTree(Data=merge, Path=merge_2)
list_item = ListItem(List=flatten(wall_axes), Index=merge_2, Wrap=True)
create_tree_2 = CreateTree(Data=list_item, Path=merge_2)
length_parameter = LengthParameter(Curve=create_tree_2, Parameter=create_tree)  # -> Length, Length_2
list_item_2 = ListItem(List=create_tree_2, Index=0, Wrap=True)
merge_3 = Merge(Data1=length_parameter.Length, Data2=length_parameter.Length_2)
smaller_than = SmallerThan(FirstNumber=merge_3, SecondNumber=td)  # -> SmallerThan, OrEqualTo
# Remove connections =0 and >td
equality = Equality(FirstNumber=merge_3, SecondNumber=0)  # -> Equality, Inequality
gate_and = GateAnd(A=equality.Inequality, B=smaller_than.SmallerThan)
multiplication = Multiplication(A=gate_and, B=merge_3)
list_item_3 = ListItem(List=reverse(multiplication), Index=0, Wrap=True)
list_item_4 = ListItem(List=multiplication, Index=0, Wrap=True)
extend_curve = ExtendCurve(Curve=list_item_2, Type=0, Start=expr("-x", list_item_4), End=expr("-x", list_item_3))
list_length = ListLength(List=flatten(wall_axes))
join_curves = JoinCurves(Curves=extend_curve, Preserve=True)  # -> simplify(Curves)
series = Series(Start=0, Step=1, Count=list_length)
shift_paths = ShiftPaths(Data=merge_2, Offset=-1)  # -> flatten(Data)
get_rhino_attributes = GetRhinoAttributes(Geometry=wall_axes)  # -> Name, Layer, Color
create_set = CreateSet(List=shift_paths)  # -> Set, Map
cull_index = CullIndex(List=flatten(series), Indices=create_set.Set, Wrap=True)
define_layer = DefineLayer(Name="walllines_trimmed", Color=RGB(240, 10, 10))
define_object_attributes = DefineObjectAttributes(Name=get_rhino_attributes.Name, Layer=define_layer)
dispatch = Dispatch(List=wall_axes, DispatchPattern=create_set.Set)  # -> ListA, ListB
tree_branch = TreeBranch(Tree=wall_axes, Path=cull_index, MaintainPaths=True)
merge_4 = Merge(Data1=tree_branch, Data2=join_curves)
bake_objects = BakeObjects(Geometry=merge_4, Attributes=define_object_attributes, BakeName="62", Bake=False)
