# Grasshopper definition 2_Topology.gh (Grasshopper 1.0.7)
# plug-ins: MeshEdit Components, EleFront, Scan2BIM

# trim wall lines prior to topology
# disable ceilings or segments
# if you do not want them to affect
# the topology
wall_axes = Curve()
td = Slider(3, range=0..10)
# Output
k_neighbors = Slider(10, range=0..10)
bake = Button()
wall_segments = Geometry()
# Input
wall_lines_l = Geometry(wall_axes)
ceilings = Mesh()

# ----
# 1.select adjacent curves to each P that are not connected to P
# filter endpoints that are already connected to another curve
# remove wall i from list
extend_curve = ExtendCurve(Curve=wall_lines_l, Type=0, Start=-0.02, End=-0.02)
end_points = EndPoints(Curve=simplify(graft(wall_lines_l)))  # -> simplify(Start), simplify(End)
clean_tree = CleanTree(RemoveNulls=True, RemoveInvalid=True, RemoveEmpty=False, Tree=extend_curve)
length = Length(Curve=wall_lines_l)  # -> expr("round(x,0)+1", Length)
merge = Merge(Data1=end_points.Start, Data2=end_points.End)  # -> simplify(graft(EndPoints))
curve_closest_point = CurveClosestPoint(Point=merge, Curve=clean_tree)  # -> Point, Parameter, Distance
sort_list = SortList(Keys=curve_closest_point.Distance)  # -> Keys, ValuesValuesA
divide_curve = DivideCurve(Curve=wall_lines_l, Count=length, Kinks=False)  # -> simplify(flatten(Points)), Tangents, Parameters
list_item = ListItem(List=sort_list.Keys, Index=0, Wrap=True)
larger_than = LargerThan(FirstNumber=list_item, SecondNumber=0.01)  # -> LargerThan, OrEqualTo
number = Number(expr("x+1", length))
merge_2 = Merge(Data1=0, Data2=number)
dispatch = Dispatch(List=merge, DispatchPattern=larger_than.LargerThan)  # -> ListA, ListB
closest_points = ClosestPoints(Point=dispatch.ListA, Cloud=divide_curve.Points, Count=k_neighbors)  # -> ClosestPoint, simplify(CPIndex), simplify(Distance)
larger_than_2 = LargerThan(FirstNumber=closest_points.Distance, SecondNumber=0)  # -> LargerThan, OrEqualTo
smaller_than = SmallerThan(FirstNumber=closest_points.Distance, SecondNumber=td)  # -> SmallerThan, OrEqualTo
consecutive_domains = ConsecutiveDomains(Numbers=merge_2, Additive=True)
gate_and = GateAnd(A=smaller_than.SmallerThan, B=larger_than_2.LargerThan)
dispatch_2 = Dispatch(List=closest_points.CPIndex, DispatchPattern=gate_and)  # -> ListA, ListB
find_domain = FindDomain(Domains=consecutive_domains, Number=dispatch_2.ListA, Strict=False)  # -> Index, Neighbour
list_item_2 = ListItem(List=closest_points.CPIndex, Index=dispatch_2.ListA, Wrap=True)  # disabled
create_set = CreateSet(List=find_domain.Index)  # -> Set, Map
tree_statistics = TreeStatistics(Tree=create_set.Set)  # -> Paths, Length, Count
deconstruct_path = DeconstructPath(Branch=tree_statistics.Paths)
list_item_3 = ListItem(List=deconstruct_path, Index=0, Wrap=True)  # -> simplify(Item)
create_tree = CreateTree(Data=list_item_3, Path=tree_statistics.Paths)
member_index = MemberIndex(Set=create_set.Set, Member=create_tree)  # -> simplify(Index), Count
cull_index = CullIndex(List=create_set.Set, Indices=member_index.Index, Wrap=True)  # -> simplify(List)
list_item_4 = ListItem(List=wall_lines_l, Index=cull_index, Wrap=True)
clean_tree_2 = CleanTree(RemoveNulls=True, RemoveInvalid=True, RemoveEmpty=True, Tree=list_item_4)

# ----
# extract potential pi
end_points_2 = EndPoints(Curve=simplify(wall_lines_l))  # -> simplify(Start), simplify(End); disabled

number_slider = Slider(2, range=0..10)  # disabled
shift_paths = ShiftPaths(Offset=-1)  # disabled

# ----
# keep only configurations with 3 walls
length_2 = Length(Curve=shift_paths)  # disabled
series = Series(Start=3, Step=1, Count=10)  # disabled
sort_list_2 = SortList(Keys=length_2, ValuesValuesA=shift_paths)  # -> reverse(Keys), reverse(ValuesValuesA); disabled
cull_index_2 = CullIndex(List=sort_list_2.ValuesValuesA, Indices=series, Wrap=False)  # -> simplify(List); disabled

tree_branch = TreeBranch(Tree=cull_index_2, Path=number_slider, MaintainPaths=True)  # disabled

# ----
# 2.establish potential connections of wall i
# comput U and V of wall axis i
# Compute potential V (with respect to endpoints)
# potential extensions of wall i
# Compute potential U (with respect to endpoints)
tree_statistics_2 = TreeStatistics(Tree=clean_tree_2)  # -> Paths, Length, Count
wall_lines_l_2 = Geometry(wall_lines_l)
deconstruct_path_2 = DeconstructPath(Branch=tree_statistics_2.Paths)  # -> simplify(Indices)
list_item_5 = ListItem(Parameters=deconstruct_path_2, Index=1, Wrap=True)
list_item_6 = ListItem(Walls=deconstruct_path_2, Index=0, Wrap=True)
list_item_7 = ListItem(List=wall_lines_l_2, Index=list_item_6, Wrap=True)
dispatch_3 = Dispatch(List=list_item_7, DispatchPattern=list_item_5)  # -> ListA, ListB
dispatch_4 = Dispatch(List=list_item_7, DispatchPattern=list_item_5)  # -> ListA, ListB
evaluate_curve = EvaluateCurve(Curve=reparameterize(graft(dispatch_4.ListA)), Parameter=1)  # -> Point, Tangent, Angle
evaluate_curve_2 = EvaluateCurve(Curve=reparameterize(graft(dispatch_4.ListB)), Parameter=0)  # -> Point, Tangent, Angle
rotate = Rotate(Vector=evaluate_curve.Tangent, Axis=Vector(0, 0, 1), Angle=1.570796327)
rotate_2 = Rotate(Vector=evaluate_curve_2.Tangent, Axis=Vector(0, 0, 1), Angle=1.570796327)

length_3 = Length(Curve=dispatch_3.ListA)
length_4 = Length(Curve=dispatch_3.ListB)
end_points_3 = EndPoints(Curve=list_item_7)  # -> Start, End
create_tree_2 = CreateTree(Data=list_item_7, Path=tree_statistics_2.Paths)
merge_3 = Merge(Data1=end_points_3.Start, Data2=end_points_3.End)
list_item_8 = ListItem(List=merge_3, Index=list_item_5, Wrap=True)
create_tree_3 = CreateTree(Data=list_item_8, Path=tree_statistics_2.Paths)

# ----
# 2.establish potential connections to wall j
# Compute potential V
# potential intersection points U,V
# remove invalid intersections (U,V not on connection)
# project ceilings on levels
# Compute potential U
# Potential U,V and wall extensions
# remove intersections with  ceilings
# copy and retrieve data
# Pi
# wall lines j
evaluate_curve_3 = EvaluateCurve(Curve=reparameterize(graft(clean_tree_2)), Parameter=[0, 1])  # -> Point, Tangent, Angle
extend_curve_2 = ExtendCurve(Curve=clean_tree_2, Type=0, Start=td, End=td)
rotate_3 = Rotate(Vector=evaluate_curve_3.Tangent, Axis=Vector(0, 0, 1), Angle=1.570796327)
number_2 = Number(expr("0.33*x", td))
line_sdl = LineSDL(Start=evaluate_curve_3.Point, Direction=rotate_3, Length=number_2)
extend_curve_3 = ExtendCurve(Curve=line_sdl, Type=0, Start=number_2, End=0)
shift_paths_2 = ShiftPaths(Data=extend_curve_3, Offset=-1)
merge_4 = Merge(Data1=shift_paths_2, Data2=extend_curve_2)
duplicate_data = DuplicateData(Data=clean_tree_2, Number=2, Order=False)  # -> simplify(Data)
duplicate_data_2 = DuplicateData(Data=create_tree_2, Number=2, Order=False)  # -> simplify(Data)
duplicate_data_3 = DuplicateData(Data=create_tree_3, Number=2, Order=False)  # -> simplify(Data)
curve_middle = CurveMiddle(Curve=clean_tree_2)  # -> flatten(Midpoint)
move = Move(Geometry=ceilings, Motion=Vector(0, 0, -4))  # -> Geometry, Transform
mesh_area = MeshArea(Mesh=move.Geometry)  # -> Area, Centroid
merge_5 = Merge(Data1=duplicate_data, Data2=clean_tree_2)
deconstruct = Deconstruct(Point=curve_middle)  # -> XComponent, YComponent, ZComponent
cross_reference = CrossReference(ListListA=duplicate_data_3, ListListB=merge_4, CrossMode=7)  # -> simplify(graft(ListListA)), simplify(graft(ListListB))
cross_reference_2 = CrossReference(ListListA=duplicate_data_2, ListListB=merge_5, CrossMode=7)  # -> simplify(graft(ListListA)), simplify(graft(ListListB))
deconstruct_2 = Deconstruct(Point=mesh_area.Centroid)  # -> XComponent, YComponent, ZComponent
create_set_2 = CreateSet(List=deconstruct.ZComponent)  # -> Set, Map
construct_point = ConstructPoint(XCoordinate=0, YCoordinate=0, ZCoordinate=deconstruct_2.ZComponent)
wall_i = Geometry(cross_reference_2.ListListA)
wall_j = Geometry(cross_reference_2.ListListB)
construct_point_2 = ConstructPoint(XCoordinate=0, YCoordinate=0, ZCoordinate=create_set_2.Set)
closest_point = ClosestPoint(Point=construct_point, Cloud=construct_point_2)  # -> ClosestPoint, CPIndex, Distance
project = Project(Geometry=ceilings, Plane=closest_point.ClosestPoint)  # -> Geometry, Transform
merge_6 = Merge(Data1=wall_i, Data2=wall_j)
mesh_join = MeshJoin(Meshes=project.Geometry)

extend_curve_4 = ExtendCurve(Curve=dispatch_3.ListA, Type=0, Start=expr("-x", length_3), End=td)
extend_curve_5 = ExtendCurve(Curve=dispatch_3.ListB, Type=0, Start=td, End=expr("-x", length_4))
merge_7 = Merge(Data1=extend_curve_4, Data2=extend_curve_5)
create_tree_4 = CreateTree(Data=merge_7, Path=tree_statistics_2.Paths)
line_sdl_2 = LineSDL(Start=evaluate_curve.Point, Direction=rotate, Length=number_2)
line_sdl_3 = LineSDL(Start=evaluate_curve_2.Point, Direction=rotate_2, Length=number_2)
extend_curve_6 = ExtendCurve(Curve=line_sdl_2, Type=0, Start=number_2, End=0)  # -> simplify(Curve)
extend_curve_7 = ExtendCurve(Curve=line_sdl_3, Type=0, Start=number_2, End=0)  # -> simplify(Curve)
merge_8 = Merge(Data1=extend_curve_6, Data2=extend_curve_7)
create_tree_5 = CreateTree(Data=merge_8, Path=tree_statistics_2.Paths)
merge_9 = Merge(Data1=create_tree_5, Data2=create_tree_4)

cross_reference_3 = CrossReference(ListListA=merge_9, ListListB=merge_4, CrossMode=7)  # -> simplify(graft(ListListA)), simplify(graft(ListListB))
merge_10 = Merge(Data1=cross_reference_3.ListListA, Data2=cross_reference_3.ListListB)
connections = Geometry(merge_10)
curve_curve = CurveCurve(CurveA=cross_reference_3.ListListA, CurveB=cross_reference_3.ListListB, UseTasks=True)  # -> simplify(Points), ParamsA, ParamsB
points = Geometry(curve_curve.Points)
curve_closest_point_2 = CurveClosestPoint(Point=points, Curve=connections)  # -> simplify(Point), Parameter, expr("round(x,2)", simplify(Distance))
mass_addition = MassAddition(Input=curve_closest_point_2.Distance)  # -> Result, PartialResults
equality = Equality(FirstNumber=mass_addition.Result, SecondNumber=0)  # -> Equality, Inequality
dispatch_5 = Dispatch(List=merge_6, DispatchPattern=equality.Equality)  # -> ListA, ListB
dispatch_6 = Dispatch(List=cross_reference.ListListA, DispatchPattern=equality.Equality)  # -> ListA, ListB
dispatch_7 = Dispatch(List=points, DispatchPattern=equality.Equality)  # -> ListA, ListB
geometry = Geometry(dispatch_7.ListA)
move_2 = Move(Geometry=geometry, Motion=Vector(0, 0, -0.5))  # -> Geometry, Transform
move_3 = Move(Geometry=geometry, Motion=Vector(0, 0, 0.5))  # -> Geometry, Transform
line = Line(StartPoint=move_2.Geometry, EndPoint=move_3.Geometry)
mesh_curve = MeshCurve(Mesh=mesh_join, Curve=line)  # -> Points, Faces
shift_paths_3 = ShiftPaths(Data=mesh_curve.Points, Offset=-1)
list_length = ListLength(List=shift_paths_3)
equality_2 = Equality(FirstNumber=list_length, SecondNumber=0)  # -> Equality, Inequality
curve_closest_point_3 = CurveClosestPoint(Point=geometry, Curve=wall_j)  # -> simplify(Point), ParameterP, expr("round(x,2)", simplify(Distance))
gate_and_2 = GateAnd(C=equality_2.Equality, B=True)
geometry_2 = Geometry(dispatch_7.ListA)
dispatch_8 = Dispatch(List=dispatch_6.ListA, DispatchPattern=gate_and_2)  # -> ListA, ListB
dispatch_9 = Dispatch(List=dispatch_5.ListA, DispatchPattern=gate_and_2)  # -> WalliJ, ListB
dispatch_10 = Dispatch(List=curve_closest_point_3.Point, DispatchPattern=gate_and_2)  # -> ListA, ListB
dispatch_11 = Dispatch(List=geometry, DispatchPattern=gate_and_2)  # -> ListA, ListB
geometry_3 = Geometry(dispatch_10.ListA)
geometry_4 = Geometry(dispatch_11.ListA)
geometry_5 = Geometry(dispatch_8.ListA)
geometry_6 = Geometry(dispatch_9.WalliJ)
line_2 = Line(StartPoint=geometry_5, EndPoint=geometry_4)
line_3 = Line(StartPoint=geometry_3, EndPoint=geometry_4)
line_4 = Line(StartPoint=geometry_5, EndPoint=geometry_3)  # disabled
merge_11 = Merge(Data1=line_2, Data2=line_3)

param_viewer = ParamViewer(geometry_6)
ceilings_2 = Geometry(mesh_join)
# wall length > 0
length_5 = Length(Curve=merge_11)
larger_than_3 = LargerThan(FirstNumber=length_5, SecondNumber=0.001)  # -> LargerThan, OrEqualTo

# ----
# Assign scores to configurations of lines (max 3 walls)
# remove li containing the pi's involved
# retain best config
merge_12 = Merge(Data1=graft(end_points_2.Start), Data2=graft(end_points_2.End))  # -> flatten(Result); disabled
evaluate_curve_4 = EvaluateCurve(Curve=reparameterize(cull_index_2), Parameter=0.5)  # -> Point, expr("abs(x)", Tangent), Angle; disabled
geometry_7 = Geometry(flatten(merge_12))  # disabled
end_points_4 = EndPoints(Curve=cull_index_2)  # -> Start, End; disabled
vector = Vector(expr("abs(x)", flatten(rotate_3)))  # disabled
vector_2 = Vector(expr("abs(x)", flatten(evaluate_curve_3.Tangent)))  # disabled
c_script = CSharpScript(
    pi=end_points_4.Start,
    pj=end_points_4.End,
    P=flatten(geometry_7),
    tpij=evaluate_curve_4.Tangent,
    tP=vector_2,
    tPortho=vector)  # -> out, A; inputs pi: list of Point3d, pj: list of Point3d, P: list of Point3d, tpij: list of Point3d, tP: list of Point3d, tPortho: list of Point3d; disabled
# ---------- c_script: C# ----------
    int test = 0;
    double t = 0.001;
    List <int> score = new List<int>();

    // test if pi or pj is part of P, continue (if not, its a w=0)
    for (int i = 0; i < pi.Count;i++)
    {
      bool temp1 = true;
      test = 0;
      int a = 0;
      while (temp1 == true && a < P.Count)
      {
        if (((pi[i].X == P[a].X) && (pi[i].Y == P[a].Y) && (pi[i].Z == P[a].Z) ) || ((pj[i].X == P[a].X) && (pj[i].Y == P[a].Y) && (pj[i].Z == P[a].Z)))
        {
          temp1 = false;
        }
        a++;
        test++;

      }
      a--;
      test--;
      if (temp1 == false)
      {
        if ((tpij[i].X - tP[a].X) < t && (tpij[i].Y - tP[a].Y) < t && (tpij[i].Z - tP[a].Z) < t)
        {
          score.Add(3);
        }
        else if ((tpij[i].X - tPortho[a].X) < t && (tpij[i].Y - tPortho[a].Y) < t && (tpij[i].Z - tPortho[a].Z) < t )
        {
          score.Add(2);
        }
        else
        {
          score.Add(1);
        }
      }
      else
      {
        score.Add(0);
      }
    }
    A = score;

    // test if tpij ==tP[i] (both end and start)  (if so, u =2)

    // else (v=1)
# ---------- end c_script ----------
tree_statistics_3 = TreeStatistics(Tree=c_script.A)  # -> Paths, Length, Count; disabled
mass_addition_2 = MassAddition(Input=c_script.A)  # -> Result, PartialResults; disabled
series_2 = Series(Start=0, Step=1, Count=tree_statistics_3.Count)  # disabled
sort_list_3 = SortList(Keys=flatten(mass_addition_2.Result), ValuesPaths=series_2)  # -> reverse(Keys), reverse(ValuesValuesA), reverse(ValuesPaths); disabled
merge_13 = Merge(Data1=end_points_4.Start, Data2=end_points_4.End)  # disabled
c_script_2 = CSharpScript(li=cull_index_2, endpoints=merge_13, targetpaths=sort_list_3.ValuesPaths)  # -> out, li2, endpoints2; inputs li: tree of Curve, endpoints: tree of Point3d, targetpaths: list of Int32; disabled
# ---------- c_script_2: C# ----------
    DataTree<Curve> dataTree = new DataTree<Curve>();
    DataTree<Point3d> pointsTree = new DataTree<Point3d>();

    for (int i = 0;i < li.Branches.Count;i++)
    {
      dataTree.EnsurePath(i);
      var data = li.Branch(targetpaths[i]);
      dataTree.AddRange(data);

      pointsTree.EnsurePath(i);
      var data2 = endpoints.Branch(targetpaths[i]);
      pointsTree.AddRange(data2);
    }

    li2 = dataTree;
    endpoints2 = pointsTree;
# ---------- c_script_2: C# additional code ----------
  /// <summary>
  /// This method will be called once every solution, before any calls to RunScript.
  /// </summary>
  public override void BeforeRunScript()
  { }
  /// <summary>
  /// This method will be called once every solution, after any calls to RunScript.
  /// </summary>
  public override void AfterRunScript()
  { }
# ---------- end c_script_2 ----------
delete_branch_occurences = Delete_branch_occurences(DataTree=c_script_2.endpoints2)  # disabled
tree_statistics_4 = TreeStatistics(Tree=delete_branch_occurences)  # -> Paths, Length, Count; disabled
tree_branch_2 = TreeBranch(Tree=c_script_2.li2, Path=tree_statistics_4.Paths, MaintainPaths=True)  # disabled
clean_tree_3 = CleanTree(RemoveNulls=True, RemoveInvalid=True, RemoveEmpty=True, Tree=tree_branch_2)  # disabled

tree_branch_3 = TreeBranch(Tree=c_script_2.li2, Path=number_slider, MaintainPaths=True)  # disabled

# ----
# Evaluation box
clean_tree_4 = CleanTree(RemoveNulls=True, RemoveInvalid=True, RemoveEmpty=True, Tree=geometry_4)
clean_tree_5 = CleanTree(RemoveNulls=True, RemoveInvalid=True, RemoveEmpty=True, Tree=geometry_6)
shift_paths_4 = ShiftPaths(Data=curve_curve.Points, Offset=-1)
clean_tree_6 = CleanTree(RemoveNulls=True, RemoveInvalid=True, RemoveEmpty=True, Tree=geometry_5)
shift_paths_5 = ShiftPaths(Data=merge_10, Offset=-1)
start_endpoints = Geometry(merge)
tree_statistics_5 = TreeStatistics(Tree=clean_tree_4)  # -> Paths, Length, Count
list_item_9 = ListItem(List=divide_curve.Points, Index=dispatch_2.ListA, Wrap=True)
start_point = Geometry(merge)
list_item_10 = ListItem(List=tree_statistics_5.Paths, Index=Slider(6, range=0..10), Wrap=True)
tree_branch_4 = TreeBranch(Tree=clean_tree_4, Path=list_item_10, MaintainPaths=True)
tree_branch_5 = TreeBranch(Tree=clean_tree_5, Path=list_item_10, MaintainPaths=True)
tree_branch_6 = TreeBranch(Path=list_item_10, MaintainPaths=True)
tree_branch_7 = TreeBranch(Tree=clean_tree_6, Path=list_item_10, MaintainPaths=True)
tree_branch_8 = TreeBranch(Path=list_item_10, MaintainPaths=True)
list_item_11 = ListItem(List=tree_branch_6, Index=0, Wrap=True)
list_item_12 = ListItem(List=tree_branch_8, Index=0, Wrap=True)

panel = Panel(list_item_10)

# ----
# 3.Filter connections baes on wall/ceiling collision
# wall intersection
# ceiling intersection
curve_middle_2 = CurveMiddle(Curve=merge_11)
move_4 = Move(Geometry=wall_segments, Motion=Vector(0, 0, -2))  # -> Geometry, Transform
move_5 = Move(Geometry=curve_middle_2, Motion=Vector(0, 0, -0.5))  # -> Geometry, Transform
move_6 = Move(Geometry=curve_middle_2, Motion=Vector(0, 0, 0.5))  # -> Geometry, Transform
mesh_join_2 = MeshJoin(Meshes=move_4.Geometry)
line_5 = Line(StartPoint=move_5.Geometry, EndPoint=move_6.Geometry)
mesh_curve_2 = MeshCurve(Mesh=mesh_join_2, Curve=merge_11)  # -> Points, Faces
shift_paths_6 = ShiftPaths(Data=mesh_curve_2.Points, Offset=-1)
list_length_2 = ListLength(List=shift_paths_6)
equality_3 = Equality(FirstNumber=list_length_2, SecondNumber=0)  # -> Equality, Inequality
mesh_curve_3 = MeshCurve(Mesh=ceilings_2, Curve=line_5)  # -> Points, Faces
shift_paths_7 = ShiftPaths(Data=mesh_curve_3.Points, Offset=-1)
list_length_3 = ListLength(List=shift_paths_7)
equality_4 = Equality(FirstNumber=list_length_3, SecondNumber=0)  # -> Equality, Inequality

duplicate_data_4 = DuplicateData(Data=equality_3.Equality, Number=2, Order=True)  # -> simplify(Data)
duplicate_data_5 = DuplicateData(Data=equality_4.Equality, Number=2, Order=True)  # -> simplify(Data)
panel_2 = Panel(duplicate_data_4)

gate_and_3 = GateAnd(D=larger_than_3.LargerThan, B=duplicate_data_4, C=duplicate_data_5, A=True)
dispatch_12 = Dispatch(List=geometry_6, DispatchPattern=gate_and_3)  # -> WallIJ, ListB
dispatch_13 = Dispatch(List=dispatch_10.ListA, DispatchPattern=gate_and_3)  # -> ListA, ListB
dispatch_14 = Dispatch(List=merge_11, DispatchPattern=gate_and_3)  # -> ListA, ListB
dispatch_15 = Dispatch(List=dispatch_8.ListA, DispatchPattern=gate_and_3)  # -> ListA, ListB
merge_14 = Merge(Data1=dispatch_15.ListA, Data2=dispatch_13.ListA)

clean_tree_7 = CleanTree(RemoveNulls=True, RemoveInvalid=True, RemoveEmpty=True, Tree=dispatch_14.ListA)
clean_tree_8 = CleanTree(RemoveNulls=True, RemoveInvalid=True, RemoveEmpty=True, Tree=dispatch_12.WallIJ)
clean_tree_9 = CleanTree(RemoveNulls=True, RemoveInvalid=True, RemoveEmpty=True, Tree=merge_14)

u_v_i_j = Geometry(clean_tree_7)
wall_i_j = Geometry(clean_tree_8)
P = Geometry(clean_tree_9)

# ----
# SCORES
# full intersection = 4, semi-int = 3, ortho=2
# intersection?
# ortho?
angle = Angle(VectorA=wall_i_j, VectorB=u_v_i_j)  # -> Angle, Reflex
modulus = Modulus(A=angle.Angle, B=3.141592654)
includes = Includes(Value=modulus, Domain=Domain(1.550796327, 1.590796327))  # -> Includes, Deviation
includes_2 = Includes(Value=modulus, Domain=Domain(4.692388654, 4.732388654))  # -> Includes, Deviation
includes_3 = Includes(Value=modulus, Domain=Domain(-0.02, 0.02))  # -> Includes, Deviation
includes_4 = Includes(Value=modulus, Domain=Domain(3.12, 3.16))  # -> Includes, Deviation
gate_or = GateOr(A=includes.Includes, B=includes_2.Includes)
gate_or_2 = GateOr(A=includes_3.Includes, B=includes_4.Includes)
average = Average(Input=gate_or)
average_2 = Average(Input=gate_or_2)
c_script_3 = CSharpScript(x=average_2, y=average)  # -> out, A; inputs x: Double, y: Double
# ---------- c_script_3: C# ----------
  if (x==1)
      A = 4;
    else if (x==0.5)
      A = 3;
    else if (y==1)
      A = 2;
    else A = 0;
# ---------- end c_script_3 ----------
list_length_4 = ListLength(List=wall_i_j)
dispatch_16 = Dispatch(List=c_script_3.A, DispatchPattern=list_length_4)  # -> ListA, ListB
score = Integer(dispatch_16.ListA)

panel_3 = Panel(u_v_i_j)

# ----
# Order connections by score and length (shortest connection is preferred)
length_6 = Length(Curve=u_v_i_j)
mass_addition_3 = MassAddition(Input=length_6)  # -> Result, PartialResults
score_2 = Integer(score)
shift_paths_8 = ShiftPaths(Data=mass_addition_3.Result, Offset=-1)
shift_paths_9 = ShiftPaths(Data=score_2, Offset=-1)
list_length_5 = ListLength(List=shift_paths_9)
series_3 = Series(Start=0, Step=1, Count=list_length_5)  # -> simplify(Series)
c_script_4 = CSharpScript(score=shift_paths_9, length=shift_paths_8, index=series_3)  # -> out, A; inputs score: list of Double, length: list of Double, index: list of Int32
# ---------- c_script_4: C# usings ----------
using System.Linq;
# ---------- c_script_4: C# ----------
    //var maxnumber = score.FindAll(x => x == score.Max());
    //var newscore = score.OrderByDescending(x => x);
    //var newindex = score.OrderBy(x => length.IndexOf(x));

    var joined = index.Zip(score.Zip(length, (n, a) => new { Score = n, Length = a }),
      (ix, x) => new { Index = ix, x.Score, x.Length })
      .OrderByDescending(x => x.Score).ThenBy(y => y.Length);
    var indexList = joined.Select(x => x.Index).ToList();

    A = indexList;
# ---------- end c_script_4 ----------
list_length_6 = ListLength(List=c_script_4.A)
list_item_13 = ListItem(List=c_script_4.A, Index=0, Wrap=True)
duplicate_data_6 = DuplicateData(Data=list_item_13, Number=list_length_6, Order=True)  # -> simplify(Data)
tree_statistics_6 = TreeStatistics(Tree=score_2)  # -> Paths, Length, Count
create_tree_6 = CreateTree(Data=series_3, Path=tree_statistics_6.Paths)
create_tree_7 = CreateTree(Data=duplicate_data_6, Path=tree_statistics_6.Paths)
equality_5 = Equality(FirstNumber=create_tree_6, SecondNumber=create_tree_7)  # -> Equality, Inequality
dispatch_17 = Dispatch(List=P, DispatchPattern=equality_5.Equality)  # -> ListA, ListB
dispatch_18 = Dispatch(List=wall_i_j, DispatchPattern=equality_5.Equality)  # -> ListA, ListB
dispatch_19 = Dispatch(List=u_v_i_j, DispatchPattern=equality_5.Equality)  # -> ListA, ListB

tree_branch_9 = TreeBranch(Tree=length_6, Path=list_item_10, MaintainPaths=True)
list_item_14 = ListItem(List=tree_branch_9, Index=0, Wrap=True)

clean_tree_10 = CleanTree(RemoveNulls=True, RemoveInvalid=True, RemoveEmpty=True, Tree=dispatch_17.ListA)
clean_tree_11 = CleanTree(RemoveNulls=True, RemoveInvalid=True, RemoveEmpty=True, Tree=dispatch_19.ListA)
clean_tree_12 = CleanTree(RemoveNulls=True, RemoveInvalid=True, RemoveEmpty=True, Tree=dispatch_18.ListA)

P_2 = Geometry(clean_tree_10)
wall_i_j_2 = Geometry(clean_tree_12)
u_v_i_j_2 = Geometry(clean_tree_11)

# ----
# Bake objects
# Create unique set
geometry_8 = Geometry(wall_lines_l)
c_script_5 = CSharpScript(dataTree=P_2)  # -> out, paths; inputs dataTree: tree of Point3d
# ---------- c_script_5: C# ----------
    DataTree<Point3d> winnerTree = new DataTree<Point3d>();
    List<Point3d> pointlist = new List<Point3d>();
  
    while (dataTree.BranchCount != 0)
      //for (int xx = 0; xx < 2; xx++)
    {
      // copy data from first branch to winner
      pointlist = dataTree.Branch(0);
      // create new path in winnertree with pointlist. remove that branch from datatree
      winnerTree.EnsurePath(dataTree.Paths[0]);
      winnerTree.AddRange(pointlist);
      dataTree.RemovePath(dataTree.Paths[0]);
      int[] A = new int[dataTree.BranchCount];

      // test other branches for inliers with winner(0), if so delete them
      if (dataTree.BranchCount != 0)
      {
        for (int i = 0; i < pointlist.Count; i++)
        {
          var pointtest = pointlist[i];
          for (int branchj = 0; branchj < dataTree.BranchCount; branchj++)
          {
            for (int listj = 0; listj < dataTree.Branch(branchj).Count; listj++)
            {
              if ((Math.Abs(pointtest.X - dataTree.Branch(branchj)[listj].X) < 0.001)
                && (Math.Abs(pointtest.Y - dataTree.Branch(branchj)[listj].Y) < 0.001)
                && (Math.Abs(pointtest.Z - dataTree.Branch(branchj)[listj].Z) < 0.001))
              {
                A[branchj]++;
              }
            }
          }
        }

        var C = Enumerable.Range(0, A.Length).Where(i => A[i] == pointlist.Count);
        for (int i = A.Length - 1; i >= 0; i--)
        {
          if (A[i] == pointlist.Count)
          {
            dataTree.RemovePath(dataTree.Paths[i]);
          }
        }
      }
    }

    paths = winnerTree;
# ---------- end c_script_5 ----------
get_rhino_attributes = GetRhinoAttributes(Geometry=geometry_8)  # -> Name, Layer, Color
tree_statistics_7 = TreeStatistics(Tree=c_script_5.paths)  # -> Paths, Length, Count
tree_branch_10 = TreeBranch(Tree=u_v_i_j_2, Path=tree_statistics_7.Paths, MaintainPaths=True)
deconstruct_path_3 = DeconstructPath(Branch=tree_statistics_7.Paths)  # -> simplify(Indices)
list_item_15 = ListItem(List=deconstruct_path_3, Index=0, Wrap=True)
list_item_16 = ListItem(List=get_rhino_attributes.Name, Index=list_item_15, Wrap=True)
create_tree_8 = CreateTree(Data=list_item_16, Path=tree_statistics_7.Paths)
list_length_7 = ListLength(List=tree_branch_10)
duplicate_data_7 = DuplicateData(Data=create_tree_8, Number=list_length_7, Order=True)  # -> simplify(Data)
define_layer = DefineLayer(Name="walllines_topo", Color=RGB(0, 192, 0))  # -> simplify(graft(Layer))
define_object_attributes = DefineObjectAttributes(Name=duplicate_data_7, Layer=define_layer)
bake_objects = BakeObjects(Geometry=simplify(tree_branch_10), Attributes=define_object_attributes, BakeName="56", Bake=bake)

solution = Geometry(tree_branch_10)
panel_4 = Panel(solution)
panel_5 = Panel(get_rhino_attributes.Name)
