# Grasshopper definition 3_Revitwalls.gh (Grasshopper 1.0.7)
# plug-ins: Rhino.Inside for Autodesk Revit, EleFront, MeshEdit Components

adjust_top_constraint = Button()
boolean_toggle = BooleanToggle(False)
th = Slider(1.07, range=0..5)
create_wall_types = Button()
# first reset D upon start
boolean_toggle_2 = BooleanToggle(False)
build_elevations = Button()
# INPUT
wall_segments = Mesh(simplify(graft([<mesh referenced from the Rhino model> x638])))
wall_axes = Curve(simplify(graft([<curve referenced from the Rhino model> x396])))
build_walls = Button()
floors_roofs = Mesh([<mesh referenced from the Rhino model> x102])
stream_gate = StreamGate(Stream=floors_roofs, Gate=boolean_toggle_2)  # -> Target0, Target1

# ----
# construct wall axes (optional)
stream_gate_2 = StreamGate(Stream=wall_axes, Gate=boolean_toggle)  # -> Target0, Target1
add_geometry_directshape = AddGeometryDirectShape(Geometry=stream_gate_2.Target1)  # -> flatten(DirectShape)

# ----
# Select walls clusters
get_rhino_attributes = GetRhinoAttributes(Geometry=wall_segments)  # -> flatten(Name), Layer, flatten(Color)
create_set = CreateSet(List=flatten(get_rhino_attributes.Name))  # -> Set, Map
filter_by_name = FilterByName(Geometry=flatten(wall_segments), Name=create_set.Set)  # -> simplify(Geometry)
wall_segment_clusters = Mesh(simplify(filter_by_name))

# ----
# Create Levels (roof geometry is mandatory) only run this once!
# create new levels
floors_roofs_2 = Geometry(stream_gate.Target1)
televation = Slider(1, range=0..1)
mesh_area = MeshArea(Mesh=floors_roofs_2)  # -> Area, Centroid
deconstruct = Deconstruct(Point=mesh_area.Centroid)  # -> XComponent, YComponent, flatten(ZComponent)
construct_point = ConstructPoint(XCoordinate=0, YCoordinate=0, ZCoordinate=deconstruct.ZComponent)
point_groups = PointGroups(Points=construct_point, Distance=televation)  # -> Groups, Indices
list_item = ListItem(List=construct_point, Index=point_groups.Indices, Wrap=True)
list_item_2 = ListItem(List=mesh_area.Area, Index=point_groups.Indices, Wrap=True)
weighted_average = WeightedAverage(Input=list_item, Weights=list_item_2)  # -> simplify(flatten(ArithmeticMean))
sort_list = SortList(Keys=weighted_average)  # -> Keys, ValuesValuesA
list_length = ListLength(List=weighted_average)
series = Series(Start=0, Step=10, Count=list_length)
addlevel_byelevation = AddLevelByElevation(Elevation=sort_list.Keys, Name=series)

default_elementtype = DefaultElementType(Category=<geometry referenced from the Revit model>)

# ----
# Evaluation box
clean_tree = CleanTree(RemoveNulls=True, RemoveInvalid=True, RemoveEmpty=True)
clean_tree_2 = CleanTree(RemoveNulls=True, RemoveInvalid=True, RemoveEmpty=True)
shift_paths = ShiftPaths(Offset=-1)
clean_tree_3 = CleanTree(RemoveNulls=True, RemoveInvalid=True, RemoveEmpty=True)
shift_paths_2 = ShiftPaths(Offset=-1)
start_endpoints = Geometry()
tree_statistics = TreeStatistics(Tree=wall_segments)  # -> Paths, Length, Count
list_item_3 = ListItem(Index=0, Wrap=True)
start_point = Geometry()
list_item_4 = ListItem(List=tree_statistics.Paths, Index=Slider(0, range=0..10), Wrap=True)
tree_branch = TreeBranch(Tree=wall_segments, Path=list_item_4, MaintainPaths=True)
tree_branch_2 = TreeBranch(Path=list_item_4, MaintainPaths=True)
tree_branch_3 = TreeBranch(Tree=filter_by_name, Path=list_item_4, MaintainPaths=True)
tree_branch_4 = TreeBranch(Path=list_item_4, MaintainPaths=True)
tree_branch_5 = TreeBranch(Tree=clean_tree_3, Path=list_item_4, MaintainPaths=True)
tree_branch_6 = TreeBranch(Path=list_item_4, MaintainPaths=True)
list_item_5 = ListItem(List=tree_branch_4, Index=0, Wrap=True)
list_item_6 = ListItem(List=tree_branch_6, Index=0, Wrap=True)
list_item_7 = ListItem(List=tree_branch_2, Index=0, Wrap=True)

geometry = Geometry(wall_segments)  # disabled
get_rhino_attributes_2 = GetRhinoAttributes(Geometry=geometry)  # -> Name, Layer, Color; disabled
define_layer = DefineLayer(Name="test", Color=RGB(140, 255, 0))  # disabled
define_object_attributes = DefineObjectAttributes(
    Name=get_rhino_attributes_2.Name,
    Layer=define_layer,
    Color=get_rhino_attributes_2.Color,
    Material=get_rhino_attributes_2.Color)  # disabled
bake_objects = BakeObjects(Geometry=geometry, Attributes=define_object_attributes, BakeName="13", Bake=False)  # disabled
define_color = DefineColor(Color=RGB(255, 0, 0), Source="object")
define_layer_2 = DefineLayer(Name="topo", Color=RGB(140, 255, 0))
# trimmed
define_color_2 = DefineColor(Color=RGB(255, 250, 250), Source="object")
define_object_attributes_2 = DefineObjectAttributes(Layer=define_layer_2, Color=define_color, Material=define_color)
define_layer_3 = DefineLayer(Name="trim", Color=RGB(140, 255, 0))
define_object_attributes_3 = DefineObjectAttributes(Layer=define_layer_3, Color=define_color_2, Material=define_color_2)

# ----
# Select wall axes
names_wall_clusters = Integer(simplify(graft(create_set.Set)))
wall_axes_2 = Geometry(flatten(wall_axes))

# ----
# Select base/top constraint (renew first component as it tends to bug out sometimes)
document_levels = DocumentLevels()
list_item_8 = ListItem(List=document_levels, Index=0, Wrap=True)
element_parameters = ElementParameters(Element=list_item_8, Name="Elevation", ReadOnly=False)
element_parameterget = ElementParameterGet(Element=document_levels, ParameterKey=element_parameters)
consecutive_domains = ConsecutiveDomains(Numbers=element_parameterget, Additive=False)
list_item_9 = ListItem(List=document_levels, Index=-1, Wrap=True)

stream_gate_3 = StreamGate(Stream=document_levels, Gate=boolean_toggle)  # -> Target0, Target1; disabled

# ----
# Select wall types
get_rhino_attributes_3 = GetRhinoAttributes(Geometry=wall_axes)  # -> Name, Layer, Color
stream_gate_4 = StreamGate(Stream=default_elementtype, Gate=boolean_toggle)  # -> Target0, Target1
text_split = TextSplit(Text=get_rhino_attributes_3.Name, Separators="_")  # -> simplify(Result)
elementtype_similar = ElementTypeSimilar(Type=stream_gate_4.Target1)
elementtype_identity = ElementTypeIdentity(Type=elementtype_similar)  # -> Category, FamilyName, Name
list_item_10 = ListItem(List=text_split, Index=1, Wrap=True)  # -> flatten(Item)
sfb_21_wa_lb_generic = Text("SfB_21_WA_LB_Generic_")

list_item_11 = ListItem(List=text_split, Index=0, Wrap=True)
integer = Integer(list_item_11)
member_index = MemberIndex(Set=flatten(integer), Member=names_wall_clusters)  # -> simplify(Index), Count
list_item_12 = ListItem(List=wall_axes_2, Index=member_index.Index, Wrap=True)
list_length_2 = ListLength(List=list_item_12)
geometry_2 = Geometry(simplify(graft(list_item_12)))
clean_tree_4 = CleanTree(RemoveNulls=True, RemoveInvalid=True, RemoveEmpty=True, Tree=geometry_2)  # -> flatten(Tree)

# ----
# Select height
bounding_box = BoundingBox(Content=wall_segment_clusters, Plane=PlaneXY(0, 0, 0), UnionBox=True)  # -> Box, Box_2
deconstruct_box = DeconstructBox(Box=bounding_box.Box)  # -> Plane, X, Y, Z
deconstruct_domain = DeconstructDomain(Domain=deconstruct_box.Z)  # -> Start, End
deconstruct_domain_2 = DeconstructDomain(Domain=deconstruct_box.Z)  # -> expr("x+0.5", Start), expr("x-0.5", End)
subtraction = Subtraction(A=deconstruct_domain.End, B=deconstruct_domain.Start)
height = Number(expr("round(x,2)", subtraction))
duplicate_data = DuplicateData(Data=deconstruct_domain.End, Number=list_length_2, Order=True)  # -> simplify(graft(Data))
duplicate_data_2 = DuplicateData(Data=height, Number=list_length_2, Order=True)  # -> simplify(graft(Data))
clean_tree_5 = CleanTree(RemoveNulls=True, RemoveInvalid=True, RemoveEmpty=True, Tree=duplicate_data)  # -> flatten(WallTopHeight)
clean_tree_6 = CleanTree(RemoveNulls=True, RemoveInvalid=True, RemoveEmpty=True, Tree=duplicate_data_2)  # -> flatten(Height)

join_curves = JoinCurves(Curves=list_item_12, Preserve=False)  # -> simplify(graft(Curves))

find_domain = FindDomain(Domains=consecutive_domains, Number=deconstruct_domain_2.End, Strict=False)  # -> simplify(TopConstraint), Neighbour
find_domain_2 = FindDomain(Domains=consecutive_domains, Number=deconstruct_domain_2.Start, Strict=False)  # -> simplify(BaseConstraint), Neighbour
equality = Equality(FirstNumber=find_domain_2.BaseConstraint, SecondNumber=-1)  # -> Equality, Inequality
equality_2 = Equality(FirstNumber=find_domain_2.BaseConstraint, SecondNumber=-1)  # -> Equality, Inequality
dispatch = Dispatch(List=find_domain_2.BaseConstraint, DispatchPattern=equality_2.Equality)  # -> ListA, ListB
dispatch_2 = Dispatch(List=find_domain_2.BaseConstraint, DispatchPattern=equality.Equality)  # -> ListA, ListB
list_item_13 = ListItem(List=document_levels, Index=expr("x+1", dispatch.ListB), Wrap=True)  # -> simplify(Item)
number = Number(expr("0*x", dispatch_2.ListA))
list_item_14 = ListItem(List=list_item_9, Index=dispatch.ListA, Wrap=True)  # -> simplify(Item)
merge = Merge(Data1=number, Data2=dispatch_2.ListB)
merge_2 = Merge(Data1=list_item_14, Data2=list_item_13)
list_item_15 = ListItem(List=document_levels, Index=merge, Wrap=True)  # -> simplify(Item)
duplicate_data_3 = DuplicateData(Data=merge_2, Number=list_length_2, Order=True)  # -> simplify(graft(Data))
duplicate_data_4 = DuplicateData(Data=list_item_15, Number=list_length_2, Order=True)  # -> simplify(graft(Data))
clean_tree_7 = CleanTree(RemoveNulls=True, RemoveInvalid=True, RemoveEmpty=True, Tree=duplicate_data_3)  # -> flatten(Tree)
# Create wall (this component is faulty so its better if you make the walls yourself
#  and adjust them)
clean_tree_8 = CleanTree(RemoveNulls=True, RemoveInvalid=True, RemoveEmpty=True, Tree=duplicate_data_4)  # -> flatten(Tree)

list_item_16 = ListItem(List=list_item_10, Index=member_index.Index, Wrap=True)
clean_tree_9 = CleanTree(RemoveNulls=True, RemoveInvalid=True, RemoveEmpty=True, Tree=list_item_16)  # -> simplify(graft(Tree))
number_2 = Number(expr("1000*x", clean_tree_9))
concatenate = Concatenate(FragmentA=sfb_21_wa_lb_generic, FragmentB=number_2)
match_text = MatchText(Text=elementtype_identity.Name, Pattern=concatenate, Case=True)
dispatch_3 = Dispatch(List=elementtype_similar, DispatchPattern=match_text)  # -> simplify(WallTypes), ListB
tree_statistics_2 = TreeStatistics(Tree=dispatch_3.WallTypes)  # -> Paths, Length, Count
list_length_3 = ListLength(List=flatten(tree_statistics_2.Paths))
duplicate_data_5 = DuplicateData(Data=stream_gate_4.Target1, Number=list_length_3, Order=True)
create_tree = CreateTree(Data=duplicate_data_5, Path=tree_statistics_2.Paths)
merge_3 = Merge(Data1=dispatch_3.WallTypes, Data2=create_tree)
list_item_17 = ListItem(List=merge_3, Index=0, Wrap=True)
clean_tree_10 = CleanTree(RemoveNulls=True, RemoveInvalid=True, RemoveEmpty=True, Tree=list_item_17)  # -> flatten(Tree)

stream_gate_5 = StreamGate(Stream=concatenate, Gate=Toggle(False))  # -> Target0, Target1

# ----
# Create wall types (only run once)/ sometimes category buggs out
text = Text(flatten(stream_gate_5.Target1))
create_set_2 = CreateSet(List=text)  # -> Set, Map
elementtype_duplicate = ElementTypeDuplicate(Type=default_elementtype, Name=create_set_2.Set)
list_item_18 = ListItem(List=elementtype_duplicate, Index=create_set_2.Map, Wrap=True)
tree_statistics_3 = TreeStatistics(Tree=clean_tree_4)  # -> Paths, Length, Count
create_tree_2 = CreateTree(Data=list_item_18, Path=tree_statistics_3.Paths)

text_split_2 = TextSplit(Text=create_set_2.Set, Separators="_")
list_item_19 = ListItem(List=text_split_2, Index=-1, Wrap=True)
ghpython_script = GhPythonScript(Types=elementtype_duplicate, Width=list_item_19)  # inputs Types: list, Width: list; disabled
# ---------- ghpython_script: Python ----------
import clr
clr.AddReference('System.Core')
clr.AddReference('RhinoInside.Revit')
clr.AddReference('RevitAPI') 
clr.AddReference('RevitAPIUI')

from System import Enum, Action
from System.Collections.Generic import List

import rhinoscriptsyntax as rs
import Rhino
import RhinoInside
import Grasshopper
from RhinoInside.Revit import Revit, Convert
from Autodesk.Revit import DB

doc = Revit.ActiveDBDocument
view = doc.ActiveView

if "store" not in globals():
    store = []

else:
    t = DB.Transaction(doc, 'Delete')
    t.Start()
    doc.Delete(store)
    store.Clear()
    t.Commit()

t = DB.Transaction(doc, 'ChangeWidth')
t.Start()

i = 0
for type in Types:
    cs = type.GetCompoundStructure()
    cs.SetLayerWidth(0, Width[i] / Revit.ModelUnits)
    type.SetCompoundStructure(cs)
    i += 1
t.Commit()

store = List[DB.ElementId](store)

a = store
# ---------- end ghpython_script ----------

# ----
# Construct wall geometry
stream_gate_6 = StreamGate(Stream=clean_tree_4, Gate=boolean_toggle)  # -> Target0, Target1
add_wall = AddWall(Curve=stream_gate_6.Target1, Type=clean_tree_10, Level=clean_tree_8, Height=clean_tree_6, AllowJoins=False)

# ----
# bake walls in same color as segments
member_index_2 = MemberIndex(Set=get_rhino_attributes.Name, Member=create_set.Set)  # -> simplify(Index), Count
list_item_20 = ListItem(List=member_index_2.Index, Index=0, Wrap=True)
list_item_21 = ListItem(List=flatten(get_rhino_attributes.Color), Index=list_item_20, Wrap=True)  # -> simplify(graft(Item))
element_geometry = ElementGeometry(Element=add_wall)  # -> flatten(Geometry)
list_item_22 = ListItem(List=flatten(get_rhino_attributes_3.Name), Index=member_index.Index, Wrap=True)
duplicate_data_6 = DuplicateData(Data=list_item_21, Number=list_length_2, Order=True)  # -> simplify(flatten(Colors))
name = Text(flatten(list_item_22))
define_layer_4 = DefineLayer(Name="walls_auto", Color=RGB(140, 255, 0))
define_object_attributes_4 = DefineObjectAttributes(Name=name, Layer=define_layer_4, Color=duplicate_data_6, Material=duplicate_data_6)
bake_objects_2 = BakeObjects(Geometry=element_geometry, Attributes=define_object_attributes_4, BakeName="12", Bake=False)

list_item_23 = ListItem(List=flatten(add_wall), Index=Slider(0, range=0..10), Wrap=True)

# ----
# Adjust top constraint
# if wall top height is within th of elevation, snap to that elevation
wall_top_height = Number(graft(clean_tree_5))
elevation_height = Number(element_parameterget)
stream_gate_7 = StreamGate(Stream=add_wall, Gate=Toggle(False))  # -> Target0, Target1
unconnected_height = Text("Unconnected Height")  # disabled
top_constraint = Pattern("Top Constraint")
subtraction_2 = Subtraction(A=wall_top_height, B=elevation_height)  # -> simplify(Result)
element_parameters_2 = ElementParameters(Element=list_item_23, Name=top_constraint, ReadOnly=False)
element_parameters_3 = ElementParameters(Element=list_item_23, Name=unconnected_height)  # disabled
number_3 = Number(expr("abs(x)", subtraction_2))
smaller_than = SmallerThan(FirstNumber=number_3, SecondNumber=th)  # -> SmallerThan, OrEqualTo
dispatch_4 = Dispatch(List=document_levels, DispatchPattern=smaller_than.SmallerThan)  # -> simplify(ListA), ListB
list_item_24 = ListItem(List=dispatch_4.ListA, Index=0, Wrap=True)
null_item = NullItem(Item=list_item_24)  # -> NullFlags, InvalidFlags, Description
dispatch_5 = Dispatch(List=stream_gate_7.Target1, DispatchPattern=invert(flatten(null_item.NullFlags)))  # -> Tobeadjusted, UnnconnectedHeight
dispatch_6 = Dispatch(List=flatten(wall_top_height), DispatchPattern=invert(flatten(null_item.NullFlags)))  # -> NewLevel, UnnconnectedHeight
dispatch_7 = Dispatch(List=flatten(list_item_24), DispatchPattern=invert(flatten(null_item.NullFlags)))  # -> NewLevel, UnnconnectedHeight
element_parameterset = ElementParameterSet(Element=dispatch_5.UnnconnectedHeight, ParameterKey=element_parameters_3, ParameterValue=dispatch_6.UnnconnectedHeight)  # disabled
element_parameterset_2 = ElementParameterSet(Element=dispatch_5.UnnconnectedHeight, ParameterKey=element_parameters_2)  # disabled
element_parameterset_3 = ElementParameterSet(Element=dispatch_5.Tobeadjusted, ParameterKey=element_parameters_2, ParameterValue=dispatch_7.NewLevel)

element_parameters_4 = ElementParameters(Element=list_item_23, ReadOnly=False)
element_parameterget_2 = ElementParameterGet(Element=list_item_23, ParameterKey=element_parameters_4)
panel = Panel(element_parameters_4)
partition_list = PartitionList(List=element_geometry, Size=flatten(list_length_2))  # -> simplify(Chunks)
partition_list_2 = PartitionList(List=name, Size=flatten(list_length_2))  # -> simplify(Chunks)
partition_list_3 = PartitionList(List=duplicate_data_6, Size=flatten(list_length_2))  # -> simplify(Chunks)
# select trimemd and topo seperately
length = Length(Curve=list_item_12)
panel_2 = Panel(element_parameterget_2)
sort_list_2 = SortList(Keys=length, ValuesValuesA=partition_list, ValuesA=partition_list_2, ValuesB=partition_list_3)  # -> Keys, ValuesValuesA, ValuesA, ValuesB
list_length_4 = ListLength(List=length)  # -> expr("x-1", Length)
series_2 = Series(Start=0, Step=1, Count=list_length_4)  # -> simplify(Series)
panel_3 = Panel(series_2)
# topo
list_item_25 = ListItem(List=sort_list_2.ValuesValuesA, Index=series_2, Wrap=True)
list_item_26 = ListItem(List=sort_list_2.ValuesB, Index=series_2, Wrap=True)
list_item_27 = ListItem(List=sort_list_2.ValuesA, Index=series_2, Wrap=True)
bake_objects_3 = BakeObjects(Geometry=list_item_25, Attributes=define_object_attributes_2, BakeName="645", Bake=False)
list_item_28 = ListItem(List=sort_list_2.ValuesValuesA, Index=-1, Wrap=True)
list_item_29 = ListItem(List=sort_list_2.ValuesA, Index=-1, Wrap=True)
list_item_30 = ListItem(List=sort_list_2.ValuesB, Index=-1, Wrap=True)
bake_objects_4 = BakeObjects(Geometry=list_item_28, Attributes=define_object_attributes_3, BakeName="999", Bake=False)
