# Grasshopper definition Space2.gh (Grasshopper 0.9.76)
# plug-ins: MeshEdit Components, Python Interpreter

roofs = Geometry([<mesh referenced from the Rhino model> x2])
ceiling = Geometry([<mesh referenced from the Rhino model> x60])
# Space Building 1
# Note:
# Meshes should be perfectly planar
walls = Geometry([<mesh referenced from the Rhino model> x258])
floor = Geometry([<mesh referenced from the Rhino model> x59])
roofs_2 = Geometry([<mesh referenced from the Rhino model> x2])
ceiling_2 = Geometry([<mesh referenced from the Rhino model> x60])
walls_2 = Geometry([<mesh referenced from the Rhino model> x884])
floor_2 = Geometry([<mesh referenced from the Rhino model> x59])
entwine = Entwine(Branch00=floor_2, Branch01=ceiling_2, FlattenInputs=True)
merge = Merge(Data1=walls_2)

# ----
# merge Floors >2m
entwine_2 = Entwine(Branch00=floor_2, FlattenInputs=True)
face_normals = FaceNormals(Mesh=entwine_2)  # -> Centers, Normals
average = Average(Input=face_normals.Normals)  # -> flatten(ArithmeticMean)
average_2 = Average(Input=face_normals.Centers)  # -> flatten(ArithmeticMean)
deconstruct = Deconstruct(Point=average_2)  # -> XComponent, YComponent, ZComponent
construct_point = ConstructPoint(XCoordinate=0, YCoordinate=0, ZCoordinate=deconstruct.ZComponent)
point_groups = PointGroups(Points=construct_point, Distance=Slider(2, range=0..10))  # -> Groups, Indices
list_item = ListItem(List=entwine_2, Index=point_groups.Indices, Wrap=True)  # -> simplify(Item)

# ----
# merge Ceilings>2m
entwine_3 = Entwine(Branch00=ceiling_2, FlattenInputs=True)  # -> flatten(Result)
face_normals_2 = FaceNormals(Mesh=entwine_3)  # -> Centers, Normals
average_3 = Average(Input=face_normals_2.Normals)  # -> flatten(ArithmeticMean)
average_4 = Average(Input=face_normals_2.Centers)  # -> flatten(ArithmeticMean)
deconstruct_2 = Deconstruct(Point=average_4)  # -> XComponent, YComponent, ZComponent
construct_point_2 = ConstructPoint(XCoordinate=0, YCoordinate=0, ZCoordinate=deconstruct_2.ZComponent)
point_groups_2 = PointGroups(Points=construct_point_2, Distance=Slider(2, range=0..10))  # -> Groups, Indices
list_item_2 = ListItem(List=entwine_3, Index=point_groups_2.Indices, Wrap=True)  # -> simplify(Item)

# ----
# filter walls to be approx verti
walls_3 = Geometry(simplify(graft(walls_2)))
face_normals_3 = FaceNormals(Mesh=walls_3)  # -> Centers, Normals
average_5 = Average(Input=face_normals_3.Normals)  # -> simplify(ArithmeticMean)
number = Number(walls_3)
deconstruct_3 = Deconstruct(Point=average_5)  # -> XComponent, YComponent, ZComponent
larger_than = LargerThan(FirstNumber=number, SecondNumber=Slider(1, range=0..1))  # -> LargerThan, OrEqualTo
smaller_than = SmallerThan(FirstNumber=deconstruct_3.ZComponent, SecondNumber=Slider(0.5, range=0..1))  # -> SmallerThan, OrEqualTo
gate_and = GateAnd(A=smaller_than.SmallerThan, B=larger_than.LargerThan)
dispatch = Dispatch(List=walls_3, DispatchPattern=gate_and)  # -> ListA, ListB
walls_4 = Geometry(simplify(flatten(dispatch.ListA)))

# ----
# Find Wall Candidates
# compute bounding boxes pairs walls
walls_5 = Geometry(simplify(graft(walls_4)))
mesh_area = MeshArea(Mesh=walls_5)  # -> Area, Centroid
face_normals_4 = FaceNormals(Mesh=walls_5)  # -> Centers, Normals
closest_points = ClosestPoints(Point=mesh_area.Centroid, Cloud=flatten(mesh_area.Centroid), Count=Slider(70, range=0..100))  # -> ClosestPoint, simplify(CPIndex), Distance
average_6 = Average(Input=face_normals_4.Normals)  # -> simplify(ArithmeticMean)
list_length = ListLength(List=closest_points.CPIndex)
duplicate_data = DuplicateData(Data=walls_5, Number=list_length, Order=True)  # -> simplify(graft(Data))
list_item_3 = ListItem(List=flatten(walls_5), Index=closest_points.CPIndex, Wrap=True)  # -> simplify(graft(Item))
plane_normal = PlaneNormal(Origin=simplify(graft(mesh_area.Centroid)), ZAxis=average_6)  # -> simplify(Plane)
merge_2 = Merge(Data1=duplicate_data, Data2=list_item_3)
duplicate_data_2 = DuplicateData(Data=plane_normal, Number=list_length, Order=True)  # -> simplify(graft(Data))
bounding_box = BoundingBox(Content=merge_2, Plane=duplicate_data_2, UnionBox=True)  # -> Box, Box_2

# ----
# thickness < x m thickness
# box
# surf
# indices
deconstruct_box = DeconstructBox(Box=bounding_box.Box)  # -> Plane, X, Y, Z
deconstruct_domain = DeconstructDomain(Domain=deconstruct_box.Z)  # -> Start, End
subtraction = Subtraction(A=deconstruct_domain.End, B=deconstruct_domain.Start)
number_2 = Number(expr("abs(x)", subtraction))
smaller_than_2 = SmallerThan(FirstNumber=number_2, SecondNumber=Slider(0.6, range=0..1))  # -> SmallerThan, OrEqualTo
dispatch_2 = Dispatch(List=simplify(graft(closest_points.CPIndex)), DispatchPattern=smaller_than_2.SmallerThan)  # -> ListA, ListB
dispatch_3 = Dispatch(List=merge_2, DispatchPattern=smaller_than_2.SmallerThan)  # -> ListA, ListB
dispatch_4 = Dispatch(List=bounding_box.Box, DispatchPattern=smaller_than_2.SmallerThan)  # -> ListA, ListB
surf = Geometry(dispatch_3.ListA)
box = Geometry(dispatch_4.ListA)

# ----
# Filter boxes
# Area box < 2*(SArea1+SArea2)
# surf
# boxes
# dot (normals) < 15° or >75°
# indices
# distance between curves < 3m
# Cannot Intersect with a 0.9*ceiling
# Height box >1m
# no collision with large orthogonal suf
mesh_area_2 = MeshArea(Mesh=surf)  # -> Area, Centroid
ceilings = Geometry(ceiling_2)
floors = Geometry(floor_2)
box_properties = BoxProperties(Box=box)  # -> Center, Diagonal, Area, Volume, Degeneracy
number_3 = Number(surf)
mesh_closest_point = MeshClosestPoint(Point=mesh_area_2.Centroid, Mesh=surf)  # -> Point, Index, Parameter
bounding_box_2 = BoundingBox(Content=surf, Plane=PlaneXY(0, 0, 0), UnionBox=True)  # -> Box, Box_2
deconstruct_mesh = DeconstructMesh(Mesh=surf)  # -> Vertices, Faces, Colours, Normals
mass_addition = MassAddition(Input=number_3)  # -> Result, PartialResults
entwine_4 = Entwine(Branch00=ceilings, Branch01=floors, FlattenInputs=True)
geometry = Geometry(mesh_area_2.Centroid)
deconstruct_vector = DeconstructVector(Vector=box_properties.Diagonal)  # -> XComponent, YComponent, ZComponent
multiplication = Multiplication(A=deconstruct_vector.XComponent, B=deconstruct_vector.YComponent)
mesh_area_3 = MeshArea(Mesh=entwine_4)  # -> Area, Centroid
number_4 = Number(expr("0.5*x", multiplication))
list_item_4 = ListItem(List=geometry, Index=0, Wrap=True)
mesh_eval = MeshEval(Mesh=surf, Parameter=mesh_closest_point.Parameter)  # -> Point, unitize(Normal), Colour
list_item_5 = ListItem(List=geometry, Index=1, Wrap=True)
deconstruct_box_2 = DeconstructBox(Box=bounding_box_2.Box)  # -> Plane, X, Y, Z
convex_hull = ConvexHull(Points=deconstruct_mesh.Vertices, Plane=PlaneXY(0, 0, 0))  # -> Hull, HullZ, Indices
larger_than_2 = LargerThan(FirstNumber=mass_addition.Result, SecondNumber=number_4)  # -> LargerThan, OrEqualTo
scale = Scale(Geometry=entwine_4, Center=mesh_area_3.Centroid, Factor=0.8)  # -> simplify(Geometry), Transform
deconstruct_domain_2 = DeconstructDomain(Domain=deconstruct_box_2.Z)  # -> Start, End
smaller_than_3 = SmallerThan(FirstNumber=deconstruct_vector.ZComponent, SecondNumber=Slider(0.7, range=0..1))  # -> SmallerThan, OrEqualTo
shift_paths = ShiftPaths(Data=list_item_4, Offset=-1)
walls_6 = Geometry(simplify(walls_4))
list_item_6 = ListItem(List=mesh_eval.Normal, Index=0, Wrap=True)
# distance mesh to box < 0.2m
normal = Geometry(list_item_6)
shift_paths_2 = ShiftPaths(Data=normal, Offset=-1)
list_item_7 = ListItem(List=mesh_eval.Normal, Index=1, Wrap=True)
shift_paths_3 = ShiftPaths(Data=convex_hull.HullZ, Offset=-1)
number_5 = Number(walls_6)
subtraction_2 = Subtraction(A=deconstruct_domain_2.End, B=deconstruct_domain_2.Start)
list_item_8 = ListItem(List=shift_paths, Index=0, Wrap=True)
list_item_9 = ListItem(List=shift_paths_2, Index=0, Wrap=True)
dot_product = DotProduct(VectorA=list_item_6, VectorB=list_item_7, Unitize=True)  # -> expr("abs(x)", DotProduct)
deconstruct_mesh_2 = DeconstructMesh(Mesh=scale.Geometry)  # -> Vertices, Faces, Colours, Normals
larger_than_3 = LargerThan(FirstNumber=number_5, SecondNumber=Slider(3, range=0..10))  # -> LargerThan, OrEqualTo
list_item_10 = ListItem(List=shift_paths_3, Index=0, Wrap=True)
list_item_11 = ListItem(List=shift_paths_3, Index=1, Wrap=True)
larger_than_4 = LargerThan(FirstNumber=expr("abs(x)", subtraction_2), SecondNumber=Slider(1, range=0..1))  # -> LargerThan, OrEqualTo
includes = Includes(Value=dot_product, Domain=Domain(0.85, 1.05))  # -> Includes, Deviation
vector = Vector([Vector(0, 0, -2), Vector(0, 0, 2)])
convex_hull_2 = ConvexHull(Points=deconstruct_mesh_2.Vertices, Plane=PlaneXY(0, 0, 0))  # -> Hull, simplify(HullZ), Indices
curve_proximity = CurveProximity(CurveA=list_item_10, CurveB=list_item_11)  # -> PointA, PointB, Distance
line = Line(StartPoint=list_item_4, EndPoint=list_item_5)
shift_paths_4 = ShiftPaths(Data=convex_hull_2.HullZ, Offset=-1)
list_length_2 = ListLength(List=entwine_4)
dispatch_5 = Dispatch(List=walls_6, DispatchPattern=larger_than_3.LargerThan)  # -> ListA, ListB
dispatch_6 = Dispatch(List=flatten(list_item_9), DispatchPattern=flatten(larger_than_3.LargerThan))  # -> ListA, ListB
dot_product_2 = DotProduct(VectorA=list_item_9, VectorB=flatten(dispatch_6.ListA), Unitize=True)  # -> expr("abs(x)", DotProduct)
mass_addition_2 = MassAddition(Input=includes.Includes)  # -> Result, PartialResults
smaller_than_4 = SmallerThan(FirstNumber=dot_product_2, SecondNumber=Slider(0.15, range=0..1))  # -> SmallerThan, OrEqualTo
boundary_surfaces = BoundarySurfaces(Edges=convex_hull_2.HullZ)
smaller_than_5 = SmallerThan(FirstNumber=curve_proximity.Distance, SecondNumber=Slider(4, range=0..10))  # -> SmallerThan, OrEqualTo
duplicate_data_3 = DuplicateData(Data=graft(vector), Number=list_length_2, Order=True)  # -> simplify(Data)
extrude = Extrude(Base=simplify(graft(boundary_surfaces)), Direction=simplify(graft(duplicate_data_3)))  # -> flatten(Extrusion)
mesh_curve = MeshCurve(Mesh=extrude, Curve=line)  # -> Points, Faces
list_length_3 = ListLength(List=shift_paths)
shift_paths_5 = ShiftPaths(Data=mesh_curve.Points, Offset=-1)
dispatch_7 = Dispatch(List=dispatch_5.ListA, DispatchPattern=smaller_than_4.SmallerThan)  # -> ListA, ListB
duplicate_data_4 = DuplicateData(Data=dispatch_7.ListA, Number=list_length_3, Order=True)  # -> simplify(Data)
list_length_4 = ListLength(List=shift_paths_5)
list_length_5 = ListLength(List=dispatch_7.ListA)
partition_list = PartitionList(List=duplicate_data_4, Size=list_length_5)
smaller_than_6 = SmallerThan(FirstNumber=list_length_4, SecondNumber=Slider(1, range=0..1))  # -> SmallerThan, OrEqualTo
gate_and_2 = GateAnd(B=smaller_than_6.SmallerThan, C=mass_addition_2.Result, D=smaller_than_5.SmallerThan)
dispatch_8 = Dispatch(List=box, DispatchPattern=gate_and_2)  # -> ListA, ListB
collision_one_many = CollisionOneMany(Collider=dispatch_8.ListA, Obstacles=extrude)  # -> reverse(Collision), Index; disabled
dispatch_9 = Dispatch(List=dispatch_2.ListA, DispatchPattern=gate_and_2)  # -> ListA, ListB
dispatch_10 = Dispatch(List=surf, DispatchPattern=gate_and_2)  # -> ListA, ListB

# ----
# create additional room segments for roofs
# merge room segments that can be connected with each other
roofs_3 = Geometry(roofs_2)  # disabled
deconstruct_mesh_3 = DeconstructMesh(Mesh=roofs_3)  # -> Vertices, Faces, Colours, Normals; disabled
convex_hull_3 = ConvexHull(Points=deconstruct_mesh_3.Vertices, Plane=PlaneXY(0, 0, 0))  # -> Hull, simplify(HullZ), Indices; disabled
boundary_surfaces_2 = BoundarySurfaces(Edges=convex_hull_3.HullZ)  # disabled
extrude_2 = Extrude(Base=boundary_surfaces_2, Direction=Vector(0, 0, 3))  # disabled

# ----
# Group clusters
shift_paths_6 = ShiftPaths(Data=dispatch_9.ListA, Offset=-1)
walls_7 = Geometry(walls_4)
list_length_6 = ListLength(List=walls_7)
series = Series(Start=0, Step=1, Count=list_length_6)
integer = Integer(series)
merge_3 = Merge(Data1=simplify(graft(integer)), Data2=shift_paths_6)
sort_list = SortList(Keys=merge_3)  # -> Keys, ValuesValuesA
python_script = PythonScript(x=sort_list.Keys)  # -> out, cluster; inputs x: tree of Int32
# ---------- python_script: Python ----------
import math
import rhinoscriptsyntax as rs
import Grasshopper.DataTree as ghdt

#x.BranchCount = amount of branches
#x.Count = number of elements in branch x
#x.Branch(0) =acess tree branch
#a=branch[0]=access list

# create 0 list cluster with range(0,len(walls))
cluster=[0] * x.BranchCount
# iterate trough branches to change cluster indices
for i in range(x.BranchCount): # iterate over all branches
    branch=x.Branch(i)
    n=[]
    for k in range(branch.Count):
        n.append(cluster[branch[k]])
    n=set(n) # create unique set
    n=list(n)
    if 0 in n:
        n.remove(0)
    print n
    if len(n) !=0: # if so, change existing values in cluster to n[0]
        for l in range(len(n)): 
            indices=[]
            # find indices(cluster) ==n[l] in cluster
            indices = [m for m, p in enumerate(cluster) if p == n[l]]
            # change those indindices to n[0]
            for o in range(len(indices)):
                cluster[indices[o]]=n[0]
    for j in range( branch.Count): # change new values in cluster
        if len(n)!=0:
            cluster[branch[j]]=n[0] # change cluster in branch i
        else:
            cluster[branch[j]]=i+1
    print cluster
# ---------- end python_script ----------
construct_point_3 = ConstructPoint(XCoordinate=python_script.cluster, YCoordinate=0, ZCoordinate=0)
point_groups_3 = PointGroups(Points=construct_point_3, Distance=0.1)  # -> Groups, simplify(Indices)
list_item_12 = ListItem(List=walls_7, Index=point_groups_3.Indices, Wrap=True)

# ----
# CLUSTER Wall Segments
geometry_2 = Geometry(dispatch_8.ListA)

shift_paths_7 = ShiftPaths(Data=dispatch_10.ListA, Offset=-1)
tree_branch = TreeBranch(Tree=shift_paths_7, Path=Slider(10, range=0..10), MaintainPaths=True)
number_slider = Slider(6, range=0..100)  # disabled

# ----
# Create Boxes
mesh_area_4 = MeshArea(Mesh=list_item_12)  # -> Area, Centroid
mesh_closest_point_2 = MeshClosestPoint(Point=mesh_area_4.Centroid, Mesh=list_item_12)  # -> Point, Index, Parameter
weighted_average = WeightedAverage(Input=mesh_area_4.Centroid, Weights=mesh_area_4.Area)
mesh_eval_2 = MeshEval(Mesh=list_item_12, Parameter=mesh_closest_point_2.Parameter)  # -> Point, unitize(Normal), Colour
weighted_average_2 = WeightedAverage(Input=mesh_eval_2.Normal, Weights=mesh_area_4.Area)
plane_normal_2 = PlaneNormal(Origin=weighted_average, ZAxis=unitize(weighted_average_2))
bounding_box_3 = BoundingBox(Content=list_item_12, Plane=plane_normal_2, UnionBox=True)  # -> Box, Box_2

# ----
# Merge Breps that atleast have 30% overlap
# boxes to merge
# test boxes for overlap
number_slider_2 = Slider(100, range=0..100)
number_6 = Number(bounding_box_3.Box)
sort_list_2 = SortList(Keys=flatten(number_6), ValuesValuesA=flatten(bounding_box_3.Box))  # -> Keys, reverse(ValuesValuesA)
populate_3d = Populate3D(Region=sort_list_2.ValuesValuesA, Count=number_slider_2, Seed=1)
point_in_breps = PointInBreps(Brep=graft(sort_list_2.ValuesValuesA), Point=flatten(populate_3d), Strict=False)  # -> Inside, simplify(Index)
partition_list_2 = PartitionList(List=point_in_breps.Index, Size=number_slider_2)
create_set = CreateSet(List=partition_list_2)  # -> Set, Map
member_index = MemberIndex(Set=partition_list_2, Member=create_set.Set)  # -> Index, Count
member_index_2 = MemberIndex(Set=create_set.Set, Member=-1)  # -> Index, Count
division = Division(A=member_index.Count, B=number_slider_2)
cull_index = CullIndex(List=division, Indices=member_index_2.Index, Wrap=True)
cull_index_2 = CullIndex(List=create_set.Set, Indices=member_index_2.Index, Wrap=True)
larger_than_5 = LargerThan(FirstNumber=cull_index, SecondNumber=Slider(0.6, range=0..1))  # -> LargerThan, OrEqualTo
dispatch_11 = Dispatch(List=cull_index_2, DispatchPattern=larger_than_5.LargerThan)  # -> simplify(ListA), ListB
clean_tree = CleanTree(RemoveNulls=True, RemoveInvalid=True, RemoveEmpty=True, Tree=dispatch_11.ListA)
shift_paths_8 = ShiftPaths(Data=clean_tree, Offset=-1)
tree_statistics = TreeStatistics(Tree=clean_tree)  # -> Paths, Length, Count
list_length_7 = ListLength(List=shift_paths_8)  # -> flatten(Length)
text_split = TextSplit(Text=tree_statistics.Paths, Separators=";")
list_item_13 = ListItem(List=text_split, Index=1, Wrap=True)  # -> simplify(Item)
text_split_2 = TextSplit(Text=list_item_13, Separators="}")
list_item_14 = ListItem(List=text_split_2, Index=0, Wrap=True)  # -> flatten(Item)
partition_list_3 = PartitionList(List=list_item_14, Size=list_length_7)  # -> simplify(Chunks)
python_script_2 = PythonScript(x=partition_list_3)  # -> out, cluster; inputs x: tree of Int32; same code as python_script
construct_point_4 = ConstructPoint(XCoordinate=python_script_2.cluster, YCoordinate=0, ZCoordinate=0)
point_groups_4 = PointGroups(Points=construct_point_4, Distance=0.1)  # -> Groups, simplify(Indices)
list_item_15 = ListItem(List=sort_list_2.ValuesValuesA, Index=point_groups_4.Indices, Wrap=True)

# ----
# create new boxes
deconstruct_brep = DeconstructBrep(Brep=list_item_15)  # -> Faces, Edges, Vertices
shift_paths_9 = ShiftPaths(Data=deconstruct_brep.Faces, Offset=-1)
number_7 = Number(shift_paths_9)
sort_list_3 = SortList(Keys=number_7, ValuesValuesA=shift_paths_9)  # -> reverse(Keys), reverse(ValuesValuesA)
evaluate_surface = EvaluateSurface(Surface=sort_list_3.ValuesValuesA, Point=Point(0.5, 0.5, 0))  # -> Point, Normal, Frame
list_item_16 = ListItem(List=evaluate_surface.Normal, Index=0, Wrap=True)  # -> simplify(Item)
plane_normal_3 = PlaneNormal(Origin=Point(0, 0, 0), ZAxis=list_item_16)
bounding_box_4 = BoundingBox(Content=list_item_15, Plane=plane_normal_3, UnionBox=True)  # -> flatten(Box), Box_2

deconstruct_box_3 = DeconstructBox(Box=bounding_box_4.Box)  # -> Plane, X, Y, Z
deconstruct_domain_3 = DeconstructDomain(Domain=deconstruct_box_3.Z)  # -> Start, End
subtraction_3 = Subtraction(A=deconstruct_domain_3.End, B=deconstruct_domain_3.Start)
smaller_than_7 = SmallerThan(FirstNumber=expr("abs(x)", subtraction_3), SecondNumber=Slider(0.05, range=0..0.1))  # -> SmallerThan, OrEqualTo
dispatch_12 = Dispatch(List=deconstruct_box_3.Plane, DispatchPattern=smaller_than_7.SmallerThan)  # -> simplify(graft(ListA)), ListB
dispatch_13 = Dispatch(List=bounding_box_4.Box, DispatchPattern=smaller_than_7.SmallerThan)  # -> simplify(graft(ListA)), ListB
move = Move(Geometry=dispatch_13.ListA, Motion=expr("-0.1*x", dispatch_12.ListA))  # -> Geometry, Transform
merge_4 = Merge(Data1=graft(move.Geometry), Data2=graft(dispatch_13.ListA))  # -> simplify(Result)
bounding_box_5 = BoundingBox(Content=merge_4, Plane=dispatch_12.ListA, UnionBox=True)  # -> Box, Box_2
merge_5 = Merge(Data1=dispatch_13.ListB, Data2=bounding_box_5.Box)  # -> flatten(Result)

box_properties_2 = BoxProperties(Box=merge_5)  # -> Center, Diagonal, Area, Volume, Degeneracy
scale_2 = Scale(Geometry=merge_5, Center=box_properties_2.Center, Factor=1.01)  # -> Geometry, Transform
number_slider_3 = Slider(3, range=0..10)  # disabled

# ----
# select wall segments in box
walls_8 = Geometry(simplify(flatten(walls_4)))
partial_wall_objects = Geometry(flatten(scale_2.Geometry))
mesh_area_5 = MeshArea(Mesh=walls_8)  # -> Area, Centroid
populate_geometry = PopulateGeometry(Geometry=walls_8, Count=50, Seed=1)  # -> simplify(Population)
point_in_breps_2 = PointInBreps(Brep=partial_wall_objects, Point=populate_geometry, Strict=False)  # -> Inside, simplify(Index)
create_set_2 = CreateSet(List=point_in_breps_2.Index)  # -> Set, Map
member_index_3 = MemberIndex(Set=point_in_breps_2.Index, Member=create_set_2.Set)  # -> Index, Count
sort_list_4 = SortList(Keys=member_index_3.Count, ValuesValuesA=create_set_2.Set)  # -> Keys, reverse(ValuesValuesA)
list_length_8 = ListLength(List=partial_wall_objects)
list_item_17 = ListItem(List=sort_list_4.ValuesValuesA, Index=0, Wrap=True)  # -> flatten(Item)
series_2 = Series(Start=0, Step=1, Count=list_length_8)
sort_list_5 = SortList(Keys=list_item_17, ValuesValuesA=walls_8)  # -> Keys, ValuesValuesA
member_index_4 = MemberIndex(Set=sort_list_5.Keys, Member=series_2)  # -> Index, Count
partition_list_4 = PartitionList(List=sort_list_5.ValuesValuesA, Size=member_index_4.Count)  # -> simplify(Chunks)

geometry_3 = Geometry(<mesh referenced from the Rhino model>)

# ----
# select wall segments in box
walls_9 = Geometry(simplify(flatten(walls_4)))
partial_wall_objects_2 = Geometry(flatten(scale_2.Geometry))
mesh_area_6 = MeshArea(Mesh=walls_9)  # -> Area, Centroid
populate_geometry_2 = PopulateGeometry(Geometry=walls_9, Count=50, Seed=1)  # -> simplify(graft(Population))
point_in_breps_3 = PointInBreps(Brep=partial_wall_objects_2, Point=populate_geometry_2, Strict=False)  # -> Inside, simplify(Index)
create_set_3 = CreateSet(List=point_in_breps_3.Index)  # -> Set, Map
member_index_5 = MemberIndex(Set=point_in_breps_3.Index, Member=create_set_3.Set)  # -> Index, Count
sort_list_6 = SortList(Keys=member_index_5.Count, ValuesValuesA=create_set_3.Set)  # -> Keys, reverse(ValuesValuesA)
list_length_9 = ListLength(List=partial_wall_objects_2)
list_item_18 = ListItem(List=sort_list_6.ValuesValuesA, Index=0, Wrap=True)  # -> flatten(Item)
series_3 = Series(Start=0, Step=1, Count=list_length_9)
sort_list_7 = SortList(Keys=list_item_18, ValuesValuesA=walls_9)  # -> Keys, ValuesValuesA
member_index_6 = MemberIndex(Set=sort_list_7.Keys, Member=series_3)  # -> Index, Count
partition_list_5 = PartitionList(List=sort_list_7.ValuesValuesA, Size=member_index_6.Count)  # -> simplify(Chunks)

shape_in_brep = ShapeInBrep(Brep=simplify(graft(scale_2.Geometry)), Shape=walls_9)  # -> simplify(Relation)

# ----
# duplicate single faces walls
wall_surf = Geometry(partition_list_4)
mesh_area_7 = MeshArea(Mesh=wall_surf)  # -> Area, Centroid
mesh_closest_point_3 = MeshClosestPoint(Point=mesh_area_7.Centroid, Mesh=wall_surf)  # -> Point, Index, Parameter
list_length_10 = ListLength(List=wall_surf)
equality = Equality(FirstNumber=list_length_10, SecondNumber=1)  # -> Equality, Inequality
mesh_eval_3 = MeshEval(Mesh=wall_surf, Parameter=mesh_closest_point_3.Parameter)  # -> Point, Normal, Colour
dispatch_14 = Dispatch(List=mesh_eval_3.Normal, DispatchPattern=equality.Equality)  # -> ListA, ListB
dispatch_15 = Dispatch(List=wall_surf, DispatchPattern=equality.Equality)  # -> ListA, ListB
move_2 = Move(Geometry=dispatch_15.ListA, Motion=expr("-0.1*x", dispatch_14.ListA))  # -> Geometry, Transform
merge_6 = Merge(Data1=wall_surf, Data2=move_2.Geometry)
wall_surf_2 = Geometry(merge_6)

member_index_7 = MemberIndex(Set=shape_in_brep, Member=0)  # -> simplify(Index), Count
list_item_19 = ListItem(List=walls_9, Index=member_index_7.Index, Wrap=True)
tree_branch_2 = TreeBranch(Tree=list_item_19, Path=Slider(10, range=0..10), MaintainPaths=True)
number_slider_4 = Slider(43, range=0..100)
panel = Panel(member_index_7.Index)

# ----
# RECONSTRUCT PARTIAL Walls
# cluster per wall face
# averaged normal and plane
# partition lists
# signed distance
partial_wall_objects_3 = Geometry(flatten(scale_2.Geometry))
wall_surf_3 = Geometry(wall_surf_2)
deconstruct_box_4 = DeconstructBox(Box=partial_wall_objects_3)  # -> simplify(graft(Plane)), X, Y, Z
mesh_area_8 = MeshArea(Mesh=wall_surf_3)  # -> Area, Centroid
mesh_closest_point_4 = MeshClosestPoint(Point=mesh_area_8.Centroid, Mesh=wall_surf_3)  # -> Point, Index, Parameter
mesh_eval_4 = MeshEval(Mesh=wall_surf_3, Parameter=mesh_closest_point_4.Parameter)  # -> Point, Normal, Colour
weighted_average_3 = WeightedAverage(Input=mesh_area_8.Centroid, Weights=mesh_area_8.Area)
weighted_average_4 = WeightedAverage(Input=mesh_eval_4.Normal, Weights=mesh_area_8.Area)
plane_origin = PlaneOrigin(Base=deconstruct_box_4.Plane, Origin=weighted_average_3)
adjust_plane = AdjustPlane(Plane=plane_origin, Normal=plane_origin)
plane_closest_point = PlaneClosestPoint(Point=mesh_area_8.Centroid, Plane=adjust_plane)  # -> Point, UVPoint, Distance
sort_list_8 = SortList(Keys=plane_closest_point.Distance, ValuesValuesA=wall_surf_2)  # -> Keys, ValuesValuesA
smaller_than_8 = SmallerThan(FirstNumber=sort_list_8.Keys, SecondNumber=0)  # -> SmallerThan, OrEqualTo
mass_addition_3 = MassAddition(Input=smaller_than_8.SmallerThan)  # -> Result, PartialResults
list_length_11 = ListLength(List=smaller_than_8.SmallerThan)
subtraction_4 = Subtraction(A=list_length_11, B=mass_addition_3.Result)
merge_7 = Merge(Data1=mass_addition_3.Result, Data2=subtraction_4)
partition_list_6 = PartitionList(List=sort_list_8.ValuesValuesA, Size=merge_7)
wall_faces = Geometry(partition_list_6)

number_slider_5 = Slider(300, range=0..1000)  # disabled
# Create Revit Floors
ggrvt_material = GgRvtMaterial(Name="Concrete", Class=15)  # disabled
number_slider_6 = Slider(52, range=0..1000)
tree_branch_3 = TreeBranch(Tree=simplify(graft(scale_2.Geometry)), Path=number_slider_6, MaintainPaths=True)
ggrvt_materiallayer = GgRvtMaterialLayer(RvtMaterial=ggrvt_material, Thickness=number_slider_5, Function=0, Wraps=True, Structural=True, Variable=False)  # disabled
tree_branch_4 = TreeBranch(Tree=populate_geometry, Path=number_slider_6, MaintainPaths=True)
number_slider_7 = Slider(10, range=0..10)
text = Text("Generic Floor")  # disabled
# Create Revit Floors
ggrvt_floortype = GgRvtFloorType(
    Name=text,
    LayersCore=ggrvt_materiallayer,
    Interior=True,
    ggIFC_ggIds="56452644-7d36-4b48-95e5-a12354be0a26;12uXSRrlr3i8yasp5Lax8s")  # disabled
number_slider_8 = Slider(28, range=0..100)

# ----
# Compute thickness and hearthplane
# compute best fit thickness
# compute best fit wall faces
# create best fit partial wall
hearlth_plane_normal = Geometry(weighted_average_4)
hearlth_plane = Geometry(adjust_plane)
wall_faces_2 = Geometry(wall_faces)
deconstruct_mesh_4 = DeconstructMesh(Mesh=wall_faces_2)  # -> simplify(Vertices), simplify(Faces), Colours, Normals
duplicate_data_5 = DuplicateData(Data=hearlth_plane, Number=2, Order=True)  # -> simplify(graft(Data))
duplicate_data_6 = DuplicateData(Data=hearlth_plane_normal, Number=2, Order=True)  # -> simplify(graft(Data))
mesh_area_9 = MeshArea(Mesh=wall_faces_2)  # -> graft(Area), Centroid
list_length_12 = ListLength(List=deconstruct_mesh_4.Vertices)
shift_paths_10 = ShiftPaths(Data=deconstruct_mesh_4.Vertices, Offset=-1)
deconstruct_vector_2 = DeconstructVector(Vector=duplicate_data_6)  # -> XComponent, YComponent, ZComponent
duplicate_data_7 = DuplicateData(Data=mesh_area_9.Area, Number=list_length_12, Order=True)  # -> simplify(Data)
plane_closest_point_2 = PlaneClosestPoint(Point=shift_paths_10, Plane=duplicate_data_5)  # -> Point, UVPoint, Distance
vector_xyz = VectorXYZ(XComponent=deconstruct_vector_2.XComponent, YComponent=deconstruct_vector_2.YComponent, ZComponent=0)  # -> unitize(Vector), Length
shift_paths_11 = ShiftPaths(Data=duplicate_data_7, Offset=-1)
average_7 = Average(Input=plane_closest_point_2.Distance)
weighted_average_5 = WeightedAverage(Input=plane_closest_point_2.Distance, Weights=shift_paths_11)
amplitude = Amplitude(Vector=vector_xyz.Vector, Amplitude=weighted_average_5)
shift_paths_12 = ShiftPaths(Data=weighted_average_5, Offset=-1)
move_3 = Move(Geometry=duplicate_data_5, Motion=amplitude)  # -> Geometry, Transform
project = Project(Geometry=wall_faces_2, Plane=move_3.Geometry)  # -> Geometry, Transform
number_8 = Number(expr("abs(x)", shift_paths_12))
mass_addition_4 = MassAddition(Input=shift_paths_12)  # -> Result, PartialResults
shift_paths_13 = ShiftPaths(Data=project.Geometry, Offset=-1)
mass_addition_5 = MassAddition(Input=number_8)  # -> Result, PartialResults
bounding_box_6 = BoundingBox(Content=shift_paths_13, Plane=hearlth_plane, UnionBox=True)  # -> Box, Box_2
partials_walls = Geometry(flatten(bounding_box_6.Box))
wall_thickness = Number(expr("round(x,2)", mass_addition_5.Result))

# ----
# cut all floor/ceiling meshes with walls
# filter small patches
partial_wall_objects_4 = Geometry(flatten(partials_walls))
floor_ceiling = Geometry(entwine)
deconstruct_mesh_5 = DeconstructMesh(Mesh=floor_ceiling)  # -> Vertices, Faces, Colours, Normals
convex_hull_4 = ConvexHull(Points=deconstruct_mesh_5.Vertices, Plane=PlaneXY(0, 0, 0))  # -> Hull, simplify(HullZ), Indices
boundary_surfaces_3 = BoundarySurfaces(Edges=convex_hull_4.HullZ)
trim_solid = TrimSolid(Shape=boundary_surfaces_3, Cutters=partial_wall_objects_4)
area = Area(Geometry=trim_solid)  # -> Area, Centroid
larger_than_6 = LargerThan(FirstNumber=area.Area, SecondNumber=Slider(1, range=0..1))  # -> LargerThan, OrEqualTo
dispatch_16 = Dispatch(List=trim_solid, DispatchPattern=larger_than_6.LargerThan)  # -> simplify(ListA), ListB
shift_paths_14 = ShiftPaths(Data=dispatch_16.ListA, Offset=-1)
explode_tree = ExplodeTree(Data=shift_paths_14)  # -> Branch0, Branch1
# Partial Room Segments
ceiling_3 = Geometry(explode_tree.Branch1)
floor_3 = Geometry(explode_tree.Branch0)

# ----
# merge above ceilings with floors
# based on first collision with extrusion
# create Brep extrusion of floors
# test for ceiling inliers (keep ceilings with >40% inliers)
# test if ceiling can connect to floor unobstructed (<20% obstruction from ceilings or other floors)
# non-colliding meshes
ceiling_4 = Geometry(explode_tree.Branch1)  # disabled
number_9 = Number(expr("round(x,0)+10", ceiling_4))  # disabled
populate_geometry_3 = PopulateGeometry(Geometry=ceiling_4, Count=number_9, Seed=1)  # disabled
floor_4 = Geometry(explode_tree.Branch0)  # disabled
floors_2 = Geometry(simplify(graft(floor_4)))  # disabled
list_length_13 = ListLength(List=populate_geometry_3)  # -> flatten(Length); disabled
list_length_14 = ListLength(List=floor_4)  # disabled
deconstruct_mesh_6 = DeconstructMesh(Mesh=floor_4)  # -> Vertices, Faces, Colours, Normals; disabled
mesh_area_10 = MeshArea(Mesh=floors_2)  # -> Area, Centroid; disabled
duplicate_data_8 = DuplicateData(Data=graft(floor_4), Number=list_length_14, Order=True)  # -> simplify(Data); disabled
number_slider_9 = Slider(0.2, range=0..1)  # disabled
convex_hull_5 = ConvexHull(Points=deconstruct_mesh_6.Vertices, Plane=PlaneXY(0, 0, 0))  # -> Hull, HullZ, Indices; disabled
deconstruct_4 = Deconstruct(Point=mesh_area_10.Centroid)  # -> XComponent, YComponent, ZComponent; disabled
extrude_3 = Extrude(Base=convex_hull_5.HullZ, Direction=Vector(0, 0, 20))  # disabled
cap_holes = CapHoles(Brep=extrude_3)  # -> simplify(ExtrudedFloors); disabled
list_length_15 = ListLength(List=cap_holes)  # disabled
duplicate_data_9 = DuplicateData(Data=list_length_13, Number=list_length_15, Order=True)  # -> simplify(Data); disabled
duplicate_data_10 = DuplicateData(Data=ceiling_4, Number=list_length_15, Order=True)  # -> simplify(Data); disabled
point_in_brep = PointInBrep(Brep=cap_holes, Point=flatten(populate_geometry_3), Strict=False)  # disabled
partition_list_7 = PartitionList(List=point_in_brep, Size=duplicate_data_9)  # disabled
create_set_4 = CreateSet(List=partition_list_7)  # -> Set, Map; disabled
member_index_8 = MemberIndex(Set=partition_list_7, Member=create_set_4.Set)  # -> Index, Count; disabled
sort_list_9 = SortList(Keys=member_index_8.Count, ValuesValuesA=create_set_4.Set)  # -> reverse(Keys), reverse(ValuesValuesA); disabled
list_item_20 = ListItem(List=sort_list_9.ValuesValuesA, Index=0, Wrap=True)  # disabled
list_length_16 = ListLength(List=partition_list_7)  # disabled
division_2 = Division(A=member_index_8.Count, B=list_length_16)  # disabled
number_slider_10 = Slider(0.3, range=0..1)  # disabled
larger_than_7 = LargerThan(FirstNumber=division_2, SecondNumber=number_slider_10)  # -> LargerThan, OrEqualTo; disabled
dispatch_17 = Dispatch(List=create_set_4.Set, DispatchPattern=larger_than_7.LargerThan)  # -> ListA, ListB; disabled
mass_addition_6 = MassAddition(Input=dispatch_17.ListA)  # -> Result, PartialResults; disabled
shift_paths_15 = ShiftPaths(Data=mass_addition_6.Result, Offset=-1)  # disabled
dispatch_18 = Dispatch(List=duplicate_data_10, DispatchPattern=shift_paths_15)  # -> ListA, ListB; disabled
ceiling_candidates = Geometry(dispatch_18.ListA)  # disabled
number_10 = Number(expr("round(x,0)+10", ceiling_candidates))  # disabled
populate_geometry_4 = PopulateGeometry(Geometry=ceiling_candidates, Count=number_10, Seed=1)  # disabled
face_normals_5 = FaceNormals(Mesh=ceiling_candidates)  # -> simplify(Centers), Normals; disabled
list_length_17 = ListLength(List=populate_geometry_4)  # disabled
shift_paths_16 = ShiftPaths(Data=list_length_17, Offset=-1)  # disabled
deconstruct_5 = Deconstruct(Point=populate_geometry_4)  # -> XComponent, YComponent, ZComponent; disabled
duplicate_data_11 = DuplicateData(Data=deconstruct_4.ZComponent, Number=shift_paths_16, Order=True)  # -> simplify(Data); disabled
construct_point_5 = ConstructPoint(
    XCoordinate=deconstruct_5.XComponent,
    YCoordinate=deconstruct_5.YComponent,
    ZCoordinate=expr("x-0.5", deconstruct_5.ZComponent))  # disabled
construct_point_6 = ConstructPoint(XCoordinate=deconstruct_5.XComponent, YCoordinate=deconstruct_5.YComponent, ZCoordinate=expr("x+0.5", duplicate_data_11))  # disabled
clean_tree_2 = CleanTree(RemoveNulls=True, RemoveInvalid=True, RemoveEmpty=True, Tree=ceiling_candidates)  # disabled
line_2 = Line(StartPoint=construct_point_5, EndPoint=construct_point_6)  # disabled
number_11 = Number(expr("x+1", list_length_17))  # disabled
shift_paths_17 = ShiftPaths(Data=line_2, Offset=-1)  # disabled
collision_one_many_2 = CollisionOneMany(Collider=shift_paths_17, Obstacles=ceiling_candidates)  # -> Collision, Index; disabled
merge_8 = Merge(Data1=shift_paths_17, Data2=duplicate_data_8)  # disabled
partition_list_8 = PartitionList(List=collision_one_many_2.Collision, Size=shift_paths_16)  # disabled
mass_addition_7 = MassAddition(Input=partition_list_8)  # -> Result, PartialResults; disabled
division_3 = Division(A=mass_addition_7.Result, B=number_11)  # -> simplify(Result); disabled
smaller_than_9 = SmallerThan(FirstNumber=division_3, SecondNumber=number_slider_9)  # -> SmallerThan, OrEqualTo; disabled
shift_paths_18 = ShiftPaths(Data=smaller_than_9.SmallerThan, Offset=-1)  # disabled
dispatch_19 = Dispatch(List=clean_tree_2, DispatchPattern=shift_paths_18)  # -> ListA, ListB; disabled
linked_ceiling_meshes = Geometry(dispatch_19.ListA)  # disabled

# ----
# find unmatched floors and compute best fit ceiling for them
# take first nearby above ceiling
null_item = NullItem(Item=ceiling_candidates)  # -> NullFlags, InvalidFlags, Description; disabled
list_length_18 = ListLength(List=linked_ceiling_meshes)  # disabled
ceiling_5 = Geometry(explode_tree.Branch1)  # disabled
floor_5 = Geometry(explode_tree.Branch0)  # disabled
equality_2 = Equality(FirstNumber=list_length_18, SecondNumber=0)  # -> Equality, Inequality; disabled
mass_addition_8 = MassAddition(Input=null_item.NullFlags)  # -> Result, PartialResults; disabled
dispatch_20 = Dispatch(List=simplify(graft(floor_4)), DispatchPattern=mass_addition_8.Result)  # -> ListA, ListB; disabled
floors_with_friends = Geometry(dispatch_20.ListB)  # disabled
lonely_floors = Geometry(dispatch_20.ListA)  # disabled
mesh_area_11 = MeshArea(Mesh=lonely_floors)  # -> Area, Centroid; disabled
mesh_area_12 = MeshArea(Mesh=ceiling_5)  # -> Area, Centroid; disabled
deconstruct_6 = Deconstruct(Point=mesh_area_12.Centroid)  # -> XComponent, YComponent, ZComponent; disabled
deconstruct_7 = Deconstruct(Point=mesh_area_11.Centroid)  # -> XComponent, YComponent, ZComponent; disabled
closest_points_2 = ClosestPoints(Point=mesh_area_11.Centroid, Cloud=mesh_area_12.Centroid, Count=10)  # -> ClosestPoint, CPIndex, Distance; disabled
list_item_21 = ListItem(List=deconstruct_6.ZComponent, Index=closest_points_2.CPIndex, Wrap=True)  # disabled
list_item_22 = ListItem(List=ceiling_5, Index=closest_points_2.CPIndex, Wrap=True)  # disabled
subtraction_5 = Subtraction(A=list_item_21, B=deconstruct_7.ZComponent)  # disabled
number_slider_11 = Slider(2, range=0..10)  # disabled
larger_than_8 = LargerThan(FirstNumber=subtraction_5, SecondNumber=number_slider_11)  # -> LargerThan, OrEqualTo; disabled
dispatch_21 = Dispatch(List=list_item_22, DispatchPattern=larger_than_8.LargerThan)  # -> ListA, ListB; disabled
dispatch_22 = Dispatch(List=subtraction_5, DispatchPattern=larger_than_8.LargerThan)  # -> ListA, ListB; disabled
sort_list_10 = SortList(Keys=dispatch_22.ListA, ValuesValuesA=dispatch_21.ListA)  # -> Keys, ValuesValuesA; disabled
list_item_23 = ListItem(List=sort_list_10.ValuesValuesA, Index=0, Wrap=True)  # disabled
clean_tree_3 = CleanTree(RemoveNulls=True, RemoveInvalid=True, RemoveEmpty=True, Tree=list_item_23)  # -> simplify(LonelyCeilings); disabled
lonely_ceilings = Geometry(clean_tree_3)  # disabled

# ----
# Create best room blueprint: Project ceilings on floor plane
floors_with_friends_2 = Geometry(floors_with_friends)  # disabled
linked_ceiling_meshes_2 = Geometry(dispatch_19.ListA)  # disabled
clean_tree_4 = CleanTree(RemoveNulls=True, RemoveInvalid=True, RemoveEmpty=True, Tree=floors_with_friends_2)  # disabled
face_normals_6 = FaceNormals(Mesh=clean_tree_4)  # -> Centers, Normals; disabled
plane_fit = PlaneFit(Points=face_normals_6.Centers)  # -> simplify(Plane), Deviation; disabled
project_2 = Project(Geometry=linked_ceiling_meshes_2, Plane=plane_fit.Plane)  # -> Geometry, Transform; disabled
merge_9 = Merge(Data1=project_2.Geometry)  # disabled

# ----
# extrude blueprints and trim with ceiling geometry
linked_ceiling_meshes_3 = Geometry(linked_ceiling_meshes)  # disabled
lonely_ceilings_2 = Geometry(lonely_ceilings)  # disabled
lonely_floors_2 = Geometry(lonely_floors)  # disabled
blueprint = Geometry(merge_9)  # disabled
merge_10 = Merge(Data1=blueprint, Data2=lonely_floors_2)  # disabled
merge_11 = Merge(Data1=lonely_ceilings_2, Data2=linked_ceiling_meshes_3)  # disabled
deconstruct_mesh_7 = DeconstructMesh(Mesh=merge_10)  # -> Vertices, Faces, Colours, Normals; disabled
deconstruct_mesh_8 = DeconstructMesh(Mesh=merge_11)  # -> Vertices, Faces, Colours, Normals; disabled
shift_paths_19 = ShiftPaths(Data=deconstruct_mesh_7.Vertices, Offset=-1)  # disabled
convex_hull_6 = ConvexHull(Points=deconstruct_mesh_8.Vertices, Plane=PlaneXY(0, 0, 0))  # -> Hull, HullZ, Indices; disabled
convex_hull_7 = ConvexHull(Points=shift_paths_19, Plane=PlaneXY(0, 0, 0))  # -> Hull, HullZ, Indices; disabled
boundary_surfaces_4 = BoundarySurfaces(Edges=convex_hull_6.HullZ)  # disabled
mesh_area_13 = MeshArea(Mesh=boundary_surfaces_4)  # -> Area, Centroid; disabled
boundary_surfaces_5 = BoundarySurfaces(Edges=convex_hull_7.HullZ)  # disabled
scale_3 = Scale(Geometry=boundary_surfaces_4, Center=mesh_area_13.Centroid, Factor=50)  # -> Geometry, Transform; disabled
extrude_4 = Extrude(Base=scale_3.Geometry, Direction=Vector(0, 0, 20))  # disabled
extrude_5 = Extrude(Base=boundary_surfaces_5, Direction=Vector(0, 0, 20))  # disabled
shift_paths_20 = ShiftPaths(Data=extrude_4, Offset=-1)  # disabled
trim_solid_2 = TrimSolid(Shape=extrude_5, Cutters=shift_paths_20)  # -> simplify(Result); disabled

solid_difference = SolidDifference(BrepsA=extrude_5, BrepsB=shift_paths_20)  # -> simplify(Result); disabled
partial_room_segments = Geometry(trim_solid_2)  # disabled
merge_12 = Merge(Data1=trim_solid_2, Data2=extrude_2)  # -> flatten(Result); disabled
tree_branch_5 = TreeBranch(Tree=simplify(graft(floor_4)), Path=number_slider, MaintainPaths=True)  # disabled
tree_branch_6 = TreeBranch(Tree=linked_ceiling_meshes, Path=number_slider, MaintainPaths=True)  # disabled
tree_branch_7 = TreeBranch(Tree=ceiling_candidates, Path=number_slider, MaintainPaths=True)  # disabled
tree_branch_8 = TreeBranch(Tree=linked_ceiling_meshes, Path=number_slider, MaintainPaths=True)  # disabled
panel_2 = Panel(tree_branch_7)  # disabled

# ----
# parallel intersections
# extract orthogonal face of each box
# extract centre plane p(w)
partial_wall_objects_5 = Geometry(flatten(partials_walls))  # disabled
deconstruct_brep_2 = DeconstructBrep(Brep=partial_wall_objects_5)  # -> simplify(Faces), Edges, Vertices; disabled
deconstruct_box_5 = DeconstructBox(Box=partial_wall_objects_5)  # -> Plane, X, Y, flatten(Z); disabled
area_2 = Area(Geometry=partial_wall_objects_5)  # -> Area, simplify(graft(Centroid)); disabled
area_3 = Area(Geometry=deconstruct_brep_2.Faces)  # -> Area, Centroid; disabled
deconstruct_8 = Deconstruct(Point=area_3.Centroid)  # -> XComponent, YComponent, ZComponent; disabled
sort_list_11 = SortList(Keys=deconstruct_8.ZComponent, ValuesValuesA=deconstruct_brep_2.Faces)  # -> Keys, ValuesValuesA; disabled
list_item_24 = ListItem(List=sort_list_11.ValuesValuesA, Index=[1, 2, 3, 4], Wrap=True)  # disabled
number_12 = Number(list_item_24)  # disabled
sort_list_12 = SortList(Keys=number_12, ValuesValuesA=list_item_24)  # -> Keys, ValuesValuesA; disabled
list_item_25 = ListItem(List=sort_list_12.ValuesValuesA, Index=2, Wrap=True)  # disabled
area_4 = Area(Geometry=list_item_25)  # -> Area, Centroid; disabled
vector_2pt = Vector2Pt(PointA=area_4.Centroid, PointB=area_2.Centroid, Unitize=False)  # -> Vector, Length; disabled
move_4 = Move(Geometry=list_item_25, Motion=vector_2pt.Vector)  # -> Geometry, Transform; disabled
list_item_26 = ListItem(List=sort_list_12.ValuesValuesA, Index=[0, 1], Wrap=True)  # -> graft(Item); disabled
area_5 = Area(Geometry=list_item_26)  # -> Area, simplify(Centroid); disabled
centroid = Geometry(flatten(area_2.Centroid))  # disabled

# ----
# closest planes to ortho faces
# distance between wall planes <0.8m
# Dot(Normal)<0.15
# No collision with rooms
number_slider_12 = Slider(20, range=0..100)  # disabled
closest_points_3 = ClosestPoints(Point=area_5.Centroid, Cloud=centroid, Count=number_slider_12)  # -> simplify(ClosestPoint), simplify(CPIndex), Distance; disabled
list_item_27 = ListItem(List=flatten(move_4.Geometry), Index=closest_points_3.CPIndex, Wrap=True)  # -> simplify(Item); disabled
evaluate_surface_2 = EvaluateSurface(Surface=list_item_26, Point=Point(0, 0, 0))  # -> Point, Normal, Frame; disabled
evaluate_surface_3 = EvaluateSurface(Surface=list_item_27, Point=Point(0, 0, 0))  # -> Point, Normal, Frame; disabled
surface_closest_point = SurfaceClosestPoint(Point=area_5.Centroid, Surface=list_item_27)  # -> Point, UVPoint, Distance; disabled
room_segments = Geometry(flatten(partial_room_segments))  # disabled
dot_product_3 = DotProduct(VectorA=evaluate_surface_2.Normal, VectorB=evaluate_surface_3.Normal, Unitize=False)  # -> expr("abs(x)", DotProduct); disabled
number_slider_13 = Slider(0.1, range=0..0.1)  # disabled
larger_than_9 = LargerThan(FirstNumber=surface_closest_point.Distance, SecondNumber=number_slider_13)  # -> LargerThan, OrEqualTo; disabled
number_slider_14 = Slider(0.8, range=0..1)  # disabled
smaller_than_10 = SmallerThan(FirstNumber=surface_closest_point.Distance, SecondNumber=number_slider_14)  # -> SmallerThan, OrEqualTo; disabled
number_slider_15 = Slider(0.15, range=0..1)  # disabled
smaller_than_11 = SmallerThan(FirstNumber=dot_product_3, SecondNumber=number_slider_15)  # -> SmallerThan, OrEqualTo; disabled
list_length_19 = ListLength(List=closest_points_3.CPIndex)  # disabled
gate_and_3 = GateAnd(A=smaller_than_10.SmallerThan, C=larger_than_9.LargerThan, B=smaller_than_11.SmallerThan)  # disabled
duplicate_data_12 = DuplicateData(Data=list_item_26, Number=list_length_19, Order=True)  # -> simplify(Data); disabled
dispatch_23 = Dispatch(List=surface_closest_point.Point, DispatchPattern=gate_and_3)  # -> ListA, ListB; disabled
line_3 = Line(StartPoint=area_5.Centroid, EndPoint=dispatch_23.ListA)  # disabled
collision_one_many_3 = CollisionOneMany(Collider=line_3, Obstacles=room_segments)  # -> Collision, Index; disabled
dispatch_24 = Dispatch(List=dispatch_23.ListA, DispatchPattern=invert(collision_one_many_3.Collision))  # -> ListA, ListB; disabled
dispatch_25 = Dispatch(List=duplicate_data_12, DispatchPattern=gate_and_3)  # -> OrthoFaces, ListB; disabled
dispatch_26 = Dispatch(List=dispatch_25.OrthoFaces, DispatchPattern=invert(collision_one_many_3.Collision))  # -> ListA, ListB; disabled

shift_paths_21 = ShiftPaths(Data=dispatch_23.ListA, Offset=-1)  # disabled
shift_paths_22 = ShiftPaths(Data=list_item_27, Offset=-1)  # disabled
shift_paths_23 = ShiftPaths(Data=list_item_26, Offset=-1)  # disabled
tree_branch_9 = TreeBranch(Tree=shift_paths_21, Path=number_slider_3, MaintainPaths=True)  # disabled
tree_branch_10 = TreeBranch(Tree=shift_paths_22, Path=number_slider_3, MaintainPaths=True)  # disabled
tree_branch_11 = TreeBranch(Tree=shift_paths_23, Path=number_slider_3, MaintainPaths=True)  # disabled
explode_tree_2 = ExplodeTree(Data=list_item_26)  # -> Branch0, Branch1; disabled
explode_tree_3 = ExplodeTree(Data=list_item_27)  # -> Branch0, Branch1; disabled
explode_tree_4 = ExplodeTree(Data=dispatch_23.ListA)  # -> Branch0, Branch1; disabled
geometry_4 = Geometry(explode_tree_2.Branch0)  # disabled
geometry_5 = Geometry(explode_tree_3.Branch0)  # disabled
geometry_6 = Geometry(explode_tree_4.Branch0)  # disabled

# ----
# create additional wall by moveing ortho face
deconstruct_9 = Deconstruct(Point=dispatch_24.ListA)  # -> XComponent, YComponent, ZComponent; disabled
deconstruct_10 = Deconstruct(Point=area_5.Centroid)  # -> XComponent, YComponent, ZComponent; disabled
construct_point_7 = ConstructPoint(XCoordinate=deconstruct_9.XComponent, YCoordinate=deconstruct_9.YComponent, ZCoordinate=deconstruct_10.ZComponent)  # disabled
line_4 = Line(StartPoint=area_5.Centroid, EndPoint=construct_point_7)  # disabled
plane_normal_4 = PlaneNormal(Origin=Point(0, 0, 0), ZAxis=evaluate_surface_2.Normal)  # disabled
move_5 = Move(Geometry=dispatch_26.ListA, Motion=line_4)  # -> simplify(Geometry), Transform; disabled
merge_13 = Merge(Data1=move_5.Geometry, Data2=dispatch_26.ListA)  # -> simplify(Result); disabled
bounding_box_7 = BoundingBox(Content=merge_13, Plane=plane_normal_4, UnionBox=True)  # -> flatten(Box), Box_2; disabled
clean_tree_5 = CleanTree(RemoveNulls=True, RemoveInvalid=True, RemoveEmpty=True, Tree=bounding_box_7.Box)  # disabled

# ----
# Give thin walls a default thickness of 10cm
deconstruct_box_6 = DeconstructBox(Box=clean_tree_5)  # -> Plane, X, Y, Z; disabled
deconstruct_domain_4 = DeconstructDomain(Domain=deconstruct_box_6.Z)  # -> Start, End; disabled
subtraction_6 = Subtraction(A=deconstruct_domain_4.End, B=deconstruct_domain_4.Start)  # disabled
number_slider_16 = Slider(0.05, range=0..0.1)  # disabled
smaller_than_12 = SmallerThan(FirstNumber=expr("abs(x)", subtraction_6), SecondNumber=number_slider_16)  # -> SmallerThan, OrEqualTo; disabled
dispatch_27 = Dispatch(List=deconstruct_box_6.Plane, DispatchPattern=smaller_than_12.SmallerThan)  # -> simplify(graft(ListA)), ListB; disabled
dispatch_28 = Dispatch(List=clean_tree_5, DispatchPattern=smaller_than_12.SmallerThan)  # -> simplify(graft(ListA)), ListB; disabled
move_6 = Move(Geometry=dispatch_28.ListA, Motion=expr("-0.1*x", dispatch_27.ListA))  # -> Geometry, Transform; disabled
merge_14 = Merge(Data1=graft(move_6.Geometry), Data2=graft(dispatch_28.ListA))  # -> simplify(Result); disabled
bounding_box_8 = BoundingBox(Content=merge_14, Plane=dispatch_27.ListA, UnionBox=True)  # -> Box, Box_2; disabled
merge_15 = Merge(Data1=dispatch_28.ListB, Data2=bounding_box_8.Box)  # disabled

merge_16 = Merge(Data1=partials_walls, Data2=merge_15)  # -> flatten(Result); disabled

# ----
# non-parallel intersections upperstrict adjancecy matrix
# filter intersections
# distance intersection to both walls <3m
# wall extensions (surf) do not collide with Rooms
# Comon domain in Z of intersection lines
# create intersection surface from intersection line and closest point on Brep
partial_wall_objects_6 = Geometry(flatten(merge_16))  # disabled
room_segments_2 = Geometry(flatten(partial_room_segments))  # disabled
# Wall intersection Theory
# find intersections
box_properties_3 = BoxProperties(Box=partial_wall_objects_6)  # -> Center, Diagonal, Area, Volume, Degeneracy; disabled
deconstruct_box_7 = DeconstructBox(Box=partial_wall_objects_6)  # -> Plane, X, Y, Z; disabled
plane_normal_5 = PlaneNormal(Origin=box_properties_3.Center, ZAxis=deconstruct_box_7.Plane)  # disabled
bounding_box_9 = BoundingBox(Content=partial_wall_objects_6, Plane=PlaneXY(0, 0, 0))  # -> Box, Box_2; disabled
cross_reference = CrossReference(ListListA=plane_normal_5, ListListB=plane_normal_5, CrossMode=7)  # -> ListListA, ListListB; disabled
cross_reference_2 = CrossReference(ListListA=partial_wall_objects_6, ListListB=partial_wall_objects_6, CrossMode=7)  # -> ListListA, ListListB; disabled
deconstruct_box_8 = DeconstructBox(Box=bounding_box_9.Box)  # -> Plane, X, Y, flatten(Z); disabled
plane_plane = PlanePlane(PlaneA=cross_reference.ListListA, PlaneB=cross_reference.ListListB)  # disabled
cross_reference_3 = CrossReference(ListListA=deconstruct_box_8.Z, ListListB=deconstruct_box_8.Z, CrossMode=7)  # -> ListListA, ListListB; disabled
point_on_curve = PointOnCurve(plane_plane, parameter=0.5)  # disabled
deconstruct_domain_5 = DeconstructDomain(Domain=simplify(graft(cross_reference_3.ListListA)))  # -> Start, End; disabled
deconstruct_domain_6 = DeconstructDomain(Domain=simplify(graft(cross_reference_3.ListListB)))  # -> Start, End; disabled
brep_closest_point = BrepClosestPoint(Point=point_on_curve, Brep=cross_reference_2.ListListB)  # -> Point, Distance; disabled
brep_closest_point_2 = BrepClosestPoint(Point=point_on_curve, Brep=cross_reference_2.ListListA)  # -> Point, Distance; disabled
merge_17 = Merge(Data1=deconstruct_domain_5.End, Data2=deconstruct_domain_6.End)  # disabled
merge_18 = Merge(Data1=deconstruct_domain_5.Start, Data2=deconstruct_domain_6.Start)  # disabled
number_slider_17 = Slider(3, range=0..10)  # disabled
smaller_than_13 = SmallerThan(FirstNumber=brep_closest_point_2.Distance, SecondNumber=number_slider_17)  # -> SmallerThan, OrEqualTo; disabled
smaller_than_14 = SmallerThan(FirstNumber=brep_closest_point.Distance, SecondNumber=number_slider_17)  # -> SmallerThan, OrEqualTo; disabled
sort_list_13 = SortList(Keys=merge_18)  # -> reverse(Keys), ValuesValuesA; disabled
sort_list_14 = SortList(Keys=merge_17)  # -> Keys, ValuesValuesA; disabled
gate_and_4 = GateAnd(A=smaller_than_13.SmallerThan, B=smaller_than_14.SmallerThan)  # -> simplify(graft(Result)); disabled
list_item_28 = ListItem(List=sort_list_14.Keys, Index=0, Wrap=True)  # disabled
list_item_29 = ListItem(List=sort_list_13.Keys, Index=0, Wrap=True)  # disabled
construct_point_8 = ConstructPoint(XCoordinate=0, YCoordinate=0, ZCoordinate=list_item_29)  # disabled
construct_point_9 = ConstructPoint(XCoordinate=0, YCoordinate=0, ZCoordinate=list_item_28)  # disabled
xy_plane = XYPlane(Origin=construct_point_8)  # disabled
xy_plane_2 = XYPlane(Origin=construct_point_9)  # disabled
line_2plane = Line2Plane(Line=simplify(graft(plane_plane)), PlaneA=xy_plane, PlaneB=xy_plane_2)  # disabled
extrude_point = ExtrudePoint(Base=line_2plane, Point=simplify(graft(brep_closest_point.Point)))  # disabled
extrude_point_2 = ExtrudePoint(Base=line_2plane, Point=simplify(graft(brep_closest_point_2.Point)))  # disabled
merge_19 = Merge(Data1=extrude_point_2, Data2=extrude_point)  # -> simplify(graft(Result)); disabled
collision_one_many_4 = CollisionOneMany(Collider=merge_19, Obstacles=simplify(flatten(room_segments_2)))  # -> Collision, Index; disabled
shift_paths_24 = ShiftPaths(Data=collision_one_many_4.Collision, Offset=-1)  # disabled
mass_addition_9 = MassAddition(Input=shift_paths_24)  # -> Result, PartialResults; disabled
equality_3 = Equality(FirstNumber=mass_addition_9.Result, SecondNumber=0)  # -> Equality, Inequality; disabled
shift_paths_25 = ShiftPaths(Data=merge_19, Offset=-1)  # disabled
gate_and_5 = GateAnd(A=gate_and_4, B=equality_3.Equality)  # disabled
merge_20 = Merge(Data1=graft(cross_reference_2.ListListA), Data2=graft(cross_reference_2.ListListB))  # -> simplify(Result); disabled
dispatch_29 = Dispatch(List=simplify(graft(point_on_curve)), DispatchPattern=gate_and_5)  # -> ListA, ListB; disabled
duplicate_data_13 = DuplicateData(Data=gate_and_5, Number=2, Order=True)  # -> simplify(graft(Data)); disabled
dispatch_30 = Dispatch(List=graft(merge_20), DispatchPattern=duplicate_data_13)  # -> ListA, ListB; disabled

dispatch_31 = Dispatch(List=simplify(graft(line_2plane)), DispatchPattern=gate_and_5)  # -> ListA, ListB; disabled
clean_tree_6 = CleanTree(RemoveNulls=True, RemoveInvalid=True, RemoveEmpty=True, Tree=dispatch_30.ListA)  # disabled
clean_tree_7 = CleanTree(RemoveNulls=True, RemoveInvalid=True, RemoveEmpty=True, Tree=dispatch_29.ListA)  # disabled

# ----
# move intersection point up to centroid height
duplicate_data_14 = DuplicateData(Data=clean_tree_7, Number=2, Order=True)  # -> simplify(graft(Data)); disabled
box_properties_4 = BoxProperties(Box=clean_tree_6)  # -> Center, Diagonal, Area, Volume, Degeneracy; disabled
deconstruct_11 = Deconstruct(Point=duplicate_data_14)  # -> XComponent, YComponent, ZComponent; disabled
deconstruct_12 = Deconstruct(Point=box_properties_4.Center)  # -> XComponent, YComponent, ZComponent; disabled
construct_point_10 = ConstructPoint(XCoordinate=deconstruct_11.XComponent, YCoordinate=deconstruct_11.YComponent, ZCoordinate=deconstruct_12.ZComponent)  # disabled

panel_3 = Panel(dispatch_23.ListA)  # disabled
geometry_7 = Geometry(dispatch_31.ListA)  # disabled
pipe = Pipe(Curve=geometry_7, Radius=0.1, Caps=2)  # disabled
partial_wall_objects_7 = Geometry(merge_16)  # disabled

# ----
# test if intersection is outside Brep. If so, extend Brep
# boxes
# compute which face of box to move by projecting extension point at same height of centroid box
# extension points
corresponding_boxes = Geometry(clean_tree_6)  # disabled
intersection_points = Geometry(construct_point_10)  # disabled
point_in_brep_2 = PointInBrep(Brep=corresponding_boxes, Point=intersection_points, Strict=False)  # disabled
dispatch_32 = Dispatch(List=intersection_points, DispatchPattern=invert(point_in_brep_2))  # -> simplify(graft(ListA)), ListB; disabled
dispatch_33 = Dispatch(List=corresponding_boxes, DispatchPattern=invert(point_in_brep_2))  # -> simplify(graft(ListA)), ListB; disabled
clean_tree_8 = CleanTree(RemoveNulls=True, RemoveInvalid=True, RemoveEmpty=True, Tree=dispatch_33.ListA)  # disabled
# EXTEND intersections
clean_tree_9 = CleanTree(RemoveNulls=True, RemoveInvalid=True, RemoveEmpty=True, Tree=dispatch_32.ListA)  # disabled
box_properties_5 = BoxProperties(Box=clean_tree_8)  # -> Center, Diagonal, Area, Volume, Degeneracy; disabled
point_groups_5 = PointGroups(Points=flatten(box_properties_5.Center), Distance=0.1)  # -> Groups, Indices; disabled
list_item_30 = ListItem(List=flatten(clean_tree_9), Index=point_groups_5.Indices, Wrap=True)  # -> simplify(graft(Item)); disabled
list_item_31 = ListItem(List=flatten(clean_tree_8), Index=point_groups_5.Indices, Wrap=True)  # -> simplify(graft(Item)); disabled
geometry_8 = Geometry(list_item_31)  # disabled
shift_paths_26 = ShiftPaths(Data=list_item_31, Offset=-1)  # disabled
deconstruct_brep_3 = DeconstructBrep(Brep=geometry_8)  # -> simplify(Faces), Edges, Vertices; disabled
mesh_area_14 = MeshArea(Mesh=deconstruct_brep_3.Faces)  # -> Area, Centroid; disabled
closest_point = ClosestPoint(Point=list_item_30, Cloud=mesh_area_14.Centroid)  # -> ClosestPoint, CPIndex, Distance; disabled
line_5 = Line(StartPoint=closest_point.ClosestPoint, EndPoint=list_item_30)  # disabled
list_item_32 = ListItem(List=deconstruct_brep_3.Faces, Index=closest_point.CPIndex, Wrap=True)  # disabled
move_7 = Move(Geometry=list_item_32, Motion=line_5)  # -> Geometry, Transform; disabled
shift_paths_27 = ShiftPaths(Data=move_7.Geometry, Offset=-1)  # disabled
list_item_33 = ListItem(List=list_item_31, Index=0, Wrap=True)  # disabled
merge_21 = Merge(Data1=list_item_31, Data2=move_7.Geometry)  # disabled
deconstruct_box_9 = DeconstructBox(Box=list_item_33)  # -> Plane, X, Y, Z; disabled
bounding_box_10 = BoundingBox(Content=merge_21, Plane=deconstruct_box_9.Plane, UnionBox=True)  # -> Box, Box_2; disabled

list_item_34 = ListItem(List=list_item_31, Index=0, Wrap=True)  # disabled
merge_22 = Merge(Data1=list_item_32, Data2=move_7.Geometry)  # disabled
# EXTEND VERTICAL intersections
bounding_box_11 = BoundingBox(Content=merge_22, Plane=deconstruct_box_9.Plane, UnionBox=True)  # -> Box, Box_2; disabled
ggrvt_floor = GgRvtFloor(RvtFloorType=ggrvt_floortype)  # disabled
param_viewer = ParamViewer(adjust_plane)
ggifc_material = GgIFCMaterial()  # disabled
number_slider_18 = Slider(4, range=0..100)  # disabled
number_slider_19 = Slider(1, range=0..10)  # disabled
ggifc_baketofile = GgIFCBaketoFile(Accurate=True, IFC4=False, Radians=True, RepMapExport="NONE")  # disabled

# ----
# test if intersection is inside Brep and within 20cm +half thickness oposing wall of border. If so, trim Brep
# test if distance is valid or not
# extract vertical sides of wall
# group trims per wall
# boxes
# intersection points
# extented face
intersection_points_2 = Geometry(construct_point_10)  # disabled
corresponding_boxes_2 = Geometry(clean_tree_6)  # disabled
point_in_brep_3 = PointInBrep(Brep=corresponding_boxes_2, Point=intersection_points_2, Strict=False)  # disabled
dispatch_34 = Dispatch(List=corresponding_boxes_2, DispatchPattern=point_in_brep_3)  # -> simplify(graft(ListA)), ListB; disabled
dispatch_35 = Dispatch(List=intersection_points_2, DispatchPattern=point_in_brep_3)  # -> simplify(graft(ListA)), ListB; disabled
clean_tree_10 = CleanTree(RemoveNulls=True, RemoveInvalid=True, RemoveEmpty=True, Tree=dispatch_35.ListA)  # disabled
clean_tree_11 = CleanTree(RemoveNulls=True, RemoveInvalid=True, RemoveEmpty=True, Tree=dispatch_34.ListA)  # disabled
deconstruct_brep_4 = DeconstructBrep(Brep=clean_tree_11)  # -> Faces, Edges, Vertices; disabled
deconstruct_box_10 = DeconstructBox(Box=clean_tree_11)  # -> Plane, X, Y, Z; disabled
deconstruct_domain_7 = DeconstructDomain(Domain=deconstruct_box_10.Z)  # -> Start, End; disabled
evaluate_surface_4 = EvaluateSurface(Surface=deconstruct_brep_4.Faces, Point=Point(0, 0, 0))  # -> Point, Normal, Frame; disabled
# TRIM intersections
duplicate_data_15 = DuplicateData(Data=clean_tree_11, Number=2, Order=True)  # -> simplify(Data); disabled
subtraction_7 = Subtraction(A=deconstruct_domain_7.Start, B=deconstruct_domain_7.End)  # disabled
deconstruct_13 = Deconstruct(Point=evaluate_surface_4.Normal)  # -> XComponent, YComponent, expr("abs(x)", ZComponent); disabled
number_13 = Number(expr("abs(x)*0.5", subtraction_7))  # disabled
shift_paths_28 = ShiftPaths(Data=number_13, Offset=-1)  # disabled
smaller_than_15 = SmallerThan(FirstNumber=deconstruct_13.ZComponent, SecondNumber=0.15)  # -> SmallerThan, OrEqualTo; disabled
dispatch_36 = Dispatch(List=deconstruct_brep_4.Faces, DispatchPattern=smaller_than_15.SmallerThan)  # -> ListA, ListB; disabled
number_14 = Number(dispatch_36.ListA)  # disabled
sort_list_15 = SortList(Keys=number_14, ValuesValuesA=dispatch_36.ListA)  # -> Keys, ValuesValuesA; disabled
number_slider_20 = Slider(0.2, range=0..1)  # disabled
list_item_35 = ListItem(List=sort_list_15.ValuesValuesA, Index=[0, 1], Wrap=True)  # -> simplify(Item); disabled
surface_closest_point_2 = SurfaceClosestPoint(Point=clean_tree_10, Surface=list_item_35)  # -> Point, UVPoint, Distance; disabled
path_mapper = PathMapper(shift_paths_28, source="{A}(i)", target="{A}(item_count - 1 - i)")  # disabled
duplicate_data_16 = DuplicateData(Data=clean_tree_10, Number=2, Order=True)  # -> simplify(Data); disabled
addition = Addition(A=number_slider_20, B=graft(path_mapper))  # disabled
smaller_than_16 = SmallerThan(FirstNumber=surface_closest_point_2.Distance, SecondNumber=addition)  # -> SmallerThan, OrEqualTo; disabled
dispatch_37 = Dispatch(List=duplicate_data_15, DispatchPattern=smaller_than_16.SmallerThan)  # -> ListA, ListB; disabled
dispatch_38 = Dispatch(List=duplicate_data_16, DispatchPattern=smaller_than_16.SmallerThan)  # -> ListA, ListB; disabled
dispatch_39 = Dispatch(List=list_item_35, DispatchPattern=smaller_than_16.SmallerThan)  # -> ListA, ListB; disabled
# points
clean_tree_12 = CleanTree(RemoveNulls=True, RemoveInvalid=True, RemoveEmpty=True, Tree=dispatch_38.ListA)  # disabled
# boxes
clean_tree_13 = CleanTree(RemoveNulls=True, RemoveInvalid=True, RemoveEmpty=True, Tree=dispatch_37.ListA)  # disabled
# faces
clean_tree_14 = CleanTree(RemoveNulls=True, RemoveInvalid=True, RemoveEmpty=True, Tree=dispatch_39.ListA)  # disabled
box_properties_6 = BoxProperties(Box=clean_tree_13)  # -> Center, Diagonal, Area, Volume, Degeneracy; disabled
point_groups_6 = PointGroups(Points=flatten(box_properties_6.Center), Distance=0.1)  # -> Groups, Indices; disabled
list_item_36 = ListItem(List=flatten(clean_tree_14), Index=point_groups_6.Indices, Wrap=True)  # -> simplify(graft(Item)); disabled
list_item_37 = ListItem(List=flatten(clean_tree_12), Index=point_groups_6.Indices, Wrap=True)  # -> simplify(graft(Item)); disabled
list_item_38 = ListItem(List=flatten(clean_tree_13), Index=point_groups_6.Indices, Wrap=True)  # -> simplify(graft(Item)); disabled
area_6 = Area(Geometry=list_item_36)  # -> Area, Centroid; disabled
geometry_9 = Geometry(list_item_38)  # disabled
shift_paths_29 = ShiftPaths(Data=list_item_38, Offset=-1)  # disabled
line_6 = Line(StartPoint=list_item_37, EndPoint=area_6.Centroid)  # disabled
list_item_39 = ListItem(List=shift_paths_29, Index=0, Wrap=True)  # disabled
scale_4 = Scale(Geometry=list_item_36, Center=area_6.Centroid, Factor=2)  # -> Geometry, Transform; disabled

reverse = Reverse(Vector=line_6)  # disabled
extend_curve = ExtendCurve(Curve=line_6, Type=0, Start=0, End=0.2)  # disabled
move_8 = Move(Geometry=scale_4.Geometry, Motion=reverse)  # -> Geometry, Transform; disabled

extrude_6 = Extrude(Base=move_8.Geometry, Direction=extend_curve)  # disabled
shift_paths_30 = ShiftPaths(Data=extrude_6, Offset=-1)  # disabled
solid_difference_2 = SolidDifference(BrepsA=list_item_39, BrepsB=shift_paths_30)  # disabled

shift_paths_31 = ShiftPaths(Data=list_item_37, Offset=-1)  # disabled
shift_paths_32 = ShiftPaths(Data=list_item_39, Offset=-1)  # disabled
shift_paths_33 = ShiftPaths(Data=extrude_6, Offset=-1)  # disabled
tree_branch_12 = TreeBranch(Tree=shift_paths_31, Path=number_slider_18, MaintainPaths=True)  # disabled
tree_branch_13 = TreeBranch(Tree=list_item_39, Path=number_slider_18, MaintainPaths=True)  # disabled

# ----
# extend walls vertically to match with floors/roofs
# upper boundary
# lower boundary
# Lowest face
# Highest face
roofs_4 = Geometry(roofs_2)  # disabled
floor_6 = Geometry(floor_2)  # disabled
merge_23 = Merge(Data1=floor_6, Data2=roofs_4)  # disabled
deconstruct_mesh_9 = DeconstructMesh(Mesh=merge_23)  # -> Vertices, Faces, Colours, Normals; disabled
partial_room_segments_2 = Geometry(merge_12)  # disabled
convex_hull_8 = ConvexHull(Points=deconstruct_mesh_9.Vertices, Plane=PlaneXY(0, 0, 0))  # -> Hull, simplify(HullZ), Indices; disabled
boundary_surfaces_6 = BoundarySurfaces(Edges=convex_hull_8.HullZ)  # -> flatten(Surfaces); disabled
number_slider_21 = Slider(-0.2, range=-1..1)  # disabled
number_slider_22 = Slider(3, range=0..10)  # disabled
number_slider_23 = Slider(3, range=0..10)  # disabled
number_slider_24 = Slider(-0.2, range=-1..1)  # disabled
deconstruct_box_11 = DeconstructBox(Box=partial_wall_objects_7)  # -> simplify(graft(Plane)), X, Y, Z; disabled

# ----
# Name
# material type ( thickness)
# hearthline
# height
text_2 = Text("mm")  # disabled
# Create IFCSTANDARDWALLS
text_3 = Text("Generic - ")  # disabled
ggrvt_material_2 = GgRvtMaterial(Name="Generic", Class=1)  # disabled
ggrvt_baketofile = GgRvtBaketoFile(Accurate=False, IFC4=True, Radians=True, RepMapExport="NONE")  # disabled

# ----
# Merge Trims and extensions
partial_wall_objects_8 = Geometry(flatten(merge_16))  # disabled
number_15 = Number(partial_wall_objects_8)  # disabled
number_16 = Number(flatten(list_item_34))  # disabled
number_17 = Number(flatten(list_item_39))  # disabled
member_index_9 = MemberIndex(Set=number_15, Member=number_16)  # -> flatten(Index), Count; disabled
member_index_10 = MemberIndex(Set=number_15, Member=number_17)  # -> flatten(Index), Count; disabled
create_set_5 = CreateSet(List=member_index_9.Index)  # -> Set, Map; disabled
# er klopt iets niet met volgorde
tree_statistics_2 = TreeStatistics(Tree=shift_paths_30)  # -> Paths, Length, Count; disabled
replace_items = ReplaceItems(List=partial_wall_objects_8, Item=flatten(bounding_box_10.Box), Indices=member_index_9.Index, Wrap=False)  # -> simplify(graft(List)); disabled
replace_paths = ReplacePaths(Data=shift_paths_30, Search=tree_statistics_2.Paths, Replace=member_index_10.Index)  # disabled

bounding_box_12 = BoundingBox(Content=replace_items, Plane=PlaneXY(0, 0, 0))  # -> Box, Box_2; disabled
tree_branch_14 = TreeBranch(Tree=simplify(graft(replace_items)), Path=number_slider_19, MaintainPaths=True)  # disabled
tree_branch_15 = TreeBranch(Tree=replace_paths, Path=number_slider_19, MaintainPaths=True)  # disabled
move_9 = Move(Geometry=bounding_box_12.Box, Motion=Vector(0, 0, 100))  # -> simplify(Geometry), Transform; disabled
merge_24 = Merge(Data1=replace_paths, Data2=move_9.Geometry)  # disabled

solid_difference_3 = SolidDifference(BrepsA=replace_items, BrepsB=merge_24)  # disabled

extendet_trimmed_walls = Geometry(solid_difference_3)  # disabled
deconstruct_brep_5 = DeconstructBrep(Brep=extendet_trimmed_walls)  # -> Faces, Edges, Vertices; disabled
deconstruct_brep_6 = DeconstructBrep(Brep=extendet_trimmed_walls)  # -> simplify(Faces), Edges, Vertices; disabled
area_7 = Area(Geometry=deconstruct_brep_5.Faces)  # -> Area, Centroid; disabled
mesh_area_15 = MeshArea(Mesh=deconstruct_brep_6.Faces)  # -> Area, Centroid; disabled
deconstruct_14 = Deconstruct(Point=area_7.Centroid)  # -> XComponent, YComponent, ZComponent; disabled
deconstruct_15 = Deconstruct(Point=mesh_area_15.Centroid)  # -> XComponent, YComponent, ZComponent; disabled
sort_list_16 = SortList(
    Keys=deconstruct_14.ZComponent,
    ValuesHigh=area_7.Centroid,
    ValuesLow=deconstruct_14.ZComponent,
    ValuesLow_2=area_7.Centroid)  # -> reverse(Keys), reverse(ValuesHigh), ValuesLow, ValuesLow_2; disabled
list_item_40 = ListItem(List=sort_list_16.ValuesHigh, Index=0, Wrap=True)  # -> simplify(Item); disabled
list_item_41 = ListItem(List=sort_list_16.ValuesLow_2, Index=0, Wrap=True)  # -> simplify(Item); disabled
surface_closest_point_3 = SurfaceClosestPoint(Point=list_item_40, Surface=boundary_surfaces_6)  # -> Point, UVPoint, Distance; disabled
surface_closest_point_4 = SurfaceClosestPoint(Point=list_item_41, Surface=boundary_surfaces_6)  # -> Point, UVPoint, Distance; disabled
deconstruct_16 = Deconstruct(Point=surface_closest_point_3.Point)  # -> XComponent, YComponent, ZComponent; disabled
deconstruct_17 = Deconstruct(Point=surface_closest_point_4.Point)  # -> XComponent, YComponent, ZComponent; disabled
list_item_42 = ListItem(List=sort_list_16.ValuesLow, Index=0, Wrap=True)  # -> simplify(Item); disabled
list_item_43 = ListItem(List=sort_list_16.Keys, Index=0, Wrap=True)  # -> simplify(Item); disabled
sort_list_17 = SortList(Keys=deconstruct_15.ZComponent, ValuesA=deconstruct_brep_6.Faces, ValuesB=deconstruct_brep_6.Faces)  # -> Keys, ValuesA, reverse(ValuesB); disabled
subtraction_8 = Subtraction(A=deconstruct_16.ZComponent, B=list_item_43)  # disabled
subtraction_9 = Subtraction(A=list_item_42, B=deconstruct_17.ZComponent)  # disabled
larger_than_10 = LargerThan(FirstNumber=subtraction_8, SecondNumber=number_slider_21)  # -> LargerThan, OrEqualTo; disabled
smaller_than_17 = SmallerThan(FirstNumber=surface_closest_point_3.Distance, SecondNumber=number_slider_22)  # -> SmallerThan, OrEqualTo; disabled
smaller_than_18 = SmallerThan(FirstNumber=surface_closest_point_4.Distance, SecondNumber=number_slider_23)  # -> SmallerThan, OrEqualTo; disabled
larger_than_11 = LargerThan(FirstNumber=subtraction_9, SecondNumber=number_slider_24)  # -> LargerThan, OrEqualTo; disabled
list_item_44 = ListItem(List=sort_list_17.ValuesA, Index=0, Wrap=True)  # disabled
list_item_45 = ListItem(List=sort_list_17.ValuesB, Index=0, Wrap=True)  # disabled
area_8 = Area(Geometry=list_item_44)  # -> Area, Centroid; disabled
area_9 = Area(Geometry=list_item_45)  # -> Area, Centroid; disabled
deconstruct_18 = Deconstruct(Point=area_8.Centroid)  # -> XComponent, YComponent, ZComponent; disabled
deconstruct_19 = Deconstruct(Point=area_9.Centroid)  # -> XComponent, YComponent, ZComponent; disabled
gate_and_6 = GateAnd(A=larger_than_10.LargerThan, B=smaller_than_17.SmallerThan)  # disabled
gate_and_7 = GateAnd(A=larger_than_11.LargerThan, B=smaller_than_18.SmallerThan)  # disabled
dispatch_40 = Dispatch(List=surface_closest_point_3.Point, DispatchPattern=gate_and_6)  # -> ListA, ListB; disabled
dispatch_41 = Dispatch(List=surface_closest_point_4.Point, DispatchPattern=gate_and_7)  # -> ListA, ListB; disabled
deconstruct_20 = Deconstruct(Point=dispatch_40.ListA)  # -> XComponent, YComponent, ZComponent; disabled
deconstruct_21 = Deconstruct(Point=dispatch_41.ListA)  # -> XComponent, YComponent, ZComponent; disabled
sort_list_18 = SortList(Keys=deconstruct_20.ZComponent, ValuesValuesA=dispatch_40.ListA)  # -> reverse(Keys), reverse(ValuesValuesA); disabled
sort_list_19 = SortList(Keys=deconstruct_21.ZComponent, ValuesValuesA=dispatch_41.ListA)  # -> Keys, ValuesValuesA; disabled
list_item_46 = ListItem(List=sort_list_19.ValuesValuesA, Index=0, Wrap=True)  # disabled
deconstruct_22 = Deconstruct(Point=list_item_46)  # -> XComponent, YComponent, ZComponent; disabled
construct_point_11 = ConstructPoint(XCoordinate=deconstruct_18.XComponent, YCoordinate=deconstruct_18.YComponent, ZCoordinate=deconstruct_22.ZComponent)  # disabled
line_7 = Line(StartPoint=area_8.Centroid, EndPoint=construct_point_11)  # disabled
move_10 = Move(Geometry=list_item_44, Motion=line_7)  # -> Geometry, Transform; disabled
list_item_47 = ListItem(List=sort_list_18.ValuesValuesA, Index=0, Wrap=True)  # disabled
deconstruct_23 = Deconstruct(Point=list_item_47)  # -> XComponent, YComponent, ZComponent; disabled
construct_point_12 = ConstructPoint(XCoordinate=deconstruct_19.XComponent, YCoordinate=deconstruct_19.YComponent, ZCoordinate=deconstruct_23.ZComponent)  # disabled
line_8 = Line(StartPoint=area_9.Centroid, EndPoint=construct_point_12)  # disabled
move_11 = Move(Geometry=list_item_45, Motion=line_8)  # -> Geometry, Transform; disabled
merge_25 = Merge(Data1=simplify(graft(extendet_trimmed_walls)), Data2=move_10.Geometry, Data3=move_11.Geometry)  # disabled
bounding_box_13 = BoundingBox(Content=merge_25, Plane=deconstruct_box_11.Plane, UnionBox=True)  # -> Final_Walls, Box; disabled

final_walls = Geometry(flatten(bounding_box_13.Final_Walls))  # disabled
deconstruct_brep_7 = DeconstructBrep(Brep=final_walls)  # -> simplify(Faces), Edges, Vertices; disabled
list_length_20 = ListLength(List=flatten(final_walls))  # disabled
mesh_area_16 = MeshArea(Mesh=deconstruct_brep_7.Faces)  # -> Area, Centroid; disabled
duplicate_data_17 = DuplicateData(Data=text_3, Number=list_length_20, Order=True)  # -> simplify(graft(Data)); disabled
duplicate_data_18 = DuplicateData(Data=text_2, Number=list_length_20, Order=True)  # -> simplify(graft(Data)); disabled
end_points = EndPoints(Curve=deconstruct_brep_7.Edges)  # -> Start, End; disabled
deconstruct_24 = Deconstruct(Point=mesh_area_16.Centroid)  # -> XComponent, YComponent, ZComponent; disabled
vector_2pt_2 = Vector2Pt(PointA=end_points.Start, PointB=end_points.End, Unitize=False)  # -> Vector, Length; disabled
sort_list_20 = SortList(Keys=deconstruct_24.ZComponent, ValuesA=deconstruct_brep_7.Faces, ValuesB=deconstruct_brep_7.Faces)  # -> Keys, ValuesA, ValuesB; disabled
deconstruct_25 = Deconstruct(Point=vector_2pt_2.Vector)  # -> XComponent, YComponent, expr("abs(x)", ZComponent); disabled
list_item_48 = ListItem(List=sort_list_20.ValuesB, Index=0, Wrap=True)  # disabled
brep_edges = BrepEdges(Brep=list_item_48)  # -> Naked, Interior, NonManifold; disabled
length = Length(Curve=brep_edges.Naked)  # disabled
sort_list_21 = SortList(Keys=length, ValuesValuesA=brep_edges.Naked)  # -> Keys, ValuesValuesA; disabled
list_item_49 = ListItem(List=sort_list_21.Keys, Index=0, Wrap=True)  # disabled
number_18 = Number(expr("abs(round(x,2))", simplify(list_item_49)))  # disabled
number_19 = Number(expr("1000*x", number_18))  # disabled
integer_2 = Integer(number_19)  # disabled
concatenate = Concatenate(FragmentA=duplicate_data_17, FragmentB=integer_2)  # disabled
ggrvt_materiallayer_2 = GgRvtMaterialLayer(RvtMaterial=ggrvt_material_2, Thickness=number_18, Function=0, Wraps=True, Structural=True, Variable=False)  # disabled
concatenate_2 = Concatenate(FragmentA=concatenate, FragmentB=duplicate_data_18)  # disabled
sort_list_22 = SortList(Keys=deconstruct_25.ZComponent, ValuesValuesA=vector_2pt_2.Vector)  # -> Keys, reverse(ValuesValuesA); disabled
ggrvt_walltype = GgRvtWallType(Name=concatenate_2, LayersCore=ggrvt_materiallayer_2, Interior=True, ggIFC_ggIds="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")  # disabled
list_item_50 = ListItem(List=sort_list_22.ValuesValuesA, Index=0, Wrap=True)  # disabled
divide_curve = DivideCurve(Curve=brep_edges.Naked, Count=10, Kinks=False)  # -> simplify(Points), Tangents, Parameters; disabled
deconstruct_26 = Deconstruct(Point=list_item_50)  # -> XComponent, YComponent, expr("abs(x)", simplify(ZComponent)); disabled
shift_paths_34 = ShiftPaths(Data=divide_curve.Points, Offset=-1)  # disabled
fit_line = FitLine(Points=shift_paths_34)  # disabled
number_20 = Number(expr("0.5*x", number_18))  # disabled
ggrvt_wall = GgRvtWall(
    RvtWallType=ggrvt_walltype,
    Offset=number_20,
    PositiveDirection=False,
    PathOrPerimeter=fit_line,
    WallHeight=deconstruct_26.ZComponent,
    ggIFC_ggIds="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")  # disabled

bounding_box_14 = BoundingBox(Content=flatten(bounding_box_13.Final_Walls), Plane=PlaneXY(0, 0, 0), UnionBox=True)  # -> Box, Box_2; disabled
ggifc_guid = GgIFCGUID(Number=bounding_box_13.Final_Walls)  # disabled
list_item_51 = ListItem(List=ggifc_guid, Index=0, Wrap=True)  # disabled
ggifc_advanced_brep = GgIFCAdvancedBrep(Brep=bounding_box_14.Box)  # disabled
ggifc_materiallayer = GgIFCMaterialLayer(IFCMaterial=ggifc_material, Thickness=number_18, Ventilated=False, Priority=0)  # disabled
ggifc_materiallayerset = GgIFCMaterialLayerSet(IfcMaterialLayers=ggifc_materiallayer)  # -> IfcMaterialLayerSet, Thickness; disabled
ggifc_faceted_brep = GgIFCFacetedBrep(Brep=bounding_box_13.Final_Walls, FacetTolerance=0.025)  # disabled
ggifc_building = GgIFCBuilding(
    Name="Grasshopper Building",
    Desc="GH Building",
    IFCRepItem=ggifc_advanced_brep,
    LongName="GH Building",
    BuildingComposition="ELEMENT",
    ggIFC_ggIds="d6616d13-e279-4c43-89db-7c76ef106a9a;1FBOANFKX8DgVQlWggsUeO")  # disabled
ggifc_wall_type = GgIFCWallType(
    PredefinedType=10,
    IfcMaterialLayer=ggifc_materiallayer,
    ggIFC_ggIds="cabd58d0-3b7b-45ec-9ae1-da6e1db48f25;0VBGjD55L7Cvy4caZrKAhM;0v3EukudjBmgd9boOV3Jlz;3RBk2$mnn6UPEh1eGJolSN;2gaJeB4zTF0BRvHozKRwlT;2jWiiHwTXD9uWsRopgFTkL;11tb139dvAGgZgh25vkgOw;0UivEcvNT6SAj58zKrGyvG;2uGJn1C7r2iwiX$3AlD0vc;3f6caD2BvBSghO2io30ZVu;19B3CfDWD5efRNTpQWTMEs;3ej0b$rkLFbQeGO$2wCvIw")  # disabled
ggifc_wall = GgIFCWall(IfcRepItem=bounding_box_13.Final_Walls, IfcWallType=ggrvt_walltype)  # disabled
tree_branch_16 = TreeBranch(Tree=solid_difference_3, Path=number_slider_19, MaintainPaths=True)  # disabled
ggifc_project = GgIFCProject(
    RootSiteBuilding=ggifc_building,
    Name="Grasshopper Project",
    WorldCoordinates=PlaneXY(0, 0, 0),
    ggIFC_ggIds="572496b8-3989-4418-8d2e-944bfd191eec;11lH7qq0L6UQ$BFSVE7tVX")  # disabled
ggifc_wall_standard_case = GgIFCWallStandardCase(
    IFCContainer=ggifc_building,
    IfcWallType=ggifc_wall_type,
    Offset=number_20,
    PositiveDirection=False,
    PathOrPerimeter=fit_line,
    WallHeight=deconstruct_26.ZComponent,
    ggIFC_ggIds="b014dc54-4cfd-4f59-9a31-d712d20d8096;2HEJxg8In9dwAl0w11YCaX;2F9SvlO9v9WxvqcTz2mJJu;3OfXyirbzB5uZPjDLctwlk;38MstZehz19hGkp2b7TxkO;2Ur32YU6LCxgFuiTd6sdFP;16PnIAI$b1Q8D1NrcG8X6Z;27aZe867rANRYhmV5_lMcq;1l_P_PEZv0jBOGXjP5P0Ft;24ceJeu695VOhVfJWnifKn;2WRtJmvBP4N8dMYJih_Vc5;3EmVJuhOT83OMQ4LgR$Uxl")  # disabled
ggifc_wall_2 = GgIFCWall(
    IFCContainer=ggifc_building,
    IfcRepItem=ggifc_advanced_brep,
    ggIFC_ggIds="45982323-2330-43e5-8c45-ff8a484e58d4;3adzos4IzBSuV6RFgVzBcS;1z7_glrbXAde1333YKM4J5;2tZWWnEO9BIhk6dy1xe8ny;2CLTFkHlLEyOO6Fl0YygCU;2B1oBlTgv4_geWoUdxHqmk;3nsyl8AnLCKPTH_h6dU7OZ;3JvD6wpB91vwM18Ta4hRiA;2hqwl6BMjDGuxNv3iCHLxt;2aJ7iptC54yPFu3Id6RCdp;0Qd9dIPKX8Su_Kb6LSMlwx;0K$BtiXdH9_Aqz1vBf5rRa")  # disabled
panel_4 = Panel(ggrvt_walltype)  # disabled
ifc_wall = IFCWall(ggifc_wall_standard_case)  # disabled
panel_5 = Panel(ggifc_wall_2)  # disabled
panel_6 = Panel(list_item_49)  # disabled
