# Grasshopper definition reconstruction_space1.gh (Grasshopper 0.9.76)
# plug-ins: MeshEdit Components

ceiling = Geometry([<mesh referenced from the Rhino model> x24])
floor = Geometry([<mesh referenced from the Rhino model> x14])
merge = Merge(Data1=ceiling, Data2=floor)
# 1.Represent walls and slabs as a single plane
walls = Geometry([<mesh referenced from the Rhino model> x257])
merge_2 = Merge(Data1=walls, Data2=merge)

# ----
# merge Ceilings>2m
entwine = Entwine(Branch00=ceiling, FlattenInputs=True)  # -> flatten(Result)
face_normals = FaceNormals(Mesh=entwine)  # -> Centers, Normals
# create 2D graph floors and ceilings above
average = Average(Input=face_normals.Normals)  # -> flatten(ArithmeticMean)
average_2 = Average(Input=face_normals.Centers)  # -> flatten(ArithmeticMean)
deconstruct = Deconstruct(Point=average_2)  # -> XComponent, YComponent, ZComponent
construct_point = ConstructPoint(XCoordinate=0, YCoordinate=0, ZCoordinate=deconstruct.ZComponent)
point_groups = PointGroups(Points=construct_point, Distance=Slider(2, range=0..10))  # -> Groups, Indices
list_item = ListItem(List=entwine, Index=point_groups.Indices, Wrap=True)  # -> simplify(Item)

# ----
# merge Floors >2m
entwine_2 = Entwine(Branch00=floor, FlattenInputs=True)  # -> flatten(Result)
face_normals_2 = FaceNormals(Mesh=entwine_2)  # -> Centers, Normals
average_3 = Average(Input=face_normals_2.Normals)  # -> flatten(ArithmeticMean)
average_4 = Average(Input=face_normals_2.Centers)  # -> flatten(ArithmeticMean)
deconstruct_2 = Deconstruct(Point=average_4)  # -> XComponent, YComponent, ZComponent
construct_point_2 = ConstructPoint(XCoordinate=0, YCoordinate=0, ZCoordinate=deconstruct_2.ZComponent)
point_groups_2 = PointGroups(Points=construct_point_2, Distance=Slider(2, range=0..10))  # -> Groups, Indices
list_item_2 = ListItem(List=entwine_2, Index=point_groups_2.Indices, Wrap=True)  # -> simplify(Item)

# ----
# Space Building 1
# Find Wall Candidates
# dot(normals) >0.85
# Compute bounding boxes
# Centroid vectors < 1m
# vector length < 2m + srqt(A)
face_normals_3 = FaceNormals(Mesh=walls)  # -> Centers, Normals
average_5 = Average(Input=face_normals_3.Centers)  # -> flatten(ArithmeticMean)
list_item_3 = ListItem(List=face_normals_3.Normals, Index=0, Wrap=True)
list_length = ListLength(List=average_5)
cross_reference = CrossReference(ListListA=average_5, ListListB=average_5, CrossMode=1)  # -> ListListA, ListListB
shift_paths = ShiftPaths(Data=list_item_3, Offset=-1)  # -> flatten(NormalVector)
vector_2pt = Vector2Pt(PointA=cross_reference.ListListA, PointB=cross_reference.ListListB, Unitize=False)  # -> CentroidVector, Length
cross_reference_2 = CrossReference(ListListA=shift_paths, ListListB=shift_paths, CrossMode=1)  # -> ListListA, ListListB
duplicate_data = DuplicateData(Data=shift_paths, Number=list_length, Order=True)
number = Number(expr("sqrt(x)+2", walls))
# 2.Intersect surf with 4 neirest orthogonal surf
dot_product = DotProduct(VectorA=cross_reference_2.ListListA, VectorB=cross_reference_2.ListListB, Unitize=False)  # -> expr("abs(x)", DotProduct)
dot_product_2 = DotProduct(VectorA=duplicate_data, VectorB=vector_2pt.CentroidVector, Unitize=False)  # -> expr("abs(x)", DotProduct)
vector_length = VectorLength(Vector=vector_2pt.CentroidVector)
duplicate_data_2 = DuplicateData(Data=number, Number=list_length, Order=True)
smaller_than = SmallerThan(FirstNumber=vector_length, SecondNumber=duplicate_data_2)  # -> SmallerThan, OrEqualTo
larger_than = LargerThan(FirstNumber=dot_product, SecondNumber=Slider(0.8, range=0..1))  # -> LargerThan, OrEqualTo
smaller_than_2 = SmallerThan(FirstNumber=dot_product_2, SecondNumber=Slider(1, range=0..1))  # -> SmallerThan, OrEqualTo
series = Series(Start=list_length, Step=0, Count=list_length)
gate_and = GateAnd(A=larger_than.LargerThan, B=smaller_than_2.SmallerThan, C=smaller_than.SmallerThan)
duplicate_data_3 = DuplicateData(Data=walls, Number=list_length, Order=True)
partition_list = PartitionList(List=gate_and, Size=series)  # -> simplify(Chunks)
partition_list_2 = PartitionList(List=duplicate_data_3, Size=series)  # -> simplify(Chunks)
cull_pattern = CullPattern(List=partition_list_2, CullPattern=partition_list)
face_normals_4 = FaceNormals(Mesh=cull_pattern)  # -> Centers, Normals
shift_paths_2 = ShiftPaths(Data=face_normals_4.Normals, Offset=-1)
average_6 = Average(Input=shift_paths_2)
plane_normal = PlaneNormal(Origin=Point(0, 0, 0), ZAxis=average_6)
bounding_box = BoundingBox(Content=cull_pattern, Plane=plane_normal, UnionBox=True)  # -> Box, Box_2
box_properties = BoxProperties(Box=bounding_box.Box)  # -> Center, Diagonal, Area, Volume, Degeneracy
scale = Scale(Geometry=bounding_box.Box, Center=box_properties.Center, Factor=1.1)  # -> flatten(Geometry), Transform

geometry = Geometry()  # disabled
face_normals_5 = FaceNormals()  # -> Centers, Normals
list_length_2 = ListLength(List=face_normals_5.Centers)
# 2b.if surface overextends one of 4 neighbours, divide it and let it search again
# a) compute normals
face_normals_6 = FaceNormals()  # -> Centers, Normals
face_normals_7 = FaceNormals()  # -> Centers, Normals
# a) find orthonogal neighbours
average_7 = Average(Input=face_normals_6.Centers)
closest_points = ClosestPoints(Point=average_7, Cloud=face_normals_7.Centers, Count=4)  # -> simplify(ClosestPoint), CPIndex, Distance

# ----
# merge above ceilings with floors
# based on first collision with extrusion
# create Brep extrusion of floors
# test for ceiling inliers (keep ceilings with majority inliers)
# test if ceiling can connect to floor unobstructed (given 0.2r)
# non-colliding meshes
list_length_3 = ListLength(List=face_normals.Centers)  # -> flatten(Length)
deconstruct_mesh = DeconstructMesh(Mesh=entwine_2)  # -> Vertices, Faces, Colours, Normals
face_normals_8 = FaceNormals(Mesh=entwine_2)  # -> Centers, Normals
convex_hull = ConvexHull(Points=deconstruct_mesh.Vertices, Plane=PlaneXY(0, 0, 0))  # -> Hull, HullZ, Indices
average_8 = Average(Input=face_normals_8.Centers)  # -> simplify(ArithmeticMean)
extrude = Extrude(Base=convex_hull.HullZ, Direction=Vector(0, 0, 20))
deconstruct_3 = Deconstruct(Point=average_8)  # -> XComponent, YComponent, expr("x+0.5", ZComponent)
cap_holes = CapHoles(Brep=extrude)  # -> simplify(Brep)
list_length_4 = ListLength(List=cap_holes)
duplicate_data_4 = DuplicateData(Data=list_length_3, Number=list_length_4, Order=True)  # -> simplify(Data)
duplicate_data_5 = DuplicateData(Data=entwine, Number=list_length_4, Order=True)  # -> simplify(Data)
point_in_brep = PointInBrep(Brep=cap_holes, Point=flatten(face_normals.Centers), Strict=False)
partition_list_3 = PartitionList(List=point_in_brep, Size=duplicate_data_4)
create_set = CreateSet(List=partition_list_3)  # -> Set, Map
member_index = MemberIndex(Set=partition_list_3, Member=create_set.Set)  # -> Index, Count
sort_list = SortList(Keys=member_index.Count, ValuesValuesA=create_set.Set)  # -> reverse(Keys), reverse(ValuesValuesA)
list_item_4 = ListItem(List=sort_list.ValuesValuesA, Index=0, Wrap=True)
shift_paths_3 = ShiftPaths(Data=list_item_4, Offset=-1)
dispatch = Dispatch(List=duplicate_data_5, DispatchPattern=shift_paths_3)  # -> ListA, ListB
construct_point_3 = ConstructPoint(XCoordinate=deconstruct_3.XComponent, YCoordinate=deconstruct_3.YComponent, ZCoordinate=deconstruct_3.ZComponent)
geometry_2 = Geometry(dispatch.ListA)
face_normals_9 = FaceNormals(Mesh=geometry_2)  # -> Centers, Normals
average_9 = Average(Input=face_normals_9.Centers)  # -> simplify(ArithmeticMean)
shift_paths_4 = ShiftPaths(Data=average_9, Offset=-1)
deconstruct_4 = Deconstruct(Point=shift_paths_4)  # -> XComponent, YComponent, expr("x-0.5", ZComponent)
construct_point_4 = ConstructPoint(XCoordinate=deconstruct_4.XComponent, YCoordinate=deconstruct_4.YComponent, ZCoordinate=deconstruct_4.ZComponent)
line = Line(StartPoint=construct_point_4, EndPoint=construct_point_3)
pipe = Pipe(Curve=line, Radius=0.2, Caps=0)  # -> simplify(Pipe)
collision_one_many = CollisionOneMany(Collider=pipe, Obstacles=entwine)  # -> Collision, Index
shift_paths_5 = ShiftPaths(Data=collision_one_many.Collision, Offset=-1)
dispatch_2 = Dispatch(List=geometry_2, DispatchPattern=shift_paths_5)  # -> ListA, ListB
geometry_3 = Geometry(dispatch_2.ListB)

list_item_5 = ListItem(List=face_normals_6.Normals, Index=0, Wrap=True)

# ----
# Project ceilings on floor plane
geometry_4 = Geometry(simplify(graft(entwine_2)))
geometry_5 = Geometry(dispatch_2.ListB)
# merge overlapping meshes
face_normals_10 = FaceNormals(Mesh=geometry_4)  # -> Centers, Normals
plane_fit = PlaneFit(Points=face_normals_10.Centers)  # -> simplify(Plane), Deviation
project = Project(Geometry=geometry_3, Plane=plane_fit.Plane)  # -> Geometry, Transform
merge_3 = Merge(Data1=project.Geometry, Data2=geometry_4)

closest_points_2 = ClosestPoints(Point=face_normals_5.Centers, Cloud=flatten(face_normals_5.Centers), Count=10)  # -> ClosestPoint, CPIndex, Distance
list_item_6 = ListItem(List=face_normals_7.Normals, Index=0, Wrap=True)
shift_paths_6 = ShiftPaths(Data=list_item_5, Offset=-1)
shift_paths_7 = ShiftPaths(Data=list_item_6, Offset=-1)
tree_branch = TreeBranch(Tree=cull_pattern, Path=Slider(3, range=0..100), MaintainPaths=True)

# ----
# Filter bounding boxes
# BB (Z) >2m
# bounding boxes
# representing walls
# BB (Area) >2m²
deconstruct_vector = DeconstructVector(Vector=box_properties.Diagonal)  # -> XComponent, YComponent, expr("abs(x)", ZComponent)
larger_than_2 = LargerThan(FirstNumber=box_properties.Volume, SecondNumber=Slider(2, range=0..10))  # -> LargerThan, OrEqualTo
larger_than_3 = LargerThan(FirstNumber=deconstruct_vector.ZComponent, SecondNumber=Slider(2, range=0..10))  # -> LargerThan, OrEqualTo
gate_and_2 = GateAnd(A=larger_than_3.LargerThan, B=larger_than_2.LargerThan)  # -> flatten(Result)
dispatch_3 = Dispatch(List=flatten(box_properties.Center), DispatchPattern=gate_and_2)  # -> ListA, ListB
dispatch_4 = Dispatch(List=scale.Geometry, DispatchPattern=gate_and_2)  # -> ListA, ListB
number_2 = Number(dispatch_4.ListA)
sort_list_2 = SortList(Keys=number_2, ValuesValuesA=dispatch_4.ListA, ValuesA=dispatch_3.ListA)  # -> Keys, reverse(ValuesValuesA), reverse(ValuesA)
list_length_5 = ListLength(List=sort_list_2.Keys)
series_2 = Series(Start=0, Step=1, Count=list_length_5)
point_in_breps = PointInBreps(Brep=graft(sort_list_2.ValuesValuesA), Point=sort_list_2.ValuesA, Strict=False)  # -> Inside, Index
cull_pattern_2 = CullPattern(List=series_2, CullPattern=point_in_breps.Inside)
list_item_7 = ListItem(List=cull_pattern_2, Index=0, Wrap=True)  # -> flatten(Item)
create_set_2 = CreateSet(List=list_item_7)  # -> Set, Map
list_item_8 = ListItem(List=flatten(sort_list_2.ValuesValuesA), Index=create_set_2.Set, Wrap=True)

# ----
# Trim Floor/ceiling meshes with wall boxes
floor_ceiling_meshes = Geometry(merge_3)
wall_boxes = Geometry(list_item_8)
deconstruct_mesh_2 = DeconstructMesh(Mesh=floor_ceiling_meshes)  # -> Vertices, Faces, Colours, Normals
shift_paths_8 = ShiftPaths(Data=deconstruct_mesh_2.Vertices, Offset=-1)
convex_hull_2 = ConvexHull(Points=shift_paths_8, Plane=PlaneXY(0, 0, 0))  # -> Hull, flatten(HullZ), Indices
trim_solid = TrimSolid(Shape=convex_hull_2.HullZ, Cutters=wall_boxes)  # -> flatten(Result)
area = Area(Geometry=trim_solid)  # -> Area, Centroid
larger_than_4 = LargerThan(FirstNumber=area.Area, SecondNumber=Slider(2, range=0..10))  # -> LargerThan, OrEqualTo
dispatch_5 = Dispatch(List=trim_solid, DispatchPattern=larger_than_4.LargerThan)  # -> ListA, ListB
geometry_6 = Geometry(dispatch_5.ListA)

geometry_7 = Geometry(convex_hull_2.HullZ)
# create graph of ceiling/floor meshes
mesh_area = MeshArea(Mesh=geometry_7)  # -> Area, Centroid
closest_points_3 = ClosestPoints(Point=mesh_area.Centroid, Cloud=mesh_area.Centroid, Count=10)  # -> ClosestPoint, CPIndex, Distance
list_item_9 = ListItem(List=sort_list_2.ValuesValuesA, Index=Slider(32, range=0..100), Wrap=True)
# Distance boudanries < 2m
list_item_10 = ListItem(List=geometry_7, Index=closest_points_3.CPIndex, Wrap=True)  # -> simplify(Item)
curve_proximity = CurveProximity(CurveA=simplify(graft(geometry_7)), CurveB=list_item_10)  # -> PointA, PointB, Distance
# vertical distance < 1.5m
subtraction = Subtraction(A=curve_proximity.PointA, B=curve_proximity.PointB)
# wall intersection =0
line_2 = Line(StartPoint=curve_proximity.PointA, EndPoint=curve_proximity.PointB)
deconstruct_vector_2 = DeconstructVector(Vector=subtraction)  # -> XComponent, YComponent, expr("abs(x)", ZComponent)
smaller_than_3 = SmallerThan(FirstNumber=deconstruct_vector_2.ZComponent, SecondNumber=Slider(1.5, range=0..10))  # -> SmallerThan, OrEqualTo
geometry_8 = Geometry(list_item_8)
dispatch_6 = Dispatch(List=area.Centroid, DispatchPattern=larger_than_4.LargerThan)  # -> ListA, ListB

# ----
# sort meshes per storey
deconstruct_5 = Deconstruct(Point=dispatch_6.ListA)  # -> XComponent, YComponent, ZComponent
construct_point_5 = ConstructPoint(XCoordinate=0, YCoordinate=0, ZCoordinate=deconstruct_5.ZComponent)
point_groups_3 = PointGroups(Points=construct_point_5, Distance=Slider(2, range=0..10))  # -> Groups, Indices
list_item_11 = ListItem(List=geometry_6, Index=point_groups_3.Indices, Wrap=True)  # -> simplify(Item)
