# Grasshopper definition reconstruction_walls3.gh (Grasshopper 0.9.76)
# plug-ins: MeshEdit Components

n_block_segmented_walls_per_level_correc = Geometry([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])  # "N-block segmented walls per level correct"

# ----
# start data
segmented_walls_per_level_per_wall = Geometry(Tree({1;0}: [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], {1;1}: [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], {1;2}: [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], {1;3}: [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], {1;4}: [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], {1;5}: [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]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))
elevation_heights = Point(Tree({0}: [Point(0, 0, 0)], {1}: [Point(0, 0, 4.886337113)], {2}: [Point(0, 0, 8.423327244)], {3}: [Point(0, 0, 11.73485373)]))
floor = Surface(Tree({0}: [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], {1}: [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], {2}: [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], {3}: [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]))

wall_per_level = Geometry(Tree({0}: [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], {1}: [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], {2}: [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], {3}: [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]))
walls = Surface(Tree({0}: [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], {1}: [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], {2}: [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], {3}: [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], {4}: [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], {5}: [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]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))

# ----
# Input
boolean_toggle = BooleanToggle(True)
floors = Geometry([<mesh referenced from the Rhino model> x8])
walls_2 = Geometry([<mesh referenced from the Rhino model> x627])
stream_filter = StreamFilter(Gate=boolean_toggle, Stream1=walls_2)
stream_filter_2 = StreamFilter(Gate=boolean_toggle, Stream1=floors)

walls_final = Geometry()

# ----
# 1. split by normal
# find potential surface partners
# 1. split by coplanarity
# 1. split by proximity
# 1. split by extrusion (parrallel)
geometry = Geometry(flatten([<brep referenced from the Rhino model> x109]))
brep_edges = BrepEdges(Brep=geometry)  # -> Naked, Interior, NonManifold
evaluate_surface = EvaluateSurface(Surface=reparameterize(geometry), Point=Point(0.5, 0.5, 0))  # -> Point, expr("abs(x)", Normal), Frame
bounding_box = BoundingBox(Content=graft(geometry), Plane=graft(evaluate_surface.Frame))  # -> flatten(Box), Box_2
surface_closest_point = SurfaceClosestPoint(Point=simplify(graft(evaluate_surface.Point)), Surface=simplify(geometry))  # -> Point, UVPoint, Distance
join_curves = JoinCurves(Curves=brep_edges.Naked, Preserve=False)
deconstruct_brep = DeconstructBrep(Brep=bounding_box.Box)  # -> Faces, Edges, Vertices
angle = Angle(VectorA=graft(evaluate_surface.Normal), VectorB=evaluate_surface.Normal)  # -> Angle, Reflex
smaller_than = SmallerThan(FirstNumber=surface_closest_point.Distance, SecondNumber=Slider(0.25, range=0..2))  # -> simplify(SmallerThan), OrEqualTo
number = Number(deconstruct_brep.Faces)
length = Length(Curve=join_curves)
sort_list = SortList(Keys=number, ValuesValuesA=deconstruct_brep.Faces)  # -> Keys, reverse(ValuesValuesA)
smaller_than_2 = SmallerThan(FirstNumber=angle.Angle, SecondNumber=Slider(0.3, range=0..1))  # -> simplify(SmallerThan), OrEqualTo
sort_list_2 = SortList(Keys=length, ValuesValuesA=join_curves)  # -> reverse(Keys), reverse(ValuesValuesA)
list_item = ListItem(List=sort_list.ValuesValuesA, Index=0, Wrap=True)  # -> flatten(Item)
# idee: extrusion in relatie tot hoogte wall! er moet op verschillende schaal gewerkt worden!!!
# idee predictors: gebruik de aanwezigheid van clutter als feature
extrude = Extrude(Base=list_item, Direction=expr("x*2", evaluate_surface.Normal))
move = Move(Geometry=extrude, Motion=expr("-x", evaluate_surface.Normal))  # -> Geometry, Transform
point_in_breps = PointInBreps(Brep=graft(move.Geometry), Point=evaluate_surface.Point, Strict=False)  # -> simplify(Inside), Index
list_item_2 = ListItem(List=join_curves, Index=0, Wrap=True)  # -> simplify(Item)
curve_proximity = CurveProximity(CurveA=list_item_2, CurveB=flatten(list_item_2))  # -> PointA, PointB, Distance
smaller_than_3 = SmallerThan(FirstNumber=curve_proximity.Distance, SecondNumber=Slider(1, range=0..5))  # -> SmallerThan, OrEqualTo
gate_majority = GateMajority(A=smaller_than.SmallerThan, B=smaller_than_3.SmallerThan, C=point_in_breps.Inside)
gate_and = GateAnd(A=smaller_than_2.SmallerThan, B=gate_majority)
dispatch = Dispatch(List=geometry, DispatchPattern=gate_and)  # -> ListA, ListB
clean_tree = CleanTree(RemoveNulls=True, RemoveInvalid=True, RemoveEmpty=True, Tree=dispatch.ListA)

# ----
# Delete to small segments
number_2 = Number(walls_final)
larger_than = LargerThan(FirstNumber=number_2, SecondNumber=Slider(0.4, range=0..1))  # -> LargerThan, OrEqualTo
dispatch_2 = Dispatch(List=walls_final, DispatchPattern=larger_than.LargerThan)  # -> ListA, ListB
geometry_2 = Geometry(dispatch_2.ListB)

stream_filter_3 = StreamFilter(Gate=Toggle(True), Stream1=dispatch_2.ListA)

# ----
# convert mesh to surface
mesh_edges = MeshEdges(Mesh=stream_filter_3)  # -> NakedEdges, InteriorEdges, NonManifoldEdges
join_curves_2 = JoinCurves(Curves=mesh_edges.NakedEdges, Preserve=False)  # -> simplify(Curves)
length_2 = Length(Curve=join_curves_2)
sort_list_3 = SortList(Keys=length_2, ValuesValuesA=join_curves_2)  # -> reverse(Keys), reverse(ValuesValuesA)
list_item_3 = ListItem(List=sort_list_3.ValuesValuesA, Index=0, Wrap=True)
boundary_surfaces = BoundarySurfaces(Edges=list_item_3)

# ----
# create ghost point above data set
# 10cm offset for noise
mesh_area = MeshArea(Mesh=stream_filter_2)  # -> Area, Centroid
deconstruct = Deconstruct(Point=mesh_area.Centroid)  # -> XComponent, YComponent, ZComponent
construct_point = ConstructPoint(XCoordinate=0, YCoordinate=0, ZCoordinate=deconstruct.ZComponent)
# Compute Elevations
sort_list_4 = SortList(Keys=deconstruct.ZComponent, ValuesZpoint=construct_point, ValuesCentroid=mesh_area.Centroid, ValuesArea=mesh_area.Area)  # -> reverse(Keys), reverse(ValuesZpoint), reverse(ValuesCentroid), reverse(ValuesArea)
# Segment walls
number_slider = Slider(1, range=0..1)
point_groups = PointGroups(Points=sort_list_4.ValuesZpoint, Distance=number_slider)  # -> Groups, Indices
average = Average(Input=deconstruct.ZComponent)
list_item_4 = ListItem(List=sort_list_4.ValuesArea, Index=point_groups.Indices, Wrap=True)
list_item_5 = ListItem(List=sort_list_4.ValuesCentroid, Index=point_groups.Indices, Wrap=True)
construct_point_2 = ConstructPoint(XCoordinate=0, YCoordinate=0, ZCoordinate=expr("x+100", average))
weighted_average = WeightedAverage(Input=list_item_5, Weights=list_item_4)  # -> flatten(ArithmeticMean)
merge = Merge(Data1=weighted_average, Data2=construct_point_2)
xy_plane = XYPlane(Origin=merge)
move_2 = Move(Geometry=xy_plane, Motion=Vector(0, 0, -0.1))  # -> Geometry, Transform

# ----
# split surfaces on single storey from multi storey surfaces and organise them
bounding_box_2 = BoundingBox(Content=stream_filter, Plane=PlaneXY(0, 0, 0))  # -> graft(Box), Box_2
deconstruct_2 = Deconstruct(Point=flatten(move_2.Geometry))  # -> XComponent, YComponent, ZComponent
deconstruct_box = DeconstructBox(Box=bounding_box_2.Box)  # -> Plane, X, Y, Z
consecutive_domains = ConsecutiveDomains(Numbers=deconstruct_2.ZComponent, Additive=False)
deconstruct_domain = DeconstructDomain(Domain=deconstruct_box.Z)  # -> Start, End
merge_2 = Merge(Data1=deconstruct_domain.Start, Data2=deconstruct_domain.End)  # -> simplify(Result)
find_domain = FindDomain(Domains=consecutive_domains, Number=merge_2, Strict=False)  # -> Index, Neighbour
delete_consecutive = DeleteConsecutive(Set=find_domain.Index, Wrap=False)  # -> simplify(Set), Count
list_length = ListLength(List=delete_consecutive.Set)
equality = Equality(FirstNumber=list_length, SecondNumber=1)  # -> Equality, Inequality
dispatch_3 = Dispatch(List=stream_filter, DispatchPattern=flatten(equality.Equality))  # -> SingleStoreySruf, MultiStoreySurf

# ----
# Segment Walls
explode_tree = ExplodeTree(Elevations=graft(move_2.Geometry))  # -> Branch0, Branch1, Branch2, Branch3, Branch4, Branch5, Branch6
remaining_surf = Geometry(dispatch_3.MultiStoreySurf)
mesh_split_plane = MeshSplitPlane(Mesh=remaining_surf, Plane=simplify(explode_tree.Branch1))  # -> flatten(Above), flatten(Below)
merge_3 = Merge(Data1=mesh_split_plane.Above, Data2=remaining_surf)
mesh_split_plane_2 = MeshSplitPlane(Mesh=merge_3, Plane=simplify(explode_tree.Branch2))  # -> flatten(Above), flatten(Below)
merge_4 = Merge(Data1=mesh_split_plane_2.Above, Data2=remaining_surf)
mesh_split_plane_3 = MeshSplitPlane(Mesh=merge_4, Plane=simplify(explode_tree.Branch3))  # -> flatten(Above), flatten(Below)
merge_5 = Merge(Data1=mesh_split_plane_3.Above, Data2=remaining_surf)
mesh_split_plane_4 = MeshSplitPlane(Mesh=merge_5, Plane=simplify(explode_tree.Branch4))  # -> flatten(Above), flatten(Below)
merge_6 = Merge(Data1=mesh_split_plane_4.Above, Data2=remaining_surf)
mesh_split_plane_5 = MeshSplitPlane(Mesh=merge_6, Plane=simplify(explode_tree.Branch5))  # -> flatten(Above), flatten(Below)
merge_7 = Merge(Data1=mesh_split_plane_5.Above, Data2=remaining_surf)
mesh_split_plane_6 = MeshSplitPlane(Mesh=merge_7, Plane=simplify(explode_tree.Branch6))  # -> flatten(Above), flatten(Below)
merge_8 = Merge(
    Data1=dispatch_3.SingleStoreySruf,
    Data2=mesh_split_plane.Above,
    Data3=mesh_split_plane.Below,
    Data4=mesh_split_plane_2.Above,
    Data5=mesh_split_plane_2.Below,
    Data6=mesh_split_plane_3.Above,
    Data7=mesh_split_plane_3.Below,
    Data8=mesh_split_plane_4.Above,
    Data9=mesh_split_plane_4.Below,
    Data10=mesh_split_plane_5.Above,
    Data11=mesh_split_plane_5.Below,
    Data12=mesh_split_plane_6.Above,
    Data13=mesh_split_plane_6.Below)

# ----
# Group walls per elevation
# Filter outliers
# 1. top and bot of surf in domain
# scale surfaces to avoid noise
# order per height
# 2. domains match with centroid
mesh_area_2 = MeshArea(Mesh=merge_8)  # -> Area, Centroid
deconstruct_3 = Deconstruct(Point=mesh_area_2.Centroid)  # -> XComponent, YComponent, ZComponent
sort_list_5 = SortList(Keys=deconstruct_3.ZComponent, ValuesValuesA=merge_8)  # -> Keys, ValuesValuesA
bounding_box_3 = BoundingBox(Content=sort_list_5.ValuesValuesA, Plane=PlaneXY(0, 0, 0))  # -> Box, Box_2
box_properties = BoxProperties(Box=bounding_box_3.Box)  # -> Center, Diagonal, Area, Volume, Degeneracy
scale = Scale(Geometry=bounding_box_3.Box, Center=box_properties.Center, Factor=0.8)  # -> Geometry, Transform
deconstruct_brep_2 = DeconstructBrep(Brep=scale.Geometry)  # -> Faces, Edges, Vertices
deconstruct_4 = Deconstruct(Point=deconstruct_brep_2.Vertices)  # -> XComponent, YComponent, ZComponent
bounds = Bounds(Numbers=deconstruct_4.ZComponent)
deconstruct_domain_2 = DeconstructDomain(Domain=bounds)  # -> Start, End
merge_9 = Merge(Data1=deconstruct_domain_2.Start, Data2=deconstruct_domain_2.End)  # -> simplify(Result)
find_domain_2 = FindDomain(Domains=consecutive_domains, Number=merge_9, Strict=False)  # -> Index, Neighbour
average_2 = Average(Input=deconstruct_4.ZComponent)  # -> simplify(ArithmeticMean)
delete_consecutive_2 = DeleteConsecutive(Set=find_domain_2.Index, Wrap=False)  # -> Set, Count
find_domain_3 = FindDomain(Domains=consecutive_domains, Number=average_2, Strict=False)  # -> simplify(Index), Neighbour
list_item_6 = ListItem(List=delete_consecutive_2.Set, Index=0, Wrap=True)  # -> simplify(Item)
list_length_2 = ListLength(List=delete_consecutive_2.Set)  # -> simplify(Length)
equality_2 = Equality(FirstNumber=list_item_6, SecondNumber=find_domain_3.Index)  # -> Equality, Inequality
equality_3 = Equality(FirstNumber=list_length_2, SecondNumber=1)  # -> Equality, Inequality
gate_and_2 = GateAnd(A=equality_3.Equality, B=equality_2.Equality)
dispatch_4 = Dispatch(List=simplify(graft(sort_list_5.ValuesValuesA)), DispatchPattern=gate_and_2)  # -> flatten(ListA), ListB
dispatch_5 = Dispatch(List=find_domain_3.Index, DispatchPattern=gate_and_2)  # -> flatten(ListA), ListB
create_set = CreateSet(List=dispatch_5.ListA)  # -> Set, Map
member_index = MemberIndex(Set=dispatch_5.ListA, Member=create_set.Set)  # -> Index, Count
list_item_7 = ListItem(List=dispatch_4.ListA, Index=member_index.Index, Wrap=True)  # -> simplify(Item)

# ----
# Create + filter potential bounding boxes walls
# filter boxes by volume/surface ratio
# calc ratio of area BB surf vs volume <1.5
# extract BB surf
# take largest  bounding box size
# split boxes in directions
# use largest surf as basis for bounding box
number_3 = Number(clean_tree)
sort_list_6 = SortList(Keys=number_3, ValuesValuesA=clean_tree)  # -> Keys, reverse(ValuesValuesA)
list_item_8 = ListItem(List=sort_list_6.ValuesValuesA, Index=0, Wrap=True)
evaluate_surface_2 = EvaluateSurface(Surface=reparameterize(list_item_8), Point=Point(0.5, 0.5, 0))  # -> Point, expr("abs(x)", Normal), Frame
bounding_box_4 = BoundingBox(Content=clean_tree, Plane=evaluate_surface_2.Frame, UnionBox=True)  # -> flatten(Box), Box_2
deconstruct_brep_3 = DeconstructBrep(Brep=bounding_box_4.Box)  # -> simplify(Faces), Edges, Vertices
evaluate_surface_3 = EvaluateSurface(Surface=reparameterize(deconstruct_brep_3.Faces), Point=Point(0.5, 0.5, 0))  # -> Point, expr("abs(x)", Normal), Frame
# cluster walls
box_properties_2 = BoxProperties(Box=bounding_box_4.Box)  # -> Center, Diagonal, Area, Volume, Degeneracy
angle_2 = Angle(VectorA=evaluate_surface_3.Normal, VectorB=evaluate_surface_2.Normal)  # -> Angle, Reflex
smaller_than_4 = SmallerThan(FirstNumber=angle_2.Angle, SecondNumber=0.1)  # -> SmallerThan, OrEqualTo
dispatch_6 = Dispatch(List=deconstruct_brep_3.Faces, DispatchPattern=smaller_than_4.SmallerThan)  # -> ListA, ListB
list_item_9 = ListItem(List=dispatch_6.ListA, Index=0, Wrap=True)
number_4 = Number(flatten(list_item_9))
division = Division(A=box_properties_2.Volume, B=number_4)
smaller_than_5 = SmallerThan(FirstNumber=division, SecondNumber=Slider(1.5, range=0..10))  # -> SmallerThan, OrEqualTo
dispatch_7 = Dispatch(List=flatten(evaluate_surface_2.Normal), DispatchPattern=smaller_than_5.SmallerThan)  # -> ListA, ListB
dispatch_8 = Dispatch(List=bounding_box_4.Box, DispatchPattern=smaller_than_5.SmallerThan)  # -> ListA, ListB
closest_point = ClosestPoint(Point=dispatch_7.ListA, Cloud=[Point(1, 0, 0), Point(0, 1, 0), Point(0, 0, 1)])  # -> ClosestPoint, CPIndex, Distance
geometry_3 = Geometry(dispatch_8.ListA)
sift_pattern = SiftPattern(List=geometry_3, SiftPattern=closest_point.CPIndex)  # -> Output0, Output1
entwine = Entwine(Branch00=sift_pattern.Output0, Branch01=sift_pattern.Output1, FlattenInputs=True)
clean_tree_2 = CleanTree(RemoveNulls=True, RemoveInvalid=True, RemoveEmpty=True, Tree=entwine)
box_properties_3 = BoxProperties(Box=clean_tree_2)  # -> Center, Diagonal, Area, Volume, Degeneracy
scale_2 = Scale(Geometry=clean_tree_2, Center=box_properties_3.Center, Factor=1.2)  # -> Geometry, Transform
sort_list_7 = SortList(Keys=box_properties_3.Volume, ValuesGeometry=scale_2.Geometry, ValuesPoints=box_properties_3.Center)  # -> reverse(Keys), reverse(ValuesGeometry), reverse(ValuesPoints)
point_in_breps_2 = PointInBreps(Brep=sort_list_7.ValuesGeometry, Point=sort_list_7.ValuesPoints, Strict=False)  # -> Inside, Index
sort_list_8 = SortList(Keys=point_in_breps_2.Index)  # -> Keys, ValuesValuesA
delete_consecutive_3 = DeleteConsecutive(Set=sort_list_8.Keys, Wrap=False)  # -> Set, Count
list_item_10 = ListItem(List=sort_list_7.ValuesGeometry, Index=delete_consecutive_3.Set, Wrap=True)  # -> simplify(Item)
box_properties_4 = BoxProperties(Box=list_item_10)  # -> Center, Diagonal, Area, Volume, Degeneracy
scale_3 = Scale(Geometry=list_item_10, Center=box_properties_4.Center, Factor=0.833)  # -> Geometry, Transform

number_slider_2 = Slider(84, range=0..130)
tree_branch = TreeBranch(Tree=simplify(graft(list_item)), Path=number_slider_2, MaintainPaths=True)
tree_branch_2 = TreeBranch(Tree=clean_tree, Path=number_slider_2, MaintainPaths=True)

# ----
# Group walls per bounding box
surf = Geometry(geometry)
evaluate_surface_4 = EvaluateSurface(Surface=reparameterize(surf), Point=Point(0.5, 0.5, 0))  # -> Point, expr("abs(x)", Normal), Frame
explode_tree_2 = ExplodeTree(Data=scale_3.Geometry)  # -> Branch0, Branch1, Branch2, Branch3, Branch4
point_in_breps_3 = PointInBreps(Brep=explode_tree_2.Branch1, Point=evaluate_surface_4.Point, Strict=False)  # -> Inside, Index
point_in_breps_4 = PointInBreps(Brep=explode_tree_2.Branch2, Point=evaluate_surface_4.Point, Strict=True)  # -> Inside, Index
point_in_breps_5 = PointInBreps(Brep=explode_tree_2.Branch0, Point=evaluate_surface_4.Point, Strict=False)  # -> Inside, Index
geometry_4 = Geometry(surf)
dispatch_9 = Dispatch(List=point_in_breps_4.Inside, DispatchPattern=point_in_breps_4.Inside)  # -> ListA, ListB
dispatch_10 = Dispatch(List=point_in_breps_3.Index, DispatchPattern=point_in_breps_3.Inside)  # -> ListA, ListB
dispatch_11 = Dispatch(List=point_in_breps_5.Index, DispatchPattern=point_in_breps_5.Inside)  # -> ListA, ListB
dispatch_12 = Dispatch(List=geometry_4, DispatchPattern=point_in_breps_5.Inside)  # -> ListA, ListB
dispatch_13 = Dispatch(List=geometry_4, DispatchPattern=point_in_breps_3.Inside)  # -> ListA, ListB
dispatch_14 = Dispatch(List=geometry_4, DispatchPattern=point_in_breps_4.Inside)  # -> ListA, ListB
construct_point_3 = ConstructPoint(XCoordinate=0, YCoordinate=expr("x+1000", dispatch_10.ListA), ZCoordinate=0)
construct_point_4 = ConstructPoint(XCoordinate=0, YCoordinate=0, ZCoordinate=dispatch_9.ListA)
construct_point_5 = ConstructPoint(XCoordinate=dispatch_11.ListA, YCoordinate=0, ZCoordinate=0)
# method1: grouping is normal dependant!
merge_10 = Merge(Data1=dispatch_12.ListA, Data2=dispatch_13.ListA, Data3=dispatch_14.ListA)  # -> flatten(Result)
merge_11 = Merge(Data1=construct_point_5, Data2=construct_point_3, Data3=construct_point_4)  # -> flatten(Result)
point_groups_2 = PointGroups(Points=merge_11, Distance=0.1)  # -> Groups, simplify(Indices)
list_item_11 = ListItem(List=merge_10, Index=point_groups_2.Indices, Wrap=True)  # -> simplify(Item)

tree_statistics = TreeStatistics(Tree=list_item_7)  # -> Paths, Length, Count

# ----
# method2: normal independant clustering
bounding_boxes = Geometry(flatten(list_item_10))
surf_2 = Geometry(geometry)
box_properties_5 = BoxProperties(Box=bounding_boxes)  # -> Center, Diagonal, Area, Volume, Degeneracy
sort_list_9 = SortList(Keys=box_properties_5.Volume, ValuesA=bounding_boxes)  # -> Keys, reverse(ValuesA)
mesh_area_3 = MeshArea(Mesh=surf_2)  # -> Area, Centroid
point_in_breps_6 = PointInBreps(Brep=sort_list_9.ValuesA, Point=mesh_area_3.Centroid, Strict=False)  # -> Inside, Index
construct_point_6 = ConstructPoint(XCoordinate=point_in_breps_6.Index, YCoordinate=0, ZCoordinate=0)
point_groups_3 = PointGroups(Points=construct_point_6, Distance=0.5)  # -> simplify(Groups), simplify(Indices)
list_item_12 = ListItem(List=surf_2, Index=point_groups_3.Indices, Wrap=True)
number_5 = Number(list_item_12)
sort_list_10 = SortList(Keys=number_5, ValuesA=list_item_12)  # -> Keys, reverse(ValuesA)

# ----
# move surf to avoid mis clustering
explode_tree_3 = ExplodeTree(Data=list_item_7)  # -> Branch0, Branch1, Branch2, Branch3, Branch4, Branch5
geometry_5 = Geometry(explode_tree_3.Branch5)
geometry_6 = Geometry(explode_tree_3.Branch4)
geometry_7 = Geometry(explode_tree_3.Branch2)
geometry_8 = Geometry(explode_tree_3.Branch3)
geometry_9 = Geometry(explode_tree_3.Branch1)
move_3 = Move(Geometry=geometry_7, Motion=Vector(0, 0, 12))  # -> Geometry, Transform
move_4 = Move(Geometry=geometry_8, Motion=Vector(0, 0, 18))  # -> Geometry, Transform
move_5 = Move(Geometry=geometry_9, Motion=Vector(0, 0, 6))  # -> Geometry, Transform
move_6 = Move(Geometry=geometry_5, Motion=Vector(0, 0, 30))  # -> Geometry, Transform
move_7 = Move(Geometry=geometry_6, Motion=Vector(0, 0, 24))  # -> Geometry, Transform
geometry_10 = Geometry(explode_tree_3.Branch0)
entwine_2 = Entwine(
    Branch00=geometry_10,
    Branch01=move_5.Geometry,
    Branch02=move_3.Geometry,
    Branch03=move_4.Geometry,
    Branch04=move_7.Geometry,
    Branch05=move_6.Geometry,
    FlattenInputs=True)
clean_tree_3 = CleanTree(RemoveNulls=True, RemoveInvalid=True, RemoveEmpty=True, Tree=entwine_2)

# ----
# filter surf that dont belong
# sort by area
evaluate_surface_5 = EvaluateSurface(Surface=reparameterize(list_item_11), Point=Point(0.5, 0.5, 0))  # -> Point, expr("abs(x)", Normal), Frame
number_6 = Number(list_item_11)
sort_list_11 = SortList(Keys=number_6, ValuesValuesA=list_item_11, ValuesA=evaluate_surface_5.Normal)  # -> reverse(Keys), reverse(ValuesValuesA), reverse(ValuesA)
list_item_13 = ListItem(List=sort_list_11.ValuesA, Index=0, Wrap=True)
angle_3 = Angle(VectorA=list_item_13, VectorB=sort_list_11.ValuesA)  # -> Angle, Reflex
smaller_than_6 = SmallerThan(FirstNumber=angle_3.Angle, SecondNumber=0.5)  # -> SmallerThan, OrEqualTo
dispatch_15 = Dispatch(List=sort_list_11.ValuesValuesA, DispatchPattern=smaller_than_6.SmallerThan)  # -> ListA, ListB

tree_branch_3 = TreeBranch(Tree=list_item_12, Path=Slider(0, range=0..130), MaintainPaths=True)

# ----
# flip all surfaces in same direction
# (given largest surface)
list_item_14 = ListItem(List=sort_list_10.ValuesA, Index=0, Wrap=True)
flip = Flip(Surface=sort_list_10.ValuesA, Guide=list_item_14)  # -> simplify(Surface), Result
path_mapper = PathMapper(flip.Surface, source="{A;B}", target="{path_index}")
geometry_11 = Geometry(flip.Surface)

# ----
# filter walls that contain only horizontal surf.
wall_surf = Geometry(geometry_11)
evaluate_surface_6 = EvaluateSurface(Surface=reparameterize(wall_surf), Point=Point(0.5, 0.5, 0))  # -> Point, expr("abs(x)", Normal), Frame
average_3 = Average(Input=evaluate_surface_6.Normal)
deconstruct_vector = DeconstructVector(Vector=average_3)  # -> XComponent, YComponent, ZComponent
smaller_than_7 = SmallerThan(FirstNumber=deconstruct_vector.ZComponent, SecondNumber=0.6)  # -> SmallerThan, OrEqualTo
dispatch_16 = Dispatch(List=wall_surf, DispatchPattern=smaller_than_7.SmallerThan)  # -> ListA, ListB
geometry_12 = Geometry(dispatch_16.ListB)
clean_tree_4 = CleanTree(RemoveNulls=True, RemoveInvalid=True, RemoveEmpty=True, Tree=dispatch_16.ListA)

# ----
# cluster per wall face
# averaged normal and plane
# partition lists
# signed distance
# filter single faced walls. list length is
#  easiest else you get problems with
# non-vertical walls
wall_surf_2 = Geometry(clean_tree_4)
path_mapper_2 = PathMapper(wall_surf_2, source="{A}", target="{path_index}")
wall_surf_3 = Geometry(path_mapper_2)
evaluate_surface_7 = EvaluateSurface(Surface=reparameterize(wall_surf_3), Point=Point(0.5, 0.5, 0))  # -> Point, Normal, Frame
number_7 = Number(wall_surf_3)
weighted_average_2 = WeightedAverage(Input=evaluate_surface_7.Normal, Weights=expr("x*x", number_7))
average_4 = Average(Input=evaluate_surface_7.Point)
list_item_15 = ListItem(List=evaluate_surface_7.Frame, Index=0, Wrap=True)
list_length_3 = ListLength(List=wall_surf_3)
plane_origin = PlaneOrigin(Base=list_item_15, Origin=average_4)
equality_4 = Equality(FirstNumber=list_length_3, SecondNumber=1)  # -> Equality, Inequality
adjust_plane = AdjustPlane(Plane=plane_origin, Normal=weighted_average_2)
dispatch_17 = Dispatch(Planes=adjust_plane, DispatchPattern=equality_4.Equality)  # -> ListA, ListB
dispatch_18 = Dispatch(Points=evaluate_surface_7.Point, DispatchPattern=equality_4.Equality)  # -> ListA, ListB
plane_closest_point = PlaneClosestPoint(Point=dispatch_18.ListB, Plane=dispatch_17.ListB)  # -> Point, UVPoint, Distance
dispatch_19 = Dispatch(List=wall_surf_3, DispatchPattern=equality_4.Equality)  # -> ListA, ListB
sort_list_12 = SortList(Keys=plane_closest_point.Distance, ValuesValuesA=dispatch_19.ListB)  # -> Keys, ValuesValuesA
smaller_than_8 = SmallerThan(FirstNumber=sort_list_12.Keys, SecondNumber=0)  # -> SmallerThan, OrEqualTo
mass_addition = MassAddition(Input=smaller_than_8.SmallerThan)  # -> Result, PartialResults
list_length_4 = ListLength(List=smaller_than_8.SmallerThan)
subtraction = Subtraction(A=list_length_4, B=mass_addition.Result)
merge_12 = Merge(Data1=mass_addition.Result, Data2=subtraction)
partition_list = PartitionList(List=sort_list_12.ValuesValuesA, Size=merge_12)
merge_13 = Merge(Data1=partition_list, Data2=graft(dispatch_19.ListA))

path_mapper_3 = PathMapper(merge_13, source="{A;B}", target="{path_index}")
tree_branch_4 = TreeBranch(Tree=path_mapper_3, Path=Slider(100, range=0..100), MaintainPaths=True)
tree_branch_5 = TreeBranch(Tree=merge_13, Path="{0;1;0}", MaintainPaths=True)

# ----
# Compute best wall face
evaluate_surface_8 = EvaluateSurface(Surface=reparameterize(merge_13), Point=Point(0.5, 0.5, 0))  # -> Point, Normal, Frame
number_8 = Number(expr("x+10", merge_13))
divide_surface = DivideSurface(Surface=merge_13, UCount=number_8, VCount=number_8)  # -> Points, Normals, Parameters
shift_paths = ShiftPaths(Data=divide_surface.Points, Offset=-2)
plane_fit = PlaneFit(Points=shift_paths)  # -> Plane, Deviation
weighted_average_3 = WeightedAverage(Input=evaluate_surface_8.Point, Weights=number_8)
plane_origin_2 = PlaneOrigin(Base=plane_fit.Plane, Origin=weighted_average_3)

# ----
# compute Wall thickness
# reverse list of sampled points
# compute distance between points and best oposite wall plane
# Cluster thicknesses and appoint new thickness
# give single walls 1cm thickness (else problems)
merge_14 = Merge(Data1=subtraction, Data2=mass_addition.Result)
geometry_13 = Geometry(reverse(sort_list_12.ValuesValuesA))
partition_list_2 = PartitionList(List=geometry_13, Size=merge_14)
wall_clustering = Slider(0.03, range=0..0.1)
merge_15 = Merge(Data1=partition_list_2, Data2=graft(dispatch_19.ListA))
number_9 = Number(expr("x+10", merge_15))
mass_addition_2 = MassAddition(Input=number_9)  # -> Result, PartialResults
shift_paths_2 = ShiftPaths(Data=mass_addition_2.Result, Offset=-1)
divide_surface_2 = DivideSurface(Surface=merge_15, UCount=number_9, VCount=number_9)  # -> Points, Normals, Parameters
shift_paths_3 = ShiftPaths(Data=divide_surface_2.Points, Offset=-2)
plane_closest_point_2 = PlaneClosestPoint(Point=shift_paths_3, Plane=plane_origin_2)  # -> Point, UVPoint, expr("abs(x)", Distance)
average_5 = Average(Input=plane_closest_point_2.Distance)
shift_paths_4 = ShiftPaths(Data=average_5, Offset=-1)
weighted_average_4 = WeightedAverage(Input=shift_paths_4, Weights=expr("sqrt(x)", shift_paths_2))
construct_point_7 = ConstructPoint(XCoordinate=flatten(weighted_average_4), YCoordinate=0, ZCoordinate=0)
point_groups_4 = PointGroups(Points=construct_point_7, Distance=wall_clustering)  # -> Groups, Indices
average_6 = Average(Input=point_groups_4.Groups)  # -> flatten(ArithmeticMean)
deconstruct_5 = Deconstruct(Point=expr("round(x,2)", average_6))  # -> XComponent, YComponent, ZComponent
sort_list_13 = SortList(Keys=deconstruct_5.XComponent)  # -> Keys, ValuesValuesA
consecutive_domains_2 = ConsecutiveDomains(Numbers=sort_list_13.Keys, Additive=False)
find_domain_4 = FindDomain(Domains=consecutive_domains_2, Number=weighted_average_4, Strict=False)  # -> Index, Neighbour
list_item_16 = ListItem(List=sort_list_13.Keys, Index=find_domain_4.Index, Wrap=True)
clustered_wall_thickness = Number(list_item_16)
equality_5 = Equality(FirstNumber=clustered_wall_thickness, SecondNumber=0)  # -> Equality, Inequality
dispatch_20 = Dispatch(List=clustered_wall_thickness, DispatchPattern=equality_5.Equality)  # -> ListA, ListB
number_10 = Number(expr("x+0.01", dispatch_20.ListA))
merge_16 = Merge(Data1=number_10, Data2=dispatch_20.ListB)

# ----
# Compute wall placement
# compute distance to heartplane
# move heartplane to 1 face of wall
# % of error contribution is given
#  by opposite face
# % weight per side
# move new heartplane away according to error+new thickness
real_thickness_d = Number(weighted_average_4)
thickness_d = Number(simplify(merge_16))
wall_faces = Geometry(plane_origin_2)
heart_plane = Geometry(adjust_plane)
shift_paths_5 = ShiftPaths(Data=wall_faces, Offset=-1)
path_mapper_4 = PathMapper(thickness_d, source="{A}", target="{path_index}")
path_mapper_5 = PathMapper(heart_plane, source="{A}", target="{path_index}")
path_mapper_6 = PathMapper(real_thickness_d, source="{A}", target="{path_index}")
path_mapper_7 = PathMapper(shift_paths_5, source="{A}", target="{path_index}")
thickness_d_2 = Number(path_mapper_4)
thickness = Number(expr("0.5*x", thickness_d_2))
real_thickness_d_2 = Number(path_mapper_6)
area_per_wall_face = Number(merge_13)
average_normal = Geometry(weighted_average_2)
list_length_5 = ListLength(List=path_mapper_7)
mass_addition_3 = MassAddition(Input=area_per_wall_face)  # -> Result, PartialResults
subtraction_2 = Subtraction(A=real_thickness_d_2, B=thickness_d_2)
duplicate_data = DuplicateData(Data=average_normal, Number=list_length_5, Order=True)  # -> simplify(graft(Data))
duplicate_data_2 = DuplicateData(Data=path_mapper_5, Number=list_length_5, Order=True)  # -> simplify(graft(Data))
duplicate_data_3 = DuplicateData(Data=thickness, Number=list_length_5, Order=True)  # -> simplify(Data)
wall_faces_points = Geometry(shift_paths)
shift_paths_6 = ShiftPaths(Data=mass_addition_3.Result, Offset=-1)
plane_closest_point_3 = PlaneClosestPoint(Point=wall_faces_points, Plane=duplicate_data_2)  # -> Point, UVPoint, Distance
path_mapper_8 = PathMapper(shift_paths_6, source="{A}", target="{path_index}")
average_7 = Average(Input=plane_closest_point_3.Distance)
multiplication = Multiplication(A=average_7, B=duplicate_data)
move_8 = Move(Geometry=duplicate_data_2, Motion=multiplication)  # -> Geometry, Transform
area_per_wall_face_2 = Number(path_mapper_8)
mass_addition_4 = MassAddition(Input=area_per_wall_face_2)  # -> Result, PartialResults
division_2 = Division(A=area_per_wall_face_2, B=mass_addition_4.Result)
list_item_17 = ListItem(List=division_2, Index=0, Wrap=True)
list_item_18 = ListItem(List=division_2, Index=1, Wrap=True)
merge_17 = Merge(Data1=list_item_18, Data2=list_item_17)
shift_paths_7 = ShiftPaths(Data=duplicate_data, Offset=-1)
multiplication_2 = Multiplication(A=subtraction_2, B=merge_17)
shift_paths_8 = ShiftPaths(Data=move_8.Geometry, Offset=-1)
list_item_19 = ListItem(List=multiplication_2, Index=0, Wrap=True)
list_item_20 = ListItem(List=shift_paths_7, Index=0, Wrap=True)
list_item_21 = ListItem(List=thickness, Index=0, Wrap=True)
list_item_22 = ListItem(List=shift_paths_8, Index=0, Wrap=True)
multiplication_3 = Multiplication(A=list_item_19, B=list_item_20)
multiplication_4 = Multiplication(A=list_item_21, B=list_item_20)
addition = Addition(A=multiplication_3, B=multiplication_4)
move_9 = Move(Geometry=list_item_22, Motion=addition)  # -> NewHeartplane, Transform

vector_length = VectorLength(Vector=addition)  # disabled
panel = Panel(vector_length)  # disabled

# ----
# Compute Wall contour
# data needs to be duplicated because
# you cannnot merge 1 face
#  (need 2 at least)
wall_surf_4 = Geometry(merge_13)
shift_paths_9 = ShiftPaths(Data=wall_surf_4, Offset=-1)
heart_plane_2 = Geometry(move_9.NewHeartplane)
untrim = Untrim(Surface=shift_paths_9)
project = Project(Geometry=untrim, Plane=heart_plane_2)  # -> Geometry, Transform
duplicate_data_4 = DuplicateData(Data=project.Geometry, Number=2, Order=True)  # -> simplify(Data)
region_union = RegionUnion(Curves=duplicate_data_4, Plane=heart_plane_2)  # -> simplify(Result)

# ----
# Compute Wall contour 2
# (other is unreliable)
# data needs to be duplicated because
# you cannnot merge 1 face
#  (need 2 at least)
wall_surf_5 = Geometry(merge_13)
shift_paths_10 = ShiftPaths(Data=wall_surf_5, Offset=-1)
heart_plane_3 = Geometry(move_9.NewHeartplane)
project_2 = Project(Geometry=shift_paths_10, Plane=heart_plane_3)  # -> Geometry, Transform
brep_edges_2 = BrepEdges(Brep=project_2.Geometry)  # -> Naked, Interior, NonManifold
shift_paths_11 = ShiftPaths(Data=brep_edges_2.Naked, Offset=-1)
boundary_surfaces_2 = BoundarySurfaces(Edges=region_union)

# ----
# create solid Wall
list_length_6 = ListLength(List=boundary_surfaces_2)
thickness_2 = Number(expr("x/2", simplify(merge_16)))
normal = Geometry(weighted_average_2)
duplicate_data_5 = DuplicateData(Data=normal, Number=list_length_6, Order=True)  # -> simplify(Normal)
duplicate_data_6 = DuplicateData(Data=thickness_2, Number=list_length_6, Order=True)  # -> simplify(Thick2)
duplicate_data_7 = DuplicateData(Data=merge_16, Number=list_length_6, Order=True)  # -> simplify(Thick)
multiplication_5 = Multiplication(A=duplicate_data_5, B=duplicate_data_6)
multiplication_6 = Multiplication(A=duplicate_data_5, B=duplicate_data_7)
move_10 = Move(Geometry=boundary_surfaces_2, Motion=expr("-x", multiplication_5))  # -> Geometry, Transform
extrude_2 = Extrude(Base=move_10.Geometry, Direction=multiplication_6)  # -> simplify(Extrusion)
move_11 = Move(Geometry=move_10.Geometry, Motion=multiplication_6)  # -> Geometry, Transform

# ----
# Cloudcompare geometry
# reconstructed
# initial
geometry_14 = Geometry(move_10.Geometry)  # disabled
geometry_15 = Geometry(move_11.Geometry)  # disabled
merge_18 = Merge(Data1=geometry_14, Data2=geometry_15)  # -> simplify(Result); disabled
geometry_16 = Geometry(geometry)  # disabled
geometry_17 = Geometry(merge_18)  # disabled

# ----
# Place Geometry back in place
cap_holes = CapHoles(Brep=extrude_2)  # -> simplify(flatten(Brep)); disabled
geometry_18 = Geometry(geometry_17)  # disabled
bounding_box_5 = BoundingBox(Content=geometry_18, Plane=PlaneXY(0, 0, 0), UnionBox=False)  # -> Box, Box_2; disabled
box_properties_6 = BoxProperties(Box=bounding_box_5.Box)  # -> Center, Diagonal, Area, Volume, Degeneracy; disabled
deconstruct_6 = Deconstruct(Point=box_properties_6.Center)  # -> XComponent, YComponent, ZComponent; disabled
series = Series(Start=0, Step=6, Count=tree_statistics.Count)  # disabled
list_length_7 = ListLength(List=series)  # -> expr("x-1", Length); disabled
number_11 = Number(series)  # disabled
number_12 = Number(series)  # disabled
number_13 = Number(reverse(series))  # disabled
cull_index = CullIndex(List=number_12, Indices=0, Wrap=True)  # -> simplify(graft(List)); disabled
list_item_23 = ListItem(List=number_13, Index=0, Wrap=True)  # disabled
cull_index_2 = CullIndex(List=number_11, Indices=list_length_7, Wrap=True)  # -> simplify(graft(List)); disabled
construct_domain = ConstructDomain(DomainStart=list_item_23, DomainEnd=999)  # -> flatten(Domain); disabled
construct_domain_2 = ConstructDomain(DomainStart=cull_index_2, DomainEnd=cull_index)  # -> flatten(Domain); disabled
merge_19 = Merge(Data1=construct_domain_2, Data2=construct_domain)  # disabled
find_domain_5 = FindDomain(Domains=merge_19, Number=deconstruct_6.ZComponent, Strict=False)  # -> Index, Neighbour; disabled
sort_list_14 = SortList(Keys=find_domain_5.Index, ValuesValuesA=flatten(bounding_box_5.Box))  # -> reverse(Keys), reverse(ValuesValuesA); disabled
construct_point_8 = ConstructPoint(XCoordinate=sort_list_14.Keys, YCoordinate=0, ZCoordinate=0)  # disabled
point_groups_5 = PointGroups(Points=flatten(construct_point_8), Distance=0.5)  # -> Groups, Indices; disabled
list_item_24 = ListItem(List=flatten(geometry_18), Index=point_groups_5.Indices, Wrap=True)  # disabled
explode_tree_4 = ExplodeTree(Data=list_item_24)  # -> Branch0, Branch1, Branch2, Branch3, Branch4, Branch5; disabled
geometry_19 = Geometry(explode_tree_4.Branch2)  # disabled
geometry_20 = Geometry(explode_tree_4.Branch1)  # disabled
geometry_21 = Geometry(explode_tree_4.Branch3)  # disabled
geometry_22 = Geometry(explode_tree_4.Branch4)  # disabled
move_12 = Move(Geometry=geometry_20, Motion=Vector(0, 0, -6))  # -> Geometry, Transform; disabled
move_13 = Move(Geometry=geometry_21, Motion=Vector(0, 0, -18))  # -> Geometry, Transform; disabled
move_14 = Move(Geometry=geometry_19, Motion=Vector(0, 0, -12))  # -> Geometry, Transform; disabled
move_15 = Move(Geometry=geometry_22, Motion=Vector(0, 0, -24))  # -> Geometry, Transform; disabled
geometry_23 = Geometry(explode_tree_4.Branch0)  # disabled
merge_20 = Merge(Data1=geometry_23, Data2=move_12.Geometry, Data3=move_14.Geometry, Data4=move_13.Geometry, Data5=move_15.Geometry)  # disabled

panel_2 = Panel(extrude_2)
number_slider_3 = Slider(0, range=0..130)
tree_branch_6 = TreeBranch(Tree=simplify(graft(list_item)), Path=number_slider_3, MaintainPaths=True)
tree_branch_7 = TreeBranch(Tree=extrude_2, Path=number_slider_3, MaintainPaths=True)
