# Grasshopper definition reconstruction_walls4.gh (Grasshopper 1.0.7)
# plug-ins: MeshEdit Components, RhinoInside.Revit

# ----
# start data
segmented_walls_per_level_per_wall = Geometry(Tree({1;0}: [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], {1;1}: [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], {1;2}: [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], {1;3}: [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], {1;4}: [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], {1;5}: [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]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))
elevation_heights = Point(Tree({0}: [Point(0, 0, 0)], {1}: [Point(0, 0, 4.886337113)], {2}: [Point(0, 0, 8.423327244)], {3}: [Point(0, 0, 11.73485373)]))
floor = Surface(Tree({0}: [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], {1}: [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], {2}: [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], {3}: [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]))

wall_per_level = Geometry(Tree({0}: [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], {1}: [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], {2}: [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], {3}: [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]))
walls = Surface(Tree({0}: [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], {1}: [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], {2}: [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], {3}: [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], {4}: [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], {5}: [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]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))
n_block_segmented_walls_per_level_correc = Geometry([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])  # "N-block segmented walls per level correct"

# ----
# Input
boolean_toggle = BooleanToggle(True)
floors = Geometry(<mesh referenced from the Rhino model>)
walls_2 = Geometry([<mesh referenced from the Rhino model> x3])
stream_filter = StreamFilter(Gate=boolean_toggle, Stream1=walls_2)
stream_filter_2 = StreamFilter(Gate=boolean_toggle, Stream1=floors)

mesh_area = MeshArea(Mesh=walls_2)  # -> Area, Centroid
mesh_area_2 = MeshArea(Mesh=walls_2)  # -> Area, Centroid
mesh_closest_point = MeshClosestPoint(Point=mesh_area_2.Centroid, Mesh=walls_2)  # -> Point, Index, Parameter
mesh_eval = MeshEval(Mesh=walls_2, Parameter=mesh_closest_point.Parameter)  # -> Point, Normal, Colour
walls_final = Geometry()

# ----
# Delete to small segments
number = Number(walls_final)
larger_than = LargerThan(FirstNumber=number, SecondNumber=Slider(0.4, range=0..1))  # -> LargerThan, OrEqualTo
dispatch = Dispatch(List=walls_final, DispatchPattern=larger_than.LargerThan)  # -> ListA, ListB
geometry = Geometry(dispatch.ListB)

stream_filter_3 = StreamFilter(Gate=Toggle(True), Stream1=dispatch.ListA)

# ----
# convert mesh to surface
mesh_edges = MeshEdges(Mesh=stream_filter_3)  # -> NakedEdges, InteriorEdges, NonManifoldEdges
join_curves = JoinCurves(Curves=mesh_edges.NakedEdges, Preserve=False)  # -> simplify(Curves)
length = Length(Curve=join_curves)
sort_list = SortList(Keys=length, ValuesValuesA=join_curves)  # -> reverse(Keys), reverse(ValuesValuesA)
list_item = ListItem(List=sort_list.ValuesValuesA, Index=0, Wrap=True)
boundary_surfaces = BoundarySurfaces(Edges=list_item)

# ----
# create ghost point above data set
# 10cm offset for noise
mesh_area_3 = MeshArea(Mesh=stream_filter_2)  # -> Area, Centroid
deconstruct = Deconstruct(Point=mesh_area_3.Centroid)  # -> XComponent, YComponent, ZComponent
construct_point = ConstructPoint(XCoordinate=0, YCoordinate=0, ZCoordinate=deconstruct.ZComponent)
# Compute Elevations
sort_list_2 = SortList(
    Keys=deconstruct.ZComponent,
    ValuesZpoint=construct_point,
    ValuesCentroid=mesh_area_3.Centroid,
    ValuesArea=mesh_area_3.Area)  # -> reverse(Keys), reverse(ValuesZpoint), reverse(ValuesCentroid), reverse(ValuesArea)
# Segment walls
number_slider = Slider(1, range=0..1)
point_groups = PointGroups(Points=sort_list_2.ValuesZpoint, Distance=number_slider)  # -> Groups, Indices
average = Average(Input=deconstruct.ZComponent)
list_item_2 = ListItem(List=sort_list_2.ValuesArea, Index=point_groups.Indices, Wrap=True)
list_item_3 = ListItem(List=sort_list_2.ValuesCentroid, Index=point_groups.Indices, Wrap=True)
construct_point_2 = ConstructPoint(XCoordinate=0, YCoordinate=0, ZCoordinate=expr("x+100", average))
weighted_average = WeightedAverage(Input=list_item_3, Weights=list_item_2)  # -> flatten(ArithmeticMean)
merge = Merge(Data1=weighted_average, Data2=construct_point_2)
xy_plane = XYPlane(Origin=merge)
move = Move(Geometry=xy_plane, Motion=Vector(0, 0, -0.1))  # -> Geometry, Transform

# ----
# split surfaces on single storey from multi storey surfaces and organise them
bounding_box = BoundingBox(Content=stream_filter, Plane=PlaneXY(0, 0, 0))  # -> graft(Box), Box_2
deconstruct_2 = Deconstruct(Point=flatten(move.Geometry))  # -> XComponent, YComponent, ZComponent
deconstruct_box = DeconstructBox(Box=bounding_box.Box)  # -> Plane, X, Y, Z
consecutive_domains = ConsecutiveDomains(Numbers=deconstruct_2.ZComponent, Additive=False)
deconstruct_domain = DeconstructDomain(Domain=deconstruct_box.Z)  # -> Start, End
merge_2 = Merge(Data1=deconstruct_domain.Start, Data2=deconstruct_domain.End)  # -> simplify(Result)
find_domain = FindDomain(Domains=consecutive_domains, Number=merge_2, Strict=False)  # -> Index, Neighbour
delete_consecutive = DeleteConsecutive(Set=find_domain.Index, Wrap=False)  # -> simplify(Set), Count
list_length = ListLength(List=delete_consecutive.Set)
equality = Equality(FirstNumber=list_length, SecondNumber=1)  # -> Equality, Inequality
dispatch_2 = Dispatch(List=stream_filter, DispatchPattern=flatten(equality.Equality))  # -> SingleStoreySruf, MultiStoreySurf

# ----
# Segment Walls
explode_tree = ExplodeTree(Elevations=graft(move.Geometry))  # -> Branch0, Branch1, Branch2, Branch3, Branch4, Branch5, Branch6
remaining_surf = Geometry(dispatch_2.MultiStoreySurf)
mesh_split_plane = MeshSplitPlane(Mesh=remaining_surf, Plane=simplify(explode_tree.Branch1))  # -> flatten(Above), flatten(Below)
merge_3 = Merge(Data1=mesh_split_plane.Above, Data2=remaining_surf)
mesh_split_plane_2 = MeshSplitPlane(Mesh=merge_3, Plane=simplify(explode_tree.Branch2))  # -> flatten(Above), flatten(Below)
merge_4 = Merge(Data1=mesh_split_plane_2.Above, Data2=remaining_surf)
mesh_split_plane_3 = MeshSplitPlane(Mesh=merge_4, Plane=simplify(explode_tree.Branch3))  # -> flatten(Above), flatten(Below)
merge_5 = Merge(Data1=mesh_split_plane_3.Above, Data2=remaining_surf)
mesh_split_plane_4 = MeshSplitPlane(Mesh=merge_5, Plane=simplify(explode_tree.Branch4))  # -> flatten(Above), flatten(Below)
merge_6 = Merge(Data1=mesh_split_plane_4.Above, Data2=remaining_surf)
mesh_split_plane_5 = MeshSplitPlane(Mesh=merge_6, Plane=simplify(explode_tree.Branch5))  # -> flatten(Above), flatten(Below)
merge_7 = Merge(Data1=mesh_split_plane_5.Above, Data2=remaining_surf)
mesh_split_plane_6 = MeshSplitPlane(Mesh=merge_7, Plane=simplify(explode_tree.Branch6))  # -> flatten(Above), flatten(Below)
merge_8 = Merge(
    Data1=dispatch_2.SingleStoreySruf,
    Data2=mesh_split_plane.Above,
    Data3=mesh_split_plane.Below,
    Data4=mesh_split_plane_2.Above,
    Data5=mesh_split_plane_2.Below,
    Data6=mesh_split_plane_3.Above,
    Data7=mesh_split_plane_3.Below,
    Data8=mesh_split_plane_4.Above,
    Data9=mesh_split_plane_4.Below,
    Data10=mesh_split_plane_5.Above,
    Data11=mesh_split_plane_5.Below,
    Data12=mesh_split_plane_6.Above,
    Data13=mesh_split_plane_6.Below)

# ----
# Group walls per elevation
# Filter outliers
# 1. top and bot of surf in domain
# scale surfaces to avoid noise
# order per height
# 2. domains match with centroid
mesh_area_4 = MeshArea(Mesh=merge_8)  # -> Area, Centroid
deconstruct_3 = Deconstruct(Point=mesh_area_4.Centroid)  # -> XComponent, YComponent, ZComponent
sort_list_3 = SortList(Keys=deconstruct_3.ZComponent, ValuesValuesA=merge_8)  # -> Keys, ValuesValuesA
bounding_box_2 = BoundingBox(Content=sort_list_3.ValuesValuesA, Plane=PlaneXY(0, 0, 0))  # -> Box, Box_2
box_properties = BoxProperties(Box=bounding_box_2.Box)  # -> Center, Diagonal, Area, Volume, Degeneracy
scale = Scale(Geometry=bounding_box_2.Box, Center=box_properties.Center, Factor=0.8)  # -> Geometry, Transform
deconstruct_brep = DeconstructBrep(Brep=scale.Geometry)  # -> Faces, Edges, Vertices
deconstruct_4 = Deconstruct(Point=deconstruct_brep.Vertices)  # -> XComponent, YComponent, ZComponent
bounds = Bounds(Numbers=deconstruct_4.ZComponent)
deconstruct_domain_2 = DeconstructDomain(Domain=bounds)  # -> Start, End
merge_9 = Merge(Data1=deconstruct_domain_2.Start, Data2=deconstruct_domain_2.End)  # -> simplify(Result)
find_domain_2 = FindDomain(Domains=consecutive_domains, Number=merge_9, Strict=False)  # -> Index, Neighbour
average_2 = Average(Input=deconstruct_4.ZComponent)  # -> simplify(ArithmeticMean)
delete_consecutive_2 = DeleteConsecutive(Set=find_domain_2.Index, Wrap=False)  # -> Set, Count
find_domain_3 = FindDomain(Domains=consecutive_domains, Number=average_2, Strict=False)  # -> simplify(Index), Neighbour
list_item_4 = ListItem(List=delete_consecutive_2.Set, Index=0, Wrap=True)  # -> simplify(Item)
list_length_2 = ListLength(List=delete_consecutive_2.Set)  # -> simplify(Length)
equality_2 = Equality(FirstNumber=list_item_4, SecondNumber=find_domain_3.Index)  # -> Equality, Inequality
equality_3 = Equality(FirstNumber=list_length_2, SecondNumber=1)  # -> Equality, Inequality
gate_and = GateAnd(A=equality_3.Equality, B=equality_2.Equality)
dispatch_3 = Dispatch(List=simplify(graft(sort_list_3.ValuesValuesA)), DispatchPattern=gate_and)  # -> flatten(ListA), ListB
dispatch_4 = Dispatch(List=find_domain_3.Index, DispatchPattern=gate_and)  # -> flatten(ListA), ListB
create_set = CreateSet(List=dispatch_4.ListA)  # -> Set, Map
member_index = MemberIndex(Set=dispatch_4.ListA, Member=create_set.Set)  # -> Index, Count
list_item_5 = ListItem(List=dispatch_3.ListA, Index=member_index.Index, Wrap=True)  # -> simplify(Item)

number_slider_2 = Slider(84, range=0..130)
bounding_box_3 = BoundingBox(Content=walls_2, Plane=PlaneXY(0, 0, 0), UnionBox=True)  # -> Box, Box_2

# ----
# Create Elevation
mesh_area_5 = MeshArea(Mesh=floors)  # -> Area, Centroid
deconstruct_5 = Deconstruct(Point=mesh_area_5.Centroid)  # -> XComponent, YComponent, ZComponent
addlevel_byelevation = AddLevelByElevation(Elevation=deconstruct_5.ZComponent)

deconstruct_box_2 = DeconstructBox(Box=bounding_box_3.Box)  # -> Plane, X, Y, Z
mesh_area_6 = MeshArea(Mesh=floors)  # -> Area, Centroid
categorytypes = CategoryTypes({"Model": 1, "Annotation": 2, "Analytical": 5}, selected="Model")
deconstruct_domain_3 = DeconstructDomain(Domain=deconstruct_box_2.Z)  # -> Start, End
document_elementtypes = DocumentElementTypes()
xy_plane_2 = XYPlane(Origin=mesh_area_6.Centroid)
subtraction = Subtraction(A=deconstruct_domain_3.End, B=deconstruct_5.ZComponent)
family_name_here = ElementTypeByName()
generic_200mm = ElementTypeByName()
family_name_here_2 = ElementTypeByName()
document_elementtypes_2 = DocumentElementTypes(TypeName="Generic - 200mm")
wall = BuiltInParameterByName()
tree_statistics = TreeStatistics(Tree=list_item_5)  # -> Paths, Length, Count

# ----
# move surf to avoid mis clustering
explode_tree_2 = ExplodeTree(Data=list_item_5)  # -> Branch0, Branch1, Branch2, Branch3, Branch4, Branch5
geometry_2 = Geometry(explode_tree_2.Branch5)
geometry_3 = Geometry(explode_tree_2.Branch4)
geometry_4 = Geometry(explode_tree_2.Branch2)
geometry_5 = Geometry(explode_tree_2.Branch3)
geometry_6 = Geometry(explode_tree_2.Branch1)
move_2 = Move(Geometry=geometry_4, Motion=Vector(0, 0, 12))  # -> Geometry, Transform
move_3 = Move(Geometry=geometry_5, Motion=Vector(0, 0, 18))  # -> Geometry, Transform
move_4 = Move(Geometry=geometry_6, Motion=Vector(0, 0, 6))  # -> Geometry, Transform
move_5 = Move(Geometry=geometry_2, Motion=Vector(0, 0, 30))  # -> Geometry, Transform
move_6 = Move(Geometry=geometry_3, Motion=Vector(0, 0, 24))  # -> Geometry, Transform
geometry_7 = Geometry(explode_tree_2.Branch0)
entwine = Entwine(
    Branch00=geometry_7,
    Branch01=move_4.Geometry,
    Branch02=move_2.Geometry,
    Branch03=move_3.Geometry,
    Branch04=move_6.Geometry,
    Branch05=move_5.Geometry,
    FlattenInputs=True)
clean_tree = CleanTree(RemoveNulls=True, RemoveInvalid=True, RemoveEmpty=True, Tree=entwine)

number_slider_3 = Slider(0, range=0..130)

# ----
# cluster per wall face
# averaged normal and plane
# partition lists
# signed distance
# filter single faced walls. list length is
#  easiest else you get problems with
# non-vertical walls
wall_surf = Geometry(walls_2)
path_mapper = PathMapper(wall_surf, source="{A}", target="{path_index}")
wall_surf_2 = Geometry(path_mapper)
evaluate_surface = EvaluateSurface(Surface=reparameterize(wall_surf_2), Point=Point(0.5, 0.5, 0))  # -> Point, Normal, Frame
number_2 = Number(wall_surf_2)
weighted_average_2 = WeightedAverage(Input=mesh_eval.Normal, Weights=expr("x*x", number_2))
average_3 = Average(Input=mesh_eval.Point)
list_item_6 = ListItem(List=mesh_eval.Colour, Index=0, Wrap=True)
list_length_3 = ListLength(List=wall_surf_2)
plane_origin = PlaneOrigin(Base=list_item_6, Origin=average_3)
equality_4 = Equality(FirstNumber=list_length_3, SecondNumber=1)  # -> Equality, Inequality
dispatch_5 = Dispatch(Points=mesh_eval.Point, DispatchPattern=equality_4.Equality)  # -> ListA, ListB
dispatch_6 = Dispatch(List=wall_surf_2, DispatchPattern=equality_4.Equality)  # -> ListA, ListB

xz_plane = XZPlane(Origin=average_3)

adjust_plane = AdjustPlane(Plane=xz_plane, Normal=weighted_average_2)
dispatch_7 = Dispatch(Planes=adjust_plane, DispatchPattern=equality_4.Equality)  # -> ListA, ListB
plane_closest_point = PlaneClosestPoint(Point=dispatch_5.ListB, Plane=dispatch_7.ListB)  # -> Point, UVPoint, Distance
sort_list_4 = SortList(Keys=plane_closest_point.Distance, ValuesValuesA=dispatch_6.ListB)  # -> Keys, ValuesValuesA
smaller_than = SmallerThan(FirstNumber=sort_list_4.Keys, SecondNumber=0)  # -> SmallerThan, OrEqualTo
mass_addition = MassAddition(Input=smaller_than.SmallerThan)  # -> Result, PartialResults
list_length_4 = ListLength(List=smaller_than.SmallerThan)
subtraction_2 = Subtraction(A=list_length_4, B=mass_addition.Result)
merge_10 = Merge(Data1=mass_addition.Result, Data2=subtraction_2)
partition_list = PartitionList(List=sort_list_4.ValuesValuesA, Size=merge_10)
merge_11 = Merge(Data1=partition_list, Data2=graft(dispatch_6.ListA))

# ----
# Compute Wall contour 3
bounding_box_4 = BoundingBox(Content=walls_2, Plane=adjust_plane, UnionBox=True)  # -> Box, Box_2
brep_edges = BrepEdges(Brep=bounding_box_4.Box)  # -> Naked, Interior, NonManifold
brep_plane = BrepPlane(Brep=bounding_box_4.Box, Plane=adjust_plane)  # -> Curves, Points
length_2 = Length(Curve=brep_edges.Interior)
sort_list_5 = SortList(Keys=length_2, ValuesA=brep_edges.Interior)  # -> Keys, ValuesA
curve_middle = CurveMiddle(Curve=sort_list_5.ValuesA)
list_item_7 = ListItem(List=curve_middle, Index=0, Wrap=True)
list_item_8 = ListItem(List=curve_middle, Index=1, Wrap=True)
line = Line(StartPoint=list_item_7, EndPoint=list_item_8)

path_mapper_2 = PathMapper(merge_11, source="{A;B}", target="{path_index}")
tree_branch = TreeBranch(Tree=path_mapper_2, Path=Slider(100, range=0..100), MaintainPaths=True)
project = Project(Geometry=line, Plane=xy_plane_2)  # -> Geometry, Transform
tree_branch_2 = TreeBranch(Tree=merge_11, Path="{0;1;0}", MaintainPaths=True)
addwall_bycurve = AddWallByCurve(Curve=project.Geometry, Level=addlevel_byelevation, Height=subtraction, AllowJoins=True)
element_parameterset = ElementParameterSet(Element=addwall_bycurve)

# ----
# Compute best wall face
evaluate_surface_2 = EvaluateSurface(Surface=reparameterize(merge_11), Point=Point(0.5, 0.5, 0))  # -> Point, Normal, Frame
number_3 = Number(expr("x+10", merge_11))
divide_surface = DivideSurface(Surface=merge_11, UCount=number_3, VCount=number_3)  # -> Points, Normals, Parameters
shift_paths = ShiftPaths(Data=divide_surface.Points, Offset=-2)
plane_fit = PlaneFit(Points=shift_paths)  # -> Plane, Deviation
weighted_average_3 = WeightedAverage(Input=evaluate_surface_2.Point, Weights=number_3)
plane_origin_2 = PlaneOrigin(Base=plane_fit.Plane, Origin=weighted_average_3)

mesh_area_7 = MeshArea(Mesh=merge_11)  # -> Area, Centroid
element_parameters = ElementParameters(Element=addwall_bycurve)
weighted_average_4 = WeightedAverage(Input=mesh_area_7.Centroid, Weights=mesh_area_7.Area)
panel = Panel(element_parameters)
mesh_closest_point_2 = MeshClosestPoint(Point=mesh_area_7.Centroid, Mesh=merge_11)  # -> Point, Index, Parameter
mesh_eval_2 = MeshEval(Mesh=merge_11, Parameter=mesh_closest_point_2.Parameter)  # -> Point, Normal, Colour
plane_origin_3 = PlaneOrigin(Base=adjust_plane, Origin=weighted_average_4)

# ----
# Compute wall placement
# compute distance to heartplane
# move heartplane to 1 face of wall
# % of error contribution is given
#  by opposite face
# % weight per side
# move new heartplane away according to error+new thickness
wall_faces = Geometry(plane_origin_3)
heart_plane = Geometry(adjust_plane)
shift_paths_2 = ShiftPaths(Data=wall_faces, Offset=-1)
path_mapper_3 = PathMapper(heart_plane, source="{A}", target="{path_index}")
path_mapper_4 = PathMapper(shift_paths_2, source="{A}", target="{path_index}")
area_per_wall_face = Number(merge_11)
average_normal = Geometry(weighted_average_2)
list_length_5 = ListLength(List=shift_paths_2)
mass_addition_2 = MassAddition(Input=area_per_wall_face)  # -> Result, PartialResults
duplicate_data = DuplicateData(Data=average_normal, Number=list_length_5, Order=True)  # -> simplify(graft(Data))
duplicate_data_2 = DuplicateData(Data=heart_plane, Number=list_length_5, Order=True)  # -> simplify(graft(Data))
wall_faces_points = Geometry(mesh_area_7.Centroid)
shift_paths_3 = ShiftPaths(Data=mass_addition_2.Result, Offset=-1)
plane_closest_point_2 = PlaneClosestPoint(Point=wall_faces_points, Plane=duplicate_data_2)  # -> Point, UVPoint, Distance
path_mapper_5 = PathMapper(shift_paths_3, source="{A}", target="{path_index}")
average_4 = Average(Input=plane_closest_point_2.Distance)
multiplication = Multiplication(A=average_4, B=duplicate_data)
move_7 = Move(Geometry=duplicate_data_2, Motion=multiplication)  # -> Geometry, Transform
area_per_wall_face_2 = Number(path_mapper_5)
mass_addition_3 = MassAddition(Input=area_per_wall_face_2)  # -> Result, PartialResults
division = Division(A=area_per_wall_face_2, B=mass_addition_3.Result)
list_item_9 = ListItem(List=division, Index=0, Wrap=True)
list_item_10 = ListItem(List=division, Index=1, Wrap=True)
merge_12 = Merge(Data1=list_item_10, Data2=list_item_9)
shift_paths_4 = ShiftPaths(Data=duplicate_data, Offset=-1)
shift_paths_5 = ShiftPaths(Data=move_7.Geometry, Offset=-1)
list_item_11 = ListItem(List=duplicate_data, Index=0, Wrap=True)
list_item_12 = ListItem(List=shift_paths_5, Index=0, Wrap=True)

# ----
# 1. split by normal
# find potential surface partners
# 1. split by coplanarity
# 1. split by proximity
# 1. split by extrusion (parrallel)
geometry_8 = Geometry(flatten(walls_2))
evaluate_surface_3 = EvaluateSurface(Surface=reparameterize(geometry_8), Point=Point(0.5, 0.5, 0))  # -> Point, expr("abs(x)", Normal), Frame

mesh_closest_point_3 = MeshClosestPoint(Point=mesh_area.Centroid, Mesh=geometry_8)  # -> Point, Index, Parameter
mesh_eval_3 = MeshEval(Mesh=geometry_8, Parameter=mesh_closest_point_3.Parameter)  # -> Point, Normal, Colour

brep_edges_2 = BrepEdges(Brep=mesh_eval_3.Point)  # -> Naked, Interior, NonManifold
bounding_box_5 = BoundingBox(Content=graft(geometry_8), Plane=graft(mesh_eval_3.Normal))  # -> flatten(Box), Box_2
surface_closest_point = SurfaceClosestPoint(Point=simplify(graft(mesh_eval_3.Normal)), Surface=simplify(geometry_8))  # -> Point, UVPoint, Distance
join_curves_2 = JoinCurves(Curves=brep_edges_2.Naked, Preserve=False)
deconstruct_brep_2 = DeconstructBrep(Brep=bounding_box_5.Box)  # -> Faces, Edges, Vertices
angle = Angle(VectorA=graft(mesh_eval_3.Colour), VectorB=mesh_eval_3.Normal)  # -> Angle, Reflex
smaller_than_2 = SmallerThan(FirstNumber=surface_closest_point.Distance, SecondNumber=Slider(0.25, range=0..2))  # -> simplify(SmallerThan), OrEqualTo
number_4 = Number(deconstruct_brep_2.Faces)
length_3 = Length(Curve=join_curves_2)
sort_list_6 = SortList(Keys=number_4, ValuesValuesA=deconstruct_brep_2.Faces)  # -> Keys, reverse(ValuesValuesA)
smaller_than_3 = SmallerThan(FirstNumber=angle.Angle, SecondNumber=Slider(0.3, range=0..1))  # -> simplify(SmallerThan), OrEqualTo
sort_list_7 = SortList(Keys=length_3, ValuesValuesA=join_curves_2)  # -> reverse(Keys), reverse(ValuesValuesA)
list_item_13 = ListItem(List=sort_list_6.ValuesValuesA, Index=0, Wrap=True)  # -> flatten(Item)
# idee: extrusion in relatie tot hoogte wall! er moet op verschillende schaal gewerkt worden!!!
# idee predictors: gebruik de aanwezigheid van clutter als feature
extrude = Extrude(Base=list_item_13, Direction=expr("x*2", mesh_eval_3.Normal))
move_8 = Move(Geometry=extrude, Motion=expr("-x", mesh_eval_3.Normal))  # -> Geometry, Transform
point_in_breps = PointInBreps(Brep=graft(move_8.Geometry), Point=mesh_eval_3.Point, Strict=False)  # -> simplify(Inside), Index
list_item_14 = ListItem(List=join_curves_2, Index=0, Wrap=True)  # -> simplify(Item)
curve_proximity = CurveProximity(CurveA=list_item_14, CurveB=flatten(list_item_14))  # -> PointA, PointB, Distance
smaller_than_4 = SmallerThan(FirstNumber=curve_proximity.Distance, SecondNumber=Slider(1, range=0..5))  # -> SmallerThan, OrEqualTo
gate_majority = GateMajority(A=smaller_than_2.SmallerThan, B=smaller_than_4.SmallerThan, C=point_in_breps.Inside)
gate_and_2 = GateAnd(A=smaller_than_3.SmallerThan, B=gate_majority)
dispatch_8 = Dispatch(List=geometry_8, DispatchPattern=gate_and_2)  # -> ListA, ListB
clean_tree_2 = CleanTree(RemoveNulls=True, RemoveInvalid=True, RemoveEmpty=True, Tree=dispatch_8.ListA)

tree_branch_3 = TreeBranch(Tree=simplify(graft(list_item_13)), Path=number_slider_2, MaintainPaths=True)

# ----
# Create + filter potential bounding boxes walls
# filter boxes by volume/surface ratio
# calc ratio of area BB surf vs volume <1.5
# extract BB surf
# take largest  bounding box size
# split boxes in directions
# use largest surf as basis for bounding box
number_5 = Number(clean_tree_2)
sort_list_8 = SortList(Keys=number_5, ValuesValuesA=clean_tree_2)  # -> Keys, reverse(ValuesValuesA)
list_item_15 = ListItem(List=sort_list_8.ValuesValuesA, Index=0, Wrap=True)
evaluate_surface_4 = EvaluateSurface(Surface=reparameterize(list_item_15), Point=Point(0.5, 0.5, 0))  # -> Point, expr("abs(x)", Normal), Frame
bounding_box_6 = BoundingBox(Content=clean_tree_2, Plane=evaluate_surface_4.Frame, UnionBox=True)  # -> flatten(Box), Box_2
deconstruct_brep_3 = DeconstructBrep(Brep=bounding_box_6.Box)  # -> simplify(Faces), Edges, Vertices
evaluate_surface_5 = EvaluateSurface(Surface=reparameterize(deconstruct_brep_3.Faces), Point=Point(0.5, 0.5, 0))  # -> Point, expr("abs(x)", Normal), Frame
# cluster walls
box_properties_2 = BoxProperties(Box=bounding_box_6.Box)  # -> Center, Diagonal, Area, Volume, Degeneracy
angle_2 = Angle(VectorA=evaluate_surface_5.Normal, VectorB=evaluate_surface_4.Normal)  # -> Angle, Reflex
smaller_than_5 = SmallerThan(FirstNumber=angle_2.Angle, SecondNumber=0.1)  # -> SmallerThan, OrEqualTo
dispatch_9 = Dispatch(List=deconstruct_brep_3.Faces, DispatchPattern=smaller_than_5.SmallerThan)  # -> ListA, ListB
list_item_16 = ListItem(List=dispatch_9.ListA, Index=0, Wrap=True)
number_6 = Number(flatten(list_item_16))
division_2 = Division(A=box_properties_2.Volume, B=number_6)
smaller_than_6 = SmallerThan(FirstNumber=division_2, SecondNumber=Slider(1.5, range=0..10))  # -> SmallerThan, OrEqualTo
dispatch_10 = Dispatch(List=flatten(evaluate_surface_4.Normal), DispatchPattern=smaller_than_6.SmallerThan)  # -> ListA, ListB
dispatch_11 = Dispatch(List=bounding_box_6.Box, DispatchPattern=smaller_than_6.SmallerThan)  # -> ListA, ListB
closest_point = ClosestPoint(Point=dispatch_10.ListA, Cloud=[Point(1, 0, 0), Point(0, 1, 0), Point(0, 0, 1)])  # -> ClosestPoint, CPIndex, Distance
geometry_9 = Geometry(dispatch_11.ListA)
sift_pattern = SiftPattern(List=geometry_9, SiftPattern=closest_point.CPIndex)  # -> Output0, Output1
entwine_2 = Entwine(Branch00=sift_pattern.Output0, Branch01=sift_pattern.Output1, FlattenInputs=True)
clean_tree_3 = CleanTree(RemoveNulls=True, RemoveInvalid=True, RemoveEmpty=True, Tree=entwine_2)
box_properties_3 = BoxProperties(Box=clean_tree_3)  # -> Center, Diagonal, Area, Volume, Degeneracy
scale_2 = Scale(Geometry=clean_tree_3, Center=box_properties_3.Center, Factor=1.2)  # -> Geometry, Transform
sort_list_9 = SortList(Keys=box_properties_3.Volume, ValuesGeometry=scale_2.Geometry, ValuesPoints=box_properties_3.Center)  # -> reverse(Keys), reverse(ValuesGeometry), reverse(ValuesPoints)
point_in_breps_2 = PointInBreps(Brep=sort_list_9.ValuesGeometry, Point=sort_list_9.ValuesPoints, Strict=False)  # -> Inside, Index
sort_list_10 = SortList(Keys=point_in_breps_2.Index)  # -> Keys, ValuesValuesA
delete_consecutive_3 = DeleteConsecutive(Set=sort_list_10.Keys, Wrap=False)  # -> Set, Count
list_item_17 = ListItem(List=sort_list_9.ValuesGeometry, Index=delete_consecutive_3.Set, Wrap=True)  # -> simplify(Item)
box_properties_4 = BoxProperties(Box=list_item_17)  # -> Center, Diagonal, Area, Volume, Degeneracy
scale_3 = Scale(Geometry=list_item_17, Center=box_properties_4.Center, Factor=0.833)  # -> Geometry, Transform

tree_branch_4 = TreeBranch(Tree=clean_tree_2, Path=number_slider_2, MaintainPaths=True)

# ----
# Group walls per bounding box
surf = Geometry(geometry_8)
evaluate_surface_6 = EvaluateSurface(Surface=reparameterize(surf), Point=Point(0.5, 0.5, 0))  # -> Point, expr("abs(x)", Normal), Frame
explode_tree_3 = ExplodeTree(Data=scale_3.Geometry)  # -> Branch0, Branch1, Branch2, Branch3, Branch4
point_in_breps_3 = PointInBreps(Brep=explode_tree_3.Branch1, Point=evaluate_surface_6.Point, Strict=False)  # -> Inside, Index
point_in_breps_4 = PointInBreps(Brep=explode_tree_3.Branch2, Point=evaluate_surface_6.Point, Strict=True)  # -> Inside, Index
point_in_breps_5 = PointInBreps(Brep=explode_tree_3.Branch0, Point=evaluate_surface_6.Point, Strict=False)  # -> Inside, Index
geometry_10 = Geometry(surf)
dispatch_12 = Dispatch(List=point_in_breps_4.Inside, DispatchPattern=point_in_breps_4.Inside)  # -> ListA, ListB
dispatch_13 = Dispatch(List=point_in_breps_3.Index, DispatchPattern=point_in_breps_3.Inside)  # -> ListA, ListB
dispatch_14 = Dispatch(List=point_in_breps_5.Index, DispatchPattern=point_in_breps_5.Inside)  # -> ListA, ListB
dispatch_15 = Dispatch(List=geometry_10, DispatchPattern=point_in_breps_5.Inside)  # -> ListA, ListB
dispatch_16 = Dispatch(List=geometry_10, DispatchPattern=point_in_breps_3.Inside)  # -> ListA, ListB
dispatch_17 = Dispatch(List=geometry_10, DispatchPattern=point_in_breps_4.Inside)  # -> ListA, ListB
construct_point_3 = ConstructPoint(XCoordinate=0, YCoordinate=expr("x+1000", dispatch_13.ListA), ZCoordinate=0)
construct_point_4 = ConstructPoint(XCoordinate=0, YCoordinate=0, ZCoordinate=dispatch_12.ListA)
construct_point_5 = ConstructPoint(XCoordinate=dispatch_14.ListA, YCoordinate=0, ZCoordinate=0)
# method1: grouping is normal dependant!
merge_13 = Merge(Data1=dispatch_15.ListA, Data2=dispatch_16.ListA, Data3=dispatch_17.ListA)  # -> flatten(Result)
merge_14 = Merge(Data1=construct_point_5, Data2=construct_point_3, Data3=construct_point_4)  # -> flatten(Result)
point_groups_2 = PointGroups(Points=merge_14, Distance=0.1)  # -> Groups, simplify(Indices)
list_item_18 = ListItem(List=merge_13, Index=point_groups_2.Indices, Wrap=True)  # -> simplify(Item)

# ----
# method2: normal independant clustering
bounding_boxes = Geometry(flatten(list_item_17))
surf_2 = Geometry(geometry_8)
box_properties_5 = BoxProperties(Box=bounding_boxes)  # -> Center, Diagonal, Area, Volume, Degeneracy
sort_list_11 = SortList(Keys=box_properties_5.Volume, ValuesValuesA=bounding_boxes)  # -> Keys, reverse(ValuesValuesA)
mesh_area_8 = MeshArea(Mesh=surf_2)  # -> Area, Centroid
point_in_breps_6 = PointInBreps(Brep=sort_list_11.ValuesValuesA, Point=mesh_area_8.Centroid, Strict=False)  # -> Inside, Index
construct_point_6 = ConstructPoint(XCoordinate=point_in_breps_6.Index, YCoordinate=0, ZCoordinate=0)
point_groups_3 = PointGroups(Points=construct_point_6, Distance=0.5)  # -> simplify(Groups), simplify(Indices)
list_item_19 = ListItem(List=surf_2, Index=point_groups_3.Indices, Wrap=True)
number_7 = Number(list_item_19)
sort_list_12 = SortList(Keys=number_7, ValuesValuesA=list_item_19)  # -> Keys, reverse(ValuesValuesA)

# ----
# filter surf that dont belong
# sort by area
evaluate_surface_7 = EvaluateSurface(Surface=reparameterize(list_item_18), Point=Point(0.5, 0.5, 0))  # -> Point, expr("abs(x)", Normal), Frame
number_8 = Number(list_item_18)
sort_list_13 = SortList(Keys=number_8, ValuesValuesA=list_item_18, ValuesA=evaluate_surface_7.Normal)  # -> reverse(Keys), reverse(ValuesValuesA), reverse(ValuesA)
list_item_20 = ListItem(List=sort_list_13.ValuesA, Index=0, Wrap=True)
angle_3 = Angle(VectorA=list_item_20, VectorB=sort_list_13.ValuesA)  # -> Angle, Reflex
smaller_than_7 = SmallerThan(FirstNumber=angle_3.Angle, SecondNumber=0.5)  # -> SmallerThan, OrEqualTo
dispatch_18 = Dispatch(List=sort_list_13.ValuesValuesA, DispatchPattern=smaller_than_7.SmallerThan)  # -> ListA, ListB

tree_branch_5 = TreeBranch(Tree=list_item_19, Path=Slider(0, range=0..130), MaintainPaths=True)

# ----
# flip all surfaces in same direction
# (given largest surface)
list_item_21 = ListItem(List=sort_list_12.ValuesValuesA, Index=0, Wrap=True)
flip = Flip(Surface=sort_list_12.ValuesValuesA, Guide=list_item_21)  # -> simplify(Surface), Result
path_mapper_6 = PathMapper(flip.Surface, source="{A;B}", target="{path_index}")
geometry_11 = Geometry(flip.Surface)

# ----
# filter walls that contain only horizontal surf.
wall_surf_3 = Geometry(geometry_11)
evaluate_surface_8 = EvaluateSurface(Surface=reparameterize(wall_surf_3), Point=Point(0.5, 0.5, 0))  # -> Point, expr("abs(x)", Normal), Frame
average_5 = Average(Input=evaluate_surface_8.Normal)
deconstruct_vector = DeconstructVector(Vector=average_5)  # -> XComponent, YComponent, ZComponent
smaller_than_8 = SmallerThan(FirstNumber=deconstruct_vector.ZComponent, SecondNumber=0.6)  # -> SmallerThan, OrEqualTo
dispatch_19 = Dispatch(List=wall_surf_3, DispatchPattern=smaller_than_8.SmallerThan)  # -> ListA, ListB
geometry_12 = Geometry(dispatch_19.ListB)
clean_tree_4 = CleanTree(RemoveNulls=True, RemoveInvalid=True, RemoveEmpty=True, Tree=dispatch_19.ListA)

tree_branch_6 = TreeBranch(Tree=simplify(graft(list_item_13)), Path=number_slider_3, MaintainPaths=True)

# ----
# Compute Wall contour
# data needs to be duplicated because
# you cannnot merge 1 face
#  (need 2 at least)
wall_surf_4 = Geometry(merge_11)
shift_paths_6 = ShiftPaths(Data=wall_surf_4, Offset=-1)
untrim = Untrim(Surface=shift_paths_6)

# ----
# Compute Wall contour 2
# (other is unreliable)
# data needs to be duplicated because
# you cannnot merge 1 face
#  (need 2 at least)
wall_surf_5 = Geometry(merge_11)
shift_paths_7 = ShiftPaths(Data=wall_surf_5, Offset=-1)

# ----
# create solid Wall
normal = Geometry(weighted_average_2)

# ----
# Place Geometry back in place
series = Series(Start=0, Step=6, Count=tree_statistics.Count)  # disabled
list_length_6 = ListLength(List=series)  # -> expr("x-1", Length); disabled
number_9 = Number(series)  # disabled
number_10 = Number(series)  # disabled
number_11 = Number(reverse(series))  # disabled
cull_index = CullIndex(List=number_10, Indices=0, Wrap=True)  # -> simplify(graft(List)); disabled
list_item_22 = ListItem(List=number_11, Index=0, Wrap=True)  # disabled
cull_index_2 = CullIndex(List=number_9, Indices=list_length_6, Wrap=True)  # -> simplify(graft(List)); disabled
construct_domain = ConstructDomain(DomainStart=list_item_22, DomainEnd=999)  # -> flatten(Domain); disabled
construct_domain_2 = ConstructDomain(DomainStart=cull_index_2, DomainEnd=cull_index)  # -> flatten(Domain); disabled
merge_15 = Merge(Data1=construct_domain_2, Data2=construct_domain)  # disabled

# ----
# compute Wall thickness
# reverse list of sampled points
# compute distance between points and best oposite wall plane
# Cluster thicknesses and appoint new thickness
# give single walls 1cm thickness (else problems)
merge_16 = Merge(Data1=subtraction_2, Data2=mass_addition.Result)
geometry_13 = Geometry(reverse(sort_list_4.ValuesValuesA))
partition_list_2 = PartitionList(List=geometry_13, Size=merge_16)
wall_clustering = Slider(0.03, range=0..0.1)
merge_17 = Merge(Data1=partition_list_2, Data2=graft(dispatch_6.ListA))
number_12 = Number(expr("x+10", merge_17))
mass_addition_4 = MassAddition(Input=number_12)  # -> Result, PartialResults
shift_paths_8 = ShiftPaths(Data=mass_addition_4.Result, Offset=-1)
divide_surface_2 = DivideSurface(Surface=merge_17, UCount=number_12, VCount=number_12)  # -> Points, Normals, Parameters

face_normals = FaceNormals(Mesh=partition_list_2)  # -> Centers, Normals

# ----
# Cloudcompare geometry
# reconstructed
# initial
geometry_14 = Geometry(geometry_8)  # disabled

shift_paths_9 = ShiftPaths(Data=face_normals.Centers, Offset=-2)
plane_closest_point_3 = PlaneClosestPoint(Point=shift_paths_9, Plane=plane_origin_3)  # -> Point, UVPoint, expr("abs(x)", Distance)
average_6 = Average(Input=plane_closest_point_3.Distance)
shift_paths_10 = ShiftPaths(Data=average_6, Offset=-1)
weighted_average_5 = WeightedAverage(Input=shift_paths_10, Weights=expr("sqrt(x)", shift_paths_8))
construct_point_7 = ConstructPoint(XCoordinate=flatten(weighted_average_5), YCoordinate=0, ZCoordinate=0)
point_groups_4 = PointGroups(Points=construct_point_7, Distance=wall_clustering)  # -> Groups, Indices
average_7 = Average(Input=point_groups_4.Groups)  # -> flatten(ArithmeticMean)
deconstruct_6 = Deconstruct(Point=expr("round(x,2)", average_7))  # -> XComponent, YComponent, ZComponent
sort_list_14 = SortList(Keys=deconstruct_6.XComponent)  # -> Keys, ValuesValuesA

merge_18 = Merge(Data1=sort_list_14.Keys, Data2=sort_list_14.Keys)

consecutive_domains_2 = ConsecutiveDomains(Numbers=merge_18, Additive=False)
find_domain_4 = FindDomain(Domains=consecutive_domains_2, Number=weighted_average_5, Strict=False)  # -> Index, Neighbour
list_item_23 = ListItem(List=sort_list_14.Keys, Index=find_domain_4.Index, Wrap=True)
clustered_wall_thickness = Number(list_item_23)
equality_5 = Equality(FirstNumber=clustered_wall_thickness, SecondNumber=0)  # -> Equality, Inequality
dispatch_20 = Dispatch(List=clustered_wall_thickness, DispatchPattern=equality_5.Equality)  # -> ListA, ListB
number_13 = Number(expr("x+0.01", dispatch_20.ListA))
merge_19 = Merge(Data1=number_13, Data2=dispatch_20.ListB)

real_thickness_d = Number(simplify(weighted_average_5))
thickness_d = Number(simplify(merge_19))
path_mapper_7 = PathMapper(thickness_d, source="{A}", target="{path_index}")
path_mapper_8 = PathMapper(real_thickness_d, source="{A}", target="{path_index}")
real_thickness_d_2 = Number(real_thickness_d)
thickness_d_2 = Number(thickness_d)
thickness = Number(expr("0.5*x", thickness_d_2))
subtraction_3 = Subtraction(A=real_thickness_d_2, B=thickness_d_2)
duplicate_data_3 = DuplicateData(Data=thickness, Number=list_length_5, Order=True)  # -> simplify(Data)
multiplication_2 = Multiplication(A=subtraction_3, B=merge_12)
list_item_24 = ListItem(List=multiplication_2, Index=0, Wrap=True)
list_item_25 = ListItem(List=thickness, Index=0, Wrap=True)
multiplication_3 = Multiplication(A=list_item_24, B=list_item_11)
multiplication_4 = Multiplication(A=list_item_25, B=list_item_11)
addition = Addition(A=multiplication_3, B=multiplication_4)
move_9 = Move(Geometry=list_item_12, Motion=addition)  # -> NewHeartplane, Transform

heart_plane_2 = Geometry(move_9.NewHeartplane)
project_2 = Project(Geometry=untrim, Plane=heart_plane_2)  # -> Geometry, Transform
duplicate_data_4 = DuplicateData(Data=project_2.Geometry, Number=2, Order=True)  # -> simplify(Data)
region_union = RegionUnion(Curves=duplicate_data_4, Plane=heart_plane_2)  # -> simplify(Result)

heart_plane_3 = Geometry(move_9.NewHeartplane)
project_3 = Project(Geometry=shift_paths_7, Plane=heart_plane_3)  # -> Geometry, Transform
brep_edges_3 = BrepEdges(Brep=project_3.Geometry)  # -> Naked, Interior, NonManifold
shift_paths_11 = ShiftPaths(Data=brep_edges_3.Naked, Offset=-1)
boundary_surfaces_2 = BoundarySurfaces(Edges=region_union)

list_length_7 = ListLength(List=boundary_surfaces_2)
thickness_2 = Number(expr("x/2", simplify(merge_19)))
duplicate_data_5 = DuplicateData(Data=normal, Number=list_length_7, Order=True)  # -> simplify(Normal)
duplicate_data_6 = DuplicateData(Data=thickness_2, Number=list_length_7, Order=True)  # -> simplify(Thick2)
duplicate_data_7 = DuplicateData(Data=merge_19, Number=list_length_7, Order=True)  # -> simplify(Thick)
multiplication_5 = Multiplication(A=duplicate_data_5, B=duplicate_data_6)
multiplication_6 = Multiplication(A=duplicate_data_5, B=duplicate_data_7)
move_10 = Move(Geometry=boundary_surfaces_2, Motion=expr("-x", multiplication_5))  # -> Geometry, Transform
extrude_2 = Extrude(Base=move_10.Geometry, Direction=multiplication_6)  # -> simplify(Extrusion)
move_11 = Move(Geometry=move_10.Geometry, Motion=multiplication_6)  # -> Geometry, Transform

geometry_15 = Geometry(move_10.Geometry)  # disabled
geometry_16 = Geometry(move_11.Geometry)  # disabled
merge_20 = Merge(Data1=geometry_15, Data2=geometry_16)  # -> simplify(Result); disabled
geometry_17 = Geometry(merge_20)  # disabled

cap_holes = CapHoles(Brep=extrude_2)  # -> simplify(flatten(Brep)); disabled
geometry_18 = Geometry(geometry_17)  # disabled
bounding_box_7 = BoundingBox(Content=geometry_18, Plane=PlaneXY(0, 0, 0), UnionBox=False)  # -> Box, Box_2; disabled
box_properties_6 = BoxProperties(Box=bounding_box_7.Box)  # -> Center, Diagonal, Area, Volume, Degeneracy; disabled
deconstruct_7 = Deconstruct(Point=box_properties_6.Center)  # -> XComponent, YComponent, ZComponent; disabled
find_domain_5 = FindDomain(Domains=merge_15, Number=deconstruct_7.ZComponent, Strict=False)  # -> Index, Neighbour; disabled
sort_list_15 = SortList(Keys=find_domain_5.Index, ValuesValuesA=flatten(bounding_box_7.Box))  # -> reverse(Keys), reverse(ValuesValuesA); disabled
construct_point_8 = ConstructPoint(XCoordinate=sort_list_15.Keys, YCoordinate=0, ZCoordinate=0)  # disabled
point_groups_5 = PointGroups(Points=flatten(construct_point_8), Distance=0.5)  # -> Groups, Indices; disabled
list_item_26 = ListItem(List=flatten(geometry_18), Index=point_groups_5.Indices, Wrap=True)  # disabled
explode_tree_4 = ExplodeTree(Data=list_item_26)  # -> Branch0, Branch1, Branch2, Branch3, Branch4, Branch5; disabled
geometry_19 = Geometry(explode_tree_4.Branch2)  # disabled
geometry_20 = Geometry(explode_tree_4.Branch1)  # disabled
geometry_21 = Geometry(explode_tree_4.Branch3)  # disabled
geometry_22 = Geometry(explode_tree_4.Branch4)  # disabled
move_12 = Move(Geometry=geometry_20, Motion=Vector(0, 0, -6))  # -> Geometry, Transform; disabled
move_13 = Move(Geometry=geometry_21, Motion=Vector(0, 0, -18))  # -> Geometry, Transform; disabled
move_14 = Move(Geometry=geometry_19, Motion=Vector(0, 0, -12))  # -> Geometry, Transform; disabled
move_15 = Move(Geometry=geometry_22, Motion=Vector(0, 0, -24))  # -> Geometry, Transform; disabled
geometry_23 = Geometry(explode_tree_4.Branch0)  # disabled
merge_21 = Merge(Data1=geometry_23, Data2=move_12.Geometry, Data3=move_14.Geometry, Data4=move_13.Geometry, Data5=move_15.Geometry)  # disabled

panel_2 = Panel(extrude_2)
tree_branch_7 = TreeBranch(Tree=extrude_2, Path=number_slider_3, MaintainPaths=True)
