# Grasshopper definition revitinside1.gh (Grasshopper 1.0.7)
# plug-ins: Scan2BIM

# ----
# INPUT
mesh = Mesh([<mesh referenced from the Rhino model> x6])
mesh_2 = Mesh([<mesh referenced from the Rhino model> x5])
mesh_3 = Mesh([<mesh referenced from the Rhino model> x4])
entwine = Entwine(Branch00=mesh_3, Branch01=mesh_2, Branch02=mesh, FlattenInputs=True)  # -> simplify(Result)
mesh_4 = Mesh(simplify(graft(entwine)))

# ----
# 0.compute opossing points  for multiple walls
# EDGE valid
# v(nsi) . v(psi,psj) > 0.75
# edges
# dotproduct (abs)
# v(nsj) . v(psi,psj) > 0.75
# dotproduct (signed)
# v (nsi)
# (psi)
populate_geometry = PopulateGeometry(Geometry=mesh_4, Count=expr("x", mesh_4), Seed=1)  # -> simplify(Population)
shift_paths = ShiftPaths(Data=populate_geometry, Offset=-1)
number_slider = Slider(15, range=0..100)
list_length = ListLength(List=populate_geometry)
closest_points = ClosestPoints(Point=shift_paths, Cloud=shift_paths, Count=number_slider)  # -> ClosestPoint, CPIndex, Distance
shift_paths_2 = ShiftPaths(Data=list_length, Offset=-1)
line = Line(StartPoint=graft(shift_paths), EndPoint=closest_points.ClosestPoint)
consecutive_domains = ConsecutiveDomains(Numbers=shift_paths_2, Additive=True)  # -> simplify(Domains)
shift_paths_3 = ShiftPaths(Data=closest_points.CPIndex, Offset=-1)
find_domain = FindDomain(Domains=consecutive_domains, Number=shift_paths_3, Strict=False)  # -> expr("x+1", Index), Neighbour
list_length_2 = ListLength(List=populate_geometry)
list_item = ListItem(List=entwine, Index=find_domain.Index, Wrap=True)  # -> graft(Item)
duplicate_data = DuplicateData(Data=mesh_4, Number=list_length_2, Order=True)  # -> simplify(graft(Data))
shift_paths_4 = ShiftPaths(Data=list_item, Offset=-1)
shift_paths_5 = ShiftPaths(Data=list_length, Offset=-1)
mesh_closest_point = MeshClosestPoint(Point=graft(populate_geometry), Mesh=duplicate_data)  # -> Point, Index, Parameter
multiplication = Multiplication(A=shift_paths_5, B=number_slider)
partition_list = PartitionList(List=shift_paths_4, Size=multiplication)  # -> simplify(graft(Chunks))
shift_paths_6 = ShiftPaths(Data=line, Offset=-1)
mesh_eval = MeshEval(Mesh=duplicate_data, Parameter=mesh_closest_point.Parameter)  # -> Point, Normal, Colour
mesh_closest_point_2 = MeshClosestPoint(Point=graft(closest_points.ClosestPoint), Mesh=list_item)  # -> Point, Index, Parameter
shift_paths_7 = ShiftPaths(Data=mesh_eval.Point, Offset=-2)  # -> graft(Data)
shift_paths_8 = ShiftPaths(Data=mesh_eval.Normal, Offset=-2)  # -> graft(Data)
mesh_eval_2 = MeshEval(Mesh=partition_list, Parameter=mesh_closest_point_2.Parameter)  # -> Point, Normal, Colour
duplicate_data_2 = DuplicateData(Data=shift_paths_8, Number=number_slider, Order=True)  # -> simplify(Data)
dot_product = DotProduct(VectorA=simplify(graft(duplicate_data_2)), VectorB=simplify(graft(line)), Unitize=True)
dot_product_2 = DotProduct(VectorA=simplify(graft(duplicate_data_2)), VectorB=simplify(graft(line)), Unitize=False)
duplicate_data_3 = DuplicateData(Data=shift_paths_7, Number=number_slider, Order=True)  # -> simplify(Data)
shift_paths_9 = ShiftPaths(Data=dot_product, Offset=-2)
shift_paths_10 = ShiftPaths(Data=dot_product_2, Offset=-2)
shift_paths_11 = ShiftPaths(Data=mesh_eval_2.Normal, Offset=-2)
dot_product_3 = DotProduct(VectorA=simplify(graft(shift_paths_11)), VectorB=simplify(graft(shift_paths_6)), Unitize=True)
dot_product_4 = DotProduct(VectorA=simplify(graft(shift_paths_11)), VectorB=simplify(graft(shift_paths_6)), Unitize=False)
shift_paths_12 = ShiftPaths(Data=dot_product_3, Offset=-1)
shift_paths_13 = ShiftPaths(Data=dot_product_4, Offset=-1)
number = Number(expr("abs(x)", shift_paths_12))
number_2 = Number(expr("abs(x)", shift_paths_9))
number_3 = Number(expr("abs(x)", shift_paths_13))
number_4 = Number(expr("abs(x)", shift_paths_10))
larger_than = LargerThan(FirstNumber=number_2, SecondNumber=Slider(0.75, range=0..1))  # -> simplify(LargerThan), OrEqualTo
larger_than_2 = LargerThan(FirstNumber=number, SecondNumber=Slider(0.75, range=0..1))  # -> LargerThan, OrEqualTo
gate_and = GateAnd(A=larger_than.LargerThan, B=larger_than_2.LargerThan)
shift_paths_14 = ShiftPaths(Data=duplicate_data_2, Offset=-1)
dispatch = Dispatch(List=simplify(shift_paths_6), DispatchPattern=gate_and)  # -> ListA, ListB
dispatch_2 = Dispatch(List=simplify(number_4), DispatchPattern=gate_and)  # -> ListA, ListB
dispatch_3 = Dispatch(List=simplify(number_3), DispatchPattern=gate_and)  # -> ListA, ListB
dispatch_4 = Dispatch(List=simplify(shift_paths_10), DispatchPattern=gate_and)  # -> ListA, ListB
shift_paths_15 = ShiftPaths(Data=duplicate_data_3, Offset=-1)
dispatch_5 = Dispatch(List=simplify(shift_paths_14), DispatchPattern=gate_and)  # -> ListA, ListB
dispatch_6 = Dispatch(List=simplify(shift_paths_15), DispatchPattern=gate_and)  # -> ListA, ListB
merge = Merge(Data1=graft(dispatch_2.ListA), Data2=graft(dispatch_3.ListA))
geometry = Geometry(dispatch.ListA)
average = Average(Input=merge)
shift_paths_16 = ShiftPaths(Data=average, Offset=-1)

# ----
# compute Mode thickness
interval = Slider(0.02, range=0..0.1)
bounds = Bounds(Numbers=shift_paths_16)
deconstruct_domain = DeconstructDomain(Domain=bounds)  # -> Start, End
subtraction = Subtraction(A=deconstruct_domain.End, B=deconstruct_domain.Start)
evaluate = Evaluate(Expression="round(i/interval,0)", I=subtraction, interval=interval)
histogram_maker = HistogramMaker(data=shift_paths_16, divs=evaluate)  # -> out, simplify(histogram); inputs data: list, divs: Int32
# ---------- histogram_maker: C# usings ----------
using System.IO;
using System.Linq;
using System.Data;
using System.Drawing;
using System.Reflection;
using System.Windows.Forms;
using System.Xml;
using System.Xml.Linq;
using System.Runtime.InteropServices;

using Rhino.DocObjects;
using Rhino.Collections;
using GH_IO;
using GH_IO.Serialization;
# ---------- histogram_maker: C# ----------
    //find min and max of each

    double minsofar = Convert.ToDouble(data[0]);
    double maxsofar = Convert.ToDouble(data[0]);

    foreach (object xx in data)
    {
      minsofar = Math.Min(minsofar, Convert.ToDouble(xx));
      maxsofar = Math.Max(maxsofar, Convert.ToDouble(xx));
    }

    //assign each value a category, 0 being the lowest group, 100 being the highest
    int[] cats = new int[divs + 1];
    for (int i = 0; i < cats.Length; i++) cats[i] = 0;

    for (int i = 0; i < data.Count; i++)
    {
      double cat = divs * ((Convert.ToDouble(data[i]) - minsofar) / (maxsofar - minsofar));
      Math.Round(Convert.ToDouble(data[i]) + divs/2, 0);
      cats[(int) cat]++;
    }

    histogram = cats;
# ---------- end histogram_maker ----------
cull_index = CullIndex(List=histogram_maker.histogram, Indices=[0, 1, 2], Wrap=True)
average_2 = Average(Input=shift_paths_16)
c_script = CSharpScript(histogram=cull_index)  # -> out, i; inputs histogram: list of Int32
# ---------- c_script: C# usings ----------
using System.Linq;
# ---------- c_script: C# ----------
    List<int> sortedhistogram = new List<int>(histogram.OrderByDescending(x => x));

    int peak1 = sortedhistogram[0];
    i = histogram.FindIndex(x => x == peak1);

    //    peaki = Math.Sqrt(histogram[i_p1]);
    //    peakj = Math.Sqrt(histogram[i_p2]);
    // peaki = (double) (histogram[i_p1]) / peak1;
# ---------- end c_script ----------
number_5 = Number(3)
evaluate_2 = Evaluate(
    Expression="(i-offset)*interval+startdomain+0.5*interval",
    i=c_script.i,
    offset=number_5,
    interval=interval,
    startdomain=deconstruct_domain.Start)
number_6 = Number(expr("round(x,2)", simplify(evaluate_2)))

# ----
# Compute hearthline
# create C
# create P
project = Project(Geometry=dispatch_6.ListA, Plane=PlaneXY(0, 0, 0))  # -> Geometry, Transform
evaluate_3 = Evaluate(Expression="n*0.5*d*dotproduct/abs(dotproduct)", n=dispatch_5.ListA, d=number_6, dotproduct=dispatch_4.ListA)
move = Move(Geometry=project.Geometry, Motion=evaluate_3)  # -> Geometry, Transform
wallfit = Wallfit(C=move.Geometry, P=project.Geometry, K=Slider(100, range=0..100), T=Slider(0.05, range=0..1), Dw=number_6, W=0.7, N=4)  # -> Hearth_line, InlrNum, Error

vector_display = VectorDisplay(Anchor=dispatch_6.ListA, Vector=dispatch_5.ListA)
