# Grasshopper definition revitinside2.gh (Grasshopper 1.0.7)
# plug-ins: EleFront, Scan2BIM

mesh = Mesh([<mesh referenced from the Rhino model> x240])
get_rhino_attributes = GetRhinoAttributes(Geometry=mesh)  # -> Name, Layer, Color
create_set = CreateSet(List=get_rhino_attributes.Name)  # -> Set, Map
sort_list = SortList(Keys=create_set.Set)  # -> Keys, ValuesA
filter_by_name = FilterByName(Geometry=mesh, Name=create_set.Set)  # -> simplify(Geometry)
panel = Panel(sort_list.Keys)
tree_branch = TreeBranch(Tree=filter_by_name, Path=Slider(3, range=0..10), MaintainPaths=True)

# ----
# INPUT
mesh_2 = Mesh([<mesh referenced from the Rhino model> x6])
mesh_3 = Mesh([<mesh referenced from the Rhino model> x2])
mesh_4 = Mesh(tree_branch)
entwine = Entwine(Branch00=mesh_4, Branch01=mesh_3, Branch02=mesh_2, FlattenInputs=True)  # -> simplify(Result)
mesh_5 = Mesh(simplify(filter_by_name))

# ----
# 0.compute opossing points  for multiple walls
# EDGE valid
# v(nsi) . v(psi,psj) > 0.05
# edges
# dotproduct (abs)
# v(nsi) . v(nsj) > 0.75
# dotproduct (signed)
# v (nsi)
# (psi)
populate_geometry = PopulateGeometry(Geometry=mesh_5, Count=expr("2*x", mesh_5), Seed=1)  # -> simplify(Population)
shift_paths = ShiftPaths(Data=populate_geometry, Offset=-1)
number_slider = Slider(15, range=0..100)
list_length = ListLength(List=populate_geometry)
closest_points = ClosestPoints(Point=shift_paths, Cloud=shift_paths, Count=number_slider)  # -> ClosestPoint, CPIndex, Distance
shift_paths_2 = ShiftPaths(Data=list_length, Offset=-1)
line = Line(StartPoint=graft(shift_paths), EndPoint=closest_points.ClosestPoint)
consecutive_domains = ConsecutiveDomains(Numbers=shift_paths_2, Additive=True)  # -> simplify(Domains)
shift_paths_3 = ShiftPaths(Data=closest_points.CPIndex, Offset=-1)
find_domain = FindDomain(Domains=consecutive_domains, Number=shift_paths_3, Strict=False)  # -> expr("x+1", Index), Neighbour
list_length_2 = ListLength(List=populate_geometry)
list_item = ListItem(List=mesh_5, Index=find_domain.Index, Wrap=True)  # -> graft(Item)
duplicate_data = DuplicateData(Data=graft(mesh_5), Number=list_length_2, Order=True)  # -> simplify(graft(Data))
shift_paths_4 = ShiftPaths(Data=list_item, Offset=-1)
shift_paths_5 = ShiftPaths(Data=list_length, Offset=-1)
mesh_closest_point = MeshClosestPoint(Point=graft(populate_geometry), Mesh=duplicate_data)  # -> Point, Index, Parameter
multiplication = Multiplication(A=shift_paths_5, B=number_slider)
partition_list = PartitionList(List=shift_paths_4, Size=multiplication)  # -> simplify(graft(Chunks))
mesh_eval = MeshEval(Mesh=duplicate_data, Parameter=mesh_closest_point.Parameter)  # -> Point, Normal, Colour
mesh_closest_point_2 = MeshClosestPoint(Point=graft(closest_points.ClosestPoint), Mesh=list_item)  # -> Point, Index, Parameter
shift_paths_6 = ShiftPaths(Data=mesh_eval.Point, Offset=-2)  # -> graft(Data)
shift_paths_7 = ShiftPaths(Data=mesh_eval.Normal, Offset=-2)  # -> graft(Data)
mesh_eval_2 = MeshEval(Mesh=partition_list, Parameter=mesh_closest_point_2.Parameter)  # -> Point, Normal, Colour
duplicate_data_2 = DuplicateData(Data=shift_paths_6, Number=number_slider, Order=True)  # -> simplify(Data)
duplicate_data_3 = DuplicateData(Data=shift_paths_7, Number=number_slider, Order=True)  # -> simplify(Data)
shift_paths_8 = ShiftPaths(Data=duplicate_data_3, Offset=-1)
dot_product = DotProduct(VectorA=simplify(graft(duplicate_data_3)), VectorB=simplify(graft(line)), Unitize=False)  # disabled
dot_product_2 = DotProduct(VectorA=simplify(graft(duplicate_data_3)), VectorB=simplify(graft(line)), Unitize=False)
shift_paths_9 = ShiftPaths(Data=dot_product_2, Offset=-2)
shift_paths_10 = ShiftPaths(Data=dot_product, Offset=-2)  # disabled
shift_paths_11 = ShiftPaths(Data=mesh_eval_2.Normal, Offset=-2)
dot_product_3 = DotProduct(VectorA=simplify(graft(shift_paths_11)), VectorB=simplify(graft(shift_paths_8)), Unitize=True)
dot_product_4 = DotProduct(VectorA=simplify(graft(shift_paths_11)), VectorB=simplify(graft(shift_paths_8)), Unitize=True)
shift_paths_12 = ShiftPaths(Data=dot_product_3, Offset=-1)
shift_paths_13 = ShiftPaths(Data=dot_product_4, Offset=-1)
number = Number(expr("abs(x)", shift_paths_12))
number_2 = Number(expr("abs(x)", shift_paths_9))
number_3 = Number(expr("abs(x)", shift_paths_13))
number_4 = Number(expr("abs(x)", shift_paths_10))  # disabled
larger_than = LargerThan(FirstNumber=number_2, SecondNumber=Slider(0.05, range=0..1))  # -> simplify(LargerThan), OrEqualTo
larger_than_2 = LargerThan(FirstNumber=number, SecondNumber=Slider(0.5, range=0..1))  # -> LargerThan, OrEqualTo
shift_paths_14 = ShiftPaths(Data=duplicate_data_3, Offset=-1)
shift_paths_15 = ShiftPaths(Data=duplicate_data_2, Offset=-1)

mesh_closest_point_3 = MeshClosestPoint(Point=graft(populate_geometry), Mesh=duplicate_data)  # -> Point, Index, Parameter
panel_2 = Panel(list_length_2)
vector_display = VectorDisplay(Anchor=mesh_eval.Point, Vector=mesh_eval.Normal)
shift_paths_16 = ShiftPaths(Data=line, Offset=-1)
length = Length(Curve=shift_paths_16)
panel_3 = Panel(number_2)
# |v(psi,psj)| <0.8
smaller_than = SmallerThan(FirstNumber=length, SecondNumber=Slider(1, range=0..1))  # -> SmallerThan, OrEqualTo

gate_and = GateAnd(C=smaller_than.SmallerThan, A=larger_than.LargerThan, B=larger_than_2.LargerThan)
dispatch = Dispatch(List=simplify(number_2), DispatchPattern=gate_and)  # -> ListA, ListB
dispatch_2 = Dispatch(List=simplify(number_3), DispatchPattern=gate_and)  # -> ListA, ListB; disabled
dispatch_3 = Dispatch(List=simplify(shift_paths_9), DispatchPattern=gate_and)  # -> ListA, ListB
dispatch_4 = Dispatch(List=simplify(shift_paths_16), DispatchPattern=gate_and)  # -> ListA, ListB
dispatch_5 = Dispatch(List=simplify(shift_paths_14), DispatchPattern=gate_and)  # -> ListA, ListB
dispatch_6 = Dispatch(List=simplify(shift_paths_15), DispatchPattern=gate_and)  # -> ListA, ListB
merge = Merge(Data1=graft(dispatch.ListA), Data2=graft(dispatch_2.ListA))  # disabled
geometry = Geometry(dispatch_4.ListA)
average = Average(Input=dispatch.ListA)
shift_paths_17 = ShiftPaths(Data=average, Offset=-1)  # disabled

number_5 = Number(expr("abs(x)", dispatch_3.ListA))
division = Division(A=number_5, B=dispatch_3.ListA)
panel_4 = Panel(larger_than_2.LargerThan)
vector_display_2 = VectorDisplay(Anchor=dispatch_6.ListA, Vector=dispatch_5.ListA)

# ----
# Compute hearthline
# create C
# create P
project = Project(Geometry=dispatch_6.ListA, Plane=PlaneXY(0, 0, 0))  # -> Geometry, Transform

# ----
# compute Mode thickness
interval = Slider(0.02, range=0..0.1)
bounds = Bounds(Numbers=dispatch.ListA)
deconstruct_domain = DeconstructDomain(Domain=bounds)  # -> Start, End
subtraction = Subtraction(A=deconstruct_domain.End, B=deconstruct_domain.Start)
evaluate = Evaluate(Expression="round(i/interval,0)", I=subtraction, interval=interval)
histogram_maker = HistogramMaker(data=dispatch.ListA, divs=evaluate)  # -> out, simplify(histogram); inputs data: list, divs: Int32
# ---------- histogram_maker: C# usings ----------
using System.IO;
using System.Linq;
using System.Data;
using System.Drawing;
using System.Reflection;
using System.Windows.Forms;
using System.Xml;
using System.Xml.Linq;
using System.Runtime.InteropServices;

using Rhino.DocObjects;
using Rhino.Collections;
using GH_IO;
using GH_IO.Serialization;
# ---------- histogram_maker: C# ----------
    //find min and max of each

    double minsofar = Convert.ToDouble(data[0]);
    double maxsofar = Convert.ToDouble(data[0]);

    foreach (object xx in data)
    {
      minsofar = Math.Min(minsofar, Convert.ToDouble(xx));
      maxsofar = Math.Max(maxsofar, Convert.ToDouble(xx));
    }

    //assign each value a category, 0 being the lowest group, 100 being the highest
    int[] cats = new int[divs + 1];
    for (int i = 0; i < cats.Length; i++) cats[i] = 0;

    for (int i = 0; i < data.Count; i++)
    {
      double cat = divs * ((Convert.ToDouble(data[i]) - minsofar) / (maxsofar - minsofar));
      Math.Round(Convert.ToDouble(data[i]) + divs/2, 0);
      cats[(int) cat]++;
    }

    histogram = cats;
# ---------- end histogram_maker ----------
cull_index = CullIndex(List=histogram_maker.histogram, Indices=[0, 1, 2], Wrap=True)  # -> simplify(List)
average_2 = Average(Input=dispatch.ListA)
c_script = CSharpScript(histogram=cull_index)  # -> out, simplify(i); inputs histogram: list of Int32
# ---------- c_script: C# usings ----------
using System.Linq;
# ---------- c_script: C# ----------
    List<int> sortedhistogram = new List<int>(histogram.OrderByDescending(x => x));

    int peak1 = sortedhistogram[0];
    i = histogram.FindIndex(x => x == peak1);

    //    peaki = Math.Sqrt(histogram[i_p1]);
    //    peakj = Math.Sqrt(histogram[i_p2]);
    // peaki = (double) (histogram[i_p1]) / peak1;
# ---------- end c_script ----------
number_6 = Number(3)
evaluate_2 = Evaluate(
    Expression="(i+offset)*interval+startdomain+0.5*interval",
    i=c_script.i,
    offset=number_6,
    interval=interval,
    startdomain=deconstruct_domain.Start)  # -> simplify(Result)

path_mapper = PathMapper(evaluate_2, source=["{A;B}", "{A}"], target=["{path_index}", "{path_index}"])

number_7 = Number(expr("round(x,2)", simplify(path_mapper)))

evaluate_3 = Evaluate(Expression="n*0.5*d*dotproduct/abs(dotproduct)", n=dispatch_5.ListA, d=simplify(number_7), dotproduct=dispatch_3.ListA)
move = Move(Geometry=project.Geometry, Motion=evaluate_3)  # -> Geometry, Transform
wallfit = Wallfit(
    C=project.Geometry,
    P=project.Geometry,
    K=Slider(100, range=0..100),
    T=Slider(0.05, range=0..1),
    Dw=simplify(number_7),
    W=0.7,
    N=4)  # -> Hearth_line, InlrNum, Error

panel_5 = Panel(wallfit.Hearth_line)
panel_6 = Panel(path_mapper)
