# Grasshopper definition 00_ElementExtraction.gh (Grasshopper 1.0.7)
# plug-ins: Volvox, Rhino.Inside for Autodesk Revit, EleFront, Scan2BIM, Tarsier, TextToNumbers, XMPparser, visibleElements, ViewportExporterRotMat

# ----
# INPUT PARAMETERS
# BIM ELEMENTS
# PCD_SFM
# PCD_LIDAR
# IMG_RGB
# MESH
distance_threshold_segmentation = Slider(0.5, range=0..1)
file_path_input_point_cloud = FilePath("D:\Data\2018-06 Werfopvolging Academiestraat Gent\week 22\PCD\week22 photogrammetry - Cloud.e57")
select_bim_elements = Element(simplify(graft([<wall referenced from the Revit model> x10, <floor referenced from the Revit model> x2, <familyinstance referenced from the Revit model> x4, <floor referenced from the Revit model> x2, <instanceelement referenced from the Revit model>, <familyinstance referenced from the Revit model> x3, <floor referenced from the Revit model>, <familyinstance referenced from the Revit model> x19, <instanceelement referenced from the Revit model> x5, <wall referenced from the Revit model>, <curveelement referenced from the Revit model> x2, <floor referenced from the Revit model> x3, <wall referenced from the Revit model> x3, <familyinstance referenced from the Revit model> x3])))
run = Button()
abort = Button()
run_2 = BooleanToggle(True)
run_3 = BooleanToggle(True)
abort_2 = BooleanToggle(False)
distance_threshold_cloud_selection = Slider(10, range=0..100)
file_path_input_point_cloud_2 = FilePath("D:\Data\2018-06 Werfopvolging Academiestraat Gent\week 22\PCD\week 22 lidar_CC.e57")
percentage_to_import = Slider(0.1, range=0..1)
run_4 = BooleanToggle(True)
abort_3 = BooleanToggle(False)
file_path_imagerdf = FilePath("D:\Data\2018-06 Werfopvolging Academiestraat Gent\week 22\IMG_RGB\week22_realign.csv")
mesh = Mesh()
file_path_mesh = FilePath("D:\Data\2018-06 Werfopvolging Academiestraat Gent\week 22\IMG_RGB\week22_realign.csv")

write_bim_meshes = BooleanToggle(False)
# MONITORING DATA
monitoring_data_file_path = FilePath("D:\Data\2018-06 Werfopvolging Academiestraat Gent\week 22\MONITORING DATA\")
# MESH ELEMENTS
mesh_2 = Mesh(<mesh referenced from the Rhino model>)
xmp_files_directory = FilePath("D:\Data\Work data\Phd\11_analyses\BIMage\Democo leopoldskazerne\Complete_img&BIMduplicates\BIM-based approach\01_RealImagesXMP\")
run_5 = BooleanToggle(True)
cam_directory = FilePath("D:\Data\Work data\Phd\11_analyses\BIMage\Democo leopoldskazerne\Complete_img&BIMduplicates\BIM-based approach\00_RealImages\")

# ----
# 0.Select REVIT GEOMETRIES
stream_filter = StreamFilter(Gate=run_2, Stream1=select_bim_elements)
element_geometry = ElementGeometry(Elements=stream_filter)  # -> simplify(Geometry)
brep = Brep()
null_item = NullItem(Item=brep)  # -> NullFlags, InvalidFlags, Description
cull_pattern = CullPattern(List=brep, CullPattern=invert(null_item.NullFlags))
cull_pattern_2 = CullPattern(List=stream_filter, CullPattern=invert(null_item.NullFlags))
clean_tree = CleanTree(RemoveNulls=True, RemoveInvalid=True, RemoveEmpty=True, Tree=cull_pattern_2)
clean_tree_2 = CleanTree(RemoveNulls=True, RemoveInvalid=True, RemoveEmpty=True, Tree=cull_pattern)
mesh_brep = MeshBrep(
    Brep=clean_tree_2,
    Settings={GridMaxCount=0, GridMinCount=16, JaggedSeams=False, MaxEdgeLength=0, MinEdgeLength=0.0001, MinTolerance=0, Refine=True, RefineAngle=0, RelativeTolerance=0.65, SimplePlanes=True, Tolerance=0})

area = Area(Geometry=mesh_brep)  # -> Area, Centroid
move = Move(Geometry=area.Centroid, Motion=Vector(2, 2, 2))  # -> Geometry, Transform

# ----
# Load all point clouds
loade57 = LoadE57(FilePath=file_path_input_point_cloud, Index=-1, Percent=1, Run=run, Abort=abort, Check=True)  # -> Cloud, Pose

# ----
# 1.Load XMP file with image locations
point = Point(flatten(move.Geometry))
list_length = ListLength(List=point)
cloud_grid = CloudGrid(Plane=point, Size=5, ExtentX=10, ExtentY=15, ExtentZ=2)
cloud_statistics = CloudStatistics(Cloud=point)  # -> Count, Colors, Colors_2
random_vectors = RandomVectors(Amount=list_length, Unitize=True, Seed=2)
deconstruct_cloud = DeconstructCloud(Cloud=point)  # -> Points, Normals, Colors
point_2 = Point(simplify(graft(point)))
vector = Vector(simplify(graft(random_vectors)))

# ----
# Load only those clouds that are within range of the objects
bim_meshes = Brep(clean_tree_2)
e57_metadata = E57Metadata(FilePath=file_path_input_point_cloud_2)  # -> FormatName, FileGuid, VersionMajor, VersionMinor, LibraryVersion, Date, Metadata, Scans, Poses, ScanCount
area_2 = Area(Geometry=bim_meshes)  # -> Area, Centroid
closest_points = ClosestPoints(Point=area_2.Centroid, Cloud=e57_metadata.Poses, Count=10)  # -> ClosestPoint, CPIndex, Distance
larger_than = LargerThan(FirstNumber=closest_points.Distance, SecondNumber=distance_threshold_cloud_selection)  # -> LargerThan, OrEqualTo
dispatch = Dispatch(List=closest_points.CPIndex, DispatchPattern=larger_than.LargerThan)  # -> flatten(ListA), ListB
create_set = CreateSet(List=dispatch.ListA)  # -> Set, Map
scan_id_s = Integer(create_set.Set)
loade57_2 = LoadE57(
    FilePath=file_path_input_point_cloud_2,
    Index=scan_id_s,
    Percent=percentage_to_import,
    Run=run_3,
    Abort=abort_2,
    Check=True)  # -> Cloud, Pose

# ----
# Create Image locations
import_coordinates = ImportCoordinates(File=file_path_imagerdf, Separator=",", XIndex=0, YIndex=1, ZIndex=2)

# ----
# Segment point cloud given BIM meshes
key = Key("d")
mesh_compare = MeshCompare(Cloud=loade57.Cloud, Mesh=clean_tree_2, Key=key)  # disabled
construct_domain = ConstructDomain(DomainStart=0, DomainEnd=distance_threshold_segmentation)
cull_cloud = CullCloud(Cloud=mesh_compare, Key=key, Domain=construct_domain)  # -> simplify(Cloud)
merge_clouds = MergeClouds(Cloud=cull_cloud)
cloud_statistics_2 = CloudStatistics(Cloud=merge_clouds)  # -> Count, Colors, Colors_2
larger_than_2 = LargerThan(FirstNumber=cloud_statistics_2.Count, SecondNumber=2)  # -> LargerThan, OrEqualTo
dispatch_2 = Dispatch(List=clean_tree, DispatchPattern=larger_than_2.LargerThan)  # -> ListA, ListB
dispatch_3 = Dispatch(List=merge_clouds, DispatchPattern=larger_than_2.LargerThan)  # -> ListA, ListB

# ----
# 2. Read in the recorded imagery parameters
xmpparser = XMPparser(ImagesLocation=cam_directory, XMPFilesLocation=xmp_files_directory, Run=run_5)  # -> flatten(Names), flatten(Locations), flatten(Rotations), flatten(ImageWidth), flatten(ImageHeight), flatten(FocalLength)

# ----
# Update camera locations to
# BIM coordinate system
# Error catching &
# conversion
vector_xyz = VectorXYZ(XComponent=104659.911, YComponent=192394.387, ZComponent=24.4)  # -> Vector, Length
ignore_z_component = VectorXYZ(XComponent=13.3367, YComponent=-5.853, ZComponent=0)  # -> Vector, Length
subtraction = Subtraction(A=xmpparser.Locations, B=vector_xyz.Vector)
addition = Addition(A=ignore_z_component.Vector, B=subtraction)

construct_cloud = ConstructCloud(Points=flatten(point), Normals=flatten(point))

# ----
# erroneous determination of focal lengths for DJI-images in RC
# --> update to correct value
duplicate_data = DuplicateData(Data=23.905, Number=242, Order=True)  # -> flatten(Data)
split_list = SplitList(List=xmpparser.FocalLength, Index=242)  # -> flatten(ListA), flatten(ListB)
# Output (2)
merge = Merge(Data1=duplicate_data, Data2=split_list.ListB)

# ----
# Convert to matrices
texttonumbers = TextToNumbers(Text=xmpparser.Rotations)  # -> simplify(NrS)
construct_matrix = ConstructMatrix(Rows=3, Columns=3, Values=texttonumbers)  # -> flatten(Matrix)

# ----
# Visualize point cloud segmentation
domain = Domain(distance_threshold_segmentation)
range = Range(Domain=domain, Steps=10)
dedomain = DeconstructDomain(Domain=domain)  # -> Start, End
gradient = Gradient(
    LowerLimit=dedomain.Start,
    UpperLimit=dedomain.End,
    Parameter=range,
    stops=[0: RGB(0, 128, 0), 0.5: RGB(255, 255, 0), 1: RGB(255, 0, 0)])
prevdata = PreviewData(Cloud=cull_cloud, Key=key, Values=range, Colors=gradient)

bounding_box = BoundingBox(Content=merge_clouds, Plane=PlaneXY(0, 0, 0))  # -> Box, Box_2
panel = Panel(create_set.Set)

# ----
# Bake BIM MESH GEOMETRY
element_name = ElementName(Element=clean_tree)  # -> Element, Name
element_passport = ElementPassport(Element=element_name.Element)  # -> DocumentGUID, Document, UniqueID, Id
element_category = ElementCategory(Element=element_name.Element)  # -> Element, Category
element_materials = ElementMaterials(Element=element_name.Element)  # -> Materials, Paint
text = Text()
define_object_attributes = DefineObjectAttributes(Name=element_passport.Id, Layer=text, Material=element_materials.Materials)  # -> simplify(Attributes)
number = Number(1)
bake_objects = BakeObjects(Geometry=clean_tree_2, Attributes=define_object_attributes, BakeName=number, Bake=False)

# ----
# WRITE MESH GEOMETRY as one file
element_name_2 = ElementName(Element=dispatch_2.ListA)  # -> Element, Name; disabled
element_category_2 = ElementCategory(Element=element_name_2.Element)  # -> Element, Category; disabled
text_2 = Text(text)  # disabled
define_object_attributes_2 = DefineObjectAttributes(Layer=text_2)  # -> simplify(Attributes); disabled
number_2 = Number(2)  # disabled
bake_objects_2 = BakeObjects(Geometry=dispatch_3.ListA, Attributes=define_object_attributes_2, BakeName=number_2, Bake=False)  # disabled

fragment_b = FragmentB("SfM_MESHRDF")

# ----
# WRITE BIM MESH GEOMETRY as a list of  obj files (Open3D)
revit_id = Text(element_passport.Id)
replace_text = ReplaceText(Text=revit_id, Find=":", Replace="_", RecursiveReplace=False)
text_3 = Text(".obj")
file_path = FilePath(monitoring_data_file_path)
concatenate = Concatenate(B=file_path, Fragment_B=replace_text, A=text_3)
export_meshes = ExportMeshes(
    FilePath=concatenate,
    Meshes=mesh_brep,
    Settings=[" _Geometry=_Mesh ", " _EndOfLine=CRLF ", " _ExportRhinoObjectNames=_DoNotExportObjectNames ", " _ExportRhinoGroupOrLayerNames=_DoNotExportGroupNames ", " _ExportMeshTextureCoordinates=_Yes ", " _ExportMeshVertexNormals=_No ", " _CreateNGons=_No ", " _ExportMaterialDefinitions=_No ", " _YUp=_No ", " _WrapLongLines=Yes ", " _VertexWelding=_Welded ", " _WritePrecision=4 ", " _Enter ", " _DetailedOptions ", " _JaggedSeams=_No ", " _PackTextures=_No ", " _Refine=_Yes ", " _SimplePlane=_No ", " _AdvancedOptions ", " _Angle=50 ", " _AspectRatio=0 ", " _Distance=0.0", " _Density=0 ", " _Density=0.45 ", " _Grid=0 ", " _MaxEdgeLength=0 ", " _MinEdgeLength=0.0001 "],
    Run=write_bim_meshes)

# ----
# replace this with a directory and a filename
# 1.Load & segment MESH file
# this resets the list
run_6 = BooleanToggle(False)
bim_meshes_2 = Mesh(graft(clean_tree_2))
bim_meshes_3 = Mesh(flatten(clean_tree_2))
source_meshes = Mesh(<mesh referenced from the Rhino model>)
mesh_split = MeshSplit(Mesh=source_meshes, Splitters=bim_meshes_3)
area_3 = Area(Geometry=mesh_split)  # -> Area, Centroid
tree_statistics = TreeStatistics(Tree=bim_meshes_2)  # -> Paths, Length, Count
point_in_breps = PointInBreps(Brep=graft(clean_tree_2), Point=area_3.Centroid, Strict=False, UseTasks=True)  # -> Inside, Index
replace_text_2 = ReplaceText(Text=element_passport.Id, Find=":", Replace="_", RecursiveReplace=False)
dispatch_4 = Dispatch(List=mesh_split, DispatchPattern=point_in_breps.Inside)  # -> ListA, ListB
tree_statistics_2 = TreeStatistics(Tree=dispatch_4.ListA)  # -> Paths, Length, Count
replace_paths = ReplacePaths(Data=dispatch_4.ListA, Search=tree_statistics_2.Paths, Replace=tree_statistics.Paths)
concatenate_2 = Concatenate(B=file_path, SfM_Mesh="SfM_Mesh_", Fragment_B=replace_text_2, Obj=".obj")
shift_paths = ShiftPaths(Data=replace_paths, Offset=-1)
clean_tree_3 = CleanTree(RemoveNulls=True, RemoveInvalid=True, RemoveEmpty=True, Tree=shift_paths)
tree_statistics_3 = TreeStatistics(Tree=clean_tree_3)  # -> Paths, Length, Count
tree_branch = TreeBranch(Tree=concatenate_2, Path=tree_statistics_3.Paths, MaintainPaths=True)
export_meshes_2 = ExportMeshes(
    FilePath=tree_branch,
    Meshes=clean_tree_3,
    Settings=[" _Geometry=_Mesh ", " _EndOfLine=CRLF ", " _ExportRhinoObjectNames=_DoNotExportObjectNames ", " _ExportRhinoGroupOrLayerNames=_DoNotExportGroupNames ", " _ExportMeshTextureCoordinates=_Yes ", " _ExportMeshVertexNormals=_No ", " _CreateNGons=_No ", " _ExportMaterialDefinitions=_No ", " _YUp=_No ", " _WrapLongLines=Yes ", " _VertexWelding=_Welded ", " _WritePrecision=4 ", " _Enter ", " _DetailedOptions ", " _JaggedSeams=_No ", " _PackTextures=_No ", " _Refine=_Yes ", " _SimplePlane=_No ", " _AdvancedOptions ", " _Angle=50 ", " _AspectRatio=0 ", " _Distance=0.0", " _Density=0 ", " _Density=0.45 ", " _Grid=0 ", " _MaxEdgeLength=0 ", " _MinEdgeLength=0.0001 "],
    Run=run_6)

# ----
# EVALUATION
number_slider = Slider(0, range=0..1000)
number_slider_2 = Slider(0, range=0..10)
tree_statistics_4 = TreeStatistics(Tree=dispatch_4.ListA)  # -> Paths, Length, Count
list_item = ListItem(List=tree_statistics_4.Paths, Index=number_slider, Wrap=True)
tree_branch_2 = TreeBranch(Tree=dispatch_4.ListA, Path=list_item, MaintainPaths=True)
list_item_2 = ListItem(List=tree_branch_2, Index=Slider(3, range=0..10), Wrap=True)

panel_2 = Panel(export_meshes_2)
# WRITE MESH RDF in same mesh location
concatenate_3 = Concatenate(B=file_path, Fragment_B=fragment_b, A=".ttl")

# ----
# WRITE POINT CLOUDS as a list of ply files (Open3D)
replace_text_3 = ReplaceText(Text=element_passport.Id, Find=":", Replace="_", RecursiveReplace=False)
text_4 = Text(".ply")
concatenate_4 = Concatenate(B=file_path, Fragment_B=replace_text_3, A=text_4)
# this PCD guid should be unique
export_point_cloud = ExportPointCloud(
    FilePath=concatenate_4,
    PointCloud=dispatch_3.ListA,
    Settings=[" _ExportType=_Binary", " _VertexesAsDoubles=_Yes ", " _ExportNormals=_Yes ", " _ExportColors=_Yes ", " _ExportMaterial=_No "],
    Run=Toggle(False))

# ----
# 7. Create BIMages, equivalent to real images
# Actions
# Inputs
# 8. Create list of visible elements per image
run_7 = BooleanToggle(False)
rendering_type = ValueList({"Wireframe", "Shaded", "Rendered", "X-ray"}, selected="Shaded")
bim_duplicate_images_location = FilePath("D:\Data\Work data\Phd\11_analyses\BIMage\Democo leopoldskazerne\Complete_img&BIMduplicates\BIM-based approach\02_BIMages\")
view_type = ValueList({"Perspective", "Top", "Front", "Right"}, selected="Perspective")
rhino_geometries = Relay()
area_4 = Area(Geometry=rhino_geometries)  # -> Area, Centroid
# (necessary because BIM dataset shifted up/downwards)
viewportexporterrotmat = ViewportExporterRotMat(
    Names=xmpparser.Names,
    Locations=addition,
    RotationMatrix=construct_matrix,
    ImageWidth=xmpparser.ImageWidth,
    ImageHeight=xmpparser.ImageHeight,
    FocalLength35mm=merge,
    FilePath=bim_duplicate_images_location,
    ViewType=view_type,
    RenderingType=rendering_type,
    Run=run_7)
visibleelements = VisibleElements(ImageFolder=bim_duplicate_images_location, ImageNames=xmpparser.Names, PxToGrow=70, ImageLocations=addition, Run=False)  # -> ElementNames, Coverage, BB, GrownBB

export_e57_point_cloud = ExportE57PointCloud(FilePath=concatenate_4, Run=False)

# ----
# RAYTRACE IMG-OBJ and write json file with GUIDS of each image
# distance condition
# vector condition
# intersection condition
number_slider_3 = Slider(30, range=0..100)
area_5 = Area(Geometry=mesh_brep)  # -> Area, Centroid
mesh_3 = Mesh(mesh_brep)
mesh_join = MeshJoin(Meshes=flatten(mesh_3))
n_i = Vector(vector)
point_3 = Point(area_5.Centroid)
closest_points_2 = ClosestPoints(Point=point_3, Cloud=flatten(point_2), Count=number_slider_3)  # -> ClosestPoint, simplify(CPIndex), simplify(Distance)
list_item_3 = ListItem(List=flatten(n_i), Index=closest_points_2.CPIndex, Wrap=True)
t_d = Slider(20, range=0..100)
dot_product = DotProduct(VectorA=n_i, VectorB=list_item_3, Unitize=False)
t_n = Slider(0.7, range=0..1)
smaller_than = SmallerThan(FirstNumber=closest_points_2.Distance, SecondNumber=t_d)  # -> simplify(SmallerThan), OrEqualTo
larger_than_3 = LargerThan(FirstNumber=dot_product, SecondNumber=t_n)  # -> simplify(LargerThan), OrEqualTo
gate_and = GateAnd(A=simplify(smaller_than.SmallerThan), B=simplify(larger_than_3.LargerThan))
dispatch_5 = Dispatch(List=closest_points_2.CPIndex, DispatchPattern=gate_and)  # -> ListA, ListB
list_item_4 = ListItem(List=flatten(point_2), Index=dispatch_5.ListA, Wrap=True)
line = Line(StartPoint=simplify(point_3), EndPoint=list_item_4)
mesh_curve = MeshCurve(Mesh=mesh_join, Curve=line)  # -> Points, Faces
list_length_2 = ListLength(List=mesh_curve.Points)
shift_paths_2 = ShiftPaths(Data=list_length_2, Offset=-1)  # -> simplify(Data)
smaller_than_2 = SmallerThan(FirstNumber=shift_paths_2, SecondNumber=Slider(2, range=0..10))  # -> SmallerThan, OrEqualTo
dispatch_6 = Dispatch(List=dispatch_5.ListA, DispatchPattern=smaller_than_2.SmallerThan)  # -> ListA, ListB
list_item_5 = ListItem(List=flatten(point_2), Index=dispatch_6.ListA, Wrap=True)  # -> simplify(Item)
indices_of_images = Integer(dispatch_6.ListA)
line_2 = Line(StartPoint=point_3, EndPoint=list_item_5)  # -> simplify(Line)

export_rdf = ExportRDF(Filename=concatenate_3)
panel_3 = Panel(concatenate_4)
