# Grasshopper definition 00_WallExtraction.gh (Grasshopper 1.0.7)
# plug-ins: Rhino.Inside for Autodesk Revit, Volvox

# Revit Families
query_families = QueryFamilies(Category=<geometry referenced from the Revit model>)
# Revit Wall
wall = Wall(<wall referenced from the Revit model>)
# Revit Document
document = Document({CentralModelURI="empty:", CentralPathName="", ModelURI="file:///G:/My Drive/Team4810_Mansion/4.Plannen/Architectural_new_v0.5.rvt", PathName="G:\My Drive\Team4810_Mansion\4.Plannen\Architectural_new_v0.5.rvt"})
active_document = ActiveDocument()
abort = Button()
run = Button()
# Load point cloud
file_path = FilePath("G:\My Drive\Team4810_Mansion\4.Plannen\PCD\unified.e57")
element_geometry = ElementGeometry(Elements=wall)
element_type = ElementType(Element=wall)  # -> Element, Type
loade57 = LoadE57(FilePath=file_path, Index=-1, Percent=1, Run=run, Abort=abort, Check=True)  # -> Cloud, Pose
family_filter = FamilyFilter(FamilyName=query_families, Inverted=False)
bounding_box = BoundingBox(Content=element_geometry, Plane=PlaneXY(0, 0, 0), UnionBox=True)  # -> Box, Box_2
abort_2 = Button()
run_2 = Button()
type_filter = TypeFilter(Types=element_type.Type, Inverted=False)
query_elements = QueryElements(Filter=family_filter, Limit=100)  # -> simplify(Elements), Count
tree_branch = TreeBranch(Tree=query_elements.Elements, Path=simplify("{0}"), MaintainPaths=True)
box_properties = BoxProperties(Box=bounding_box.Box)  # -> Center, Diagonal, Area, Volume, Degeneracy
move = Move(Geometry=box_properties.Center, Motion=Vector(0, 0, 1.5))  # -> Geometry, Transform
query_elements_2 = QueryElements(Filter=type_filter, Limit=100)  # -> Elements, Count
list_item = ListItem(List=tree_branch, Index=1, Wrap=True)
element_type_2 = ElementType(Element=list_item)  # -> Element, Type
add_component_location = AddComponentLocation(
    Location=move.Geometry,
    Type=element_type_2.Type,
    Level=<geometry referenced from the Revit model>,
    Host=wall,
    TrackingMode=2)
element_location = ElementLocation(Element=add_component_location)  # -> Element, Location, Hand, Facing, WorkPlane
element_passport = ElementPassport(Element=list_item)  # -> DocumentGUID, Document, UniqueID, Id
element_name = ElementName(Element=list_item)  # -> Element, Name
element_geometry_2 = ElementGeometry(Elements=query_elements.Elements)
abort_3 = Button()
run_3 = Button()
similar_types = SimilarTypes(Type=element_type_2.Type)
element_curve = ElementCurve(Element=add_component_location)  # -> Element, Curve
file_path_2 = FilePath("D:\Data\test.e57")
element_parameter = ElementParameter(Element=add_component_location)  # -> Element, Value
element_location_2 = ElementLocation(Element=wall)  # -> Element, Location, Hand, Facing, WorkPlane
# holes incl.
element_geometry_3 = ElementGeometry()
# Bounding box
element_bounding_geometry = ElementBoundingGeometry(Element=wall)
tree_branch_2 = TreeBranch(Tree=element_geometry_2, Path="{0;1}", MaintainPaths=True)
new_component_family = NewComponentFamily(Template=similar_types, Overwrite=False)
default_type = DefaultType()
list_item_2 = ListItem(List=tree_branch_2, Index=Slider(0, range=0..10), Wrap=True)
query_element_parameters = QueryElementParameters()
bounding_box_2 = BoundingBox(Content=tree_branch_2, Plane=PlaneXY(0, 0, 0), UnionBox=True)  # -> Box, Box_2
brep = Brep(bounding_box_2.Box)
bcrop = BoxCrop(Box=brep)
cloudx = CloudEngineX(Cloud=loade57.Cloud, Run=run_2, Abort=abort_2, Instruction0=bcrop, showinfo=True)
save_e57_ex = SaveE57Ex(
    FilePath=file_path_2,
    Guid=element_passport.DocumentGUID,
    Scans=cloudx,
    ScanGuid=element_passport.UniqueID,
    Name=element_name.Name,
    AtomS=False,
    AtomE=False,
    Spherical=False,
    Run=run_3,
    Abort=abort_3)
save_component_family = SaveComponentFamily(Overwrite=False, Compact=False, Backups=-1)
panel = Panel(element_passport.UniqueID)
