# Grasshopper definition 00_WindowExtraction.gh (Grasshopper 1.0.7)
# plug-ins: Volvox, Rhino.Inside for Autodesk Revit, EleFront, Scan2BIM, Tarsier

# ----
# 0.Select REVIT GEOMETRIES
element = Element(simplify(graft([<wall referenced from the Revit model> x10, <floor referenced from the Revit model> x2, <familyinstance referenced from the Revit model> x4, <floor referenced from the Revit model> x2, <instanceelement referenced from the Revit model>, <familyinstance referenced from the Revit model> x3, <floor referenced from the Revit model>, <familyinstance referenced from the Revit model> x19, <instanceelement referenced from the Revit model> x5, <wall referenced from the Revit model>, <curveelement referenced from the Revit model> x2, <floor referenced from the Revit model> x3, <wall referenced from the Revit model> x3, <familyinstance referenced from the Revit model> x3])))
element_geometry = ElementGeometry(Elements=element)  # -> simplify(Geometry)
brep = Brep(element_geometry)
null_item = NullItem(Item=brep)  # -> NullFlags, InvalidFlags, Description
cull_pattern = CullPattern(List=brep, CullPattern=invert(null_item.NullFlags))
cull_pattern_2 = CullPattern(List=element, CullPattern=invert(null_item.NullFlags))
clean_tree = CleanTree(RemoveNulls=True, RemoveInvalid=True, RemoveEmpty=True, Tree=cull_pattern_2)
clean_tree_2 = CleanTree(RemoveNulls=True, RemoveInvalid=True, RemoveEmpty=True, Tree=cull_pattern)

# ----
# 1.Load  and segment point cloud
abort = Button()
run = Button()
file_path = FilePath("D:\Data\2018-06 Werfopvolging Academiestraat Gent\week 22\PCD\week22 photogrammetry - Cloud.e57")
loade57 = LoadE57(FilePath=file_path, Index=-1, Percent=1, Run=run, Abort=abort, Check=True)  # -> Cloud, Pose
key = Key("d")
mesh_compare = MeshCompare(Cloud=loade57.Cloud, Mesh=clean_tree_2, Key=key)
construct_domain = ConstructDomain(DomainStart=0, DomainEnd=Slider(0.5, range=0..1))
cull_cloud = CullCloud(Cloud=mesh_compare, Key=key, Domain=construct_domain)  # -> simplify(Cloud)
merge_clouds = MergeClouds(Cloud=cull_cloud)
cloud_statistics = CloudStatistics(Cloud=merge_clouds)  # -> Count, Colors, Colors_2
larger_than = LargerThan(FirstNumber=cloud_statistics.Count, SecondNumber=Slider(2, range=0..10))  # -> LargerThan, OrEqualTo
dispatch = Dispatch(List=clean_tree, DispatchPattern=larger_than.LargerThan)  # -> ListA, ListB
dispatch_2 = Dispatch(List=merge_clouds, DispatchPattern=larger_than.LargerThan)  # -> PointCloud, ListB

mesh_brep = MeshBrep(
    Brep=clean_tree_2,
    Settings={GridMaxCount=0, GridMinCount=16, JaggedSeams=False, MaxEdgeLength=0, MinEdgeLength=0.0001, MinTolerance=0, Refine=True, RefineAngle=0, RelativeTolerance=0.65, SimplePlanes=True, Tolerance=0})
bounding_box = BoundingBox(Content=clean_tree_2, Plane=PlaneXY(0, 0, 0))  # -> Box, Box_2
deconstruct_box = DeconstructBox(Box=bounding_box.Box)  # -> Plane, X, Y, Z
dedomain = DeconstructDomain(Domain=deconstruct_box.Y)  # -> Start, End
subtraction = Subtraction(A=dedomain.End, B=dedomain.Start)
number = Number(expr("abs(round(10*x+10,0))", simplify(subtraction)))

# ----
# histogram in X direction
# 1cm per bracket
deconstruct_brep = DeconstructBrep(Brep=clean_tree_2)  # -> simplify(Faces), Edges, Vertices
sort_list = SortList(Keys=deconstruct_brep.Faces, ValuesValuesA=deconstruct_brep.Faces)  # -> reverse(Keys), reverse(ValuesValuesA)
list_item = ListItem(List=sort_list.ValuesValuesA, Index=0, Wrap=True)
area = Area(Geometry=list_item)  # -> Area, Centroid
deconstruct_point_cloud = DeconstructPointCloud(PointCloud=dispatch_2.PointCloud)  # -> Points, Colours, Normals
xz_plane = XZPlane(Origin=area.Centroid)
plane_closest_point = PlaneClosestPoint(Point=deconstruct_point_cloud.Points, Plane=xz_plane)  # -> Point, UVPoint, simplify(Distance)
histogram_maker = HistogramMaker(data=plane_closest_point.Distance, divs=number)  # -> out, simplify(histogram); inputs data: list, divs: Int32
# ---------- histogram_maker: C# usings ----------
using System.IO;
using System.Linq;
using System.Data;
using System.Drawing;
using System.Reflection;
using System.Windows.Forms;
using System.Xml;
using System.Xml.Linq;
using System.Runtime.InteropServices;

using Rhino.DocObjects;
using Rhino.Collections;
using GH_IO;
using GH_IO.Serialization;
# ---------- histogram_maker: C# ----------
    //find min and max of each

    double minsofar = Convert.ToDouble(data[0]);
    double maxsofar = Convert.ToDouble(data[0]);

    foreach (object xx in data)
    {
      minsofar = Math.Min(minsofar, Convert.ToDouble(xx));
      maxsofar = Math.Max(maxsofar, Convert.ToDouble(xx));
    }

    //assign each value a category, 0 being the lowest group, 100 being the highest
    int[] cats = new int[divs + 1];
    for (int i = 0; i < cats.Length; i++) cats[i] = 0;

    for (int i = 0; i < data.Count; i++)
    {
      double cat = divs * ((Convert.ToDouble(data[i]) - minsofar) / (maxsofar - minsofar));
      Math.Round(Convert.ToDouble(data[i]) + divs/2, 0);
      cats[(int) cat]++;
    }

    histogram = cats;
# ---------- end histogram_maker ----------
# rebar:
# >medium #p
# >noisy histogram
# >computed thickness < d
# > y=c vertical histogram
# molding:
# >high #p
# >noisy histogram
# >computed thickness > d
# > y=c vertical histogram
c_script = CSharpScript(histogram=histogram_maker.histogram)  # -> out, computed_wall_thickness, peaki, peakj, rij, ri, rj; inputs histogram: list of Int32
# ---------- c_script: C# usings ----------
using System.Linq;
# ---------- c_script: C# ----------
    List<int> sortedhistogram = new List<int>(histogram.OrderByDescending(x => x));

    int peak1 = sortedhistogram[0];
    int peak2 = 0;
    int i_p2 = 0;
    int i_p1 = histogram.FindIndex(x => x == peak1);

    //thickness
    int i = 0;
    int temp = 0;

    while (temp < 5 && i < sortedhistogram.Count)
    {
      peak2 = sortedhistogram[i];
      i_p2 = histogram.FindIndex(x => x == peak2);
      if ( Math.Abs(i_p1 - i_p2) > 5)
      {
        temp = Math.Abs(i_p1 - i_p2);

      }
      i++;
    }
    computed_wall_thickness = temp * 0.01;
    if (i_p1 > i_p2)
    {
      int swap = 0;
      swap = i_p1;
      i_p1 = i_p2;
      i_p2 = swap;

    }
    //    peaki = Math.Sqrt(histogram[i_p1]);
    //    peakj = Math.Sqrt(histogram[i_p2]);
    peaki = (double)(histogram[i_p1]) / peak1;
    peakj = (double)(histogram[i_p2]) / peak1;

    //    // average #p trough
    //    rij = Math.Sqrt(histogram.GetRange(i_p1 + 2, temp - 2).Average());
    //
    //    // average #p front
    //    ri = Math.Sqrt(histogram.GetRange(1, i_p1 - 2).Average());
    //
    //    // average #p back
    //    rj = Math.Sqrt(histogram.GetRange(i_p2 + 0, histogram.Count - i_p2).Average());
    // average #p trough
    rij = (double)histogram.GetRange(i_p1 + 2, temp - 2).Average() / peak1;

    // average #p front
    ri = (double)(histogram.GetRange(1, i_p1 - 2).Average()) / peak1;

    // average #p back
    rj = (double)(histogram.GetRange(i_p2 + 0, histogram.Count - i_p2).Average()) / peak1;
# ---------- end c_script ----------
# occluded:
# >low #p
# >random histogram
# >random thickness
# >random vertical histogram
# non-existing:
# >low #p
# >random histogram
# >random thickness
# >peak at bottom of vertical histogram
# anchors:
# >low #p
# >random histogram
# >random thickness
# >peak at bottom of vertical histogram
quick_graph = QuickGraph(histogram_maker.histogram, SortOrder=0)

# ----
# histogram in X direction (10cm per fraction) (y=c means fully observed wall)
bounding_box_2 = BoundingBox(Content=clean_tree_2, Plane=PlaneXY(0, 0, 0))  # -> Box, Box_2
deconstruct_box_2 = DeconstructBox(Box=bounding_box_2.Box)  # -> Plane, X, Y, Z
deconstruct = Deconstruct(Point=deconstruct_point_cloud.Points)  # -> XComponent, YComponent, simplify(ZComponent)
dedomain_2 = DeconstructDomain(Domain=deconstruct_box_2.X)  # -> Start, End
subtraction_2 = Subtraction(A=deconstruct.XComponent, B=dedomain_2.Start)  # -> simplify(Result)
subtraction_3 = Subtraction(A=dedomain_2.End, B=dedomain_2.Start)
number_2 = Number(expr("abs(round(10*x+10,0))", simplify(subtraction_3)))
number_3 = Number(expr("abs(x)", subtraction_2))
histogram_maker_2 = HistogramMaker(data=number_3, divs=number_2)  # -> out, simplify(A); inputs data: list, divs: Int32
# ---------- histogram_maker_2: C# ----------
    //find min and max of each

    double minsofar = Convert.ToDouble(data[0]);
    double maxsofar = Convert.ToDouble(data[0]);

    foreach (object xx in data)
    {
      minsofar = Math.Min(minsofar, Convert.ToDouble(xx));
      maxsofar = Math.Max(maxsofar, Convert.ToDouble(xx));
    }

    //assign each value a category, 0 being the lowest group, 100 being the highest
    int[] cats = new int[divs + 1];
    for (int i = 0; i < cats.Length; i++) cats[i] = 0;

    for (int i = 0; i < data.Count; i++)
    {
      //double cat = divs * ((Convert.ToDouble(data[i]) - minsofar) / (maxsofar - minsofar));
      double cat = Math.Round(Convert.ToDouble(data[i]) * 10, 0);
      cats[(int) cat]++;
    }

    A = cats;
# ---------- end histogram_maker_2 ----------
quick_graph_2 = QuickGraph(histogram_maker_2.A, SortOrder=0)

# ----
# histogram in Y direction (10cm per fraction) (y=c means fully observed wall)
bounding_box_3 = BoundingBox(Content=clean_tree_2, Plane=PlaneXY(0, 0, 0))  # -> Box, Box_2
deconstruct_box_3 = DeconstructBox(Box=bounding_box_3.Box)  # -> Plane, X, Y, Z
deconstruct_2 = Deconstruct(Point=deconstruct_point_cloud.Points)  # -> XComponent, YComponent, simplify(ZComponent)
dedomain_3 = DeconstructDomain(Domain=deconstruct_box_3.Y)  # -> Start, End
subtraction_4 = Subtraction(A=dedomain_3.End, B=dedomain_3.Start)
subtraction_5 = Subtraction(A=deconstruct_2.YComponent, B=dedomain_3.Start)  # -> simplify(Result)
number_4 = Number(expr("abs(round(10*x+10,0))", simplify(subtraction_4)))
number_5 = Number(expr("abs(x)", subtraction_5))
histogram_maker_3 = HistogramMaker(data=number_5, divs=number_4)  # -> out, simplify(A); inputs data: list, divs: Int32; same code as histogram_maker_2
quick_graph_3 = QuickGraph(histogram_maker_3.A, SortOrder=0)

# ----
# histogram in Z direction (10cm per fraction) (y=c means fully observed wall)
bounding_box_4 = BoundingBox(Content=clean_tree_2, Plane=PlaneXY(0, 0, 0))  # -> Box, Box_2
deconstruct_box_4 = DeconstructBox(Box=bounding_box_4.Box)  # -> Plane, X, Y, Z
deconstruct_3 = Deconstruct(Point=deconstruct_point_cloud.Points)  # -> XComponent, YComponent, simplify(ZComponent)
dedomain_4 = DeconstructDomain(Domain=deconstruct_box_4.Z)  # -> Start, End
subtraction_6 = Subtraction(A=deconstruct_3.ZComponent, B=dedomain_4.Start)  # -> simplify(Result)
subtraction_7 = Subtraction(A=dedomain_4.End, B=dedomain_4.Start)
number_6 = Number(expr("abs(round(10*x+10,0))", simplify(subtraction_7)))
number_7 = Number(expr("abs(x)", subtraction_6))
histogram_maker_4 = HistogramMaker(data=number_7, divs=number_6)  # -> out, simplify(A); inputs data: list, divs: Int32; same code as histogram_maker_2
quick_graph_4 = QuickGraph(histogram_maker_4.A, SortOrder=0)

panel = Panel(number_3)
# eval histogram first
# only works with 2 sided walls
merge = Merge(Data1=c_script.ri, Data2=c_script.rj)
average = Average(Input=merge)

# ----
# WRITE GEOMETRY
element_name = ElementName(Element=clean_tree)  # -> Element, Name
element_category = ElementCategory(Element=element_name.Element)  # -> Element, Category
element_materials = ElementMaterials(Element=element_name.Element)  # -> Materials, Paint
text = Text(element_category.Category)
number_8 = Number(1)

element_passport = ElementPassport(Element=element_name.Element)  # -> DocumentGUID, Document, UniqueID, Id
panel_2 = Panel(element_name.Element)

define_object_attributes = DefineObjectAttributes(Name=element_passport.Id, Layer=text, Material=element_materials.Materials)  # -> simplify(Attributes)
bake_objects = BakeObjects(Geometry=clean_tree_2, Attributes=define_object_attributes, BakeName=number_8, Bake=False)

# ----
# WRITE MESH GEOMETRY as one file
element_name_2 = ElementName(Element=dispatch.ListA)  # -> Element, Name
element_category_2 = ElementCategory(Element=element_name_2.Element)  # -> Element, Category
text_2 = Text(text)
define_object_attributes_2 = DefineObjectAttributes(Layer=text_2)  # -> simplify(Attributes)
number_9 = Number(2)
bake_objects_2 = BakeObjects(Geometry=dispatch_2.PointCloud, Attributes=define_object_attributes_2, BakeName=number_9, Bake=False)

# ----
# WRITE MESH GEOMETRY as a list of files (Open3D)
text_3 = Text(element_passport.Id)
replace_text = ReplaceText(Text=text_3, Find=":", Replace="_", RecursiveReplace=False)
text_4 = Text(".obj")
file_path_2 = FilePath("D:\Data\2018-06 Werfopvolging Academiestraat Gent\week 22\MONITORING DATA\")
concatenate = Concatenate(B=file_path_2, Fragment_B=replace_text, A=text_4)
export_meshes = ExportMeshes(
    FilePath=concatenate,
    Meshes=mesh_brep,
    Settings=[" _Geometry=_Mesh ", " _EndOfLine=CRLF ", " _ExportRhinoObjectNames=_DoNotExportObjectNames ", " _ExportRhinoGroupOrLayerNames=_DoNotExportGroupNames ", " _ExportMeshTextureCoordinates=_Yes ", " _ExportMeshVertexNormals=_No ", " _CreateNGons=_No ", " _ExportMaterialDefinitions=_No ", " _YUp=_No ", " _WrapLongLines=Yes ", " _VertexWelding=_Welded ", " _WritePrecision=4 ", " _Enter ", " _DetailedOptions ", " _JaggedSeams=_No ", " _PackTextures=_No ", " _Refine=_Yes ", " _SimplePlane=_No ", " _AdvancedOptions ", " _Angle=50 ", " _AspectRatio=0 ", " _Distance=0.0", " _Density=0 ", " _Density=0.45 ", " _Grid=0 ", " _MaxEdgeLength=0 ", " _MinEdgeLength=0.0001 "],
    Run=Toggle(False))

# ----
# WRITE POINT CLOUDS as a list of ply files (Open3D)
replace_text_2 = ReplaceText(Text=element_passport.Id, Find=":", Replace="_", RecursiveReplace=False)
text_5 = Text(".ply")
concatenate_2 = Concatenate(B=file_path_2, Fragment_B=replace_text_2, A=text_5)
export_point_cloud = ExportPointCloud(
    FilePath=concatenate_2,
    PointCloud=dispatch_2.PointCloud,
    Settings=[" _ExportType=_Binary", " _VertexesAsDoubles=_Yes ", " _ExportNormals=_Yes ", " _ExportColors=_Yes ", " _ExportMaterial=_No "],
    Run=Toggle(False))

export_e57_point_cloud = ExportE57PointCloud(FilePath=concatenate_2, Run=False)
