# Grasshopper definition Mesh_Segmentation4.gh (Grasshopper 1.0.7)
# plug-ins: EleFront, Scan2BIM

# ----
# Input Mesh that needs to be segmented
#  (1 Mesh only (can be joined mesh)
# 65s: 500k v mesh
# 120s: 1500k meshes
mesh = Mesh(simplify(graft(<mesh referenced from the Rhino model>)))

# ----
# Segment Mesh based on N,C
number_slider = Slider(1, range=0..1)
region_growing_normalscolors2 = Region_Growing_NormalsColors2(
    Mesh=mesh,
    ThresValN=30,
    ThresValC=30,
    MaxDist=number_slider,
    Minsize=Slider(200, range=0..1000),
    Offset=Slider(0.3, range=0..1),
    Tilesize=Slider(50000, range=0..1000000))  # -> simplify(FaceIndices)

# ----
# construct submeshes
restructure_mesh2 = Restructure_Mesh2(Mesh=mesh, Indices=region_growing_normalscolors2)

# ----
# colorize meshes
tree_statistics = TreeStatistics(Tree=simplify(graft(restructure_mesh2)))  # -> Paths, Length, Count
random = Random(Range=Domain(0, 255), Number=tree_statistics.Count, Seed=2)  # -> graft(Random)
random_2 = Random(Range=Domain(0, 255), Number=tree_statistics.Count, Seed=50)  # -> graft(Random)
random_3 = Random(Range=Domain(0, 255), Number=tree_statistics.Count, Seed=78)  # -> graft(Random)
colour_rgb = ColourRGB(Alpha=255, Red=random, Green=random_2, Blue=random_3)  # -> simplify(Colour)
tree_statistics_2 = TreeStatistics(Tree=colour_rgb)  # -> Paths, Length, Count
replace_paths = ReplacePaths(Data=colour_rgb, Search=tree_statistics_2.Paths, Replace=tree_statistics.Paths)

# ----
# bake geometry
list_length = ListLength(List=flatten(restructure_mesh2))
series = Series(Start=0, Step=1, Count=list_length)  # -> simplify(graft(Series))
define_layer = DefineLayer(Name="Segmented Mesh")
define_object_attributes = DefineObjectAttributes(Name=series, Layer=define_layer, Color=replace_paths)
bake_objects = BakeObjects(Geometry=simplify(graft(restructure_mesh2)), Attributes=define_object_attributes, Bake=False)

mesh_colours = MeshColours(Mesh=graft(restructure_mesh2), Colours=replace_paths)  # -> simplify(Mesh); disabled
