# Grasshopper definition PCD_Segmentation1.gh (Grasshopper 1.0.7)
# plug-ins: Volvox, EleFront, Scan2BIM

# ----
# Input PCD that needs to be segmented
#  (Can be multiple point clouds)
# 3M: 100s
cloud = Cloud(<cloud referenced from the Rhino model>)

# ----
# Segment PCD based on N,C
number_slider = Slider(0.2, range=0..1)
region_growing_pcd1 = Region_Growing_PCD1(
    Point_Cloud=cloud,
    ThresValN=Slider(15, range=0..100),
    ThresValC=Slider(100, range=0..100),
    MaxDist=number_slider,
    Minsize=Slider(2000, range=0..10000),
    Offset=Slider(0.1, range=0..1),
    Tilesize=Slider(500000, range=0..1000000))  # disabled

# ----
# construct subclouds
restructure_pcd1 = Restructure_PCD1(Point_Cloud=cloud, Indices=region_growing_pcd1)  # -> simplify(graft(Sub_Clouds)); disabled
restructure_colorize_pcd = RestructureColorize_PCD(Point_Cloud=cloud, Indices=region_growing_pcd1)

list_item = ListItem(List=restructure_colorize_pcd, Index=Slider(68, range=0..100), Wrap=True)

# ----
# bake geometry
list_length = ListLength(List=flatten(restructure_colorize_pcd))
define_layer = DefineLayer(Name="Segmented Mesh")
series = Series(Start=0, Step=1, Count=list_length)  # -> simplify(graft(Series))
define_object_attributes = DefineObjectAttributes(Name=series, Layer=define_layer)
bake_objects = BakeObjects(Geometry=simplify(graft(restructure_colorize_pcd)), Attributes=define_object_attributes, Bake=False)
