# Grasshopper definition PCD_meshcreation.gh (Grasshopper 1.0.7)
# plug-ins: Volvox, EleFront

# input point cloud
cloud = Cloud([<cloud referenced from the Rhino model> x63])
voxel_colored = VoxelColored(Cloud=cloud, VoxelSize=Slider(0.05, range=0..0.1))
list_length = ListLength(List=cloud)
get_points = GetPoints(Cloud=cloud, Indices=0)  # -> Points, Normals, flatten(Colors)
series = Series(Start=0, Step=1, Count=list_length)
define_layer = DefineLayer(Name="Segmented Mesh")
define_object_attributes = DefineObjectAttributes(Name=series, Layer=define_layer, Color=get_points.Colors)
# output simplified mesh
bake_objects = BakeObjects(Geometry=voxel_colored, Attributes=define_object_attributes, BakeName="4", Bake=False)
