# Grasshopper definition Points_Segmentation1.gh (Grasshopper 1.0.7)
# plug-ins: EleFront, Scan2BIM

# ----
# Input Mesh that needs to be segmented
#  (1 Mesh only (can be joined mesh)
# 65s: 500k v mesh
# 120s: 1500k meshes
mesh = Mesh(simplify(graft(<mesh referenced from the Rhino model>)))

# ----
# Segment Mesh based on N,C
number_slider = Slider(1, range=0..1)
region_growing_normalscolors2 = Region_Growing_NormalsColors2(
    Mesh=mesh,
    ThresValN=30,
    ThresValC=30,
    MaxDist=number_slider,
    Minsize=Slider(20, range=0..1000),
    Offset=Slider(0.3, range=0..1),
    Tilesize=Slider(500000, range=0..1000000))  # -> simplify(FaceIndices)

restructure_mesh = Restructure_Mesh(Mesh=mesh, Indices=region_growing_normalscolors2)

# ----
# construct submeshes
c_script = CSharpScript(Rhino_mesh=mesh, Rhino_indices=region_growing_normalscolors2)  # -> out, A; inputs Rhino_mesh: Mesh, Rhino_indices: list of Double; disabled
# ---------- c_script: C# usings ----------
using System.Linq;
# ---------- c_script: C# ----------
    int cluster_count = (int) Rhino_indices.Max();
     List<Mesh> Rhino_submeshes = new List<Mesh>();       
    ///1. maak lijsten van idexen per value van Rhino-indices
    ///2. Retrieve de Mesh.face van idere index
    ///3. Retrieve hoekpunten van iedere Mesh.face van iedere index
    ///4. maak nieuwe meshfaces van hoekpunten
    ///5. maak nieuwe mesh
    for (int i = 0; i < cluster_count; i++)
    {
      Mesh Rhino_submesh = new Mesh();
      List<MeshFace> Rhino_faces = new List<MeshFace>();

      ///C_indexlist[i] = Enumerable.Range(0, Rhino_indices.Count).Where(flap => Rhino_indices[flap] == i+1).ToArray();
      var C_indexlist = Enumerable.Range(0, Rhino_indices.Count).Where(flap => Rhino_indices[flap] == i + 1).ToList();
      ///Rhino_submeshes.Add(Rhino_mesh.Faces.ExtractFaces(C_indexlist));
      ///Rhino_submeshes.Add(Rhino_mesh.Faces.ElementAt(C_indexlist));

      for (int j = 0; j < C_indexlist.Count; j++)
      {
        Rhino_faces.Add(Rhino_mesh.Faces.GetFace(C_indexlist[j]));
      }
      Rhino_submesh.Faces.AddFaces(Rhino_faces);
      Rhino_submesh.Vertices.AddVertices(Rhino_mesh.Vertices);
      Rhino_submesh.Vertices.CullUnused();
      Rhino_submeshes.Add(Rhino_submesh);
    }
    ///A = C_indexlist[0];
    A = Rhino_submeshes;
# ---------- end c_script ----------

# ----
# colorize meshes
tree_statistics = TreeStatistics(Tree=simplify(graft(c_script.A)))  # -> Paths, Length, Count
random = Random(Range=Domain(0, 255), Number=tree_statistics.Count, Seed=2)  # -> graft(Random)
random_2 = Random(Range=Domain(0, 255), Number=tree_statistics.Count, Seed=50)  # -> graft(Random)
random_3 = Random(Range=Domain(0, 255), Number=tree_statistics.Count, Seed=78)  # -> graft(Random)
colour_rgb = ColourRGB(Alpha=255, Red=random, Green=random_2, Blue=random_3)  # -> simplify(Colour)
tree_statistics_2 = TreeStatistics(Tree=colour_rgb)  # -> Paths, Length, Count
replace_paths = ReplacePaths(Data=colour_rgb, Search=tree_statistics_2.Paths, Replace=tree_statistics.Paths)

# ----
# bake geometry
list_length = ListLength(List=flatten(c_script.A))
series = Series(Start=0, Step=1, Count=list_length)  # -> simplify(graft(Series))
define_layer = DefineLayer(Name="Segmented Mesh")
define_object_attributes = DefineObjectAttributes(Name=series, Layer=define_layer, Color=replace_paths)
bake_objects = BakeObjects(Geometry=simplify(graft(c_script.A)), Attributes=define_object_attributes, Bake=False)

mesh_colours = MeshColours(Mesh=c_script.A, Colours=replace_paths)
