# Grasshopper definition Convex_hull.gh (Grasshopper 1.0.7)
# plug-ins: Grasshopper-BricsCAD-Connection, EleFront, Volvox

# ----
# Input
# Selecteer alle lijnen
# in tekening
# Selecteer output path
# voor de convex hull
select_path = FilePath("K:\Projects\2022-01 Project VLAIO Bauwens\1. Opnames\Grego\20210417 Grego\")
curve = Curve([{BcDocName="3D ontwerp Machine20210415", Handle=145962, Index=0, SubentityType=0}, {BcDocName="3D ontwerp Machine20210415", Handle=145964, Index=0, SubentityType=0}, {BcDocName="3D ontwerp Machine20210415", Handle=145965, Index=0, SubentityType=0}, {BcDocName="3D ontwerp Machine20210415", Handle=145966, Index=0, SubentityType=0}, {BcDocName="3D ontwerp Machine20210415", Handle=145967, Index=0, SubentityType=0}, {BcDocName="3D ontwerp Machine20210415", Handle=145968, Index=0, SubentityType=0}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])

# ----
# Selecteer getransformeerde
# mesh
tin = Guid(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)

# ----
# Selecteer gebakte polyline
polyline = Guid(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)

# ----
# Alle lijnen baken
crv = Curve(curve)
txt = Text("Lijnen")
# BAKEN
bake = BakeObjects(Geometry=crv, BakeName=txt, Bake=False)

# ----
# Meshes maken
number_slider = Slider(0.2, range=0..1)
join = JoinCurves(Curves=curve, Preserve=False)
divdist = DivideDistance(Curve=join, Distance=number_slider)  # -> flatten(Points), Tangents, Parameters
del = DelaunayMesh(Points=divdist.Points, Plane=PlaneXY(0, 0, 0))

# ----
# Meshes baken
txt_2 = Text("Mesh")
bake_2 = BakeObjects(Geometry=del, BakeName=txt_2, Bake=False)

# ----
# Meshes maken om te exporteren
pdecon = Deconstruct(Point=divdist.Points)  # -> XComponent, YComponent, ZComponent
int = Integer(-1)
multiplication = Multiplication(A=pdecon.ZComponent, B=int)
pt = ConstructPoint(XCoordinate=pdecon.XComponent, YCoordinate=multiplication, ZCoordinate=pdecon.YComponent)
xz = XZPlane(Origin=Point(0, 0, 0))
del_2 = DelaunayMesh(Points=pt, Plane=xz)

# ----
# Getransformeerde
# meshes baken
txt_3 = Text("Meshomgekeerd")
bake_3 = BakeObjects(Geometry=del_2, BakeName=txt_3, Bake=False)

# ----
# Mesh exporteren
mesh = Text("Mesh")
obj = Text(".obj")
export = ExportObjects(FolderPath=select_path, FileName=mesh, FileExtension=obj, RhinoObjects=tin, AxisSystem=PlaneXY(0, 0, 0), Export=False)

# ----
# Convex hull polyline
# exporteren
polyline_2 = Text("polyline")
dxf = Text(".dxf")
# EXPORTEREN
export_2 = ExportObjects(
    FolderPath=select_path,
    FileName=polyline_2,
    FileExtension=dxf,
    RhinoObjects=polyline,
    AxisSystem=PlaneXY(0, 0, 0),
    Export=False)

# ----
# Convex hull polyline aanmaken
number_slider_2 = Slider(0.15, range=0..1)
divdist_2 = DivideDistance(Curve=curve, Distance=number_slider_2)  # -> flatten(Points), Tangents, Parameters
hull = ConvexHull(Points=divdist_2.Points, Plane=PlaneXY(0, 0, 0))  # -> Hull, HullZ, Indices
crv_2 = Curve(hull.Hull)
crv_3 = Curve(hull.HullZ)
bake_4 = BakeObjects(Geometry=crv_3, BakeName=polyline_2, Bake=False)

# ----
# Tin als IFC exporteren
# IFC lijkt leeg te zijn
entity = Entity({BcDocName="3D ontwerp Machine20210415", Handle=154278, Index=0, SubentityType=0})
select_path_2 = FilePath("K:\Projects\2022-01 Project VLAIO Bauwens\1. Opnames\Grego\20210417 Grego\")
txt_4 = Text("TIN.ifc")
txt_5 = Text(select_path_2)
join_2 = TextJoin(Text=[txt_5, txt_4])
ifc = IFCExport(BuildingElement=entity, FileName=join_2)

# ----
# Kies de juiste puntenwolk
# die moet ingeladen worden.
lambert08_ellips_output_cc_bin = Text("LAMBERT08_ELLIPS_output_CC.bin")
lambert08_taw_output_cc_bin = Text("LAMBERT08_TAW_output_CC.bin")
lambert72_ellips_output_cc_bin = Text("LAMBERT72_ELLIPS_output_CC.bin")
lambert72_taw_output_cc_bin = Text("LAMBERT72_TAW_output_CC.bin")

# ----
# Kies de juiste puntenwolk
# die moet ingeladen worden.
pcdlambert08_ellips_e57 = Text("PCDLAMBERT08_ELLIPS.e57")
pcdlambert08_taw_e57 = Text("PCDLAMBERT08_TAW.e57")
pcdlambert72_ellips_e57 = Text("PCDLAMBERT72_ELLIPS.e57")
pcdlambert72_taw_e57 = Text("PCDLAMBERT72_TAW.e57")

txt_6 = Text("\"")
join_3 = TextJoin(Text=[select_path, lambert08_ellips_output_cc_bin])

# ----
# Puntenwolk inladen (10% vd punten)
toggle = BooleanToggle(True)
join_4 = TextJoin(Text=[select_path, pcdlambert08_ellips_e57])
loade57 = LoadE57(FilePath=join_4, Index=-1, Percent=10, Run=toggle, Abort=False, Check=False)  # -> Cloud, Pose

join_5 = TextJoin(Text=[txt_6, join_3])
join_6 = TextJoin(Text=[join_5, txt_6])
opencc = OpenFile(FilePath=join_6, Run=Toggle(True))
e57meta = E57Metadata(FilePath=join_4)  # -> FormatName, FileGuid, VersionMajor, VersionMinor, LibraryVersion, Date, Metadata, Scans, Poses, ScanCount
panel = Panel(e57meta.ScanCount)
decloud = DeconstructCloud(Cloud=loade57.Cloud)  # -> Points, Normals, Colors
