# Grasshopper definition Convex_hullv2.gh (Grasshopper 1.0.7)
# plug-ins: Grasshopper-BricsCAD-Connection

curve = Curve([{BcDocName="3D ontwerp Machine20210415", Handle=145962, Index=0, SubentityType=0}, {BcDocName="3D ontwerp Machine20210415", Handle=145964, Index=0, SubentityType=0}, {BcDocName="3D ontwerp Machine20210415", Handle=145965, Index=0, SubentityType=0}, {BcDocName="3D ontwerp Machine20210415", Handle=145966, Index=0, SubentityType=0}, {BcDocName="3D ontwerp Machine20210415", Handle=145967, Index=0, SubentityType=0}, {BcDocName="3D ontwerp Machine20210415", Handle=145968, Index=0, SubentityType=0}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])
crv = Curve(curve)
divdist = DivideDistance(Curve=crv, Distance=Slider(0.25, range=0..1))  # -> flatten(Points), Tangents, Parameters
hull = ConvexHull(Points=divdist.Points, Plane=PlaneXY(0, 0, 0))  # -> Hull, HullZ, Indices
