# Grasshopper definition MB_volumes_v0.1.gh (Grasshopper 1.0.7)
# plug-ins: Volvox, MeshEdit Components, EleFront

# ----
# OPHOGING
txt = Text("OPHOGING")
crv = Curve([<curve referenced from the Rhino model> x379])
filterlay = FilterByLayer(Geometry=crv, Layer=txt)

# ----
# UITGRAVING
txt_2 = Text("UITGRAVING")
crv_2 = Curve([<curve referenced from the Rhino model> x379])
filterlay_2 = FilterByLayer(Geometry=crv_2, Layer=txt_2)

# ----
# WEG
txt_3 = Text("WEG")
crv_3 = Curve([<curve referenced from the Rhino model> x379])
filterlay_3 = FilterByLayer(Geometry=crv_3, Layer=txt_3)

cloud = Cloud(<cloud referenced from the Rhino model>)
# INPUT
join = JoinCurves(Curves=filterlay, Preserve=False)
join_2 = JoinCurves(Curves=filterlay_3, Preserve=False)
join_3 = JoinCurves(Curves=filterlay_2, Preserve=False)
pframes = PerpFrames(Curve=join, Count=10, Align=True)  # -> simplify(Frames), Parameters
lng = ListLength(List=filterlay)
subtraction = Subtraction(A=lng, B=1)
dom = ConstructDomain(DomainStart=0, DomainEnd=subtraction)
scx = SurfaceCurve(Surface=pframes.Frames, Curve=join)  # -> Curves, Points, UVPoints, Normals, Parameters, Tangents
midpt = CurveMiddle(Curve=filterlay)  # -> simplify(graft(Midpoint))
mcx = MeshCurve(Mesh=pframes.Frames, Curve=join)  # -> simplify(Points), simplify(Faces)
midpt_2 = CurveMiddle(Curve=filterlay)
range = Range(Domain=dom, Steps=subtraction)
dist = Distance(PointA=midpt, PointB=midpt_2)  # -> simplify(Distance)
crv_cp = CurveClosestPoint(Point=mcx.Points, Curve=simplify(graft(join)))  # -> Point, Parameter, Distance
panel = Panel(mcx.Points)
ins = InsertItems(List=simplify(graft(filterlay)), Item=range, Indices=filterlay, Wrap=True)  # -> simplify(List)
expression = Expression(x=dist, y=Slider(6, range=0..20), Expression="If(x<y,True,False)")
smaller = SmallerThan(FirstNumber=crv_cp.Distance, SecondNumber=Slider(0.01, range=0..0.01))  # -> simplify(SmallerThan), OrEqualTo
panel_2 = Panel(ins)
bool = Boolean(expression)
panel_3 = Panel(smaller.SmallerThan)
cull = CullPattern(List=dist, CullPattern=bool)
cull_2 = CullPattern(List=ins, CullPattern=bool)
branch = TreeBranch(Tree=cull_2, Path=Slider(0, range=0..100), MaintainPaths=True)

mesh = Mesh(<mesh referenced from the Rhino model>)
explode = Explode(Curve=filterlay, Recursive=True)  # -> Segments, flatten(Vertices)
length = Length(Curve=filterlay)
sort_list = SortList(Keys=length, ValuesValuesA=filterlay)  # -> Keys, reverse(ValuesValuesA)
list_item = ListItem(List=sort_list.ValuesValuesA, Index=0, Wrap=True)
move = Move(Geometry=list_item, Motion=Vector(0, 0, -20))  # -> Geometry, Transform
extrude = Extrude(Base=move.Geometry, Direction=Vector(0, 0, 40))
cap_holes = CapHoles(Brep=extrude)
mesh_split = MeshSplit(Mesh=mesh, Splitters=cap_holes)
list_item_2 = ListItem(List=mesh_split, Index=Slider(1, range=0..10), Wrap=True)

_3d_convexhull = _3DConvexHull(Points=explode.Vertices)

mesh_2 = Mesh(<mesh referenced from the Rhino model>)
explode_2 = Explode(Curve=join_3, Recursive=True)  # -> Segments, flatten(Vertices)
length_2 = Length(Curve=join_3)
sort_list_2 = SortList(Keys=length_2, ValuesValuesA=join_3)  # -> Keys, reverse(ValuesValuesA)
list_item_3 = ListItem(List=sort_list_2.ValuesValuesA, Index=0, Wrap=True)
move_2 = Move(Geometry=list_item_3, Motion=Vector(0, 0, -20))  # -> Geometry, Transform
extrude_2 = Extrude(Base=move_2.Geometry, Direction=Vector(0, 0, 40))
cap_holes_2 = CapHoles(Brep=extrude_2)
mesh_split_2 = MeshSplit(Mesh=mesh_2, Splitters=cap_holes_2)
list_item_4 = ListItem(List=mesh_split_2, Index=Slider(1, range=0..10), Wrap=True)

panel_4 = Panel(cull_2)

mesh_3 = Mesh(<mesh referenced from the Rhino model>)
explode_3 = Explode(Curve=join_2, Recursive=True)  # -> Segments, flatten(Vertices)
length_3 = Length(Curve=join_2)
sort_list_3 = SortList(Keys=length_3, ValuesValuesA=join_2)  # -> Keys, reverse(ValuesValuesA)
list_item_5 = ListItem(List=sort_list_3.ValuesValuesA, Index=0, Wrap=True)
move_3 = Move(Geometry=list_item_5, Motion=Vector(0, 0, -20))  # -> Geometry, Transform
extrude_3 = Extrude(Base=move_3.Geometry, Direction=Vector(0, 0, 40))
cap_holes_3 = CapHoles(Brep=extrude_3)
mesh_split_3 = MeshSplit(Mesh=mesh_3, Splitters=cap_holes_3)
list_item_6 = ListItem(List=mesh_split_3, Index=Slider(1, range=0..10), Wrap=True)
